# Grasshopper definition 230818_CAE_design_tool-backup.ghx (Grasshopper 1.0.7)
# plug-ins: MeshEdit Components

panel = Panel("Reload libraries")
bang = Button()
unload = PythonScript(reload=bang)
# ---------- unload: Python ----------
from compas_ghpython import unload_modules

if reload:
    unload_modules('climate_active_envelopes')
# ---------- end unload ----------

python = GhPythonScript()  # -> out, a; disabled
# ---------- python: Python ----------
__author__ = "Bootsy"
__version__ = "2023.04.27"

import rhinoscriptsyntax as rs

                """
                if j == 0: #first planes
                    z1.Rotate(m.radians(90), plane.ZAxis)
                    z1.Translate(z1.XAxis*-(width/2 + mortar))
                    z1.Translate(z1.YAxis*-(width/2 + mortar))
                    
                if j == len(planes)-1: #last planes
                    z1_copy = rg.Plane(z1)
                    z1_copy.Rotate(m.radians(90), z1_copy.ZAxis)
                    z1_copy.Translate(z1_copy.YAxis*-(width+width/2+mortar*2))
                    z1_copy.Translate(z1_copy.XAxis*-(width/2 + mortar))
                    row.append(z1_copy)
                """
# ---------- end python ----------

# ---- group: globals
elem_ins = Mesh(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)
design_globals = GhPythonScript(init=Button(), width="0.115", height="0.071", length="0.24", mortar="0.01", elem_ins=elem_ins)  # -> assembly; inputs elem_ins: Mesh
# ---------- design_globals: Python ----------
from compas.geometry import Frame, Polygon, Plane
from compas.datastructures import Mesh
from climate_active_envelopes.assembly import Assembly


from compas_ghpython.artists import Artist

assembly = Assembly()

assembly.set_attribute('width', width)
assembly.set_attribute('height', height)
assembly.set_attribute('length', length)
assembly.set_attribute('mortar', mortar)
assembly.set_attribute('elem_ins', elem_ins)
# ---------- end design_globals ----------

# ---- group: draw element
show = BooleanToggle(False)
show_2 = BooleanToggle(False)
elem_def = GhPythonScript(assembly=design_globals)  # -> assembly, elem_full, elem_ins
# ---------- elem_def: Python ----------
from compas.geometry import Frame
from compas_rhino.geometry import RhinoMesh
from compas.datastructures import Mesh
from compas.artists import Artist
from climate_active_envelopes.assembly import Assembly, Element
import Rhino.Geometry as rg


# dimensions full brick
length = assembly.get_attribute('length')
width = assembly.get_attribute('width')
height = assembly.get_attribute('height')
elem_ins = assembly.get_attribute('elem_ins')


elem_full = Element.from_dimensions(length, width, height)
elem_full.tool_frame = Frame([0, 0, height], [1, 0, 0], [0, -1, 0])


elem_ins = Element.from_rhinomesh_geometry(elem_ins, Frame([0, 0, height/2], [1, 0, 0], [0, -1, 0]))
elem_ins.tool_frame = Frame([0, 0, height], [1, 0, 0], [0, -1, 0])

print elem_ins
print elem_full
# ---------- end elem_def ----------
draw = PythonScript(elem_full=elem_def.elem_full, elem_ins=elem_def.elem_ins, show_full=show_2, show_ins=show)  # -> M, F, S
# ---------- draw: Python ----------
from compas.artists import Artist


#M = Artist(elem_ins.mesh).draw()
#print M

if show_full:
    M = Artist(elem_full.mesh).draw()
    F = Artist(elem_full.frame).draw()
    S = Artist(elem_full.tool_frame).draw()


if show_ins:
    M = Artist(elem_ins.mesh).draw()
    F = Artist(elem_ins.frame).draw()
    S = Artist(elem_ins.tool_frame).draw()
# ---------- end draw ----------
pln = Plane(draw.F)
pln_2 = Plane(draw.S)
mesh = Mesh(draw.M)

# ----
length = Slider(4.53, range=4..10)
width = Slider(3.93, range=2..7)
height = Slider(2.38, range=2..3)

number_slider = Slider(3, range=0..3)
reference_model = GhPythonScript(length=length, width=width, height=height, key=number_slider)  # -> ref_model, nodes, edges, current_node, current_nodes_neighbors, labels
# ---------- reference_model: Python ----------
from compas.datastructures import Mesh, Network
from compas_ghpython.artists import NetworkArtist
from compas_ghpython import draw_spheres
from climate_active_envelopes.assembly.reference_model import Reference_Model
from compas.colors import Color
from compas.artists import Artist, MeshArtist, artist

rm = Reference_Model()

ref_model =  rm.create_outer_wall_network(length, width, height)

# draw network nodes and network edges
nodes, edges = NetworkArtist(ref_model).draw()


# vizualize current node and its neighbors
current_node = {'pos': ref_model.node_coordinates(key), 'radius' : 0.03}
current_node = draw_spheres([current_node])
current_nodes_neighbors_keys = ref_model.neighbors(key)
current_nodes_neighbors = [{'pos': ref_model.node_coordinates(key), 'radius' : 0.02} for key in current_nodes_neighbors_keys]
current_nodes_neighbors = draw_spheres(current_nodes_neighbors)
labels = [key for key in ref_model.nodes()]


"""
corner_attributes = {}
for face in reference_unit.faces():
    vertices = reference_unit.face_vertices(face)

    sides_with_walls = []
    for i, vertex in enumerate(vertices):
        print vertex
        next_vertex = vertices[(i + 1) % len(vertices)]  # Get the next vertex in a cyclic manner
        if reference_unit.is_edge_on_boundary(vertex, next_vertex):
            sides_with_walls.append((vertex, next_vertex))

    for side_vertices in sides_with_walls:
        print side_vertices
        for vertex in side_vertices:
            corner_attributes[vertex] = {'adjoining_wall': True}
"""
# ---------- end reference_model ----------
pt = Point(reference_model.nodes)
line = Line(reference_model.edges)
brep = Brep(reference_model.current_node)
brep_2 = Brep(reference_model.current_nodes_neighbors)
swatch = ColourSwatch(SwatchColor=RGB(0, 0, 0))
tag = TextTag(Location=reference_model.nodes, Text=reference_model.labels, Colour=swatch)
preview = CustomPreview(Geometry=line, Material=swatch)
preview_2 = CustomPreview(Geometry=brep, Material=ColourSwatch(SwatchColor=RGB(255, 255, 255)))
preview_3 = CustomPreview(Geometry=brep_2, Material=ColourSwatch(SwatchColor=RGB(214, 62, 62)))

py = PythonScript()  # -> HERE, DATA
# ---------- py: Python ----------
import os

HERE = os.path.dirname(ghdoc.Path)
DATA = os.path.abspath(os.path.join(HERE, "..", "data"))

#print(HERE)
#print(DATA)
# ---------- end py ----------

# ---- group: wall_mesh
global_wall = GhPythonScript(assembly=elem_def.assembly, wall_length=Slider(2, range=0.4..10), wall_height=Slider(1, range=0.3..10))  # -> assembly, mesh_wall, mesh_grid
# ---------- global_wall: Python ----------
from compas.datastructures import Mesh
from compas.geometry import Curve, Point, Frame
from compas.artists import MeshArtist, Artist
import math as m
import Rhino.Geometry as rg
from compas.utilities import normalize_values

length = assembly.get_attribute('length')
height = assembly.get_attribute('height')
width = assembly.get_attribute('width')
mortar = assembly.get_attribute('mortar')


mesh_wall = Mesh()

mesh_grid = []


step_in_z = height + mortar/2
step_in_x = (length+width)/2 + mortar
vertices_per_row = int(wall_length / step_in_x)


row = int(wall_height / step_in_z)
#interval = period/vertices_per_row

total_length = (vertices_per_row - 1) * (step_in_x)


#create vertices
for j in range(row): 
    z = j * step_in_z
    for i in range(vertices_per_row): 
        y = 0
        x = i * step_in_x
        mesh_wall.add_vertex(x = x, y = y, z = z) 

#create faces
for j in range(row -1):
    planes_per_row = []
    for i in range(vertices_per_row - 1):
        a = i + j * vertices_per_row
        b = a + vertices_per_row
        c = b + 1
        d = a + 1

#create planes at faces_centroid
        vertex_centroid = mesh_wall.face_centroid(mesh_wall.add_face([a, b, c, d]))
        vertex_pts = Point(vertex_centroid[0], vertex_centroid[1], vertex_centroid[2])
        vertex_frame = Frame([vertex_pts[0], vertex_pts[1], vertex_pts[2]], [1,0,0], [0,1,0])
        vertex_plane = Artist(vertex_frame).draw()
        planes_per_row.append(vertex_plane)
    mesh_grid.append(planes_per_row)

face_cplanes = [plane for planes_row in mesh_grid for plane in planes_row]



























"""
if add_left:
    # create vertices
    for j in range(row): 
        z = j * step_in_z
        for i in range(vertices_per_row_2): 
            y = i * step_in_x
            x = 0
            mesh_wall_left.add_vertex(x = x, y = y, z = z) 
            #V2 = MeshArtist(mesh_wall_left).draw_vertices()
            
    #create faces
    for j in range(row - 1):
        planes_per_row_2 = []
        for i in range(vertices_per_row_2 - 1):
            e = i + j * vertices_per_row_2
            f = e + vertices_per_row_2
            g = f + 1
            h = e + 1
            #mesh_wall_left.add_face([e, f, g, h])
            #M2 = MeshArtist(mesh_wall_left).draw()

    #create planes at faces_centroid
            vertex_centroid_2 = mesh_wall_left.face_centroid(mesh_wall_left.add_face([e, f, g, h]))
            vertex_cpts_2 = Point(vertex_centroid_2[0], vertex_centroid_2[1], vertex_centroid_2[2])
            vertex_cframe_2 = Frame([vertex_cpts_2[0], vertex_cpts_2[1], vertex_cpts_2[2]], [1,0,0], [0,1,0])
            vertex_cplane_2 = Artist(vertex_cframe_2).draw()
            planes_per_row_2.append(vertex_cplane_2)
        mesh_grid_left.append(planes_per_row_2)

    face_cplanes_2 = [plane_2 for planes_row_2 in mesh_grid_left for plane_2 in planes_row_2]




if add_right:
    # create vertices
    for j in range(row): 
        z = j * step_in_z
        for i in range(vertices_per_row_2): 
            y = i * step_in_x
            x = (total_length)
            mesh_wall_right.add_vertex(x = x, y = y, z = z) 


    #create faces
    for j in range(row - 1):
        planes_per_row_2 = []
        for i in range(vertices_per_row_2 - 1):
            k = i + j * vertices_per_row_2
            l = k + vertices_per_row_2
            m = l + 1
            n = k + 1

    #create planes at faces_centroid
            vertex_centroid_3 = mesh_wall_right.face_centroid(mesh_wall_right.add_face([k, l, m, n]))
            vertex_cpts_3 = Point(vertex_centroid_3[0], vertex_centroid_3[1], vertex_centroid_3[2])
            vertex_cframe_3 = Frame([vertex_cpts_3[0], vertex_cpts_3[1], vertex_cpts_3[2]], [1,0,0], [0,1,0])
            vertex_cplane_3 = Artist(vertex_cframe_3).draw()
            planes_per_row_2.append(vertex_cplane_3)
        mesh_grid_right.append(planes_per_row_2)

    face_cplanes_2 = [plane_3 for planes_row_3 in mesh_grid_right for plane_3 in planes_row_3]
    
    
#mesh_wall_all = []
#mesh_wall_all += mesh_wall, mesh_wall_left, mesh_wall_right


## Create wall curves left and right
#total_length = step_in_x*(vertices_per_row-1)
#total_height = step_in_z*(row-1)

#wall_crv_left = rg.Line(rg.Point3d(0,0,0), rg.Point3d(0,0,total_height))
#wall_crv_bottom_left = rg.Line(rg.Point3d(0,0,0), rg.Point3d(0, m.pi*0.5, 0))

#wall_crv_right = rg.Line(rg.Point3d(total_length,0,0), rg.Point3d(total_length, 0, total_height))
#wall_crv_bottom_right = rg.Line(rg.Point3d(total_length,0,0), rg.Point3d(total_length, m.pi*0.5, 0))



#        if add_front:
#            x = i * step_in_x
#            y = amplitude * m.sin(interval * i + phase)
#            mesh_wall.add_vertex(x=x, y=y, z=z)
#
#        if add_left:
#            x = 0
#            y = i * step_in_x
#            mesh_wall.add_vertex(x=x, y=y, z=z)
#
#        if add_right:
#            y = i * step_in_x
#            x = total_length
#            mesh_wall.add_vertex(x=x, y=y, z=z)
"""
# ---------- end global_wall ----------

show_3 = BooleanToggle(True)
show_4 = BooleanToggle(False)
show_5 = BooleanToggle(False)
draw_2 = PythonScript(mesh_wall=global_wall.mesh_wall, show_faces=show_3, show_vertices=show_4, show_labels=show_5)  # -> M, V, L
# ---------- draw_2: Python ----------
from compas.artists import Artist, MeshArtist, artist
import Rhino.Geometry as rg

meshes = []
vertices = []
labels = []

if show_faces:
    M = MeshArtist(mesh_wall).draw()
    #M_left = MeshArtist(mesh_wall_left).draw()
    #M_right = MeshArtist(mesh_wall_right).draw()

if show_vertices:
    V = MeshArtist(mesh_wall).draw_vertices()
    #V_left = MeshArtist(mesh_wall_left).draw_vertices()
    #V_right = MeshArtist(mesh_wall_right).draw_vertices()

if show_labels:
    L = [key for key in mesh_wall.vertices()]
    #L_left = [key for key in mesh_wall_left.vertices()]
    #L_right = [key for key in mesh_wall_right.vertices()]


    meshes = M
# ---------- end draw_2 ----------
mesh_2 = Mesh(draw_2.M)
pt_2 = Point(draw_2.V)
tag_2 = TextTag(Location=draw_2.V, Text=draw_2.L, Colour=ColourSwatch(SwatchColor=RGB(0, 0, 0)))

# ----
network_code_backup = GhPythonScript()  # -> out, a
# ---------- network_code_backup: Python ----------
    def create_outer_wall_network(self, length, width, height):
        """Create network from mesh
        """
        mesh_wall = Mesh()
        # Add front side vertices
        for j in range(2):
            x = j * width
            for i in range(2):
                z = i * height
                mesh_wall.add_vertex(x=x, y=0, z=z)
        
        # Add front side face
        for j in range(1):
            for i in range(1):
                a = i + j * 2
                b = a + 1
                c = b + 2
                d = a + 2
                mesh_wall.add_face([a, b, c, d])
        
        # add left side vertices
        for j in range(2):
            z = j * height
            for i in range(2):
                y = i * length
                x = 0
                mesh_wall.add_vertex(x=x, y=y, z=z)
        
        # add left side face
        for j in range(1):
            for i in range(1):
                a = 4 + i + j * 2
                b = a + 1
                c = b + 2
                d = a + 2
                mesh_wall.add_face([a, b, c, d])
        
        # add right side vertices
        for j in range(2):
            z = j * height
            for i in range(2):
                y = i * length
                x = width
                mesh_wall.add_vertex(x=x, y=y, z=z)
        
        # add right side face
        for j in range(1):
            for i in range(1):
                a = 8 + i + j * 2
                b = a + 1
                c = b + 2
                d = a + 2
                mesh_wall.add_face([a, b, c, d])
        
        # Add back side vertices
        for j in range(2):
            x = j * width
            for i in range(2):
                y = length
                z = i * height
                mesh_wall.add_vertex(x=x, y=y, z=z)
        
        # Add back side face
        for j in range(1):
            for i in range(1):
                a = 12 + i + j * 2
                b = a + 1
                c = b + 2
                d = a + 2
                mesh_wall.add_face([a, b, c, d])

        network = self.network
        centroids = []
        
        # add face centroids as node to the network
        for face in mesh_wall.faces():
            center = mesh_wall.face_centroid(face)
            centroids.append(center)
        
        for i, center_pts in enumerate(centroids):
            network.add_node(i, x=center_pts[0], y=center_pts[1], z=center_pts[2])
        
        # add face edges of adjoining faces to the network
        connections = [(0, [1, 2]), (1, [0, 3]), (2, [0, 3]), (3, [1, 2])]
        
        for node, neighbors in connections:
            for neighbor in neighbors:
                # check both directions of the nodes if edge already exists
                if network.has_edge(node, neighbor) != True:
                    if network.has_edge(neighbor, node) != True:
                        network.add_edge(node, neighbor)

        return network
# ---------- end network_code_backup ----------
python_2 = GhPythonScript(ref_model=reference_model.ref_model, key=number_slider)  # -> out, draw
# ---------- python_2: Python ----------
from compas.geometry import Brep, Box, Frame, Point
from compas.artists import Artist, MeshArtist
from compas.colors import Color

breps = []

node_breps = {}



for node in ref_model.nodes():
    node_xyz = ref_model.node_coordinates(node)

    frame = Frame(Point(node_xyz[0], node_xyz[1], node_xyz[2]), [1,0,0], [0,1,0])

    box = Box(frame, 0.1,0.1,0.1)


    node_breps[node] = box

    breps.append(box)




for elem in breps[i]:
    print i, elem
    draw = Artist(elem).draw(Color.from_rgb255(41,49,51))
# ---------- end python_2 ----------
toggle = BooleanToggle(True)  # disabled

key = Slider(388, range=0..388)
till_key = Button()
start = Button()
reset = Button()
stop = Button()
back = Button()
step = Button()
full = Button()
list = ValueList({"20", "50", "100", "500", "1000", "5000"}, selected="1000")

# ---- group: transformation values
number_slider_2 = Slider(1, range=0.01..1)
context = Brep(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)
flip = MeshFlip(Mesh=mesh_2)
direct_sun_hours = DirectSunHours(geometry=flip, context=context, grid_size=number_slider_2, run=Toggle(True))  # -> points, results, mesh, sky_mtx
mesh_3 = Mesh(direct_sun_hours.mesh)

# ----
plane_grid = GhPythonScript(assembly=global_wall.assembly, mesh_grid=global_wall.mesh_grid)  # -> assembly, plane_grid, planes; inputs mesh_grid: list
# ---------- plane_grid: Python ----------
from compas.geometry import Curve, Point, Frame
from compas.artists import Artist, artist
import math as m
import Rhino.Geometry as rg

length = assembly.get_attribute('length')
height = assembly.get_attribute('height')
width = assembly.get_attribute('width')
mortar = assembly.get_attribute('mortar')


plane_grid = []

def create_plane_grid(mesh_grid):

    for i, row_planes in enumerate(mesh_grid):
        row = []
        for j, plane in enumerate(row_planes):
            z1 = plane
            z1.Translate(z1.ZAxis*-height/2)


            #odd layers
            if i%2 == 0: 
                if j%2 == 0: 
                    z1.Translate(z1.YAxis*+(length/4 + mortar/4))
                    z1.Rotate(m.radians(90), z1.ZAxis)
                    z4 = rg.Plane(z1)
                    z4.Translate(z4.XAxis*+(length + mortar))
                    row.append(z4)

                if j%2 == 1:
                    z2 = rg.Plane(z1)
                    z2.Rotate(m.radians(90), z2.ZAxis)
                    z2.Translate(z2.YAxis*+(width/2 + mortar/2))
                    z2.Translate(z2.XAxis*+((length/2+width/2) + mortar))
                    row.append(z2)
                    z3 = rg.Plane(z2)
                    z2.Translate(z2.YAxis*-(width + mortar))
                    row.append(z3)
                    z5 = rg.Plane(z1)
                    z5.Translate(z5.YAxis*+((length+ width) + mortar*2))
                    row.append(z5)


            #even layers
            if i%2 == 1:
                if j%2 == 1:
                    z1.Translate(z1.YAxis*+(length/4 + mortar/4))
                    z1.Rotate(m.radians(90), z1.ZAxis)
                    z4 = rg.Plane(z1)
                    z4.Translate(z4.XAxis*+(length + mortar))
                    row.append(z4)

                if j%2 == 0:
                    z2 = rg.Plane(z1)
                    z2.Rotate(m.radians(90), z2.ZAxis)
                    z2.Translate(z2.YAxis*+(width/2 + mortar/2))
                    z2.Translate(z2.XAxis*+((length/2+width/2) + mortar))
                    row.append(z2)
                    z3 = rg.Plane(z2)
                    z2.Translate(z2.YAxis*-(width + mortar))
                    row.append(z3)
                    z5 = rg.Plane(z1)
                    z5.Translate(z5.YAxis*+((length+ width) + mortar*2))
                    row.append(z5)

            row.append(z1)
        plane_grid.append(row)
    return plane_grid

plane_grid = create_plane_grid(mesh_grid)


def list_from_2darray(array):
    return [item for sublist in array for item in sublist]

planes = list_from_2darray(plane_grid)
# ---------- end plane_grid ----------
dist = GhPythonScript(
    mesh_grid=global_wall.mesh_grid,
    plane_grid=plane_grid.plane_grid,
    mesh_wall=global_wall.mesh_wall,
    transf_values=direct_sun_hours.results)  # -> out, t_pts, params_grid; inputs mesh_grid: list, plane_grid: list, transf_values: list
# ---------- dist: Python ----------
import Rhino.Geometry as rg
from compas.utilities import normalize_values
from compas.geometry import Curve, Point, Frame, Vector
from compas.artists import Artist

import Rhino.Geometry as rg
from compas.utilities import normalize_values
from compas.geometry import Curve, Point, Frame


# create list of face_centroids
c_pts = []
for j, face in enumerate(mesh_wall.faces()):
    vertex_centroid = mesh_wall.face_centroid(face)
    points = rg.Point3d(vertex_centroid[0],vertex_centroid[1], vertex_centroid[2])
    c_pts.append(points)

#normalize values from the simulation
transf_values = normalize_values(transf_values, -1.0, 0.0)
params_grid = []

# create new planes / points from transf_values
t_pts = []
t_pls = []
for i, points in enumerate(c_pts):
    x = points[0]
    z = points[2]
    y = transf_values[i]
    t_pt = rg.Point3d(x,y,z)
    t_pts.append(t_pt)
    # create planes from points
    t_pl = rg.Plane(rg.Point3d(x,y,z), rg.Vector3d(1, 0, 0), rg.Vector3d(0, 1, 0))
    t_pls.append(t_pl)

"""
def calculate_distance_to(transf_values, mesh_wall):
    #normalize values from the simulation
    transf_values = normalize_values(transf_values, 0.00, -0.3)

    # create list of face_centroids of the initial mesh
    c_pts = []
    for j, face in enumerate(mesh_wall.faces()):
        vertex_centroid = mesh_wall.face_centroid(face)
        points = rg.Point3d(vertex_centroid[0],vertex_centroid[1], vertex_centroid[2])
        c_pts.append(points)

    #create new planes / points from transf_values
    t_pts = []
    t_pls = []
    for i, points in enumerate(c_pts):
        x = points[0]
        z = points[2]
        y = transf_values[i]
        #create transformation points
        t_pt = rg.Point3d(x,y,z)
        t_pts.append(t_pt)
    
        # create planes from points
        t_pl = rg.Plane(rg.Point3d(x,y,z), rg.Vector3d(1, 0, 0), rg.Vector3d(0, 1, 0))
        t_pls.append(t_pl)

    #t_points = []
    distances = []
    for c_pt, t_pt in zip(c_pts, t_pts):
        c_point = rg.Point3d(c_pt)
        t_point = rg.Point3d(t_pt)
        #t_points.append(t_point)
        distance = rg.Point3d.DistanceTo(c_point, t_point)
        distances.append(distance)
    return distances
    #return t_points

dist_params = calculate_distance_to(transf_values, mesh_wall)


params_per_row = []
for i, row_planes in enumerate(mesh_grid):
    for j, plane in enumerate(row_planes):
        params_per_row.append(dist_params[j])


params_grid = []
for i, row_planes in enumerate(plane_grid):
    params_row = []
    for j, planes in enumerate(row_planes):
        if i%2 == 0 and j%3 == 1 and j%2 == 1:
            new_params_odd = params_per_row[j]
            params_row.append(new_params_odd)

        if i%2 == 1  and j%3 != 0 and j%3 != 1 and j%2 == 1:
            new_params_even = params_per_row[j]
            params_row.append(new_params_even)
    params_grid.append(params_row)


values = []
for i, row in enumerate(params_grid):
    for j, trans_val in enumerate(row):
        if i%2 == 0:
            print "row_odd =", i, "transf_per_row =", j, "trans_val =", trans_val
        if i%2 ==1:
            print "row_even =", i, "transf_per_row =", j, "trans_val =", trans_val
        trans_val = params_grid[i][j]

        values.append(trans_val)
print values
"""
# ---------- end dist ----------

panel_2 = Panel(dist.out)
transformation = GhPythonScript(plane_grid=plane_grid.plane_grid, mesh_wall=global_wall.mesh_wall, transf_values=direct_sun_hours.results)  # -> t_pts, params_grid; inputs plane_grid: list, transf_values: list
# ---------- transformation: Python ----------
import Rhino.Geometry as rg
from compas.utilities import normalize_values
from compas.geometry import Curve, Point, Frame


# create list of face_centroids
c_pts = []
for j, face in enumerate(mesh_wall.faces()):
    vertex_centroid = mesh_wall.face_centroid(face)
    points = rg.Point3d(vertex_centroid[0],vertex_centroid[1], vertex_centroid[2])
    c_pts.append(points)

#normalize values from the simulation
transf_values = normalize_values(transf_values, 0, -0.1)
params_grid = []

# create new planes / points from transf_values
t_pts = []
t_pls = []
for i, points in enumerate(c_pts):
    x = points[0]
    z = points[2]
    y = transf_values[i]
    t_pt = rg.Point3d(x,y,z)
    t_pts.append(t_pt)
    # create planes from points
    t_pl = rg.Plane(rg.Point3d(x,y,z), rg.Vector3d(1, 0, 0), rg.Vector3d(0, 1, 0))
    t_pls.append(t_pl)

"""
    planes = plane_grid[i]


    for j, plane in enumerate(planes):
        params = {
            'plane': plane,
            't_pt': t_pts[i],
            't_pl': t_pls[i],
            'dist': t_pts[i] - c_pts[i]
        }
        params_grid.append(params)

params_list = []
for i,row in enumerate(params_grid):
    print i
    for j, params_list in enumerate(row):
        pass

"""



    #print i, row
    #for j, params_list in enumerate(row):
        #print params_list

#def translate_points(c_pts, t_vecs):
#    translated_points = []
#    for c_pt, t_vec in zip(c_pts, t_vecs):
#        translated_point = rg.Point3d.Add(c_pt, t_vec)
#        translated_points.append(translated_point)
#    return translated_points
#
#points = translate_points(c_pts, t_vecs)

#points = translate_points(c_pts, t_vecs)
# ---------- end transformation ----------
pt_3 = Point(transformation.t_pts)
draw_3 = GhPythonScript(planes=plane_grid.planes, scale=Slider(0.03, range=0..1))  # -> P, V, C, W; inputs planes: list
# ---------- draw_3: Python ----------
from System.Drawing import Color
from compas_ghpython.artists import FrameArtist

red = Color.FromArgb(255, 0, 0)
green = Color.FromArgb(0, 255, 0)
blue = Color.FromArgb(0, 0, 255)

P = []
V = []
C = []

scale = float(scale)

for plane in planes:
    if not plane:
        continue
    P += [plane.Origin] * 3
    V.append(plane.XAxis * scale)
    V.append(plane.YAxis * scale)
    V.append(plane.ZAxis * scale)
    C += [red, green, blue]

W = 3
# ---------- end draw_3 ----------

# ---- group: assembly structure
transf = BooleanToggle(True)
assembly = GhPythonScript(
    assembly=plane_grid.assembly,
    generate=Button(),
    t_pts=dist.t_pts,
    transform=transf,
    plane_grid=plane_grid.plane_grid,
    params_grid=dist.params_grid,
    elem_full=elem_def.elem_full,
    elem_ins=elem_def.elem_ins)  # -> out, assembly; inputs t_pts: list of Point3d, plane_grid: list, params_grid: list, values: list
# ---------- assembly: Python ----------
import Rhino.Geometry as rg
import math as m
from compas.geometry import Frame, Point, Rotation, Transformation, Translation
from compas.utilities import normalize_values
from climate_active_envelopes.assembly import Assembly

#from climate_active_envelopes.assembly import BRICK_Assembly as Assembly

length = assembly.get_attribute('length')
height = assembly.get_attribute('height')
width = assembly.get_attribute('width')
mortar = assembly.get_attribute('mortar')

if generate:
    for i, row in enumerate(plane_grid): # number of layers and all planes
        for j, plane in enumerate(row): #j = planes / layer
            frame = Frame(plane.Origin, plane.XAxis, plane.YAxis)
            frame_pt = frame.point

            if transform == True:
                for t_pt in t_pts:
                    dist =  t_pt.DistanceTo(rg.Point3d(frame.point[0], frame.point[1], frame.point[2]))

                if i%2 == 0 and j%3 == 1 and j%2 == 1:
                    plane.Translate(plane.XAxis*-m.radians(dist*2))

                if i%2 == 1  and j%3 != 0 and j%3 != 1 and j%2 == 1:
                    plane.Translate(plane.XAxis*-m.radians(dist*2))
                T = Transformation.from_frame_to_frame(Frame.worldXY(), Frame(plane.Origin, plane.XAxis, plane.YAxis))
            else: 
                T = Transformation.from_frame_to_frame(Frame.worldXY(), frame)


            if i%2 == 1 and j%2 == 1 and j%3 != 1:
                c = elem_full.transformed(T)
                assembly.add_element(c)
            elif i%2 == 0 and j%2 == 1 and j%3 != 0:
                c = elem_full.transformed(T)
                assembly.add_element(c)
            else:
                c = elem_ins.transformed(T)
                assembly.add_element(c)



"""
if generate:
    for i, row in enumerate(plane_grid): # number of layers and all planes
        for j, plane in enumerate(row): # j = planes / layer
            frame = Frame(plane.Origin, plane.XAxis, plane.YAxis)
            frame_pt = frame.point

            if transform == True:
                if i % 2 == 0 and j % 3 == 1 and j % 2 == 1:
                    trans_val = params_grid[i]  # Access the trans_val from params_grid
                    print trans_val
                    plane.Translate(plane.XAxis * - trans_val)

                if i % 2 == 1 and j % 3 != 0 and j % 3 != 1 and j % 2 == 1:
                    trans_val = params_grid[i]  # Access the trans_val from params_grid
                    plane.Translate(plane.XAxis * - trans_val)

                T = Transformation.from_frame_to_frame(Frame.worldXY(), Frame(plane.Origin, plane.XAxis, plane.YAxis))
            else: 
                T = Transformation.from_frame_to_frame(Frame.worldXY(), frame)

            if i % 2 == 1 and j % 2 == 1 and j % 3 != 1:
                c = elem_full.transformed(T)
                assembly.add_element(c)
            if i % 2 == 0 and j % 2 == 1 and j % 3 != 0:
                c = elem_full.transformed(T)
                assembly.add_element(c)
            else:
                c = elem_ins.transformed(T)
                assembly.add_element(c)
"""
#if generate:
#    for i, row in enumerate(plane_grid): # number of layers and all planes
#        for j, plane in enumerate(row): # j = planes / layer
#            frame = Frame(plane.Origin, plane.XAxis, plane.YAxis)
#            frame_pt = frame.point
#
#            if transform == True:
#                for value in values:
#                    dist = value
#                    print dist
#                if i % 2 == 0 and j % 3 == 1 and j % 2 == 1:
#                    #trans_val = params_grid[i][j]  # Access the trans_val from params_grid
#                    plane.Translate(plane.XAxis *- m.radians(dist*10))
#
#                if i % 2 == 1 and j % 3 != 0 and j % 3 != 1 and j % 2 == 1:
#                    #trans_val = params_grid[i][j]  # Access the trans_val from params_grid
#                    plane.Translate(plane.XAxis *- m.radians(dist*10))
#
#                T = Transformation.from_frame_to_frame(Frame.worldXY(), Frame(plane.Origin, plane.XAxis, plane.YAxis))
#            else: 
#                T = Transformation.from_frame_to_frame(Frame.worldXY(), frame)
#
#            if i % 2 == 1 and j % 2 == 1 and j % 3 != 1:
#                c = elem_full.transformed(T)
#                assembly.add_element(c)
#            elif i % 2 == 0 and j % 2 == 1 and j % 3 != 0:
#                c = elem_full.transformed(T)
#                assembly.add_element(c)
#            else:
#                c = elem_ins.transformed(T)
#                assembly.add_element(c)



#if generate:
#    for i, row in enumerate(plane_grid): # number of layers and all planes
#        for j, plane in enumerate(row): #j = planes / layer
#            frame = Frame(plane.Origin, plane.XAxis, plane.YAxis)
#            frame_pt = frame.point
#
#            if transform == True:
#                for t_pt in t_pts:
#                    dist =  t_pt.DistanceTo(rg.Point3d(frame.point[0], frame.point[1], frame.point[2]))
#
#                if i%2 == 0 and j%3 == 1 and j%2 == 1:
#                    plane.Translate(plane.XAxis*-m.radians(dist*2))
#
#                if i%2 == 1  and j%3 != 0 and j%3 != 1 and j%2 == 1:
#                    plane.Translate(plane.XAxis*-m.radians(dist*2))
#                T = Transformation.from_frame_to_frame(Frame.worldXY(), Frame(plane.Origin, plane.XAxis, plane.YAxis))
#            else: 
#                T = Transformation.from_frame_to_frame(Frame.worldXY(), frame)
#
#
#            if i%2 == 1 and j%2 == 1 and j%3 != 1:
#                c = elem_full.transformed(T)
#                assembly.add_element(c)
#            elif i%2 == 0 and j%2 == 1 and j%3 != 0:
#                c = elem_full.transformed(T)
#                assembly.add_element(c)
#            else:
#                c = elem_ins.transformed(T)
#                assembly.add_element(c)


#for i, row in enumerate(plane_grid):
#    params_row = []
#    for j, plane in enumerate(row):
#        frame = Frame(plane.Origin, plane.XAxis, plane.YAxis)
#        frame_pt = frame.point
#
#        if i%2 == 0 and j%3 == 1 and j%2 == 1:
#            trans_val_odd = params_per_row[j]
#            plane.Translate(plane.XAxis * - trans_val_odd)
#
#        if i%2 == 1  and j%3 != 0 and j%3 != 1 and j%2 == 1:
#            trans_val_even = params_per_row[j]
#            plane.Translate(plane.XAxis * - trans_val_even)
#
#        T = Transformation.from_frame_to_frame(Frame.worldXY(), Frame(plane.Origin, plane.XAxis, plane.YAxis))
#    else: 
#        T = Transformation.from_frame_to_frame(Frame.worldXY(), frame)
#
#    
#        c = elem_full.transformed(T)
#        assembly.add_element(c)
    
#    if i%2 == 1 and j%2 == 1 and j%3 != 1:
#        c = elem_full.transformed(T)
#        assembly.add_element(c)
#    elif i%2 == 0 and j%2 == 1 and j%3 != 0:
#        c = elem_full.transformed(T)
#        assembly.add_element(c)
#    else:
#        c = elem_ins.transformed(T)
#        assembly.add_element(c)
# ---------- end assembly ----------

# ---- group: to JSON
export = PythonScript(DATA=py.DATA, assembly=assembly.assembly, export_to_json=Button())
# ---------- export: Python ----------
import os
#from compas.datastructures.mesh import mesh_quads_to_triangles
#from compas.datastructures.mesh import mesh_unify_cycles



if export_to_json:

    filename = "brickwall.json"
    PATH = os.path.join(DATA, filename)



    # the assembly has to be serialized such that it can be called from CPython
    assembly.to_json(PATH)

"""
if export_to_json_unity:
    
    for key, e in assembly.elements():
    
        #convert to trimesh
        mesh_quads_to_triangles(e._mesh, check_angles=False)
        #mesh_unify_cycles(e._mesh)
        #print e._mesh.faces
        #print e._mesh.face_vertices(list(e._mesh.faces())[0])

    filename = "brickwall_unity.json"
    PATH = os.path.join(DATA, filename)
    assembly.to_json(PATH)
"""
# ---------- end export ----------

# ----
vdisex = VectorDisplayEx(Point=draw_3.P, Vector=draw_3.V, Colour=draw_3.C, Width=draw_3.W)
rec = DataRecorder(assembly.out, DataLimit=-10, RecordData=True)
panel_3 = Panel(rec)

# ---- group: Network Artist
show_6 = BooleanToggle(True)
draw_4 = GhPythonScript(assembly=assembly.assembly, show_network=show_6, key=Slider(26, range=0..47))  # -> nodes, edges, current_node, current_node_neighbors; inputs key: Int32
# ---------- draw_4: Python ----------
import sys, os
import ghpythonlib.components as ghcomp
from compas.datastructures import Network
from compas_ghpython.artists import NetworkArtist
from compas_rhino.geometry import RhinoLine

import compas_ghpython
import Rhino.Geometry as rg


data = assembly.network.to_data()
network = Network.from_data(data)

print assembly.network.number_of_nodes()

def draw_network(network):
    """Draw a network in Grasshopper.
    """
    points = []
    for key, attr in network.nodes(True):
        points.append({
            'pos': network.node_coordinates(key),
        })

    lines = []
    for (u, v), attr in network.edges(True):
        lines.append({
            'start': network.node_coordinates(u),
            'end': network.node_coordinates(v),
        })

    points_rg = compas_ghpython.draw_points(points)
    lines_rg = compas_ghpython.draw_lines(lines)

    return points_rg, lines_rg

if show_network:
    nodes, edges = draw_network(network)
    
    current_node = {'pos': network.node_coordinates(key), 'radius': 0.03}
    current_node = compas_ghpython.draw_spheres([current_node])
    
    current_node_neighbors_keys = network.neighbors(key)
    current_node_neighbors = [{'pos': network.node_coordinates(key), 'radius': 0.02} for key in current_node_neighbors_keys]
    current_node_neighbors = compas_ghpython.draw_spheres(current_node_neighbors)
# ---------- end draw_4 ----------
pt_4 = Point(draw_4.nodes)
line_2 = Line(draw_4.edges)
brep_3 = Brep(draw_4.current_node)
brep_4 = Brep(draw_4.current_node_neighbors)

# ----
counter = CountThroughList(
    assembly=assembly.assembly,
    start=start,
    stop=stop,
    step=step,
    step_back=back,
    reset=reset,
    full=full,
    till_key=till_key,
    key=key,
    interval=list)  # -> item, counter; inputs start: Boolean, stop: Boolean, step_back: Boolean, key: Int32
# ---------- counter: Python ----------
from scriptcontext import sticky as st
from compas_ghpython import update_component


L = list(assembly.elements())
# store data in component
guid = str(ghenv.Component.InstanceGuid)
counter_key = "counter_" + guid
running_key = "running_" + guid

if counter_key not in st:
    st[counter_key] = 0

if running_key not in st:
    st[running_key] = False
    

if st[running_key]:
    if st[counter_key] < len(L) - 1:
        st[counter_key] += 1
        update_component(ghenv, interval)
    else:
        st[counter_key] = 0
        st[running_key] = False
    
    
if start:
    st[running_key] = True

if stop:
    st[running_key] = False

if step:
    if st[counter_key] < len(L) - 1:
        st[counter_key] += 1

if step_back:
    if  0 < st[counter_key] < len(L):
        st[counter_key] -= 1

if reset:
    st[counter_key] = 0

if till_key:
    st[counter_key] = key

if full:
    st[counter_key] = len(L)-1

if len(L):
    item = L[st[counter_key]]



#st["visualisation_counter"] = st[counter_key]
#st[counter_key]= 500
counter = st[counter_key]
# ---------- end counter ----------
idx = Panel(counter.counter)

# ---- group: Assembly Artist
show_7 = BooleanToggle(True)
show_8 = BooleanToggle(False)
show_9 = BooleanToggle(False)
draw_5 = PythonScript(assembly=assembly.assembly, show_all=show_7, show_current=show_8, show_counter=show_9, counter=counter.counter)  # -> G, G_element, tool_planes_WCS, current_tool_plane; inputs counter: Int32
# ---------- draw_5: Python ----------
import os
import sys

import math

from compas.colors import Color
from compas.artists import Artist
from compas_ghpython.artists import NetworkArtist


G = []
G_element = []
#color = Color.from_rgb255(220,165,165)

key_index = assembly.network.key_index()
keys = [key_index[key] for key in assembly.network.nodes()]
elements = [assembly.element(key) for key in keys]
#print elements
#print([(e.gripping_frame) for e in elements])

tool_planes_WCS = [Artist(e.tool_frame).draw() for e in elements]

current_tool_plane = tool_planes_WCS[counter]

if show_all and not show_counter:
    for element in elements:
        mesh = Artist(element.mesh).draw(Color.from_rgb255(220,165,165))
        G.append(mesh)

if show_counter:
    for element in elements[0:counter+1]:
        mesh = Artist(element.mesh).draw(Color.from_rgb255(220,165,165))
        G.append(mesh)

if show_current:
    element = assembly.element(counter)
    mesh = Artist(element.mesh).draw(Color.from_rgb255(41,49,51))
    G_element.append(mesh)


#    course = assembly.network.node_attribute(key=counter, name='course')
#    keys_in_course = list(assembly.network.nodes_where({'course': course}))
#    elements = [assembly.element(key) for key in keys_in_course]
#    for element in elements:
#        mesh = Artist(element.mesh).draw(color)
#        G.append(mesh)
# ---------- end draw_5 ----------
geo = Geometry(draw_5.G_element)
pln_3 = Plane(draw_5.tool_planes_WCS)
geo_2 = Geometry(draw_5.G)
pln_4 = Plane(draw_5.current_tool_plane)

# ---- group: transformation values (continued)
incidentradiation = LBIncidentRadiation(
    sky_mtx=direct_sun_hours.sky_mtx,
    geometry=flatten(geo_2),
    context=flatten(context),
    grid_size=number_slider_2,
    run=Toggle(False))  # -> out, points, results, total, mesh, legend, title, int_mtx; plug-in component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

# ----
mesh_4 = Mesh(incidentradiation.mesh)

# ==== cluster DirectSunHours
file_path = FilePath("C:\Users\Bootsy\Downloads\Braunschweig-hour.epw")
importepw = LBImportEPW(epw_file=file_path)  # -> location, dry_bulb_temperature, dew_point_temperature, relative_humidity, wind_speed, wind_direction, direct_normal_rad, diffuse_horizontal_rad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; plug-in component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
analysisperiod = LBAnalysisPeriod(
    start_month=Slider(3, range=0..10),
    start_day=Slider(1, range=0..10),
    start_hour=Slider(11, range=0..100),
    end_month=Slider(8, range=0..10),
    end_day=Slider(31, range=0..100),
    end_hour=Slider(16, range=0..100))  # -> period, hoys, dates; plug-in component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
sunpath = LBSunPath(north="0", location=importepw.location, hoys=analysisperiod.hoys, scale=0.05)  # -> out, vectors, altitudes, azimuths, hoys, sun_pts, analemma, daily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; plug-in component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
colrange = LBColorRange(index=22)  # -> colors; plug-in component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
legendpar = LBLegendParameters(colors=colrange)  # -> leg_par; plug-in component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
skymatrix = LBCumulativeSkyMatrix(
    north="0",
    location=importepw.location,
    direct_rad=importepw.direct_normal_rad,
    diffuse_rad=importepw.diffuse_horizontal_rad,
    hoys=analysisperiod.hoys)  # -> out, sky_mtx; plug-in component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
geometry = ClusterInput()
context = ClusterInput()
grid_size = ClusterInput()
run = ClusterInput()
sky_mtx = ClusterOutput(skymatrix.sky_mtx)
incidentradiation = LBIncidentRadiation(
    sky_mtx=skymatrix.sky_mtx,
    geometry=flatten(geometry),
    context=flatten(context),
    grid_size=grid_size,
    legend_par=legendpar,
    run=run)  # -> out, points, results, total, mesh, legend, title, int_mtx; plug-in component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
results = ClusterOutput(incidentradiation.results)
points = ClusterOutput(incidentradiation.points)
mesh = ClusterOutput(incidentradiation.mesh)
