# Grasshopper definition 230822_CAE_reference_tool.ghx (Grasshopper 1.0.7)

python = GhPythonScript()  # -> out, a
# ---------- python: Python ----------
from compas.datastructures import Mesh

def create_rectangle_mesh(length, height):
    mesh = Mesh()

    a, b, c, d = mesh.add_face([[0, 0, 0], [length, 0, 0], [length, height, 0], [0, height, 0]])

    return mesh


length = 3.0 
height = 3.0  


rectangle_mesh = create_rectangle_mesh(length, height)
# ---------- end python ----------

panel = Panel("Reload libraries")
bang = Button()
unload = PythonScript(reload=bang)
# ---------- unload: Python ----------
from compas_ghpython import unload_modules

if reload:
    unload_modules('climate_active_envelopes')
# ---------- end unload ----------

py = PythonScript()  # -> HERE, DATA
# ---------- py: Python ----------
import os

HERE = os.path.dirname(ghdoc.Path)
DATA = os.path.abspath(os.path.join(HERE, "..", "data"))

print(HERE)
print(DATA)
# ---------- end py ----------

# ---- group: reference elements
pln = Plane(Plane(origin=(3, 0, 0), x=(0, 1, 0), y=(-1, 0, 0)))
pln_2 = Plane(PlaneXY(0, 0, 0))
mesh = Mesh(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)
mesh_2 = Mesh(<mesh referenced from the Rhino model>)
pln_3 = Plane(Plane(origin=(3, 3, 0), x=(-1, 0, 0), y=(0, -1, 0)))
mesh_3 = Mesh(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)
pln_4 = Plane(Plane(origin=(0, 3, 0), x=(0, -1, 0), y=(1, 0, 0)))
mesh_4 = Mesh(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)

# ---- group: reference elements / front_element
reference_element = GhPythonScript(
    plane=pln_2,
    rh_mesh=mesh,
    length=Slider(3, range=0.4..10),
    height=Slider(3, range=0.3..10),
    bond_type="stretcher_header_bond")  # -> front_element, M
# ---------- reference_element: Python ----------
from climate_active_envelopes.assembly import ReferenceElement as Element
from compas.artists import Artist
from compas.geometry import Frame
from compas_rhino.geometry import RhinoMesh


frame = Frame(plane.Origin, plane.XAxis, plane.YAxis)

rhino_mesh = RhinoMesh.from_geometry(rh_mesh)
compas_mesh = rhino_mesh.to_compas()

front_element = Element.from_parameters(frame, compas_mesh, length, height, bond_type)

print front_element.length


M = Artist(front_element.mesh).draw()
# ---------- end reference_element ----------

# ---- group: reference elements / right_element
reference_element_2 = GhPythonScript(
    plane=pln,
    rh_mesh=mesh_2,
    length=Slider(3, range=0.4..10),
    height=Slider(3, range=0.3..10),
    bond_type="stretcher_header_bond")  # -> right_element
# ---------- reference_element_2: Python ----------
from climate_active_envelopes.assembly import ReferenceElement as Element
from compas.geometry import Frame
from compas_rhino.geometry import RhinoMesh

frame = Frame(plane.Origin, plane.XAxis, plane.YAxis)

rhino_mesh = RhinoMesh.from_geometry(rh_mesh)
compas_mesh = rhino_mesh.to_compas()

right_element = Element.from_parameters(frame, compas_mesh, length, height, bond_type)
# ---------- end reference_element_2 ----------

# ---- group: reference elements / back_element
reference_element_3 = GhPythonScript(
    plane=pln_3,
    rh_mesh=mesh_3,
    length=Slider(3, range=0.4..10),
    height=Slider(3, range=0.3..10),
    bond_type="stretcher_header_bond")  # -> back_element
# ---------- reference_element_3: Python ----------
from climate_active_envelopes.assembly import ReferenceElement as Element
from compas.geometry import Frame
from compas_rhino.geometry import RhinoMesh

frame = Frame(plane.Origin, plane.XAxis, plane.YAxis)

rhino_mesh = RhinoMesh.from_geometry(rh_mesh)
compas_mesh = rhino_mesh.to_compas()

back_element = Element.from_parameters(frame, compas_mesh, length, height, bond_type)
# ---------- end reference_element_3 ----------

# ---- group: reference elements / left_element
reference_element_4 = GhPythonScript(
    plane=pln_4,
    rh_mesh=mesh_4,
    length=Slider(3, range=0.4..10),
    height=Slider(3, range=0.3..10),
    bond_type="stretcher_header_bond")  # -> left_element
# ---------- reference_element_4: Python ----------
from climate_active_envelopes.assembly import ReferenceElement as Element
from compas.geometry import Frame
from compas_rhino.geometry import RhinoMesh

frame = Frame(plane.Origin, plane.XAxis, plane.YAxis)

rhino_mesh = RhinoMesh.from_geometry(rh_mesh)
compas_mesh = rhino_mesh.to_compas()

left_element = Element.from_parameters(frame, compas_mesh, length, height, bond_type)
# ---------- end reference_element_4 ----------

# ---- group: brick elements
elem_ins = Mesh(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)
brick_element = GhPythonScript(brick_width="0.115", brick_height="0.071", brick_length="0.24", mortar="0.01", elem_ins=elem_ins)  # -> brick_full, brick_ins; inputs elem_ins: Mesh
# ---------- brick_element: Python ----------
from compas.geometry import Frame
from compas_rhino.geometry import RhinoMesh
from compas.datastructures import Mesh
from compas.artists import Artist
from climate_active_envelopes.assembly import Element
import Rhino.Geometry as rg




brick_full = Element.from_dimensions(brick_length, brick_width, brick_height)
brick_full.tool_frame = Frame([0, 0, brick_height], [1, 0, 0], [0, -1, 0])


brick_ins = Element.from_rhinomesh_geometry(elem_ins, Frame([0, 0, brick_height/2], [1, 0, 0], [0, -1, 0]))
brick_ins.tool_frame = Frame([0, 0, brick_height], [1, 0, 0], [0, -1, 0])

print brick_ins
print brick_full
# ---------- end brick_element ----------

# ---- group: brick elements / draw element
show = BooleanToggle(False)
show_2 = BooleanToggle(False)
draw_elements = PythonScript(elem_full=reference_element.front_element, elem_ins=brick_element.brick_ins, show_full=show_2, show_ins=show)  # -> M, F, S
# ---------- draw_elements: Python ----------
from compas.artists import Artist


#M = Artist(elem_ins.mesh).draw()
#print M

if show_full:
    M = Artist(elem_full.mesh).draw()
    F = Artist(elem_full.frame).draw()
    S = Artist(elem_full.tool_frame).draw()


if show_ins:
    M = Artist(elem_ins.mesh).draw()
    F = Artist(elem_ins.frame).draw()
    S = Artist(elem_ins.tool_frame).draw()
# ---------- end draw_elements ----------
pln_5 = Plane(draw_elements.F)
mesh_5 = Mesh(draw_elements.M)
pln_6 = Plane(draw_elements.S)

# ----
mesh_6 = Mesh(reference_element.M)

# ---- group: reference model
connectivity = GhPythonScript()  # -> connectivity
# ---------- connectivity: Python ----------
connectivity = [[0,1], [1,2], [2,3], [3,0]]

#print reference_model.add_connection(0, 2)
#reference_model.add_connection(1, 3)
#reference_model.add_connection(2, 1)
#reference_model.add_connection(3, 0)
# ---------- end connectivity ----------
reference_model = GhPythonScript(
    init=Button(),
    reference_elements=[reference_element.front_element, reference_element_2, reference_element_3, reference_element_4],
    connectivity=connectivity)  # -> out, reference_model; inputs reference_elements: list, connectivity: list
# ---------- reference_model: Python ----------
from climate_active_envelopes.assembly import ReferenceModel as Assembly
from compas.datastructures import Network
from compas_ghpython.artists import NetworkArtist



reference_model = Assembly()

for i, element in enumerate(reference_elements):
    reference_model.add_element(element)

print connectivity

for connection in connectivity:
    reference_model.add_connection(connection[0], connection[1])

data = reference_model.network.to_data()
network = Network.from_data(data)
print network


nodes, edges = NetworkArtist(network).draw()
# ---------- end reference_model ----------

draw_network = GhPythonScript(reference_model=reference_model.reference_model)  # -> out, nodes, edges
# ---------- draw_network: Python ----------
from compas.datastructures import Network
from compas_ghpython.artists import NetworkArtist



data = reference_model.network.to_data()
network = Network.from_data(data)

nodes, edges = NetworkArtist(network).draw()
# ---------- end draw_network ----------
pt = Point(draw_network.nodes)
line = Line(draw_network.edges)

# ----
python_2 = GhPythonScript(reference_model=reference_model.reference_model)  # -> out, planes, plane_grid; disabled
# ---------- python_2: Python ----------
#print reference_model
#print reference_model.number_of_elements()
import Rhino.Geometry as rg
from compas.geometry import Translation
from compas.geometry import Curve, Point, Frame

brick_length = 0.24
brick_height = 0.115
brick_width = 0.071
mortar = 0.01


grid = []

for i, ref_element in reference_model.elements():
    print ref_element.frame
    length = ref_element.length
    height = ref_element.height
    courses = int(height / (brick_height + mortar/2))
    bricks_per_course = int(length / ((brick_length + brick_width)/2 + mortar))
    total_length = (bricks_per_course - 1) * (bricks_per_course)

    plane_grid = []
    for course in range(courses):
        z_val = course * (brick_height + mortar)
        #T1 = Translation(ref_element.frame.zaxis*z_val)

        planes = []
        for bricks in range(bricks_per_course):
            x_val = bricks * ((brick_length + brick_width)/2 + mortar)
            plane = rg.Plane(rg.Point3d(x_val, 0, z_val), rg.Vector3d(0, 0, 1))

            #T2 = Translation(ref_element.frame.zaxis*x_val)
            #frame = ref_element.frame
            #plane = rg.Plane(frame.point, frame.xaxis, frame.yaxis) 
            #plane.transform(T1*T2)

            planes.append(plane)
        plane_grid.append(planes)
    grid.append(plane_grid)



def list_from_2darray(array):
    return [item for sublist in array for item in sublist]

planes = list_from_2darray(grid[1])
# ---------- end python_2 ----------
python_3 = GhPythonScript(reference_model=reference_model.reference_model)  # -> out, planes, plane_grid
# ---------- python_3: Python ----------
#print reference_model
#print reference_model.number_of_elements()
import Rhino.Geometry as rg
from compas.geometry import Curve, Point, Frame
from compas.artists import Artist, artist
import math as m


brick_length = 0.24
brick_height = 0.115
brick_width = 0.071
mortar = 0.01


for i, ref_element in reference_model.elements():
    length = ref_element.length
    height = ref_element.height

courses = int(height / (brick_height + mortar/2))
bricks_per_course = int(length / ((brick_length + brick_width)/2 + mortar))
total_length = (bricks_per_course - 1) * (bricks_per_course)

plane_grid = []
for course in range(courses):
    z_coordinate = course * (brick_height + mortar)
    planes = []
    for brick in range(bricks_per_course):
        x_coordinate = brick * ((brick_length + brick_width)/2 + mortar)

        plane = rg.Plane(rg.Point3d(x_coordinate, 0, z_coordinate), rg.Vector3d(0, 0, 1))

        planes.append(plane)
    plane_grid.append(planes)





def list_from_2darray(array):
    return [item for sublist in array for item in sublist]

planes = list_from_2darray(plane_grid)
# ---------- end python_3 ----------
plane_grid = GhPythonScript(plane_grid=python_3.plane_grid)  # -> out, planes, grid; inputs plane_grid: list
# ---------- plane_grid: Python ----------
import Rhino.Geometry as rg
from compas.geometry import Curve, Point, Frame
from compas.artists import Artist, artist
import math as m


length = 0.24
height = 0.115
width = 0.071
mortar = 0.01

grid = []

for i, row_planes in enumerate(plane_grid):
    row = []
    for j, plane in enumerate(row_planes):

        z1 = plane
        z1.Translate(z1.ZAxis*-height/2)


        #odd layers
        if i%2 == 0: 
            if j%2 == 0: 
                z1.Translate(z1.YAxis*+(length/4 + mortar/4))
                z1.Rotate(m.radians(90), z1.ZAxis)
                z4 = rg.Plane(z1)
                z4.Translate(z4.XAxis*+(length + mortar))
                row.append(z4)

            if j%2 == 1:
                z2 = rg.Plane(z1)
                z2.Rotate(m.radians(90), z2.ZAxis)
                z2.Translate(z2.YAxis*+(width/2 + mortar/2))
                z2.Translate(z2.XAxis*+((length/2+width/2) + mortar))
                row.append(z2)
                z3 = rg.Plane(z2)
                z2.Translate(z2.YAxis*-(width + mortar))
                row.append(z3)
                z5 = rg.Plane(z1)
                z5.Translate(z5.YAxis*+((length+ width) + mortar*2))
                row.append(z5)


        #even layers
        if i%2 == 1:
            if j%2 == 1:
                z1.Translate(z1.YAxis*+(length/4 + mortar/4))
                z1.Rotate(m.radians(90), z1.ZAxis)
                z4 = rg.Plane(z1)
                z4.Translate(z4.XAxis*+(length + mortar))
                row.append(z4)

            if j%2 == 0:
                z2 = rg.Plane(z1)
                z2.Rotate(m.radians(90), z2.ZAxis)
                z2.Translate(z2.YAxis*+(width/2 + mortar/2))
                z2.Translate(z2.XAxis*+((length/2+width/2) + mortar))
                row.append(z2)
                z3 = rg.Plane(z2)
                z2.Translate(z2.YAxis*-(width + mortar))
                row.append(z3)
                z5 = rg.Plane(z1)
                z5.Translate(z5.YAxis*+((length+ width) + mortar*2))
                row.append(z5)

        row.append(z1)
    grid.append(row)





def list_from_2darray(array):
    return [item for sublist in array for item in sublist]

planes = list_from_2darray(grid)
# ---------- end plane_grid ----------
plane_grid_2 = GhPythonScript()  # -> assembly, plane_grid, planes; inputs mesh_grid: list; disabled
# ---------- plane_grid_2: Python ----------
from compas.geometry import Curve, Point, Frame
from compas.artists import Artist, artist
import math as m
import Rhino.Geometry as rg

length = assembly.get_attribute('length')
height = assembly.get_attribute('height')
width = assembly.get_attribute('width')
mortar = assembly.get_attribute('mortar')


plane_grid = []

def create_plane_grid(mesh_grid):

    for i, row_planes in enumerate(mesh_grid):
        row = []
        for j, plane in enumerate(row_planes):
            z1 = plane
            z1.Translate(z1.ZAxis*-height/2)


            #odd layers
            if i%2 == 0: 
                if j%2 == 0: 
                    z1.Translate(z1.YAxis*+(length/4 + mortar/4))
                    z1.Rotate(m.radians(90), z1.ZAxis)
                    z4 = rg.Plane(z1)
                    z4.Translate(z4.XAxis*+(length + mortar))
                    row.append(z4)

                if j%2 == 1:
                    z2 = rg.Plane(z1)
                    z2.Rotate(m.radians(90), z2.ZAxis)
                    z2.Translate(z2.YAxis*+(width/2 + mortar/2))
                    z2.Translate(z2.XAxis*+((length/2+width/2) + mortar))
                    row.append(z2)
                    z3 = rg.Plane(z2)
                    z2.Translate(z2.YAxis*-(width + mortar))
                    row.append(z3)
                    z5 = rg.Plane(z1)
                    z5.Translate(z5.YAxis*+((length+ width) + mortar*2))
                    row.append(z5)


            #even layers
            if i%2 == 1:
                if j%2 == 1:
                    z1.Translate(z1.YAxis*+(length/4 + mortar/4))
                    z1.Rotate(m.radians(90), z1.ZAxis)
                    z4 = rg.Plane(z1)
                    z4.Translate(z4.XAxis*+(length + mortar))
                    row.append(z4)

                if j%2 == 0:
                    z2 = rg.Plane(z1)
                    z2.Rotate(m.radians(90), z2.ZAxis)
                    z2.Translate(z2.YAxis*+(width/2 + mortar/2))
                    z2.Translate(z2.XAxis*+((length/2+width/2) + mortar))
                    row.append(z2)
                    z3 = rg.Plane(z2)
                    z2.Translate(z2.YAxis*-(width + mortar))
                    row.append(z3)
                    z5 = rg.Plane(z1)
                    z5.Translate(z5.YAxis*+((length+ width) + mortar*2))
                    row.append(z5)

            row.append(z1)
        plane_grid.append(row)
    return plane_grid

plane_grid = create_plane_grid(mesh_grid)


def list_from_2darray(array):
    return [item for sublist in array for item in sublist]

planes = list_from_2darray(plane_grid)
# ---------- end plane_grid_2 ----------
generate = Button()
transf = BooleanToggle(False)
assembly = GhPythonScript(assembly=plane_grid_2.assembly, plane_grid=plane_grid_2.plane_grid)  # -> out, assembly; inputs plane_grid: list, params_grid: list, values: list; disabled
# ---------- assembly: Python ----------
import Rhino.Geometry as rg
import math as m
from compas.geometry import Frame, Point, Rotation, Transformation, Translation
from compas.utilities import normalize_values
from climate_active_envelopes.assembly import Assembly

#from climate_active_envelopes.assembly import BRICK_Assembly as Assembly

length = assembly.get_attribute('length')
height = assembly.get_attribute('height')
width = assembly.get_attribute('width')
mortar = assembly.get_attribute('mortar')

if generate:
    for i, row in enumerate(plane_grid): # number of layers and all planes
        for j, plane in enumerate(row): # j = planes / layer
            frame = Frame(plane.Origin, plane.XAxis, plane.YAxis)
            frame_pt = frame.point

            if transform == True:
                if i % 2 == 0 and j % 3 == 1 and j % 2 == 1:
                    trans_val = params_grid[i]  # Access the trans_val from params_grid
                    print trans_val
                    plane.Translate(plane.XAxis * - trans_val)

                if i % 2 == 1 and j % 3 != 0 and j % 3 != 1 and j % 2 == 1:
                    trans_val = params_grid[i]  # Access the trans_val from params_grid
                    plane.Translate(plane.XAxis * - trans_val)

                T = Transformation.from_frame_to_frame(Frame.worldXY(), Frame(plane.Origin, plane.XAxis, plane.YAxis))
            else: 
                T = Transformation.from_frame_to_frame(Frame.worldXY(), frame)

            if i % 2 == 1 and j % 2 == 1 and j % 3 != 1:
                c = elem_full.transformed(T)
                assembly.add_element(c)
            if i % 2 == 0 and j % 2 == 1 and j % 3 != 0:
                c = elem_full.transformed(T)
                assembly.add_element(c)
            else:
                c = elem_ins.transformed(T)
                assembly.add_element(c)

#if generate:
#    for i, row in enumerate(plane_grid): # number of layers and all planes
#        for j, plane in enumerate(row): # j = planes / layer
#            frame = Frame(plane.Origin, plane.XAxis, plane.YAxis)
#            frame_pt = frame.point
#
#            if transform == True:
#                for value in values:
#                    dist = value
#                    print dist
#                if i % 2 == 0 and j % 3 == 1 and j % 2 == 1:
#                    #trans_val = params_grid[i][j]  # Access the trans_val from params_grid
#                    plane.Translate(plane.XAxis *- m.radians(dist*10))
#
#                if i % 2 == 1 and j % 3 != 0 and j % 3 != 1 and j % 2 == 1:
#                    #trans_val = params_grid[i][j]  # Access the trans_val from params_grid
#                    plane.Translate(plane.XAxis *- m.radians(dist*10))
#
#                T = Transformation.from_frame_to_frame(Frame.worldXY(), Frame(plane.Origin, plane.XAxis, plane.YAxis))
#            else: 
#                T = Transformation.from_frame_to_frame(Frame.worldXY(), frame)
#
#            if i % 2 == 1 and j % 2 == 1 and j % 3 != 1:
#                c = elem_full.transformed(T)
#                assembly.add_element(c)
#            elif i % 2 == 0 and j % 2 == 1 and j % 3 != 0:
#                c = elem_full.transformed(T)
#                assembly.add_element(c)
#            else:
#                c = elem_ins.transformed(T)
#                assembly.add_element(c)



#if generate:
#    for i, row in enumerate(plane_grid): # number of layers and all planes
#        for j, plane in enumerate(row): #j = planes / layer
#            frame = Frame(plane.Origin, plane.XAxis, plane.YAxis)
#            frame_pt = frame.point
#
#            if transform == True:
#                for t_pt in t_pts:
#                    dist =  t_pt.DistanceTo(rg.Point3d(frame.point[0], frame.point[1], frame.point[2]))
#
#                if i%2 == 0 and j%3 == 1 and j%2 == 1:
#                    plane.Translate(plane.XAxis*-m.radians(dist*2))
#
#                if i%2 == 1  and j%3 != 0 and j%3 != 1 and j%2 == 1:
#                    plane.Translate(plane.XAxis*-m.radians(dist*2))
#                T = Transformation.from_frame_to_frame(Frame.worldXY(), Frame(plane.Origin, plane.XAxis, plane.YAxis))
#            else: 
#                T = Transformation.from_frame_to_frame(Frame.worldXY(), frame)
#
#
#            if i%2 == 1 and j%2 == 1 and j%3 != 1:
#                c = elem_full.transformed(T)
#                assembly.add_element(c)
#            elif i%2 == 0 and j%2 == 1 and j%3 != 0:
#                c = elem_full.transformed(T)
#                assembly.add_element(c)
#            else:
#                c = elem_ins.transformed(T)
#                assembly.add_element(c)


#for i, row in enumerate(plane_grid):
#    params_row = []
#    for j, plane in enumerate(row):
#        frame = Frame(plane.Origin, plane.XAxis, plane.YAxis)
#        frame_pt = frame.point
#
#        if i%2 == 0 and j%3 == 1 and j%2 == 1:
#            trans_val_odd = params_per_row[j]
#            plane.Translate(plane.XAxis * - trans_val_odd)
#
#        if i%2 == 1  and j%3 != 0 and j%3 != 1 and j%2 == 1:
#            trans_val_even = params_per_row[j]
#            plane.Translate(plane.XAxis * - trans_val_even)
#
#        T = Transformation.from_frame_to_frame(Frame.worldXY(), Frame(plane.Origin, plane.XAxis, plane.YAxis))
#    else: 
#        T = Transformation.from_frame_to_frame(Frame.worldXY(), frame)
#
#    
#        c = elem_full.transformed(T)
#        assembly.add_element(c)
    
#    if i%2 == 1 and j%2 == 1 and j%3 != 1:
#        c = elem_full.transformed(T)
#        assembly.add_element(c)
#    elif i%2 == 0 and j%2 == 1 and j%3 != 0:
#        c = elem_full.transformed(T)
#        assembly.add_element(c)
#    else:
#        c = elem_ins.transformed(T)
#        assembly.add_element(c)
# ---------- end assembly ----------
brick_assembly = GhPythonScript(
    reference_model=reference_model.reference_model,
    grid=plane_grid.grid,
    generate=generate,
    transform=transf,
    key=Slider(0, range=0..3),
    brick_full=brick_element.brick_full,
    brick_ins=brick_element.brick_ins)  # -> out, brick_assembly, current_node; inputs grid: list, generate: Boolean, key: Int32
# ---------- brick_assembly: Python ----------
import compas_ghpython
import Rhino.Geometry as rg
import math as m
from compas.geometry import Frame, Point, Rotation, Transformation, Translation
from compas.utilities import normalize_values
from climate_active_envelopes.assembly import Assembly

current_node = {'pos': reference_model.network.node_coordinates(key), 'radius': 0.1}
current_node = compas_ghpython.draw_spheres([current_node])

assembly = Assembly()

if generate:
    for i, row in enumerate(grid): # number of layers and all planes
        for j, plane in enumerate(row): #j = planes / layer
            frame = Frame(plane.Origin, plane.XAxis, plane.YAxis)
            frame_pt = frame.point
    
            if transform == True:
                for t_pt in t_pts:
                    dist =  t_pt.DistanceTo(rg.Point3d(frame.point[0], frame.point[1], frame.point[2]))
    
                if i%2 == 0 and j%3 == 1 and j%2 == 1:
                    plane.Translate(plane.XAxis*-m.radians(dist*2))
    
                if i%2 == 1  and j%3 != 0 and j%3 != 1 and j%2 == 1:
                    plane.Translate(plane.XAxis*-m.radians(dist*2))
                T = Transformation.from_frame_to_frame(Frame.worldXY(), Frame(plane.Origin, plane.XAxis, plane.YAxis))
            else: 
                T = Transformation.from_frame_to_frame(Frame.worldXY(), frame)
    
    
            if i%2 == 1 and j%2 == 1 and j%3 != 1:
                c = brick_full.transformed(T)
                assembly.add_element(c)
            elif i%2 == 0 and j%2 == 1 and j%3 != 0:
                c = brick_full.transformed(T)
                assembly.add_element(c)
            else:
                c = brick_ins.transformed(T)
                assembly.add_element(c)
# ---------- end brick_assembly ----------
panel_2 = Panel(brick_assembly.out)
brep = Brep(brick_assembly.current_node)

# ---- group: Network Artist
show_3 = BooleanToggle(False)
draw = GhPythonScript(assembly=brick_assembly.brick_assembly, show_network=show_3, key=Slider(26, range=0..47))  # -> nodes, edges, current_node, current_node_neighbors; inputs key: Int32
# ---------- draw: Python ----------
import sys, os
import ghpythonlib.components as ghcomp
from compas.datastructures import Network
from compas_ghpython.artists import NetworkArtist
from compas_rhino.geometry import RhinoLine

import compas_ghpython
import Rhino.Geometry as rg


data = assembly.network.to_data()
network = Network.from_data(data)

print assembly.network.number_of_nodes()

def draw_network(network):
    """Draw a network in Grasshopper.
    """
    points = []
    for key, attr in network.nodes(True):
        points.append({
            'pos': network.node_coordinates(key),
        })

    lines = []
    for (u, v), attr in network.edges(True):
        lines.append({
            'start': network.node_coordinates(u),
            'end': network.node_coordinates(v),
        })

    points_rg = compas_ghpython.draw_points(points)
    lines_rg = compas_ghpython.draw_lines(lines)

    return points_rg, lines_rg

if show_network:
    nodes, edges = draw_network(network)
    
    current_node = {'pos': network.node_coordinates(key), 'radius': 0.03}
    current_node = compas_ghpython.draw_spheres([current_node])
    
    current_node_neighbors_keys = network.neighbors(key)
    current_node_neighbors = [{'pos': network.node_coordinates(key), 'radius': 0.02} for key in current_node_neighbors_keys]
    current_node_neighbors = compas_ghpython.draw_spheres(current_node_neighbors)
# ---------- end draw ----------
pt_2 = Point(draw.nodes)
line_2 = Line(draw.edges)
brep_2 = Brep(draw.current_node_neighbors)
brep_3 = Brep(draw.current_node)

# ----
key = Slider(388, range=0..388)
till_key = Button()
start = Button()
reset = Button()
stop = Button()
back = Button()
step = Button()
full = Button()
list = ValueList({"20", "50", "100", "500", "1000", "5000"}, selected="1000")

counter = CountThroughList(
    assembly=brick_assembly.brick_assembly,
    start=start,
    stop=stop,
    step=step,
    step_back=back,
    reset=reset,
    full=full,
    till_key=till_key,
    key=key,
    interval=list)  # -> item, counter; inputs start: Boolean, stop: Boolean, step_back: Boolean, key: Int32
# ---------- counter: Python ----------
from scriptcontext import sticky as st
from compas_ghpython import update_component


L = list(assembly.elements())
# store data in component
guid = str(ghenv.Component.InstanceGuid)
counter_key = "counter_" + guid
running_key = "running_" + guid

if counter_key not in st:
    st[counter_key] = 0

if running_key not in st:
    st[running_key] = False
    

if st[running_key]:
    if st[counter_key] < len(L) - 1:
        st[counter_key] += 1
        update_component(ghenv, interval)
    else:
        st[counter_key] = 0
        st[running_key] = False
    
    
if start:
    st[running_key] = True

if stop:
    st[running_key] = False

if step:
    if st[counter_key] < len(L) - 1:
        st[counter_key] += 1

if step_back:
    if  0 < st[counter_key] < len(L):
        st[counter_key] -= 1

if reset:
    st[counter_key] = 0

if till_key:
    st[counter_key] = key

if full:
    st[counter_key] = len(L)-1

if len(L):
    item = L[st[counter_key]]



#st["visualisation_counter"] = st[counter_key]
#st[counter_key]= 500
counter = st[counter_key]
# ---------- end counter ----------
idx = Panel(counter.counter)

# ---- group: Assembly Artist
show_4 = BooleanToggle(True)
show_5 = BooleanToggle(False)
show_6 = BooleanToggle(False)
draw_2 = PythonScript(
    assembly=brick_assembly.brick_assembly,
    show_all=show_4,
    show_current=show_5,
    show_counter=show_6,
    counter=counter.counter)  # -> G, G_element, tool_planes_WCS, current_tool_plane; inputs counter: Int32
# ---------- draw_2: Python ----------
import os
import sys

import math

from compas.colors import Color
from compas.artists import Artist
from compas_ghpython.artists import NetworkArtist



G = []
G_element = []
#color = Color.from_rgb255(220,165,165)

key_index = assembly.network.key_index()
keys = [key_index[key] for key in assembly.network.nodes()]
elements = [assembly.element(key) for key in keys]
#print elements
#print([(e.gripping_frame) for e in elements])

tool_planes_WCS = [Artist(e.tool_frame).draw() for e in elements]

current_tool_plane = tool_planes_WCS[counter]

if show_all and not show_counter:
    for element in elements:
        mesh = Artist(element.mesh).draw(Color.from_rgb255(220,165,165))
        G.append(mesh)

if show_counter:
    for element in elements[0:counter+1]:
        mesh = Artist(element.mesh).draw(Color.from_rgb255(220,165,165))
        G.append(mesh)

if show_current:
    element = assembly.element(counter)
    mesh = Artist(element.mesh).draw(Color.from_rgb255(41,49,51))
    G_element.append(mesh)


#    course = assembly.network.node_attribute(key=counter, name='course')
#    keys_in_course = list(assembly.network.nodes_where({'course': course}))
#    elements = [assembly.element(key) for key in keys_in_course]
#    for element in elements:
#        mesh = Artist(element.mesh).draw(color)
#        G.append(mesh)
# ---------- end draw_2 ----------
pln_7 = Plane(draw_2.tool_planes_WCS)
geo = Geometry(draw_2.G_element)
pln_8 = Plane(draw_2.current_tool_plane)
geo_2 = Geometry(draw_2.G)

# ---- group: assembly structure
transf_2 = BooleanToggle(False)  # disabled
button = Button()  # disabled
assembly_2 = GhPythonScript(generate=button, transform=transf_2)  # -> assembly; inputs t_pts: list of Point3d, plane_grid: list, params_grid: list; disabled
# ---------- assembly_2: Python ----------
import Rhino.Geometry as rg
import math as m
from compas.geometry import Frame, Point, Rotation, Transformation, Translation
from compas.utilities import normalize_values
#from climate_aware_robotic_envelope.assembly import Assembly

#from climate_active_envelopes.assembly import BRICK_Assembly as Assembly


length = assembly.get_attribute('length')
height = assembly.get_attribute('height')
width = assembly.get_attribute('width')
mortar = assembly.get_attribute('mortar')

"""
c_pts = []
for j, face in enumerate(mesh_wall.faces()):
    vertex_centroid = mesh_wall.face_centroid(face)
    points = rg.Point3d(vertex_centroid[0],vertex_centroid[1], vertex_centroid[2])
    c_pts.append(points)

for i, points in enumerate(c_pts):
    transf_values = normalize_values(transf_values, -0.10, 0.0)
    t_val = transf_values[i]
    t_pl = rg.Plane(rg.Point3d(points[0],t_val,points[2]), rg.Vector3d(1, 0, 0), rg.Vector3d(0, 1, 0))
    t_frame = Frame(t_pl.Origin, t_pl.XAxis, t_pl.YAxis)
"""
if generate:
    for i, row in enumerate(plane_grid): # number of layers and all planes
        for j, plane in enumerate(row): #j = planes / layer
            frame = Frame(plane.Origin, plane.XAxis, plane.YAxis)
            frame_pt = frame.point

            if transform == True:
                for t_pt in t_pts:
                    dist =  t_pt.DistanceTo(rg.Point3d(frame.point[0], frame.point[1], frame.point[2]))

                if i%2 == 0 and j%3 == 1 and j%2 == 1:
                    plane.Translate(plane.XAxis*-m.radians(dist*2))

                if i%2 == 1  and j%3 != 0 and j%3 != 1 and j%2 == 1:
                    plane.Translate(plane.XAxis*-m.radians(dist*2))
                T = Transformation.from_frame_to_frame(Frame.worldXY(), Frame(plane.Origin, plane.XAxis, plane.YAxis))
            else: 
                T = Transformation.from_frame_to_frame(Frame.worldXY(), frame)


            if i%2 == 1 and j%2 == 1 and j%3 != 1:
                c = elem_full.transformed(T)
                assembly.add_element(c)
            elif i%2 == 0 and j%2 == 1 and j%3 != 0:
                c = elem_full.transformed(T)
                assembly.add_element(c)
            else:
                c = elem_ins.transformed(T)
                assembly.add_element(c)
# ---------- end assembly_2 ----------

# ----
python_4 = GhPythonScript()  # -> out, a
# ---------- python_4: Python ----------
    @classmethod
    def create_ref_elem(cls, frame, length, height):
        """Class method for constructing a mesh.

        Parameters
        frame, length, height

        :class:`Mesh`
            Mesh datastructure.
        :class:`Frame`
            Origin frame of the element.
        ----------
        """
        element = cls(frame)
        element.mesh = Mesh()
        element._length = length
        element._height = height

        # Add front side vertices
        for i in range(2):
            x = i * length
            for j in range(2):
                z = j * height
                element.mesh.add_vertex(x=x, y=0, z=z)
        # Add front side face
        for i in range(1):
            for j in range(1):
                a = i + j * 2
                b = a + 1
                c = b + 2
                d = a + 2
                element.mesh.add_face([a, b, c, d])
 
        element._source = element.mesh
        return element


    @classmethod
    def create_ref_elem_from_mesh(cls, frame, wall_length, wall_height, brick_length, brick_width, brick_height, mortar):
        """Class method for constructing a mesh.

        Parameters
        frame, length, height

        :class:`Mesh`
            Mesh datastructure.
        :class:`Frame`
            Origin frame of the element.
        ----------
        """

        element = cls(frame)
        element.mesh = Mesh()
        element.length = wall_length
        element.height = wall_height


        step_in_z = brick_height + mortar/2
        step_in_x = (brick_length+brick_width)/2 + mortar
        vertices_per_row = int(wall_length / step_in_x)
        row = int(wall_height / step_in_z)

        #create vertices
        for j in range(row): 
            z = j * step_in_z
            for i in range(vertices_per_row): 
                y = 0
                x = i * step_in_x
                element.mesh.add_vertex(x = x, y = y, z = z) 

        #create faces
        for j in range(row -1):
            for i in range(vertices_per_row - 1):
                a = i + j * vertices_per_row
                b = a + vertices_per_row
                c = b + 1
                d = a + 1
                element.mesh.add_face([a, b, c, d])
        element._source = element.mesh
        return element
# ---------- end python_4 ----------
show_7 = BooleanToggle(True)
show_8 = BooleanToggle(True)
step_2 = Button()
back_2 = Button()
python_5 = GhPythonScript(reference_model=python_4.out, step=step_2, back=back_2)  # -> out, counter
# ---------- python_5: Python ----------
from scriptcontext import sticky as st
from compas_ghpython import update_component

L = list(reference_model.elements())
# store data in component
guid = str(ghenv.Component.InstanceGuid)
counter_key = "counter_" + guid
running_key = "running_" + guid

if counter_key not in st:
    st[counter_key] = 0

if running_key not in st:
    st[running_key] = False

if st[running_key]:
    if st[counter_key] < len(L) - 1:
        st[counter_key] += 1
        update_component(ghenv, interval)
    else:
        st[counter_key] = 0
        st[running_key] = False

if step:
    if st[counter_key] < len(L) - 1:
        st[counter_key] += 1

if back:
    if  0 < st[counter_key] < len(L):
        st[counter_key] -= 1

counter = st[counter_key]
# ---------- end python_5 ----------

show_9 = BooleanToggle(True)
draw_3 = GhPythonScript(reference_model=python_4.out, show_network=show_9, counter=python_5.counter)  # -> nodes, edges, current_node, current_node_neighbors, labels; inputs counter: Int32
# ---------- draw_3: Python ----------
import sys, os
import ghpythonlib.components as ghcomp
from compas.datastructures import Network
from compas_ghpython.artists import NetworkArtist
from compas_rhino.geometry import RhinoLine

import compas_ghpython
import Rhino.Geometry as rg


data = reference_model.network.to_data()
network = Network.from_data(data)

#print reference_model.network.number_of_nodes()

def draw_network(network):
    """Draw a network in Grasshopper.
    """
    points = []
    for counter, attr in network.nodes(True):
        points.append({
            'pos': network.node_coordinates(counter),
        })

    lines = []
    for (u, v), attr in network.edges(True):
        lines.append({
            'start': network.node_coordinates(u),
            'end': network.node_coordinates(v),
        })

    points_rg = compas_ghpython.draw_points(points)
    lines_rg = compas_ghpython.draw_lines(lines)

    return points_rg, lines_rg

if show_network:
    nodes, edges = draw_network(network)
    
    current_node = {'pos': network.node_coordinates(counter), 'radius': 0.1}
    current_node = compas_ghpython.draw_spheres([current_node])
    
    current_node_neighbors_counters = network.neighbors(counter)
    current_node_neighbors = [{'pos': network.node_coordinates(counter), 'radius': 0.2} for counter in current_node_neighbors_counters]
    current_node_neighbors = compas_ghpython.draw_spheres(current_node_neighbors)

    labels = [counter for counter in network.nodes()]
# ---------- end draw_3 ----------
pt_3 = Point(draw_3.nodes)
brep_4 = Brep(draw_3.current_node_neighbors)
line_3 = Line(draw_3.edges)
brep_5 = Brep(draw_3.current_node)
tag = TextTag(Location=draw_3.nodes, Text=draw_3.labels)

draw_4 = PythonScript(reference_model=reference_model.reference_model, show_all=show_7, show_current=show_8, counter=python_5.counter)  # -> ref_elems, ref_elem, planes, current_plane; inputs counter: Int32
# ---------- draw_4: Python ----------
import os
import sys

import math

from compas.colors import Color
from compas.artists import Artist
from compas_ghpython.artists import NetworkArtist


ref_elems = []
ref_elem = []

key_index = reference_model.network.key_index()
keys = [key_index[key] for key in reference_model.network.nodes()]
elements = [reference_model.element(key) for key in keys]

planes = [Artist(e.frame).draw() for e in elements]
current_plane = planes[counter]


if show_all:
    for element in elements:
        mesh = Artist(element.mesh).draw(Color.from_rgb255(220,165,165))
        ref_elems.append(mesh)


if show_current:
    element = reference_model.element(counter)
    mesh = Artist(element.mesh).draw(Color.from_rgb255(41,49,51))
    ref_elem.append(mesh)
# ---------- end draw_4 ----------
geo_3 = Geometry(draw_4.ref_elems)
geo_4 = Geometry(draw_4.ref_elem)
pln_9 = Plane(draw_4.planes)
pln_10 = Plane(draw_4.current_plane)
global_wall = GhPythonScript()  # -> assembly, mesh_wall, mesh_grid
# ---------- global_wall: Python ----------
from compas.datastructures import Mesh
from compas.geometry import Curve, Point, Frame
from compas.artists import MeshArtist, Artist
import math as m
import Rhino.Geometry as rg
from compas.utilities import normalize_values

length = assembly.get_attribute('length')
height = assembly.get_attribute('height')
width = assembly.get_attribute('width')
mortar = assembly.get_attribute('mortar')


mesh_wall = Mesh()

mesh_grid = []


step_in_z = height + mortar/2
step_in_x = (length+width)/2 + mortar
vertices_per_row = int(wall_length / step_in_x)


row = int(wall_height / step_in_z)
#interval = period/vertices_per_row

total_length = (vertices_per_row - 1) * (step_in_x)


#create vertices
for j in range(row): 
    z = j * step_in_z
    for i in range(vertices_per_row): 
        y = 0
        x = i * step_in_x
        mesh_wall.add_vertex(x = x, y = y, z = z) 

#create faces
for j in range(row -1):
    planes_per_row = []
    for i in range(vertices_per_row - 1):
        a = i + j * vertices_per_row
        b = a + vertices_per_row
        c = b + 1
        d = a + 1

#create planes at faces_centroid
        vertex_centroid = mesh_wall.face_centroid(mesh_wall.add_face([a, b, c, d]))
        vertex_pts = Point(vertex_centroid[0], vertex_centroid[1], vertex_centroid[2])
        vertex_frame = Frame([vertex_pts[0], vertex_pts[1], vertex_pts[2]], [1,0,0], [0,1,0])
        vertex_plane = Artist(vertex_frame).draw()
        planes_per_row.append(vertex_plane)
    mesh_grid.append(planes_per_row)

face_cplanes = [plane for planes_row in mesh_grid for plane in planes_row]



























"""
if add_left:
    # create vertices
    for j in range(row): 
        z = j * step_in_z
        for i in range(vertices_per_row_2): 
            y = i * step_in_x
            x = 0
            mesh_wall_left.add_vertex(x = x, y = y, z = z) 
            #V2 = MeshArtist(mesh_wall_left).draw_vertices()
            
    #create faces
    for j in range(row - 1):
        planes_per_row_2 = []
        for i in range(vertices_per_row_2 - 1):
            e = i + j * vertices_per_row_2
            f = e + vertices_per_row_2
            g = f + 1
            h = e + 1
            #mesh_wall_left.add_face([e, f, g, h])
            #M2 = MeshArtist(mesh_wall_left).draw()

    #create planes at faces_centroid
            vertex_centroid_2 = mesh_wall_left.face_centroid(mesh_wall_left.add_face([e, f, g, h]))
            vertex_cpts_2 = Point(vertex_centroid_2[0], vertex_centroid_2[1], vertex_centroid_2[2])
            vertex_cframe_2 = Frame([vertex_cpts_2[0], vertex_cpts_2[1], vertex_cpts_2[2]], [1,0,0], [0,1,0])
            vertex_cplane_2 = Artist(vertex_cframe_2).draw()
            planes_per_row_2.append(vertex_cplane_2)
        mesh_grid_left.append(planes_per_row_2)

    face_cplanes_2 = [plane_2 for planes_row_2 in mesh_grid_left for plane_2 in planes_row_2]




if add_right:
    # create vertices
    for j in range(row): 
        z = j * step_in_z
        for i in range(vertices_per_row_2): 
            y = i * step_in_x
            x = (total_length)
            mesh_wall_right.add_vertex(x = x, y = y, z = z) 


    #create faces
    for j in range(row - 1):
        planes_per_row_2 = []
        for i in range(vertices_per_row_2 - 1):
            k = i + j * vertices_per_row_2
            l = k + vertices_per_row_2
            m = l + 1
            n = k + 1

    #create planes at faces_centroid
            vertex_centroid_3 = mesh_wall_right.face_centroid(mesh_wall_right.add_face([k, l, m, n]))
            vertex_cpts_3 = Point(vertex_centroid_3[0], vertex_centroid_3[1], vertex_centroid_3[2])
            vertex_cframe_3 = Frame([vertex_cpts_3[0], vertex_cpts_3[1], vertex_cpts_3[2]], [1,0,0], [0,1,0])
            vertex_cplane_3 = Artist(vertex_cframe_3).draw()
            planes_per_row_2.append(vertex_cplane_3)
        mesh_grid_right.append(planes_per_row_2)

    face_cplanes_2 = [plane_3 for planes_row_3 in mesh_grid_right for plane_3 in planes_row_3]
    
    
#mesh_wall_all = []
#mesh_wall_all += mesh_wall, mesh_wall_left, mesh_wall_right


## Create wall curves left and right
#total_length = step_in_x*(vertices_per_row-1)
#total_height = step_in_z*(row-1)

#wall_crv_left = rg.Line(rg.Point3d(0,0,0), rg.Point3d(0,0,total_height))
#wall_crv_bottom_left = rg.Line(rg.Point3d(0,0,0), rg.Point3d(0, m.pi*0.5, 0))

#wall_crv_right = rg.Line(rg.Point3d(total_length,0,0), rg.Point3d(total_length, 0, total_height))
#wall_crv_bottom_right = rg.Line(rg.Point3d(total_length,0,0), rg.Point3d(total_length, m.pi*0.5, 0))



#        if add_front:
#            x = i * step_in_x
#            y = amplitude * m.sin(interval * i + phase)
#            mesh_wall.add_vertex(x=x, y=y, z=z)
#
#        if add_left:
#            x = 0
#            y = i * step_in_x
#            mesh_wall.add_vertex(x=x, y=y, z=z)
#
#        if add_right:
#            y = i * step_in_x
#            x = total_length
#            mesh_wall.add_vertex(x=x, y=y, z=z)
"""
# ---------- end global_wall ----------
plane_grid_3 = GhPythonScript()  # -> assembly, plane_grid, planes; inputs mesh_grid: list; same code as plane_grid_2
global_plane_grid = GhPythonScript()  # -> planes, crv_loft, curves, global_plane_grid; inputs num_row: Int32
# ---------- global_plane_grid: Python ----------
import Rhino.Geometry as rg
import math as m
from compas.geometry import Curve

#length = assembly.get_attribute('length')
#height = assembly.get_attribute('height')
#width = assembly.get_attribute('width')

curves = []
global_plane_grid = []

mortar = 0.005
#length = length + 0.06
n = num_row



def create_global_planes(curve, num_row):
    for i in range(n):
        crv = curve.ToNurbsCurve()
        crv.Translate(rg.Vector3d.ZAxis*(height+mortar)*i)
        curves.append(crv)


    for j, curve in enumerate(curves):
        row = []
        vparams = rg.Curve.DivideByLength(curve, (length+mortar), True)
        planes = rg.Curve.GetPerpendicularFrames(curve, vparams)

        for k, plane in enumerate(planes):
            plane.Rotate(m.radians(-90), plane.YAxis)
            plane.Translate(plane.XAxis*+(width+mortar/2))
            row.append(plane)

        global_plane_grid.append(row)
    return global_plane_grid

global_plane_grid = create_global_planes(curve, num_row)


def list_from_2darray(array):
    return [item for sublist in array for item in sublist]

planes = list_from_2darray(global_plane_grid)



crv_loft = rg.Brep.CreateFromLoft(curves, rg.Point3d.Unset, rg.Point3d.Unset, rg.LoftType(2), False )
print crv_loft
# ---------- end global_plane_grid ----------
plane_grid_4 = GhPythonScript(global_plane_grid=global_plane_grid.global_plane_grid)  # -> curves, planes, plane_grid; inputs global_plane_grid: list
# ---------- plane_grid_4: Python ----------
import Rhino.Geometry as rg
import math as m
from compas.geometry import Curve

length = assembly.get_attribute('length')
height = assembly.get_attribute('height')
width = assembly.get_attribute('width')

curves = []
plane_grid = []

mortar = 0.005

def create_planes_plane_grid(height, width):

    for i, planes in enumerate(global_plane_grid):
        row = []
        for j, plane in enumerate(planes):
            #print len(plane)
            z1 = plane

            #zone 1

            #z1.Translate(z1.ZAxis*-height)
            if i %2 == 0:
                z1.Translate(z1.XAxis*-(length/2 + mortar/2))
                
                if j == 0: #first planes
                    z1.Rotate(m.radians(90), plane.ZAxis)
                    z1.Translate(z1.XAxis*-(width/2 + mortar))
                    z1.Translate(z1.YAxis*-(width/2 + mortar))
                    
                if j == len(planes)-1: #last planes
                    z1_copy = rg.Plane(z1)
                    z1_copy.Rotate(m.radians(90), z1_copy.ZAxis)
                    z1_copy.Translate(z1_copy.YAxis*-(width+width/2+mortar*2))
                    z1_copy.Translate(z1_copy.XAxis*-(width/2 + mortar))
                    row.append(z1_copy)

            row.append(z1)


        plane_grid.append(row)
    return plane_grid

plane_grid = create_planes_plane_grid(height, width)





def list_from_2darray(array):
    return [item for sublist in array for item in sublist]

planes = list_from_2darray(plane_grid)
# ---------- end plane_grid_4 ----------
generate_assembly = GhPythonScript()  # -> assembly, COURSES; inputs ptransf: Plane, attr_pts: list of Point3d
# ---------- generate_assembly: Python ----------
import Rhino.Geometry as rg
import math
from scriptcontext import sticky as st


from compas.geometry import Frame
from compas.geometry import Transformation
from compas.geometry import Rotation
from compas.geometry import Translation
from compas.geometry import Point

from compas_ghpython import draw_frame

from assembly_information_model.assembly import Assembly

import Rhino.Geometry as rg



length, width, height = [elem_full._source.xsize, elem_full._source.ysize, elem_full._source.zsize]
print(width, length, height)

"""
COURSES = 7
bricks_in_course = 4

MORTAR_PERPENDS = 0.01

total_length = bricks_in_course * length + (bricks_in_course - 1) * MORTAR_PERPENDS
gap = MORTAR_PERPENDS

assembly = Assembly() # initialize an empty assembly class
planes = [] # just for vizualisation

for course in range(COURSES):
    dy = course * height
    is_odd = course % 2 != 0
    dx = 0
    for j in range(bricks_in_course):
        first = j == 0
        last = j == bricks_in_course - 1
        if is_odd:
            T = Translation.from_vector([dx + length/5 , 0, dy])
            e = elem_full.transformed(T)
            dx += length + gap/2
        else:
            T = Translation.from_vector([dx, 0, dy])
            e = elem_full.transformed(T)
            dx += length
        
        cpt = e.frame.point
        
        #apply rotation to the bricks according to the distance of the attractor points
        min_dist = 10
        for attr_pt in attr_pts:
            dist =  attr_pt.DistanceTo(rg.Point3d(cpt.x, cpt.y, cpt.z))
            if dist<min_dist:
                min_dist = dist
            #print dist
        dist = min_dist
        if is_odd:
            R = Rotation.from_axis_and_angle([0,0,1], -math.radians(1/(0.3*dist*dist)), point=e.frame.point) 
        else:
            R = Rotation.from_axis_and_angle([0,0,1], math.radians(1/(0.3*dist*dist)), point=e.frame.point) 
        e.transform(R)
        
        planes.append(draw_frame(e.tool_frame)) #only for visualizing in gh
        assembly.add_element(e, course=course)
        dx += gap

if transform:
    T = Transformation.from_frame_to_frame(Frame.worldXY(), Frame(ptransf.Origin, ptransf.XAxis, ptransf.YAxis))
    assembly.transform(T)
    assembly.network.transform(T)
"""
# ---------- end generate_assembly ----------
