# Grasshopper definition 230831_CAE_reference_tool-fail.ghx (Grasshopper 1.0.7)

panel = Panel("Reload libraries")
bang = Button()
unload = PythonScript(reload=bang)
# ---------- unload: Python ----------
from compas_ghpython import unload_modules

if reload:
    unload_modules('climate_active_envelopes')
# ---------- end unload ----------

py = PythonScript()  # -> HERE, DATA
# ---------- py: Python ----------
import os

HERE = os.path.dirname(ghdoc.Path)
DATA = os.path.abspath(os.path.join(HERE, "..", "data"))

print(HERE)
print(DATA)
# ---------- end py ----------

# ---- group: reference elements
mesh = Mesh(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)
pln = Plane(Plane(origin=(3, 0, 0), x=(0, 1, 0), y=(-1, 0, 0)))
pln_2 = Plane(PlaneXY(0, 0, 0))
mesh_2 = Mesh(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)
pln_3 = Plane(Plane(origin=(3, 3, 0), x=(-1, 0, 0), y=(0, -1, 0)))
mesh_3 = Mesh(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)
pln_4 = Plane(Plane(origin=(0, 3, 0), x=(0, -1, 0), y=(1, 0, 0)))
mesh_4 = Mesh(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)

# ---- group: reference elements / front_element
reference_element = GhPythonScript(
    init=Button(),
    plane=pln_2,
    rh_mesh=mesh,
    length=Slider(1, range=0.4..10),
    height=Slider(1, range=0.3..10),
    bond_type="flemish_bond")  # -> front_element, M
# ---------- reference_element: Python ----------
from climate_active_envelopes.assembly import ReferenceElement as Element
from compas.artists import Artist
from compas.geometry import Frame
from compas_rhino.geometry import RhinoMesh
from compas.datastructures import Mesh



frame = Frame(plane.Origin, plane.XAxis, plane.YAxis)

front_element = Element.from_parameters(frame, RhinoMesh.from_geometry(rh_mesh).to_compas(), length, height, bond_type)

M = Artist(front_element.mesh).draw()
# ---------- end reference_element ----------

# ---- group: reference elements / right_element
reference_element_2 = GhPythonScript(plane=pln, rh_mesh=mesh_2, length=Slider(3, range=0.4..10), height=Slider(3, range=0.3..10), bond_type="flemish_bond")  # -> right_element
# ---------- reference_element_2: Python ----------
from climate_active_envelopes.assembly import ReferenceElement as Element
from compas.geometry import Frame
from compas_rhino.geometry import RhinoMesh

frame = Frame(plane.Origin, plane.XAxis, plane.YAxis)

rhino_mesh = RhinoMesh.from_geometry(rh_mesh)
compas_mesh = rhino_mesh.to_compas()

right_element = Element.from_parameters(frame, compas_mesh, length, height, bond_type)
# ---------- end reference_element_2 ----------

# ---- group: reference elements / back_element
reference_element_3 = GhPythonScript(plane=pln_3, rh_mesh=mesh_3, length=Slider(3, range=0.4..10), height=Slider(3, range=0.3..10), bond_type="flemish_bond")  # -> back_element
# ---------- reference_element_3: Python ----------
from climate_active_envelopes.assembly import ReferenceElement as Element
from compas.geometry import Frame
from compas_rhino.geometry import RhinoMesh

frame = Frame(plane.Origin, plane.XAxis, plane.YAxis)

rhino_mesh = RhinoMesh.from_geometry(rh_mesh)
compas_mesh = rhino_mesh.to_compas()

back_element = Element.from_parameters(frame, compas_mesh, length, height, bond_type)
# ---------- end reference_element_3 ----------

# ---- group: reference elements / left_element
reference_element_4 = GhPythonScript(plane=pln_4, rh_mesh=mesh_4, length=Slider(3, range=0.4..10), height=Slider(3, range=0.3..10), bond_type="flemish_bond")  # -> left_element
# ---------- reference_element_4: Python ----------
from climate_active_envelopes.assembly import ReferenceElement as Element
from compas.geometry import Frame
from compas_rhino.geometry import RhinoMesh

frame = Frame(plane.Origin, plane.XAxis, plane.YAxis)

rhino_mesh = RhinoMesh.from_geometry(rh_mesh)
compas_mesh = rhino_mesh.to_compas()

left_element = Element.from_parameters(frame, compas_mesh, length, height, bond_type)
# ---------- end reference_element_4 ----------

# ----
mesh_5 = Mesh(reference_element.M)

file_path = FilePath("C:\Users\Bootsy\Downloads\Braunschweig-hour.epw")
brep = Brep(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)
context = Brep(<brep referenced from the Rhino model>)
cluster = Cluster(
    start_month=Slider(3, range=0..10),
    index=Slider(0, range=0..26),
    north="0",
    start_day=Slider(1, range=0..10),
    start_hour=Slider(11, range=0..100),
    end_month=Slider(8, range=0..10),
    end_day=Slider(31, range=0..100),
    end_hour=Slider(16, range=0..100),
    geometry=brep,
    context=context,
    epw_file=file_path,
    grid_size=Slider(0.2, range=0..1),
    run=Toggle(True),
    offset_dist=Slider(0, range=0..0.1),
    north_2="0")  # -> points, results, mesh, legend
pt = Point(cluster.points)
mesh_6 = Mesh(cluster.mesh)

# ---- group: reference model
connectivity = GhPythonScript()  # -> connectivity
# ---------- connectivity: Python ----------
connectivity = [[0,1], [1,2], [2,3], [3,0]]

#print reference_model.add_connection(0, 2)
#reference_model.add_connection(1, 3)
#reference_model.add_connection(2, 1)
#reference_model.add_connection(3, 0)
# ---------- end connectivity ----------
reference_model = GhPythonScript(
    reference_elements=[reference_element.front_element, reference_element_2, reference_element_3, reference_element_4],
    connectivity=connectivity)  # -> out, reference_model; inputs reference_elements: list, connectivity: list
# ---------- reference_model: Python ----------
from climate_active_envelopes.assembly import ReferenceModel
from compas.datastructures import Network
from compas_ghpython.artists import NetworkArtist



reference_model = ReferenceModel()

for i, element in enumerate(reference_elements):
    reference_model.add_element(element)

print connectivity

for connection in connectivity:
    reference_model.add_connection(connection[0], connection[1])

data = reference_model.network.to_data()
network = Network.from_data(data)



nodes, edges = NetworkArtist(network).draw()
# ---------- end reference_model ----------

draw_network = GhPythonScript(reference_model=reference_model.reference_model)  # -> out, nodes, edges
# ---------- draw_network: Python ----------
from compas.datastructures import Network
from compas_ghpython.artists import NetworkArtist



data = reference_model.network.to_data()
network = Network.from_data(data)

nodes, edges = NetworkArtist(network).draw()
# ---------- end draw_network ----------
pt_2 = Point(draw_network.nodes)
line = Line(draw_network.edges)

# ----
dist = GhPythonScript(points=cluster.points, results=cluster.results)  # -> color_values; inputs points: list of Point3d, results: list
# ---------- dist: Python ----------
import Rhino.Geometry as rg
from compas.utilities import normalize_values
from compas.geometry import Curve, Point, Frame, Vector
from compas.artists import Artist
import math as m
import Rhino.Geometry as rg
from compas.utilities import normalize_values
from compas.geometry import Curve, Point, Frame




transf_values = normalize_values(results, 0.0, 0.055)
print transf_values
#shading_values = []
#shading_points = []
#
#for i, point in enumerate(points):
#    frame = Frame([transf_values[i], point[1] , point[2]], [1,0,0], [0,1,0])
#    transf_value = transf_values[i]
#    
#
#    
#    
#    shading_values.append(transf_value)
#    shading_points.append(frame.point)
# ---------- end dist ----------
generate = Button()
insulated_brick = Brep(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)
brick_assembly = GhPythonScript(
    reference_model=reference_model.reference_model,
    generate=generate,
    key=Slider(0, range=0..3),
    insulated_brick=insulated_brick,
    create_self_shading=Toggle(True),
    color_values=dist)  # -> out, brick_assembly, reference_model; inputs generate: Boolean, insulated_brick: Mesh, color_values: list
# ---------- brick_assembly: Python ----------
import compas_ghpython
import Rhino.Geometry as rg
import math as m
from compas.geometry import Frame, Point, Rotation, Transformation, Translation
from compas.utilities import normalize_values
from climate_active_envelopes.assembly import ReferenceElement, ReferenceModel, Brick, Assembly
from compas_rhino.geometry import RhinoMesh
from compas.datastructures import Mesh



reference_element = reference_model.element(key)
if generate:
        reference_element.generate_brick_assembly(insulated_brick_mesh = RhinoMesh.from_geometry(insulated_brick).to_compas(), shading_values = shading_values, create_self_shading = create_self_shading )

brick_assembly = reference_element.brick_assembly


for key, element, node in brick_assembly.elements(data=True):
    print key
    frames = node["element"].frame
    values = color_values[key]

print values

"""
    color_vals = normalize_values(color_vals, 0.055, -0.005)
    for i, (element, data) in enumerate(elements):
        translation_val = color_vals[i] *1.15


        if data["course"] < 3:
           angle = 0
           translation_val = 0.035
           if foundation_mode == 'front':
               translation_val = 0.15
        print "translation_val: ", translation_val


        T = Translation(element.frame.zaxis*(translation_val)) * R

        relative_transformation = T * element.current_transformation.inverse()
        element.transform(relative_transformation)
        element.current_transformation = T
"""
# ---------- end brick_assembly ----------
python = GhPythonScript()  # -> out, a
# ---------- python: Python ----------
    def generate_brick_assembly_flemish_bond(self, brick_dimensions={"length": 0.24, "width": 0.115, "height": 0.075, "joint_height": 0.01}, insulated_brick_mesh=None):
        """ Algorithm to generate the brick_assembly model for the flemish bond brickwork."""

        assembly = Assembly()

        frame = self.frame

        brick_length = brick_dimensions["length"]
        brick_height = brick_dimensions["height"]
        brick_width = brick_dimensions["width"]
        mortar_joint_height = brick_dimensions["joint_height"]

        courses = int(self.height / (brick_height + mortar_joint_height/2))
        bricks_per_course = int(self.length / ((brick_length + brick_width)/2 + mortar_joint_height))              

        

        def create_brick_and_add_to_assembly(brick_type, fixed = True, frame = frame):
            if brick_type == "full":
                my_brick = Brick.from_dimensions(frame, brick_dimensions["length"], brick_dimensions["width"], brick_dimensions["height"])
            elif brick_type == "insulated":
                my_brick = Brick.from_mesh_and_frame(insulated_brick_mesh, frame)          
            else:
                return
            assembly.add_element(my_brick, attr_dict={"brick_type": brick_type, "fixed": fixed})

        for course in range(courses):
            z_val = course * (brick_height + mortar_joint_height)
            course_is_odd = course%2 == 0

            for brick in range(bricks_per_course):
                x_val = brick * ((brick_length + brick_width)/2 + mortar_joint_height)
                T = Translation.from_vector(frame.xaxis * x_val + frame.zaxis * z_val)
                current_frame = frame.transformed(T)
                brick_in_course_is_odd = brick%2 == 0
                brick_in_course_is_even = brick%2 == 1

                if course_is_odd:
                    if brick_in_course_is_odd: 
                        T = Translation.from_vector(current_frame.yaxis *+ (brick_length/4 + mortar_joint_height/4))
                        R = Rotation.from_axis_and_angle(current_frame.zaxis, m.radians(90), point=current_frame.point)
                        current_frame = current_frame.transformed(T*R) #brick_full, not_fixed                     
                        create_brick_and_add_to_assembly("full", fixed=False ,  frame = current_frame)

                        T1 = Translation.from_vector(current_frame.xaxis *+ (brick_length + mortar_joint_height))
                        T2 = Translation.from_vector(current_frame.yaxis *- (mortar_joint_height/6))
                        current_frame = current_frame.transformed(T1*T2)
                        create_brick_and_add_to_assembly("insulated", fixed=True , frame = current_frame)

                    else:
                        create_brick_and_add_to_assembly("full", fixed=True , frame = current_frame)

                        R = Rotation.from_axis_and_angle(current_frame.zaxis, m.radians(90), point=current_frame.point)
                        T1 = Translation.from_vector(current_frame.yaxis *+ (brick_width/2 + mortar_joint_height/4))
                        T2 = Translation.from_vector(current_frame.xaxis *+ ((brick_length/2+brick_width/2) + mortar_joint_height))
                        current_frame = current_frame.transformed(R*T1*T2)
                        create_brick_and_add_to_assembly("insulated", fixed=True , frame = current_frame)

                        T = Translation.from_vector(current_frame.yaxis *- (brick_width+mortar_joint_height))
                        current_frame = current_frame.transformed(T)
                        create_brick_and_add_to_assembly("insulated", fixed=True , frame = current_frame)

                        R = Rotation.from_axis_and_angle(current_frame.zaxis, m.radians(90), point=current_frame.point)
                        T1 = Translation.from_vector(current_frame.xaxis *+ (brick_width/2 + mortar_joint_height))
                        T2 = Translation.from_vector(current_frame.yaxis *- ((brick_length/2 + brick_width/2) + mortar_joint_height/2 + mortar_joint_height))
                        current_frame = current_frame.transformed(R*T1*T2)
                        create_brick_and_add_to_assembly("insulated", fixed=True , frame = current_frame)

                else:
                    if brick_in_course_is_even:
                        T = Translation.from_vector(current_frame.yaxis *+ (brick_length/4 + mortar_joint_height/4))
                        R = Rotation.from_axis_and_angle(current_frame.zaxis, m.radians(90), point=current_frame.point)
                        current_frame = current_frame.transformed(T*R) #brick_full, not_fixed
                        create_brick_and_add_to_assembly("full", fixed=False , frame = current_frame)

                        T1 = Translation.from_vector(current_frame.xaxis *+ (brick_length + mortar_joint_height))
                        T2 = Translation.from_vector(current_frame.yaxis *- (mortar_joint_height/6))
                        current_frame = current_frame.transformed(T1*T2)
                        create_brick_and_add_to_assembly("insulated", fixed=True , frame = current_frame)                      

                    else:                                             
                        create_brick_and_add_to_assembly("full", fixed=True , frame = current_frame)

                        R = Rotation.from_axis_and_angle(current_frame.zaxis, m.radians(90), point=current_frame.point)
                        T1 = Translation.from_vector(current_frame.yaxis *+ (brick_width/2 + mortar_joint_height/4))
                        T2 = Translation.from_vector(current_frame.xaxis *+ ((brick_length/2+brick_width/2) + mortar_joint_height))
                        current_frame = current_frame.transformed(R*T1*T2)
                        create_brick_and_add_to_assembly("insulated", fixed=True , frame = current_frame)

                        T = Translation.from_vector(current_frame.yaxis *- (brick_width+mortar_joint_height))
                        current_frame = current_frame.transformed(T)
                        create_brick_and_add_to_assembly("insulated", fixed=True , frame = current_frame)

                        R = Rotation.from_axis_and_angle(current_frame.zaxis, m.radians(90), point=current_frame.point)
                        T1 = Translation.from_vector(current_frame.xaxis *+ (brick_width/2 + mortar_joint_height))
                        T2 = Translation.from_vector(current_frame.yaxis *- ((brick_length/2 + brick_width/2) + mortar_joint_height/2 + mortar_joint_height))
                        current_frame = current_frame.transformed(R*T1*T2)
                        create_brick_and_add_to_assembly("insulated", fixed=True , frame = current_frame)
     
        self.brick_assembly = assembly
# ---------- end python ----------
python_2 = GhPythonScript(brick_assembly=brick_assembly.brick_assembly)  # -> out, a
# ---------- python_2: Python ----------
from climate_active_envelopes.assembly import ReferenceElement, ReferenceModel, Brick, Assembly




for key, element, node in brick_assembly.elements(data=True):
    frames = node["element"].frame

    #print frames.point
    #if node["brick_type"] == "full" and node["fixed"] == False:
        #print node


for node in brick_assembly.elements(data=True):

    print node[2]["element"].frame
# ---------- end python_2 ----------
python_3 = GhPythonScript()  # -> out, a
# ---------- python_3: Python ----------
def add_brick(course_is_odd, brick_in_course_is_odd, current_frame):
    def apply_transformations(transformations):
        for transformation in transformations:
            current_frame = current_frame.transformed(transformation)

    brick_type = "full" if course_is_odd else "insulated"

    if course_is_odd:
        T1 = Translation.from_vector(current_frame.yaxis * (brick_length / 4 + mortar_joint_height / 4))
        R = Rotation.from_axis_and_angle(current_frame.zaxis, m.radians(90), point=current_frame.point)
        apply_transformations([T1, R])
        create_brick_and_add_to_assembly(brick_type, fixed=False, frame=current_frame)

        T1 = Translation.from_vector(current_frame.xaxis * (brick_length + mortar_joint_height))
        T2 = Translation.from_vector(current_frame.yaxis * - (mortar_joint_height / 6))
        apply_transformations([T1, T2])
        create_brick_and_add_to_assembly("insulated", fixed=True, frame=current_frame)

    else:
        if brick_in_course_is_odd:
            T1 = Translation.from_vector(current_frame.yaxis * (brick_length / 4 + mortar_joint_height / 4))
            R = Rotation.from_axis_and_angle(current_frame.zaxis, m.radians(90), point=current_frame.point)
            apply_transformations([T1, R])
            create_brick_and_add_to_assembly(brick_type, fixed=False, frame=current_frame)

        T1 = Translation.from_vector(current_frame.xaxis * (brick_length + mortar_joint_height))
        T2 = Translation.from_vector(current_frame.yaxis * - (mortar_joint_height / 6))
        apply_transformations([T1, T2])
        create_brick_and_add_to_assembly(brick_type, fixed=True, frame=current_frame)

    if not brick_in_course_is_odd:
        R = Rotation.from_axis_and_angle(current_frame.zaxis, m.radians(90), point=current_frame.point)
        T1 = Translation.from_vector(current_frame.yaxis * (brick_width / 2 + mortar_joint_height / 4))
        T2 = Translation.from_vector(current_frame.xaxis * ((brick_length / 2 + brick_width / 2) + mortar_joint_height))
        apply_transformations([R, T1, T2])
        create_brick_and_add_to_assembly("insulated", fixed=True, frame=current_frame)

        T = Translation.from_vector(current_frame.yaxis * - (brick_width + mortar_joint_height))
        current_frame = current_frame.transformed(T)
        create_brick_and_add_to_assembly("insulated", fixed=True, frame=current_frame)

        R = Rotation.from_axis_and_angle(current_frame.zaxis, m.radians(90), point=current_frame.point)
        T1 = Translation.from_vector(current_frame.xaxis * (brick_width / 2 + mortar_joint_height))
        T2 = Translation.from_vector(current_frame.yaxis * - (
                (brick_length / 2 + brick_width / 2) + mortar_joint_height / 2 + mortar_joint_height))
        apply_transformations([R, T1, T2])
        create_brick_and_add_to_assembly("insulated", fixed=True, frame=current_frame)

# Example usage:
add_brick(course_is_odd, brick_in_course_is_odd, current_frame)
# ---------- end python_3 ----------

# ---- group: Network Artist
show = BooleanToggle(False)
draw = GhPythonScript(assembly=brick_assembly.brick_assembly, show_network=show, key=Slider(26, range=0..47))  # -> nodes, edges, current_node, current_node_neighbors; inputs key: Int32
# ---------- draw: Python ----------
import sys, os
import ghpythonlib.components as ghcomp
from compas.datastructures import Network
from compas_ghpython.artists import NetworkArtist
from compas_rhino.geometry import RhinoLine

import compas_ghpython
import Rhino.Geometry as rg


data = assembly.network.to_data()
network = Network.from_data(data)

print assembly.network.number_of_nodes()

def draw_network(network):
    """Draw a network in Grasshopper.
    """
    points = []
    for key, attr in network.nodes(True):
        points.append({
            'pos': network.node_coordinates(key),
        })

    lines = []
    for (u, v), attr in network.edges(True):
        lines.append({
            'start': network.node_coordinates(u),
            'end': network.node_coordinates(v),
        })

    points_rg = compas_ghpython.draw_points(points)
    lines_rg = compas_ghpython.draw_lines(lines)

    return points_rg, lines_rg

if show_network:
    nodes, edges = draw_network(network)
    
    current_node = {'pos': network.node_coordinates(key), 'radius': 0.03}
    current_node = compas_ghpython.draw_spheres([current_node])
    
    current_node_neighbors_keys = network.neighbors(key)
    current_node_neighbors = [{'pos': network.node_coordinates(key), 'radius': 0.02} for key in current_node_neighbors_keys]
    current_node_neighbors = compas_ghpython.draw_spheres(current_node_neighbors)
# ---------- end draw ----------
pt_3 = Point(draw.nodes)
line_2 = Line(draw.edges)
brep_2 = Brep(draw.current_node_neighbors)
brep_3 = Brep(draw.current_node)

# ----
key = Slider(358, range=0..388)
till_key = Button()
start = Button()
reset = Button()
stop = Button()
back = Button()
step = Button()
full = Button()
list = ValueList({"20", "50", "100", "500", "1000", "5000"}, selected="1000")

python_4 = GhPythonScript(key=Slider(1, range=0..3))  # -> out, reference_model, planes; disabled
# ---------- python_4: Python ----------
import Rhino.Geometry as rg
from compas.geometry import Point
from compas.geometry import Translation, Frame, Point, Rotation, Transformation
from compas_ghpython import draw_frame
from compas.artists import Artist
from compas.datastructures import Network
from climate_active_envelopes.assembly import ReferenceModel, Assembly
from climate_active_envelopes.assembly import ReferenceElement, Brick
import math as m

assembly = Assembly()

reference_element = reference_model.element(key)


#reference_element.generate_brick_assembly()


#def generate_brick_assembly_stretcher_header_bond(brick_dimensions={"length": 0.24, "width": 0.115, "height": 0.071, "joint_height": 0.01}):
    
brick_length = 0.24
brick_height = 0.071
brick_width = 0.115
mortar_joint_height = 0.01
frame = reference_element.frame

courses = int(reference_element.height / (brick_height + mortar_joint_height/2))
bricks_per_course = int(reference_element.length / ((brick_length + brick_width)/2 + mortar_joint_height))

frames_grid = []
for course in range(courses):
    z_val = course * (brick_height + mortar_joint_height)
    course_is_odd = course%2 == 0
    course_is_even = course%2 == 1

    frames = []
    for brick in range(bricks_per_course):
        x_val = brick * ((brick_length + brick_width)/2 + mortar_joint_height)
        translation_vector = reference_element.frame.xaxis * x_val + reference_element.frame.zaxis * z_val
        T = Translation.from_vector(translation_vector)
        f1 = reference_element.frame.transformed(T)
        brick_in_course_is_odd = brick%2 == 0
        brick_in_course_is_even = brick%2 == 1

        if course_is_odd:
            if brick_in_course_is_odd: 
                T = Translation.from_vector(f1.yaxis *+ (brick_length/4 + mortar_joint_height/4))
                R = Rotation.from_axis_and_angle(f1.zaxis, m.radians(90), point=f1.point)
                f1 = f1.transformed(T*R) #brick_full, alternating


#                T_my_brick = Transformation.from_frame_to_frame(brick_full.frame, f1)
#                brick_full.transformed(T_my_brick)
#                assembly.add_element(brick_full, attr_dict={"brick_type": "full"})


                f4 = f1.copy() 
                T = Translation.from_vector(f4.xaxis *+ (brick_length + mortar_joint_height))
                f4 = f4.transformed(T)
                frames.append(f4) #brick insulated

            if brick_in_course_is_even:
                f2 = f1.copy()
                R = Rotation.from_axis_and_angle(f1.zaxis, m.radians(90), point=f2.point)
                T1 = Translation.from_vector(f2.yaxis * (brick_width/2 + mortar_joint_height/2))
                T2 = Translation.from_vector(f2.xaxis * ((brick_length/2+brick_width/2) + mortar_joint_height))
                f2 = f2.transformed(R*T1*T2)
                frames.append(f2) #brick insulated

                f3 = f2.copy()
                T = Translation.from_vector(f3.yaxis*- (brick_width+mortar_joint_height))
                f3 = f3.transformed(T)
                frames.append(f3) #brick insulated

                f5 = f1.copy()
                T = Translation.from_vector(f5.yaxis*+((brick_length+ brick_width) + mortar_joint_height*2))
                f5 = f5.transformed(T)
                frames.append(f5) #brick insulated

        if course_is_even:
            if brick_in_course_is_even:
                T = Translation.from_vector(f1.yaxis *+ (brick_length/4 + mortar_joint_height/4) )
                R = Rotation.from_axis_and_angle(f1.zaxis, m.radians(90), point=f1.point)
                f1 = f1.transformed(T*R) #brick_full, alternating

                f4 = f1.copy()
                T = Translation.from_vector(f4.xaxis*+(brick_length + mortar_joint_height))
                f4 = f4.transformed(T)
                frames.append(f4) #brick insulated

            if brick_in_course_is_odd: 
                f2 = f1.copy()
                R = Rotation.from_axis_and_angle(f2.zaxis, m.radians(90), point=f2.point)
                T1 = Translation.from_vector(f2.yaxis *+ (brick_width/2 + mortar_joint_height/2))
                T2 = Translation.from_vector(f2.xaxis *+ ((brick_length/2+brick_width/2) + mortar_joint_height))
                f2 = f2.transformed(R*T1*T2)
                frames.append(f2) #brick insulated

                f3 = f2.copy()
                T = Translation.from_vector(f3.yaxis*- (brick_width+mortar_joint_height))
                f3 = f3.transformed(T)
                frames.append(f3) #brick insulated

                f5 = f1.copy()
                T = Translation.from_vector(f5.yaxis*+((brick_length+ brick_width) + mortar_joint_height*2))
                f5 = f5.transformed(T)
                frames.append(f5) #brick insulated

        frames.append(f1) 
    frames_grid.append(frames)





#for i, row in enumerate(frame_grid): # number of layers and all planes
# for j, frame in enumerate(row): #j = planes / layer
#
#     T = Transformation.from_frame_to_frame(Frame.worldXY(), frame)
#
#     if i%2 == 1 and j%2 == 1 and j%3 != 1:
#         c = brick_full.transformed(T)
#         my_brick = Brick.from_dimensions(frame, brick_dimensions["length"], brick_dimensions["width"], brick_dimensions["height"], brick_dimensions["joint_height"])
#         assembly.add_element(my_brick, attr_dict={"brick_type": "full"})
#     elif i%2 == 0 and j%2 == 1 and j%3 != 0:
#         c = brick_full.transformed(T)
#         assembly.add_element(c)
#     else:
#         c = brick_insulated.transformed(T)
#         assembly.add_element(c)



#only to vizualize in rhino!!!
planes_grid = []
for course_frames in frames_grid:
    course_planes = []
    for frame in course_frames:
        origin = rg.Point3d(frame.point.x, frame.point.y, frame.point.z)
        xaxis = rg.Vector3d(frame.xaxis.x, frame.xaxis.y, frame.xaxis.z)
        yaxis = rg.Vector3d(frame.yaxis.x, frame.yaxis.y, frame.yaxis.z)
        plane = rg.Plane(origin, xaxis, yaxis)
        course_planes.append(plane)
    planes_grid.append(course_planes)

def list_from_2darray(array):
    return [item for sublist in array for item in sublist]
planes = list_from_2darray(planes_grid)
# ---------- end python_4 ----------
assembly = GhPythonScript()  # -> out, assembly; inputs plane_grid: list, params_grid: list, values: list; disabled
# ---------- assembly: Python ----------
import Rhino.Geometry as rg
import math as m
from compas.geometry import Frame, Point, Rotation, Transformation, Translation
from compas.utilities import normalize_values
from climate_active_envelopes.assembly import Assembly

#from climate_active_envelopes.assembly import BRICK_Assembly as Assembly

length = assembly.get_attribute('length')
height = assembly.get_attribute('height')
width = assembly.get_attribute('width')
mortar = assembly.get_attribute('mortar')

if generate:
    for i, row in enumerate(plane_grid): # number of layers and all planes
        for j, plane in enumerate(row): # j = planes / layer
            frame = Frame(plane.Origin, plane.XAxis, plane.YAxis)
            frame_pt = frame.point

            if transform == True:
                if i % 2 == 0 and j % 3 == 1 and j % 2 == 1:
                    trans_val = params_grid[i]  # Access the trans_val from params_grid
                    print trans_val
                    plane.Translate(plane.XAxis * - trans_val)

                if i % 2 == 1 and j % 3 != 0 and j % 3 != 1 and j % 2 == 1:
                    trans_val = params_grid[i]  # Access the trans_val from params_grid
                    plane.Translate(plane.XAxis * - trans_val)

                T = Transformation.from_frame_to_frame(Frame.worldXY(), Frame(plane.Origin, plane.XAxis, plane.YAxis))
            else: 
                T = Transformation.from_frame_to_frame(Frame.worldXY(), frame)

            if i % 2 == 1 and j % 2 == 1 and j % 3 != 1:
                c = elem_full.transformed(T)
                assembly.add_element(c)
            if i % 2 == 0 and j % 2 == 1 and j % 3 != 0:
                c = elem_full.transformed(T)
                assembly.add_element(c)
            else:
                c = elem_ins.transformed(T)
                assembly.add_element(c)

#if generate:
#    for i, row in enumerate(plane_grid): # number of layers and all planes
#        for j, plane in enumerate(row): # j = planes / layer
#            frame = Frame(plane.Origin, plane.XAxis, plane.YAxis)
#            frame_pt = frame.point
#
#            if transform == True:
#                for value in values:
#                    dist = value
#                    print dist
#                if i % 2 == 0 and j % 3 == 1 and j % 2 == 1:
#                    #trans_val = params_grid[i][j]  # Access the trans_val from params_grid
#                    plane.Translate(plane.XAxis *- m.radians(dist*10))
#
#                if i % 2 == 1 and j % 3 != 0 and j % 3 != 1 and j % 2 == 1:
#                    #trans_val = params_grid[i][j]  # Access the trans_val from params_grid
#                    plane.Translate(plane.XAxis *- m.radians(dist*10))
#
#                T = Transformation.from_frame_to_frame(Frame.worldXY(), Frame(plane.Origin, plane.XAxis, plane.YAxis))
#            else: 
#                T = Transformation.from_frame_to_frame(Frame.worldXY(), frame)
#
#            if i % 2 == 1 and j % 2 == 1 and j % 3 != 1:
#                c = elem_full.transformed(T)
#                assembly.add_element(c)
#            elif i % 2 == 0 and j % 2 == 1 and j % 3 != 0:
#                c = elem_full.transformed(T)
#                assembly.add_element(c)
#            else:
#                c = elem_ins.transformed(T)
#                assembly.add_element(c)



#if generate:
#    for i, row in enumerate(plane_grid): # number of layers and all planes
#        for j, plane in enumerate(row): #j = planes / layer
#            frame = Frame(plane.Origin, plane.XAxis, plane.YAxis)
#            frame_pt = frame.point
#
#            if transform == True:
#                for t_pt in t_pts:
#                    dist =  t_pt.DistanceTo(rg.Point3d(frame.point[0], frame.point[1], frame.point[2]))
#
#                if i%2 == 0 and j%3 == 1 and j%2 == 1:
#                    plane.Translate(plane.XAxis*-m.radians(dist*2))
#
#                if i%2 == 1  and j%3 != 0 and j%3 != 1 and j%2 == 1:
#                    plane.Translate(plane.XAxis*-m.radians(dist*2))
#                T = Transformation.from_frame_to_frame(Frame.worldXY(), Frame(plane.Origin, plane.XAxis, plane.YAxis))
#            else: 
#                T = Transformation.from_frame_to_frame(Frame.worldXY(), frame)
#
#
#            if i%2 == 1 and j%2 == 1 and j%3 != 1:
#                c = elem_full.transformed(T)
#                assembly.add_element(c)
#            elif i%2 == 0 and j%2 == 1 and j%3 != 0:
#                c = elem_full.transformed(T)
#                assembly.add_element(c)
#            else:
#                c = elem_ins.transformed(T)
#                assembly.add_element(c)


#for i, row in enumerate(plane_grid):
#    params_row = []
#    for j, plane in enumerate(row):
#        frame = Frame(plane.Origin, plane.XAxis, plane.YAxis)
#        frame_pt = frame.point
#
#        if i%2 == 0 and j%3 == 1 and j%2 == 1:
#            trans_val_odd = params_per_row[j]
#            plane.Translate(plane.XAxis * - trans_val_odd)
#
#        if i%2 == 1  and j%3 != 0 and j%3 != 1 and j%2 == 1:
#            trans_val_even = params_per_row[j]
#            plane.Translate(plane.XAxis * - trans_val_even)
#
#        T = Transformation.from_frame_to_frame(Frame.worldXY(), Frame(plane.Origin, plane.XAxis, plane.YAxis))
#    else: 
#        T = Transformation.from_frame_to_frame(Frame.worldXY(), frame)
#
#    
#        c = elem_full.transformed(T)
#        assembly.add_element(c)
    
#    if i%2 == 1 and j%2 == 1 and j%3 != 1:
#        c = elem_full.transformed(T)
#        assembly.add_element(c)
#    elif i%2 == 0 and j%2 == 1 and j%3 != 0:
#        c = elem_full.transformed(T)
#        assembly.add_element(c)
#    else:
#        c = elem_ins.transformed(T)
#        assembly.add_element(c)
# ---------- end assembly ----------

counter = CountThroughList(
    assembly=brick_assembly.brick_assembly,
    start=start,
    stop=stop,
    step=step,
    step_back=back,
    reset=reset,
    full=full,
    till_key=till_key,
    key=key,
    interval=list)  # -> item, counter; inputs start: Boolean, stop: Boolean, step_back: Boolean, key: Int32
# ---------- counter: Python ----------
from scriptcontext import sticky as st
from compas_ghpython import update_component


L = list(assembly.elements())
# store data in component
guid = str(ghenv.Component.InstanceGuid)
counter_key = "counter_" + guid
running_key = "running_" + guid

if counter_key not in st:
    st[counter_key] = 0

if running_key not in st:
    st[running_key] = False
    

if st[running_key]:
    if st[counter_key] < len(L) - 1:
        st[counter_key] += 1
        update_component(ghenv, interval)
    else:
        st[counter_key] = 0
        st[running_key] = False
    
    
if start:
    st[running_key] = True

if stop:
    st[running_key] = False

if step:
    if st[counter_key] < len(L) - 1:
        st[counter_key] += 1

if step_back:
    if  0 < st[counter_key] < len(L):
        st[counter_key] -= 1

if reset:
    st[counter_key] = 0

if till_key:
    st[counter_key] = key

if full:
    st[counter_key] = len(L)-1

if len(L):
    item = L[st[counter_key]]



#st["visualisation_counter"] = st[counter_key]
#st[counter_key]= 500
counter = st[counter_key]
# ---------- end counter ----------
idx = Panel(counter.counter)

# ---- group: Assembly Artist
show_2 = BooleanToggle(True)
show_3 = BooleanToggle(True)
show_4 = BooleanToggle(False)
draw_2 = PythonScript(
    assembly=brick_assembly.brick_assembly,
    show_all=show_2,
    show_current=show_3,
    show_counter=show_4,
    counter=counter.counter)  # -> G, G_element, tool_planes_WCS, current_tool_plane; inputs counter: Int32
# ---------- draw_2: Python ----------
import os
import sys

import math

from compas.colors import Color
from compas.artists import Artist
from compas_ghpython.artists import NetworkArtist



G = []
G_element = []
#color = Color.from_rgb255(220,165,165)

key_index = assembly.network.key_index()
keys = [key_index[key] for key in assembly.network.nodes()]
elements = [assembly.element(key) for key in keys]
#print elements
#print([(e.gripping_frame) for e in elements])

tool_planes_WCS = [Artist(e.tool_frame).draw() for e in elements]

current_tool_plane = tool_planes_WCS[counter]

if show_all and not show_counter:
    for element in elements:
        mesh = Artist(element.mesh).draw(Color.from_rgb255(220,165,165))
        G.append(mesh)

if show_counter:
    for element in elements[0:counter+1]:
        mesh = Artist(element.mesh).draw(Color.from_rgb255(220,165,165))
        G.append(mesh)

if show_current:
    element = assembly.element(counter)
    print element
    mesh = Artist(element.mesh).draw(Color.from_rgb255(41,49,51))
    G_element.append(mesh)


#    course = assembly.network.node_attribute(key=counter, name='course')
#    keys_in_course = list(assembly.network.nodes_where({'course': course}))
#    elements = [assembly.element(key) for key in keys_in_course]
#    for element in elements:
#        mesh = Artist(element.mesh).draw(color)
#        G.append(mesh)
# ---------- end draw_2 ----------
geo = Geometry(draw_2.G)
pln_5 = Plane(draw_2.tool_planes_WCS)
geo_2 = Geometry(draw_2.G_element)
pln_6 = Plane(draw_2.current_tool_plane)

# ----
pln_7 = Plane(python_4.planes)

# ---- group: assembly structure
transf = BooleanToggle(False)  # disabled
button = Button()  # disabled
assembly_2 = GhPythonScript(generate=button, transform=transf)  # -> assembly; inputs t_pts: list of Point3d, plane_grid: list, params_grid: list; disabled
# ---------- assembly_2: Python ----------
import Rhino.Geometry as rg
import math as m
from compas.geometry import Frame, Point, Rotation, Transformation, Translation
from compas.utilities import normalize_values
#from climate_aware_robotic_envelope.assembly import Assembly

#from climate_active_envelopes.assembly import BRICK_Assembly as Assembly


length = assembly.get_attribute('length')
height = assembly.get_attribute('height')
width = assembly.get_attribute('width')
mortar = assembly.get_attribute('mortar')

"""
c_pts = []
for j, face in enumerate(mesh_wall.faces()):
    vertex_centroid = mesh_wall.face_centroid(face)
    points = rg.Point3d(vertex_centroid[0],vertex_centroid[1], vertex_centroid[2])
    c_pts.append(points)

for i, points in enumerate(c_pts):
    transf_values = normalize_values(transf_values, -0.10, 0.0)
    t_val = transf_values[i]
    t_pl = rg.Plane(rg.Point3d(points[0],t_val,points[2]), rg.Vector3d(1, 0, 0), rg.Vector3d(0, 1, 0))
    t_frame = Frame(t_pl.Origin, t_pl.XAxis, t_pl.YAxis)
"""
if generate:
    for i, row in enumerate(plane_grid): # number of layers and all planes
        for j, plane in enumerate(row): #j = planes / layer
            frame = Frame(plane.Origin, plane.XAxis, plane.YAxis)
            frame_pt = frame.point

            if transform == True:
                for t_pt in t_pts:
                    dist =  t_pt.DistanceTo(rg.Point3d(frame.point[0], frame.point[1], frame.point[2]))

                if i%2 == 0 and j%3 == 1 and j%2 == 1:
                    plane.Translate(plane.XAxis*-m.radians(dist*2))

                if i%2 == 1  and j%3 != 0 and j%3 != 1 and j%2 == 1:
                    plane.Translate(plane.XAxis*-m.radians(dist*2))
                T = Transformation.from_frame_to_frame(Frame.worldXY(), Frame(plane.Origin, plane.XAxis, plane.YAxis))
            else: 
                T = Transformation.from_frame_to_frame(Frame.worldXY(), frame)


            if i%2 == 1 and j%2 == 1 and j%3 != 1:
                c = elem_full.transformed(T)
                assembly.add_element(c)
            elif i%2 == 0 and j%2 == 1 and j%3 != 0:
                c = elem_full.transformed(T)
                assembly.add_element(c)
            else:
                c = elem_ins.transformed(T)
                assembly.add_element(c)
# ---------- end assembly_2 ----------

# ----
python_5 = GhPythonScript()  # -> out, a
# ---------- python_5: Python ----------
    @classmethod
    def create_ref_elem(cls, frame, length, height):
        """Class method for constructing a mesh.

        Parameters
        frame, length, height

        :class:`Mesh`
            Mesh datastructure.
        :class:`Frame`
            Origin frame of the element.
        ----------
        """
        element = cls(frame)
        element.mesh = Mesh()
        element._length = length
        element._height = height

        # Add front side vertices
        for i in range(2):
            x = i * length
            for j in range(2):
                z = j * height
                element.mesh.add_vertex(x=x, y=0, z=z)
        # Add front side face
        for i in range(1):
            for j in range(1):
                a = i + j * 2
                b = a + 1
                c = b + 2
                d = a + 2
                element.mesh.add_face([a, b, c, d])
 
        element._source = element.mesh
        return element


    @classmethod
    def create_ref_elem_from_mesh(cls, frame, wall_length, wall_height, brick_length, brick_width, brick_height, mortar):
        """Class method for constructing a mesh.

        Parameters
        frame, length, height

        :class:`Mesh`
            Mesh datastructure.
        :class:`Frame`
            Origin frame of the element.
        ----------
        """

        element = cls(frame)
        element.mesh = Mesh()
        element.length = wall_length
        element.height = wall_height


        step_in_z = brick_height + mortar/2
        step_in_x = (brick_length+brick_width)/2 + mortar
        vertices_per_row = int(wall_length / step_in_x)
        row = int(wall_height / step_in_z)

        #create vertices
        for j in range(row): 
            z = j * step_in_z
            for i in range(vertices_per_row): 
                y = 0
                x = i * step_in_x
                element.mesh.add_vertex(x = x, y = y, z = z) 

        #create faces
        for j in range(row -1):
            for i in range(vertices_per_row - 1):
                a = i + j * vertices_per_row
                b = a + vertices_per_row
                c = b + 1
                d = a + 1
                element.mesh.add_face([a, b, c, d])
        element._source = element.mesh
        return element
# ---------- end python_5 ----------
show_5 = BooleanToggle(True)
show_6 = BooleanToggle(True)
step_2 = Button()
back_2 = Button()
python_6 = GhPythonScript(reference_model=python_5.out, step=step_2, back=back_2)  # -> out, counter
# ---------- python_6: Python ----------
from scriptcontext import sticky as st
from compas_ghpython import update_component

L = list(reference_model.elements())
# store data in component
guid = str(ghenv.Component.InstanceGuid)
counter_key = "counter_" + guid
running_key = "running_" + guid

if counter_key not in st:
    st[counter_key] = 0

if running_key not in st:
    st[running_key] = False

if st[running_key]:
    if st[counter_key] < len(L) - 1:
        st[counter_key] += 1
        update_component(ghenv, interval)
    else:
        st[counter_key] = 0
        st[running_key] = False

if step:
    if st[counter_key] < len(L) - 1:
        st[counter_key] += 1

if back:
    if  0 < st[counter_key] < len(L):
        st[counter_key] -= 1

counter = st[counter_key]
# ---------- end python_6 ----------

show_7 = BooleanToggle(True)
draw_3 = GhPythonScript(reference_model=python_5.out, show_network=show_7, counter=python_6.counter)  # -> nodes, edges, current_node, current_node_neighbors, labels; inputs counter: Int32
# ---------- draw_3: Python ----------
import sys, os
import ghpythonlib.components as ghcomp
from compas.datastructures import Network
from compas_ghpython.artists import NetworkArtist
from compas_rhino.geometry import RhinoLine

import compas_ghpython
import Rhino.Geometry as rg


data = reference_model.network.to_data()
network = Network.from_data(data)

#print reference_model.network.number_of_nodes()

def draw_network(network):
    """Draw a network in Grasshopper.
    """
    points = []
    for counter, attr in network.nodes(True):
        points.append({
            'pos': network.node_coordinates(counter),
        })

    lines = []
    for (u, v), attr in network.edges(True):
        lines.append({
            'start': network.node_coordinates(u),
            'end': network.node_coordinates(v),
        })

    points_rg = compas_ghpython.draw_points(points)
    lines_rg = compas_ghpython.draw_lines(lines)

    return points_rg, lines_rg

if show_network:
    nodes, edges = draw_network(network)
    
    current_node = {'pos': network.node_coordinates(counter), 'radius': 0.1}
    current_node = compas_ghpython.draw_spheres([current_node])
    
    current_node_neighbors_counters = network.neighbors(counter)
    current_node_neighbors = [{'pos': network.node_coordinates(counter), 'radius': 0.2} for counter in current_node_neighbors_counters]
    current_node_neighbors = compas_ghpython.draw_spheres(current_node_neighbors)

    labels = [counter for counter in network.nodes()]
# ---------- end draw_3 ----------
pt_4 = Point(draw_3.nodes)
brep_4 = Brep(draw_3.current_node_neighbors)
line_3 = Line(draw_3.edges)
brep_5 = Brep(draw_3.current_node)
tag = TextTag(Location=draw_3.nodes, Text=draw_3.labels)

draw_4 = PythonScript(reference_model=reference_model.reference_model, show_all=show_5, show_current=show_6, counter=python_6.counter)  # -> ref_elems, ref_elem, planes, current_plane; inputs counter: Int32
# ---------- draw_4: Python ----------
import os
import sys

import math

from compas.colors import Color
from compas.artists import Artist
from compas_ghpython.artists import NetworkArtist


ref_elems = []
ref_elem = []

key_index = reference_model.network.key_index()
keys = [key_index[key] for key in reference_model.network.nodes()]
elements = [reference_model.element(key) for key in keys]

planes = [Artist(e.frame).draw() for e in elements]
current_plane = planes[counter]


if show_all:
    for element in elements:
        mesh = Artist(element.mesh).draw(Color.from_rgb255(220,165,165))
        ref_elems.append(mesh)


if show_current:
    element = reference_model.element(counter)
    mesh = Artist(element.mesh).draw(Color.from_rgb255(41,49,51))
    ref_elem.append(mesh)
# ---------- end draw_4 ----------
geo_3 = Geometry(draw_4.ref_elems)
geo_4 = Geometry(draw_4.ref_elem)
pln_8 = Plane(draw_4.planes)
pln_9 = Plane(draw_4.current_plane)

# ==== cluster Cluster
epw_file = ClusterInput()
importepw = LBImportEPW(epw_file=epw_file)  # -> location, dry_bulb_temperature, dew_point_temperature, relative_humidity, wind_speed, wind_direction, direct_normal_rad, diffuse_horizontal_rad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; plug-in component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
start_month = ClusterInput()
start_day = ClusterInput()
start_hour = ClusterInput()
end_month = ClusterInput()
end_day = ClusterInput()
end_hour = ClusterInput()
analysisperiod = LBAnalysisPeriod(
    start_month=start_month,
    start_day=start_day,
    start_hour=start_hour,
    end_month=end_month,
    end_day=end_day,
    end_hour=end_hour)  # -> period, hoys, dates; plug-in component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
north = ClusterInput()
sunpath = LBSunPath(north=north, location=importepw.location, hoys=analysisperiod.hoys, scale=0.05)  # -> out, vectors, altitudes, azimuths, hoys, sun_pts, analemma, daily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; plug-in component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
index = ClusterInput()
colrange = LBColorRange(index=index)  # -> colors; plug-in component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
north_2 = ClusterInput()
legendpar = LBLegendParameters(colors=colrange)  # -> leg_par; plug-in component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
skymatrix = LBCumulativeSkyMatrix(
    north=north_2,
    location=importepw.location,
    direct_rad=importepw.direct_normal_rad,
    diffuse_rad=importepw.diffuse_horizontal_rad,
    hoys=analysisperiod.hoys)  # -> out, sky_mtx; plug-in component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
geometry = ClusterInput()
context = ClusterInput()
grid_size = ClusterInput()
run = ClusterInput()
offset_dist = ClusterInput()
incidentradiation = LBIncidentRadiation(
    sky_mtx=skymatrix.sky_mtx,
    geometry=flatten(geometry),
    context=flatten(context),
    grid_size=grid_size,
    offset_dist=offset_dist,
    legend_par=legendpar,
    run=run)  # -> report, points, results, total, mesh, legend, title, int_mtx; plug-in component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
legend = ClusterOutput(incidentradiation.legend)
points = ClusterOutput(incidentradiation.points)
results = ClusterOutput(incidentradiation.results)
mesh = ClusterOutput(incidentradiation.mesh)
