# Grasshopper definition CAE fabtory fabrication setup_updated.ghx (Grasshopper 1.0.7)

# ---- group: import from .json
import = Button(ExpressionNormal="True", ExpressionPressed="False")
py = PythonScript()  # -> HERE, DATA
# ---------- py: Python ----------
import os

HERE = os.path.dirname(ghdoc.Path)
DATA = os.path.abspath(os.path.join(HERE, "..", "data"))
print(HERE)
print(DATA)
# ---------- end py ----------
initial_assembly = GhPythonScript(DATA=py.DATA, filename="brickwall_new.json", import_from_json=import)  # -> out, non_fixed_bricks_keys, assembly; inputs import_from_json: Boolean
# ---------- initial_assembly: Python ----------
import os
import json
from scriptcontext import sticky
#from climate_active_envelopes.assembly import ReferenceElement as Element
from climate_active_envelopes_fabrication.assembly import Assembly


assembly = Assembly()

if import_from_json:
    #filename = "brickwall.json"
    PATH = os.path.join(DATA,"assembly", filename)

    print PATH
    assembly = Assembly.from_json(PATH)
    
    
    with open(PATH, 'r') as f:
        data = json.load(f)
        
    filtered_bricks = {node_id: brick_info for node_id, brick_info in data["node"].items() if not brick_info["fixed"]}
    non_fixed_bricks_keys = list(filtered_bricks.keys())
    print(non_fixed_bricks_keys)
# ---------- end initial_assembly ----------

# ---- group: Reload library
reload = Button()
path = PythonScript()  # -> HERE, DATA, ROBOT_DESCRIPTION
# ---------- path: Python ----------
import os

HERE = os.path.dirname(ghdoc.Path)
DATA = os.path.abspath(os.path.join(HERE, "..", "data"))
ROBOT_DESCRIPTION = os.path.abspath(os.path.join(DATA, "robot_description"))

print(HERE)
print(DATA)
print(ROBOT_DESCRIPTION)
# ---------- end path ----------
py_2 = PythonScript(reload=reload)
# ---------- py_2: Python ----------
if reload:
    from compas_ghpython import unload_modules
    unload_modules("compas")
    unload_modules("compas_fab")
    unload_modules("compas_rrc")
    unload_modules("abb_fabrication_control")
    unload_modules("fabtory_fabrication_control")


    unload_modules("fabrication_manager")
    unload_modules("assembly_information_model")
    unload_modules('climate_active_envelopes_fabrication')
# ---------- end py_2 ----------

# ----
# plane
y_axis = Curve(<curve referenced from the Rhino model>)
x_axis = Curve(<curve referenced from the Rhino model>)
plane = PythonScript(plane_axes=[y_axis, x_axis])  # -> plane; inputs plane_axes: list of Curve
# ---------- plane: Python ----------
import Rhino.Geometry as rg

x_axis, y_axis = plane_axes

x_axis = rg.Line(x_axis.PointAtStart, x_axis.PointAtEnd)
y_axis = rg.Line(y_axis.PointAtStart, y_axis.PointAtEnd)

if x_axis.From.DistanceTo(y_axis.From) < 0.01:
    origin = x_axis.From
    xvec = x_axis.Direction
    yvec = y_axis.Direction
elif x_axis.To.DistanceTo(y_axis.To) < 0.01:
    origin = x_axis.To
    xvec = -x_axis.Direction
    yvec = -y_axis.Direction
elif x_axis.From.DistanceTo(y_axis.To) < 0.01:
    origin = x_axis.From
    xvec = x_axis.Direction
    yvec = -y_axis.Direction
elif x_axis.To.DistanceTo(y_axis.From) < 0.01:
    origin = x_axis.To
    xvec = -x_axis.Direction
    yvec = y_axis.Direction

plane = rg.Plane(origin, xvec, yvec)
# ---------- end plane ----------

# ---- group: import from .json
show = BooleanToggle(True)

# ---- group: import from .json / Network Artist
show_2 = BooleanToggle(True)
draw = GhPythonScript(assembly=initial_assembly.assembly, show_network=show_2, key=Slider(0, range=0..47))  # -> nodes, edges, current_node, current_node_neighbors; inputs key: Int32
# ---------- draw: Python ----------
import sys, os
import ghpythonlib.components as ghcomp
from compas.datastructures import Network
from compas_ghpython.artists import NetworkArtist
from compas_rhino.geometry import RhinoLine

import compas_ghpython
import Rhino.Geometry as rg


data = assembly.network.to_data()
network = Network.from_data(data)

print assembly.network.number_of_nodes()

def draw_network(network):
    """Draw a network in Grasshopper.
    """
    points = []
    for key, attr in network.nodes(True):
        points.append({
            'pos': network.node_coordinates(key),
        })

    lines = []
    for (u, v), attr in network.edges(True):
        lines.append({
            'start': network.node_coordinates(u),
            'end': network.node_coordinates(v),
        })

    points_rg = compas_ghpython.draw_points(points)
    lines_rg = compas_ghpython.draw_lines(lines)

    return points_rg, lines_rg

if show_network:
    nodes, edges = draw_network(network)
    
    current_node = {'pos': network.node_coordinates(key), 'radius': 0.03}
    current_node = compas_ghpython.draw_spheres([current_node])
    
    current_node_neighbors_keys = network.neighbors(key)
    current_node_neighbors = [{'pos': network.node_coordinates(key), 'radius': 0.02} for key in current_node_neighbors_keys]
    current_node_neighbors = compas_ghpython.draw_spheres(current_node_neighbors)
# ---------- end draw ----------
line = Line(draw.edges)
pt = Point(draw.nodes)
brep = Brep(draw.current_node)
brep_2 = Brep(draw.current_node_neighbors)

# ----
# planes from curve
number_slider = Slider(0.13, range=0..1)
crv = Curve(<curve referenced from the Rhino model>)
curve_def = GhPythonScript(crv=crv, div_len=number_slider)  # -> planes; inputs crv: Curve
# ---------- curve_def: Python ----------
import rhinoscriptsyntax as rs
from compas.geometry import Frame, Line, Vector
from compas_ghpython import draw_frame

# dividing curve
pts = rs.DivideCurveLength(crv, div_len)
frames = [Frame([pt.X, pt.Y, pt.Z], [-1, 0, 0], [0, 1, 0]) for pt in pts]
print frames

# for vizualization
planes = []
for frame in frames:
    planes.append(draw_frame(frame))
# ---------- end curve_def ----------

draw_2 = GhPythonScript(planes=curve_def, scale=Slider(0.2, range=0..1))  # -> P, V, C, W; inputs planes: list
# ---------- draw_2: Python ----------
from System.Drawing import Color
from compas_ghpython.artists import FrameArtist

red = Color.FromArgb(255, 0, 0)
green = Color.FromArgb(0, 255, 0)
blue = Color.FromArgb(0, 0, 255)

P = []
V = []
C = []

scale = float(scale)

for plane in planes:
    if not plane:
        continue
    P += [plane.Origin] * 3
    V.append(plane.XAxis * scale)
    V.append(plane.YAxis * scale)
    V.append(plane.ZAxis * scale)
    C += [red, green, blue]

W = 3
# ---------- end draw_2 ----------
vdisex = VectorDisplayEx(Point=draw_2.P, Vector=draw_2.V, Colour=draw_2.C, Width=draw_2.W)

# ---- group: import from .json
key = Slider(358, range=0..388)
till_key = Button()
start = Button()
reset = Button()
stop = Button()
back = Button()
step = Button()
full = Button()
list = ValueList({"20", "50", "100", "500", "1000", "5000"}, selected="1000")

counter = CountThroughList(
    assembly=initial_assembly.assembly,
    start=start,
    stop=stop,
    step=step,
    step_back=back,
    reset=reset,
    full=full,
    till_key=till_key,
    key=key,
    interval=list)  # -> item, counter; inputs start: Boolean, stop: Boolean, step_back: Boolean, key: Int32
# ---------- counter: Python ----------
from scriptcontext import sticky as st
from compas_ghpython import update_component


L = list(assembly.elements())
# store data in component
guid = str(ghenv.Component.InstanceGuid)
counter_key = "counter_" + guid
running_key = "running_" + guid

if counter_key not in st:
    st[counter_key] = 0

if running_key not in st:
    st[running_key] = False
    

if st[running_key]:
    if st[counter_key] < len(L) - 1:
        st[counter_key] += 1
        update_component(ghenv, interval)
    else:
        st[counter_key] = 0
        st[running_key] = False
    
    
if start:
    st[running_key] = True

if stop:
    st[running_key] = False

if step:
    if st[counter_key] < len(L) - 1:
        st[counter_key] += 1

if step_back:
    if  0 < st[counter_key] < len(L):
        st[counter_key] -= 1

if reset:
    st[counter_key] = 0

if till_key:
    st[counter_key] = key

if full:
    st[counter_key] = len(L)-1

if len(L):
    item = L[st[counter_key]]



#st["visualisation_counter"] = st[counter_key]
#st[counter_key]= 500
counter = st[counter_key]
# ---------- end counter ----------
idx = Panel(counter.counter)

# ---- group: import from .json / Assembly Artist
show_3 = BooleanToggle(False)
show_4 = BooleanToggle(True)
show_5 = BooleanToggle(False)
draw_3 = PythonScript(
    assembly=initial_assembly.assembly,
    show_all=show_3,
    show_current=show_4,
    show_counter=show_5,
    show_planes=show,
    counter=counter.counter,
    non_fixed_bricks_keys=initial_assembly.non_fixed_bricks_keys)  # -> G, G_element, tool_planes_WCS, current_tool_plane; inputs counter: Int32, non_fixed_bricks_keys: list
# ---------- draw_3: Python ----------
import os
import sys

import math

from compas.colors import Color
from compas.artists import Artist
from compas_ghpython.artists import NetworkArtist



G = []
G_element = []
#color = Color.from_rgb255(220,165,165)

key_index = assembly.network.key_index()
keys = [key_index[key] for key in assembly.network.nodes()]

keys = [key for key in keys if key in list(map(int, non_fixed_bricks_keys))]


print keys


elements = [assembly.element(key) for key in keys]
#print elements
#print([(e.gripping_frame) for e in elements])


if show_planes:
    tool_planes_WCS = [Artist(e.tool_frame).draw() for e in elements]
    current_tool_plane = tool_planes_WCS[counter]


if show_all and not show_counter:
    for element in elements:
        mesh = Artist(element.mesh).draw(Color.from_rgb255(220,165,165))
        G.append(mesh)
        
        
if show_counter:
    for element in elements[0:counter+1]:
        mesh = Artist(element.mesh).draw(Color.from_rgb255(220,165,165))
        G.append(mesh)
        

if show_current:
    element = assembly.element(counter)
    print element
    mesh = Artist(element.mesh).draw(Color.from_rgb255(41,49,51))
    G_element.append(mesh)
    

#    course = assembly.network.node_attribute(key=counter, name='course')
#    keys_in_course = list(assembly.network.nodes_where({'course': course}))
#    elements = [assembly.element(key) for key in keys_in_course]
#    for element in elements:
#        mesh = Artist(element.mesh).draw(color)
#        G.append(mesh)
# ---------- end draw_3 ----------
geo = Geometry(draw_3.G)
geo_2 = Geometry(draw_3.G_element)
pln = Plane(draw_3.current_tool_plane)
pln_2 = Plane(draw_3.tool_planes_WCS)

# ---- group: import from .json / transformed planes
x_axis_2 = Curve(<curve referenced from the Rhino model>)
y_axis_2 = Curve(<curve referenced from the Rhino model>)
new_position = PythonScript(plane_axes=[x_axis_2, y_axis_2])  # -> plane; inputs plane_axes: list of Curve; same code as plane
transform = GhPythonScript(
    tool_planes=draw_3.tool_planes_WCS,
    target_plane=new_position,
    counter=counter.counter,
    safety_offset=Slider(0, range=0..1))  # -> transformed_planes, current_transformed_plane; inputs tool_planes: list, target_plane: Plane, counter: Int32
# ---------- transform: Python ----------
from compas.geometry import Frame, Transformation, Translation
from compas.artists import Artist



frames = []
target_frame = Frame(target_plane.Origin, target_plane.XAxis, target_plane.YAxis)


for plane in tool_planes:
    frame = Frame(plane.Origin, plane.XAxis, plane.YAxis)
    #T1 = Transformation.from_frame_to_frame(target_frame, Frame.worldXY())
    T1 = Transformation.from_change_of_basis(target_frame, Frame.worldXY())
    T2 = Translation.from_vector(frame.zaxis*+safety_offset)
    frame.transform(T1)
    frame.transform(T2)
    frames.append(frame)



transformed_planes = [Artist(frame).draw() for frame in frames]
current_transformed_plane = transformed_planes[counter]
# ---------- end transform ----------
draw_4 = GhPythonScript(planes=transform.current_transformed_plane, scale=Slider(0.1, range=0..1))  # -> P, V, C, W; inputs planes: list; same code as draw_2
pln_3 = Plane(transform.transformed_planes)
vdisex_2 = VectorDisplayEx(Point=draw_4.P, Vector=draw_4.V, Colour=draw_4.C, Width=draw_4.W)

# ----
# STATE  VIEWER
trigger = Trigger(Interval=100, TimerInterval=100, Target=fabrication_state)
fabrication_state = PythonScript()  # -> out, state, num_tasks, num_current_task, num_tasks_left, log_messages
# ---------- fabrication_state: Python ----------
from scriptcontext import sticky as st

fabrication = st["fabrication"]

if hasattr(fabrication, "task_thread"):
    if fabrication.task_thread.is_alive():
        state = "THREAD RUNNING"
    else:
        state = "THREAD STOPPED"

num_tasks = len(fabrication.tasks)
if fabrication.current_task_key is not None:
    num_current_task = fabrication.current_task_key+1
else:
    num_current_task = 0
num_tasks_left = num_tasks-num_current_task
log_messages = fabrication.log_messages
# ---------- end fabrication_state ----------
state = Panel(fabrication_state.state)
num_tasks = Panel(fabrication_state.num_tasks)
num_current_task = Panel(fabrication_state.num_current_task)
num_tasks_left = Panel(fabrication_state.num_tasks_left)
log_messages = Panel(fabrication_state.log_messages)

x_axis_3 = Curve(<curve referenced from the Rhino model>)
y_axis_3 = Curve(<curve referenced from the Rhino model>)
pick_up = PythonScript(plane_axes=[x_axis_3, y_axis_3])  # -> plane; inputs plane_axes: list of Curve; same code as plane

tcp_speed = Slider(250, range=0..1000)
place_planes = Plane(curve_def)

panel = Panel("""Frame(Point(2.981, -1.762, 0.797), Vector(0.000, -1.000, 0.000), Vector(-1.000, 0.000, 0.000))
Configuration((0.991, -0.634, 0.530, -0.044, -1.901, 1.020, 0.580), (2, 0, 0, 0, 0, 0, 0), ('axis_joint', 'joint_1', 'joint_2', 'joint_3', 'joint_4', 'joint_5', 'joint_6'))""")
panel_2 = Panel("""Frame(Point(2.981, -1.762, 0.797), Vector(0.000, -1.000, 0.000), Vector(-1.000, 0.000, 0.000))
Configuration((1.243, -0.676, 0.436, 0.240, 1.105, -1.061, -0.771), (2, 0, 0, 0, 0, 0, 0), ('axis_joint', 'joint_1', 'joint_2', 'joint_3', 'joint_4', 'joint_5', 'joint_6'))""")
tcp_speed_2 = Slider(250, range=0..1000)
set_tool = Button()
tcp_speed_3 = Slider(250, range=0..1000)
target_plane = Plane(plane)

to_frame = Button()
to_robtarget = Button()

to_single_joints = Button()
to_joints = Button()

set_tool_2 = Button()
python = GhPythonScript()  # -> out, a
# ---------- python: Python ----------
# class ABBTask(Task):
#     def run(self, stop_thread, last_command=None):
#         while not stop_thread():
#             if last_command.done or last_command is None:
#                 self.is_completed = True
#                 return True


class PickBrickTask(ABBTask):
    def __init__(self, robot, cart, configuration, pick_frame, key=None):
        super(PickBrickTask, self).__init__(key)
        self.robot = robot
        self.cart = cart
        self.configuration = configuration
        self.pick_frame = pick_frame

    def run(self, stop_thread):
        #Move to side of brick
        self.configuration = Configuration((4.107, -1.307, 1.022, -0.252, 0.371, -0.805, -1.409), (2, 0, 0, 0, 0, 0, 0), ('axis_joint', 'joint_1', 'joint_2', 'joint_3', 'joint_4', 'joint_5', 'joint_6'))
        ffc.commands.move_to_joints(self.robot, self.configuration)
        print ('robot moved to safety position')

        #Open gripper
        ffc.commands.open(self.robot)
        self.log('gripper is open')

        # Move to safety distance above pick_up_frame
        self.configuration = Configuration((4.200, -1.244, 1.127, -0.345, 0.448, -0.834, -1.458), (2, 0, 0, 0, 0, 0, 0), ('axis_joint', 'joint_1', 'joint_2', 'joint_3', 'joint_4', 'joint_5', 'joint_6'))
        ffc.commands.move_to_joints(self.robot, self.configuration)
        print ('robot moved to safety position')

        # Move to pick_up_frame
        ffc.commands.move_to_robtarget(self.robot, self.pick_frame, self.cart)
        self.log('robot moved to pick_up_frame')
        
        # Close gripper
        ffc.commands.close(self.robot)
        self.log('gripper closed')

        # Move to safety distance above pick_up_frame
        self.configuration = Configuration((4.200, -1.244, 1.127, -0.345, 0.448, -0.834, -1.458), (2, 0, 0, 0, 0, 0, 0), ('axis_joint', 'joint_1', 'joint_2', 'joint_3', 'joint_4', 'joint_5', 'joint_6'))
        ffc.commands.move_to_joints(self.robot, self.configuration)
        print ('robot moved to safety position')

        # Move to side of brick
        self.configuration = Configuration((4.107, -1.307, 1.022, -0.252, 0.371, -0.805, -1.409), (2, 0, 0, 0, 0, 0, 0), ('axis_joint', 'joint_1', 'joint_2', 'joint_3', 'joint_4', 'joint_5', 'joint_6'))
        lc = ffc.commands.move_to_joints(self.robot, self.configuration)
        print ('robot moved to safety position')

        return super(PickBrickTask, self).run(stop_thread, lc)
# ---------- end python ----------

get_frame = Button()
get_robtarget = Button()
get_joints = Button()

x_axis_4 = Curve(<curve referenced from the Rhino model>)  # disabled
y_axis_4 = Curve(<curve referenced from the Rhino model>)  # disabled
pick_up_2 = PythonScript(plane_axes=[x_axis_4, y_axis_4])  # -> plane; inputs plane_axes: list of Curve; disabled; same code as plane

# ---- group: brick mortar tool
geo_3 = Geometry(<brep referenced from the Rhino model>)
mesh = Mesh(geo_3)
mjoin = MeshJoin(Meshes=mesh)
yaxis_line = Curve(<curve referenced from the Rhino model>)
xaxis_line = Curve(<curve referenced from the Rhino model>)
tool = PythonScript(rhmesh=mjoin, xline=xaxis_line, yline=yaxis_line)  # -> values_for_robotstudio, tool; inputs rhmesh: Mesh
# ---------- tool: Python ----------
import Rhino.Geometry as rg
import os, math
from compas.geometry import Frame, Rotation
from compas.datastructures import Mesh
from compas_ghpython.artists import MeshArtist
from compas_fab.robots import Tool
from compas_rhino.geometry import RhinoMesh


xaxis = rg.Line(xline.PointAtStart, xline.PointAtEnd)
yaxis = rg.Line(yline.PointAtStart, yline.PointAtEnd)

if xaxis.From.DistanceTo(yaxis.From) < 0.01:
    origin = xaxis.From
    xaxis = xaxis.Direction
    yaxis = yaxis.Direction
elif xaxis.To.DistanceTo(yaxis.To) < 0.01:
    origin = xaxis.To
    xaxis = -xaxis.Direction
    yaxis = -yaxis.Direction
elif xaxis.From.DistanceTo(yaxis.To) < 0.01:
    origin = xaxis.From
    xaxis = xaxis.Direction
    yaxis = -yaxis.Direction
elif xaxis.To.DistanceTo(yaxis.From) < 0.01:
    origin = xaxis.To
    xaxis = -xaxis.Direction
    yaxis = yaxis.Direction

xaxis.Unitize()
yaxis.Unitize()

ee_frame = Frame(origin, xaxis, yaxis)
ee_mesh = RhinoMesh.from_geometry(rhmesh).to_compas()

tool = Tool(ee_mesh, ee_frame, collision=None, name="t_brick_short")
print ee_frame


values_for_robotstudio = [[round(entry*1000, 5) for entry in list(ee_frame.point)], list(ee_frame.quaternion)]
print values_for_robotstudio
# ---------- end tool ----------
values_for_robotstudio = Panel(tool.values_for_robotstudio)

# ---- group: measurement tool
geo_4 = Geometry(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)
mesh_2 = Mesh(geo_4)
mjoin_2 = MeshJoin(Meshes=mesh_2)
yaxis_line_2 = Curve(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)
xaxis_line_2 = Curve(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)
tool_2 = PythonScript(rhmesh=mjoin_2, xline=xaxis_line_2, yline=yaxis_line_2)  # -> values_for_robotstudio, tool; inputs rhmesh: Mesh
# ---------- tool_2: Python ----------
import Rhino.Geometry as rg
import os, math
from compas.geometry import Frame, Rotation
from compas.datastructures import Mesh
from compas_ghpython.artists import MeshArtist
from compas_fab.robots import Tool
from compas_rhino.geometry import RhinoMesh

xaxis = rg.Line(xline.PointAtStart, xline.PointAtEnd)
yaxis = rg.Line(yline.PointAtStart, yline.PointAtEnd)

if xaxis.From.DistanceTo(yaxis.From) < 0.01:
    origin = xaxis.From
    xaxis = xaxis.Direction
    yaxis = yaxis.Direction
elif xaxis.To.DistanceTo(yaxis.To) < 0.01:
    origin = xaxis.To
    xaxis = -xaxis.Direction
    yaxis = -yaxis.Direction
elif xaxis.From.DistanceTo(yaxis.To) < 0.01:
    origin = xaxis.From
    xaxis = xaxis.Direction
    yaxis = -yaxis.Direction
elif xaxis.To.DistanceTo(yaxis.From) < 0.01:
    origin = xaxis.To
    xaxis = -xaxis.Direction
    yaxis = yaxis.Direction

xaxis.Unitize()
yaxis.Unitize()

ee_frame = Frame(origin, xaxis, yaxis)
ee_mesh = RhinoMesh.from_geometry(rhmesh).to_compas()

tool = Tool(ee_mesh, ee_frame, collision=None, name="t_measurement")

values_for_robotstudio = [[round(entry*1000, 5) for entry in list(ee_frame.point)], list(ee_frame.quaternion)]
print values_for_robotstudio
# ---------- end tool_2 ----------
values_for_robotstudio_2 = Panel(tool_2.values_for_robotstudio)

# ---- group: concrete extruder tool
geo_5 = Geometry(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)
mesh_3 = Mesh(geo_5)
mjoin_3 = MeshJoin(Meshes=mesh_3)
yaxis_line_3 = Curve(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)
xaxis_line_3 = Curve(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)
tool_3 = PythonScript(rhmesh=mjoin_3, xline=xaxis_line_3, yline=yaxis_line_3)  # -> values_for_robotstudio, tool; inputs rhmesh: Mesh
# ---------- tool_3: Python ----------
import Rhino.Geometry as rg
import os, math
from compas.geometry import Frame, Rotation
from compas.datastructures import Mesh
from compas_ghpython.artists import MeshArtist
from compas_fab.robots import Tool
from compas_rhino.geometry import RhinoMesh


xaxis = rg.Line(xline.PointAtStart, xline.PointAtEnd)
yaxis = rg.Line(yline.PointAtStart, yline.PointAtEnd)

if xaxis.From.DistanceTo(yaxis.From) < 0.01:
    origin = xaxis.From
    xaxis = xaxis.Direction
    yaxis = yaxis.Direction
elif xaxis.To.DistanceTo(yaxis.To) < 0.01:
    origin = xaxis.To
    xaxis = -xaxis.Direction
    yaxis = -yaxis.Direction
elif xaxis.From.DistanceTo(yaxis.To) < 0.01:
    origin = xaxis.From
    xaxis = xaxis.Direction
    yaxis = -yaxis.Direction
elif xaxis.To.DistanceTo(yaxis.From) < 0.01:
    origin = xaxis.To
    xaxis = -xaxis.Direction
    yaxis = yaxis.Direction

xaxis.Unitize()
yaxis.Unitize()

ee_frame = Frame(origin, xaxis, yaxis)
ee_mesh = RhinoMesh.from_geometry(rhmesh).to_compas()

tool = Tool(ee_mesh, ee_frame, collision=None, name="t_concreteextruder")

values_for_robotstudio = [[round(entry*1000, 5) for entry in list(ee_frame.point)], list(ee_frame.quaternion)]
print values_for_robotstudio
# ---------- end tool_3 ----------
values_for_robotstudio_3 = Panel(tool_3.values_for_robotstudio)

# ----
number_slider_2 = Slider(0.2, range=0..1)  # disabled

safety_distance = Slider(0.41, range=0..0.5)  # disabled
place_planes_2 = Plane()  # disabled
ghpython_script = GhPythonScript(pick_plane=pick_up_2, place_planes=place_planes_2, safety_distance=safety_distance)  # -> out, pick_frames, place_frames, mortar_frames; inputs pick_plane: Plane, place_planes: list of Plane; disabled
# ---------- ghpython_script: Python ----------
from compas_ghpython.utilities import list_to_ghtree
from compas.geometry import Frame
import fabtory_fabrication_control as ffc
import Rhino.Geometry as rg

pick_frames = []
place_frames = []
mortar_frames = []

safety_pick_plane = rg.Plane((pick_plane.Origin + safety_distance * rg.Vector3d(0,0,1)), pick_plane.XAxis , pick_plane.YAxis)


for place_plane in place_planes:
    safety_place_planes = rg.Plane((place_plane.Origin + safety_distance * rg.Vector3d(0,0,1)), place_plane.XAxis , place_plane.YAxis)

    pick_sequence = ffc.utilities.plane_to_frame(safety_place_planes), ffc.utilities.plane_to_frame(safety_pick_plane), ffc.utilities.plane_to_frame(pick_plane)
    mortar_sequence = ffc.utilities.plane_to_frame(safety_place_planes), ffc.utilities.plane_to_frame(place_plane)
    place_sequence = ffc.utilities.plane_to_frame(safety_pick_plane), ffc.utilities.plane_to_frame(safety_place_planes), ffc.utilities.plane_to_frame(place_plane)

    #print_sequence = place_plane[]

    pick_frames.append(pick_sequence)
    place_frames.append(place_sequence)
    mortar_frames.append(mortar_sequence)
# ---------- end ghpython_script ----------
draw_5 = GhPythonScript(ee_plane=pick_up_2, scale=number_slider_2)  # -> P, V, C, W; inputs ee_plane: list; disabled
# ---------- draw_5: Python ----------
from System.Drawing import Color
from compas_ghpython.artists import FrameArtist

red = Color.FromArgb(255, 0, 0)
green = Color.FromArgb(0, 255, 0)
blue = Color.FromArgb(0, 0, 255)

P = []
V = []
C = []

scale = float(scale)

for plane in ee_plane:
    if not plane:
        continue
    P += [plane.Origin] * 3
    V.append(plane.XAxis * scale)
    V.append(plane.YAxis * scale)
    V.append(plane.ZAxis * scale)
    C += [red, green, blue]

W = 3
# ---------- end draw_5 ----------
vdisex_3 = VectorDisplayEx(Point=draw_5.P, Vector=draw_5.V, Colour=draw_5.C, Width=draw_5.W)  # disabled

filter = StreamFilter(Gate=0, Stream0=tool_2.tool, Stream1=tool_3.tool, Stream2=tool.tool)

# ----
# Tool
panel_3 = Panel("Attach a custom tool")
list_2 = ValueList({"measurement_tool": 0, "parallel_gripper_with_clay_extruder": 1, "parallel_brick_grippers": 2, "perpendicular_gripper_with_clay_extruder": 3}, selected="perpendicular_gripper_with_clay_extruder")
list_3 = ValueList({"nozzle": "t_nozzle", "gripper_625": "t_gripper_625", "gripper_125": "t_gripper_125", "gripper_240": "t_gripper_240"}, selected="gripper_240")
show_6 = BooleanToggle(True)
py_3 = PythonScript()  # -> DATA
# ---------- py_3: Python ----------
import os

#package_path = os.path.dirname(mobile_fabrication_control.__file__)
#DATA = os.path.abspath(os.path.join(package_path,"../../data"))

package_path = ghdoc.Path
# package_path = os.path.dirname(ur_fabrication_control.__file__)
#DATA = os.path.abspath(os.path.join(package_path,"../../data"))

# .stl files not stored in am_hackathon repo. but in mobile_fabrication_control
DATA = os.path.abspath(os.path.join(package_path,"../../../fabtory_fabrication_control/data"))

print(package_path)
print(DATA)
# ---------- end py_3 ----------
tools = PythonScript(data_path=py_3, tool=list_2, tcp_frame=list_3, show=show_6)  # -> values_for_RS, tool, ee_plane, M
# ---------- tools: Python ----------
import os, math
from compas.geometry import Frame, Rotation
from compas.datastructures import Mesh
from compas.datastructures import Mesh
from compas_ghpython.artists import MeshArtist
from compas_fab.robots import Tool
from compas_ghpython.utilities import draw_frame

tolerance = 0

if tool == 0:
    filename = 'measurement_tool_zaxis.stl'
    ee_frame = Frame([0, 0, 0.109], [1, 0, 0], [0, 1, 0])

elif tool == 1:
    filename = 'parallel_gripper_with_clay_extruder.stl'

    if tcp_frame == "t_nozzle":
        ee_frame = Frame([0.301, 0.00, 0.167], [0, 0, 1], [0, -1, 0])

    elif tcp_frame == "t_gripper_625":
        ee_frame = Frame([0.0, 0.52, 0.10], [0, 0, 1], [1, 0, 0])

elif tool == 2:
    filename = 'parallel_brick_grippers.stl'
    if tcp_frame == "t_gripper_125":
        ee_frame = Frame([0.0, 0.533, 0.100], [1, 0, 0], [0, 0, -1])

    elif tcp_frame == "t_gripper_240":
        ee_frame = Frame([0.414, 0.00, 0.100], [0, -1, 0], [0, 0, -1])
        
elif tool == 3:
    filename = 'perpendicular_gripper_with_clay_extruder.stl'
    if tcp_frame == "t_gripper_125":
        ee_frame = Frame([0.0, 0.533, 0.100], [1, 0, 0], [0, 0, -1])

    elif tcp_frame == "t_gripper_240":
        ee_frame = Frame([0.414, 0.00, 0.100], [0, -1, 0], [0, 0, -1])


data_path = os.path.join(data_path, "tool_geometry")
fullfilename = os.path.join(data_path, filename)
#print fullfilename

ee_mesh = Mesh.from_stl(fullfilename)
collision_mesh = ee_mesh

if show:
    artist = MeshArtist(ee_mesh)
    M = artist.draw()

tool = Tool(ee_mesh, ee_frame,  name=tcp_frame)
print tool.name

ee_plane = draw_frame(ee_frame)

values_for_robotstudio = [[round(entry*1000, 5) for entry in list(ee_frame.point)], list(ee_frame.quaternion)]
print values_for_robotstudio
# ---------- end tools ----------
draw_6 = GhPythonScript(ee_plane=tools.ee_plane, scale=Slider(0.2, range=0..1))  # -> P, V, C, W; inputs ee_plane: list; same code as draw_5
mesh_4 = Mesh(tools.M)
remove = Button()
add = Button()
vdisex_4 = VectorDisplayEx(Point=draw_6.P, Vector=draw_6.V, Colour=draw_6.C, Width=draw_6.W)
values_for_robotstudio_4 = Panel(tools.values_for_RS)

plane_2 = Plane(tools.ee_plane)

# ----
# ROS & ABB client
ros_ip = ValueList({"127.0.0.1"}, selected="127.0.0.1")
ros_port = ValueList({"9090"}, selected="9090")
ros = ROSConnect(ip=ros_ip, port=ros_port, connect=Toggle(True))  # -> ros_client, is_connected; inputs port: Int32, connect: Boolean
#   port ip: The ip address ROS. Defaults to 127.0.0.1.
#   port port: The port of ROS. Defaults to 9090.
#   port connect: If True, connects to ROS. If False, disconnects from ROS. Defaults to False.
#   port ros_client: The ROS client.
#   port is_connected: True if connection established.
# ---------- ros: Python ----------
"""
Connect or disconnect to ROS.

COMPAS FAB v0.19.1
"""
from ghpythonlib.componentbase import executingcomponent as component
from scriptcontext import sticky as st

from compas_fab.backends import RosClient
from compas_fab.ghpython.components import create_id


class ROSConnect(component):
    def RunScript(self, ip, port, connect):
        ros_client = None

        ip = ip or '127.0.0.1'
        port = port or 9090

        key = create_id(self, 'ros_client')
        ros_client = st.get(key, None)

        if ros_client:
            st[key].close()
        if connect:
            st[key] = RosClient(ip, port)
            st[key].run(5)

        ros_client = st.get(key, None)
        is_connected = ros_client.is_connected if ros_client else False
        return (ros_client, is_connected)
# ---------- end ros ----------
is_connected = Panel(ros.is_connected)
abb = GhPythonScript(ros_client=ros.ros_client, connect=Toggle(True))  # -> out, abb_client; inputs connect: Boolean
# ---------- abb: Python ----------
import compas_rrc as rrc

if ros_client:
    if ros_client.is_connected and connect: 
        # Create ABB Client
        abb_client = rrc.AbbClient(ros_client, '/rob1')
# ---------- end abb ----------

# ----
# Load Model
# Load robot from local package
load = Button()
list_4 = ValueList({"abb_fabtory"}, selected="abb_fabtory")
units = ValueList({"m": 1, "cm": 100, "mm": 1000}, selected="m")

# ----
# Robot Model
panel_4 = Panel("abb_fabtory.srdf")

load_model = PythonScript(
    path=path.ROBOT_DESCRIPTION,
    package=list_4,
    urdf_name="abb_fabtory.urdf",
    srdf_name=panel_4,
    scale_factor=units,
    load=load)  # -> robot
# ---------- load_model: Python ----------
import os
from scriptcontext import sticky as st
import compas
from compas.robots import RobotModel
from compas.robots import LocalPackageMeshLoader
from compas_fab.robots import Robot
from compas_fab.robots import RobotSemantics
from compas_fab.ghpython import RobotArtist

packages = ["abb_irb6700_support", "abb_end_effectors", "abb_fabtory"]
loaders = []

for package in packages:
    loaders.append(LocalPackageMeshLoader(path, package))

#path directory
package_path = os.path.join(path, package)
print(package_path)

urdf_filename = os.path.join(package_path, "urdf", urdf_name)
srdf_filename = os.path.join(package_path, srdf_name)

assert os.path.isfile(urdf_filename)
assert os.path.isfile(srdf_filename)

compas.PRECISION = '12f'

# store robot in component
guid = str(ghenv.Component.InstanceGuid)
robot_key = "robot_" + guid

if robot_key not in st:
    st[robot_key] = None

#load robot model from urdf
if load:
    model = RobotModel.from_urdf_file(urdf_filename)
    model.load_geometry(*loaders)
    artist = RobotArtist(model)
    semantics = RobotSemantics.from_srdf_file(srdf_filename, model)
    robot = Robot(model, artist, semantics, client=None)

    st[robot_key] = robot
robot = st[robot_key]

#vizualize robot in the right scale of your environment
robot.scale(scale_factor)
# ---------- end load_model ----------

set = PythonScript(robot=load_model, ros_client=ros.ros_client, abb_client=abb.abb_client)  # -> out, robot, main_group_name
# ---------- set: Python ----------
if robot and ros_client and abb_client:
    robot.ros_client = ros_client
    robot.abb_client = abb_client

    robot.info()
    main_group_name = robot.main_group_name
    print robot.info
# ---------- end set ----------

robot_info = Panel(set.out)

attach_remove = PythonScript(robot=load_model, tool=tools.tool, attach=add, remove=remove)  # -> bang
# ---------- attach_remove: Python ----------
if attach:
    robot.attach_tool(tool)

if remove:
    robot.detach_tool()
# ---------- end attach_remove ----------

# ----
# forward kinematics
number_slider_3 = Slider(0, range=-400..400)
# Configuration
number_slider_4 = Slider(0, range=0..4.2)
jp = GhPythonScript()  # -> configuration_values
# ---------- jp: Python ----------
import math
joint_values = [-3.136, -0.328, -1.218, 3.129, 0.852, 0.008]
#joint_values = [math.degrees(j) for j in joint_values]
#joint_positions = [0] * 6

cart = 0
joint_values = [0,0,0,0,0,0]

configuration_values = [cart] + joint_values
# ---------- end jp ----------
forward_kinematics = PythonScript(
    robot=set.robot,
    reset_configuration=Button(),
    configuration_values=jp,
    a_cart=number_slider_4,
    a_a1=Slider(-40.92, range=-180..180),
    a_a2=Slider(0, range=-90..150),
    a_a3=Slider(0, range=-180..180),
    a_a4=Slider(0, range=-400..400),
    a_a5=Slider(0, range=-125..120),
    a_a6=number_slider_3)  # -> full_configuration; inputs reset_configuration: Boolean, configuration_values: list
# ---------- forward_kinematics: Python ----------
import math
import Grasshopper
import copy
from compas.robots import Joint
from compas_fab.robots import Configuration





if reset_configuration:
    j = 0
    for i in range(ghenv.Component.Params.Input.Count):
        nslider = ghenv.Component.Params.Input[i].Sources[0]
        if nslider.GetType() == Grasshopper.Kernel.Special.GH_NumberSlider:
            nslider.TrySetSliderValue(configuration_values[j])
            j += 1


if robot:
    joint_positions = [a_cart, a_a1, a_a2, a_a3, a_a4, a_a5, a_a6]
    #print joint_positions
    joint_positions_degrees = copy.deepcopy(joint_positions)
    joint_types = robot.get_configurable_joint_types()
    #print(joint_types)
    for i, joint_type in enumerate(joint_types):
        if joint_type == Joint.REVOLUTE:
            joint_positions[i] = math.radians(joint_positions[i])
        if joint_type == Joint.PRISMATIC:
            joint_positions[i] = joint_positions[i]
    full_configuration = Configuration(joint_positions, joint_types)
    #print full_configuration
# ---------- end forward_kinematics ----------

# ----
# inverse kinematics
ik = PythonScript(robot=set.robot)  # -> configuration
# ---------- ik: Python ----------
from compas_fab.robots import Configuration

if robot:
    types = robot.get_configurable_joint_types()
    values = [0] * len(types)
    configuration = Configuration(values, types)
    print configuration
    print robot.get_configurable_joint_names()
# ---------- end ik ----------
list_5 = ValueList({"fk_configuration": 0, "robot_configuration": 1}, selected="fk_configuration")
fk_configuration = Data(forward_kinematics)
go_to_start_configuration = BooleanToggle(False)
avoid_collisions = BooleanToggle(False)
filter_2 = StreamFilter(Gate=list_5, Stream0=fk_configuration, Stream1=ik)
inverse_kinematics = GhPythonScript(
    compute=Toggle(True),
    robot=set.robot,
    plane=plane,
    start_configuration=filter_2,
    go_to_start_configuration=go_to_start_configuration,
    avoid_collisions=avoid_collisions,
    group=set.main_group_name)  # -> out, ik_configuration, t0cp; inputs plane: Plane
# ---------- inverse_kinematics: Python ----------
from __future__ import print_function
import logging
from compas.geometry import Frame
from scriptcontext import sticky as st
from compas_ghpython.utilities import draw_frame

LOGGER = logging.getLogger('roslibpy')

#vizualize t0cf
if robot.attached_tool:
    t0cf = Frame(plane.Origin, plane.XAxis, plane.YAxis)
    t0cp = draw_frame(t0cf)
    print (t0cf)


if compute:
    robot.client = robot.ros_client
    if go_to_start_configuration:
        ik_configuration = start_configuration
    else:
        tool_frame = Frame(plane.Origin, plane.XAxis, plane.YAxis)
        ik_configuration = robot.inverse_kinematics(tool_frame,
                                                    start_configuration,
                                                    group=group,
                                                    options={
                                                      'avoid_collisions':avoid_collisions,
                                                      'return_full_configuration':True,
                                                    })        
#group_configuration = robot.get_group_configuration(group, ik_configuration)
#print (group_configuration)
st["ik_configuration"] = ik_configuration

ik_configuration = st["ik_configuration"] 
print(ik_configuration)
# ---------- end inverse_kinematics ----------
out = Panel(inverse_kinematics.out)
draw_7 = GhPythonScript(planes=inverse_kinematics.t0cp, scale=Slider(0.2, range=0..1))  # -> P, V, C, W; inputs planes: list; same code as draw_2
vdisex_5 = VectorDisplayEx(Point=draw_7.P, Vector=draw_7.V, Colour=draw_7.C, Width=draw_7.W)

# ----
# 3>
tasks = GhPythonScript(
    create=Toggle(True),
    robot=set.robot,
    pick_plane=pick_up,
    speed=tcp_speed,
    place_planes=place_planes,
    configuration=forward_kinematics)  # -> tasks; inputs pick_plane: Plane, place_planes: list of Plane
# ---------- tasks: Python ----------
import time
from scriptcontext import sticky as st
from fabrication_manager.task import Task
from climate_active_envelopes_fabrication.tasks import StartConfigurationTask, SetToolTask, PickBrickTask, PlaceBrickTask, SafePositionTask
import abb_fabrication_control as ffc
import compas_rrc as rrc

if create:
    tasks = []
    cart = configuration.joint_values[0]

    # Go to safety configuration
    #task = StartConfigurationTask(robot, configuration)
#    task = SafePositionTask(robot, cart, configuration, key=len(tasks))
#    task.parallelizable = False
#    tasks.append(task)

    for i in range(len(place_planes)):
        print i
        # Set tool
        task = SetToolTask(robot, tool_name='t_gripper_125', key=len(tasks))
        task.parallelizable = False
        tasks.append(task)

        # Pick up bricks
        pick_frame = ffc.utilities.plane_to_frame(pick_plane)
        #print pick_frame
        task = PickBrickTask(robot, cart, configuration, pick_frame=pick_frame, key=len(tasks))
        task.parallelizable = False
        tasks.append(task)

    # Place bricks
        place_frame = ffc.utilities.plane_to_frame(place_planes[i])
        print place_frame
        task = PlaceBrickTask(robot, cart, configuration, place_frame, key=len(tasks))
        task.parallelizable = False
        tasks.append(task)

#        # Go to safety configuration
#        task = StartConfigurationTask(robot, configuration)
#        task.parallelizable = False
#        tasks.append(task)
# ---------- end tasks ----------
start_fabrication = Button()
stop_fabrication = Button()
set_tasks = Button()
reset_2 = Button()
next = Button()
last = Button()
init = Button()
fabricationmanager = PythonScript(
    tasks=tasks,
    init=init,
    parallelize=Toggle(False),
    set_tasks=set_tasks,
    start=start_fabrication,
    stop=stop_fabrication,
    reset_task=reset_2,
    next_task=next,
    prev_task=last)  # -> out, server; inputs tasks: list
# ---------- fabricationmanager: Python ----------
from scriptcontext import sticky as st
from fabrication_manager.fabrication import FabricationManager

if init:
    fabrication = FabricationManager()
    fabrication.parallelize = parallelize
    st["fabrication"] = fabrication

fabrication = st["fabrication"]

if set_tasks:
    print "setting tasks"    
    fabrication.clear_tasks()
    fabrication.set_tasks(tasks)

if start:
    #if robot.is_connected(): #and arduino.is_connected():
    print "starting process"
    fabrication.start()

if stop:
    print "stopping process"
    fabrication.stop()
    
if reset_task:
    print "resetting process"
    fabrication.reset()

if next_task:
    t = fabrication.get_next_task()
    task_state_set(True, t)
    
if reset_task:
    t = fabrication.get_next_task()
    task_state_set(False, t)

if prev_task:
    t = fabrication.get_next_task()
    task_state_set(False, t)
    t = fabrication.tasks[fabrication.current_task_key-1]
    task_state_set(False, t)
    fabrication.get_next_task()

def task_state_set(state, t):
    t.is_completed = state
    t.is_running = False
# ---------- end fabricationmanager ----------
data_recorder = DataRecorder(fabricationmanager.out, DataLimit=-10, RecordData=True)
out_2 = Panel(data_recorder)

list_6 = ValueList({"0 forward_kinematics": 0, "1 inverse_kinematics": 1}, selected="0 forward_kinematics")
fk_configuration_2 = Data(forward_kinematics)
ik_configuration = Data(inverse_kinematics.ik_configuration)
filter_3 = StreamFilter(Gate=list_6, Stream0=fk_configuration_2, Stream1=ik_configuration)

# ----
# Visualisation
show_end_effector_frame = BooleanToggle(True)
show_base_frame = BooleanToggle(False)
show_collision = BooleanToggle(False)
show_frames = BooleanToggle(False)
show_visual = BooleanToggle(True)
show_acm = BooleanToggle(False)
robot_visualize = RobotVisualize(
    robot=set.robot,
    group=set.main_group_name,
    configuration=filter_3,
    redraw=attach_remove,
    show_visual=show_visual,
    show_collision=show_collision,
    show_frames=show_frames,
    show_base_frame=show_base_frame,
    show_end_effector_frame=show_end_effector_frame,
    show_acm=show_acm)  # -> visual, collision, attached_meshes, frames, base_frame, ee_frame; inputs redraw: list, show_visual: Boolean, show_collision: Boolean, show_frames: Boolean, show_base_frame: Boolean, show_end_effector_frame: Boolean, show_acm: Boolean
#   port group: The planning group used for end-effector and base visualization.
#   port configuration: The robot's full configuration.
#   port redraw: A list of attached collision meshes.
#   port show_visual: Whether or not to show the robot's visual meshes.
#   port show_collision: Whether or not to show the robot's collision meshes.
#   port show_frames: Whether or not to show the robot's joint frames.
#   port show_base_frame: Whether or not to show the robot's base frame.
#   port show_end_effector_frame: Whether or not to show the robot's end-effector frame.
#   port show_acm: Whether or not to show the attached collision meshes (if any).
#   port visual: The robot's visual Rhino meshes (if any).
#   port collision: The robot's collision Rhino meshes (if any).
#   port attached_meshes: The attached collision Rhino meshes (if any).
#   port frames: The robot's joint frames as Rhino planes (if any).
#   port base_frame: The robot's base frame as a Rhino plane (if any).
#   port ee_frame: The robot's end-effector frame as a Rhino plane (if any).
# ---------- robot_visualize: Python ----------
"""
Visualizes the robot.

COMPAS FAB v0.19.1
"""
from compas.geometry import Frame
from compas.geometry import Transformation
from compas_ghpython.artists import Artist
from ghpythonlib.componentbase import executingcomponent as component


class RobotVisualize(component):
    def RunScript(self, robot, group, configuration, attached_collision_meshes, show_visual, show_collision,
                  show_frames, show_base_frame, show_end_effector_frame, show_acm):

        visual = None
        collision = None
        attached_meshes = None
        frames = None
        base_frame = None
        ee_frame = None

        if robot:
            show_visual = True if show_visual is None else show_visual
            configuration = configuration or robot.zero_configuration()

            robot.update(configuration, visual=show_visual, collision=show_collision)
            compas_frames = robot.transformed_frames(configuration, group)

            if show_visual:               
                visual = robot.artist.draw_visual()
                

            if show_collision:
                collision = robot.artist.draw_collision()

            if show_base_frame:
                base_compas_frame = compas_frames[0]
                base_frame = Artist(base_compas_frame).draw()

            if show_end_effector_frame:
                ee_compas_frame = robot.forward_kinematics(configuration, group, options=dict(solver='model', link="tool0"))
                #if robot.attached_tool:
                    #ee_compas_frame = robot.from_t0cf_to_tcf([ee_compas_frame])[0]
                ee_frame = Artist(ee_compas_frame).draw()

            if show_frames:
                frames = []
                for compas_frame in compas_frames[1:]:
                    frame = Artist(compas_frame).draw()
                    frames.append(frame)

            if show_acm:
                attached_meshes = []
                for acm in attached_collision_meshes:
                    frame = robot.forward_kinematics(configuration, options=dict(solver='model', link_name=acm.link_name))
                    T = Transformation.from_frame_to_frame(Frame.worldXY(), frame)
                    mesh = acm.collision_mesh.mesh.transformed(T)
                    attached_meshes.append(Artist(mesh).draw())

        return (visual, collision, attached_meshes, frames, base_frame, ee_frame)
# ---------- end robot_visualize ----------
draw_8 = GhPythonScript(planes=[robot_visualize.frames, robot_visualize.base_frame, robot_visualize.ee_frame], scale=Slider(0.2, range=0..1))  # -> P, V, C, W; inputs planes: list; same code as draw_2
geo_6 = Geometry([robot_visualize.visual, robot_visualize.collision, robot_visualize.attached_meshes])
vdisex_6 = VectorDisplayEx(Point=draw_8.P, Vector=draw_8.V, Colour=draw_8.C, Width=draw_8.W)
# Move Control
preview = CustomPreview(Geometry=geo_6, Shader=ColourSwatch(SwatchColor=RGB(207, 157, 160)))

pln_4 = Plane(robot_visualize.ee_frame)

# ----
# Move Joints
tcp_speed_4 = Slider(250, range=0..1000)
movej_command = GhPythonScript(
    robot=set.robot,
    configuration=filter_3,
    speed=tcp_speed_4,
    move_to_joints=to_joints,
    move_single_joints=to_single_joints)  # -> out; inputs move_to_joints: Boolean
# ---------- movej_command: Python ----------
import abb_fabrication_control as ffc
import compas_rrc as rrc


from compas.geometry import Scale
from compas.robots import Joint
import math



# Print text on FlexPenant
# robot.abb_client.send(rrc.PrintText('Welcome TUM to COMPAS_RRC! ;)'))

#print configuration

if move_to_joints:
    #ffc.commands.move_to_joints(robot, configuration, speed=speed, zone=rrc.Zone.FINE)
    ffc.commands.move_to_joints_2(robot, configuration, speed=speed, zone=rrc.Zone.FINE)


#ext_axes = rrc.ExternalAxes.from_configuration(configuration) #store all robot values from configuration
#cart = rrc.ExternalAxes(ext_axes.values[0]) #store cart values from robot values
#joints = rrc.RobotJoints(ext_axes.values[1:]) #store joint values from robot values
#robot.abb_client.send(rrc.MoveToJoints(joints, cart, speed, zone)) #send move to joints command



#joint_goal = movejoints.get_current_joint_values()
#print joint_goal


if move_single_joints:
    pass
    # TODO
# ---------- end movej_command ----------
data_recorder_2 = DataRecorder(movej_command, DataLimit=-10, RecordData=True)
out_3 = Panel(data_recorder_2)

jp_2 = GhPythonScript(robot=set.robot)  # -> full_configurations
# ---------- jp_2: Python ----------
import math
import Grasshopper
import copy
from compas.robots import Joint
from compas_fab.robots import Configuration




"""
joint_values = [-3.136, -0.328, -1.218, 3.129, 0.852, 0.008]
#joint_values = [math.degrees(j) for j in joint_values]
#joint_positions = [0] * 6

configurations_values = []

cart = 0
joint_values = [0,0,0,0,0,0]
configuration_values = [cart] + joint_values

configurations_values.append(configuration_values)

full_configurations = []

for configuration_values in configurations_values:

    joint_positions_degrees = copy.deepcopy(configuration_values)
    joint_types = robot.get_configurable_joint_types()
    #print(joint_types)
    for i, joint_type in enumerate(joint_types):
        if joint_type == Joint.REVOLUTE:
            joint_positions[i] = math.radians(joint_positions[i])
        if joint_type == Joint.PRISMATIC:
            joint_positions[i] = joint_positions[i]
    full_configurations.append(Configuration(joint_positions, joint_types))


if move_to_joints:
    #ffc.commands.move_to_joints(robot, configuration, speed=speed, zone=rrc.Zone.FINE)
    ffc.commands.move_to_joints_2(robot, configuration, speed=speed, zone=rrc.Zone.FINE)
"""





full_configurations = []

c = Configuration((0.937, -1.328, 0.277, 0.786, 0.276, -1.079, -0.134), (2, 0, 0, 0, 0, 0, 0), ('axis_joint', 'joint_1', 'joint_2', 'joint_3', 'joint_4', 'joint_5', 'joint_6'))
full_configurations.append(c)

c = Configuration((1.691, -2.350, -0.365, 0.800, -0.258, -0.483, 0.197), (2, 0, 0, 0, 0, 0, 0), ('axis_joint', 'joint_1', 'joint_2', 'joint_3', 'joint_4', 'joint_5', 'joint_6'))
full_configurations.append(c)

c = Configuration((1.679, -1.497, 0.538, -0.330, -0.150, -1.191, 0.272), (2, 0, 0, 0, 0, 0, 0), ('axis_joint', 'joint_1', 'joint_2', 'joint_3', 'joint_4', 'joint_5', 'joint_6'))
full_configurations.append(c)
# ---------- end jp_2 ----------

# ----
# Move Joints from List
tcp_speed_5 = Slider(250, range=0..1000)
to_joints_2 = Button()
movej_command_2 = GhPythonScript(robot=set.robot, configurations=jp_2, speed=tcp_speed_5, move_to_joints=to_joints_2)  # -> out; inputs configurations: list, move_to_joints: Boolean
# ---------- movej_command_2: Python ----------
import abb_fabrication_control as ffc
import compas_rrc as rrc


if move_to_joints:
    for configuration in configurations:
        ffc.commands.move_to_joints_2(robot, configuration, speed=speed, zone=rrc.Zone.Z200)
# ---------- end movej_command_2 ----------
data_recorder_3 = DataRecorder(movej_command_2, DataLimit=-10, RecordData=True)
out_4 = Panel(data_recorder_3)

# ----
# Move Cartesian from List
to_frames = Button()
to_robtargets = Button()
movel_command = GhPythonScript(
    robot=set.robot,
    configuration=filter_3,
    speed=tcp_speed_2,
    move_to_frames=to_frames,
    move_to_robtargets=to_robtargets,
    set_tool=set_tool_2)  # -> out; inputs target_planes: list of Plane, move_to_frames: Boolean, move_to_robtargets: Boolean
# ---------- movel_command: Python ----------
import compas_rrc as rrc
import abb_fabrication_control as ffc
from compas.geometry import Frame

#set tool in RobotStudio
if set_tool:
    if robot.attached_tool:
        tool_name = robot.attached_tool.name
        done = robot.abb_client.send(rrc.SetTool(tool_name))
        print tool_name
    else:
        robot.abb_client.send(rrc.SetTool("tool0"))

if move_to_frames:
    #transform target plane into target frame
    
    for i, target_plane in enumerate(target_planes):
        if i < len(target_planes)-1:
            zone = rrc.Zone.Z50
        else:
            zone = rrc.Zone.FINE
        print zone
        target_frame = Frame(target_plane.Origin, target_plane.XAxis, target_plane.YAxis)
        #send move to frame command
        ffc.commands.move_to_frame(robot, target_frame, speed=speed, zone=zone, scalefactor=1000)


if move_to_robtargets:
    for i, target_plane in enumerate(target_planes):
        if i < len(target_planes)-1:
            zone = rrc.Zone.Z50
        else:
            zone = rrc.Zone.FINE
        print zone
        #transform target plane into target frame
        target_frame = Frame(target_plane.Origin, target_plane.XAxis, target_plane.YAxis)
        #store cart value from configuration
        cart = (configuration.joint_values[0])
        #send move to robtarget command
        ffc.commands.move_to_robtarget(robot, target_frame, cart, speed=speed, zone=zone, scalefactor=1000)
# ---------- end movel_command ----------
data_recorder_4 = DataRecorder(movel_command, DataLimit=-10, RecordData=True)
out_5 = Panel(data_recorder_4)

# ----
# Move Cartesian
movel_command_2 = GhPythonScript(
    robot=set.robot,
    configuration=filter_3,
    speed=tcp_speed_3,
    target_plane=plane,
    move_to_frame=to_frame,
    move_to_robtarget=to_robtarget,
    set_tool=set_tool)  # -> out; inputs target_plane: Plane, move_to_frame: Boolean, move_to_robtarget: Boolean
# ---------- movel_command_2: Python ----------
import compas_rrc as rrc
import abb_fabrication_control as ffc
from compas.geometry import Frame

#set tool in RobotStudio
if set_tool:
    if robot.attached_tool:
        tool_name = robot.attached_tool.name
        print tool_name
        done = robot.abb_client.send(rrc.SetTool(tool_name))
        print done
    else:
        robot.abb_client.send(rrc.SetTool("tool0"))

if move_to_frame:
    #transform target plane into target frame
    target_frame = Frame(target_plane.Origin, target_plane.XAxis, target_plane.YAxis)
    #send move to frame command
    ffc.commands.move_to_frame(robot, target_frame, speed=speed, zone=rrc.Zone.FINE, scalefactor=1000)

if move_to_robtarget:
    #transform target plane into target frame
    target_frame = Frame(target_plane.Origin, target_plane.XAxis, target_plane.YAxis)
    #store cart value from configuration
    cart = (configuration.joint_values[0])
    #send move to robtarget command
    ffc.commands.move_to_robtarget(robot, target_frame, cart, speed=speed, zone=rrc.Zone.FINE, scalefactor=1000)
# ---------- end movel_command_2 ----------
data_recorder_5 = DataRecorder(movel_command_2, DataLimit=-10, RecordData=True)
out_6 = Panel(data_recorder_5)

# ----
# Get Robot Configurations
get_joints_2 = GhPythonScript(robot=set.robot, get_frame=get_frame, get_robtarget=get_robtarget, get_joints=get_joints)  # -> joint, current_plane
# ---------- get_joints_2: Python ----------
from compas_ghpython.artists import FrameArtist
from scriptcontext import sticky as st
import fabtory_fabrication_control as ffc
import os

# store robot in component
guid = str(ghenv.Component.InstanceGuid)
current_frame_key = "current_frame_" + guid
current_robtarget_key = "current_robtarget_" + guid
current_configuration_key = "current_configuration_" + guid

if current_frame_key not in st:
    st[current_frame_key] = None

if current_robtarget_key not in st:
    st[current_robtarget_key] = None

if current_configuration_key not in st:
    st[current_configuration_key] = None


#get commands
if get_frame:
    current_frame = ffc.feedback.get_frame(robot, scalefactor=0.001)
    st[current_frame_key] = current_frame

if get_robtarget:
    current_robtarget = ffc.feedback.get_robtarget(robot, scalefactor=0.001)
    print current_robtarget
    st[current_robtarget_key] = current_robtarget


if get_joints:
    current_configuration = ffc.feedback.get_joints(robot)
    st[current_configuration_key] = current_configuration
    print current_configuration

# sticky
if st[current_frame_key]:
    current_frame = st[current_frame_key]
    artist = FrameArtist(current_frame)
    current_plane = artist.draw()

if st[current_robtarget_key]:
    current_robtarget = st[current_robtarget_key]

if st[current_configuration_key]:
    current_configuration = st[current_configuration_key]
    print current_configuration
# ---------- end get_joints_2 ----------
data_recorder_6 = DataRecorder(get_joints_2.joint, DataLimit=-10, RecordData=True)
draw_9 = GhPythonScript(plane=get_joints_2.current_plane, scale=Slider(0.2, range=0..1))  # -> P, V, C, W; inputs plane: Plane
# ---------- draw_9: Python ----------
from System.Drawing import Color
from compas_ghpython.artists import FrameArtist

red = Color.FromArgb(255, 0, 0)
green = Color.FromArgb(0, 255, 0)
blue = Color.FromArgb(0, 0, 255)

P = []
V = []
C = []

scale = float(scale)


if plane:
    P += [plane.Origin] * 3
    V.append(plane.XAxis * scale)
    V.append(plane.YAxis * scale)
    V.append(plane.ZAxis * scale)
    C += [red, green, blue]
    
    W = 3
# ---------- end draw_9 ----------
joint_values = Panel(data_recorder_6)
vdisex_7 = VectorDisplayEx(Point=draw_9.P, Vector=draw_9.V, Colour=draw_9.C, Width=draw_9.W)

# ----
# Digital Output
button = Button()
send_digital_signal = GhPythonScript(robot=set.robot, close_gripper=button, open_gripper=Button(), extruding_mortar=Button())  # -> out
# ---------- send_digital_signal: Python ----------
import fabtory_fabrication_control as ffc


if close_gripper:
    #robot.abb_client.send(rrc.SetDigital('Ausgang_100_0', 1))
    #robot.abb_client.send(rrc.WaitTime(2))
    #robot.abb_client.send(rrc.SetDigital('Ausgang_100_0', 0))
    #robot.abb_client.send(rrc.PrintText('Finished I/O'))

    ffc.commands.close(robot)
    print ('gripper is closed')

if open_gripper:
    ffc.commands.open(robot)
    print ('gripper is open')

if extruding_mortar:
    ffc.commands.extrude(robot)
    print ('is extruding')
# ---------- end send_digital_signal ----------
data_recorder_7 = DataRecorder(send_digital_signal, DataLimit=-10, RecordData=True)
out_7 = Panel(data_recorder_7)
