# Grasshopper definition assembly_design.ghx (Grasshopper 1.0.8)
# plug-ins: RhinoCodePluginGH

# ----
# Generate brick parts
list = ValueList({"none", "full", "insulated", "half"}, selected="half")
part = Python3Script()  # -> out, brick_full, brick_insulated, brick_half
# ---------- part: Python ----------
import os
from compas.geometry import Frame, Box
from compas.datastructures import Mesh
from climate_active_envelopes.assembly import CAEPart as Part



#brick_full
length, width, height = 0.24, 0.115, 0.075
brick_full = Part.from_dimensions(length=length, width=width, height=height)
brick_full.attributes['name'] = "brick_full"
#print(brick_full.attributes)
print(brick_full.__data__)


#brick_insulated_placeholder_new
length, width, height = 0.24, 0.115, 0.075
brick_insulated = Part.from_dimensions(length=length, width=width, height=height)
brick_insulated.attributes['name'] = "brick_insulated"
print(brick_insulated.__data__)


# #brick_insulated_placeholder
# length, width, height = 0.245, 0.12, 0.075
# brick_insulated = Part.from_dimensions(length=length, width=width, height=height)
# brick_insulated.attributes['name'] = "brick_insulated"
# print(brick_insulated.__data__)

#corner brick
length, width, height = 0.245, 0.06, 0.075
brick_half = Part.from_dimensions(length=length, width=width, height=height)
brick_half.attributes['name'] = "brick_half"
print(brick_half.__data__)

#brick_insulated
# package_path = ghdoc.Path
# data_path = os.path.abspath(os.path.join(package_path,"../../../climate_active_envelopes/data/brick_types"))
# filename = 'brick_insulated_reduced.stl'
# brick_insulated_mesh = Mesh.from_stl(os.path.join(data_path, filename))
# brick_insulated = Part.from_mesh_and_frame(brick_insulated_mesh)
# brick_insulated.attributes['name'] = "brick_insulated"
# #print(brick_insulated.__data__)
# ---------- end part ----------
draw = Python3Script(brick_full=part.brick_full, brick_insulated=part.brick_insulated, brick_half=part.brick_half, show=list)  # -> M, P
# ---------- draw: Python ----------
from compas_rhino.conversions import mesh_to_rhino, box_to_rhino, frame_to_rhino
from climate_active_envelopes.assembly import CAEPart as Part
from compas.geometry import Frame
from compas.geometry import Vector
from compas.geometry import Box


if show=="full":

    #extract the mesh of the part for visulization
    compas_mesh_full = brick_full.mesh

    #convert to rhino mesh
    M = mesh_to_rhino(compas_mesh_full)

    #extract and convert to rhino plane
    P = frame_to_rhino(brick_full.frame)
    #brick_full.gripping_frame = full_brick.frame
    #print(full_brick.__data__)
    print(type(brick_full))

    
elif show == "insulated":
    
    #extract the mesh of the part for visulization
    compas_mesh_insulated = brick_insulated.mesh

    #convert to rhino mesh
    M = mesh_to_rhino(compas_mesh_insulated)
    
    #extract and convert to rhino plane
    P = frame_to_rhino(brick_insulated.frame)

elif show == "half":

    #extract the mesh of the part for visulization
    compas_mesh_half = brick_half.mesh

    #convert to rhino mesh
    M = mesh_to_rhino(compas_mesh_half)
    
    #extract and convert to rhino plane
    P = frame_to_rhino(brick_half.frame)

else:
    pass
# ---------- end draw ----------
mesh = Mesh(draw.M)
pln = Plane(draw.P)

list_2 = ValueList({"rotate", "translate"}, selected="translate")

compas = Python3Script()  # -> out; disabled
# ---------- compas: Python ----------
import compas
print(compas.__version__)
# ---------- end compas ----------

# ----
# Unload Python modules
button = Button()
unload = Python3Script(unload=button)  # -> out, a
# ---------- unload: Python ----------
from compas_ghpython import unload_modules

unload_modules('climate_active_envelopes')
unload_modules('assembly_information_model')
# ---------- end unload ----------

geometry_input = Brep(<brep referenced from the Rhino model>)

# ----
# Slicing mesh input
layer_height = Slider(0.1, range=0..1)
contour = Python3Script(brep=geometry_input, layer_height=layer_height)  # -> out, contour_curves; inputs brep: Mesh, layer_height: Double
# ---------- contour: Python ----------
import Rhino.Geometry as rg

mesh = brep

vertices = mesh.Vertices
pt_base = vertices[0]
pt_end = vertices[2]


pt_base = vertices[0]
pt_end = vertices[1]


start_plane = rg.Plane(pt_base, rg.Vector3d(0, 0, 1))
end_plane = rg.Plane(pt_end, rg.Vector3d(0, 0, 1))

contour_curves =rg.Mesh.CreateContourCurves(mesh, pt_base,  pt_end, layer_height)
# ---------- end contour ----------
crv = Curve(contour.contour_curves)

compas___version = Panel(compas)  # disabled

# ----
# Create empty assembly datastructure
button_2 = Button()
assembly = Python3Script(init=button_2)  # -> out, my_assembly
# ---------- assembly: Python ----------
from climate_active_envelopes.assembly import CAEAssembly as Assembly

#create empty assembly
my_assembly = Assembly()
# ---------- end assembly ----------

assembly_2 = Python3Script(init=Button())  # -> out, my_assembly; same code as assembly
insulated_bricks = Brep([<brep referenced from the Rhino model> x931])
full_bricks = Brep([<brep referenced from the Rhino model> x72])

previous_face = Button()
# Classification of the Building Components
next_face = Button()
reset = Button()

brep = Brep([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])
next_edge = Button()
add_brick_model = Python3Script(my_assembly=assembly_2.my_assembly, bricks_full=full_bricks, bricks_insulated=insulated_bricks)  # -> out, my_assembly; inputs bricks_full: list of Box, bricks_insulated: list of Box
# ---------- add_brick_model: Python ----------
from compas.geometry import Frame, Box
from compas_rhino.conversions import box_to_compas

for brep in brick_model:
    box = box_to_compas(brep)
    mesh = Box.to_mesh(box)
    frame = Frame(mesh.centroid(), [1, 0, 0], [0, 1, 0])
    mesh.frame = frame
    part_key = my_assembly.add_part(mesh, attr_dict={"brick_type": "brick_full"})
    z_value = frame.point.z
    my_assembly.graph.node_attribute(part_key, 'z', z_value)


# Get the sorted courses
courses = my_assembly.assembly_courses()

# Add connections between adjacent bricks in each course
for course in courses:
    for i in range(len(course) - 1):
        a_key = course[i]
        b_key = course[i + 1]
        my_assembly.add_connection(a_key, b_key)

print(my_assembly)


current_part = my_assembly.part(part_key)
print(current_part.attributes)
# ---------- end add_brick_model ----------
course_height = Slider(0.1, range=0..1)

start = Button()
stop = Button()
step = Button()
back = Button()
reset_2 = Button()
full = Button()
list_3 = ValueList({"20", "50", "100", "500", "1000", "5000"}, selected="500")

list_4 = ValueList({"show all": "show_all", "show until key": "show_until_key", "show nothing": "show_nothing"}, selected="show until key")

start_2 = Button()
stop_2 = Button()
step_2 = Button()
back_2 = Button()
reset_3 = Button()
full_2 = Button()
list_5 = ValueList({"20", "50", "100", "500", "1000", "5000"}, selected="500")

show_face_until_key = BooleanToggle(False)
show_current_face = BooleanToggle(True)
# Visualisation Cell Network
show_all = BooleanToggle(True)

show_face_neighbor_until_key = BooleanToggle(False)
show_inner_wall_neighbors = BooleanToggle(False)
show_wall_neighbors = BooleanToggle(False)
show_slab_neighbors = BooleanToggle(False)
show_face_neighbor = BooleanToggle(False)
show_current_edge = BooleanToggle(True)

list_6 = ValueList({"show all": "show_all", "show until key": "show_until_key", "show nothing": "show_nothing"}, selected="show all")

z = Slider(-0.41, range=-3..3)  # disabled
y = Slider(1.32, range=0..3)  # disabled

geo = Geometry(<extrusion referenced from the Rhino model>)
geo_2 = Geometry(<extrusion referenced from the Rhino model>)
geo_3 = Geometry(<extrusion referenced from the Rhino model>)
quad = Quadrangulate(Mesh=geo, Angle=0.03490658504, Ratio=0.875)  # -> Mesh, Count
quad_2 = Quadrangulate(Mesh=geo_3, Angle=0.03490658504, Ratio=0.875)  # -> Mesh, Count
quad_3 = Quadrangulate(Mesh=geo_2, Angle=0.03490658504, Ratio=0.875)  # -> Mesh, Count
cell_network = Python3Script(units=[quad_3.Mesh, quad_2.Mesh, quad.Mesh])  # -> out, cell_network; inputs units: list of Mesh
# ---------- cell_network: Python ----------
from climate_active_envelopes.assembly import CAEComponent as component
from compas_rhino.conversions import mesh_to_compas
from compas.datastructures import CellNetwork

mesh_units = []

for unit in units:
    mesh_units.append(mesh_to_compas(unit))
 
#create an empty CellNetwork
cell_network = CellNetwork()

cell_network = component.create_cell_network(mesh_units, cell_network)
print(cell_network)

# for mesh in mesh_units:
#     fkeys = []
#     for fkey in mesh.faces():
#         face_vertices = []
#         for vkey in mesh.face_vertices(fkey):
#             x, y, z = mesh.vertex_coordinates(vkey)
#             vertex = component.find_or_add_vertex(cell_network, x, y, z)
#             face_vertices.append(vertex)
#         fkey = cell_network.add_face(face_vertices)
#         fkeys.append(fkey)
#     cell_network.add_cell(fkeys)

# print(cell_network)



# for box in boxes:
#     b = box_to_compas(box)
#     m = Mesh(b)


# cell_groups = [
#     all_meshes[0:6],  # First cell
#     all_meshes[6:11]  # Second cell
# ]

# for cell_meshes in cell_groups:
#     fkeys = []
#     for mesh in cell_meshes:
#         # Extract vertices and faces from the mesh
#         for fkey in mesh.faces():
#             face_vertices = []
#             for vkey in mesh.face_vertices(fkey):
#                 x, y, z = mesh.vertex_coordinates(vkey)
#                 vertex = component.find_or_add_vertex(cell_network, x, y, z)
#                 face_vertices.append(vertex)
#             fkey = cell_network.add_face(face_vertices)
#             fkeys.append(fkey)
#     cell_network.add_cell(fkeys)

# print(cell_network)
# ---------- end cell_network ----------
cell_network_2 = Panel(cell_network.out)

x = Slider(0, range=0..3)  # disabled
crv_2 = Curve(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)  # disabled
pln_2 = Plane(Plane(origin=(-14.74086668, 24.62869101, -0.3574083905), x=(0, 1, 0), y=(-1, 0, 0)))  # disabled

# ----
# Create Reference Model
geo_4 = Geometry(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)
geo_5 = Geometry(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)

quad_4 = Quadrangulate(Mesh=geo_5, Angle=0.03490658504, Ratio=0.875)  # -> Mesh, Count
quad_5 = Quadrangulate(Mesh=geo_4, Angle=0.03490658504, Ratio=0.875)  # -> Mesh, Count
cell_network_3 = Python3Script(units=[quad_5.Mesh, quad_4.Mesh])  # -> out, cell_network; inputs units: list of Mesh
# ---------- cell_network_3: Python ----------
from climate_active_envelopes.assembly import CAECellNetwork as Cell_Network
from compas_rhino.conversions import mesh_to_compas
from compas.datastructures import Mesh, CellNetwork


cell_network = Cell_Network()

mesh_units = []

for unit in units:
    mesh_units.append(mesh_to_compas(unit))

cell_network = cell_network.create_cell_network(mesh_units)
print(cell_network)

cell_network.initialize_network()
# ---------- end cell_network_3 ----------

cell_network_4 = Panel(cell_network_3.out)

face_types = Python3Script(cell_network=cell_network_3.cell_network, next_face=next_face, previous_face=previous_face, reset=reset)  # -> out, all_faces_type, current_face_type, neighbor_faces_type, cell_network, fkey
# ---------- face_types: Python ----------
from scriptcontext import sticky as st

#st["edge_key"] = edge_key
#st["face_key"] = face_key


print(cell_network)
L = range(cell_network.number_of_faces())

#store data in component
guid = str(ghenv.Component.InstanceGuid)
face_key = "key_" + guid
running_key = "running_" + guid



if face_key not in st:
    st[face_key] = 0

if next_face:
    if st[face_key] < len(L) - 1:
        st[face_key] += 1
    else:
        st[face_key] = 0 

if previous_face:
    if st[face_key] < len(L) - 1:
        st[face_key] -= 1
    else:
        st[face_key] = 0 

if reset:
    st[face_key] = 0
    st[running_key] = False

fkey = st[face_key]


#Category for all faces in all cells
face_types = cell_network.sort_faces_by_type(cell_network)

# Print the face_type of the faces in face_types['walls']
for face, face_type in face_types['walls']:
    print(face, face_type)

# Print the face_type of all faces in face_types
all_faces_type = []
for faces in face_types.values():
    for face, face_type in faces:
        all_faces_type.append(face_type)


# Category for selected face
current_face, current_face_type = cell_network.select_face_by_fkey(cell_network, fkey)


# Category of neighboring faces
neighbor_faces_type = []
neighbors, neighbor_face_types = (cell_network.select_face_neighbors(cell_network, fkey))
for neighbor, face_type in neighbor_face_types:
    neighbor_faces_type.append(face_type)

wall_neighbors = []
slab_neighbors = []
neighbors, neighbor_face_types = cell_network.select_face_neighbors(cell_network, fkey)

for neighbor, face_type in neighbor_face_types:
    if face_type in ["outer wall", "inner wall"]:
        wall_neighbors.append(neighbor)

    if face_type in ["slab"]:
        slab_neighbors.append(neighbor)

# Store wall_neighbors and slab_neighbors in cell_network
cell_network.wall_neighbors = wall_neighbors
cell_network.slab_neighbors = slab_neighbors

# Store face_key to the cell_network
cell_network.fkey = fkey

# Store current_face with fkey in cell_network
cell_network.current_face = current_face
cell_network.current_face_type = current_face_type
# ---------- end face_types ----------
panel = Panel(face_types.fkey)

next_neighbor = Button()
edge_types = Python3Script(cell_network=face_types.cell_network, next_neighbor=next_neighbor, next_edge=next_edge)  # -> out, shared_edge_type, current_edge_type, cell_network, face_edge_key, ekey
# ---------- edge_types: Python ----------
from compas_rhino.conversions import mesh_to_rhino, line_to_rhino
from scriptcontext import sticky as st

face_neighbors = cell_network.wall_neighbors + cell_network.slab_neighbors
L = range(len(cell_network.wall_neighbors))

#store data in component
guid = str(ghenv.Component.InstanceGuid)
face_edge_key = "key_" + guid

if face_edge_key not in st:
    st[face_edge_key] = 0

if next_neighbor:
    if st[face_edge_key] < len(L) - 1:
        st[face_edge_key] += 1
    else:
        st[face_edge_key] = 0 

face_edge_key = st[face_edge_key]+1

# Store face_key to the cell_network
cell_network.face_edge_key = face_edge_key

# Get type of the shared edge
shared_edge, edge_type = cell_network.get_shared_edge(cell_network, cell_network.current_face, cell_network.wall_neighbors, face_edge_key)
shared_edge_type = edge_type

# Store edge_type and shared_edge in cell_network
cell_network.shared_edge = shared_edge
cell_network.shared_edge_type = shared_edge_type







L = range(cell_network.number_of_edges())


edge_key = "ekey_" + guid
if edge_key not in st:
    st[edge_key] = 0
if next_edge:
    if st[edge_key] < len(L) - 1:
        st[edge_key] += 1
    else:
        st[edge_key] = 0 
ekey = st[edge_key]+1

# Store face_key to the cell_network
cell_network.ekey = ekey



current_edge, current_edge_type = cell_network.select_edge_by_ekey(cell_network, ekey)
cell_network.current_edge = current_edge

print(current_edge, current_edge_type)
face_edges = cell_network.face_edges(cell_network.current_face)
print(face_edges)
#print(cell_network.select_face_and_get_adjacent_edges(cell_network, cell_network.fkey))
# ---------- end edge_types ----------
panel_2 = Panel(edge_types.shared_edge_type)

cellnetwork_data = Python3Script(
    cell_network=edge_types.cell_network,
    my_assembly=assembly.my_assembly,
    course_height=course_height,
    brick_full=part.brick_full,
    brick_insulated=part.brick_insulated,
    brick_half=part.brick_half)  # -> out, start_line, start_edge_type, end_edge_type, current_face_type, cell_network, start, end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; inputs course_height: Double
# ---------- cellnetwork_data: Python ----------
import math as m
from compas_rhino.conversions import mesh_to_compas, point_to_rhino, line_to_rhino

assembly_data = (cell_network.generate_assembly_data_from_cellnetwork(cell_network, course_height))
my_assembly.set_brick_params(brick_full, brick_insulated, brick_half)

start_edge_type = assembly_data['start_edge_type']
end_edge_type = assembly_data['end_edge_type']
start_edge = assembly_data['start_edge']
current_face_type = assembly_data['face_type']
edge_length = assembly_data['direction_vector']
face_normal = assembly_data['face_normal']
print(face_normal)
print(edge_length)
start_pt = assembly_data['curve_start_point']
start = point_to_rhino(start_pt)
end = point_to_rhino(assembly_data['curve_end_point'])
start_edge = cell_network.edge_line(start_edge)
start_line = line_to_rhino(start_edge)


for data in my_assembly.compute_brick_layout(cell_network, course_height, 0.02):
    bricks_per_course, course_is_odd, direction_vector, start_edge_type, end_edge_type, curve_midpoint, adjusted_start_point, adjusted_end_point = data
print(adjusted_end_point)
print(adjusted_start_point)
# ---------- end cellnetwork_data ----------

# ----
# Create brick assembly
number_slider = Slider(0.02, range=0..0.1)
list_7 = ValueList({"Flemish bond": "flemish_bond", "Vertical bond": "vertical_bond", "Fench bond": "french_bond"}, selected="Flemish bond")
list_8 = ValueList({"Single layer": "single_layer", "Double layer": "double_layer"}, selected="Double layer")
create_assembly = Python3Script(
    cell_network=cellnetwork_data.cell_network,
    my_assembly=assembly.my_assembly,
    bond_type=list_7,
    wall_system=list_8,
    brick_full=part.brick_full,
    brick_insulated=part.brick_insulated,
    brick_half=part.brick_half,
    brick_spacing=number_slider,
    course_height=course_height)  # -> out, my_assembly; inputs brick_spacing: Double, course_height: Double
# ---------- create_assembly: Python ----------
#shared_edge = cell_network.shared_edge
#edge_type = cell_network.shared_edge_type


my_assembly.set_brick_params(brick_full, brick_insulated, brick_half)


my_assembly.generate_wall(cell_network,
                      bond_type, 
                      wall_system,  
                      brick_spacing, 
                      course_height)
# ---------- end create_assembly ----------

get_centroids = Python3Script(my_assembly=create_assembly.my_assembly, transform_type=list_2)  # -> out, my_assembly, keys; inputs transform_type: String
# ---------- get_centroids: Python ----------
from compas.geometry import Frame, Translation, Rotation, Transformation, Point
from compas_rhino.conversions import plane_to_compas_frame, point_to_compas

import math
import Rhino.Geometry as rg

values = []
keys = []


for key in my_assembly.graph.nodes_where({"transform_type": transform_type}):
    part = my_assembly.part(key)
    keys.append(key)

my_assembly = my_assembly
# ---------- end get_centroids ----------
panel_3 = Panel(edge_types.ekey)
line = Line(cellnetwork_data.start_line)
pln_3 = Plane(line)
pt = Point(cellnetwork_data.start)
pt_2 = Point(cellnetwork_data.end)
pt_3 = Point(cellnetwork_data.adjusted_end_point)
pt_4 = Point(cellnetwork_data.adjusted_start_point)

panel_4 = Panel(face_types.all_faces_type)
panel_5 = Panel(face_types.current_face_type)
panel_6 = Panel(face_types.neighbor_faces_type)

panel_7 = Panel(edge_types.current_edge_type)
panel_8 = Panel(cellnetwork_data.start_edge_type)
panel_9 = Panel(cellnetwork_data.end_edge_type)
panel_10 = Panel(cellnetwork_data.current_face_type)
panel_11 = Panel(cellnetwork_data.face_normal)
vec = Vector(cellnetwork_data.face_normal)

vizualize_cell_network = Python3Script(
    cell_network=face_types.cell_network,
    show_all=show_all,
    show_current_face=show_current_face,
    show_face_until_key=show_face_until_key)  # -> P, L, M, mesh_till_key, current_mesh
# ---------- vizualize_cell_network: Python ----------
from compas.geometry import Frame
from compas_rhino.conversions import frame_to_rhino, line_to_rhino, mesh_to_rhino
from scriptcontext import sticky as st


fkey = cell_network.fkey


if show_all:
    P = []
    for vertex_key in cell_network.vertices():
        coordinates = cell_network.vertex_coordinates(vertex_key)
        #print(f"Vertex Key: {vertex_key}, Coordinates: {coordinates}")
        frames = Frame(coordinates, [1, 0, 0], [0, 1, 0])
        rhino_planes = frame_to_rhino(frames)
        P.append(rhino_planes)

    L = []
    for edge in cell_network.edges():
        print(edge)
        line = cell_network.edge_line(edge)
        curves = line_to_rhino(line)
        L.append(curves)

    M = []
    for face in cell_network.faces():
        face_meshes = cell_network.faces_to_mesh([face])
        mesh = mesh_to_rhino(face_meshes)
        M.append(mesh)

if show_face_until_key:
    all_face_meshes = []
    for face in cell_network.faces():
        face_mesh = cell_network.faces_to_mesh([face])
        all_face_meshes.append(face_mesh)
    mesh_till_key = [mesh_to_rhino(face_mesh) for face_mesh in all_face_meshes[:int(fkey)]]

if show_current_face:
    selected_face, face_type = cell_network.select_face_by_fkey(cell_network, fkey)
    current_face_mesh = cell_network.faces_to_mesh([selected_face])
    current_mesh = mesh_to_rhino(current_face_mesh) 


# wall_neighbors = []
# slab_neighbors = []
# neighbors, neighbor_face_types = cell_network.select_face_neighbors(cell_network, fkey)
# for neighbor, face_type in neighbor_face_types:
#     if show_wall_neighbors:
#         if face_type in ["outer wall", "inner wall"]:
#             neighbor_faces_meshes = cell_network.faces_to_mesh([neighbor])
#             mesh_neighbor = mesh_to_rhino(neighbor_faces_meshes)
#             wall_neighbors.append(mesh_neighbor)
#     if show_slab_neighbors:
#         if face_type in ["slab"]:
#             neighbor_faces_meshes = cell_network.faces_to_mesh([neighbor])
#             mesh_neighbor = mesh_to_rhino(neighbor_faces_meshes)
#             slab_neighbors.append(mesh_neighbor)
# ---------- end vizualize_cell_network ----------
points = Point(vizualize_cell_network.P)

# ----
# Shading Simulation
toggle = BooleanToggle(True)
number_slider_2 = Slider(0.2, range=0..1)
number_slider_3 = Slider(0, range=0..360)
epw_file = FilePath("C:\Users\julia\Downloads\DEU_BY_Munich-Theresienwiese.108650_TMYx\DEU_BY_Munich-Theresienwiese.108650_TMYx.epw")
context_input = Brep([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])
sun_hours = SunHours(
    start_month=Slider(7, range=0..10),
    start_day=Slider(1, range=0..10),
    start_hour=Slider(11, range=0..100),
    end_month=Slider(8, range=0..10),
    end_day=Slider(31, range=0..100),
    end_hour=Slider(16, range=0..100),
    north=number_slider_3,
    geometry=vizualize_cell_network.current_mesh,
    epw_file=epw_file,
    context=context_input,
    grid_size=Slider(0.04, range=0..0.1),
    offset_dist=number_slider_2,
    run=toggle)  # -> hoys, location, sky_mtx, results, mesh, legend

# ----
# Apply Gradient
vals = Python3Script(results=sun_hours.results)  # -> out, color_values; inputs results: list
# ---------- vals: Python ----------
from compas.itertools import normalize_values



def normalize_to_highest(values, max_value=140.0, target_min=0.0, target_max=1.0):
    """Normalizes a list of values based on the highest value in the list, 
    scaled to a specific range.

    Args:
    values: A list of numerical values.
    max_value: The expected maximum value. Defaults to 116.0.
    target_min: The minimum value of the target range. Defaults to 0.0.
    target_max: The maximum value of the target range. Defaults to 0.7.

    Returns:
    A list of normalized values.
    """
    highest_value = max(values)
    factor = highest_value / max_value  # Calculate the scaling factor
    normalized_values = normalize_values(values, target_min, target_max * factor)
    return normalized_values


color_values = normalize_to_highest(results)

#color_values = normalize_values(results, 0.0, 0.7)
print(color_values)




"""
color_points = []

for i, point in enumerate(points):
    frame = Frame([color_values[i], point[1] , point[2]], [1,0,0], [0,1,0])
    
    color_points.append(frame.point)
"""
# ---------- end vals ----------
panel_12 = Panel(vals.color_values)
apply_gradient = Python3Script(
    my_assembly=get_centroids.my_assembly,
    values=vals.color_values,
    keys=get_centroids.keys,
    transform_type=list_2,
    transform=Button())  # -> out, my_assembly; inputs values: list, keys: list
# ---------- apply_gradient: Python ----------
import math
import Rhino.Geometry as rg
from compas.geometry import Frame, Point
from compas.geometry import Transformation, Rotation, Translation


#print(my_assembly.apply_gradient(values, keys, transform_type_))


#print(my_assembly.__data__)

#transform_types = {node_id: my_assembly.graph.node_attribute(node_id, 'transform_type') for node_id in my_assembly.graph.nodes()}


if transform:
    assembly = my_assembly
    my_assembly.apply_gradient(values, keys, transform_type)

    #print(test)
# ---------- end apply_gradient ----------

geo_6 = Geometry(sun_hours.legend)

visualize = Python3Script(show=Toggle(False), mesh=sun_hours.mesh)  # -> out, M
# ---------- visualize: Python ----------
if show == True:
    M = mesh
# ---------- end visualize ----------
mesh_2 = Mesh(visualize.M)

panel_13 = Panel(geo_6)

# ----
# Sun Path
number_slider_4 = Slider(0.3, range=0..10)
pt_5 = Point(Point(-0.1120708673, 31.05692892, 0))
sunpath = LBSunPath(north=number_slider_3, location=sun_hours.location, hoys=sun_hours.hoys, center_pt=pt_5, scale=number_slider_4)  # -> report, vectors, altitudes, azimuths, hoys, sun_pts, analemma, daily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; plug-in component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
geo_7 = Geometry([sunpath.compass, sunpath.daily, sunpath.analemma, sunpath.legend, sunpath.title, sunpath.sun_pts])

# ----
# Transform
toggle_2 = BooleanToggle(False)
pln_4 = Plane(PlaneXY(2.43007085, -1.968439302, -0.2055923429))
transform = Python3Script(my_assembly=apply_gradient.my_assembly, transform=toggle_2, origin_plane=pln, new_origin_plane=pln_4)  # -> out, my_assembly
# ---------- transform: Python ----------
from compas.geometry import Frame, Transformation, Rotation, Translation
from compas_rhino.conversions import plane_to_compas_frame


new_origin_frame = plane_to_compas_frame(new_origin_plane)
origin_frame = plane_to_compas_frame(origin_plane)

if transform:
    T = Transformation.from_frame_to_frame(origin_frame, new_origin_frame)
    my_assembly = my_assembly.transformed(T)
# ---------- end transform ----------

vizualize_face_neighbors = Python3Script(
    cell_network=edge_types.cell_network,
    show_wall_neighbors=show_wall_neighbors,
    show_slab_neighbors=show_slab_neighbors,
    show_inner_wall_neighbors=show_inner_wall_neighbors,
    show_face_neighbor=show_face_neighbor,
    show_face_neighbor_unil_key=show_face_neighbor_until_key,
    show_current_edge=show_current_edge)  # -> out, wall_neighbors, slab_neighbors, inner_wall_neighbors, next_neighbor, neighbor_until_key, current_curve
# ---------- vizualize_face_neighbors: Python ----------
from compas_rhino.conversions import mesh_to_rhino, line_to_rhino
from scriptcontext import sticky as st

# face_neighbors = cell_network.wall_neighbors + cell_network.slab_neighbors
# L = range(len(cell_network.wall_neighbors))

# #store data in component
# guid = str(ghenv.Component.InstanceGuid)
# edge_key = "key_" + guid

# if edge_key not in st:
#     st[edge_key] = 0

# if next_neighbor:
#     if st[edge_key] < len(L) - 1:
#         st[edge_key] += 1
#     else:
#         st[edge_key] = 0 

# ekey = st[edge_key]+1
face_edge_key = cell_network.face_edge_key
ekey = cell_network.ekey
fkey = cell_network.fkey


wall_neighbors = []
slab_neighbors = []
neighbors, neighbor_face_types = cell_network.select_face_neighbors(cell_network, fkey)

for neighbor, face_type in neighbor_face_types:
    if show_wall_neighbors:
        if face_type in ["outer wall", "inner wall"]:
            neighbor_faces_meshes = cell_network.faces_to_mesh([neighbor])
            mesh_neighbor = mesh_to_rhino(neighbor_faces_meshes)
            wall_neighbors.append(mesh_neighbor)
    if show_slab_neighbors:
        if face_type in ["slab"]:
            neighbor_faces_meshes = cell_network.faces_to_mesh([neighbor])
            mesh_neighbor = mesh_to_rhino(neighbor_faces_meshes)
            slab_neighbors.append(mesh_neighbor)



edge_type = cell_network.shared_edge_type
shared_edge = cell_network.shared_edge


inner_wall_neighbors = []
edge_faces = cell_network.edge_faces(shared_edge)
if show_inner_wall_neighbors:
    for face in edge_faces:
         if face != cell_network.current_face:
            if edge_type == 'inner wall joint':
                neighbor = mesh_to_rhino(cell_network.faces_to_mesh([face]))
                inner_wall_neighbors.append(neighbor)
            else:
                neighbor = mesh_to_rhino(cell_network.faces_to_mesh([face]))
                inner_wall_neighbors.append(neighbor)

neighbor_face_meshes = []
for i, face in enumerate(cell_network.wall_neighbors):
    if i < face_edge_key:

        #Vizualize the neighboring faces (one-by-one and until key)
        if show_face_neighbor:
            next_neighbor = mesh_to_rhino(cell_network.faces_to_mesh([face]))

        if show_face_neighbor_unil_key:
            neighbor_face_meshes.append(cell_network.faces_to_mesh([face]))
            neighbor_until_key = [mesh_to_rhino(face_mesh) for face_mesh in neighbor_face_meshes[:int(face_edge_key)]]


# Vizualize the shared edge
shared_edge = cell_network.get_shared_edge(cell_network, cell_network.current_face, cell_network.wall_neighbors, face_edge_key)
shared_edge_type = shared_edge[1]
edge_between_faces = []
line = cell_network.edge_line(shared_edge[0])
curves = line_to_rhino(line)
edge_between_faces.append(curves)

# Vizualize current edge
if show_current_edge:
    current_edge = cell_network.current_edge
    current_curve = line_to_rhino(cell_network.edge_line(current_edge))
# ---------- end vizualize_face_neighbors ----------

# ----
# Export to JSON
export = Button()
path = Python3Script()  # -> HERE, DATA, ASSEMBLY
# ---------- path: Python ----------
import os

HERE = os.path.dirname(ghdoc.Path)
DATA = os.path.abspath(os.path.join(HERE, "..", "data"))
ASSEMBLY = os.path.abspath(os.path.join(DATA, "assembly"))

print(HERE)
print(DATA)
print(ASSEMBLY)
# ---------- end path ----------
export_2 = Python3Script(ASSEMBLY=path.ASSEMBLY, my_assembly=transform.my_assembly, export=export)  # -> out; inputs ASSEMBLY: String
# ---------- export_2: Python ----------
import os


    

#print(my_assembly.__data__)
if export:
    #print(DATA)
    filename = "250211_brickwall_2.json"
    PATH = os.path.join(ASSEMBLY, filename)

    # the assembly has to be serialized such that it can be called from CPython
    my_assembly.to_json(PATH, pretty=True)
    print(my_assembly)
# ---------- end export_2 ----------

crv_3 = Curve(vizualize_cell_network.L)

preview = CustomPreview(
    Geometry=[vizualize_face_neighbors.wall_neighbors, vizualize_face_neighbors.slab_neighbors],
    Material=ColourSwatch(SwatchColor=RGB(181, 125, 157)))
preview_2 = CustomPreview(
    Geometry=[vizualize_face_neighbors.inner_wall_neighbors, vizualize_face_neighbors.next_neighbor],
    Material=ColourSwatch(SwatchColor=RGB(255, 216, 203)))
preview_3 = CustomPreview(
    Geometry=[vizualize_face_neighbors.neighbor_until_key, vizualize_face_neighbors.current_curve],
    Material=ColourSwatch(SwatchColor=RGB(255, 131, 138)))

preview_4 = CustomPreview(Geometry=vizualize_cell_network.mesh_till_key, Material=ColourSwatch(SwatchColor=RGB(255, 125, 157)))
preview_5 = CustomPreview(Geometry=vizualize_cell_network.current_mesh, Material=ColourSwatch(SwatchColor=RGB(255, 194, 157)))

opening = Python3Script(cell_network=edge_types.cell_network, curve=crv_2, plane=pln_2, x=x, y=y, z=z)  # -> out, rhino_curve, target_plane, cell_network; inputs curve: Curve, plane: Plane, x: Double, y: Double, z: Double; disabled
# ---------- opening: Python ----------
from climate_active_envelopes.assembly import CAEComponent as component
from compas_rhino.conversions import curve_to_compas, line_to_rhino, point_to_rhino, curve_to_rhino, plane_to_compas_frame, frame_to_rhino_plane
from compas.geometry import Frame, Transformation, Point, Line, Translation, Vector
import Rhino.Geometry as rg




compas_line = curve_to_compas(curve)
frame = plane_to_compas_frame(plane)

if cell_network.current_face_type == 'outer wall':

    vertices = cell_network.face_vertices(cell_network.current_face)
    target_point = cell_network.vertex_coordinates(vertices[0])

    face_normal = cell_network.face_normal(cell_network.current_face)
    x_direction = Vector(face_normal[0], face_normal[1] ,face_normal[2])

    z_direction = Vector(0, 0, 1)
    y_direction = z_direction.cross(x_direction)

    target_frame = Frame(target_point, x_direction, y_direction)

    T1 = Transformation.from_frame_to_frame(frame, target_frame)
    transformed_line = compas_line.transformed(T1)

    shift_x = face_normal[0] * x
    shift_y = face_normal[0] * y
    shift_z = face_normal[0] * z

    T2 = Translation.from_vector([shift_x, shift_y, shift_z])
    shifted_transformed_line = transformed_line.transformed(T2)
    
    rhino_curve = curve_to_rhino(shifted_transformed_line)

#outer_wall_attrs = component.outer_wall_attributes(cell_network, shifted_transformed_line)









# if cell_network.current_face_type == 'outer wall':

#     vertices = cell_network.face_vertices(cell_network.current_face)
#     target_point = cell_network.vertex_coordinates(vertices[0])

#     face_normal = cell_network.face_normal(cell_network.current_face)
#     x_direction = Vector(face_normal[0], face_normal[1] ,face_normal[2])

#     z_direction = Vector(0, 0, 1)
#     y_direction = z_direction.cross(x_direction)


#     target_frame = Frame(target_point, x_direction, y_direction)
#     target_plane = frame_to_rhino_plane(target_frame)
    

#     T = Transformation.from_frame_to_frame(frame, target_frame)
#     transformed_line = compas_line.transformed(T)
    

#     translation = Translation.from_vector([shift_x, 0, shift_z])
#     shifted_transformed_line = transformed_line.transformed(translation)

    
#     rhino_curve = curve_to_rhino(shifted_transformed_line)

# outer_wall_attrs = component.outer_wall_attributes(cell_network, shifted_transformed_line)


# # Print the face type and window attribute
# for face, attributes in outer_wall_attrs.items():
#     face_type = attributes.get('face_type')
#     has_window = 'window' in attributes
#     print(f"Face: {face}, Type: {face_type}, Has Window: {has_window}")
# ---------- end opening ----------
crv_4 = Curve(opening.rhino_curve)  # disabled
pln_5 = Plane(opening.target_plane)  # disabled

# ----
# Radiation Simulation
toggle_3 = BooleanToggle(False)

# ----
# Visualisation Dashboard
counter = Python3Script(
    my_assembly=add_brick_model.my_assembly,
    start=start,
    stop=stop,
    step=step,
    step_back=back,
    reset=reset_2,
    full=full,
    interval=list_3)  # -> out, current_key, counter
# ---------- counter: Python ----------
from scriptcontext import sticky as st
import Grasshopper

def update_component(ghenv, delay):
    """Schedule an update of the Grasshopper component.

    After the specified delay, the GH component will be automatically updated.

    Parameters
    ----------
    ghenv : :class:`GhPython.Component.PythonEnvironment`
        The current GHPython environment.
    delay : :obj:`int`
        Time in milliseconds until the update is performed.

    Raises
    ------
    ValueError
        If the delay is less than zero.

    """
    if delay <= 0:
        raise ValueError("Delay must be greater than zero")

    ghcomp = ghenv.Component
    ghdoc = ghcomp.OnPingDocument()

    def callback(ghdoc):
        if ghdoc.SolutionState != Grasshopper.Kernel.GH_ProcessStep.Process:
            ghcomp.ExpireSolution(False)

    ghdoc.ScheduleSolution(delay, Grasshopper.Kernel.GH_Document.GH_ScheduleDelegate(callback))


courses = my_assembly.assembly_courses(tol=0.01)
#print(courses)


L = [node for course in courses for node in course]


guid = str(ghenv.Component.InstanceGuid)
counter_key = "counter_" + guid
running_key = "running_" + guid

if counter_key not in st:
    st[counter_key] = 0

if running_key not in st:
    st[running_key] = False

if st[running_key]:
    if st[counter_key] < len(L) - 1:
        st[counter_key] += 1
        update_component(ghenv, interval)
    else:
        st[counter_key] = 0
        st[running_key] = False

if start:
    st[running_key] = True

if stop:
    st[running_key] = False

if step:
    if st[counter_key] < len(L) - 1:
        st[counter_key] += 1

if step_back:
    if st[counter_key] < len(L) - 1:
        st[counter_key] -= 1

if reset:
    st[counter_key] = 0
    st[running_key] = False

if full:
    st[counter_key] = len(L) - 1

if len(L):
    item = L[st[counter_key]]
    print(f"Current node item: {item}")

#st["visualisation_counter"] = st[counter_key]
counter = st[counter_key] + 1

current_key = item
# ---------- end counter ----------
panel_14 = Panel(counter.counter)

visualize_2 = Python3Script(
    my_assembly=add_brick_model.my_assembly,
    show=list_4,
    highlight_current_part=Toggle(True),
    current_key=counter.current_key)  # -> out, parts_geometry, parts_frame, current_part_geometry, current_part_frame, current_part_gripping_frame
# ---------- visualize_2: Python ----------
from compas_rhino.conversions import mesh_to_rhino, box_to_rhino, frame_to_rhino

courses = my_assembly.assembly_courses(tol=0.01)
L = [node for course in courses for node in course]


#get parts datastructure
parts = [p for p in my_assembly.parts()]


if show == "show_all":
    
#get parts datastructure
    parts = [p for p in my_assembly.parts()]
    parts_geometry = []
    parts_frame = []

    #part = parts[0]
    #print(part.gripping_frame)

    #extract the mesh of the parts for visulization (+ converted to rhino mesh)
    for p in parts:
        print(p)
        parts_geometry.append(mesh_to_rhino(p))
    
    #extract the frame of the parts for visulization (+ converted to rhino plane)
    parts_frame = [frame_to_rhino(p.frame) for p in parts]
    key = my_assembly.graph.number_of_nodes()-1

if show == "show_until_key":

    current_index = L.index(current_key)
    keys_to_visualize = L[:current_index + 1]

    parts_geometry = [mesh_to_rhino(parts[key]) for key in keys_to_visualize]
    parts_frame = [frame_to_rhino(parts[key].frame) for key in keys_to_visualize]

    key = current_key


if show == "show_nothing":
    print("Nothing to see")
    pass

if highlight_current_part:
    current_part = my_assembly.part(key)
    current_part_geometry = mesh_to_rhino(current_part)
    current_part_frame = frame_to_rhino(current_part.frame)
    #current_part_gripping_frame = frame_to_rhino(current_part.gripping_frame)
    
    print(current_part.__data__)
# ---------- end visualize_2 ----------
panel_15 = Panel(counter.current_key)

geo_8 = Geometry(visualize_2.parts_geometry)
geo_9 = Geometry(visualize_2.parts_frame)
geo_10 = Geometry(visualize_2.current_part_geometry)
geo_11 = Geometry(visualize_2.current_part_gripping_frame)
preview_6 = CustomPreview(Geometry=geo_8, Material=ColourSwatch(SwatchColor=RGB(196, 141, 141)))
preview_7 = CustomPreview(Geometry=geo_9, Material=ColourSwatch(SwatchColor=RGB(255, 125, 157)))
preview_8 = CustomPreview(Geometry=geo_10, Material=ColourSwatch(SwatchColor=RGB(255, 125, 157)))
preview_9 = CustomPreview(Geometry=geo_11, Material=ColourSwatch(SwatchColor=RGB(255, 125, 157)))

panel_16 = Panel(visualize_2.out)
draw_2 = Python3Script(planes=geo_11, scale=Slider(0.2, range=0..1))  # -> out, P, V, C, W; inputs planes: list of Plane
# ---------- draw_2: Python ----------
from System.Drawing import Color

red = Color.FromArgb(255, 0, 0)
green = Color.FromArgb(0, 255, 0)
blue = Color.FromArgb(0, 0, 255)

P = []
V = []
C = []

scale = float(scale)

for plane in planes:
    if not plane:
        continue
    P += [plane.Origin] * 3
    V.append(plane.XAxis * scale)
    V.append(plane.YAxis * scale)
    V.append(plane.ZAxis * scale)
    C += [red, green, blue]

W = 3
# ---------- end draw_2 ----------
vdisex = VectorDisplayEx(Point=draw_2.P, Vector=draw_2.V, Colour=draw_2.C, Width=draw_2.W)

# ----
# Visualisation Dashboard
counter_2 = Python3Script(
    my_assembly=transform.my_assembly,
    start=start_2,
    stop=stop_2,
    step=step_2,
    step_back=back_2,
    reset=reset_3,
    full=full_2,
    interval=list_5)  # -> out, counter
# ---------- counter_2: Python ----------
from scriptcontext import sticky as st
import Grasshopper

def update_component(ghenv, delay):
    """Schedule an update of the Grasshopper component.

    After the specified delay, the GH component will be automatically updated.

    Parameters
    ----------
    ghenv : :class:`GhPython.Component.PythonEnvironment`
        The current GHPython environment.
    delay : :obj:`int`
        Time in milliseconds until the update is performed.

    Raises
    ------
    ValueError
        If the delay is less than zero.

    """
    if delay <= 0:
        raise ValueError("Delay must be greater than zero")

    ghcomp = ghenv.Component
    ghdoc = ghcomp.OnPingDocument()

    def callback(ghdoc):
        if ghdoc.SolutionState != Grasshopper.Kernel.GH_ProcessStep.Process:
            ghcomp.ExpireSolution(False)

    ghdoc.ScheduleSolution(delay, Grasshopper.Kernel.GH_Document.GH_ScheduleDelegate(callback))

L = range(my_assembly.graph.number_of_nodes())

# store data in component
guid = str(ghenv.Component.InstanceGuid)
counter_key = "counter_" + guid
running_key = "running_" + guid

if counter_key not in st:
    st[counter_key] = 0

if running_key not in st:
    st[running_key] = False
    

if st[running_key]:
    if st[counter_key] < len(L) - 1:
        st[counter_key] += 1
        update_component(ghenv, interval)
    else:
        st[counter_key] = 0
        st[running_key] = False
    
if start:
    st[running_key] = True

if stop:
    st[running_key] = False

if step:
    if st[counter_key] < len(L) - 1:
        st[counter_key] += 1

if step_back:
    if st[counter_key] < len(L) - 1:
        st[counter_key] -= 1

if reset:
    st[counter_key] = 0
    st[running_key] = False

if full:
    st[counter_key] = len(L)-1

if len(L):
    item = L[st[counter_key]]


#st["visualisation_counter"] = st[counter_key]
counter = st[counter_key]+1
# ---------- end counter_2 ----------
panel_17 = Panel(counter_2.counter)
visualize_3 = Python3Script(my_assembly=transform.my_assembly, show=list_6, highlight_current_part=Toggle(False), counter=panel_17)  # -> out, parts_geometry, parts_frame, current_part_geometry, current_part_frame, current_part_gripping_frame
# ---------- visualize_3: Python ----------
from compas_rhino.conversions import mesh_to_rhino, box_to_rhino, frame_to_rhino

#print assembly
print(my_assembly)
#counter = int(counter)

#get parts datastructure
parts = [p for p in my_assembly.parts()]

#get current part

#if show_wall == True:

if show == "show_all":
    
#get parts datastructure
    parts = [p for p in my_assembly.parts()]
    parts_geometry = []
    parts_frame = []

    #part = parts[0]
    #print(part.gripping_frame)

    #extract the mesh of the parts for visulization (+ converted to rhino mesh)
    parts_geometry = [mesh_to_rhino(p.mesh) for p in parts]
    
    #extract the frame of the parts for visulization (+ converted to rhino plane)
    parts_frame = [frame_to_rhino(p.frame) for p in parts]
    #print(parts_geometry)

    key = my_assembly.graph.number_of_nodes()-1

if show == "show_until_key":
    #extract the mesh of the parts for visulization (+ converted to rhino mesh)
    parts_geometry = [mesh_to_rhino(p.mesh) for p in parts[0:int(counter)]]
    
    #extract the frame of the parts for visulization (+ converted to rhino plane)
    parts_frame = [frame_to_rhino(p.frame) for p in parts[0:int(counter)]]

    key = int(counter)-1

if show == "show_nothing":
    print("Nothing to see")
    pass

if highlight_current_part:
    current_part = my_assembly.part(key)
    current_part_geometry = mesh_to_rhino(current_part.mesh)
    current_part_frame = frame_to_rhino(current_part.frame)
    current_part_gripping_frame = frame_to_rhino(current_part.gripping_frame)
    
    print(current_part.__data__)
# ---------- end visualize_3 ----------
panel_18 = Panel(visualize_3.out)

radiation_simulation = RadiationSimulation(
    sky_mtx=sun_hours.sky_mtx,
    geometry=visualize_3.parts_geometry,
    context=context_input,
    offset_dist=number_slider_2,
    run=toggle_3)  # -> mesh, legend
geo_12 = Geometry(radiation_simulation.legend)
brick_wall = Mesh(radiation_simulation.mesh)

geo_13 = Geometry([visualize_3.current_part_frame, visualize_3.current_part_geometry])
geo_14 = Geometry(visualize_3.parts_geometry)
geo_15 = Geometry(visualize_3.parts_frame)
geo_16 = Geometry(visualize_3.current_part_gripping_frame)
preview_10 = CustomPreview(Geometry=geo_14, Material=ColourSwatch(SwatchColor=RGB(196, 141, 141)))
preview_11 = CustomPreview(Geometry=geo_15, Material=ColourSwatch(SwatchColor=RGB(255, 125, 157)))
preview_12 = CustomPreview(Geometry=geo_13, Material=ColourSwatch(SwatchColor=RGB(255, 125, 157)))
preview_13 = CustomPreview(Geometry=geo_16, Material=ColourSwatch(SwatchColor=RGB(255, 125, 157)))

draw_3 = Python3Script(planes=geo_16, scale=Slider(0.2, range=0..1))  # -> out, P, V, C, W; inputs planes: list of Plane; same code as draw_2
vdisex_2 = VectorDisplayEx(Point=draw_3.P, Vector=draw_3.V, Colour=draw_3.C, Width=draw_3.W)

# ==== cluster SunHours
epw_file = ClusterInput()
start_month = ClusterInput()
start_day = ClusterInput()
start_hour = ClusterInput()
end_month = ClusterInput()
end_day = ClusterInput()
end_hour = ClusterInput()
importepw = LBImportEPW(epw_file=epw_file)  # -> location, dry_bulb_temperature, dew_point_temperature, relative_humidity, wind_speed, wind_direction, direct_normal_rad, diffuse_horizontal_rad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; plug-in component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
analysisperiod = LBAnalysisPeriod(
    start_month=start_month,
    start_day=start_day,
    start_hour=start_hour,
    end_month=end_month,
    end_day=end_day,
    end_hour=end_hour)  # -> period, hoys, dates; plug-in component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
north = ClusterInput()
hoys = ClusterOutput(analysisperiod.hoys)
skymatrix = LBCumulativeSkyMatrix(
    north=north,
    location=importepw.location,
    direct_rad=importepw.direct_normal_rad,
    diffuse_rad=importepw.diffuse_horizontal_rad,
    hoys=analysisperiod.hoys)  # -> report, sky_mtx; plug-in component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
location = ClusterOutput(importepw.location)
sky_mtx = ClusterOutput(skymatrix.sky_mtx)
colrange = LBColorRange(index=Slider(5, range=0..100))  # -> colors; plug-in component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
geometry = ClusterInput()
context = ClusterInput()
grid_size = ClusterInput()
offset_dist = ClusterInput()
run = ClusterInput()
legendpar = LBLegendParameters(colors=colrange)  # -> leg_par; plug-in component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
incidentradiation = LBIncidentRadiation(
    sky_mtx=skymatrix.sky_mtx,
    geometry=flatten(geometry),
    context=flatten(context),
    grid_size=grid_size,
    offset_dist=offset_dist,
    legend_par=legendpar,
    run=run)  # -> report, points, results, total, mesh, legend, title, int_mtx; plug-in component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
results = ClusterOutput(incidentradiation.results)
mesh = ClusterOutput(incidentradiation.mesh)
legend = ClusterOutput(incidentradiation.legend)

# ==== cluster RadiationSimulation
colrange = LBColorRange(index=Slider(0, range=0..100))  # -> colors; plug-in component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
sky_mtx = ClusterInput()
geometry = ClusterInput()
context = ClusterInput()
offset_dist = ClusterInput()
run = ClusterInput()
legendpar = LBLegendParameters(colors=colrange)  # -> leg_par; plug-in component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
incidentradiation = LBIncidentRadiation(
    sky_mtx=sky_mtx,
    geometry=flatten(geometry),
    context=flatten(context),
    grid_size=Slider(1, range=0..1),
    offset_dist=offset_dist,
    legend_par=legendpar,
    run=run)  # -> report, points, results, total, mesh, legend, title, int_mtx; plug-in component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
legend = ClusterOutput(incidentradiation.legend)
mesh = ClusterOutput(incidentradiation.mesh)
