# Grasshopper definition assembly_design_configurator.ghx (Grasshopper 1.0.8)
# plug-ins: RhinoCodePluginGH

mesh = Mesh(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)
pln = Plane(PlaneXY(0, 0, 0))
mesh_2 = Mesh(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)  # disabled
pln_2 = Plane(PlaneXY(0, 0, 0))  # disabled

# ---- group: front_element
number_slider = Slider(3, range=0.4..10)  # disabled
number_slider_2 = Slider(3, range=0.3..10)  # disabled
panel = Panel("stretcher_header_bond")  # disabled
reference_element = GhPythonScript(plane=pln_2, rh_mesh=mesh_2, length=number_slider, height=number_slider_2, bond_type=panel)  # -> front_element, M; disabled
# ---------- reference_element: Python ----------
from climate_active_envelopes.assembly import ReferenceElement as Element
from compas.artists import Artist
from compas.geometry import Frame
from compas_rhino.geometry import RhinoMesh


frame = Frame(plane.Origin, plane.XAxis, plane.YAxis)

rhino_mesh = RhinoMesh.from_geometry(rh_mesh)
compas_mesh = rhino_mesh.to_compas()

front_element = Element.from_parameters(frame, compas_mesh, length, height, bond_type)

print front_element.length


M = Artist(front_element.mesh).draw()
# ---------- end reference_element ----------

# ----
py3 = Python3Script(mesh=mesh, plane=pln, length=Slider(3, range=0.4..10), height=Slider(3, range=0.4..10), bond_type="flemish_bond")  # -> out, a; inputs mesh: Mesh
# ---------- py3: Python ----------
from climate_active_envelopes import CAEElement



# from climate_active_envelopes.element import CAEElement as Element
# #from climate_active_envelopes.assembly import ReferenceElement as Element
# from compas.geometry import Frame
# #from compas_rhino.geometry import RhinoMesh



# frame = Frame(plane.Origin, plane.XAxis, plane.YAxis)

# #rhino_mesh = RhinoMesh.from_geometry(rh_mesh)
# #compas_mesh = rhino_mesh.to_compas()

# front_element = Element.from_parameters(frame, compas_mesh, length, height, bond_type)

# print(front_element.length)
# ---------- end py3 ----------
mesh_3 = Mesh(reference_element.M)  # disabled
connectivity = GhPythonScript()  # -> connectivity
# ---------- connectivity: Python ----------
connectivity = [[0,1], [1,2], [2,3], [3,0]]

#print reference_model.add_connection(0, 2)
#reference_model.add_connection(1, 3)
#reference_model.add_connection(2, 1)
#reference_model.add_connection(3, 0)
# ---------- end connectivity ----------

# ----
# Generate brick parts
list = ValueList({"none", "full", "insulated"}, selected="full")
part = Python3Script()  # -> out, full_brick, insulated_brick
# ---------- part: Python ----------
import os
from compas.geometry import Frame, Box
from compas.datastructures import Mesh
from climate_active_envelopes.assembly import CAEPart as Part



#full_brick
length, width, height = 0.24, 0.115, 0.075
full_brick = Part.from_dimensions(length=length, width=width, height=height)
full_brick.attributes['name'] = "full_brick"
#print(full_brick.attributes)
print(full_brick.__data__)

#insulated_brick_placeholder
# length, width, height = 0.245, 0.12, 0.075
# insulated_brick = Part.from_dimensions(length=length, width=width, height=height)
# insulated_brick.attributes['name'] = "insulated_brick"
# print(insulated_brick.__data__)



#insulated_brick
package_path = ghdoc.Path
data_path = os.path.abspath(os.path.join(package_path,"../../../climate_active_envelopes/data/brick_types"))
filename = 'insulated_brick_reduced.stl'
insulated_brick_mesh = Mesh.from_stl(os.path.join(data_path, filename))
insulated_brick = Part.from_mesh_and_frame(insulated_brick_mesh)
insulated_brick.attributes['name'] = "insulated_brick"
#print(insulated_brick.__data__)
# ---------- end part ----------
draw = Python3Script(full_brick=part.full_brick, insulated_brick=part.insulated_brick, show=list)  # -> M, P
# ---------- draw: Python ----------
from compas_rhino.conversions import mesh_to_rhino, box_to_rhino, frame_to_rhino
from climate_active_envelopes.assembly import CAEPart as Part
from compas.geometry import Frame
from compas.geometry import Vector
from compas.geometry import Box


if show=="full":

    #extract the mesh of the part for visulization
    compas_mesh_full = full_brick.mesh

    #convert to rhino mesh
    M = mesh_to_rhino(compas_mesh_full)

    #extract and convert to rhino plane
    P = frame_to_rhino(full_brick.frame)
    #brick_full.gripping_frame = full_brick.frame
    #print(full_brick.__data__)
    print(type(full_brick))

    
elif show == "insulated":
    
    #extract the mesh of the part for visulization
    compas_mesh_insulated = insulated_brick.mesh

    #convert to rhino mesh
    M = mesh_to_rhino(compas_mesh_insulated)
    
    #extract and convert to rhino plane
    P = frame_to_rhino(insulated_brick.frame)

else:
    pass
# ---------- end draw ----------
mesh_4 = Mesh(draw.M)
pln_3 = Plane(draw.P)

compas = Python3Script()  # -> out
# ---------- compas: Python ----------
import compas
print(compas.__version__)
# ---------- end compas ----------

number_slider_3 = Slider(120, range=0..360)

# ----
# Unload Python modules
button = Button()
unload = Python3Script(unload=button)  # -> out, a
# ---------- unload: Python ----------
from compas_ghpython import unload_modules

unload_modules('climate_active_envelopes')
unload_modules('assembly_information_model')
# ---------- end unload ----------

reference_model = GhPythonScript(init=Button(), reference_elements=reference_element.front_element, connectivity=connectivity)  # -> out, reference_model; inputs reference_elements: list, connectivity: list
# ---------- reference_model: Python ----------
from climate_active_envelopes.assembly import ReferenceModel
from compas.datastructures import Network
from compas_ghpython.artists import NetworkArtist



reference_model = ReferenceModel()

for i, element in enumerate(reference_elements):
    reference_model.add_element(element)

print connectivity

for connection in connectivity:
    reference_model.add_connection(connection[0], connection[1])

data = reference_model.network.to_data()
network = Network.from_data(data)



nodes, edges = NetworkArtist(network).draw()
# ---------- end reference_model ----------
total_length = Panel(compas)
list_2 = ValueList({"rotate", "translate"}, selected="rotate")
input_brep = Brep(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)

# ----
# Climate Simulation
number_slider_4 = Slider(16, range=0..100)
number_slider_5 = Slider(7, range=0..10)
number_slider_6 = Slider(1, range=0..10)
number_slider_7 = Slider(11, range=0..100)
number_slider_8 = Slider(8, range=0..10)
number_slider_9 = Slider(31, range=0..100)
number_slider_10 = Slider(0.2, range=0..1)
path = FilePath("C:\Users\julia\Downloads\DEU_BY_Munich-Theresienwiese.108650_TMYx\DEU_BY_Munich-Theresienwiese.108650_TMYx.epw")
context = Brep([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])
climate_simulation = ClimateSimulation(
    start_month=number_slider_5,
    start_day=number_slider_6,
    start_hour=number_slider_7,
    end_month=number_slider_8,
    end_day=number_slider_9,
    end_hour=number_slider_4,
    north=number_slider_3,
    geometry=input_brep,
    epw_file=path,
    context=context,
    grid_size=Slider(0.08, range=0..0.1),
    offset_dist=number_slider_10,
    run=Toggle(True))  # -> hoys, location, results, mesh
vals = Python3Script(results=climate_simulation.results)  # -> out, color_values; inputs results: list
# ---------- vals: Python ----------
from compas.itertools import normalize_values

color_values = normalize_values(results, 0.0, 0.7)
print(color_values)




"""
color_points = []

for i, point in enumerate(points):
    frame = Frame([color_values[i], point[1] , point[2]], [1,0,0], [0,1,0])
    
    color_points.append(frame.point)
"""
# ---------- end vals ----------
mesh_5 = Mesh(climate_simulation.mesh)
panel_2 = Panel(vals.color_values)

# ----
# Slicing mesh input
layer_height = Slider(0.1, range=0..1)
contour = Python3Script(brep=input_brep, layer_height=layer_height)  # -> out, curves; inputs brep: Mesh, layer_height: Double
# ---------- contour: Python ----------
import Rhino.Geometry as rg

mesh = brep

vertices = mesh.Vertices
pt_base = vertices[0]
pt_end = vertices[2]
print(pt_end)

pt_base = vertices[0]
pt_end = vertices[1]


start_plane = rg.Plane(pt_base, rg.Vector3d(0, 0, 1))
end_plane = rg.Plane(pt_end, rg.Vector3d(0, 0, 1))

curves =rg.Mesh.CreateContourCurves(mesh, pt_base,  pt_end, layer_height)
# ---------- end contour ----------
crv = Curve(contour.curves)

# ----
# Create empty assembly datastructure
button_2 = Button()
assembly = Python3Script(init=button_2)  # -> out, my_assembly
# ---------- assembly: Python ----------
from climate_active_envelopes.assembly import CAEAssembly as Assembly

#create empty assembly
my_assembly = Assembly()
# ---------- end assembly ----------

# ----
# Create brick assembly
list_3 = ValueList({"flemish_bond": 0}, selected="flemish_bond")
create_assembly = Python3Script(
    bond=list_3,
    my_assembly=assembly.my_assembly,
    brick_full=part.full_brick,
    brick_insulated=part.insulated_brick,
    plane=pln_3,
    lines=contour.curves)  # -> out, my_assembly, total_length; inputs plane: Plane, lines: list of Line
# ---------- create_assembly: Python ----------
total_length = my_assembly.generate_wall(bond,
                        brick_full, 
                        brick_insulated,
                        plane,
                        lines
                        )
# ---------- end create_assembly ----------
total_length_2 = Panel(create_assembly.total_length)

# ----
# Apply Gradient
get_centroids = Python3Script(my_assembly=create_assembly.my_assembly, transform_type=list_2)  # -> out, my_assembly, keys; inputs transform_type: String
# ---------- get_centroids: Python ----------
from compas.geometry import Frame, Translation, Rotation, Transformation, Point
from compas_rhino.conversions import plane_to_compas_frame, point_to_compas

import math
import Rhino.Geometry as rg

values = []
keys = []


for key in my_assembly.graph.nodes_where({"transform_type": transform_type}):
    part = my_assembly.part(key)
    keys.append(key)

my_assembly = my_assembly
# ---------- end get_centroids ----------
toggle = BooleanToggle(True)
apply_gradient = Python3Script(
    my_assembly=create_assembly.my_assembly,
    values=vals.color_values,
    keys=get_centroids.keys,
    transform_type=list_2,
    transform=Button())  # -> out, my_assembly; inputs values: list, keys: list
# ---------- apply_gradient: Python ----------
import math
import Rhino.Geometry as rg
from compas.geometry import Frame, Point
from compas.geometry import Transformation, Rotation, Translation


#print(my_assembly.apply_gradient(values, keys, transform_type_))


#print(my_assembly.__data__)

#transform_types = {node_id: my_assembly.graph.node_attribute(node_id, 'transform_type') for node_id in my_assembly.graph.nodes()}




if transform:
    assembly = my_assembly
    my_assembly.apply_gradient(values, keys, transform_type)

    #print(test)
# ---------- end apply_gradient ----------

pt = Point(Point(6.146412243, 26.72663197, 0))
sunpath = LBSunPath(location=climate_simulation.location, hoys=climate_simulation.hoys, center_pt=pt, scale=Slider(0.6, range=0..10))  # -> report, vectors, altitudes, azimuths, hoys, sun_pts, analemma, daily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; plug-in component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

vec = Vector(sunpath.vectors)

# ----
# Transform
toggle_2 = BooleanToggle(False)
pln_4 = Plane(PlaneXY(2.43007085, -1.968439302, -0.2055923429))
transform = Python3Script(my_assembly=apply_gradient.my_assembly, transform=toggle_2, origin_plane=pln_3, new_origin_plane=pln_4)  # -> out, my_assembly
# ---------- transform: Python ----------
from compas.geometry import Frame, Transformation, Rotation, Translation
from compas_rhino.conversions import plane_to_compas_frame


new_origin_frame = plane_to_compas_frame(new_origin_plane)
origin_frame = plane_to_compas_frame(origin_plane)

if transform:
    T = Transformation.from_frame_to_frame(origin_frame, new_origin_frame)
    my_assembly = my_assembly.transformed(T)
# ---------- end transform ----------

start = Button()
stop = Button()
step = Button()
back = Button()
reset = Button()
full = Button()
list_4 = ValueList({"20", "50", "100", "500", "1000", "5000"}, selected="500")
counter = Python3Script(
    my_assembly=transform.my_assembly,
    start=start,
    stop=stop,
    step=step,
    step_back=back,
    reset=reset,
    full=full,
    interval=list_4)  # -> out, counter
# ---------- counter: Python ----------
from scriptcontext import sticky as st
import Grasshopper

def update_component(ghenv, delay):
    """Schedule an update of the Grasshopper component.

    After the specified delay, the GH component will be automatically updated.

    Parameters
    ----------
    ghenv : :class:`GhPython.Component.PythonEnvironment`
        The current GHPython environment.
    delay : :obj:`int`
        Time in milliseconds until the update is performed.

    Raises
    ------
    ValueError
        If the delay is less than zero.

    """
    if delay <= 0:
        raise ValueError("Delay must be greater than zero")

    ghcomp = ghenv.Component
    ghdoc = ghcomp.OnPingDocument()

    def callback(ghdoc):
        if ghdoc.SolutionState != Grasshopper.Kernel.GH_ProcessStep.Process:
            ghcomp.ExpireSolution(False)

    ghdoc.ScheduleSolution(delay, Grasshopper.Kernel.GH_Document.GH_ScheduleDelegate(callback))

L = range(my_assembly.graph.number_of_nodes())

# store data in component
guid = str(ghenv.Component.InstanceGuid)
counter_key = "counter_" + guid
running_key = "running_" + guid

if counter_key not in st:
    st[counter_key] = 0

if running_key not in st:
    st[running_key] = False
    

if st[running_key]:
    if st[counter_key] < len(L) - 1:
        st[counter_key] += 1
        update_component(ghenv, interval)
    else:
        st[counter_key] = 0
        st[running_key] = False
    
if start:
    st[running_key] = True

if stop:
    st[running_key] = False

if step:
    if st[counter_key] < len(L) - 1:
        st[counter_key] += 1

if step_back:
    if st[counter_key] < len(L) - 1:
        st[counter_key] -= 1

if reset:
    st[counter_key] = 0
    st[running_key] = False

if full:
    st[counter_key] = len(L)-1

if len(L):
    item = L[st[counter_key]]


#st["visualisation_counter"] = st[counter_key]
counter = st[counter_key]+1
# ---------- end counter ----------
panel_3 = Panel(counter.counter)

# ----
# Visualisation Dashboard
toggle_3 = BooleanToggle(False)
list_5 = ValueList({"show all": "show_all", "show until key": "show_until_key", "show nothing": "show_nothing"}, selected="show all")
visualize = Python3Script(my_assembly=transform.my_assembly, show=list_5, highlight_current_part=toggle_3, counter=panel_3)  # -> out, parts_geometry, parts_frame, current_part_geometry, current_part_frame, current_part_gripping_frame
# ---------- visualize: Python ----------
from compas_rhino.conversions import mesh_to_rhino, box_to_rhino, frame_to_rhino

#print assembly
print(my_assembly)
#counter = int(counter)

#get parts datastructure
parts = [p for p in my_assembly.parts()]

#get current part

#if show_wall == True:

if show == "show_all":
    
#get parts datastructure
    parts = [p for p in my_assembly.parts()]
    parts_geometry = []
    parts_frame = []

    #part = parts[0]
    #print(part.gripping_frame)

    #extract the mesh of the parts for visulization (+ converted to rhino mesh)
    parts_geometry = [mesh_to_rhino(p.mesh) for p in parts]
    
    #extract the frame of the parts for visulization (+ converted to rhino plane)
    parts_frame = [frame_to_rhino(p.frame) for p in parts]
    #print(parts_geometry)

    key = my_assembly.graph.number_of_nodes()-1

if show == "show_until_key":
    #extract the mesh of the parts for visulization (+ converted to rhino mesh)
    parts_geometry = [mesh_to_rhino(p.mesh) for p in parts[0:int(counter)]]
    
    #extract the frame of the parts for visulization (+ converted to rhino plane)
    parts_frame = [frame_to_rhino(p.frame) for p in parts[0:int(counter)]]

    key = int(counter)-1

if show == "show_nothing":
    print("Nothing to see")
    pass

if highlight_current_part:
    current_part = my_assembly.part(key)
    current_part_geometry = mesh_to_rhino(current_part.mesh)
    current_part_frame = frame_to_rhino(current_part.frame)
    current_part_gripping_frame = frame_to_rhino(current_part.gripping_frame)
    
    print(current_part.__data__)
# ---------- end visualize ----------
panel_4 = Panel(visualize.out)
geo = Geometry(visualize.parts_geometry)
geo_2 = Geometry(visualize.parts_frame)
geo_3 = Geometry([visualize.current_part_frame, visualize.current_part_geometry])
geo_4 = Geometry(visualize.current_part_gripping_frame)
preview = CustomPreview(Geometry=geo, Material=ColourSwatch(SwatchColor=RGB(196, 141, 141)))
preview_2 = CustomPreview(Geometry=geo_2, Material=ColourSwatch(SwatchColor=RGB(255, 125, 157)))
preview_3 = CustomPreview(Geometry=geo_3, Material=ColourSwatch(SwatchColor=RGB(255, 125, 157)))
preview_4 = CustomPreview(Geometry=geo_4, Material=ColourSwatch(SwatchColor=RGB(255, 125, 157)))
draw_2 = Python3Script(planes=geo_4, scale=Slider(0.2, range=0..1))  # -> out, P, V, C, W; inputs planes: list of Plane
# ---------- draw_2: Python ----------
from System.Drawing import Color

red = Color.FromArgb(255, 0, 0)
green = Color.FromArgb(0, 255, 0)
blue = Color.FromArgb(0, 0, 255)

P = []
V = []
C = []

scale = float(scale)

for plane in planes:
    if not plane:
        continue
    P += [plane.Origin] * 3
    V.append(plane.XAxis * scale)
    V.append(plane.YAxis * scale)
    V.append(plane.ZAxis * scale)
    C += [red, green, blue]

W = 3
# ---------- end draw_2 ----------
vdisex = VectorDisplayEx(Point=draw_2.P, Vector=draw_2.V, Colour=draw_2.C, Width=draw_2.W)

sun_study = SunStudy(
    start_month=number_slider_5,
    start_day=number_slider_6,
    start_hour=number_slider_7,
    index=Slider(0, range=0..100),
    end_month=number_slider_8,
    end_day=number_slider_9,
    end_hour=number_slider_4,
    north=number_slider_3,
    geometry=geo,
    context=context,
    grid_size=Slider(1, range=0..1),
    offset_dist=number_slider_10,
    run=Toggle(True))
brick_wall = Mesh(sun_study)

# ----
# Export to JSON
path_2 = Python3Script()  # -> HERE, DATA, ASSEMBLY
# ---------- path_2: Python ----------
import os

HERE = os.path.dirname(ghdoc.Path)
DATA = os.path.abspath(os.path.join(HERE, "..", "data"))
ASSEMBLY = os.path.abspath(os.path.join(DATA, "assembly"))

print(HERE)
print(DATA)
print(ASSEMBLY)
# ---------- end path_2 ----------
export = Button()
export_2 = Python3Script(ASSEMBLY=path_2.ASSEMBLY, my_assembly=transform.my_assembly, export=export)  # -> out; inputs ASSEMBLY: String
# ---------- export_2: Python ----------
import os

#print(my_assembly.__data__)
if export:
    #print(DATA)
    filename = "brickwall_2x2_full_and_insulated.json"
    PATH = os.path.join(ASSEMBLY, filename)

    # the assembly has to be serialized such that it can be called from CPython
    my_assembly.to_json(PATH)
# ---------- end export_2 ----------

number_slider_11 = Slider(3, range=0.4..10)  # disabled
number_slider_12 = Slider(1.2, range=0.3..10)  # disabled
py3_2 = Python3Script(wall_length=number_slider_11, wall_height=number_slider_12)  # -> out, M; inputs wall_length: Double, wall_height: Double; disabled
# ---------- py3_2: Python ----------
from compas.datastructures import Mesh
from compas.geometry import Curve, Point, Frame
from compas_rhino.conversions import frame_to_rhino, mesh_to_rhino
import math as m
import Rhino.Geometry as rg


mesh_wall = Mesh()

mesh_grid = []

length, width, height, mortar = 0.245, 0.12, 0.075, 0.11

step_in_z = height + mortar/2
step_in_x = (length+width)/2 + mortar
vertices_per_row = int(wall_length / step_in_x)
row = int(wall_height / step_in_z)


total_length = (vertices_per_row - 1) * (step_in_x)


#create vertices
for j in range(row): 
    z = j * step_in_z
    for i in range(vertices_per_row): 
        y = 0
        x = i * step_in_x
        mesh_wall.add_vertex(x = x, y = y, z = z) 

#create faces
for j in range(row -1):
    planes_per_row = []
    for i in range(vertices_per_row - 1):
        a = i + j * vertices_per_row
        b = a + vertices_per_row
        c = b + 1
        d = a + 1

#create planes at faces_centroid
        vertex_centroid = mesh_wall.face_centroid(mesh_wall.add_face([a, b, c, d]))
        vertex_pts = Point(vertex_centroid[0], vertex_centroid[1], vertex_centroid[2])
        vertex_frame = Frame([vertex_pts[0], vertex_pts[1], vertex_pts[2]], [1,0,0], [0,1,0])
        vertex_plane = frame_to_rhino(vertex_frame)
        planes_per_row.append(vertex_plane)
    mesh_grid.append(planes_per_row)

face_cplanes = [plane for planes_row in mesh_grid for plane in planes_row]

M = mesh_to_rhino(mesh_wall)
# ---------- end py3_2 ----------

# ==== cluster ClimateSimulation
epw_file = ClusterInput()
start_month = ClusterInput()
start_day = ClusterInput()
start_hour = ClusterInput()
end_month = ClusterInput()
end_day = ClusterInput()
end_hour = ClusterInput()
importepw = LBImportEPW(epw_file=epw_file)  # -> location, dry_bulb_temperature, dew_point_temperature, relative_humidity, wind_speed, wind_direction, direct_normal_rad, diffuse_horizontal_rad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; plug-in component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
analysisperiod = LBAnalysisPeriod(
    start_month=start_month,
    start_day=start_day,
    start_hour=start_hour,
    end_month=end_month,
    end_day=end_day,
    end_hour=end_hour)  # -> period, hoys, dates; plug-in component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
north = ClusterInput()
hoys = ClusterOutput(analysisperiod.hoys)
skymatrix = LBCumulativeSkyMatrix(
    north=north,
    location=importepw.location,
    direct_rad=importepw.direct_normal_rad,
    diffuse_rad=importepw.diffuse_horizontal_rad,
    hoys=analysisperiod.hoys)  # -> report, sky_mtx; plug-in component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
location = ClusterOutput(importepw.location)
colrange = LBColorRange(index=Slider(5, range=0..100))  # -> colors; plug-in component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
geometry = ClusterInput()
context = ClusterInput()
grid_size = ClusterInput()
offset_dist = ClusterInput()
run = ClusterInput()
legendpar = LBLegendParameters(colors=colrange)  # -> leg_par; plug-in component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
incidentradiation = LBIncidentRadiation(
    sky_mtx=skymatrix.sky_mtx,
    geometry=flatten(geometry),
    context=flatten(context),
    grid_size=grid_size,
    offset_dist=offset_dist,
    legend_par=legendpar,
    run=run)  # -> report, points, results, total, mesh, legend, title, int_mtx; plug-in component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
results = ClusterOutput(incidentradiation.results)
mesh = ClusterOutput(incidentradiation.mesh)

# ==== cluster SunStudy
path = FilePath("C:\Users\julia\Downloads\DEU_BY_Munich-Theresienwiese.108650_TMYx\DEU_BY_Munich-Theresienwiese.108650_TMYx.epw")
start_month = ClusterInput()
start_day = ClusterInput()
start_hour = ClusterInput()
end_month = ClusterInput()
end_day = ClusterInput()
end_hour = ClusterInput()
importepw = LBImportEPW(epw_file=path)  # -> location, dry_bulb_temperature, dew_point_temperature, relative_humidity, wind_speed, wind_direction, direct_normal_rad, diffuse_horizontal_rad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; plug-in component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
analysisperiod = LBAnalysisPeriod(
    start_month=start_month,
    start_day=start_day,
    start_hour=start_hour,
    end_month=end_month,
    end_day=end_day,
    end_hour=end_hour)  # -> period, hoys, dates; plug-in component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
north = ClusterInput()
skymatrix = LBCumulativeSkyMatrix(
    north=north,
    location=importepw.location,
    direct_rad=importepw.direct_normal_rad,
    diffuse_rad=importepw.diffuse_horizontal_rad,
    hoys=analysisperiod.hoys)  # -> report, sky_mtx; plug-in component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
index = ClusterInput()
colrange = LBColorRange(index=index)  # -> colors; plug-in component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
geometry = ClusterInput()
context = ClusterInput()
grid_size = ClusterInput()
offset_dist = ClusterInput()
run = ClusterInput()
legendpar = LBLegendParameters()  # -> leg_par; plug-in component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
incidentradiation = LBIncidentRadiation(
    sky_mtx=skymatrix.sky_mtx,
    geometry=flatten(geometry),
    context=flatten(context),
    grid_size=grid_size,
    offset_dist=offset_dist,
    legend_par=legendpar,
    run=run)  # -> report, points, results, total, mesh, legend, title, int_mtx; plug-in component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
mesh = ClusterOutput(incidentradiation.mesh)
