# Grasshopper definition assembly_design_v2-backup solar radiation.ghx (Grasshopper 1.0.8)
# plug-ins: MeshEdit Components

geo = Geometry(<extrusion referenced from the Rhino model>)
geo_2 = Geometry(<extrusion referenced from the Rhino model>)
geo_3 = Geometry(<extrusion referenced from the Rhino model>)
geo_4 = Geometry(<extrusion referenced from the Rhino model>)
geo_5 = Geometry(<extrusion referenced from the Rhino model>)
geo_6 = Geometry(<extrusion referenced from the Rhino model>)
geo_7 = Geometry(<extrusion referenced from the Rhino model>)
geo_8 = Geometry(<extrusion referenced from the Rhino model>)
quad = Quadrangulate(Mesh=geo, Angle=0.03490658504, Ratio=0.875)  # -> Mesh, Count
quad_2 = Quadrangulate(Mesh=geo_2, Angle=0.03490658504, Ratio=0.875)  # -> Mesh, Count
quad_3 = Quadrangulate(Mesh=geo_3, Angle=0.03490658504, Ratio=0.875)  # -> Mesh, Count
quad_4 = Quadrangulate(Mesh=geo_4, Angle=0.03490658504, Ratio=0.875)  # -> Mesh, Count
quad_5 = Quadrangulate(Mesh=geo_5, Angle=0.03490658504, Ratio=0.875)  # -> Mesh, Count
quad_6 = Quadrangulate(Mesh=geo_6, Angle=0.03490658504, Ratio=0.875)  # -> Mesh, Count
quad_7 = Quadrangulate(Mesh=geo_7, Angle=0.03490658504, Ratio=0.875)  # -> Mesh, Count
quad_8 = Quadrangulate(Mesh=geo_8, Angle=0.03490658504, Ratio=0.875)  # -> Mesh, Count

geo_9 = Geometry(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)
geo_10 = Geometry(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)
geo_11 = Geometry(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)
compas = Python3Script()  # -> out
# ---------- compas: Python ----------
import compas
print(compas.__version__)
# ---------- end compas ----------

# ----
# Generate brick parts
part = Python3Script()  # -> out, brick_full, brick_insulated, brick_air_dried, brick_perforated, brick_half
# ---------- part: Python ----------
import os
from compas.geometry import Frame, Box
from compas.datastructures import Mesh
from climate_active_envelopes.assembly import CAEPart as Part



#brick_full
length, width, height = 0.24, 0.115, 0.071
brick_full = Part.from_dimensions(name = "brick_full", length=length, width=width, height=height)
#print(brick_full.attributes)
#print(brick_full.__data__)

#brick_air_dried
length, width, height = 0.24, 0.115, 0.071
brick_air_dried = Part.from_dimensions(name = "brick_air_dried", length=length, width=width, height=height)

#brick_insulated_placeholder_new
length, width, height = 0.24, 0.115, 0.071
brick_insulated = Part.from_dimensions(name = "brick_insulated", length=length, width=width, height=height)

#brick_insulated
# package_path = ghdoc.Path
# data_path = os.path.abspath(os.path.join(package_path,"../../../climate_active_envelopes/data/brick_types"))
# filename = 'insulated_brick_all.stl'
# brick_insulated_mesh = Mesh.from_stl(os.path.join(data_path, filename))
# brick_insulated = Part.from_mesh_and_frame(brick_insulated_mesh)
# brick_insulated.attributes['name'] = "brick_insulated"
#print(brick_insulated.__data__)


#corner brick
length, width, height = 0.24, 0.0575, 0.071
brick_half = Part.from_dimensions(name = "brick_half", length=length, width=width, height=height)

#brick_vertically perforated
length, width, height = 0.247, 0.365, 0.249
brick_perforated = Part.from_dimensions(name = "brick_perforated", length=length, width=width, height=height)
# ---------- end part ----------
list = ValueList({"none", "full", "insulated", "perforated", "half"}, selected="none")
draw = Python3Script(
    brick_full=part.brick_full,
    brick_insulated=part.brick_insulated,
    brick_perforated=part.brick_perforated,
    brick_half=part.brick_half,
    show=list)  # -> M, P
# ---------- draw: Python ----------
from compas_rhino.conversions import mesh_to_rhino, box_to_rhino, frame_to_rhino
from climate_active_envelopes.assembly import CAEPart as Part
from compas.geometry import Frame
from compas.geometry import Vector
from compas.geometry import Box


if show=="full":

    #extract the mesh of the part for visulization
    compas_mesh_full = brick_full.mesh

    #convert to rhino mesh
    M = mesh_to_rhino(compas_mesh_full)

    #extract and convert to rhino plane
    P = frame_to_rhino(brick_full.frame)
    #brick_full.gripping_frame = full_brick.frame
    #print(full_brick.__data__)
    print(type(brick_full))

    
elif show == "insulated":
    
    #extract the mesh of the part for visulization
    compas_mesh_insulated = brick_insulated.mesh

    #convert to rhino mesh
    M = mesh_to_rhino(compas_mesh_insulated)
    
    #extract and convert to rhino plane
    P = frame_to_rhino(brick_insulated.frame)

elif show == "half":

    #extract the mesh of the part for visulization
    compas_mesh_half = brick_half.mesh

    #convert to rhino mesh
    M = mesh_to_rhino(compas_mesh_half)
    
    #extract and convert to rhino plane
    P = frame_to_rhino(brick_half.frame)

elif show == "perforated":
    #extract the mesh of the part for visulization
    compas_mesh_perforated = brick_perforated.mesh

    #convert to rhino mesh
    M = mesh_to_rhino(compas_mesh_perforated)
    
    #extract and convert to rhino plane
    P = frame_to_rhino(brick_perforated.frame)

else:
    pass
# ---------- end draw ----------
colour_swatch = ColourSwatch(SwatchColor=RGB(228, 141, 138))
preview = CustomPreview(Geometry=draw.M, Material=ColourSwatch(SwatchColor=RGB(234, 161, 149)))
pln = Plane(draw.P)

# ----
# Sun Path
number_slider = Slider(50, range=0..360)

list_2 = ValueList({"rotate", "translate"}, selected="translate")
list_3 = ValueList({"clockwise": "right", "counter clockwise": "left"}, selected="counter clockwise")
transform = Button()
reset = Button()

# ----
# Unload Python modules
# Reference Model & Building Components
button = Button()
unload = Python3Script(unload=button)  # -> out, a
# ---------- unload: Python ----------
#from compas_ghpython import unload_modules
from compas_rhino import unload_modules

unload_modules('climate_active_envelopes')
unload_modules('assembly_information_model')
# ---------- end unload ----------

quad_9 = Quadrangulate(Mesh=geo_9, Angle=0.03490658504, Ratio=0.875)  # -> Mesh, Count
quad_10 = Quadrangulate(Mesh=geo_11, Angle=0.03490658504, Ratio=0.875)  # -> Mesh, Count
compas___version = Panel(compas)

# ----
# Create empty assembly
# datastructure
button_2 = Button()
assembly = Python3Script(init=button_2)  # -> out, my_assembly
# ---------- assembly: Python ----------
from climate_active_envelopes.assembly import CAEAssembly as Assembly

#create empty assembly
my_assembly = Assembly()
# ---------- end assembly ----------

# ----
# Analysis Period
analysisperiod = LBAnalysisPeriod(
    start_month=Slider(6, range=0..10),
    start_day=Slider(1, range=0..10),
    start_hour=Slider(11, range=0..100),
    end_month=Slider(8, range=0..10),
    end_day=Slider(31, range=0..100),
    end_hour=Slider(16, range=0..100))  # -> period, hoys, dates; plug-in component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

panel = Panel("https://climate.onebuilding.org/WMO_Region_6_Europe/DEU_Germany/BY_Bayern/DEU_BY_Munich-Theresienwiese.108650_TMYx.zip")
pt = Point(Point(13.73362005, -0.3128829712, -0.015))
sun_path = SunPath(north=number_slider, hoys=analysisperiod.hoys, center_pt=pt, scale="0.17", weather_url=panel)  # -> vectors, location, direct_normal_rad, diffuse_horizontal_rad, M, compass, analemma

next_neighbor = Button()
next_edge = Button()

list_4 = ValueList({"From Reference Model": "reference_model", "From Input Surface": "mesh"}, selected="From Reference Model")
list_5 = ValueList({"Flemish bond": "flemish_bond", "Vertical bond": "vertical_bond"}, selected="Flemish bond")
list_6 = ValueList({"Cross": "cross", "Diamond_L": "diamond_large", "Diamond_S": "diamond_small"}, selected="Cross")
list_7 = ValueList({"Single layer": "single_layer", "Double layer": "double_layer"}, selected="Double layer")

# ----
# Topology of Building Components
next_face = Button()
previous_face = Button()
reset_2 = Button()

butt_joint_width = Slider(0.015, range=0.009..0.015)
bed_joint_height = Slider(0.01, range=0.009..0.015)

swatch = ColourSwatch(SwatchColor=RGB(41, 41, 41))
preview_2 = CustomPreview(Geometry=sun_path.M, Material=ColourSwatch(SwatchColor=RGB(255, 255, 0)))
preview_3 = CustomPreview(Geometry=sun_path.compass, Material=ColourSwatch(SwatchColor=RGB(0, 0, 0)))
preview_4 = CustomPreview(Geometry=sun_path.compass, Material=swatch)
curve_preview = CustomCurvePreview(Curve=sun_path.compass, Linetype={Path="(Continuous)", Segments=[]}, Colour=swatch)

context_input = Brep([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])
context_input_2 = Brep(<brep referenced from the Rhino model>)

# ----
# Brick Assembly & Brick Parts
input_surface = Brep(<brep referenced from the Rhino model>)

context_input_3 = Brep([<brep referenced from the Rhino model> x7])
context_input_4 = Brep(context_input)
skymatrix = LBCumulativeSkyMatrix(
    north=number_slider,
    location=sun_path.location,
    direct_rad=sun_path.direct_normal_rad,
    diffuse_rad=sun_path.diffuse_horizontal_rad,
    hoys=analysisperiod.hoys)  # -> report, sky_mtx; plug-in component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
number_slider_2 = Slider(0.1, range=0..0.1)
legendpar = LBLegendParameters(
    max=Slider(290, range=0..1000),
    seg_height=number_slider_2,
    seg_width=number_slider_2,
    text_height=Slider(0.06, range=0..0.1))  # -> leg_par; plug-in component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
geo_12 = Geometry([<mesh referenced from the Rhino model> x581])
weldvertices = MeshWeldVertices(Mesh=geo_12, Tolerance=0.01)  # -> RuntimeMessage, Mesh
unifynormals = MeshUnifyNormals(Mesh=weldvertices.Mesh)
facen = FaceNormals(Mesh=unifynormals)  # -> Centers, Normals; disabled
vdis = VectorDisplay(Anchor=facen.Centers, Vector=facen.Normals)  # disabled

show_face_neighbor_until_key = BooleanToggle(False)
show_inner_wall_neighbors = BooleanToggle(False)
show_wall_neighbors = BooleanToggle(False)
show_slab_neighbors = BooleanToggle(False)
show_face_neighbor = BooleanToggle(False)
show_current_edge = BooleanToggle(False)
show_vface_edges = BooleanToggle(False)
show_hface_edges = BooleanToggle(False)

start = Button()
stop = Button()
step = Button()
back = Button()
reset_3 = Button()
full = Button()
list_8 = ValueList({"20", "50", "100", "500", "1000", "5000"}, selected="500")

show_face_until_key = BooleanToggle(False)
show_current_face = BooleanToggle(True)
show_all = BooleanToggle(False)

list_9 = ValueList({"show all": "show_all", "show until key": "show_until_key", "show nothing": "show_nothing", "show connections": "show_connections", "show patches": "show_patches", "show patch"}, selected="show all")

pln_2 = Plane(PlaneXY(0, 0, 0))

compute = Button()
clear = Button()

y_axis = Curve(<curve referenced from the Rhino model>)
# Generate assembly patches
x_axis = Curve(<curve referenced from the Rhino model>)
plane = Python3Script(plane_axes=[x_axis, y_axis])  # -> out, plane, sphere; inputs plane_axes: list of Curve
# ---------- plane: Python ----------
import Rhino.Geometry as rg
from compas_rhino.conversions import  plane_to_compas_frame, sphere_to_rhino
from compas.geometry import Sphere

x_axis, y_axis = plane_axes



x_axis = rg.Line(x_axis.PointAtStart, x_axis.PointAtEnd)
y_axis = rg.Line(y_axis.PointAtStart, y_axis.PointAtEnd)

if x_axis.From.DistanceTo(y_axis.From) < 0.01:
    origin = x_axis.From
    xvec = x_axis.Direction
    yvec = y_axis.Direction
elif x_axis.To.DistanceTo(y_axis.To) < 0.01:
    origin = x_axis.To
    xvec = -x_axis.Direction
    yvec = -y_axis.Direction
elif x_axis.From.DistanceTo(y_axis.To) < 0.01:
    origin = x_axis.From
    xvec = x_axis.Direction
    yvec = -y_axis.Direction
elif x_axis.To.DistanceTo(y_axis.From) < 0.01:
    origin = x_axis.To
    xvec = -x_axis.Direction
    yvec = y_axis.Direction

plane = rg.Plane(origin, xvec, yvec)

compas_sphere = Sphere(frame = plane_to_compas_frame(plane), radius=1.4)
sphere = sphere_to_rhino(compas_sphere)
# ---------- end plane ----------
geo_13 = Geometry(plane.sphere)
preview_5 = CustomPreview(Geometry=geo_13, Material=ColourSwatch(SwatchColor=RGBA(228, 142, 157, 99)))

geo_14 = Geometry([<extrusion referenced from the Rhino model> x168])
geo_15 = Geometry([<mesh referenced from the Rhino model> x3045])
list_10 = ValueList({"patch_1": "patch_1_1009.json", "patch_2": "patch_2_1009.json", "patch_3": "patch_3_1009.json", "patch_4": "patch_4_1009.json", "patch_5": "patch_5_1009.json", "patch_6": "patch_6_1009.json", "patch_7": "patch_7_1009.json", "patch_8": "patch_8_1009.json", "patch_9": "patch_9_1009.json"}, selected="patch_9")

# ----
# Import to JSON
import = Button(ExpressionNormal="True", ExpressionPressed="False")
list_11 = ValueList({"assembly": "assembly_full_2005.json", "patch_1": "patch_1_2005.json", "patch_2": "patch_2_2005.json", "patch_3": "patch_3_2005.json", "patch_4": "patch_4_2005.json", "patch_5": "patch_5_2005.json", "patch_6": "patch_6_2005.json", "patch_7": "patch_7_2005.json", "patch_8": "patch_8_2005.json", "patch_9": "patch_9_2005.json"}, selected="assembly")
path = Python3Script()  # -> HERE, DATA
# ---------- path: Python ----------
import os

HERE = os.path.dirname(ghdoc.Path)
DATA = os.path.abspath(os.path.join(HERE, "..", "data"))
print(HERE)
print(DATA)
# ---------- end path ----------
initial_assembly = Python3Script(DATA=path.DATA, filename=list_10, import_from_json=import)  # -> out, assembly
# ---------- initial_assembly: Python ----------
import os
import json

from climate_active_envelopes.assembly import CAEAssembly as Assembly
from climate_active_envelopes.assembly import CAEPart as Part

#assembly = Assembly()

if import_from_json:
    filename = filename
    PATH = os.path.join(DATA, "assembly", filename)
    print(PATH)
    assembly = Assembly.from_json(PATH)
    print(assembly)
# ---------- end initial_assembly ----------

export = Button()
export_2 = Button()

list_12 = ValueList({"patch_1": "patch_1_1009.json", "patch_2": "patch_2_1009.json", "patch_3": "patch_3_1009.json", "patch_4": "patch_4_1009.json", "patch_5": "patch_5_1009.json", "patch_6": "patch_6_1009.json", "patch_7": "patch_7_1009.json", "patch_8": "patch_8_1009.json", "patch_9": "patch_9_1009.json"}, selected="patch_9")

preview_6 = CustomPreview(Geometry=geo_14, Material=ColourSwatch(SwatchColor=RGB(228, 141, 138)))
preview_7 = CustomPreview(Geometry=geo_15, Material=ColourSwatch(SwatchColor=RGB(234, 161, 149)))
draw_2 = Python3Script(planes=plane.plane, scale=Slider(0.2, range=0..1))  # -> out, P, V, C, W; inputs planes: list of Plane
# ---------- draw_2: Python ----------
from System.Drawing import Color

red = Color.FromArgb(255, 0, 0)
green = Color.FromArgb(0, 255, 0)
blue = Color.FromArgb(0, 0, 255)

P = []
V = []
C = []

scale = float(scale)

for plane in planes:
    if not plane:
        continue
    P += [plane.Origin] * 3
    V.append(plane.XAxis * scale)
    V.append(plane.YAxis * scale)
    V.append(plane.ZAxis * scale)
    C += [red, green, blue]

W = 3
# ---------- end draw_2 ----------
vdisex = VectorDisplayEx(Point=draw_2.P, Vector=draw_2.V, Colour=draw_2.C, Width=draw_2.W)

# ----
# Create Reference Model
geo_16 = Geometry(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)
geo_17 = Geometry(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)

quad_11 = Quadrangulate(Mesh=geo_10, Angle=0.03490658504, Ratio=0.875)  # -> Mesh, Count
quad_12 = Quadrangulate(Mesh=geo_16, Angle=0.03490658504, Ratio=0.875)  # -> Mesh, Count
referencemodel = Python3Script(units=[quad_12.Mesh, quad_11.Mesh])  # -> out, reference_model; inputs units: list of Mesh
# ---------- referencemodel: Python ----------
from climate_active_envelopes.assembly import CAEReferenceModel 
from compas_rhino.conversions import mesh_to_compas
from compas.datastructures import Mesh, CellNetwork


reference_model = CAEReferenceModel()

mesh_units = []
print(mesh_units)
for unit in units:
    mesh_units.append(mesh_to_compas(unit))

reference_model = reference_model.create_cell_network(mesh_units)
print(reference_model)

reference_model.initialize_network()
# ---------- end referencemodel ----------

cell_network = Panel(referencemodel.out)

face_types = Python3Script(reference_model=referencemodel.reference_model, next_face=next_face, previous_face=previous_face, reset=reset_2)  # -> out, current_face_type, reference_model, fkey
# ---------- face_types: Python ----------
from scriptcontext import sticky as st

#st["edge_key"] = edge_key
#st["face_key"] = face_key


print(reference_model)
L = range(reference_model.number_of_faces())

#store data in component
guid = str(ghenv.Component.InstanceGuid)
face_key = "key_" + guid
running_key = "running_" + guid



if face_key not in st:
    st[face_key] = 0

if next_face:
    if st[face_key] < len(L) - 1:
        st[face_key] += 1
    else:
        st[face_key] = 0 

if previous_face:
    if st[face_key] < len(L) - 1:
        st[face_key] -= 1
    else:
        st[face_key] = 0 

if reset:
    st[face_key] = 0
    st[running_key] = False

fkey = st[face_key]


#Category for all faces in all cells
face_types = reference_model.sort_faces_by_type()

# Print the face_type of the faces in face_types['walls']
for face, face_type in face_types['walls']:
    print(face, face_type)

# Print the face_type of all faces in face_types
all_faces_type = []
for faces in face_types.values():
    for face, face_type in faces:
        all_faces_type.append(face_type)


# Category for selected face
current_face, current_face_type = reference_model.select_face_by_fkey(fkey)


# Category of neighboring faces
neighbor_faces_type = []
neighbors, neighbor_face_types = (reference_model.select_face_neighbors(fkey))
for neighbor, face_type in neighbor_face_types:
    neighbor_faces_type.append(face_type)

wall_neighbors = []
slab_neighbors = []
neighbors, neighbor_face_types = reference_model.select_face_neighbors(fkey)

for neighbor, face_type in neighbor_face_types:
    if face_type in ["outer wall", "inner wall"]:
        wall_neighbors.append(neighbor)

    if face_type in ["slab"]:
        slab_neighbors.append(neighbor)

# Store wall_neighbors and slab_neighbors in reference_model
reference_model.wall_neighbors = wall_neighbors
reference_model.slab_neighbors = slab_neighbors

# Store face_key to the reference_model
reference_model.fkey = fkey

# Store current_face with fkey in reference_model
reference_model.current_face = current_face
reference_model.current_face_type = current_face_type
# ---------- end face_types ----------
panel_2 = Panel(face_types.current_face_type)
panel_3 = Panel(face_types.fkey)

edge_types = Python3Script(reference_model=face_types.reference_model, next_neighbor=next_neighbor, next_edge=next_edge)  # -> out, shared_edge_type, current_edge_type, vertical_edge_types, horizontal_edge_types, reference_model, ekey
# ---------- edge_types: Python ----------
from compas_rhino.conversions import mesh_to_rhino, line_to_rhino
from scriptcontext import sticky as st

face_neighbors = reference_model.wall_neighbors + reference_model.slab_neighbors
L = range(len(reference_model.wall_neighbors))

#store data in component
guid = str(ghenv.Component.InstanceGuid)
face_edge_key = "key_" + guid

if face_edge_key not in st:
    st[face_edge_key] = 0

if next_neighbor:
    if st[face_edge_key] < len(L) - 1:
        st[face_edge_key] += 1
    else:
        st[face_edge_key] = 0 

face_edge_key = st[face_edge_key]+1

# Store face_key to the reference_model
reference_model.face_edge_key = face_edge_key

# Get type of the shared edge
shared_edge, edge_type = reference_model.get_shared_edge(reference_model.current_face, reference_model.wall_neighbors, face_edge_key)
shared_edge_type = edge_type

# Store edge_type and shared_edge in reference_model
reference_model.shared_edge = shared_edge
reference_model.shared_edge_type = shared_edge_type


L = range(reference_model.number_of_edges())
edge_key = "ekey_" + guid
if edge_key not in st:
    st[edge_key] = 0
if next_edge:
    if st[edge_key] < len(L) - 1:
        st[edge_key] += 1
    else:
        st[edge_key] = 0 
ekey = st[edge_key]

# Store face_key to the reference_model
reference_model.ekey = ekey



current_edge, current_edge_type = reference_model.select_edge_by_ekey(ekey)
reference_model.current_edge = current_edge

#print(current_edge, current_edge_type)
face_edges = reference_model.face_edges(reference_model.current_face)
#print(face_edges)
#print(reference_model.select_face_and_get_adjacent_edges(reference_model.fkey))

face_edges = reference_model.select_face_and_get_adjacent_edges(reference_model.fkey)

# Lists of types
vertical_edge_types = [edge['edge_type'] for edge in face_edges['vertical_edges']]
horizontal_edge_types = [edge['edge_type'] for edge in face_edges['horizontal_edges']]
# ---------- end edge_types ----------
panel_4 = Panel(edge_types.shared_edge_type)
panel_5 = Panel(edge_types.current_edge_type)
panel_6 = Panel(edge_types.vertical_edge_types)
panel_7 = Panel(edge_types.horizontal_edge_types)
panel_8 = Panel(edge_types.ekey)

process_further = BooleanToggle(False)
python_3_script = Python3Script(process=process_further, reference_model=edge_types.reference_model)  # -> out, reference_model
# ---------- python_3_script: Python ----------
if process == True:
    reference_model = reference_model
    print('is processed')

else:
    reference_model = None
    print('is not processed')
# ---------- end python_3_script ----------
panel_9 = Panel(python_3_script.out)

# ----
# Create brick assembly
compute_2 = BooleanToggle(False)
create_assembly = Python3Script(
    compute=compute_2,
    reference_model=python_3_script.reference_model,
    my_assembly=assembly.my_assembly,
    surface=input_surface,
    input_type=list_4,
    bond_type=list_5,
    ornament_type=list_6,
    wall_system=list_7,
    brick_full=part.brick_full,
    brick_insulated=part.brick_insulated,
    brick_air_dried=part.brick_air_dried,
    brick_perforated=part.brick_perforated,
    brick_half=part.brick_half,
    brick_spacing=butt_joint_width,
    bed_joint_height=bed_joint_height)  # -> out, start_edge_type, end_edge_type, current_face_type, my_assembly; inputs surface: Surface, brick_spacing: Double, bed_joint_height: Double
# ---------- create_assembly: Python ----------
from compas_rhino.conversions import mesh_to_compas, surface_to_compas_mesh


course_height = bed_joint_height  + brick_full.shape.zsize



if compute:
    mesh = surface_to_compas_mesh(surface, 1)

    my_assembly.set_brick_params(brick_full, brick_insulated, brick_half, brick_air_dried)


    if input_type == "reference_model":
        input_data = reference_model


    if input_type == "mesh":
        input_data = mesh

    assembly_data = (reference_model.generate_assembly_data(input_data, course_height, input_type))
    print(assembly_data)
    start_edge_type = assembly_data['start_edge_type']
    end_edge_type = assembly_data['end_edge_type']
    current_face_type = assembly_data['face_type']

    my_assembly.generate_wall(reference_model,
                        bond_type, 
                        ornament_type,
                        wall_system,  
                        brick_spacing, 
                        course_height,
                        input_type,
                        input_data,
                        )
# ---------- end create_assembly ----------
panel_10 = Panel(create_assembly.start_edge_type)
panel_11 = Panel(create_assembly.end_edge_type)
panel_12 = Panel(create_assembly.current_face_type)

vizualize_reference_model = Python3Script(
    reference_model=face_types.reference_model,
    show_all=show_all,
    show_current_face=show_current_face,
    show_face_until_key=show_face_until_key)  # -> P, L, M, mesh_till_key, current_mesh
# ---------- vizualize_reference_model: Python ----------
from compas.geometry import Frame
from compas_rhino.conversions import frame_to_rhino, line_to_rhino, mesh_to_rhino
from scriptcontext import sticky as st


fkey = reference_model.fkey


if show_all:
    P = []
    for vertex_key in reference_model.vertices():
        coordinates = reference_model.vertex_coordinates(vertex_key)
        #print(f"Vertex Key: {vertex_key}, Coordinates: {coordinates}")
        frames = Frame(coordinates, [1, 0, 0], [0, 1, 0])
        rhino_planes = frame_to_rhino(frames)
        P.append(rhino_planes)

    L = []
    for edge in reference_model.edges():
        print(edge)
        line = reference_model.edge_line(edge)
        curves = line_to_rhino(line)
        L.append(curves)

    M = []
    for face in reference_model.faces():
        face_meshes = reference_model.faces_to_mesh([face])
        mesh = mesh_to_rhino(face_meshes)
        M.append(mesh)

if show_face_until_key:
    all_face_meshes = []
    for face in reference_model.faces():
        face_mesh = reference_model.faces_to_mesh([face])
        all_face_meshes.append(face_mesh)
    mesh_till_key = [mesh_to_rhino(face_mesh) for face_mesh in all_face_meshes[:int(fkey)]]

if show_current_face:
    selected_face, face_type = reference_model.select_face_by_fkey(fkey)
    current_face_mesh = reference_model.faces_to_mesh([selected_face])
    current_mesh = mesh_to_rhino(current_face_mesh) 


# wall_neighbors = []
# slab_neighbors = []
# neighbors, neighbor_face_types = reference_model.select_face_neighbors(fkey)
# for neighbor, face_type in neighbor_face_types:
#     if show_wall_neighbors:
#         if face_type in ["outer wall", "inner wall"]:
#             neighbor_faces_meshes = reference_model.faces_to_mesh([neighbor])
#             mesh_neighbor = mesh_to_rhino(neighbor_faces_meshes)
#             wall_neighbors.append(mesh_neighbor)
#     if show_slab_neighbors:
#         if face_type in ["slab"]:
#             neighbor_faces_meshes = reference_model.faces_to_mesh([neighbor])
#             mesh_neighbor = mesh_to_rhino(neighbor_faces_meshes)
#             slab_neighbors.append(mesh_neighbor)
# ---------- end vizualize_reference_model ----------
sph = Sphere(Base=vizualize_reference_model.P, Radius=0.05)

process_further_2 = BooleanToggle(False)
python_3_script_2 = Python3Script(process=process_further_2, current_mesh=vizualize_reference_model.current_mesh)  # -> out, input_mesh, G; inputs current_mesh: Mesh
# ---------- python_3_script_2: Python ----------
if process == True:
    input_mesh = current_mesh
    print('processed')

else:
    G = current_mesh
    print('not processed')
# ---------- end python_3_script_2 ----------
panel_13 = Panel(python_3_script_2.out)

# ----
# Sun hours simulation
convert = BooleanToggle(False)
to_brep = Python3Script(convert=convert, input_type=list_4, input_mesh=python_3_script_2.input_mesh, input_surface=input_surface)  # -> current_brep; inputs input_mesh: Mesh, input_surface: Brep
# ---------- to_brep: Python ----------
import Rhino.Geometry as rg


if convert:

    if input_type == "reference_model":
        current_brep = rg.Brep.CreateFromMesh(input_mesh, True)

    if input_type == "mesh":
        current_brep = input_surface
    # Convert the mesh to a Brep
# ---------- end to_brep ----------

context_input_bauinnung = Brep([<brep referenced from the Rhino model> x12])
run = BooleanToggle(False)
direct_sun_hours = DirectSunHours(vectors=sun_path.vectors, geometry=to_brep, context=context_input_4, grid_size="0.05", run=run)  # -> points, results, mesh, legend

# ----
# Apply Gradient
values = Python3Script(results=direct_sun_hours.results, min_value=Slider(0.1, range=-4..2), max_value=Slider(0, range=-2..3))  # -> out, normalized_values; inputs results: list
# ---------- values: Python ----------
from compas.itertools import normalize_values



def normalize_to_highest(values, max_value=140.0, target_min=0.1, target_max=1):
    """Normalizes a list of values based on the highest value in the list, 
    scaled to a specific range.

    Args:
    values: A list of numerical values.
    max_value: The expected maximum value. Defaults to 140.0.
    target_min: The minimum value of the target range. Defaults to 0.0.
    target_max: The maximum value of the target range. Defaults to 1.0.

    Returns:
    A list of normalized values.
    """
    highest_value = max(values)

    factor = highest_value / max_value
    print(factor)  # Calculate the scaling factor
    normalized_values = normalize_values(values, target_min, target_max * factor)
    return normalized_values

normalized_values = normalize_values(results, min_value, max_value)
#normalized_values = normalize_to_highest(results)
#print(color_values)

print(max(normalized_values))

print(normalized_values)
# ---------- end values ----------
keys = Python3Script(my_assembly=create_assembly.my_assembly, transform_type=list_2)  # -> out, my_assembly, keys; inputs transform_type: String
# ---------- keys: Python ----------
# for node_id in my_assembly.graph.nodes():
#     transform_type = my_assembly.graph.node_attribute(node_id, 'transform_type')





keys = []
for key in my_assembly.graph.nodes_where({"transform_type": transform_type}):
    keys.append(key)

print(keys)
print(transform_type)
# ---------- end keys ----------
apply_gradient = Python3Script(
    my_assembly=keys.my_assembly,
    normalized_values=values.normalized_values,
    pts=direct_sun_hours.points,
    keys=keys.keys,
    transform_type=list_2,
    rotation_direction=list_3,
    nrbh_size=Slider(1200, range=2..5000),
    transform=transform,
    reset=reset)  # -> out, my_assembly; inputs normalized_values: list, pts: list of Point3d, keys: list, nrbh_size: Int32
# ---------- apply_gradient: Python ----------
from compas_rhino.conversions import point_to_compas



#print(my_assembly.__data__)

#transform_types = {node_id: my_assembly.graph.node_attribute(node_id, 'transform_type') for node_id in my_assembly.graph.nodes()}
#print(transform_types)
points = []


if transform:
    for p in pts:
        point = point_to_compas(p)
        points.append(point)
    my_assembly.apply_gradient(normalized_values,points,keys,transform_type, rotation_direction, nrbh_size, reset=False)

elif reset:
    for p in pts:
        point = point_to_compas(p)
        points.append(point)
    my_assembly.apply_gradient(normalized_values,points,keys,transform_type, rotation_direction, nrbh_size, reset=True)   

else:
    my_assembly = my_assembly
# ---------- end apply_gradient ----------

interfaces = Python3Script(my_assembly=apply_gradient.my_assembly, show_intersections=Toggle(False))  # -> out, my_assembly, meshes
# ---------- interfaces: Python ----------
from compas.geometry import Polygon, Point
from compas_rhino.conversions import mesh_to_rhino
from shapely.geometry import Polygon as ShapelyPolygon



courses = my_assembly.assembly_courses()
#print(courses)
#sorted_parts = [part for course in courses for part in course]



polygons = my_assembly.project_part_faces(courses)    
intersections = my_assembly.compute_polygon_intersections(polygons, courses)
transformed_intersections = my_assembly.transform_intersections_to_original_course(intersections, courses)
#transformed_intersections = my_assembly.transform_intersections_to_course_above(intersections, courses)
my_assembly.set_interface_points()

# Convert transformed intersections to meshes
meshes = []

if show_intersections:

    for key, intersection in transformed_intersections.items():
        mesh = intersection.to_mesh()
        rhino_mesh = mesh_to_rhino(mesh)
        meshes.append(rhino_mesh)
# ---------- end interfaces ----------
mesh = Mesh(interfaces.meshes)

visualize = Python3Script(show=Toggle(False), mesh=direct_sun_hours.mesh)  # -> out, M
# ---------- visualize: Python ----------
if show == True:
    M = mesh
# ---------- end visualize ----------
mesh_2 = Mesh(visualize.M)

geo_18 = Geometry(direct_sun_hours.legend)
points = PointList(Points=direct_sun_hours.points, Size=0.01)
item = ListItem(List=direct_sun_hours.results, Index=Slider(2797, range=0..10000), Wrap=True)
panel_14 = Panel(item)

# ----
# Transform
toggle = BooleanToggle(True)
pln_3 = Plane(PlaneXY(9.291354467, 11.0331148, -0.0355))
transform_2 = Python3Script(my_assembly=interfaces.my_assembly, transform=toggle, origin_plane=pln_3, new_origin_plane=pln_2)  # -> out, my_assembly
# ---------- transform_2: Python ----------
from compas.geometry import Frame, Transformation, Rotation, Translation
from compas_rhino.conversions import plane_to_compas_frame


new_origin_frame = plane_to_compas_frame(new_origin_plane)
origin_frame = plane_to_compas_frame(origin_plane)

if transform:
    T = Transformation.from_frame_to_frame(origin_frame, new_origin_frame)
    my_assembly = my_assembly.transformed(T)
# ---------- end transform_2 ----------

vizualize_face_neighbors = Python3Script(
    reference_model=edge_types.reference_model,
    show_wall_neighbors=show_wall_neighbors,
    show_slab_neighbors=show_slab_neighbors,
    show_inner_wall_neighbors=show_inner_wall_neighbors,
    show_face_neighbor=show_face_neighbor,
    show_face_neighbor_unil_key=show_face_neighbor_until_key,
    show_current_edge=show_current_edge,
    show_vface_edges=show_vface_edges,
    show_hface_edges=show_hface_edges)  # -> out, wall_neighbors, slab_neighbors, inner_wall_neighbors, next_neighbor, neighbor_until_key, current_edge_curve, face_hedges_curves, face_vedges_curves
# ---------- vizualize_face_neighbors: Python ----------
from compas_rhino.conversions import mesh_to_rhino, line_to_rhino
from scriptcontext import sticky as st

# face_neighbors = reference_model.wall_neighbors + reference_model.slab_neighbors
# L = range(len(reference_model.wall_neighbors))

# #store data in component
# guid = str(ghenv.Component.InstanceGuid)
# edge_key = "key_" + guid

# if edge_key not in st:
#     st[edge_key] = 0

# if next_neighbor:
#     if st[edge_key] < len(L) - 1:
#         st[edge_key] += 1
#     else:
#         st[edge_key] = 0 

# ekey = st[edge_key]+1
face_edge_key = reference_model.face_edge_key
ekey = reference_model.ekey
fkey = reference_model.fkey


wall_neighbors = []
slab_neighbors = []
neighbors, neighbor_face_types = reference_model.select_face_neighbors(fkey)

for neighbor, face_type in neighbor_face_types:
    if show_wall_neighbors:
        if face_type in ["outer wall", "inner wall"]:
            neighbor_faces_meshes = reference_model.faces_to_mesh([neighbor])
            mesh_neighbor = mesh_to_rhino(neighbor_faces_meshes)
            wall_neighbors.append(mesh_neighbor)
    if show_slab_neighbors:
        if face_type in ["slab"]:
            neighbor_faces_meshes = reference_model.faces_to_mesh([neighbor])
            mesh_neighbor = mesh_to_rhino(neighbor_faces_meshes)
            slab_neighbors.append(mesh_neighbor)



edge_type = reference_model.shared_edge_type
shared_edge = reference_model.shared_edge


inner_wall_neighbors = []
edge_faces = reference_model.edge_faces(shared_edge)
if show_inner_wall_neighbors:
    for face in edge_faces:
         if face != reference_model.current_face:
            if edge_type == 'inner wall joint':
                neighbor = mesh_to_rhino(reference_model.faces_to_mesh([face]))
                inner_wall_neighbors.append(neighbor)
            else:
                neighbor = mesh_to_rhino(reference_model.faces_to_mesh([face]))
                inner_wall_neighbors.append(neighbor)

neighbor_face_meshes = []
for i, face in enumerate(reference_model.wall_neighbors):
    if i < face_edge_key:

        #Vizualize the neighboring faces (one-by-one and until key)
        if show_face_neighbor:
            next_neighbor = mesh_to_rhino(reference_model.faces_to_mesh([face]))

        if show_face_neighbor_unil_key:
            neighbor_face_meshes.append(reference_model.faces_to_mesh([face]))
            neighbor_until_key = [mesh_to_rhino(face_mesh) for face_mesh in neighbor_face_meshes[:int(face_edge_key)]]


# Vizualize the shared edge
shared_edge = reference_model.get_shared_edge(reference_model.current_face, reference_model.wall_neighbors, face_edge_key)
shared_edge_type = shared_edge[1]
edge_between_faces = []
line = reference_model.edge_line(shared_edge[0])
curves = line_to_rhino(line)
edge_between_faces.append(curves)

# Vizualize current edge
if show_current_edge:
    current_edge = reference_model.current_edge
    current_edge_curve = line_to_rhino(reference_model.edge_line(current_edge))


face_edges = reference_model.select_face_and_get_adjacent_edges(reference_model.fkey)
edges = [edge['edge'] for edge in face_edges['vertical_edges']] + [edge['edge'] for edge in face_edges['horizontal_edges']]
h_edges = [edge['edge'] for edge in face_edges['vertical_edges']]
v_edges = [edge['edge'] for edge in face_edges['horizontal_edges']]

#face_edges_curves = []
face_hedges_curves = []
face_vedges_curves = []

# if show_face_edges:
#     for edge in edges:
#         edge_curve = line_to_rhino(reference_model.edge_line(edge)) 
#         face_edges_curves.append(edge_curve)

if show_hface_edges:
    for h_edge in h_edges:
        h_edge_curve = line_to_rhino(reference_model.edge_line(h_edge)) 
        face_hedges_curves.append(h_edge_curve)

if show_vface_edges:
    for v_edge in v_edges:
        v_edge_curve = line_to_rhino(reference_model.edge_line(v_edge)) 
        face_vedges_curves.append(v_edge_curve)
# ---------- end vizualize_face_neighbors ----------
pipe = Pipe(
    Curve=[vizualize_face_neighbors.face_hedges_curves, vizualize_face_neighbors.face_vedges_curves, vizualize_face_neighbors.current_edge_curve],
    Radius=0.025,
    Caps=1)
preview_8 = CustomPreview(Geometry=vizualize_face_neighbors.slab_neighbors, Material=ColourSwatch(SwatchColor=RGBA(53, 61, 157, 89)))

preview_9 = CustomPreview(Geometry=vizualize_face_neighbors.wall_neighbors, Material=ColourSwatch(SwatchColor=RGBA(244, 154, 157, 92)))
preview_10 = CustomPreview(
    Geometry=[vizualize_face_neighbors.inner_wall_neighbors, vizualize_face_neighbors.next_neighbor],
    Material=ColourSwatch(SwatchColor=RGBA(216, 230, 92, 113)))
preview_11 = CustomPreview(Geometry=vizualize_face_neighbors.neighbor_until_key, Material=ColourSwatch(SwatchColor=RGB(255, 131, 138)))
preview_12 = CustomPreview(Geometry=pipe, Material=ColourSwatch(SwatchColor=RGB(255, 255, 0)))

preview_13 = CustomPreview(Geometry=sph, Material=ColourSwatch(SwatchColor=RGB(0, 0, 0)))
preview_14 = CustomPreview(Geometry=vizualize_reference_model.mesh_till_key, Material=ColourSwatch(SwatchColor=RGB(255, 125, 157)))
preview_15 = CustomPreview(Geometry=python_3_script_2.G, Material=ColourSwatch(SwatchColor=RGB(255, 0, 157)))
curve_preview_2 = CustomCurvePreview(
    Curve=vizualize_reference_model.L,
    Linetype={Path="(Continuous)", Segments=[]},
    Colour=ColourSwatch(SwatchColor=RGB(0, 0, 0)))

sequences = Python3Script(assembly=transform_2.my_assembly, plane=plane.plane, compute_sequence_in_reach=compute, clear_sequ=clear)  # -> out, assembly; inputs plane: Plane
# ---------- sequences: Python ----------
from compas.geometry import Point
from compas_rhino.conversions import  plane_to_compas_frame
from scriptcontext import sticky as st



# store data in component
guid = str(ghenv.Component.InstanceGuid)
patch_num_key  = "patch_num_" + guid

if patch_num_key not in st:
    st[patch_num_key] = 1

frame = plane_to_compas_frame(plane)

def get_nbrs_under(key):
    nbrs = assembly.graph.neighbors(key)
    nbrs_under = [n for n in nbrs if assembly.graph.node_attribute(n, "course")<assembly.graph.node_attribute(key, "course")]
    return nbrs_under

# def get_nbrs_above(key):
#     nbrs = assembly.graph.neighbors(key)
#     nbrs_above = [n for n in nbrs if assembly.graph.node_attribute(n, "course") > assembly.graph.node_attribute(key, "course")]
#     return nbrs_above

def is_node_satisfied(key):
    nbrs_under = get_nbrs_under(key)
    if len(nbrs_under):
        for n in nbrs_under:
            if assembly.graph.node_attribute(n, "used") == False:
                return False
    print(f"Node {key} is satisfied.")
    return True


def dist_to_frame(key, frame):
    part_origin = assembly.part(key).frame
    frame_point = frame.point
    # ro = robot_origin.point
    #ro_mirror = Point(ro.x, -(ro.y)-0.2, -ro.z-0.35)
    #frame_point_mirror = Point(frame_point.x, -(frame_point.y)-0.35, frame_point.z-0.35)
    frame_point_mirror = Point(frame_point.x, -(frame_point.y), frame_point.z)
    dist = frame_point.distance_to_point(part_origin.point)
    return dist

def compute_all_in_reach():
    keys = list(assembly.graph.nodes_where({"used": False}))
    keys_in_patch = []
    for key in keys:
        dist = dist_to_frame(key, frame)
        if dist < 1.4 and is_node_satisfied(key): # first row: 1.15, second row 1.50
            keys_in_patch.append(key)
            assembly.graph.node_attribute(key, 'used', True)
    return keys_in_patch

if clear_sequ:
    assembly.graph.nodes_attribute(name='used', value=0)
    assembly.graph.nodes_attribute(name='patch', value=0)
    st[patch_num_key] = 1
    assembly.graph.attributes['patch_num'] = st[patch_num_key] 

if compute_sequence_in_reach:
    keys_in_patch = []
    while True:
        new_keys = compute_all_in_reach()
        if not new_keys:
            break
        keys_in_patch.extend(new_keys)
    print(f"Keys in Patch: {keys_in_patch}")
    assembly.graph.nodes_attribute(name='patch', value=st[patch_num_key], keys=keys_in_patch)
    
    #assembly.graph.attributes['patch_num'] = st[patch_num_key] 

    patch_data = {
        'patch_number': st[patch_num_key],
        'parts': {}  # Store part data here
    }

    for key in keys_in_patch:
        part_attributes = assembly.graph.node_attributes(key=key)
        patch_data['parts'][key] = part_attributes

    assembly.graph.attributes['patch_num'] = patch_data
    st[patch_num_key] += 1
# ---------- end sequences ----------

# ----
# Export to JSON
path_2 = Python3Script()  # -> HERE, ASSEMBLY, DATA
# ---------- path_2: Python ----------
import os

HERE = os.path.dirname(ghdoc.Path)
DATA = os.path.abspath(os.path.join(HERE, "..", "data"))
ASSEMBLY = os.path.abspath(os.path.join(DATA, "assembly"))

print(HERE)
print(DATA)
print(ASSEMBLY)
# ---------- end path_2 ----------
export_3 = Python3Script(
    ASSEMBLY=path_2.ASSEMBLY,
    DATA=path_2.DATA,
    filename_patch_data=list_12,
    my_assembly=sequences.assembly,
    export_patch=export,
    export_assembly=export_2)  # -> out; inputs ASSEMBLY: String
# ---------- export_3: Python ----------
import os
import json
from compas.datastructures import Assembly
from scriptcontext import sticky as st
from climate_active_envelopes.assembly import CAEAssembly


# print(my_assembly.graph.nodes_attribute(name='patch', value=st[patch_num_key], keys=keys_in_patch))
if export_patch:
    courses = my_assembly.assembly_courses(tol=0.0001)
    c_max = max(my_assembly.graph.nodes_attribute(name="patch"))
    keys_in_patch = list(my_assembly.graph.nodes_where({"patch": c_max}))
    L_patch = [node for course in courses for node in course if node in keys_in_patch]

    # Create a copy of the graph to modify
    filtered_graph = my_assembly.graph.copy()  
    nodes_to_keep = set(L_patch)

    # Remove nodes and edges not in the specific patch
    for node in list(filtered_graph.nodes()):
        if node not in nodes_to_keep:
            filtered_graph.delete_node(node)

    # Create a temporary assembly for export
    temp_assembly = CAEAssembly()
    temp_assembly.graph = filtered_graph

    # Export the filtered assembly to a JSON file
    filename_patch_data = filename_patch_data
    PATH_assembly = os.path.join(ASSEMBLY, filename_patch_data)
    temp_assembly.to_json(PATH_assembly, pretty=True)
    print(f"Assembly exported to {PATH_assembly}")
    print(temp_assembly)



if export_assembly:
    filename_assembly = "assembly_full_2005.json"
    PATH_assembly = os.path.join(ASSEMBLY, filename_assembly)
    my_assembly.to_json(PATH_assembly, pretty=True)
    print(f"Assembly exported to {PATH_assembly}")
    print(my_assembly)
# ---------- end export_3 ----------

# ----
# Visualisation Building Component
colour_swatch_2 = ColourSwatch(SwatchColor=RGBA(0, 0, 0, 85))
preview_16 = CustomPreview(Geometry=vizualize_reference_model.M, Material=colour_swatch_2)  # disabled

run_2 = BooleanToggle(False)

# ----
# Solar Radiation
toggle_2 = BooleanToggle(True)

incidentradiation = LBIncidentRadiation(
    sky_mtx=skymatrix.sky_mtx,
    geometry=flatten(unifynormals),
    context=flatten(context_input_4),
    grid_size=Slider(1, range=0..1),
    legend_par=legendpar,
    run=toggle_2)  # -> report, points, results, total, mesh, legend, title, int_mtx; plug-in component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

brick_wall = Mesh(incidentradiation.mesh)
geo_19 = Geometry(incidentradiation.legend)
panel_15 = Panel(incidentradiation.legend)

points_2 = PointList(Points=incidentradiation.points, Size=0.01)
item_2 = ListItem(List=incidentradiation.results, Index=Slider(1825, range=0..10000), Wrap=True)
panel_16 = Panel(item_2)

# ----
# Visualisation Assembly
counter = Python3Script(
    my_assembly=initial_assembly.assembly,
    start=start,
    stop=stop,
    step=step,
    step_back=back,
    reset=reset_3,
    full=full,
    interval=list_8)  # -> out, counter
# ---------- counter: Python ----------
from scriptcontext import sticky as st
import Grasshopper

def update_component(ghenv, delay):
    """Schedule an update of the Grasshopper component.

    After the specified delay, the GH component will be automatically updated.

    Parameters
    ----------
    ghenv : :class:`GhPython.Component.PythonEnvironment`
        The current GHPython environment.
    delay : :obj:`int`
        Time in milliseconds until the update is performed.

    Raises
    ------
    ValueError
        If the delay is less than zero.

    """
    if delay <= 0:
        raise ValueError("Delay must be greater than zero")

    ghcomp = ghenv.Component
    ghdoc = ghcomp.OnPingDocument()

    def callback(ghdoc):
        if ghdoc.SolutionState != Grasshopper.Kernel.GH_ProcessStep.Process:
            ghcomp.ExpireSolution(False)

    ghdoc.ScheduleSolution(delay, Grasshopper.Kernel.GH_Document.GH_ScheduleDelegate(callback))

L = range(my_assembly.graph.number_of_nodes())

# store data in component
guid = str(ghenv.Component.InstanceGuid)
counter_key = "counter_" + guid
running_key = "running_" + guid

if counter_key not in st:
    st[counter_key] = 0

if running_key not in st:
    st[running_key] = False
    

if st[running_key]:
    if st[counter_key] < len(L) - 1:
        st[counter_key] += 1
        update_component(ghenv, interval)
    else:
        st[counter_key] = 0
        st[running_key] = False
    
if start:
    st[running_key] = True

if stop:
    st[running_key] = False

if step:
    if st[counter_key] < len(L) - 1:
        st[counter_key] += 1

if step_back:
    if st[counter_key] < len(L) - 1:
        st[counter_key] -= 1

if reset:
    st[counter_key] = 0
    st[running_key] = False

if full:
    st[counter_key] = len(L)-1

if len(L):
    item = L[st[counter_key]]


#st["visualisation_counter"] = st[counter_key]
counter = st[counter_key]+1
# ---------- end counter ----------
panel_17 = Panel(counter.counter)
visualize_2 = Python3Script(my_assembly=initial_assembly.assembly, show=list_9, highlight_current_part=Toggle(False), counter=panel_17)  # -> out, parts_geometry, brick_full_geometry, brick_insulated_geometry, parts_frame, current_part_geometry, current_part_frame, current_part_gripping_frame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
# ---------- visualize_2: Python ----------
from compas_rhino.conversions import mesh_to_rhino, box_to_rhino, frame_to_rhino
import Rhino.Geometry as rg
import ghpythonlib.components as ghcomp
from compas.colors import Color


print(my_assembly)
#counter = int(counter)

connections = []
patches = []
patches_color = []
brick_full_geometry = []
brick_insulated_geometry = []
parts_geometry  = []
# Define colors for each brick type

#get parts datastructure
parts = [p for p in my_assembly.parts()]
brick_full_parts = [p for p in parts if my_assembly.graph.node_attribute(p.key, "brick_type") == "full"]
brick_insulated_parts = [p for p in parts if my_assembly.graph.node_attribute(p.key, "brick_type") == "insulated"]

if show == "show_all":
    parts_frame = []

    brick_full_geometry = [mesh_to_rhino(p.mesh) for p in brick_full_parts]
    brick_insulated_geometry = [mesh_to_rhino(p.mesh) for p in brick_insulated_parts]
    
    #extract the frame of the parts for visulization (+ converted to rhino plane)
    parts_frame = [frame_to_rhino(p.frame) for p in parts]
    key = my_assembly.graph.number_of_nodes()-1

if show == "show_until_key":
    parts_geometry = [mesh_to_rhino(p.mesh) for p in parts[0:int(counter)]]
    parts_frame = [frame_to_rhino(p.frame) for p in parts[0:int(counter)]]
    key = int(counter)-1

if show == "show_nothing":
    print("Nothing to see")
    pass

if show == "show_connections":
    edges = list(my_assembly.connections())
    for e in edges:
        p1 = my_assembly.part(e[0]).frame.point
        p2 = my_assembly.part(e[1]).frame.point
        connections += [rg.Line(p1[0],p1[1],p1[2],p2[0],p2[1],p2[2])]

if show == "show_patches":
    c_max = max(my_assembly.graph.nodes_attribute(name='patch')) + 1
    for patch_index in range(1, c_max):
        keys_in_patch = list(my_assembly.graph.nodes_where({'patch': patch_index}))
        parts = [my_assembly.part(key) for key in keys_in_patch]
        for p in parts:
            patches.append(mesh_to_rhino(p.mesh))
            color_value = (1 - patch_index / c_max) - 0.18
            color_value = max(0, min(color_value, 1))  # Ensure the color value is within [0, 1]   
            r = int(255 * (3*color_value))
            g = int(255 * (5*color_value))
            b = int(255 * (1.5*color_value))          
            patches_color.append(ghcomp.ColourRGB(r, g, b))


if highlight_current_part:
    current_part = my_assembly.part(key)
    current_part_geometry = mesh_to_rhino(current_part.mesh)
    current_part_frame = frame_to_rhino(current_part.frame)
    current_part_gripping_frame = frame_to_rhino(current_part.gripping_frame)
    
    print(current_part.__data__)
# ---------- end visualize_2 ----------
panel_18 = Panel(visualize_2.out)

full_bricks = Python3Script(bricks=visualize_2.brick_full_geometry, run=run_2)  # -> out, brick_geo, geometry; inputs bricks: list of Mesh
# ---------- full_bricks: Python ----------
if run == False:
    brick_geo = bricks
else:
    _geometry = bricks
# ---------- end full_bricks ----------
preview_17 = CustomPreview(Geometry=full_bricks.brick_geo, Material=ColourSwatch(SwatchColor=RGB(234, 161, 149)))

geo_20 = Geometry(visualize_2.brick_insulated_geometry)
geo_21 = Geometry(visualize_2.parts_frame)
geo_22 = Geometry([visualize_2.current_part_frame, visualize_2.current_part_geometry])
geo_23 = Geometry([visualize_2.parts_geometry, visualize_2.brick_full_geometry])
geo_24 = Geometry(visualize_2.current_part_gripping_frame)
geo_25 = Geometry(visualize_2.patches)
preview_18 = CustomPreview(Geometry=geo_23, Material=ColourSwatch(SwatchColor=RGB(196, 141, 141)))
preview_19 = CustomPreview(Geometry=geo_20, Material=ColourSwatch(SwatchColor=RGB(225, 126, 123)))
preview_20 = CustomPreview(Geometry=geo_21, Material=ColourSwatch(SwatchColor=RGB(255, 125, 157)))
preview_21 = CustomPreview(Geometry=geo_22, Material=ColourSwatch(SwatchColor=RGB(255, 125, 157)))
preview_22 = CustomPreview(Geometry=geo_24, Material=ColourSwatch(SwatchColor=RGB(255, 125, 157)))
preview_23 = CustomPreview(Geometry=geo_25, Material=visualize_2.patches_color)
curve_preview_3 = CustomCurvePreview(
    Curve=visualize_2.connections,
    Linetype=<geometry referenced from the Rhino model>,
    Colour=ColourSwatch(SwatchColor=RGB(255, 0, 157)))

interfaces_2 = Python3Script(my_assembly=visualize_2.my_assembly, show_intersections=Toggle(True))  # -> out, my_assembly, meshes; same code as interfaces

draw_3 = Python3Script(planes=geo_24, scale=Slider(0.2, range=0..1))  # -> out, P, V, C, W; inputs planes: list of Plane; same code as draw_2
vdisex_2 = VectorDisplayEx(Point=draw_3.P, Vector=draw_3.V, Colour=draw_3.C, Width=draw_3.W)

mesh_3 = Mesh(interfaces_2.meshes)

# ==== cluster DirectSunHours
number_slider = Slider(0.1, range=0..0.1)
colrange = LBColorRange(index=Slider(5, range=0..10))  # -> colors; plug-in component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
max = ClusterInput()
min = ClusterInput()
panel = Panel("0")
legendpar = LBLegendParameters(
    min=min,
    max=max,
    colors=colrange,
    seg_height=number_slider,
    seg_width=number_slider,
    text_height=Slider(0.07, range=0..0.1))  # -> leg_par; plug-in component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
offset_dist = ClusterInput()
vectors = ClusterInput()
geometry = ClusterInput()
context = ClusterInput()
grid_size = ClusterInput()
run = ClusterInput()
directsunhours = LBDirectSunHours(
    vectors=flatten(vectors),
    geometry=flatten(geometry),
    context=flatten(context),
    grid_size=grid_size,
    offset_dist=offset_dist,
    legend_par=legendpar,
    run=run)  # -> report, points, results, mesh, legend, title, int_mtx; plug-in component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
points = ClusterOutput(directsunhours.points)
results = ClusterOutput(directsunhours.results)
mesh = ClusterOutput(directsunhours.mesh)
legend = ClusterOutput(directsunhours.legend)

# ==== cluster SunPath
weather_url = ClusterInput()
downloadepw = LBDownloadWeather(weather_URL=weather_url)  # -> epw_file, stat_file, ddy_file; plug-in component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
importepw = LBImportEPW(epw_file=downloadepw.epw_file)  # -> location, dry_bulb_temperature, dew_point_temperature, relative_humidity, wind_speed, wind_direction, direct_normal_rad, diffuse_horizontal_rad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; plug-in component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
diffuse_horizontal_rad = ClusterOutput(importepw.diffuse_horizontal_rad)
direct_normal_rad = ClusterOutput(importepw.direct_normal_rad)
location = ClusterOutput(importepw.location)
center_pt = ClusterInput()
scale = ClusterInput()
daily = ClusterInput()
north = ClusterInput()
hoys = ClusterInput()
sunpath = LBSunPath(north=north, location=importepw.location, hoys=hoys, center_pt=center_pt, scale=scale, daily=daily)  # -> report, vectors, altitudes, azimuths, hoys, sun_pts, analemma, daily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; plug-in component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
vectors = ClusterOutput(sunpath.vectors)
preview = CustomPreview(Geometry=[sunpath.analemma, sunpath.daily, sunpath.legend], Material=ColourSwatch(SwatchColor=RGB(41, 41, 41)))
analemma = ClusterOutput([sunpath.analemma, sunpath.daily, sunpath.legend])
msphere = MeshSphere(Base=sunpath.sun_pts, Radius="0.025", UCount=10, VCount=20)
compass = ClusterOutput(sunpath.compass)
multiplication = Multiplication(A=scale, B="100")
preview_2 = CustomPreview(Geometry=msphere, Material=ColourSwatch(SwatchColor=RGB(255, 255, 0)))
preview_3 = CustomPreview(Geometry=sunpath.compass, Material=ColourSwatch(SwatchColor=RGB(0, 0, 0)))
M = ClusterOutput(msphere)
line = LineSDL(Start=sunpath.sun_pts, Direction=sunpath.vectors, Length=multiplication)
