# Grasshopper definition cae_assembly_fabrication.ghx (Grasshopper 1.0.8)
# plug-ins: RhinoCodePluginGH

path = Python3Script()  # -> HERE, DATA, ROBOT_DESCRIPTION, ASSEMBLY
# ---------- path: Python ----------
import os

HERE = os.path.dirname(ghdoc.Path)
DATA = os.path.abspath(os.path.join(HERE, "..", "data"))
ROBOT_DESCRIPTION = os.path.abspath(os.path.join(DATA, "robot_description"))
ASSEMBLY = os.path.abspath(os.path.join(DATA, "assembly"))

print(HERE)
print(DATA)
print(ROBOT_DESCRIPTION)
print(ASSEMBLY)
# ---------- end path ----------

x_axis = Curve(<curve referenced from the Rhino model>)
y_axis = Curve(<curve referenced from the Rhino model>)
plane = Python3Script(plane_axes=[x_axis, y_axis])  # -> out, plane; inputs plane_axes: list of Curve
# ---------- plane: Python ----------
import Rhino.Geometry as rg

x_axis, y_axis = plane_axes

x_axis = rg.Line(x_axis.PointAtStart, x_axis.PointAtEnd)
y_axis = rg.Line(y_axis.PointAtStart, y_axis.PointAtEnd)

if x_axis.From.DistanceTo(y_axis.From) < 0.01:
    origin = x_axis.From
    xvec = x_axis.Direction
    yvec = y_axis.Direction
elif x_axis.To.DistanceTo(y_axis.To) < 0.01:
    origin = x_axis.To
    xvec = -x_axis.Direction
    yvec = -y_axis.Direction
elif x_axis.From.DistanceTo(y_axis.To) < 0.01:
    origin = x_axis.From
    xvec = x_axis.Direction
    yvec = -y_axis.Direction
elif x_axis.To.DistanceTo(y_axis.From) < 0.01:
    origin = x_axis.To
    xvec = -x_axis.Direction
    yvec = y_axis.Direction

plane = rg.Plane(origin, xvec, yvec)
# ---------- end plane ----------

x_axis_2 = Curve(<curve referenced from the Rhino model>)
y_axis_2 = Curve(<curve referenced from the Rhino model>)
plane_2 = Python3Script(plane_axes=[x_axis_2, y_axis_2])  # -> out, plane; inputs plane_axes: list of Curve; same code as plane

# ----
# Unload Python
# modules
button = Button()
unload = Python3Script(unload=button)  # -> out, a
# ---------- unload: Python ----------
from compas_rhino import unload_modules

unload_modules('climate_active_envelopes_design')
unload_modules('climate_active_envelopes_fabrication')

unload_modules('climate_active_envelopes_design.assembly')
unload_modules('climate_active_envelopes_design.part')

unload_modules("assembly_information_model")

unload_modules("abb_fabrication_control")
unload_modules("extruder_control")
unload_modules("fabrication_manager")
# ---------- end unload ----------

list = ValueList({"brick wall": "brickwall.json", "brick wall ex4": "ex_brickwall4.json"}, selected="brick wall")

# ----
# Import Assembly
import = Button(ExpressionPressed="False")
import_2 = Python3Script(path=path.ASSEMBLY, filename=list, import_from_json=import)  # -> out, my_assembly; inputs path: String, filename: String
# ---------- import_2: Python ----------
import os
import json
from scriptcontext import sticky as st
from climate_active_envelopes_design.assembly import CAEAssembly as Assembly


path = os.path.join(path, filename)
print(path)

if "my_assembly" not in st:
   st["my_assembly"] = None


if import_from_json:
    
    my_assembly = Assembly.from_json(path)
    st["my_assembly"] = my_assembly
        
    #filtered_bricks = {node_id: brick_info for node_id, brick_info in data["node"].items() if not brick_info["fixed"]}
    #non_fixed_bricks_keys = list(filtered_bricks.keys())
    #print(non_fixed_bricks_keys)

my_assembly = st["my_assembly"]
# ---------- end import_2 ----------

# ----
# Transform
toggle = BooleanToggle(True)
transform = Python3Script(my_assembly=import_2.my_assembly, transform=toggle, origin_plane=plane.plane, new_origin_plane=plane_2.plane)  # -> out, my_assembly
# ---------- transform: Python ----------
from compas.geometry import Frame, Transformation, Rotation, Translation
from compas_rhino.conversions import plane_to_compas_frame


new_origin_frame = plane_to_compas_frame(new_origin_plane)
origin_frame = plane_to_compas_frame(origin_plane)

if transform:
    T = Transformation.from_frame_to_frame(origin_frame, new_origin_frame)
    my_assembly = my_assembly.transformed(T)
# ---------- end transform ----------

reset = Button()
back = Button()
start = Button()
stop = Button()
step = Button()
full = Button()
list_2 = ValueList({"20", "50", "100", "500", "1000", "5000"}, selected="500")
counter = Python3Script(
    my_assembly=transform.my_assembly,
    start=start,
    stop=stop,
    step=step,
    step_back=back,
    reset=reset,
    full=full,
    interval=list_2)  # -> out, counter
# ---------- counter: Python ----------
from scriptcontext import sticky as st
import Grasshopper

def update_component(ghenv, delay):
    """Schedule an update of the Grasshopper component.

    After the specified delay, the GH component will be automatically updated.

    Parameters
    ----------
    ghenv : :class:`GhPython.Component.PythonEnvironment`
        The current GHPython environment.
    delay : :obj:`int`
        Time in milliseconds until the update is performed.

    Raises
    ------
    ValueError
        If the delay is less than zero.

    """
    if delay <= 0:
        raise ValueError("Delay must be greater than zero")

    ghcomp = ghenv.Component
    ghdoc = ghcomp.OnPingDocument()

    def callback(ghdoc):
        if ghdoc.SolutionState != Grasshopper.Kernel.GH_ProcessStep.Process:
            ghcomp.ExpireSolution(False)

    ghdoc.ScheduleSolution(delay, Grasshopper.Kernel.GH_Document.GH_ScheduleDelegate(callback))

L = range(my_assembly.graph.number_of_nodes())

# store data in component
guid = str(ghenv.Component.InstanceGuid)
counter_key = "counter_" + guid
running_key = "running_" + guid

if counter_key not in st:
    st[counter_key] = 0

if running_key not in st:
    st[running_key] = False
    

if st[running_key]:
    if st[counter_key] < len(L) - 1:
        st[counter_key] += 1
        update_component(ghenv, interval)
    else:
        st[counter_key] = 0
        st[running_key] = False
    
if start:
    st[running_key] = True

if stop:
    st[running_key] = False

if step:
    if st[counter_key] < len(L) - 1:
        st[counter_key] += 1

if step_back:
    if st[counter_key] < len(L) - 1:
        st[counter_key] -= 1

if reset:
    st[counter_key] = 0
    st[running_key] = False

if full:
    st[counter_key] = len(L)-1

if len(L):
    item = L[st[counter_key]]


#st["visualisation_counter"] = st[counter_key]
counter = st[counter_key]+1
# ---------- end counter ----------
panel = Panel(counter.counter)

# ----
# Visualise
list_3 = ValueList({"show all": "show_all", "show until key": "show_until_key"}, selected="show until key")
visualize = Python3Script(my_assembly=transform.my_assembly, show=list_3, highlight_current_part=Toggle(True), counter=counter.counter)  # -> out, parts_geometry, parts_frame, current_part_geometry, current_part_frame
# ---------- visualize: Python ----------
from compas_rhino.conversions import mesh_to_rhino, box_to_rhino, frame_to_rhino

#print assembly
print(my_assembly)

#get parts datastructure
parts = [p for p in my_assembly.parts()]

#get current part



if show == "show_all":
    
#get parts datastructure
    parts = [p for p in my_assembly.parts()]
    parts_geometry = []
    parts_frame = []

    #extract the mesh of the parts for visulization (+ converted to rhino mesh)
    parts_geometry = [mesh_to_rhino(p.mesh) for p in parts]
    
    #extract the frame of the parts for visulization (+ converted to rhino plane)
    parts_frame = [frame_to_rhino(p.frame) for p in parts]
    #print(parts_geometry)

    key = my_assembly.graph.number_of_nodes()-1

if show == "show_until_key":
    #extract the mesh of the parts for visulization (+ converted to rhino mesh)
    parts_geometry = [mesh_to_rhino(p.mesh) for p in parts[0:counter]]
    
    #extract the frame of the parts for visulization (+ converted to rhino plane)
    parts_frame = [frame_to_rhino(p.frame) for p in parts[0:counter]]

    key = counter-1

if highlight_current_part:
    current_part = my_assembly.part(key)
    current_part_geometry = mesh_to_rhino(current_part.mesh)
    current_part_frame = frame_to_rhino(current_part.frame)
# ---------- end visualize ----------
panel_2 = Panel(visualize.out)
geo = Geometry(visualize.parts_frame)
preview = CustomPreview(Geometry=visualize.parts_geometry, Material=ColourSwatch(SwatchColor=RGBA(196, 141, 141, 150)))
preview_2 = CustomPreview(Geometry=geo, Material=ColourSwatch(SwatchColor=RGB(255, 125, 157)))
preview_3 = CustomPreview(
    Geometry=[visualize.current_part_geometry, visualize.current_part_frame],
    Material=ColourSwatch(SwatchColor=RGB(255, 125, 157)))

connect = Button()
close = Button()

# ---- group: import from .json
import_3 = Button(ExpressionNormal="True", ExpressionPressed="False")
py = PythonScript()  # -> HERE, DATA
# ---------- py: Python ----------
import os

HERE = os.path.dirname(ghdoc.Path)
DATA = os.path.abspath(os.path.join(HERE, "..", "data"))
print(HERE)
print(DATA)
# ---------- end py ----------
initial_assembly = GhPythonScript(DATA=py.DATA, filename="brickwall_new.json", import_from_json=import_3)  # -> out, non_fixed_bricks_keys, assembly; inputs import_from_json: Boolean
# ---------- initial_assembly: Python ----------
import os
import json
from scriptcontext import sticky
#from climate_active_envelopes.assembly import ReferenceElement as Element
from climate_active_envelopes_fabrication.assembly import Assembly


assembly = Assembly()

if import_from_json:
    #filename = "brickwall.json"
    PATH = os.path.join(DATA,"assembly", filename)

    print PATH
    assembly = Assembly.from_json(PATH)
    
    
    with open(PATH, 'r') as f:
        data = json.load(f)
        
    filtered_bricks = {node_id: brick_info for node_id, brick_info in data["node"].items() if not brick_info["fixed"]}
    non_fixed_bricks_keys = list(filtered_bricks.keys())
    print(non_fixed_bricks_keys)
# ---------- end initial_assembly ----------

# ----
# Robot Model
panel_3 = Panel("abb_fabtory.srdf")

# ---- group: import from .json
show = BooleanToggle(True)

# ---- group: import from .json / Network Artist
show_2 = BooleanToggle(True)
draw = GhPythonScript(assembly=initial_assembly.assembly, show_network=show_2, key=Slider(0, range=0..47))  # -> nodes, edges, current_node, current_node_neighbors; inputs key: Int32
# ---------- draw: Python ----------
import sys, os
import ghpythonlib.components as ghcomp
from compas.datastructures import Network
from compas_ghpython.artists import NetworkArtist
from compas_rhino.geometry import RhinoLine

import compas_ghpython
import Rhino.Geometry as rg


data = assembly.network.to_data()
network = Network.from_data(data)

print assembly.network.number_of_nodes()

def draw_network(network):
    """Draw a network in Grasshopper.
    """
    points = []
    for key, attr in network.nodes(True):
        points.append({
            'pos': network.node_coordinates(key),
        })

    lines = []
    for (u, v), attr in network.edges(True):
        lines.append({
            'start': network.node_coordinates(u),
            'end': network.node_coordinates(v),
        })

    points_rg = compas_ghpython.draw_points(points)
    lines_rg = compas_ghpython.draw_lines(lines)

    return points_rg, lines_rg

if show_network:
    nodes, edges = draw_network(network)
    
    current_node = {'pos': network.node_coordinates(key), 'radius': 0.03}
    current_node = compas_ghpython.draw_spheres([current_node])
    
    current_node_neighbors_keys = network.neighbors(key)
    current_node_neighbors = [{'pos': network.node_coordinates(key), 'radius': 0.02} for key in current_node_neighbors_keys]
    current_node_neighbors = compas_ghpython.draw_spheres(current_node_neighbors)
# ---------- end draw ----------
pt = Point(draw.nodes)
line = Line(draw.edges)
brep = Brep(draw.current_node)
brep_2 = Brep(draw.current_node_neighbors)

# ---- group: import from .json
key = Slider(358, range=0..388)
till_key = Button()
start_2 = Button()
reset_2 = Button()
stop_2 = Button()
back_2 = Button()
step_2 = Button()
full_2 = Button()
list_4 = ValueList({"20", "50", "100", "500", "1000", "5000"}, selected="1000")

counter_2 = CountThroughList(
    assembly=initial_assembly.assembly,
    start=start_2,
    stop=stop_2,
    step=step_2,
    step_back=back_2,
    reset=reset_2,
    full=full_2,
    till_key=till_key,
    key=key,
    interval=list_4)  # -> item, counter; inputs start: Boolean, stop: Boolean, step_back: Boolean, key: Int32
# ---------- counter_2: Python ----------
from scriptcontext import sticky as st
from compas_ghpython import update_component


L = list(assembly.elements())
# store data in component
guid = str(ghenv.Component.InstanceGuid)
counter_key = "counter_" + guid
running_key = "running_" + guid

if counter_key not in st:
    st[counter_key] = 0

if running_key not in st:
    st[running_key] = False
    

if st[running_key]:
    if st[counter_key] < len(L) - 1:
        st[counter_key] += 1
        update_component(ghenv, interval)
    else:
        st[counter_key] = 0
        st[running_key] = False
    
    
if start:
    st[running_key] = True

if stop:
    st[running_key] = False

if step:
    if st[counter_key] < len(L) - 1:
        st[counter_key] += 1

if step_back:
    if  0 < st[counter_key] < len(L):
        st[counter_key] -= 1

if reset:
    st[counter_key] = 0

if till_key:
    st[counter_key] = key

if full:
    st[counter_key] = len(L)-1

if len(L):
    item = L[st[counter_key]]



#st["visualisation_counter"] = st[counter_key]
#st[counter_key]= 500
counter = st[counter_key]
# ---------- end counter_2 ----------
idx = Panel(counter_2.counter)

# ---- group: import from .json / Assembly Artist
show_3 = BooleanToggle(False)
show_4 = BooleanToggle(True)
show_5 = BooleanToggle(False)
draw_2 = PythonScript(
    assembly=initial_assembly.assembly,
    show_all=show_3,
    show_current=show_4,
    show_counter=show_5,
    show_planes=show,
    counter=counter_2.counter,
    non_fixed_bricks_keys=initial_assembly.non_fixed_bricks_keys)  # -> G, G_element, tool_planes_WCS, current_tool_plane; inputs counter: Int32, non_fixed_bricks_keys: list
# ---------- draw_2: Python ----------
import os
import sys

import math

from compas.colors import Color
from compas.artists import Artist
from compas_ghpython.artists import NetworkArtist



G = []
G_element = []
#color = Color.from_rgb255(220,165,165)

key_index = assembly.network.key_index()
keys = [key_index[key] for key in assembly.network.nodes()]

keys = [key for key in keys if key in list(map(int, non_fixed_bricks_keys))]


print keys


elements = [assembly.element(key) for key in keys]
#print elements
#print([(e.gripping_frame) for e in elements])


if show_planes:
    tool_planes_WCS = [Artist(e.tool_frame).draw() for e in elements]
    current_tool_plane = tool_planes_WCS[counter]


if show_all and not show_counter:
    for element in elements:
        mesh = Artist(element.mesh).draw(Color.from_rgb255(220,165,165))
        G.append(mesh)
        
        
if show_counter:
    for element in elements[0:counter+1]:
        mesh = Artist(element.mesh).draw(Color.from_rgb255(220,165,165))
        G.append(mesh)
        

if show_current:
    element = assembly.element(counter)
    print element
    mesh = Artist(element.mesh).draw(Color.from_rgb255(41,49,51))
    G_element.append(mesh)
    

#    course = assembly.network.node_attribute(key=counter, name='course')
#    keys_in_course = list(assembly.network.nodes_where({'course': course}))
#    elements = [assembly.element(key) for key in keys_in_course]
#    for element in elements:
#        mesh = Artist(element.mesh).draw(color)
#        G.append(mesh)
# ---------- end draw_2 ----------
geo_2 = Geometry(draw_2.G)
geo_3 = Geometry(draw_2.G_element)
pln = Plane(draw_2.current_tool_plane)
pln_2 = Plane(draw_2.tool_planes_WCS)

# ---- group: import from .json / transformed planes
y_axis_3 = Curve(<curve referenced from the Rhino model>)
x_axis_3 = Curve(<curve referenced from the Rhino model>)
new_position = PythonScript(plane_axes=[x_axis_3, y_axis_3])  # -> plane; inputs plane_axes: list of Curve; same code as plane
transform_2 = GhPythonScript(
    tool_planes=draw_2.tool_planes_WCS,
    target_plane=new_position,
    counter=counter_2.counter,
    safety_offset=Slider(0, range=0..1))  # -> transformed_planes, current_transformed_plane; inputs tool_planes: list, target_plane: Plane, counter: Int32
# ---------- transform_2: Python ----------
from compas.geometry import Frame, Transformation, Translation
from compas.artists import Artist



frames = []
target_frame = Frame(target_plane.Origin, target_plane.XAxis, target_plane.YAxis)


for plane in tool_planes:
    frame = Frame(plane.Origin, plane.XAxis, plane.YAxis)
    #T1 = Transformation.from_frame_to_frame(target_frame, Frame.worldXY())
    T1 = Transformation.from_change_of_basis(target_frame, Frame.worldXY())
    T2 = Translation.from_vector(frame.zaxis*+safety_offset)
    frame.transform(T1)
    frame.transform(T2)
    frames.append(frame)



transformed_planes = [Artist(frame).draw() for frame in frames]
current_transformed_plane = transformed_planes[counter]
# ---------- end transform_2 ----------
draw_3 = GhPythonScript(planes=transform_2.current_transformed_plane, scale=Slider(0.1, range=0..1))  # -> P, V, C, W; inputs planes: list
# ---------- draw_3: Python ----------
from System.Drawing import Color
from compas_ghpython.artists import FrameArtist

red = Color.FromArgb(255, 0, 0)
green = Color.FromArgb(0, 255, 0)
blue = Color.FromArgb(0, 0, 255)

P = []
V = []
C = []

scale = float(scale)

for plane in planes:
    if not plane:
        continue
    P += [plane.Origin] * 3
    V.append(plane.XAxis * scale)
    V.append(plane.YAxis * scale)
    V.append(plane.ZAxis * scale)
    C += [red, green, blue]

W = 3
# ---------- end draw_3 ----------
pln_3 = Plane(transform_2.transformed_planes)
vdisex = VectorDisplayEx(Point=draw_3.P, Vector=draw_3.V, Colour=draw_3.C, Width=draw_3.W)

# ----
# plane
y_axis_4 = Curve(<curve referenced from the Rhino model>)
x_axis_4 = Curve(<curve referenced from the Rhino model>)

# ----
# planes from curve
number_slider = Slider(0.13, range=0..1)
crv = Curve(<curve referenced from the Rhino model>)

plane_3 = Python3Script(plane_axes=[x_axis_4, y_axis_4])  # -> out, plane; inputs plane_axes: list; same code as plane
curve_def = Python3Script(crv=crv, div_len=number_slider)  # -> planes; inputs crv: Curve
# ---------- curve_def: Python ----------
import rhinoscriptsyntax as rs
from compas.geometry import Frame, Line, Vector
from compas_rhino.conversions import mesh_to_rhino, frame_to_rhino_plane

# dividing curve
pts = rs.DivideCurveLength(crv, div_len)
frames = [Frame([pt.X, pt.Y, pt.Z], [-1, 0, 0], [0, 1, 0]) for pt in pts]
print (frames)

# for vizualization
planes = []
for frame in frames:
    planes.append(frame_to_rhino_plane(frame))
# ---------- end curve_def ----------

# ----
# forward kinematics
number_slider_2 = Slider(1.322, range=0..4.2)

jp = Python3Script()  # -> configuration_values
# ---------- jp: Python ----------
import math
joint_values = [-3.136, -0.328, -1.218, 3.129, 0.852, 0.008]
#joint_values = [math.degrees(j) for j in joint_values]
#joint_positions = [0] * 6

cart = 0
joint_values = [0,0,0,0,0,0]

configuration_values = [cart] + joint_values

print(configuration_values)
# ---------- end jp ----------

# ---- group: Reload library
reload = Button()
path_2 = PythonScript()  # -> HERE, DATA, ROBOT_DESCRIPTION
# ---------- path_2: Python ----------
import os

HERE = os.path.dirname(ghdoc.Path)
DATA = os.path.abspath(os.path.join(HERE, "..", "data"))
ROBOT_DESCRIPTION = os.path.abspath(os.path.join(DATA, "robot_description"))

print(HERE)
print(DATA)
print(ROBOT_DESCRIPTION)
# ---------- end path_2 ----------
py_2 = PythonScript(reload=reload)
# ---------- py_2: Python ----------
if reload:
    from compas_ghpython import unload_modules
    unload_modules("compas")
    unload_modules("compas_fab")
    unload_modules("compas_rrc")
    unload_modules("abb_fabrication_control")
    unload_modules("fabtory_fabrication_control")


    unload_modules("fabrication_manager")
    unload_modules("assembly_information_model")
    unload_modules('climate_active_envelopes_fabrication')
# ---------- end py_2 ----------

# ----
# plane
y_axis_5 = Curve(<curve referenced from the Rhino model>)
x_axis_5 = Curve(<curve referenced from the Rhino model>)
plane_4 = PythonScript(plane_axes=[y_axis_5, x_axis_5])  # -> plane; inputs plane_axes: list of Curve; same code as plane

# ----
# planes from curve
number_slider_3 = Slider(0.13, range=0..1)
crv_2 = Curve(<curve referenced from the Rhino model>)
curve_def_2 = GhPythonScript(crv=crv_2, div_len=number_slider_3)  # -> planes; inputs crv: Curve
# ---------- curve_def_2: Python ----------
import rhinoscriptsyntax as rs
from compas.geometry import Frame, Line, Vector
from compas_ghpython import draw_frame

# dividing curve
pts = rs.DivideCurveLength(crv, div_len)
frames = [Frame([pt.X, pt.Y, pt.Z], [-1, 0, 0], [0, 1, 0]) for pt in pts]
print frames

# for vizualization
planes = []
for frame in frames:
    planes.append(draw_frame(frame))
# ---------- end curve_def_2 ----------

draw_4 = GhPythonScript(planes=curve_def_2, scale=Slider(0.2, range=0..1))  # -> P, V, C, W; inputs planes: list; same code as draw_3
vdisex_2 = VectorDisplayEx(Point=draw_4.P, Vector=draw_4.V, Colour=draw_4.C, Width=draw_4.W)

# ----
# STATE  VIEWER
trigger = Trigger(Interval=100, TimerInterval=100, Target=fabrication_state)
fabrication_state = PythonScript()  # -> out, state, num_tasks, num_current_task, num_tasks_left, log_messages
# ---------- fabrication_state: Python ----------
from scriptcontext import sticky as st

fabrication = st["fabrication"]

if hasattr(fabrication, "task_thread"):
    if fabrication.task_thread.is_alive():
        state = "THREAD RUNNING"
    else:
        state = "THREAD STOPPED"

num_tasks = len(fabrication.tasks)
if fabrication.current_task_key is not None:
    num_current_task = fabrication.current_task_key+1
else:
    num_current_task = 0
num_tasks_left = num_tasks-num_current_task
log_messages = fabrication.log_messages
# ---------- end fabrication_state ----------
state = Panel(fabrication_state.state)
num_tasks = Panel(fabrication_state.num_tasks)
num_current_task = Panel(fabrication_state.num_current_task)
num_tasks_left = Panel(fabrication_state.num_tasks_left)
log_messages = Panel(fabrication_state.log_messages)

x_axis_6 = Curve(<curve referenced from the Rhino model>)
y_axis_6 = Curve(<curve referenced from the Rhino model>)
pick_up = PythonScript(plane_axes=[x_axis_6, y_axis_6])  # -> plane; inputs plane_axes: list of Curve; same code as plane

tcp_speed = Slider(250, range=0..1000)
place_planes = Plane(curve_def_2)

# ----
# Move Control
tcp_speed_2 = Slider(250, range=0..1000)
set_tool = Button()
target_plane = Plane(plane_3.plane)

to_frame = Button()
to_robtarget = Button()

tcp_speed_3 = Slider(250, range=0..1000)

to_single_joints = Button()
to_joints = Button()

set_tool_2 = Button()
reset_button = Button()

# ----
# Configuration
# forward kinematics
number_slider_4 = Slider(2.12, range=0..4.2)
forward_kinematics = Python3Script(
    reset=reset_button,
    a_cart=number_slider_4,
    a_a1=Slider(-26.4, range=-180..180),
    a_a2=Slider(-23.7, range=-90..150),
    a_a3=Slider(27.7, range=-180..180),
    a_a4=Slider(38.8, range=-400..400),
    a_a5=Slider(-12, range=-125..120),
    a_a6=Slider(0, range=-400..400))  # -> configuration
# ---------- forward_kinematics: Python ----------
import math
import Grasshopper

import Rhino
import scriptcontext as sc


from compas_robots.model import Joint
from compas_robots import Configuration


def reset_sliders():
    # Get all number sliders in the document
    sliders = [comp for comp in sc.doc.Objects if isinstance(comp, Rhino.DocObjects.ObjRef) and isinstance(comp.Geometry(), Rhino.Geometry.NurbsCurve) and comp.Attributes.Name == "Number Slider"]
    
    # Loop through sliders and set their values to zero
    for slider in sliders:
        slider.Geometry().SetUserString("Value", "0")

# Check if the toggle button is toggled on
if reset_sliders:
    reset_sliders()


if model:
    joint_positions = [a_cart, a_a1, a_a2, a_a3, a_a4, a_a5, a_a6]
    print (joint_positions)
    joint_types = model.get_joint_types()
    print(joint_types)
    joint_names = model.get_configurable_joint_names()
    print(joint_names)

    for i, joint_type in enumerate(joint_types):
        if joint_type == Joint.REVOLUTE:
            joint_positions[i] = math.radians(joint_positions[i])
        if joint_type == Joint.PRISMATIC:
            joint_positions[i] = joint_positions[i]
    
    configuration = Configuration(joint_positions, joint_types, joint_names)
    print (configuration)
# ---------- end forward_kinematics ----------

# ----
# inverse kinematics
ik = Python3Script()  # -> configuration; unedited script template
list_5 = ValueList({"fk_configuration": 0, "robot_configuration": 1}, selected="robot_configuration")
fk_configuration = Data(forward_kinematics)
go_to_start_configuration = BooleanToggle(False)
avoid_collisions = BooleanToggle(False)
filter = StreamFilter(Gate=list_5, Stream0=fk_configuration, Stream1=ik)
inverse_kinematics = Python3Script(
    compute=Toggle(True),
    start_configuration=filter,
    go_to_start_configuration=go_to_start_configuration,
    avoid_collisions=avoid_collisions)  # -> out, ik_configuration, t0cp
# ---------- inverse_kinematics: Python ----------
from __future__ import print_function
import logging
from compas.geometry import Frame
from scriptcontext import sticky as st
from compas_ghpython.utilities import draw_frame

LOGGER = logging.getLogger('roslibpy')

#vizualize t0cf
if robot.attached_tool:
    t0cf = Frame(plane.Origin, plane.XAxis, plane.YAxis)
    t0cp = draw_frame(t0cf)
    print (t0cf)


if compute:
    robot.client = robot.ros_client
    if go_to_start_configuration:
        ik_configuration = start_configuration
    else:
        tool_frame = Frame(plane.Origin, plane.XAxis, plane.YAxis)
        ik_configuration = robot.inverse_kinematics(tool_frame,
                                                    start_configuration,
                                                    group=group,
                                                    options={
                                                      'avoid_collisions':avoid_collisions,
                                                      'return_full_configuration':True,
                                                    })        
#group_configuration = robot.get_group_configuration(group, ik_configuration)
#print (group_configuration)
st["ik_configuration"] = ik_configuration

ik_configuration = st["ik_configuration"] 
print(ik_configuration)
# ---------- end inverse_kinematics ----------
draw_5 = Python3Script(planes=inverse_kinematics.t0cp, scale=Slider(0.2, range=0..1))  # -> P, V, C, W; same code as draw_3
panel_4 = Panel(inverse_kinematics.out)
vdisex_3 = VectorDisplayEx(Point=draw_5.P, Vector=draw_5.V, Colour=draw_5.C, Width=draw_5.W)

toggle_2 = BooleanToggle(False)

to_frame_2 = Button()
to_robtarget_2 = Button()

tcp_speed_4 = Slider(250, range=0..1000)
set_tool_3 = Button()
# Move Control
tcp_speed_5 = Slider(250, range=0..1000)

to_single_joints_2 = Button()
to_joints_2 = Button()

target_plane_2 = Plane(plane_4)
set_tool_4 = Button()

# ----
# Visualisation
list_6 = ValueList({"0 forward_kinematics": 0, "1 inverse_kinematics": 1}, selected="0 forward_kinematics")
show_frames = BooleanToggle(True)
show_visual = BooleanToggle(True)
show_collision = BooleanToggle(True)
show_base_frame = BooleanToggle(True)
show_end_effector_frame = BooleanToggle(True)
show_acm = BooleanToggle(True)
fk_configuration_2 = Data(forward_kinematics)
ik_configuration = Data(inverse_kinematics.ik_configuration)
filter_2 = StreamFilter(Gate=list_6, Stream0=fk_configuration_2, Stream1=ik_configuration)
visualise = Python3Script(
    configuration=[forward_kinematics, filter_2],
    show_frames=show_frames,
    show_visual_meshes=show_visual,
    show_collision_meshes=show_collision,
    show_base_frame=show_base_frame,
    show_end_effector_frame=show_end_effector_frame,
    show_attached_collision_meshes=show_acm)  # -> out, joint_planes, visual_meshes, collision_meshes, base_plane, end_effector_plane, attched_collision_meshes
# ---------- visualise: Python ----------
from compas.geometry import Frame
from compas.geometry import Transformation
from compas_rhino.conversions import frame_to_rhino

if show_frames == True: 
    #print(configuration)
    joint_frames = model.transformed_frames(configuration)
    joint_planes = [frame_to_rhino(a) for a in joint_frames]

if show_base_frame == True:
    show_base_frame = model.forward_kinematics(configuration, model.get_base_link_name())
    #print(show_base_frame)
    base_plane = frame_to_rhino(show_base_frame) 

if show_end_effector_frame == True:
    end_effector_frame = model.forward_kinematics(configuration, model.get_end_effector_link_name())
    #print(end_effector_frame)
    end_effector_plane = frame_to_rhino(end_effector_frame) 

if show_visual_meshes == True:
    pass

if show_collision_meshes == True:
    pass

if show_attached_collision_meshes == True:
    pass
# ---------- end visualise ----------
pln_4 = Plane(visualise.joint_planes)
pln_5 = Plane(visualise.base_plane)
pln_6 = Plane(visualise.end_effector_plane)
draw_6 = Python3Script(frames=[visualise.end_effector_plane, visualise.joint_planes, visualise.base_plane], scale=Slider(0.2, range=0..1))  # -> P, V, C, W
# ---------- draw_6: Python ----------
from System.Drawing import Color
from compas_ghpython.artists import FrameArtist

red = Color.FromArgb(255, 0, 0)
green = Color.FromArgb(0, 255, 0)
blue = Color.FromArgb(0, 0, 255)

P = []
V = []
C = []

scale = float(scale)

for plane in frames:
    if not plane:
        continue
    P += [plane.Origin] * 3
    V.append(plane.XAxis * scale)
    V.append(plane.YAxis * scale)
    V.append(plane.ZAxis * scale)
    C += [red, green, blue]

W = 3
# ---------- end draw_6 ----------
geo_4 = Geometry([visualise.collision_meshes, visualise.attched_collision_meshes, visualise.visual_meshes])
preview_4 = CustomPreview(Geometry=geo_4, Shader=ColourSwatch(SwatchColor=RGB(207, 157, 160)))
vdisex_4 = VectorDisplayEx(Point=draw_6.P, Vector=draw_6.V, Colour=draw_6.C, Width=draw_6.W)

get_frame = Button()
get_robtarget = Button()
get_joints = Button()

# ----
# Tool
list_7 = ValueList({"measurement_tool": 0, "parallel_gripper_with_clay_extruder": 1, "parallel_brick_grippers": 2, "perpendicular_gripper_with_clay_extruder": 3}, selected="perpendicular_gripper_with_clay_extruder")
panel_5 = Panel("Attach a custom tool")
list_8 = ValueList({"nozzle": "t_nozzle", "gripper_625": "t_gripper_625", "gripper_125": "t_gripper_125", "gripper_240": "t_gripper_240"}, selected="gripper_240")
show_6 = BooleanToggle(True)
remove = Button()
add = Button()

tools = Python3Script(data_path=path.DATA, tool=list_7, tcp_frame=list_8, show=show_6)  # -> values_for_RS, tool, ee_plane, M
# ---------- tools: Python ----------
import os, math
from compas.geometry import Frame, Rotation
from compas.datastructures import Mesh
from compas_rhino.conversions import mesh_to_rhino, frame_to_rhino_plane
from compas_fab.robots import Tool

tolerance = 0

if tool == 0:
    filename = 'measurement_tool_zaxis.stl'
    ee_frame = Frame([0, 0, 0.109], [1, 0, 0], [0, 1, 0])

elif tool == 1:
    filename = 'parallel_gripper_with_clay_extruder.stl'

    if tcp_frame == "t_nozzle":
        ee_frame = Frame([0.301, 0.00, 0.167], [0, 0, 1], [0, -1, 0])

    elif tcp_frame == "t_gripper_625":
        ee_frame = Frame([0.0, 0.52, 0.10], [0, 0, 1], [1, 0, 0])

elif tool == 2:
    filename = 'parallel_brick_grippers.stl'
    if tcp_frame == "t_gripper_125":
        ee_frame = Frame([0.0, 0.533, 0.100], [1, 0, 0], [0, 0, -1])

    elif tcp_frame == "t_gripper_240":
        ee_frame = Frame([0.414, 0.00, 0.100], [0, -1, 0], [0, 0, -1])
        
elif tool == 3:
    filename = 'perpendicular_gripper_with_clay_extruder.stl'
    if tcp_frame == "t_gripper_125":
        ee_frame = Frame([0.0, 0.533, 0.100], [1, 0, 0], [0, 0, -1])

    elif tcp_frame == "t_gripper_240":
        ee_frame = Frame([0.414, 0.00, 0.100], [0, -1, 0], [0, 0, -1])


data_path = os.path.join(data_path, "tool_geometry")
fullfilename = os.path.join(data_path, filename)
#print fullfilename

ee_mesh = Mesh.from_stl(fullfilename)
collision_mesh = ee_mesh

if show:
    M = mesh_to_rhino(ee_mesh)

tool = Tool(ee_mesh, ee_frame,  name=tcp_frame)
print (tool.name)

ee_plane = frame_to_rhino_plane(ee_frame)

values_for_robotstudio = [[round(entry*1000, 5) for entry in list(ee_frame.point)], list(ee_frame.quaternion)]
print (values_for_robotstudio)
# ---------- end tools ----------
draw_7 = Python3Script(ee_plane=tools.ee_plane, scale=Slider(0.2, range=0..1))  # -> P, V, C, W; inputs ee_plane: list
# ---------- draw_7: Python ----------
from System.Drawing import Color
from compas_rhino.conversions import mesh_to_rhino, frame_to_rhino_plane

red = Color.FromArgb(255, 0, 0)
green = Color.FromArgb(0, 255, 0)
blue = Color.FromArgb(0, 0, 255)

P = []
V = []
C = []

scale = float(scale)
for plane in ee_plane:
    if not plane:
        continue
    P += [plane.Origin] * 3
    V.append(plane.XAxis * scale)
    V.append(plane.YAxis * scale)
    V.append(plane.ZAxis * scale)
    C += [red, green, blue]

W = 3
# ---------- end draw_7 ----------
plane_5 = Plane(tools.ee_plane)

mesh = Mesh(tools.M)
vdisex_5 = VectorDisplayEx(Point=draw_7.P, Vector=draw_7.V, Colour=draw_7.C, Width=draw_7.W)
values_for_robotstudio = Panel(tools.values_for_RS)

# ----
# ROS & ABB client
ros_ip = ValueList({"127.0.0.1"}, selected="127.0.0.1")
ros_port = ValueList({"9090"}, selected="9090")
clients = Python3Script(ip=ros_ip, port=ros_port, connect=connect, close=close)  # -> out, ros_client, abb_client, is_connected
# ---------- clients: Python ----------
from scriptcontext import sticky as st

import compas_rrc as rrc
from compas_fab.backends import RosClient

if 'ros_client' not in st:
    st['ros_client'] = None
    st['abb_client'] = None
    st['is_connected'] = False

if close:
    st['ros_client'].close()
    st['ros_client'] = None
    st['abb_client'] = None
    st['is_connected'] = False

if connect:
    ros_client = RosClient(ip, port)
    try:
        ros_client.run(2)
    except:
        print('Cannot connect to ROS Client')
    
    
    st['is_connected'] = ros_client.is_connected if ros_client else False

    if st['is_connected']:
        abb_client = rrc.AbbClient(ros_client, '/rob1')

        st['ros_client'] = ros_client
        st['abb_client'] = abb_client

is_connected = st['is_connected']
ros_client = st['ros_client']
abb_client = st['abb_client']

print('ROS Client: ', ros_client)
print('ABB Client: ', abb_client)
print('is connected: ', is_connected)
# ---------- end clients ----------
is_connected = Panel(clients.is_connected)

# ----
# Load robot from local package
load = Button()
list_9 = ValueList({"abb_fabtory"}, selected="abb_fabtory")

load_robot_model = Python3Script(path=path.ROBOT_DESCRIPTION, package=list_9, urdf_name="abb_fabtory.urdf", srdf_name=panel_3, load=load)  # -> out, robot_model
# ---------- load_robot_model: Python ----------
import os
from scriptcontext import sticky as st

import compas
import compas_fab

from compas_robots import RobotModel
from compas_robots.resources import LocalPackageMeshLoader

from compas_fab.robots import Robot

from compas_robots.scene import BaseRobotModelObject

# from compas_robots.ghpython.scene import RobotModelObject


#from compas_fab.robots import Robot
#from compas_fab.robots import RobotSemantics
#from compas_fab.ghpython import RobotArtist

packages = ["abb_irb6700_support", "abb_end_effectors", "abb_fabtory"]
loaders = []

for package in packages:
    loaders.append(LocalPackageMeshLoader(path, package))

#path directory
package_path = os.path.join(path, package)
print(package_path)

urdf_filename = os.path.join(package_path, "urdf", urdf_name)
srdf_filename = os.path.join(package_path, srdf_name)

assert os.path.isfile(urdf_filename)
assert os.path.isfile(srdf_filename)

compas.PRECISION = '12f'

# store robot in component
guid = str(ghenv.Component.InstanceGuid)
robot_key = "robot_" + guid

if robot_key not in st:
    st[robot_key] = None

#load robot model from urdf
if load:

    # Create robot model from URDF
    model = RobotModel.from_urdf_file(urdf_filename)
    model.load_geometry(*loaders, precision=12)
    
    st[robot_key] = model

robot_model = st[robot_key]
# ---------- end load_robot_model ----------

set = Python3Script(robot=load_robot_model.robot_model, ros_client=clients.ros_client, abb_client=clients.abb_client)  # -> out, robot, main_group_name
# ---------- set: Python ----------
if robot and ros_client and abb_client:
    robot.ros_client = ros_client
    robot.abb_client = abb_client


    #main_group_name = robot.main_group_name
    print(robot)
# ---------- end set ----------

robot_model = Data(load_robot_model.robot_model)

info = Python3Script(robot_model=robot_model)  # -> out, a
# ---------- info: Python ----------
if robot_model:
    print(robot_model)
# ---------- end info ----------
attach_remove = Python3Script(robot=load_robot_model.robot_model, tool=tools.tool, attach=add, remove=remove)  # -> bang
# ---------- attach_remove: Python ----------
if attach:
    robot.attached_tool(tool)

if remove:
    robot.detached_tool()
# ---------- end attach_remove ----------

# ----
# Info
panel_6 = Panel(info.out)

# ----
# Configuration
forward_kinematics_2 = Python3Script(
    model=robot_model,
    reset_configuration=Button(),
    a_cart=number_slider_2,
    a_a1=Slider(55.8, range=-180..180),
    a_a2=Slider(-28.2, range=-90..150),
    a_a3=Slider(46.9, range=-180..180),
    a_a4=Slider(-94.2, range=-400..400),
    a_a5=Slider(36, range=-125..120),
    a_a6=Slider(-400, range=-400..400))  # -> configuration; inputs reset_configuration: Boolean, configuration_values: list of Double
# ---------- forward_kinematics_2: Python ----------
import math

from compas_robots.model import Joint
from compas_robots import Configuration
import math
import Grasshopper
import copy


if model:
    joint_positions = [a_cart, a_a1, a_a2, a_a3, a_a4, a_a5, a_a6]
    print (joint_positions)
    joint_types = model.get_joint_types()
    print(joint_types)
    joint_names = model.get_configurable_joint_names()
    print(joint_names)

    for i, joint_type in enumerate(joint_types):
        if joint_type == Joint.REVOLUTE:
            joint_positions[i] = math.radians(joint_positions[i])
        if joint_type == Joint.PRISMATIC:
            joint_positions[i] = joint_positions[i]
    
    configuration = Configuration(joint_positions, joint_types, joint_names)
    print (configuration)



if reset_configuration:
    j = 0
    for i in range(ghenv.Component.Params.Input.Count):
        nslider = ghenv.Component.Params.Input[i].Sources[0]
        if nslider.GetType() == Grasshopper.Kernel.Special.GH_NumberSlider:
            nslider.TrySetSliderValue(configuration_values[j])
            j += 1
# ---------- end forward_kinematics_2 ----------

# ----
# inverse kinematics
list_10 = ValueList({"fk_configuration": 0, "robot_configuration": 1}, selected="fk_configuration")
ik_2 = Python3Script(robot=set.robot)  # -> configuration
# ---------- ik_2: Python ----------
#from compas_fab.robots import Configuration
from compas_robots import Configuration

if robot:
    types = robot.get_joint_types()
    values = [0] * len(types)
    configuration = Configuration(values, types)
    print (configuration)
    print (robot.get_configurable_joint_names())
# ---------- end ik_2 ----------
fk_configuration_3 = Data(forward_kinematics_2)
go_to_start_configuration_2 = BooleanToggle(False)
avoid_collisions_2 = BooleanToggle(False)
filter_3 = StreamFilter(Gate=list_10, Stream0=fk_configuration_3, Stream1=ik_2)
inverse_kinematics_2 = Python3Script(
    compute=Toggle(True),
    robot=set.robot,
    plane=plane_3.plane,
    start_configuration=filter_3,
    go_to_start_configuration=go_to_start_configuration_2,
    avoid_collisions=avoid_collisions_2)  # -> out, ik_configuration, t0cp
# ---------- inverse_kinematics_2: Python ----------
from __future__ import print_function
import logging
from compas.geometry import Frame
from scriptcontext import sticky as st
from compas_rhino.conversions import mesh_to_rhino, frame_to_rhino_plane
from compas.geometry import Frame
from compas_fab.backends import RosClient

LOGGER = logging.getLogger('roslibpy')

#vizualize t0cf
#if robot.attached_tool:
t0cf = Frame(plane.Origin, plane.XAxis, plane.YAxis)
t0cp = frame_to_rhino_plane(t0cf)
print (t0cf)


if compute:

    robot.client = robot.ros_client
    robot = robot.client.load_robot()
    #start_configuration = robot.zero_configuration()
    if go_to_start_configuration:
        ik_configuration = start_configuration
    else:
        tool_frame = Frame(plane.Origin, plane.XAxis, plane.YAxis)
        print(tool_frame)
    
        ik_configuration = robot.inverse_kinematics(tool_frame, start_configuration)
        print("Found configuration", ik_configuration)

        ik_configuration = robot.inverse_kinematics(tool_frame,
                                                    start_configuration,
                                                    group=group,
                                                    options={
                                                        'avoid_collisions':avoid_collisions,
                                                        'return_full_configuration':True,
                                                    })        
    #group_configuration = robot.get_group_configuration(group, ik_configuration)
    #print (group_configuration)
    st["ik_configuration"] = ik_configuration
    ik_configuration = st["ik_configuration"] 
    print(ik_configuration)
# ---------- end inverse_kinematics_2 ----------
draw_8 = Python3Script(planes=inverse_kinematics_2.t0cp, scale=Slider(0.2, range=0..1))  # -> P, V, C, W; inputs planes: list of Plane
# ---------- draw_8: Python ----------
from System.Drawing import Color


red = Color.FromArgb(255, 0, 0)
green = Color.FromArgb(0, 255, 0)
blue = Color.FromArgb(0, 0, 255)

P = []
V = []
C = []

scale = float(scale)

for plane in planes:
    if not plane:
        continue
    P += [plane.Origin] * 3
    V.append(plane.XAxis * scale)
    V.append(plane.YAxis * scale)
    V.append(plane.ZAxis * scale)
    C += [red, green, blue]

W = 3
# ---------- end draw_8 ----------
panel_7 = Panel(inverse_kinematics_2.out)
vdisex_6 = VectorDisplayEx(Point=draw_8.P, Vector=draw_8.V, Colour=draw_8.C, Width=draw_8.W)

list_11 = ValueList({"0 forward_kinematics": 0, "1 inverse_kinematics": 1}, selected="0 forward_kinematics")
fk_configuration_4 = Data(forward_kinematics_2)
ik_configuration_2 = Data(inverse_kinematics_2.ik_configuration)
filter_4 = StreamFilter(Gate=list_11, Stream0=fk_configuration_4, Stream1=ik_configuration_2)

jp_2 = Python3Script(robot=set.robot)  # -> full_configurations
# ---------- jp_2: Python ----------
import math
import Grasshopper
import copy
from compas_robots.model import Joint
from compas_robots import Configuration




"""
joint_values = [-3.136, -0.328, -1.218, 3.129, 0.852, 0.008]
#joint_values = [math.degrees(j) for j in joint_values]
#joint_positions = [0] * 6

configurations_values = []

cart = 0
joint_values = [0,0,0,0,0,0]
configuration_values = [cart] + joint_values

configurations_values.append(configuration_values)

full_configurations = []

for configuration_values in configurations_values:

    joint_positions_degrees = copy.deepcopy(configuration_values)
    joint_types = robot.get_configurable_joint_types()
    #print(joint_types)
    for i, joint_type in enumerate(joint_types):
        if joint_type == Joint.REVOLUTE:
            joint_positions[i] = math.radians(joint_positions[i])
        if joint_type == Joint.PRISMATIC:
            joint_positions[i] = joint_positions[i]
    full_configurations.append(Configuration(joint_positions, joint_types))


if move_to_joints:
    #ffc.commands.move_to_joints(robot, configuration, speed=speed, zone=rrc.Zone.FINE)
    ffc.commands.move_to_joints_2(robot, configuration, speed=speed, zone=rrc.Zone.FINE)
"""





full_configurations = []

c = Configuration((0.937, -1.328, 0.277, 0.786, 0.276, -1.079, -0.134), (2, 0, 0, 0, 0, 0, 0), ('axis_joint', 'joint_1', 'joint_2', 'joint_3', 'joint_4', 'joint_5', 'joint_6'))
full_configurations.append(c)

c = Configuration((1.691, -2.350, -0.365, 0.800, -0.258, -0.483, 0.197), (2, 0, 0, 0, 0, 0, 0), ('axis_joint', 'joint_1', 'joint_2', 'joint_3', 'joint_4', 'joint_5', 'joint_6'))
full_configurations.append(c)

c = Configuration((1.679, -1.497, 0.538, -0.330, -0.150, -1.191, 0.272), (2, 0, 0, 0, 0, 0, 0), ('axis_joint', 'joint_1', 'joint_2', 'joint_3', 'joint_4', 'joint_5', 'joint_6'))
full_configurations.append(c)
# ---------- end jp_2 ----------
movel_command = Python3Script(
    robot=set.robot,
    configuration=filter_4,
    speed=tcp_speed_2,
    target_plane=plane_3.plane,
    move_to_frame=to_frame,
    move_to_robtarget=to_robtarget,
    set_tool=set_tool)  # -> out
# ---------- movel_command: Python ----------
import compas_rrc as rrc
import abb_fabrication_control as ffc
from compas.geometry import Frame

#set tool in RobotStudio
if set_tool:
    if robot.attached_tool:
        tool_name = robot.attached_tool.name
        print (tool_name)
        done = robot.abb_client.send(rrc.SetTool(tool_name))
        print (done)
    else:
        robot.abb_client.send(rrc.SetTool("tool0"))

if move_to_frame:
    #transform target plane into target frame
    target_frame = Frame(target_plane.Origin, target_plane.XAxis, target_plane.YAxis)
    #send move to frame command
    ffc.commands.move_to_frame(robot, target_frame, speed=speed, zone=rrc.Zone.FINE, scalefactor=1000)

if move_to_robtarget:
    #transform target plane into target frame
    target_frame = Frame(target_plane.Origin, target_plane.XAxis, target_plane.YAxis)
    #store cart value from configuration
    cart = (configuration.joint_values[0])
    #send move to robtarget command
    ffc.commands.move_to_robtarget(robot, target_frame, cart, speed=speed, zone=rrc.Zone.FINE, scalefactor=1000)
# ---------- end movel_command ----------

# ----
# Move Cartesian
data_recorder = DataRecorder(movel_command, DataLimit=-10, RecordData=True)
out = Panel(data_recorder)

draw_9 = Python3Script(planes=curve_def, scale=Slider(0.2, range=0..1))  # -> out, P, V, C, W
# ---------- draw_9: Python ----------
from System.Drawing import Color
from compas_rhino.conversions import mesh_to_rhino, frame_to_rhino_plane

red = Color.FromArgb(255, 0, 0)
green = Color.FromArgb(0, 255, 0)
blue = Color.FromArgb(0, 0, 255)

P = []
V = []
C = []

scale = float(scale)

for plane in planes:
    if not plane:
        continue
    P += [plane.Origin] * 3
    V.append(plane.XAxis * scale)
    V.append(plane.YAxis * scale)
    V.append(plane.ZAxis * scale)
    C += [red, green, blue]

W = 3
# ---------- end draw_9 ----------

vdisex_7 = VectorDisplayEx(Point=draw_9.P, Vector=draw_9.V, Colour=draw_9.C, Width=draw_9.W)

# ----
# Visualisation
show_acm_2 = BooleanToggle(False)
show_end_effector_frame_2 = BooleanToggle(True)
show_frames_2 = BooleanToggle(True)
show_base_frame_2 = BooleanToggle(True)
show_visual_2 = BooleanToggle(True)
show_collision_2 = BooleanToggle(True)

robot_vsualise = Python3Script(
    robot=robot_model,
    group=set.main_group_name,
    configuration=filter_4,
    redraw=attach_remove,
    show_frames=show_frames_2,
    show_visual_meshes=show_visual_2,
    show_collision_meshes=show_collision_2,
    show_base_frame=show_base_frame_2,
    show_end_effector_frame=show_end_effector_frame_2,
    show_attached_collision_meshes=show_acm_2)  # -> out, joint_planes, visual_meshes, collision_meshes, base_plane, end_effector_plane, attched_collision_meshes
# ---------- robot_vsualise: Python ----------
"""
Visualizes the robot.

COMPAS FAB v0.19.1
"""
from compas.geometry import Frame
from compas.geometry import Transformation
from ghpythonlib.componentbase import executingcomponent as component
from compas_rhino.conversions import mesh_to_rhino, frame_to_rhino_plane, frame_to_rhino
import Rhino



if show_visual_meshes:               
    pass
    

if show_collision_meshes:
    pass

if show_base_frame:
    show_base_frame = robot.forward_kinematics(configuration, robot.get_base_link_name())
    #print(show_base_frame)
    base_plane = frame_to_rhino(show_base_frame)

if show_end_effector_frame:
    end_effector_frame = robot.forward_kinematics(configuration, robot.get_end_effector_link_name())
    #print(end_effector_frame)
    end_effector_plane = frame_to_rhino(end_effector_frame) 

if show_frames:
    joint_frames = robot.transformed_frames(configuration)
    joint_planes = [frame_to_rhino(a) for a in joint_frames]

if show_attached_collision_meshes:
    attached_meshes = []
    #for acm in attached_collision_meshes:
     #   frame = robot.forward_kinematics(configuration, options=dict(solver='model', link_name=acm.link_name))
     #   T = Transformation.from_frame_to_frame(Frame.worldXY(), frame)
     #   mesh = acm.collision_mesh.mesh.transformed(T)
     #   attached_meshes.append(frame_to_rhino(mesh))
# ---------- end robot_vsualise ----------
pln_7 = Plane(robot_vsualise.joint_planes)
pln_8 = Plane(robot_vsualise.base_plane)
pln_9 = Plane(robot_vsualise.end_effector_plane)
draw_10 = Python3Script(planes=[pln_9, pln_8, pln_7], scale=Slider(0.2, range=0..1))  # -> out, P, V, C, W; inputs planes: list of Plane
# ---------- draw_10: Python ----------
from System.Drawing import Color

red = Color.FromArgb(255, 0, 0)
green = Color.FromArgb(0, 255, 0)
blue = Color.FromArgb(0, 0, 255)

P = []
V = []
C = []

scale = float(scale)

for plane in planes:
    if not plane:
        continue
    P += [plane.Origin] * 3
    V.append(plane.XAxis * scale)
    V.append(plane.YAxis * scale)
    V.append(plane.ZAxis * scale)
    C += [red, green, blue]

W = 3
# ---------- end draw_10 ----------

geo_5 = Geometry([robot_vsualise.collision_meshes, robot_vsualise.visual_meshes, robot_vsualise.attched_collision_meshes])
vdisex_8 = VectorDisplayEx(Point=draw_10.P, Vector=draw_10.V, Colour=draw_10.C, Width=draw_10.W)
preview_5 = CustomPreview(Geometry=geo_5, Shader=ColourSwatch(SwatchColor=RGB(207, 157, 160)))

# ----
# ROS & ABB client
ros_ip_2 = ValueList({"127.0.0.1"}, selected="127.0.0.1")
ros_port_2 = ValueList({"9090"}, selected="9090")
ros = ROSConnect(ip=ros_ip_2, port=ros_port_2, connect=Toggle(True))  # -> ros_client, is_connected; inputs port: Int32, connect: Boolean
#   port ip: The ip address ROS. Defaults to 127.0.0.1.
#   port port: The port of ROS. Defaults to 9090.
#   port connect: If True, connects to ROS. If False, disconnects from ROS. Defaults to False.
#   port ros_client: The ROS client.
#   port is_connected: True if connection established.
# ---------- ros: Python ----------
"""
Connect or disconnect to ROS.

COMPAS FAB v0.19.1
"""
from ghpythonlib.componentbase import executingcomponent as component
from scriptcontext import sticky as st

from compas_fab.backends import RosClient
from compas_fab.ghpython.components import create_id


class ROSConnect(component):
    def RunScript(self, ip, port, connect):
        ros_client = None

        ip = ip or '127.0.0.1'
        port = port or 9090

        key = create_id(self, 'ros_client')
        ros_client = st.get(key, None)

        if ros_client:
            st[key].close()
        if connect:
            st[key] = RosClient(ip, port)
            st[key].run(5)

        ros_client = st.get(key, None)
        is_connected = ros_client.is_connected if ros_client else False
        return (ros_client, is_connected)
# ---------- end ros ----------
is_connected_2 = Panel(ros.is_connected)
abb = GhPythonScript(ros_client=ros.ros_client, connect=Toggle(True))  # -> out, abb_client; inputs connect: Boolean
# ---------- abb: Python ----------
import compas_rrc as rrc

if ros_client:
    if ros_client.is_connected and connect: 
        # Create ABB Client
        abb_client = rrc.AbbClient(ros_client, '/rob1')
# ---------- end abb ----------

# ----
# Tool
panel_8 = Panel("Attach a custom tool")
list_12 = ValueList({"measurement_tool": 0, "parallel_gripper_with_clay_extruder": 1, "parallel_brick_grippers": 2, "perpendicular_gripper_with_clay_extruder": 3}, selected="perpendicular_gripper_with_clay_extruder")
list_13 = ValueList({"nozzle": "t_nozzle", "gripper_625": "t_gripper_625", "gripper_125": "t_gripper_125", "gripper_240": "t_gripper_240"}, selected="gripper_240")
show_7 = BooleanToggle(True)
py_3 = PythonScript()  # -> DATA
# ---------- py_3: Python ----------
import os

#package_path = os.path.dirname(mobile_fabrication_control.__file__)
#DATA = os.path.abspath(os.path.join(package_path,"../../data"))

package_path = ghdoc.Path
# package_path = os.path.dirname(ur_fabrication_control.__file__)
#DATA = os.path.abspath(os.path.join(package_path,"../../data"))

# .stl files not stored in am_hackathon repo. but in mobile_fabrication_control
DATA = os.path.abspath(os.path.join(package_path,"../../../fabtory_fabrication_control/data"))

print(package_path)
print(DATA)
# ---------- end py_3 ----------
tools_2 = PythonScript(data_path=py_3, tool=list_12, tcp_frame=list_13, show=show_7)  # -> values_for_RS, tool, ee_plane, M
# ---------- tools_2: Python ----------
import os, math
from compas.geometry import Frame, Rotation
from compas.datastructures import Mesh
from compas.datastructures import Mesh
from compas_ghpython.artists import MeshArtist
from compas_fab.robots import Tool
from compas_ghpython.utilities import draw_frame

tolerance = 0

if tool == 0:
    filename = 'measurement_tool_zaxis.stl'
    ee_frame = Frame([0, 0, 0.109], [1, 0, 0], [0, 1, 0])

elif tool == 1:
    filename = 'parallel_gripper_with_clay_extruder.stl'

    if tcp_frame == "t_nozzle":
        ee_frame = Frame([0.301, 0.00, 0.167], [0, 0, 1], [0, -1, 0])

    elif tcp_frame == "t_gripper_625":
        ee_frame = Frame([0.0, 0.52, 0.10], [0, 0, 1], [1, 0, 0])

elif tool == 2:
    filename = 'parallel_brick_grippers.stl'
    if tcp_frame == "t_gripper_125":
        ee_frame = Frame([0.0, 0.533, 0.100], [1, 0, 0], [0, 0, -1])

    elif tcp_frame == "t_gripper_240":
        ee_frame = Frame([0.414, 0.00, 0.100], [0, -1, 0], [0, 0, -1])
        
elif tool == 3:
    filename = 'perpendicular_gripper_with_clay_extruder.stl'
    if tcp_frame == "t_gripper_125":
        ee_frame = Frame([0.0, 0.533, 0.100], [1, 0, 0], [0, 0, -1])

    elif tcp_frame == "t_gripper_240":
        ee_frame = Frame([0.414, 0.00, 0.100], [0, -1, 0], [0, 0, -1])


data_path = os.path.join(data_path, "tool_geometry")
fullfilename = os.path.join(data_path, filename)
#print fullfilename

ee_mesh = Mesh.from_stl(fullfilename)
collision_mesh = ee_mesh

if show:
    artist = MeshArtist(ee_mesh)
    M = artist.draw()

tool = Tool(ee_mesh, ee_frame,  name=tcp_frame)
print tool.name

ee_plane = draw_frame(ee_frame)

values_for_robotstudio = [[round(entry*1000, 5) for entry in list(ee_frame.point)], list(ee_frame.quaternion)]
print values_for_robotstudio
# ---------- end tools_2 ----------
draw_11 = GhPythonScript(ee_plane=tools_2.ee_plane, scale=Slider(0.2, range=0..1))  # -> P, V, C, W; inputs ee_plane: list
# ---------- draw_11: Python ----------
from System.Drawing import Color
from compas_ghpython.artists import FrameArtist

red = Color.FromArgb(255, 0, 0)
green = Color.FromArgb(0, 255, 0)
blue = Color.FromArgb(0, 0, 255)

P = []
V = []
C = []

scale = float(scale)

for plane in ee_plane:
    if not plane:
        continue
    P += [plane.Origin] * 3
    V.append(plane.XAxis * scale)
    V.append(plane.YAxis * scale)
    V.append(plane.ZAxis * scale)
    C += [red, green, blue]

W = 3
# ---------- end draw_11 ----------
mesh_2 = Mesh(tools_2.M)
remove_2 = Button()
add_2 = Button()
vdisex_9 = VectorDisplayEx(Point=draw_11.P, Vector=draw_11.V, Colour=draw_11.C, Width=draw_11.W)
values_for_robotstudio_2 = Panel(tools_2.values_for_RS)

plane_6 = Plane(tools_2.ee_plane)

# ----
# Load Model
# Load robot from local package
load_2 = Button()
list_14 = ValueList({"abb_fabtory"}, selected="abb_fabtory")
units = ValueList({"m": 1, "cm": 100, "mm": 1000}, selected="m")

# ----
# Robot Model
panel_9 = Panel("abb_fabtory.srdf")

load_model = PythonScript(
    path=path_2.ROBOT_DESCRIPTION,
    package=list_14,
    urdf_name="abb_fabtory.urdf",
    srdf_name=panel_9,
    scale_factor=units,
    load=load_2)  # -> robot
# ---------- load_model: Python ----------
import os
from scriptcontext import sticky as st
import compas
from compas.robots import RobotModel
from compas.robots import LocalPackageMeshLoader
from compas_fab.robots import Robot
from compas_fab.robots import RobotSemantics
from compas_fab.ghpython import RobotArtist

packages = ["abb_irb6700_support", "abb_end_effectors", "abb_fabtory"]
loaders = []

for package in packages:
    loaders.append(LocalPackageMeshLoader(path, package))

#path directory
package_path = os.path.join(path, package)
print(package_path)

urdf_filename = os.path.join(package_path, "urdf", urdf_name)
srdf_filename = os.path.join(package_path, srdf_name)

assert os.path.isfile(urdf_filename)
assert os.path.isfile(srdf_filename)

compas.PRECISION = '12f'

# store robot in component
guid = str(ghenv.Component.InstanceGuid)
robot_key = "robot_" + guid

if robot_key not in st:
    st[robot_key] = None

#load robot model from urdf
if load:
    model = RobotModel.from_urdf_file(urdf_filename)
    model.load_geometry(*loaders)
    artist = RobotArtist(model)
    semantics = RobotSemantics.from_srdf_file(srdf_filename, model)
    robot = Robot(model, artist, semantics, client=None)

    st[robot_key] = robot
robot = st[robot_key]

#vizualize robot in the right scale of your environment
robot.scale(scale_factor)
# ---------- end load_model ----------

set_2 = PythonScript(robot=load_model, ros_client=ros.ros_client, abb_client=abb.abb_client)  # -> out, robot, main_group_name
# ---------- set_2: Python ----------
if robot and ros_client and abb_client:
    robot.ros_client = ros_client
    robot.abb_client = abb_client

    robot.info()
    main_group_name = robot.main_group_name
    print robot.info
# ---------- end set_2 ----------

robot_info = Panel(set_2.out)

attach_remove_2 = PythonScript(robot=load_model, tool=tools_2.tool, attach=add_2, remove=remove_2)  # -> bang
# ---------- attach_remove_2: Python ----------
if attach:
    robot.attach_tool(tool)

if remove:
    robot.detach_tool()
# ---------- end attach_remove_2 ----------

# ----
# 3>
tasks = GhPythonScript(create=Toggle(True), robot=set_2.robot, pick_plane=pick_up, speed=tcp_speed, place_planes=place_planes)  # -> tasks; inputs pick_plane: Plane, place_planes: list of Plane
# ---------- tasks: Python ----------
import time
from scriptcontext import sticky as st
from fabrication_manager.task import Task
from climate_active_envelopes_fabrication.tasks import StartConfigurationTask, SetToolTask, PickBrickTask, PlaceBrickTask, SafePositionTask
import abb_fabrication_control as ffc
import compas_rrc as rrc

if create:
    tasks = []
    cart = configuration.joint_values[0]

    # Go to safety configuration
    #task = StartConfigurationTask(robot, configuration)
#    task = SafePositionTask(robot, cart, configuration, key=len(tasks))
#    task.parallelizable = False
#    tasks.append(task)

    for i in range(len(place_planes)):
        print i
        # Set tool
        task = SetToolTask(robot, tool_name='t_gripper_125', key=len(tasks))
        task.parallelizable = False
        tasks.append(task)

        # Pick up bricks
        pick_frame = ffc.utilities.plane_to_frame(pick_plane)
        #print pick_frame
        task = PickBrickTask(robot, cart, configuration, pick_frame=pick_frame, key=len(tasks))
        task.parallelizable = False
        tasks.append(task)

    # Place bricks
        place_frame = ffc.utilities.plane_to_frame(place_planes[i])
        print place_frame
        task = PlaceBrickTask(robot, cart, configuration, place_frame, key=len(tasks))
        task.parallelizable = False
        tasks.append(task)

#        # Go to safety configuration
#        task = StartConfigurationTask(robot, configuration)
#        task.parallelizable = False
#        tasks.append(task)
# ---------- end tasks ----------
start_fabrication = Button()
stop_fabrication = Button()
set_tasks = Button()
reset_3 = Button()
next = Button()
last = Button()
init = Button()
fabricationmanager = PythonScript(
    tasks=tasks,
    init=init,
    parallelize=Toggle(False),
    set_tasks=set_tasks,
    start=start_fabrication,
    stop=stop_fabrication,
    reset_task=reset_3,
    next_task=next,
    prev_task=last)  # -> out, server; inputs tasks: list
# ---------- fabricationmanager: Python ----------
from scriptcontext import sticky as st
from fabrication_manager.fabrication import FabricationManager

if init:
    fabrication = FabricationManager()
    fabrication.parallelize = parallelize
    st["fabrication"] = fabrication

fabrication = st["fabrication"]

if set_tasks:
    print "setting tasks"    
    fabrication.clear_tasks()
    fabrication.set_tasks(tasks)

if start:
    #if robot.is_connected(): #and arduino.is_connected():
    print "starting process"
    fabrication.start()

if stop:
    print "stopping process"
    fabrication.stop()
    
if reset_task:
    print "resetting process"
    fabrication.reset()

if next_task:
    t = fabrication.get_next_task()
    task_state_set(True, t)
    
if reset_task:
    t = fabrication.get_next_task()
    task_state_set(False, t)

if prev_task:
    t = fabrication.get_next_task()
    task_state_set(False, t)
    t = fabrication.tasks[fabrication.current_task_key-1]
    task_state_set(False, t)
    fabrication.get_next_task()

def task_state_set(state, t):
    t.is_completed = state
    t.is_running = False
# ---------- end fabricationmanager ----------
data_recorder_2 = DataRecorder(fabricationmanager.out, DataLimit=-10, RecordData=True)
out_2 = Panel(data_recorder_2)

# ----
# Move Joints
tcp_speed_6 = Slider(250, range=0..1000)
movej_command = GhPythonScript(robot=set_2.robot, speed=tcp_speed_6, move_to_joints=to_joints_2, move_single_joints=to_single_joints_2)  # -> out; inputs move_to_joints: Boolean
# ---------- movej_command: Python ----------
import abb_fabrication_control as ffc
import compas_rrc as rrc


from compas.geometry import Scale
from compas.robots import Joint
import math



# Print text on FlexPenant
# robot.abb_client.send(rrc.PrintText('Welcome TUM to COMPAS_RRC! ;)'))

#print configuration

if move_to_joints:
    #ffc.commands.move_to_joints(robot, configuration, speed=speed, zone=rrc.Zone.FINE)
    ffc.commands.move_to_joints_2(robot, configuration, speed=speed, zone=rrc.Zone.FINE)


#ext_axes = rrc.ExternalAxes.from_configuration(configuration) #store all robot values from configuration
#cart = rrc.ExternalAxes(ext_axes.values[0]) #store cart values from robot values
#joints = rrc.RobotJoints(ext_axes.values[1:]) #store joint values from robot values
#robot.abb_client.send(rrc.MoveToJoints(joints, cart, speed, zone)) #send move to joints command



#joint_goal = movejoints.get_current_joint_values()
#print joint_goal


if move_single_joints:
    pass
    # TODO
# ---------- end movej_command ----------
data_recorder_3 = DataRecorder(movej_command, DataLimit=-10, RecordData=True)
out_3 = Panel(data_recorder_3)

# ----
# Move Cartesian from List
to_frames = Button()
to_robtargets = Button()
movel_command_2 = GhPythonScript(robot=set_2.robot, speed=tcp_speed_4, move_to_frames=to_frames, move_to_robtargets=to_robtargets, set_tool=set_tool_4)  # -> out; inputs target_planes: list of Plane, move_to_frames: Boolean, move_to_robtargets: Boolean
# ---------- movel_command_2: Python ----------
import compas_rrc as rrc
import abb_fabrication_control as ffc
from compas.geometry import Frame

#set tool in RobotStudio
if set_tool:
    if robot.attached_tool:
        tool_name = robot.attached_tool.name
        done = robot.abb_client.send(rrc.SetTool(tool_name))
        print tool_name
    else:
        robot.abb_client.send(rrc.SetTool("tool0"))

if move_to_frames:
    #transform target plane into target frame
    
    for i, target_plane in enumerate(target_planes):
        if i < len(target_planes)-1:
            zone = rrc.Zone.Z50
        else:
            zone = rrc.Zone.FINE
        print zone
        target_frame = Frame(target_plane.Origin, target_plane.XAxis, target_plane.YAxis)
        #send move to frame command
        ffc.commands.move_to_frame(robot, target_frame, speed=speed, zone=zone, scalefactor=1000)


if move_to_robtargets:
    for i, target_plane in enumerate(target_planes):
        if i < len(target_planes)-1:
            zone = rrc.Zone.Z50
        else:
            zone = rrc.Zone.FINE
        print zone
        #transform target plane into target frame
        target_frame = Frame(target_plane.Origin, target_plane.XAxis, target_plane.YAxis)
        #store cart value from configuration
        cart = (configuration.joint_values[0])
        #send move to robtarget command
        ffc.commands.move_to_robtarget(robot, target_frame, cart, speed=speed, zone=zone, scalefactor=1000)
# ---------- end movel_command_2 ----------
data_recorder_4 = DataRecorder(movel_command_2, DataLimit=-10, RecordData=True)
out_4 = Panel(data_recorder_4)

# ----
# Move Cartesian
movel_command_3 = GhPythonScript(
    robot=set_2.robot,
    speed=tcp_speed_5,
    target_plane=plane_4,
    move_to_frame=to_frame_2,
    move_to_robtarget=to_robtarget_2,
    set_tool=set_tool_3)  # -> out; inputs target_plane: Plane, move_to_frame: Boolean, move_to_robtarget: Boolean
# ---------- movel_command_3: Python ----------
import compas_rrc as rrc
import abb_fabrication_control as ffc
from compas.geometry import Frame

#set tool in RobotStudio
if set_tool:
    if robot.attached_tool:
        tool_name = robot.attached_tool.name
        print tool_name
        done = robot.abb_client.send(rrc.SetTool(tool_name))
        print done
    else:
        robot.abb_client.send(rrc.SetTool("tool0"))

if move_to_frame:
    #transform target plane into target frame
    target_frame = Frame(target_plane.Origin, target_plane.XAxis, target_plane.YAxis)
    #send move to frame command
    ffc.commands.move_to_frame(robot, target_frame, speed=speed, zone=rrc.Zone.FINE, scalefactor=1000)

if move_to_robtarget:
    #transform target plane into target frame
    target_frame = Frame(target_plane.Origin, target_plane.XAxis, target_plane.YAxis)
    #store cart value from configuration
    cart = (configuration.joint_values[0])
    #send move to robtarget command
    ffc.commands.move_to_robtarget(robot, target_frame, cart, speed=speed, zone=rrc.Zone.FINE, scalefactor=1000)
# ---------- end movel_command_3 ----------
data_recorder_5 = DataRecorder(movel_command_3, DataLimit=-10, RecordData=True)
out_5 = Panel(data_recorder_5)

# ----
# Get Robot Configurations
get_joints_2 = GhPythonScript(robot=set_2.robot, get_frame=get_frame, get_robtarget=get_robtarget, get_joints=get_joints)  # -> joint, current_plane
# ---------- get_joints_2: Python ----------
from compas_ghpython.artists import FrameArtist
from scriptcontext import sticky as st
import fabtory_fabrication_control as ffc
import os

# store robot in component
guid = str(ghenv.Component.InstanceGuid)
current_frame_key = "current_frame_" + guid
current_robtarget_key = "current_robtarget_" + guid
current_configuration_key = "current_configuration_" + guid

if current_frame_key not in st:
    st[current_frame_key] = None

if current_robtarget_key not in st:
    st[current_robtarget_key] = None

if current_configuration_key not in st:
    st[current_configuration_key] = None


#get commands
if get_frame:
    current_frame = ffc.feedback.get_frame(robot, scalefactor=0.001)
    st[current_frame_key] = current_frame

if get_robtarget:
    current_robtarget = ffc.feedback.get_robtarget(robot, scalefactor=0.001)
    print current_robtarget
    st[current_robtarget_key] = current_robtarget


if get_joints:
    current_configuration = ffc.feedback.get_joints(robot)
    st[current_configuration_key] = current_configuration
    print current_configuration

# sticky
if st[current_frame_key]:
    current_frame = st[current_frame_key]
    artist = FrameArtist(current_frame)
    current_plane = artist.draw()

if st[current_robtarget_key]:
    current_robtarget = st[current_robtarget_key]

if st[current_configuration_key]:
    current_configuration = st[current_configuration_key]
    print current_configuration
# ---------- end get_joints_2 ----------
data_recorder_6 = DataRecorder(get_joints_2.joint, DataLimit=-10, RecordData=True)
draw_12 = GhPythonScript(plane=get_joints_2.current_plane, scale=Slider(0.2, range=0..1))  # -> P, V, C, W; inputs plane: Plane
# ---------- draw_12: Python ----------
from System.Drawing import Color
from compas_ghpython.artists import FrameArtist

red = Color.FromArgb(255, 0, 0)
green = Color.FromArgb(0, 255, 0)
blue = Color.FromArgb(0, 0, 255)

P = []
V = []
C = []

scale = float(scale)


if plane:
    P += [plane.Origin] * 3
    V.append(plane.XAxis * scale)
    V.append(plane.YAxis * scale)
    V.append(plane.ZAxis * scale)
    C += [red, green, blue]
    
    W = 3
# ---------- end draw_12 ----------
joint_values = Panel(data_recorder_6)
vdisex_10 = VectorDisplayEx(Point=draw_12.P, Vector=draw_12.V, Colour=draw_12.C, Width=draw_12.W)

# ----
# Digital Output
send_digital_signal = GhPythonScript(robot=set_2.robot, close_gripper=Button(), open_gripper=Button(), extruding_mortar=Button())  # -> out
# ---------- send_digital_signal: Python ----------
import fabtory_fabrication_control as ffc


if close_gripper:
    #robot.abb_client.send(rrc.SetDigital('Ausgang_100_0', 1))
    #robot.abb_client.send(rrc.WaitTime(2))
    #robot.abb_client.send(rrc.SetDigital('Ausgang_100_0', 0))
    #robot.abb_client.send(rrc.PrintText('Finished I/O'))

    ffc.commands.close(robot)
    print ('gripper is closed')

if open_gripper:
    ffc.commands.open(robot)
    print ('gripper is open')

if extruding_mortar:
    ffc.commands.extrude(robot)
    print ('is extruding')
# ---------- end send_digital_signal ----------
data_recorder_7 = DataRecorder(send_digital_signal, DataLimit=-10, RecordData=True)
out_6 = Panel(data_recorder_7)

# ----
# Move Joints from List
tcp_speed_7 = Slider(250, range=0..1000)
to_joints_3 = Button()

movej_command_2 = Python3Script(robot=set.robot, configurations=jp_2, speed=tcp_speed_7, move_to_joints=to_joints_3)  # -> out
# ---------- movej_command_2: Python ----------
import abb_fabrication_control as ffc
import compas_rrc as rrc


if move_to_joints:
    for configuration in configurations:
        ffc.commands.move_to_joints_2(robot, configuration, speed=speed, zone=rrc.Zone.Z200)
# ---------- end movej_command_2 ----------

data_recorder_8 = DataRecorder(movej_command_2, DataLimit=-10, RecordData=True)
out_7 = Panel(data_recorder_8)

# ----
# Move Joints
tcp_speed_8 = Slider(250, range=0..1000)

movej_command_3 = Python3Script(
    robot=set.robot,
    configuration=filter_4,
    speed=tcp_speed_8,
    move_to_joints=to_joints,
    move_single_joints=to_single_joints)  # -> out
# ---------- movej_command_3: Python ----------
import abb_fabrication_control as ffc
import compas_rrc as rrc


from compas.geometry import Scale
from compas_robots.model import Joint
import math



# Print text on FlexPenant
# robot.abb_client.send(rrc.PrintText('Welcome TUM to COMPAS_RRC! ;)'))

#print configuration

if move_to_joints:
    #ffc.commands.move_to_joints(robot, configuration, speed=speed, zone=rrc.Zone.FINE)
    ffc.commands.move_to_joints_2(robot, configuration, speed=speed, zone=rrc.Zone.FINE)


#ext_axes = rrc.ExternalAxes.from_configuration(configuration) #store all robot values from configuration
#cart = rrc.ExternalAxes(ext_axes.values[0]) #store cart values from robot values
#joints = rrc.RobotJoints(ext_axes.values[1:]) #store joint values from robot values
#robot.abb_client.send(rrc.MoveToJoints(joints, cart, speed, zone)) #send move to joints command



#joint_goal = movejoints.get_current_joint_values()
#print joint_goal


if move_single_joints:
    pass
    # TODO
# ---------- end movej_command_3 ----------

data_recorder_9 = DataRecorder(movej_command_3, DataLimit=-10, RecordData=True)
out_8 = Panel(data_recorder_9)

# ----
# Move Cartesian from List
to_frames_2 = Button()
to_robtargets_2 = Button()

movel_command_4 = Python3Script(
    robot=set.robot,
    configuration=filter_4,
    speed=tcp_speed_3,
    move_to_frames=to_frames_2,
    move_to_robtargets=to_robtargets_2,
    set_tool=set_tool_2)  # -> out
# ---------- movel_command_4: Python ----------
import compas_rrc as rrc
import abb_fabrication_control as ffc
from compas.geometry import Frame

#set tool in RobotStudio
if set_tool:
    if robot.attached_tool:
        tool_name = robot.attached_tool.name
        done = robot.abb_client.send(rrc.SetTool(tool_name))
        print (tool_name)
    else:
        robot.abb_client.send(rrc.SetTool("tool0"))

if move_to_frames:
    #transform target plane into target frame
    
    for i, target_plane in enumerate(target_planes):
        if i < len(target_planes)-1:
            zone = rrc.Zone.Z50
        else:
            zone = rrc.Zone.FINE
        print (zone)
        target_frame = Frame(target_plane.Origin, target_plane.XAxis, target_plane.YAxis)
        #send move to frame command
        ffc.commands.move_to_frame(robot, target_frame, speed=speed, zone=zone, scalefactor=1000)


if move_to_robtargets:
    for i, target_plane in enumerate(target_planes):
        if i < len(target_planes)-1:
            zone = rrc.Zone.Z50
        else:
            zone = rrc.Zone.FINE
        print (zone)
        #transform target plane into target frame
        target_frame = Frame(target_plane.Origin, target_plane.XAxis, target_plane.YAxis)
        #store cart value from configuration
        cart = (configuration.joint_values[0])
        #send move to robtarget command
        ffc.commands.move_to_robtarget(robot, target_frame, cart, speed=speed, zone=zone, scalefactor=1000)
# ---------- end movel_command_4 ----------

data_recorder_10 = DataRecorder(movel_command_4, DataLimit=-10, RecordData=True)
out_9 = Panel(data_recorder_10)
