# Grasshopper definition climate_simulation.ghx (Grasshopper 1.0.8)

number_slider = Slider(45, range=0..360)

# ----
# Analysis Period
analysisperiod = LBAnalysisPeriod(
    start_month=Slider(6, range=0..10),
    start_day=Slider(1, range=0..10),
    start_hour=Slider(11, range=0..100),
    end_month=Slider(8, range=0..10),
    end_day=Slider(31, range=0..100),
    end_hour=Slider(16, range=0..100))  # -> period, hoys, dates; plug-in component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

# ----
# Sun Path
number_slider_2 = Slider(0.4, range=0..10)
epw_file = FilePath("C:\Users\julia\workspace\climate_active_envelopes\rhino\DEU_BY_Munich-Theresienwiese.108650_TMYx.epw")
pt = Point(Point(13.26772139, -0.4026879976, 0))
sun_path = SunPath(
    north=number_slider,
    hoys=analysisperiod.hoys,
    center_pt=pt,
    scale=number_slider_2,
    epw_file=epw_file,
    daily=Toggle(False))  # -> vectors, location, direct_normal_rad, diffuse_horizontal_rad, M, compass, analemma
preview = CustomPreview(Geometry=sun_path.M, Material=ColourSwatch(SwatchColor=RGB(255, 255, 0)))
preview_2 = CustomPreview(Geometry=sun_path.compass, Material=ColourSwatch(SwatchColor=RGB(0, 0, 0)))
preview_3 = CustomPreview(Geometry=sun_path.analemma, Material=ColourSwatch(SwatchColor=RGB(41, 41, 41)))

# ----
# Sun hours simulation
toggle = BooleanToggle(True)
to_brep = Python3Script(convert=toggle)  # -> current_brep; inputs current_mesh: Mesh, input_surface: Brep
# ---------- to_brep: Python ----------
import Rhino.Geometry as rg


if convert:

    if input_type == "reference_model":
        current_brep = rg.Brep.CreateFromMesh(current_mesh, True)

    if input_type == "mesh":
        current_brep = input_surface
    # Convert the mesh to a Brep
# ---------- end to_brep ----------
number_slider_3 = Slider(0.04, range=0..0.1)
context_input = Brep(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)
run = BooleanToggle(True)
direct_sun_hours = DirectSunHours(vectors=sun_path.vectors, geometry=to_brep, context=context_input, grid_size=number_slider_3, run=run)  # -> points, results, mesh, legend
geo = Geometry(direct_sun_hours.legend)
panel = Panel(direct_sun_hours.legend)

visualize = Python3Script(show=Toggle(True), mesh=direct_sun_hours.mesh)  # -> out, M
# ---------- visualize: Python ----------
if show == True:
    M = mesh
# ---------- end visualize ----------
mesh = Mesh(visualize.M)

run_2 = BooleanToggle(True)
insulated_bricks = Geometry([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])
full_bricks = Geometry([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])
py3 = Python3Script(bricks=full_bricks, run=run_2)  # -> out, brick_geo, geometry; inputs bricks: list of Mesh
# ---------- py3: Python ----------
if run == False:
    brick_geo = bricks
else:
    _geometry = bricks
# ---------- end py3 ----------
preview_4 = CustomPreview(Geometry=py3.brick_geo, Material=ColourSwatch(SwatchColor=RGB(196, 141, 141)))

preview_5 = CustomPreview(Geometry=insulated_bricks, Material=ColourSwatch(SwatchColor=RGB(196, 141, 141)))

# ----
# Solar Radiation Simulation
number_slider_4 = Slider(1, range=0..1)
cluster = Cluster(
    M=py3.geometry,
    north=number_slider,
    location=sun_path.location,
    direct_rad=sun_path.direct_normal_rad,
    diffuse_rad=sun_path.diffuse_horizontal_rad,
    hoys=analysisperiod.hoys)  # -> M_2, sky_mtx
cluster_2 = Cluster_2(sky_mtx=cluster.sky_mtx, geometry=cluster.M_2, context=context_input, grid_size=number_slider_4, run=Toggle(True))  # -> mesh, legend
brick_wall = Mesh(cluster_2.mesh)
geo_2 = Geometry(cluster_2.legend)

# ----
# Sun hours Simulation
number_slider_5 = Slider(0, range=0..100)  # disabled
number_slider_6 = Slider(0.1, range=0..0.1)  # disabled
number_slider_7 = Slider(0.07, range=0..0.1)  # disabled
colrange = LBColorRange(index=number_slider_5)  # -> colors; disabled; plug-in component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
legendpar = LBLegendParameters(colors=colrange, seg_height=number_slider_6, seg_width=number_slider_6, text_height=number_slider_7)  # -> leg_par; disabled; plug-in component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
boolean_toggle = BooleanToggle(True)  # disabled
directsunhours = LBDirectSunHours(
    vectors=flatten(sun_path.vectors),
    geometry=flatten(cluster.M_2),
    context=flatten(context_input),
    grid_size=number_slider_3,
    legend_par=legendpar,
    run=boolean_toggle)  # -> report, points, results, mesh, legend, title, int_mtx; disabled; plug-in component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
mesh_2 = Mesh(directsunhours.mesh)  # disabled

# ==== cluster DirectSunHours
number_slider = Slider(0.1, range=0..0.1)
colrange = LBColorRange(index=Slider(5, range=0..10))  # -> colors; plug-in component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
legendpar = LBLegendParameters(colors=colrange, seg_height=number_slider, seg_width=number_slider, text_height=Slider(0.07, range=0..0.1))  # -> leg_par; plug-in component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
vectors = ClusterInput()
geometry = ClusterInput()
context = ClusterInput()
grid_size = ClusterInput()
run = ClusterInput()
directsunhours = LBDirectSunHours(
    vectors=flatten(vectors),
    geometry=flatten(geometry),
    context=flatten(context),
    grid_size=grid_size,
    legend_par=legendpar,
    run=run)  # -> report, points, results, mesh, legend, title, int_mtx; plug-in component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
points = ClusterOutput(directsunhours.points)
results = ClusterOutput(directsunhours.results)
mesh = ClusterOutput(directsunhours.mesh)
legend = ClusterOutput(directsunhours.legend)

# ==== cluster SunPath
epw_file = ClusterInput()
importepw = LBImportEPW(epw_file=epw_file)  # -> location, dry_bulb_temperature, dew_point_temperature, relative_humidity, wind_speed, wind_direction, direct_normal_rad, diffuse_horizontal_rad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; plug-in component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
diffuse_horizontal_rad = ClusterOutput(importepw.diffuse_horizontal_rad)
direct_normal_rad = ClusterOutput(importepw.direct_normal_rad)
location = ClusterOutput(importepw.location)
center_pt = ClusterInput()
scale = ClusterInput()
daily = ClusterInput()
north = ClusterInput()
hoys = ClusterInput()
sunpath = LBSunPath(north=north, location=importepw.location, hoys=hoys, center_pt=center_pt, scale=scale, daily=daily)  # -> report, vectors, altitudes, azimuths, hoys, sun_pts, analemma, daily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; plug-in component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
vectors = ClusterOutput(sunpath.vectors)
preview = CustomPreview(Geometry=[sunpath.analemma, sunpath.daily, sunpath.legend], Material=ColourSwatch(SwatchColor=RGB(41, 41, 41)))
analemma = ClusterOutput([sunpath.analemma, sunpath.daily, sunpath.legend])
msphere = MeshSphere(Base=sunpath.sun_pts, Radius="0.15", UCount=10, VCount=20)
compass = ClusterOutput(sunpath.compass)
multiplication = Multiplication(A=scale, B="100")
preview_2 = CustomPreview(Geometry=msphere, Material=ColourSwatch(SwatchColor=RGB(255, 255, 0)))
preview_3 = CustomPreview(Geometry=sunpath.compass, Material=ColourSwatch(SwatchColor=RGB(0, 0, 0)))
M = ClusterOutput(msphere)
line = LineSDL(Start=sunpath.sun_pts, Direction=sunpath.vectors, Length=multiplication)

# ==== cluster Cluster
M = ClusterInput()
north = ClusterInput()
location = ClusterInput()
direct_rad = ClusterInput()
diffuse_rad = ClusterInput()
hoys = ClusterInput()
weldvertices = MeshWeldVertices(Mesh=M, Tolerance=0.01)  # -> RuntimeMessage, Mesh
skymatrix = LBCumulativeSkyMatrix(north=north, location=location, direct_rad=direct_rad, diffuse_rad=diffuse_rad, hoys=hoys)  # -> report, sky_mtx; plug-in component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
sky_mtx = ClusterOutput(skymatrix.sky_mtx)
unifynormals = MeshUnifyNormals(Mesh=weldvertices.Mesh)
M_2 = ClusterOutput(unifynormals)
facen = FaceNormals(Mesh=unifynormals)  # -> Centers, Normals; disabled
vdis = VectorDisplay(Anchor=facen.Centers, Vector=facen.Normals)  # disabled

# ==== cluster Cluster_2
sky_mtx = ClusterInput()
geometry = ClusterInput()
context = ClusterInput()
grid_size = ClusterInput()
run = ClusterInput()
number_slider = Slider(0.1, range=0..0.1)
legendpar = LBLegendParameters(seg_height=number_slider, seg_width=number_slider, text_height=Slider(0.06, range=0..0.1))  # -> leg_par; plug-in component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
incidentradiation = LBIncidentRadiation(
    sky_mtx=sky_mtx,
    geometry=flatten(geometry),
    context=flatten(context),
    grid_size=grid_size,
    legend_par=legendpar,
    run=run)  # -> report, points, results, total, mesh, legend, title, int_mtx; plug-in component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
mesh = ClusterOutput(incidentradiation.mesh)
legend = ClusterOutput(incidentradiation.legend)
