# Grasshopper definition 231219_CAE_reference_model.ghx (Grasshopper 1.0.7)

brick = GhPythonScript()  # -> full_brick, insulated_brick
# ---------- brick: Python ----------
import os
from climate_active_envelopes.assembly import Brick
from compas.datastructures import Mesh

#full_brick
length, width, height = 0.24, 0.115, 0.075
full_brick = Brick.from_dimensions(length, width, height)
print full_brick


#insulated_brick
package_path = ghdoc.Path
data_path = os.path.abspath(os.path.join(package_path,"../../../climate_active_envelopes/data/brick_types"))
filename = 'insulated_brick.stl'

insulated_brick_mesh = Mesh.from_stl(os.path.join(data_path, filename))
insulated_brick = Brick.from_mesh_and_frame(insulated_brick_mesh)
print insulated_brick
# ---------- end brick ----------
draw_brick = GhPythonScript(full_brick=brick.full_brick, insulated_brick=brick.insulated_brick, show_all=Toggle(False))  # -> M, F
# ---------- draw_brick: Python ----------
from compas_ghpython.artists import MeshArtist
from compas_ghpython import draw_frame

if show_all:
    artist = MeshArtist(full_brick.mesh)
    M = [artist.draw_mesh()]
    #F = [draw_frame(full_brick.frame)]
    F = [draw_frame(full_brick.tool_frame)]



    artist = MeshArtist(insulated_brick.mesh)
    M += [artist.draw_mesh()]
    F += [draw_frame(insulated_brick.tool_frame)]
# ---------- end draw_brick ----------
mesh = Mesh(draw_brick.M)
pln = Plane(draw_brick.F)

width = Slider(0.62, range=0.2..10)
init = Button()
box = GhPythonScript(init=init, length=Slider(0.9, range=0.4..10), height=Slider(1.3, range=0.2..10), width=width)  # -> box
# ---------- box: Python ----------
from climate_active_envelopes.assembly import ReferenceElement 
from compas.datastructures import VolMesh, CellNetwork, Mesh
from compas.geometry import Box, Frame
from compas.artists import MeshArtist, Artist


box = Box(length, height, width)
# ---------- end box ----------
cellnetwork = GhPythonScript(box=box)  # -> cellnetwork
# ---------- cellnetwork: Python ----------
from compas.datastructures import CellNetwork, Mesh
from compas.geometry import Box

cellnetwork = CellNetwork()

vertices = box.vertices
[cellnetwork.add_vertex(x=x, y=y, z=z) for x, y, z in vertices]

faces = box.faces
fkeys = [cellnetwork.add_face(fverts) for fverts in faces]

cells = [fkeys]
[cellnetwork.add_cell(fkeys) for fkeys in cells]



#key = 4
#
#for key in cellnetwork.faces(data=False):
#    face_vertices = cellnetwork.face_vertices(key)
#    faces = cellnetwork.faces(key)
# ---------- end cellnetwork ----------

panel = Panel("Reload libraries")
bang = Button()
unload = PythonScript(reload=bang)
# ---------- unload: Python ----------
from compas_ghpython import unload_modules

if reload:
    unload_modules('climate_active_envelopes')
    unload_modules('assembly_information_model')
# ---------- end unload ----------
py = PythonScript()  # -> HERE, DATA
# ---------- py: Python ----------
import os

HERE = os.path.dirname(ghdoc.Path)
DATA = os.path.abspath(os.path.join(HERE, "..", "data"))

print(HERE)
print(DATA)
# ---------- end py ----------

toggle = BooleanToggle(False)  # disabled
brick_2 = GhPythonScript()  # -> full_brick, insulated_brick; disabled; same code as brick
draw_brick_2 = GhPythonScript(full_brick=brick_2.full_brick, insulated_brick=brick_2.insulated_brick, show_all=toggle)  # -> M, F; disabled; same code as draw_brick
mesh_2 = Mesh(draw_brick_2.M)  # disabled
pln_2 = Plane(draw_brick_2.F)  # disabled

width_2 = Slider(0.62, range=0.2..10)  # disabled
number_slider = Slider(3, range=0.4..10)  # disabled
number_slider_2 = Slider(2.5, range=0.2..10)  # disabled
panel_2 = Panel("flemish_bond")  # disabled
init_2 = Button()  # disabled
pln_3 = Plane(PlaneXY(0, 0, 0))  # disabled
cell = GhPythonScript(init=init_2, plane=pln_3, length=number_slider, height=number_slider_2, depth=width_2, bond_type=panel_2)  # -> cell; inputs plane: Plane; disabled
# ---------- cell: Python ----------
from climate_active_envelopes.assembly import ReferenceElement
from compas.datastructures import VolMesh, CellNetwork, Mesh
from compas.geometry import Box, Frame
from compas.artists import MeshArtist, Artist

# base element composed of length, height and depth
frame = Frame(plane.Origin, plane.XAxis, plane.YAxis)
full_element = ReferenceElement.from_dimensions(frame, length, height, depth, bond_type)
print full_element
# ---------- end cell ----------

key = Slider(1, range=0..5)
brick_assembly = GhPythonScript(
    cellnetwork=cellnetwork,
    key=key,
    generate_edges=Toggle(False),
    generate_surface=Toggle(True),
    full_brick=brick.full_brick,
    insulated_brick=brick.insulated_brick)  # -> out, polygon, brick_assembly
# ---------- brick_assembly: Python ----------
from compas.datastructures import Mesh
from assembly_information_model.assembly import Assembly
from compas.geometry import Translation, distance_point_point


assembly = Assembly() #create assembly

# Get key face and its edges
key_face = Mesh()
polygon = cellnetwork.face_polygon(key)

frame = polygon.frame #get frame of polygon
brick_length = 0.240
brick_height = 0.115
brick_width = 0.072
mortar_joint_height = 0.011 

# needs to be changed!
v1, v2 = polygon[0], polygon[1]
polygon_length = distance_point_point(v1, v2)
polygon_height = 1.3

courses = int(polygon_height / (brick_height + mortar_joint_height/2)) #number of courses
bricks_per_course = int(polygon_length / ((brick_length + brick_width)/2 + mortar_joint_height)) #number of bricks per course     

for course in range(courses): #loop over courses
    z_val = course * (brick_height + mortar_joint_height) 
    course_is_odd = course%2 == 0 #check if course is odd or even

    for brick in range(bricks_per_course): #loop over bricks in course
        x_val = brick * ((brick_length + brick_width)/2 + mortar_joint_height) 
        T = Translation.from_vector(frame.xaxis * x_val + frame.zaxis * z_val)
        current_frame = frame.transformed(T)
        brick_in_course_is_odd = brick%2 == 0
        brick_in_course_is_even = brick%2 == 1                

        T1 = Translation.from_vector(current_frame.yaxis *+ (brick_width/2))
        T2 = Translation.from_vector(current_frame.xaxis *+ (brick_width - mortar_joint_height*2 + mortar_joint_height/2))
        current_frame = current_frame.transformed(T1*T2) 


















for edge in list(cellnetwork.edges()):
    if cellnetwork.vertex_coordinates(edge[0])[2] != cellnetwork.vertex_coordinates(edge[1])[2]:
        cellnetwork.edge_attribute(edge, 'is_vertical', True)
    else:
        cellnetwork.edge_attribute(edge, 'is_horizontal', True)

edges = cellnetwork.edges(True)


#face_vertices = cellnetwork.face_vertices(key)
#print face_vertices

#edges = cellnetwork.edges(key)
#print edges

#polygon = cellnetwork.face_polygon(key)
#print polygon

#face_neighbors = cellnetwork.face_neighbors(key)
#print face_neighbors
# ---------- end brick_assembly ----------

key_2 = Slider(1, range=0..5)
select_face = GhPythonScript(cellnetwork=cellnetwork, key=key_2, generate_key_edges=Toggle(True), generate_key_surface=Toggle(True))  # -> out, edges, draw_key_face, draw_key_edges
# ---------- select_face: Python ----------
from compas.datastructures import Mesh
from compas_ghpython.artists import MeshArtist

# Get key face and its edges
key_face = Mesh()
polygon = cellnetwork.face_polygon(key)

if generate_key_surface:
    draw_key_face = MeshArtist(polygon.to_mesh()).draw()
if generate_key_edges:
    draw_key_edges = MeshArtist(polygon.to_mesh()).draw_edges()

for edge in list(cellnetwork.edges()):
    if cellnetwork.vertex_coordinates(edge[0])[2] != cellnetwork.vertex_coordinates(edge[1])[2]:
        cellnetwork.edge_attribute(edge, 'is_vertical', True)
    else:
        cellnetwork.edge_attribute(edge, 'is_horizontal', True)

edges = cellnetwork.edges(True)





#face_vertices = cellnetwork.face_vertices(key)
#print face_vertices

#edges = cellnetwork.edges(key)
#print edges

#polygon = cellnetwork.face_polygon(key)
#print polygon

#face_neighbors = cellnetwork.face_neighbors(key)
#print face_neighbors
# ---------- end select_face ----------
python = GhPythonScript()  # -> out, vertical_edges
# ---------- python: Python ----------
print list(cellnetwork.edges(True))
print list(cellnetwork.edges_where({'is_vertical': False}))

vertical_edges = [edge for edge in cellnetwork.edges() if cellnetwork.edge_attribute(edge, 'is_vertical')]
print vertical_edges
# ---------- end python ----------
mesh_3 = Mesh(select_face.draw_key_face)
line = Line(select_face.draw_key_edges)

panel_3 = Panel("0.08")  # disabled
panel_4 = Panel("0.250")  # disabled
pt = Point(Point(0, 0, -0.3140686649))  # disabled
pt_2 = Point(Point(0, 0, 0.3097182806))  # disabled
grid = GhPythonScript(mesh=select_face.draw_key_face, interval=panel_3, bricklen=panel_4, pt_base=pt, pt_end=pt_2)  # -> out, planes, plane_grid; inputs mesh: Mesh, pt_base: Point3d, pt_end: Point3d; disabled
# ---------- grid: Python ----------
import Rhino.Geometry as rg
import math as m




#for key in cellnetwork.faces():
#    face_vertices = cellnetwork.face_vertices(key)
#
#print face_vertices

def create_planegrid(brep, pt_base, pt_end, interval, bricklen):

    curves =rg.Mesh.CreateContourCurves(mesh, pt_base,  pt_end, interval)
    print curves
    
    print(curves[0])
    clen = curves[0].GetLength()
    cols = int(clen/(bricklen+0.020))*2
    print cols
    
    plane_grid = []
    
    
    
    for j, c in enumerate(curves):
        row = []
        vparams = rg.Curve.DivideByCount(c, cols, True)
        planes = rg.Curve.GetPerpendicularFrames(c, vparams)

        for i, plane in enumerate(planes):
            plane.Rotate(m.radians(90), plane.YAxis)

            if j%2 == 0 and i%2 == 0: #even course
                if i==0:
                    plane.Translate(plane.XAxis*-bricklen/4)
                    plane.Rotate(m.radians(90), plane.ZAxis)
                elif i==len(planes)-1:
                    plane.Translate(plane.XAxis*bricklen/4)
                    plane.Translate(plane.YAxis*-bricklen/5)
                    plane.Rotate(m.radians(0), plane.ZAxis)
                row.append(plane)
            if j%2 == 1 and i%2 == 1: #odd course
                row.append(plane)
        plane_grid.append(row)
    return plane_grid

def list_from_2darray(array):
    return [item for sublist in array for item in sublist]

plane_grid = create_planegrid(mesh, pt_base, pt_end, interval, bricklen)
planes = list_from_2darray(plane_grid)
# ---------- end grid ----------
generate_assembly = GhPythonScript(plane_grid=grid.plane_grid, elem_full=brick_2.full_brick, elem_ins=brick_2.insulated_brick)  # -> assembly; inputs plane_grid: list; disabled
# ---------- generate_assembly: Python ----------
import Rhino.Geometry as rg
import math
from scriptcontext import sticky as st


from compas.geometry import Frame
from compas.geometry import Transformation
from compas.geometry import Rotation
from compas.geometry import Translation
from compas.geometry import Point


from assembly_information_model.assembly import Assembly

import Rhino.Geometry as rg


assembly = Assembly() # initialize an empty assembly class


for j, row in enumerate(plane_grid):
    for i, plane in enumerate(row):
        new_plane= rg.Plane(plane)

        if j%2==0: #even layers
            new_plane.Rotate(-math.radians(20), plane.ZAxis, plane.Origin)
        else:
            new_plane.Rotate(math.radians(10), plane.ZAxis, plane.Origin)
        T = Transformation.from_frame_to_frame(Frame.worldXY(), Frame(new_plane.Origin, new_plane.XAxis, new_plane.YAxis))

        if j%2==0: #even layers
            if i==0 or i==len(row)-1:
                e = elem_full.transformed(T)
            else:
                e = elem_full.transformed(T)
        else:
            e = elem_full.transformed(T)
        assembly.add_element(e)
# ---------- end generate_assembly ----------
pln_4 = Plane(grid.planes)  # disabled

key_3 = Slider(4, range=0..11)  # disabled
reference_model = GhPythonScript(full_element=cell, key=key_3)  # -> out, reference_model; inputs full_element: list, key: Int32; disabled
# ---------- reference_model: Python ----------
from climate_active_envelopes.assembly import ReferenceModel, ReferenceElement
from compas.datastructures import Network, CellNetwork, Mesh
from compas_ghpython.artists import NetworkArtist, MeshArtist


reference_model = ReferenceModel()

print full_element[0].faces

for element in full_element:
    reference_model.add_element_2(element)








for connection in reference_model.connections(data=False):
    reference_model.add_connection(connection[0], connection[1])
    print reference_model
    print connection



#connectivity = [[0,1], [1,2], [2,3], [3,0]]
#for connection in connectivity:
#    reference_model.add_connection(connection[0], connection[1])
# ---------- end reference_model ----------
draw_cellnetwork = GhPythonScript(reference_model=reference_model.reference_model, key=key_3)  # -> out, nodes, edges, faces; inputs key: Int32; disabled
# ---------- draw_cellnetwork: Python ----------
from compas.datastructures import CellNetwork, Mesh
from compas_ghpython.artists import MeshArtist

connections = list(reference_model.connections(data=False))
connection = connections[key]
print connection

for connection in reference_model.connections(data=False):
    reference_model.add_connection(connection[0], connection[1])



reference_element = reference_model.element_2(key)
print reference_element

elem = reference_model.element_by_face(key)
print(elem)




data = reference_model.cellnetwork.to_data()
cellnetwork = CellNetwork.from_data(data)

# Vizualization of the reference_model as mesh
mesh = Mesh()

for vertexkey, attr in cellnetwork.vertices(True):
    mesh.add_vertex(vertexkey=vertexkey, attr_dict = attr)

for facekey, attr in cellnetwork.faces(True):
    vertices = cellnetwork.face_vertices(facekey)
    mesh.add_face(vertices, facekey = facekey, attr_dict=attr)

edges = MeshArtist(mesh).draw_edges()
nodes = MeshArtist(mesh).draw_vertices()
faces = MeshArtist(mesh).draw_faces()




#print reference_model.number_of_elements()
#print reference_model.cellnetwork.faces()

#for face_key in reference_model.cellnetwork.faces():
    
#faces = list(reference_model.cellnetwork.faces())

#if key < len(faces):
# ---------- end draw_cellnetwork ----------

# ---- group: export to .json
export = Button()
py_2 = PythonScript()  # -> HERE, DATA
# ---------- py_2: Python ----------
import os

HERE = os.path.dirname(ghdoc.Path)
DATA = os.path.abspath(os.path.join(HERE, "..", "data"))
print(HERE)
print(DATA)
# ---------- end py_2 ----------
export_2 = PythonScript(DATA=py_2.DATA, assembly=generate_assembly, export_to_json=export)
# ---------- export_2: Python ----------
import os
from compas.datastructures.mesh import mesh_quads_to_triangles
from compas.datastructures.mesh import mesh_unify_cycles

if export_to_json:
    
    filename = "brickwall.json"
    PATH = os.path.join(DATA, filename)
    
    # the assembly has to be serialized such that it can be called from CPython, True to enable pretty print
    assembly.to_json(PATH, True)
# ---------- end export_2 ----------

# ----
pt_3 = Point(draw_cellnetwork.nodes)  # disabled
line_2 = Line(draw_cellnetwork.edges)  # disabled

# ---- group: Network Artist
show = BooleanToggle(True)  # disabled
number_slider_3 = Slider(0, range=0..47)  # disabled
draw = GhPythonScript(assembly=generate_assembly, show_network=show, key=number_slider_3)  # -> nodes, edges, current_node, current_node_neighbors; inputs key: Int32; disabled
# ---------- draw: Python ----------
import sys, os
import ghpythonlib.components as ghcomp
from compas.datastructures import Network
from compas_ghpython.artists import NetworkArtist
#from compas_rhino.geometry import RhinoLine

import compas_ghpython
import Rhino.Geometry as rg


data = assembly.network.to_data()
network = Network.from_data(data)

print assembly.network.number_of_nodes()

def draw_network(network):
    """Draw a network in Grasshopper.
    """
    points = []
    for key, attr in network.nodes(True):
        points.append({
            'pos': network.node_coordinates(key),
        })

    lines = []
    for (u, v), attr in network.edges(True):
        lines.append({
            'start': network.node_coordinates(u),
            'end': network.node_coordinates(v),
        })

    points_rg = compas_ghpython.draw_points(points)
    lines_rg = compas_ghpython.draw_lines(lines)

    return points_rg, lines_rg

if show_network:
    nodes, edges = draw_network(network)
    
    current_node = {'pos': network.node_coordinates(key), 'radius': 0.03}
    current_node = compas_ghpython.draw_spheres([current_node])
    
    current_node_neighbors_keys = network.neighbors(key)
    current_node_neighbors = [{'pos': network.node_coordinates(key), 'radius': 0.02} for key in current_node_neighbors_keys]
    current_node_neighbors = compas_ghpython.draw_spheres(current_node_neighbors)
# ---------- end draw ----------
pt_4 = Point(draw.nodes)  # disabled
line_3 = Line(draw.edges)  # disabled
brep = Brep(draw.current_node_neighbors)  # disabled
brep_2 = Brep(draw.current_node)  # disabled

# ----
import = Button(ExpressionNormal="True", ExpressionPressed="False")
py_3 = PythonScript()  # -> HERE, DATA; same code as py_2
initial_assembly = GhPythonScript(DATA=py_3.DATA, filename="brickwall_new.json", import_from_json=import)  # -> out, assembly; inputs import_from_json: Boolean
# ---------- initial_assembly: Python ----------
import os
import json
from scriptcontext import sticky
#from climate_active_envelopes_fabrication.assembly import Assembly
from assembly_information_model.assembly import Assembly

assembly = Assembly()

if import_from_json:
    PATH = os.path.join(DATA,"assembly", filename)
    print PATH
    assembly = Assembly.from_json(PATH)
# ---------- end initial_assembly ----------

key_4 = Slider(358, range=0..388)  # disabled
till_key = Button()  # disabled
start = Button()  # disabled
reset = Button()  # disabled
stop = Button()  # disabled
back = Button()  # disabled
step = Button()  # disabled
full = Button()  # disabled
list = ValueList({"20", "50", "100", "500", "1000", "5000"}, selected="1000")  # disabled
counter = CountThroughList(
    assembly=initial_assembly.assembly,
    start=start,
    stop=stop,
    step=step,
    step_back=back,
    reset=reset,
    full=full,
    till_key=till_key,
    key=key_4,
    interval=list)  # -> item, counter; inputs start: Boolean, stop: Boolean, step_back: Boolean, key: Int32; disabled
# ---------- counter: Python ----------
from scriptcontext import sticky as st
from compas_ghpython import update_component


L = list(assembly.elements())
# store data in component
guid = str(ghenv.Component.InstanceGuid)
counter_key = "counter_" + guid
running_key = "running_" + guid

if counter_key not in st:
    st[counter_key] = 0

if running_key not in st:
    st[running_key] = False
    

if st[running_key]:
    if st[counter_key] < len(L) - 1:
        st[counter_key] += 1
        update_component(ghenv, interval)
    else:
        st[counter_key] = 0
        st[running_key] = False
    
    
if start:
    st[running_key] = True

if stop:
    st[running_key] = False

if step:
    if st[counter_key] < len(L) - 1:
        st[counter_key] += 1

if step_back:
    if  0 < st[counter_key] < len(L):
        st[counter_key] -= 1

if reset:
    st[counter_key] = 0

if till_key:
    st[counter_key] = key

if full:
    st[counter_key] = len(L)-1

if len(L):
    item = L[st[counter_key]]



#st["visualisation_counter"] = st[counter_key]
#st[counter_key]= 500
counter = st[counter_key]
# ---------- end counter ----------
idx = Panel(counter.counter)  # disabled

# ---- group: Assembly Artist
show_2 = BooleanToggle(False)  # disabled
show_3 = BooleanToggle(True)  # disabled
show_4 = BooleanToggle(True)  # disabled
show_5 = BooleanToggle(False)  # disabled
draw_2 = PythonScript(
    assembly=initial_assembly.assembly,
    show_all=show_2,
    show_current=show_3,
    show_counter=show_4,
    show_planes=show_5,
    counter=counter.counter)  # -> G, G_element, tool_planes_WCS, current_tool_plane; inputs counter: Int32; disabled
# ---------- draw_2: Python ----------
import os
import sys

import math

from compas.colors import Color
from compas.artists import Artist
from compas_ghpython.artists import NetworkArtist



G = []
G_element = []

key_index = assembly.network.key_gkey()
keys = [key for key in assembly.network.nodes()]
elements = [assembly.element(key) for key in keys]





if show_planes:
    tool_planes_WCS = [Artist(e.tool_frame).draw() for e in elements]
    current_tool_plane = tool_planes_WCS[counter]


if show_all and not show_counter:
    for element in elements:
        mesh = Artist(element.mesh).draw(Color.from_rgb255(220,165,165))
        G.append(mesh)
        
        
if show_counter:
    for element in elements[0:counter+1]:
        mesh = Artist(element.mesh).draw(Color.from_rgb255(220,165,165))
        G.append(mesh)
        

if show_current:
    element = assembly.element(counter)
    print element
    mesh = Artist(element.mesh).draw(Color.from_rgb255(41,49,51))
    G_element.append(mesh)
# ---------- end draw_2 ----------
geo = Geometry(draw_2.G_element)  # disabled
pln_5 = Plane(draw_2.tool_planes_WCS)  # disabled
geo_2 = Geometry(draw_2.G)  # disabled
pln_6 = Plane(draw_2.current_tool_plane)  # disabled

# ----
draw_cellnetwork_2 = GhPythonScript(show_all=Toggle(False), show_face=Toggle(True), show_neighbors=Toggle(False))  # -> out, selected_face, neighbor_faces, all_faces; inputs key: Int32, show_neighbors: Boolean
# ---------- draw_cellnetwork_2: Python ----------
from compas.datastructures import Mesh
from compas_ghpython.artists import MeshArtist

#nv = cellnetwork.number_of_vertices()
#ne = cellnetwork.number_of_edges()
#nf = cellnetwork.number_of_faces()
#nc = cellnetwork.number_of_cells()

#print nv, ne, nf, nc
#print cellnetwork.faces(key)

selected_face = Mesh()
all_faces = Mesh()
neighbor_faces = Mesh()


if show_face:
    polygon = cellnetwork.face_polygon(key)
    selected_face = polygon.to_mesh()
    selected_face = MeshArtist(selected_face).draw()

#    face_vertices = cellnetwork.face_vertices(key)
#    mesh.add_face(face_vertices)

#if show_neighbors:
#    for neighbor_key in list(cellnetwork.face_neighbors(key)):
#        faces_vertices = cellnetwork.face_vertices(neighbor_key)
#        mesh.add_face(faces_vertices, fkey = neighbor_key)


#for vkey, attr in cellnetwork.vertices(True):
#    mesh.add_vertex(vkey=key, attr_dict = attr)

#if show_all:
#    for fkey in cellnetwork.faces():
#        face_vertices = cellnetwork.face_vertices(fkey)
#        mesh.add_face(face_vertices)




#edges = MeshArtist(mesh).draw_edges()
#vertices = MeshArtist(mesh).draw_vertices()
#faces = MeshArtist(mesh).draw_faces()
# ---------- end draw_cellnetwork_2 ----------
init_3 = Button()
width_3 = Slider(0.62, range=0.2..10)
width_4 = Slider(0.62, range=0.2..10)
init_4 = Button()
pln_7 = Plane(PlaneXY(0, 0, 0))
brep_3 = Brep(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)

# ---- group: front_element
reference_element = GhPythonScript(
    init=init_3,
    plane=pln_7,
    rh_mesh=brep_3,
    length=Slider(1, range=0.4..10),
    height=Slider(0.3, range=0.2..10),
    bond_type="flemish_bond")  # -> front_element, M; inputs rh_mesh: Brep
# ---------- reference_element: Python ----------
from climate_active_envelopes.assembly import ReferenceElement 
from climate_active_envelopes.assembly import ReferenceModel
from compas.artists import Artist
from compas.geometry import Frame
#from compas_rhino.geometry import RhinoBrep
#from compas_rhino.geometry import RhinoMesh
from compas.datastructures import Mesh
from compas.datastructures import Network
from compas_ghpython.artists import NetworkArtist


frame = Frame(plane.Origin, plane.XAxis, plane.YAxis)
#
#mesh = RhinoBrep(rh_mesh)
#
front_element = ReferenceElement.from_parameters(frame, mesh, length, height, bond_type)
#
#M = Artist(front_element.brep).draw()
# ---------- end reference_element ----------

# ----
pln_8 = Plane(PlaneXY(0, 0, 0))
brep_4 = Brep(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)

# ---- group: front_element
reference_element_2 = GhPythonScript(
    init=init_3,
    plane=pln_8,
    rh_mesh=brep_4,
    length=Slider(1, range=0.4..10),
    height=Slider(0.3, range=0.2..10),
    bond_type="flemish_bond")  # -> left_element, M; inputs rh_mesh: Brep
# ---------- reference_element_2: Python ----------
from climate_active_envelopes.assembly import ReferenceElement 
from climate_active_envelopes.assembly import ReferenceModel
from compas.artists import Artist
from compas.geometry import Frame
#from compas_rhino.geometry import RhinoBrep
#from compas_rhino.geometry import RhinoMesh
from compas.datastructures import Mesh
from compas.datastructures import Network
from compas_ghpython.artists import NetworkArtist


#frame = Frame(plane.Origin, plane.XAxis, plane.YAxis)
#
#mesh = RhinoBrep(rh_mesh)
#
#front_element = ReferenceElement.from_parameters_2(frame, mesh, length, height, bond_type)
#
#M = Artist(front_element.brep).draw()
# ---------- end reference_element_2 ----------

# ----
reference_element_3 = GhPythonScript(
    init=init_4,
    length=Slider(0.9, range=0.4..10),
    height=Slider(0.87, range=0.2..10),
    width=width_3,
    depth=width_4,
    bond_type="flemish_bond")  # -> front_element, M, M1, M2
# ---------- reference_element_3: Python ----------
from climate_active_envelopes.assembly import ReferenceElement 
from compas.datastructures import VolMesh, CellNetwork, Mesh
from compas.geometry import Box, Frame
from compas.artists import MeshArtist, Artist


box = Box(length, height, width)

frame = Frame.worldXY()
wall = ReferenceElement.from_dimensions(frame, length, height, bond_type)


cellnetwork = CellNetwork()

for vertex in box.vertices:
    print vertex
    key = cellnetwork.add_vertex(x=vertex[0], y=vertex[1], z=vertex[2])

face_keys = []
for face in box.faces:
    print face
    key = cellnetwork.add_face(face)
    face_keys.append(key)


#cellnetwork.add_cell(face_keys)


#print cellnetwork

#Convert CellNetwork to Mesh
mesh = Mesh()

for key, attr in cellnetwork.vertices(True):
    mesh.add_vertex(key=key, attr_dict = attr)
    
for facekey, attr in cellnetwork.faces(True):
    vertices = cellnetwork.face_vertices(facekey)
    mesh.add_face(vertices, facekey = facekey, attr_dict=attr)

M = MeshArtist(mesh).draw_edges()
M1 = MeshArtist(mesh).draw_vertices()
M2 = MeshArtist(mesh).draw_faces()
# ---------- end reference_element_3 ----------
crv = Curve(reference_element_3.M)
pt_5 = Point(reference_element_3.M1)

# ---- group: reference model
connectivity = GhPythonScript()  # -> connectivity
# ---------- connectivity: Python ----------
connectivity = [[0,1], [1,2], [2,3], [3,0]]
print connectivity

#print reference_model.add_connection(0, 2)
#reference_model.add_connection(1, 3)
#reference_model.add_connection(2, 1)
#reference_model.add_connection(3, 0)
# ---------- end connectivity ----------
reference_model_2 = GhPythonScript(reference_elements=[reference_element.front_element, reference_element_2.left_element], connectivity=connectivity)  # -> out, reference_model; inputs reference_elements: list, connectivity: list
# ---------- reference_model_2: Python ----------
from climate_active_envelopes.assembly import ReferenceModel
from compas.datastructures import Network
from compas_ghpython.artists import NetworkArtist
#from compas_rhino.artists.networkartist import NetworkArtist

reference_model = ReferenceModel()
#print reference_model

#for i, element in enumerate(reference_elements):
#    reference_model.add_element(element)

print connectivity

for connection in connectivity:
    reference_model.add_connection(connection[0], connection[1])

#data = reference_model.network.to_data()
#network = Network.from_data(data)
#
#nodes, edges = NetworkArtist(network).draw()
# ---------- end reference_model_2 ----------

draw_network = GhPythonScript(reference_model=reference_model_2.reference_model)  # -> out, nodes, edges
# ---------- draw_network: Python ----------
from compas.datastructures import Network
#from compas_ghpython.artists import NetworkArtist
#from compas.artists import NetworkArtist
from compas_ghpython.artists import NetworkArtist

from compas import artists





data = reference_model.network.to_data()
network = Network.from_data(data)

print data


nodes, edges = NetworkArtist(network).draw()
# ---------- end draw_network ----------
pt_6 = Point(draw_network.nodes)
line_4 = Line(draw_network.edges)

# ----
generate_outer_corner = Button()
add_inner_brickwall = Button()
generate_brick_wall = Button()
select_brick = Button()
create_self_shading = BooleanToggle(False)
insulated_brick = Brep(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)
generate_brick_assembly = GhPythonScript(
    reference_model=reference_model_2.reference_model,
    key=Slider(0, range=0..3),
    insulated_brick=insulated_brick,
    create_self_shading=create_self_shading,
    generate_outer_corner=generate_outer_corner,
    generate_brick_wall=generate_brick_wall,
    step_up=select_brick,
    add_inner_brickwall=add_inner_brickwall)  # -> out, brick_assembly; inputs insulated_brick: Mesh, color_values: list
# ---------- generate_brick_assembly: Python ----------
from scriptcontext import sticky as st
from compas_rhino.geometry import RhinoMesh
from climate_active_envelopes.assembly import ReferenceElement

reference_element = reference_model.element(key)

if generate_brick_wall:
    reference_element.generate_brick_assembly(insulated_brick_mesh = RhinoMesh.from_geometry(insulated_brick).to_compas(), 
                                                color_values = color_values, 
                                                create_self_shading=create_self_shading) #, add_outer_corner=add_outer_corner)

if generate_outer_corner:
    reference_element.generate_outer_corner(insulated_brick_mesh = RhinoMesh.from_geometry(insulated_brick).to_compas(), 
                                                color_values = color_values, 
                                                create_self_shading=create_self_shading)


brick_assembly = reference_element.brick_assembly



#
#L = list(brick_assembly.elements())
#
#guid = str(ghenv.Component.InstanceGuid)
#element_key = "elem_" + guid
#
#if step_up:
#    if st[element_key] <  len(L) - 1:
#        st[element_key] += 1
#
#
#    element = brick_assembly.element(counter)
#    print element
#    mesh = Artist(element.mesh).draw(Color.from_rgb255(41,49,51))
#    current_brick.append(mesh)
# ---------- end generate_brick_assembly ----------

generate_outer_corner_2 = Button()
add_inner_brickwall_2 = Button()
generate_brick_wall_2 = Button()
select_brick_2 = Button()
create_self_shading_2 = BooleanToggle(False)
insulated_brick_2 = Brep(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)
generate_brick_assembly_2 = GhPythonScript(
    reference_model=reference_model_2.reference_model,
    key=Slider(0, range=0..3),
    insulated_brick=insulated_brick_2,
    create_self_shading=create_self_shading_2,
    generate_outer_corner=generate_outer_corner_2,
    generate_brick_wall=generate_brick_wall_2,
    step_up=select_brick_2,
    add_inner_brickwall=add_inner_brickwall_2)  # -> out, brick_assembly; inputs insulated_brick: Mesh, color_values: list; same code as generate_brick_assembly
