# Grasshopper definition r8_robotic_bricklaying_fabrication-BSGDJF4.ghx (Grasshopper 1.0.8)
# plug-ins: MetaHopper

# ---- group: save_paths
savedirectory = Python3Script(folder_name="patches", patch_id=Slider(6, range=0..10), create_dir=Button())  # -> out, dir_exists, DATA, DIR; inputs patch_id: Int32
# ---------- savedirectory: Python ----------
import os

#package_path = os.path.dirname(mobile_fabrication_control.__file__)
#DATA = os.path.abspath(os.path.join(package_path,"../../data"))

package_path = ghdoc.Path
# package_path = os.path.dirname(ur_fabrication_control.__file__)
#DATA = os.path.abspath(os.path.join(package_path,"../../data"))

# .stl files not stored in am_hackathon repo. but in mobile_fabrication_control
DATA = os.path.abspath(os.path.join(package_path,"../../data"))

DIR = os.path.join(DATA, folder_name, f"patch_{patch_id}")
print(DIR)
if os.path.isdir(DIR):
    dir_exists = "true"
else:
    dir_exists = "false"
    if create_dir:
        os.mkdir(DIR)
print(package_path)
print(DATA)
# ---------- end savedirectory ----------
file = Python3Script(DIR=savedirectory.DIR, filename="measurements", ext="ply")  # -> PATH
# ---------- file: Python ----------
import os
import datetime

date = today = datetime.date.today()
# print(date.year, date.month, date.day)

name = f"{filename}_{date}.{ext}"
PATH = os.path.join(DIR, name)
# ---------- end file ----------
panel = Panel(file)
file_2 = Python3Script(DIR=savedirectory.DIR, filename="reference_points", ext="ply")  # -> PATH; same code as file
panel_2 = Panel(file_2)
panel_3 = Panel(savedirectory.dir_exists)

# ----
save_to_file = Button()
reference_points = Point([<point referenced from the Rhino model> x6])
filepath = FilePath(file_2)

points_to_pcd = Python3Script(points=reference_points, filepath=filepath, write=save_to_file)  # -> out, pcd; inputs points: list of Point3d
# ---------- points_to_pcd: Python ----------
import open3d

array = [[x,y,z] for x, y, z in iter(points)]
pcd = open3d.geometry.PointCloud()
pcd.points = open3d.utility.Vector3dVector(array)
pcd.voxel_down_sample(0.0001)


if write:
    open3d.io.write_point_cloud(filepath, pcd, write_ascii=True)
    print("file written to ", str(filepath))
# ---------- end points_to_pcd ----------
reference_target = Data(points_to_pcd.pcd)

# ----
# IP Settings
# --> Set your IP address
# --> Set robot IP address
server_ip = ValueList({"192.168.0.67", "192.168.0.42", "192.168.10.12", "192.168.10.11", "192.168.10.10", "192.168.10.2", "127.0.0.1", "192.168.10.111", "192.168.0.250", "192.168.0.30", "10.42.0.212", "10.42.0.133"}, selected="192.168.0.42")
ur_ip = ValueList({"192.168.10.10", "192.168.10.20", "192.168.10.11", "192.168.10.12", "127.0.0.1", "192.168.10.111", "192.168.0.210", "192.168.0.211", "192.168.0.30"}, selected="192.168.0.210")
server_port = ValueList({"50002", "50003", "50005", "50006", "50007", "50008", "50009", "50010", "50011", "50012", "50013", "50014", "50015", "50016", "50017", "50018", "50019", "50020", "50021", "50022", "50023", "50024", "50025", "50026", "50027", "50028"}, selected="50007")
ur_port = ValueList({"30002"}, selected="30002")
globals = Python3Script(server_ip=server_ip, server_port=server_port, ur_ip=ur_ip, ur_port=ur_port, clear=Button())  # inputs server_ip: String, server_port: Int32, ur_ip: String, ur_port: Int32
# ---------- globals: Python ----------
from scriptcontext import sticky as st

st["server_ip"] = server_ip
st["server_port"] = server_port

st["ur_ip"] = ur_ip
st["ur_port"] = ur_port

if clear:
    st.clear()
# ---------- end globals ----------

# ----
# Check if UR robot
#  is available
ping = Button()
ping_2 = Python3Script(ip=ur_ip, ping=ping)  # -> out; inputs ip: String
# ---------- ping_2: Python ----------
from scriptcontext import sticky as st
from ur_fabrication_control.direct_control.utilities import is_available

guid = str(ghenv.Component.InstanceGuid)
txt_key = "txt_" + guid
if txt_key not in st:
    st[txt_key] = ""

if ping:
    
    available = is_available(ip)
    
    if available:
        st[txt_key] = "%s is up!" % ip
        trigger = True
    else:
        st[txt_key] = "%s is down!" % ip
        trigger = False

print(st[txt_key])
# ---------- end ping_2 ----------
panel_4 = Panel(ping_2)

# ----
# ROBOT
py3 = Python3Script()  # -> HERE, DATA, ROBOT_DESCRIPTION
# ---------- py3: Python ----------
import os

HERE = os.path.dirname(ghdoc.Path)
DATA = os.path.abspath(os.path.join(HERE, "..", "data"))
ROBOT_DESCRIPTION = os.path.abspath(os.path.join(DATA, "robot_description"))

print(HERE)
print(DATA)
print(ROBOT_DESCRIPTION)
# ---------- end py3 ----------
reload = Python3Script(reload=Button())  # -> out
# ---------- reload: Python ----------
if reload:
    from compas_rhino import unload_modules
    unload_modules("assembly_information_model")
    unload_modules('mobile_robot_control')
    unload_modules('fabrication_manager')
    unload_modules('ur_fabrication_control')
    unload_modules('climate_active_envelopes')
# ---------- end reload ----------

# ----
# ROS client
list = ValueList({"local": "127.0.0.1", "linux computer": "192.168.0.42", "linux eduroam": "10.181.95.254", "linux ccnet": "192.168.0.102", "linux vmware": "192.168.199.36", "robot": "192.168.0.200", "robotAA_wifi": "192.168.0.111", "robotAB_wifi": "192.168.0.112", "robotAB_eduroam": "10.181.67.95"}, selected="robot")
connect = BooleanToggle(True)
ros = Python3Script(ip=list, port="9090", connect=connect)  # -> out, ros_client, is_connected; inputs ip: String, port: Int32, connect: Boolean
# ---------- ros: Python ----------
"""
Connect or disconnect to ROS.

COMPAS FAB v0.27.0
"""
from scriptcontext import sticky as st

from compas_fab.backends import RosClient

ros_client = None

ip = ip or '127.0.0.1'
port = port or 9090
key = "ros_client_001"
ros_client = st.get(key, None)

if ros_client:
    st[key].close()
if connect:
    st[key] = RosClient(ip, port)
    st[key].run(5)

ros_client = st.get(key, None)
is_connected = ros_client.is_connected if ros_client else False
# ---------- end ros ----------
panel_5 = Panel(ros.is_connected)

# ----
# Load robot from ROS
load = Button()
# Make sure that ros bridge, file server, tf2_web_republisher and moveit config is running on the robot!
panel_6 = Panel("")
mobile_robot = Python3Script(ros_client=ros.ros_client, prefix=panel_6, load=load)  # -> out, mobile_robot; inputs prefix: String
# ---------- mobile_robot: Python ----------
from mobile_robot_control.mobile_robot import MobileRobot
from mobile_robot_control.mobile_robot_client import MobileRobotClient
from scriptcontext import sticky as st
from compas.scene import SceneObject
import Rhino
import scriptcontext

# Set Rhino document context to the active Rhino doc
scriptcontext.doc = Rhino.RhinoDoc.ActiveDoc

from compas_robots.ghpython.scene import RobotModelObject

key = 'robot_AA'
print(key)
if ros_client and ros_client.is_connected and load:
    # Set Rhino context again before interacting with Rhino-specific objects


    # Load URDF from ROS
    robot = ros_client.load_robot(
            load_geometry=True, 
            urdf_param_name= '{}/robot_description'.format(prefix),
            srdf_param_name= '{}/robot_description_semantic'.format(prefix))
    scriptcontext.doc = ghdoc
    try:
        robot.scene_object = SceneObject(item=robot.model)
    except:
        robot.scene_object = RobotModelObject(robot.model)
    mobile_robot = MobileRobot(robot.model, robot.scene_object, robot.semantics, client=None)
    st[key] = mobile_robot

    
    # Restore the Grasshopper document context after modifying Rhino objects


# Accessing the mobile_robot object in Grasshopper context
mobile_robot = st.get(key, None)
if mobile_robot:
    # Ensure we're in the Grasshopper context before doing operations specific to Grasshopper
    mobile_robot.mobile_client = MobileRobotClient(ros_client)
    mobile_robot.client = ros_client
# ---------- end mobile_robot ----------

path = Python3Script()  # -> HERE, DATA
# ---------- path: Python ----------
import os

HERE = os.path.dirname(ghdoc.Path)
DATA = os.path.abspath(os.path.join(HERE, "..", "data\patches\patch_6\BCF_lh0_2025-06-05.json"))

print(HERE)
print(DATA)
# ---------- end path ----------
mesh = Mesh(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)
py3_2 = Python3Script(filepath=path.DATA, load=Toggle(True))  # -> out, BCF
# ---------- py3_2: Python ----------
from compas.geometry import Frame
from compas_rhino.conversions import frame_to_rhino_plane
print(filepath)
if load:
    robot_frame = Frame.from_json(filepath)
    BCF = frame_to_rhino_plane(robot_frame)
# ---------- end py3_2 ----------
compas_versions = Python3Script()  # -> out, a
# ---------- compas_versions: Python ----------
import compas
import compas_fab
import compas_robots

print(compas.__version__)
print(compas_fab.__version__)
print(compas_robots.__version__)
# ---------- end compas_versions ----------

robot = Data(mobile_robot.mobile_robot)
info = Python3Script(robot=robot)  # -> out, main_group_name
# ---------- info: Python ----------
if robot:
    robot.info()
    main_group_name = robot.main_group_name
# ---------- end info ----------
panel_7 = Panel(info.out)

# ----
# Get Pose Cartesian
get = Button()
pose = Python3Script(robot=robot, get=get)  # -> out, pose_cartesian
# ---------- pose: Python ----------
from scriptcontext import sticky as st

from ur_fabrication_control.direct_control.common import get_current_pose_cartesian
from compas.geometry import Frame


server_ip = st["server_ip"]
server_port = st["server_port"]
ur_port = st["ur_port"]
ur_ip = st["ur_ip"]
pose_cartesian_meter = []
print (ur_ip)

# retrieve the current tool frame in axis angle format
if robot.attached_tool:
    print ("attached")
    tool_angle_axis = list(robot.attached_tool.frame.point) + list(robot.attached_tool.frame.axis_angle_vector)
    
else:
    tool0_frame = Frame([0, 0, 0], [1, 0, 0], [0, 1, 0])
    tool_angle_axis = list(tool0_frame.point) + list(tool0_frame.axis_angle_vector)

guid = str(ghenv.Component.InstanceGuid)
pose_cartesian_key = "pose_cartesian" + guid


if get:
    print ("getting pose")
    st[pose_cartesian_key] = get_current_pose_cartesian(tool_angle_axis, server_ip, server_port, ur_ip, ur_port, send=True)
    

if pose_cartesian_key not in st:
    pose_cartesian = []
else:
    pose_cartesian = st[pose_cartesian_key]
# ---------- end pose ----------
panel_8 = Panel(pose.out)
record = Button()
clear = Button()
rec = Python3Script(msg=pose.pose_cartesian, rec=record, clear=clear)  # -> out, record, planes; inputs msg: list
# ---------- rec: Python ----------
from scriptcontext import sticky as st
from compas.geometry import Frame
from compas_rhino.conversions import frame_to_rhino_plane

guid = str(ghenv.Component.InstanceGuid)
recorded_key =  "recorded_" + guid

if recorded_key not in st:
    st[recorded_key] = []

if clear:
    st[recorded_key] = []
else:
    if len(msg):
        if msg != [None] and rec:
            st[recorded_key].append(msg)


record = st[recorded_key]
planes = []
for pose in st[recorded_key]:
    frame = Frame.from_axis_angle_vector(pose[3:6], pose[0:3])
    planes.append(frame_to_rhino_plane(frame))
print (rec)
# ---------- end rec ----------
panel_9 = Panel(rec.record)

list_2 = ValueList({"get_pose_cartesian": 0, "manual_input": 1, "from_file": 2}, selected="get_pose_cartesian")
save_to_file_2 = Button()
pose_cartesian_planes = Point(rec.planes)
manual_points = Point([<point referenced from the Rhino model> x5])
filepath_2 = FilePath(file)

filter = StreamFilter(Gate=list_2, Stream0=pose_cartesian_planes, Stream1=manual_points)
equals = Equality(FirstNumber=list_2, SecondNumber=2)  # -> Equality, Inequality
points_to_pcd_2 = Python3Script(points=filter, filepath=filepath_2, write=save_to_file_2)  # -> out, pcd; inputs points: list of Point3d; same code as points_to_pcd
pcd_from_file = Python3Script(filepath=filepath_2, read=equals.Equality)  # -> out, pcd
# ---------- pcd_from_file: Python ----------
from compas.datastructures import Mesh
from compas.files import PLY, STL
import os
import open3d

# filepath = os.path.join(data, filename)

if read:
    pcd = open3d.io.read_point_cloud(filepath)
    print("file read from ", str(filepath))
# ---------- end pcd_from_file ----------
filter_2 = StreamFilter(Gate=list_2, Stream0=points_to_pcd_2.pcd, Stream1=points_to_pcd_2.pcd, Stream2=pcd_from_file.pcd)
measurements_source = Data(filter_2)

measurements_source_2 = Data(measurements_source)
reference_target_2 = Data(reference_target)

# ----
# Attach tool
list_3 = ValueList({"measurement tool": 0, "parallel gripper": 1, "parallel gripper V2": 2}, selected="parallel gripper V2")
show = BooleanToggle(True)
path_2 = Python3Script()  # -> DATA
# ---------- path_2: Python ----------
import os

package_path = ghdoc.Path
DATA = os.path.abspath(os.path.join(package_path,"../../data"))

print(package_path)
print(DATA)
# ---------- end path_2 ----------
tool = Python3Script(data_path=path_2, tool=list_3, show=show)  # -> tool, M, ee_plane; inputs data_path: String
# ---------- tool: Python ----------
import os, math
from compas.geometry import Frame, Rotation, Vector, Quaternion
from compas.datastructures import Mesh
from compas_rhino.conversions import mesh_to_rhino, frame_to_rhino_plane
from compas_fab.robots import Tool

tolerance = 0

if tool == 0:
    filename = 'ur20_measurement_tool.stl'
    #ee_frame = Frame([0, 0, 0], [1, 0, 0], [0, 1, 0])
    ee_frame = Frame([0, 0, 0.29722], [1, 0, 0], [0, 1, 0])

elif tool == 1:
    filename = 'ur20_cae_parallelgripper.stl'
    ee_frame = Frame([0, 0, 0.17 + tolerance],[1, 0, 0], [0, 1, 0])
    #ee_frame = Frame([0, 0, 0.175 + tolerance],[1, 0, 0], [0, 1, 0])

elif tool == 2:
    filename = 'ur20_cae_parallelgripper_v2.stl'
    ee_frame = Frame([0, 0, 0.15 + tolerance],[0, -1, 0], [1, 0, 0])

data_path = os.path.join(data_path, "tool_geometry")
fullfilename = os.path.join(data_path, filename)

ee_mesh = Mesh.from_stl(fullfilename)

if show:
    M = mesh_to_rhino(ee_mesh)

tool = Tool(ee_mesh, ee_frame)
ee_plane = frame_to_rhino_plane(ee_frame)
print(ee_frame.quaternion.xyzw)
ee_framek = Frame([0.0110607,0.00809854,0.41498], [0,1,0], [1,0,0])
print(ee_framek.quaternion.xyzw)
# ---------- end tool ----------
remove = Button()
attach = Button()
mesh_2 = Mesh(tool.M)
attach_tool = Python3Script(robot=robot, tool=tool.tool, attach=attach, remove=remove)  # -> tool, M, ee_plane, bang
# ---------- attach_tool: Python ----------
print(robot.get_group_names_from_link_name("robot_arm_flange"))

if attach:
    for planning_group in robot.get_group_names_from_link_name("robot_arm_flange"):
        robot.attach_tool(tool, group=planning_group)
if remove:
    for planning_group in robot.get_group_names_from_link_name("robot_arm_flange"):
        robot.detach_tool(group=planning_group)
# ---------- end attach_tool ----------

# ----
# Planning scene
scene = Python3Script(robot=robot)  # -> scene
# ---------- scene: Python ----------
"""
Create a planning scene.

COMPAS FAB v0.28.0
"""

from ghpythonlib.componentbase import executingcomponent as component
from scriptcontext import sticky as st

from compas_fab.ghpython.components import create_id
from compas_fab.robots import PlanningScene


class PlanningSceneComponent(component):
    def RunScript(self, robot):
        key = "planning_scene"
        if robot:
            st[key] = PlanningScene(robot)
        return st.get(key, None)
# ---------- end scene ----------

# ----
# Attach collision mesh to scene
append = Button()
remove_2 = Button()
add = Button()
mesh_object = Mesh(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)
mesh_table = Mesh(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)
collision_mesh = Python3Script(scene=scene, mesh=mesh_table, identifier="table", add=add, append=append, remove=remove_2)  # -> ok, bang; inputs mesh: Mesh, identifier: String
# ---------- collision_mesh: Python ----------
"""
Add or remove a collision mesh from the planning scene.
"""

from compas_rhino.conversions import mesh_to_compas
from compas_fab.robots import CollisionMesh

ok = False
Message = ""

if (add and append) or (append and remove) or (add and remove):
    Message = "Use only one operation at a time\n(add, append or remove)"
    raise Exception(Message)

if scene and mesh and identifier:
    compas_mesh = mesh_to_compas(mesh)
    collision_mesh = CollisionMesh(compas_mesh, identifier)
    if add:
        scene.add_collision_mesh(collision_mesh)
        Message = "Added"
        ok = True
    if append:
        scene.append_collision_mesh(collision_mesh)
        Message = "Appended"
        ok = True
    if remove:
        scene.remove_collision_mesh(identifier)
        Message = "Removed"
        ok = True
# ---------- end collision_mesh ----------
panel_10 = Panel(collision_mesh.ok)

# ----
# Attach collision mesh to robot
panel_11 = Panel("attached_brick")
remove_3 = Button()
add_2 = Button()
mesh_3 = Mesh(<mesh referenced from the Rhino model>)
attached_collision_mesh = Python3Script(scene=scene, mesh=mesh_3, identifier=panel_11, link_name="ee_link", touch_links="ee_link", add=add_2, remove=remove_3)  # -> out, attached_collision_mesh, bang; inputs mesh: Mesh
# ---------- attached_collision_mesh: Python ----------
"""
Add an attached collision mesh to the robot.

COMPAS FAB v0.28.0
"""

from compas_rhino.conversions import mesh_to_compas
from ghpythonlib.componentbase import executingcomponent as component

from compas_fab.robots import AttachedCollisionMesh
from compas_fab.robots import CollisionMesh

from compas_ghpython import create_id
import Rhino

class AttachedCollisionMeshComponent(component):
    def RunScript(self,
            scene,
            mesh: Rhino.Geometry.Mesh,
            identifier,
            link_name,
            touch_links,
            add,
            remove):
        attached_collision_mesh = None
        if scene and mesh and identifier and link_name:
            compas_mesh = mesh_to_compas(mesh)
            collision_mesh = CollisionMesh(compas_mesh, identifier)
            attached_collision_mesh = AttachedCollisionMesh(collision_mesh, link_name, touch_links)
            if add:
                scene.add_attached_collision_mesh(attached_collision_mesh)
                scene.attach_collision_mesh_to_robot_end_effector(collision_mesh, group="ur20_and_liftkit")
                scene.attach_collision_mesh_to_robot_end_effector(collision_mesh, group="ur20")
            if remove:
                scene.remove_attached_collision_mesh(identifier)
                scene.remove_collision_mesh(identifier)
        return attached_collision_mesh
# ---------- end attached_collision_mesh ----------
panel_12 = Panel(attached_collision_mesh.attached_collision_mesh)

pln = Plane(py3_2.BCF)
pln_2 = Plane(tool.ee_plane)

# ----
# real robot values
subscribe = Button()
unsubscribe = Button()
get_joint_states = Python3Script(robot=robot, subscribe=subscribe, unsubscribe=unsubscribe)
# ---------- get_joint_states: Python ----------
if subscribe:
    robot.mobile_client.joint_states_subscribe()

if unsubscribe:
    robot.mobile_client.joint_states_unsubscribe()

#robot.mobile_client.tf_subscribe("robot_arm_base", "robot_base_footprint")
#print('x')
# ---------- end get_joint_states ----------
trigger = Trigger(Interval=1000, TimerInterval=1000, Target=draw)
draw = Python3Script(robot=robot)  # -> configuration; disabled
# ---------- draw: Python ----------
from compas_robots import Configuration

configuration = robot.mobile_client.get_current_configuration()
print(configuration)
# ---------- end draw ----------

# ----
# Configuration
number_slider = Slider(0, range=-0.3..0.7)

# ----
# forward kinematics
number_slider_2 = Slider(-68.4, range=-360..360)
forward_kinematics = Python3Script(
    robot=robot,
    lift=number_slider,
    j1=Slider(-35.4, range=-180..180),
    j2=number_slider_2,
    j3=Slider(5.8, range=-180..180),
    j4=Slider(0, range=-400..400),
    j5=Slider(0, range=-125..120),
    j6=Slider(0, range=-400..400))  # -> configuration
# ---------- forward_kinematics: Python ----------
import math

from compas_robots.model import Joint
from compas_robots import Configuration


if robot:
    joint_types = robot.get_configurable_joint_types()
    joint_names = robot.get_configurable_joint_names()

    joint_values = [j1, j2, j3, j4, j5, j6]
    for i, joint_value in enumerate(joint_values):
        joint_values[i] = math.radians(joint_values[i])
    
    if len(robot.get_configurable_joints()) == 6:
        configuration = Configuration(joint_values, joint_types, joint_names)
    else:
        configuration = Configuration.from_prismatic_and_revolute_values([lift], joint_values)
    print (configuration)
    # configuration = Configuration((0.006, -0.716, -1.187, 2.378, 0.448, 1.464,  0.852), (2, 0, 0, 0, 0, 0, 0), ('robot_ewellix_lift_top_joint', 'robot_arm_shoulder_pan_joint', 'robot_arm_shoulder_lift_joint', 'robot_arm_elbow_joint', 'robot_arm_wrist_1_joint', 'robot_arm_wrist_2_joint', 'robot_arm_wrist_3_joint'))
    
    ## config for full bricks
    configuration = Configuration((0.006, -2.186, -1.048, 2.170, -2.693, -1.571, 0.955), (2, 0, 0, 0, 0, 0, 0))
    # config for ins bricks
    #configuration = Configuration((0.006, -4.472, -1.346, 2.435, -2.657, -1.574, -1.330), (2, 0, 0, 0, 0, 0, 0), ('robot_ewellix_lift_top_joint', 'robot_arm_shoulder_pan_joint', 'robot_arm_shoulder_lift_joint', 'robot_arm_elbow_joint', 'robot_arm_wrist_1_joint', 'robot_arm_wrist_2_joint', 'robot_arm_wrist_3_joint'))
# ---------- end forward_kinematics ----------

# ----
# Move the robot to origin and play around with these planes (and inverse kinematics) to get a new middle configuration.
midplnhigh = Plane(Plane(origin=(0.6356411277, 0.853334344, 2.10362402), x=(-0.9999972774, 0.001833592729, 0.001443287158), y=(0.001836342296, 0.9999964974, 0.001906058367)))
midpln = Plane(Plane(origin=(0.6340970731, 0.8553812734, 1.031208398), x=(-0.9999972774, 0.001833592729, 0.001443287158), y=(0.001836342296, 0.9999964974, 0.001906058367)))
cp = Plane(Plane(origin=(11.58862168, -0.1000004505, 0.1006858904), x=(0, -1, 0), y=(-1, 0, 0)))
pick_ins_bcf = Plane(Plane(origin=(-0.3098920653, -0.420815, 0.8716041961), x=(-0.999999554, 0.0004388141119, -0.0008362993977), y=(8.565167786e-05, 0.9239926749, 0.3824101586)))

# ----
# zero configuration
zero = Python3Script(robot=robot, group=info.main_group_name)  # -> out, configuration; inputs group: String
# ---------- zero: Python ----------
configuration = robot.zero_configuration(group)
# ---------- end zero ----------

lift_height_at_measuring = Panel("0.0")
panel_13 = Panel(draw)
list_4 = ValueList({"0 zero_configuration": 0, "1 forward_kinematics": 1, "2 analytic_inverse_kinematics": 2, "3 inverse_kinematics": 3, "4 motion_planning": 4, "5 real_configuration": 5, "6 assembly": 6}, selected="1 forward_kinematics")
show_robot_collision = BooleanToggle(False)
show_rcf = BooleanToggle(True)

# ----
# Import from JSON
list_5 = ValueList({"patch_1": "patch_1.json", "course_ongoing": "patch_2_with_configs_2025-05-20_1_course_4-ongoing.json", "patch_2": "patch_2.json", "patch_2_6": "patch_2_with_configs_2025-05-22_2_course_6.json", "patch_2-7": "patch_2_with_configs_2025-05-22_2_course_7.json", "patch_2-8": "patch_2_with_configs_2025-05-22_2_course_8.json", "patch_2-9": "patch_2_with_configs_2025-05-22_2_course_9.json", "patch_3": "patch_3_with_configs_2025-05-21_3_course_5-16.json", "patch_3_neu": "patch_3_with_configs_2025-05-21_3_course_5-16_with_configs_250522-3_course_11.json", "patch_4": "patch_4.json", "patch_4_new": "patch_4_with_configs_2025-05-23_4_course_4.json", "patch_5": "patch_5.json", "patch_6": "patch_6.json", "patch_7": "patch_7.json", "patch_8": "patch_8.json", "patch_9": "patch_9.json"}, selected="patch_6")
import = Button(ExpressionNormal="True", ExpressionPressed="False")
path_3 = Python3Script()  # -> HERE, DATA
# ---------- path_3: Python ----------
import os

HERE = os.path.dirname(ghdoc.Path)
DATA = os.path.abspath(os.path.join(HERE, "..", "data"))
print(HERE)
print(DATA)
# ---------- end path_3 ----------
initial_assembly = Python3Script(DATA=path_3.DATA, filename=list_5, import_from_json=import)  # -> out, assembly
# ---------- initial_assembly: Python ----------
import os
import json


from climate_active_envelopes.assembly import CAEAssembly as Assembly
from climate_active_envelopes.assembly import CAEPart as Part

#assembly = Assembly()

if import_from_json:
    filename = filename
    PATH = os.path.join(DATA, "assembly", filename)
    print(PATH)
    assembly = Assembly.from_json(PATH)
    print(assembly)
# ---------- end initial_assembly ----------

sorting_parts = Python3Script(my_assembly=initial_assembly.assembly)  # -> out, my_assembly; disabled
# ---------- sorting_parts: Python ----------
courses = my_assembly.assembly_courses(tol= 0.0001)
sorted_courses = my_assembly.sort_parts_by_direction(courses)
key_mapping = my_assembly.reassign_part_keys(sorted_courses)
# ---------- end sorting_parts ----------
_9mm = Plane(PlaneXY(11.58862168, -0.1000004505, 0.009135287467))
_12mm = Plane(PlaneXY(11.58862168, -0.1000004505, 0.01220939669))
_2mm = Plane(PlaneXY(11.58862168, -0.1000004505, 0.002473708139))
_6mm = Plane(PlaneXY(11.58862168, -0.1000004505, 0.006162953446))
_4mm = Plane(PlaneXY(11.58862168, -0.1000004505, 0.004371331302))
_13mm = Plane(PlaneXY(11.58862168, -0.1000004505, 0.01317777063))
_15mm = Plane(PlaneXY(11.58862168, -0.1000004505, 0.01475413647))
_22mm = Plane(PlaneXY(11.58862168, -0.1000004505, 0.02128198539))
_16mm = Plane(PlaneXY(11.58862168, -0.1000004505, 0.01579895308))
_10mm = Plane(PlaneXY(11.58862168, -0.1000004505, 0.009682728249))
_30mm = Plane(PlaneXY(11.58862168, -0.1000004505, 0.02897213989))
_25mm = Plane(PlaneXY(11.58862168, -0.1000004505, 0.02464937553))
_23mm = Plane(PlaneXY(11.58862168, -0.1000004505, 0.02232803132))
_18mm = Plane(PlaneXY(11.58862168, -0.1000004505, 0.01787056843))
_28mm = Plane(PlaneXY(11.58862168, -0.1000004505, 0.02787471332))
_26mm = Plane(PlaneXY(11.58862168, -0.1000004505, 0.02577271929))

# ----
# Transform Assembly
toggle = BooleanToggle(True)
cp_2 = Plane(PlaneXY(11.58862168, -0.1000004505, 0))
transform_assembly = Python3Script(assembly=initial_assembly.assembly, transform=toggle, center_plane=cp_2, center_plane_new=_26mm)  # -> out, assembly, node, nodes, plane_c
# ---------- transform_assembly: Python ----------
from compas.geometry import Frame, Transformation, Rotation, Translation
from compas_rhino.conversions import plane_to_compas_frame, point_to_rhino, frame_to_rhino

center_frame = plane_to_compas_frame(center_plane)
center_frame_new = plane_to_compas_frame(center_plane_new)

if transform:
    # Compute the transformation
    T = Transformation.from_frame_to_frame(center_frame, center_frame_new)
    assembly = assembly.transformed(T)

    # Reassign part keys and get the mapping of old keys to new keys
    sorted_courses = assembly.sort_parts_by_direction(assembly.assembly_courses())
    key_mapping = assembly.reassign_part_keys(sorted_courses)

    # Iterate through the parts in the assembly
    for part in assembly.parts():
        # Get the old key of the part
        old_key = part.key

        # Get the new key of the part using the key_mapping
        new_key = key_mapping.get(old_key)

        # Access the node in the graph using the new key
        if new_key is not None:
            node = assembly.graph.node[new_key]

            # Check for the presence of 'a', 'b', 'c', and 'd' attributes in the node
            if 'a' in node:
                frame_a = node['a']
                frame_a.transform(T)
                node['a'] = frame_a

            if 'b' in node:
                frame_b = node['b']
                frame_b.transform(T)
                node['b'] = frame_b

            if 'c' in node:
                frame_c = node['c']
                frame_c.transform(T)
                node['c'] = frame_c
                print(type(frame_c))
                plane_c = frame_to_rhino(frame_c)
                print(plane_c)

            if 'd' in node:
                frame_d = node['d']
                frame_d.transform(T)
                node['d'] = frame_d




# if transform:
#     T = Transformation.from_frame_to_frame(center_frame, center_frame_new)
#     assembly = assembly.transformed(T)
    

#     # Iterate through the parts in the assembly
#     for part in assembly.parts():
#         # Get the node corresponding to the part's key
#         node = assembly.graph.node[part.key]

#         # Check for the presence of 'a', 'b', 'c', and 'd' attributes in the node
#         if 'a' in node:
#             # Get the Frame object, transform it, and store the transformed Frame back
#             frame_a = node['a']  # Get the Frame object
#             frame_a.transform(T)  # Transform the Frame
#             node['a'] = frame_a  # Store the transformed Frame back
#             # node_a = frame_a.transformed(T) # Alternative: create a new transformed copy

#         if 'b' in node:
#             frame_b = node['b']
#             frame_b.transform(T)
#             node['b'] = frame_b

#         if 'c' in node:
#             frame_c = node['c']
#             frame_c.transform(T)
#             node['c'] = frame_c
#             print(type(frame_c))
#             plane_c = frame_to_rhino(frame_c)
#             print(plane_c)
#             #print(type(node['c']))  # Verify the type (should be <class 'compas.geometry.Frame'>)

#         if 'd' in node:
#             frame_d = node['d']
#             frame_d.transform(T)
#             node['d'] = frame_d
# ---------- end transform_assembly ----------

# ----
# Export to JSON
# Before exporting transform back to original position!!!
export = Button()
path_4 = Python3Script()  # -> HERE, ASSEMBLY, DATA
# ---------- path_4: Python ----------
import os

HERE = os.path.dirname(ghdoc.Path)
DATA = os.path.abspath(os.path.join(HERE, "..", "data"))
ASSEMBLY = os.path.abspath(os.path.join(DATA, "assembly"))

print(HERE)
print(DATA)
print(ASSEMBLY)
# ---------- end path_4 ----------
export_2 = Python3Script(
    ASSEMBLY=path_4.ASSEMBLY,
    DATA=path_4.DATA,
    filename_patch_data=list_5,
    my_assembly=transform_assembly.assembly,
    export_assembly=export)  # -> out; inputs ASSEMBLY: String
# ---------- export_2: Python ----------
import os
import json
from compas.datastructures import Assembly
from scriptcontext import sticky as st
from climate_active_envelopes.assembly import CAEAssembly


# # print(my_assembly.graph.nodes_attribute(name='patch', value=st[patch_num_key], keys=keys_in_patch))
# if export_patch:
#     courses = my_assembly.assembly_courses(tol=0.0001)
#     c_max = max(my_assembly.graph.nodes_attribute(name="patch"))
#     keys_in_patch = list(my_assembly.graph.nodes_where({"patch": c_max}))
#     L_patch = [node for course in courses for node in course if node in keys_in_patch]

#     # Create a copy of the graph to modify
#     filtered_graph = my_assembly.graph.copy()  
#     nodes_to_keep = set(L_patch)

#     # Remove nodes and edges not in the specific patch
#     for node in list(filtered_graph.nodes()):
#         if node not in nodes_to_keep:
#             filtered_graph.delete_node(node)

#     # Create a temporary assembly for export
#     temp_assembly = CAEAssembly()
#     temp_assembly.graph = filtered_graph

#     # Export the filtered assembly to a JSON file
#     filename_patch_data = filename_patch_data
#     PATH_assembly = os.path.join(ASSEMBLY, filename_patch_data)
#     temp_assembly.to_json(PATH_assembly, pretty=True)
#     print(f"Assembly exported to {PATH_assembly}")
#     print(temp_assembly)


filename_assembly = filename_patch_data.replace('.json', '') + '_with_configs_250523-3_course_12.json'
print(filename_assembly)
if export_assembly:
    PATH_assembly = os.path.join(ASSEMBLY, filename_assembly)
    my_assembly.to_json(PATH_assembly, pretty=True)
    print(f"Assembly exported to {PATH_assembly}")
    print(my_assembly)
# ---------- end export_2 ----------

pick_ins = Plane(Plane(origin=(-0.307153354, -0.4222838347, 0.8633069328), x=(-0.9999666696, 0.008041761362, 0.001410583988), y=(0.007953336776, 0.920408742, 0.3908765689)))
cp_3 = Plane(Plane(origin=(11.58862168, -0.1000004505, 0.1006858904), x=(0, -1, 0), y=(-1, 0, 0)))
pick_full = Plane(Plane(origin=(-0.046264354, 0.4388351653, 0.8672309328), x=(0.9999481106, 0.006777534953, 0.007605339352), y=(0.003219547778, -0.9185583247, 0.39527236)))

# ----
# Stop
stop = Button()
stop_2 = Python3Script(stop=stop)
# ---------- stop_2: Python ----------
from scriptcontext import sticky as st
from ur_fabrication_control.direct_control.common import send_stop

ur_ip = st["ur_ip"]
ur_port = st["ur_port"]

if stop:
    send_stop(ur_ip, ur_port)
# ---------- end stop_2 ----------

show_all = BooleanToggle(False)
show_connections = BooleanToggle(False)
show_patch = BooleanToggle(True)
show_patch_until_counter = BooleanToggle(True)
highlight_current_part = BooleanToggle(True)
show_place_planes = BooleanToggle(True)
show_course = BooleanToggle(False)
show_keys = BooleanToggle(True)

start = Button()
stop_3 = Button()
step = Button()
back = Button()
step_10 = Button()
back_10 = Button()
reset = Button()
full = Button()

# ----
# Assembly
init = Button()
assembly = Python3Script(init=init)  # -> assembly
# ---------- assembly: Python ----------
from assembly_information_model.assembly import Assembly
from scriptcontext import sticky as st

if init:
    assembly = Assembly()
    assembly.deconstruction_list = []
    assembly.placed_brick_amount = 0
    assembly.wall_distance = 0
    assembly.wall_height = 0
    st['assembly'] = assembly

assembly = st.get('assembly')
# ---------- end assembly ----------

visualize = Python3Script(
    my_assembly=transform_assembly.assembly,
    show_all=show_all,
    show_connections=show_connections,
    show_patch=show_patch,
    show_patch_until_counter=show_patch_until_counter,
    highlight_current_part=highlight_current_part,
    show_place_planes=show_place_planes,
    show_course=show_course,
    show_keys=show_keys,
    course=Slider(4, range=0..40),
    start=start,
    stop=stop_3,
    step=step,
    step_back=back,
    step_ten=step_10,
    step_ten_back=back_10,
    reset=reset,
    full=full)  # -> out, parts_geometry, parts_frame, parts_keys, current_part_key, current_part_geometry, current_part_frame, current_part_gripping_frame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; inputs course: Int32
# ---------- visualize: Python ----------
from compas_rhino.conversions import mesh_to_rhino, box_to_rhino, frame_to_rhino
from compas.colors import Color
import Rhino.Geometry as rg
import ghpythonlib.components as ghcomp
from scriptcontext import sticky as st

import clr
clr.AddReference("System.Drawing")
from System.Drawing import Color

courses = my_assembly.assembly_courses(tol= 0.0001)
sorted_courses = my_assembly.sort_parts_by_direction(courses)
key_mapping = my_assembly.reassign_part_keys(sorted_courses)

L = [node for course in courses for node in course]


G_neighbors = []
G_connections = []
G_course = []
G_patch = []
G_patches =  []
G_sequence_wtop_key = []
G_patches_color = []


# Define colors for each brick type
brick_colors = {
    "brick_full": (231, 124, 111),         
    "brick_insulated": (201, 124, 111),    
    "brick_air_dried": (249, 207, 155),    
    "brick_half": (201, 124, 111),
}

if show_all:
    parts_geometry = []
    parts_frame = []

    for key in my_assembly.graph.nodes():
        # Retrieve the part object
        part = my_assembly.graph.node_attribute(key, 'part')

        # Retrieve the brick_type attribute
        brick_type = my_assembly.graph.node_attribute(key, 'brick_type')
        color = brick_colors.get(brick_type, (128, 128, 128))  # Default to gray if type is unknown

        # Convert the mesh to Rhino and apply color
        rhino_mesh = mesh_to_rhino(part.mesh)
        rhino_mesh.VertexColors.CreateMonotoneMesh(Color.FromArgb(*color))  # Apply color
        parts_geometry.append(rhino_mesh)

    # Convert frames to Rhino
        rhino_frame = frame_to_rhino(part.frame)
        parts_frame.append(rhino_frame)
        key = my_assembly.graph.number_of_nodes() - 1

# if show_connections:
#     edges = list(my_assembly.connections())
#     for e in edges:
#         part1 = my_assembly.part(e[0])
#         part2 = my_assembly.part(e[1])
#         if not hasattr(part1.frame, 'point') or not hasattr(part2.frame, 'point'):
#             print(f"Missing frame point for edge: {e}")
#             continue
#         p1 = part1.frame.point
#         p2 = part2.frame.point
#         G_connections += [rg.Line(p1[0], p1[1], p1[2], p2[0], p2[1], p2[2])]


if show_patch:
    c_max = max(my_assembly.graph.nodes_attribute(name='patch'))
    keys_in_patch = list(my_assembly.graph.nodes_where({'patch': c_max}))
    L_patch = [node for course in sorted_courses for node in course if node in keys_in_patch]

    guid = str(ghenv.Component.InstanceGuid)
    counter_key = "counter_" + guid
    running_key = "running_" + guid
    if counter_key not in st:
        st[counter_key] = 0

    if start:
        st[running_key] = True

    if stop:
        st[running_key] = False

    if step:
        if st[counter_key] < len(L_patch) - 1:
            st[counter_key] += 1

    if step_back:
        if st[counter_key] > 0:
            st[counter_key] -= 1

    if step_ten:
        if st[counter_key] < len(L_patch) - 10:
            st[counter_key] += 10

    if step_ten_back:
        if st[counter_key] > 9:
            st[counter_key] -= 10

    if reset:
        st[counter_key] = 0

    if full:
        st[counter_key] = len(L_patch) - 1

    if len(L_patch):
        patch_key = L_patch[st[counter_key]]
        print(f"Current node item: {patch_key}")

    if show_patch_until_counter:
        current_index = L_patch.index(patch_key)
        parts = L_patch[:current_index + 1]
    else:
        parts = keys_in_patch

    if show_patch_until_counter and show_keys:
        parts_keys = parts

    for key in parts:
        part = my_assembly.part(key)
        brick_type = my_assembly.graph.node_attribute(key, 'brick_type')
        color = brick_colors.get(brick_type, (128, 128, 128))  # Default to gray if type is unknown
        rhino_mesh = mesh_to_rhino(part.mesh)
        rhino_mesh.VertexColors.CreateMonotoneMesh(Color.FromArgb(*color))  
        G_patch.append(rhino_mesh)

    key = patch_key


if show_course:
    course_keys = [p for p in my_assembly.graph.nodes_where(conditions={"course": course})]
    print(f"Parts in course {course}: {course_keys}")
    for key in course_keys:
        part = my_assembly.part(key)
        #brick_type = my_assembly.graph.node_attribute(key, 'brick_type')
        rhino_mesh = mesh_to_rhino(part.mesh) 
        G_course.append(rhino_mesh)


if highlight_current_part:
    current_part = my_assembly.part(patch_key)
    current_part_key = patch_key
    current_part_geometry = mesh_to_rhino(current_part.mesh)
    current_part_frame = frame_to_rhino(current_part.frame)
    current_part_gripping_frame = frame_to_rhino(current_part.gripping_frame)
    print(current_part.__data__)


if show_place_planes:
    planned_parts_geometry = []
    # Iterate over the updated graph nodes
    for key in my_assembly.graph.nodes():
        # Retrieve the part object
        part = my_assembly.part(key)
        # Check if the part has 'place_planes' and if it's not empty
        place_frames = my_assembly.graph.node_attribute(key, 'place_frames')
        if place_frames is not None and len(place_frames) != 0:
            print(key)
            # Convert the part's mesh to Rhino geometry and add it to the list
            planned_parts_geometry.append(mesh_to_rhino(part.mesh))
    print("m{}".format(patch_key))
    if my_assembly.graph.node_attribute(patch_key, 'place_frames') is not None:
        current_part_place_frames = my_assembly.graph.node_attribute(patch_key, 'place_frames')
        current_part_place_planes = [frame_to_rhino(f) for f in current_part_place_frames]
# ---------- end visualize ----------

pln_3 = Plane(visualize.current_part_gripping_frame)

# ----
# analytical inverse kinematics
select_configuration = Slider(0, range=0..7)
analytic_inverse = Python3Script(robot=robot, lift=number_slider, plane=pln_3, idx=select_configuration)  # -> out, configuration, plane_RCF, plane_tool0_RCF; inputs plane: Plane, idx: Int32
# ---------- analytic_inverse: Python ----------
import Rhino.Geometry as rg
import math
from compas.geometry import Frame, Transformation, Rotation
from compas_robots import Configuration
from ur_fabrication_control.kinematics.ur_kinematics import inverse_kinematics
from ur_fabrication_control.kinematics.ur_params import ur_params
from compas_rhino.conversions import plane_to_compas_frame
from compas_ghpython.drawing import draw_frame

# transform frame to robot coordinate system
frame_WCF = plane_to_compas_frame(plane)
frame_RCF = robot.from_WCF_to_RCF(frame_WCF)

if robot.attached_tool:
    tool0_RCF = robot.from_tcf_to_t0cf([frame_RCF])[0]
else:
    tool0_RCF = frame_RCF

plane_tool0_RCF = draw_frame(tool0_RCF)
plane_RCS = draw_frame(frame_RCF)

# calculate solutions to frame
ur_params = ur_params["ur20"] # get the parameters according to the robot model
# print ur_params
solutions = inverse_kinematics(tool0_RCF, ur_params)
print (solutions)

if not len(solutions):
    joint_values = [0, 0, 0, 0, 0, 0]
else:
    joint_values = solutions[idx]

if len(robot.get_configurable_joints()) == 6:
    configuration = Configuration.from_revolute_values(joint_values)
else:
    configuration = Configuration.from_prismatic_and_revolute_values([lift], joint_values)

print(configuration)
# ---------- end analytic_inverse ----------

pln_4 = Plane(visualize.current_part_place_planes)
pln_5 = Plane(pln_4)

# ----
# inverse kinematics
list_6 = ValueList({"ur20", "ur20_and_liftkit"}, selected="ur20")
compute = Button()
inverse = Python3Script(robot=robot, plane=pln_5, start_configuration=draw, group=list_6, compute=compute)  # -> out, configuration
# ---------- inverse: Python ----------
"""
Calculate the robot's inverse kinematic for a given plane.

COMPAS FAB v1.0.2
"""

from compas_rhino.conversions import plane_to_compas_frame
from ghpythonlib.componentbase import executingcomponent as component
from scriptcontext import sticky as st
from compas_robots import Configuration

class InverseKinematics(component):
    def RunScript(self, robot, plane, start_configuration, group, compute):
        key = "inverse_solution"
        configuration = None
        if robot and robot.client and robot.client.is_connected and plane and compute:
            frame_WCF = plane_to_compas_frame(plane)
            frame_BCF = robot.from_WCF_to_BCF(frame_WCF)
            configuration = robot.inverse_kinematics(frame_BCF, start_configuration, group)
            st["inverse_solution"] = configuration
        configuration = st.get("inverse_solution", None)
        print(configuration)
        return configuration
# ---------- end inverse ----------

pln_6 = Plane(visualize.current_part_place_planes)
panel_14 = Panel("course 12 - patch 5")
pick_full_bcf = Plane(Plane(origin=(-0.05377338232, 0.4366206332, 0.8561647274), x=(0.9990995169, -0.01710004927, 0.03882967474), y=(-0.0313059575, -0.9148247459, 0.4026358421)))
list_7 = ValueList({"brick_insulated", "brick_air_dried", "brick_full", "brick_insulated_and_full", "all_types"}, selected="brick_full")
pick_ins_bcf_2 = Plane(Plane(origin=(-0.4715842841, -0.5072080111, 0.8561647274), x=(0.9990995169, 0.01710004927, 0.03882967474), y=(0.0313059575, -0.9148247459, -0.4026358421)))
high_mid_config = BooleanToggle(True)
pick_ins_2 = Plane(Plane(origin=(-0.307153354, -0.4222838347, 0.8633069328), x=(-0.9999666696, 0.008041761362, 0.001410583988), y=(0.007953336776, 0.920408742, 0.3908765689)))
pln_7 = Plane(visualize.current_part_place_planes)
pick_full_2 = Plane(Plane(origin=(-0.046264354, 0.4388351653, 0.8672309328), x=(0.9999481106, 0.006777534953, 0.007605339352), y=(0.003219547778, -0.9185583247, 0.39527236)))

geo = Geometry([visualize.parts_frame, visualize.current_part_frame])
geo_2 = Geometry(visualize.current_part_gripping_frame)
geo_3 = Geometry([visualize.planned_parts_geometry, visualize.G_course])
geo_4 = Geometry([visualize.current_part_geometry, visualize.G_connections])
geo_5 = Geometry(visualize.parts_geometry)
preview = CustomPreview(Geometry=geo, Material=ColourSwatch(SwatchColor=RGB(255, 125, 157)))
preview_2 = CustomPreview(Geometry=geo_4, Material=ColourSwatch(SwatchColor=RGB(204, 103, 157)))
preview_3 = CustomPreview(Geometry=geo_2, Material=ColourSwatch(SwatchColor=RGB(246, 202, 157)))
preview_4 = CustomPreview(Geometry=geo_3, Material=ColourSwatch(SwatchColor=RGBA(75, 61, 235, 75)))
geo_6 = Geometry(visualize.G_patch)

# ----
# Visualisation Dashboard
panel_15 = Panel(visualize.out)
draw_2 = Python3Script(planes=geo_2, scale=Slider(0.2, range=0..1))  # -> out, P, V, C, W; inputs planes: list of Plane
# ---------- draw_2: Python ----------
from System.Drawing import Color

red = Color.FromArgb(255, 0, 0)
green = Color.FromArgb(0, 255, 0)
blue = Color.FromArgb(0, 0, 255)

P = []
V = []
C = []

scale = float(scale)

for plane in planes:
    if not plane:
        continue
    P += [plane.Origin] * 3
    V.append(plane.XAxis * scale)
    V.append(plane.YAxis * scale)
    V.append(plane.ZAxis * scale)
    C += [red, green, blue]

W = 3
# ---------- end draw_2 ----------
vdisex = VectorDisplayEx(Point=draw_2.P, Vector=draw_2.V, Colour=draw_2.C, Width=draw_2.W)

mid_right_bcf = Plane(Tree({0}: [Plane(origin=(0.6332015451, -0.6200931378, 1.144872009), x=(-0.001354793839, -0.9999967968, -0.002137957394), y=(-0.9999985033, 0.001352489362, 0.00107896528))], {0;0;0}: [Plane(origin=(0.6332015451, -0.6200931378, 1.144872009), x=(-0.001354793839, -0.9999967968, -0.002137957394), y=(-0.9999985033, 0.001352489362, 0.00107896528))]))
pick_full_bcf_2 = Plane(pick_full_2)
pick_ins_bcf_3 = Plane(pick_ins_2)
mid_left_bcf = Plane(Tree({0}: [Plane(origin=(0.6332660845, 0.8550530018, 1.041218191), x=(-0.0008476000937, -0.9999978979, -0.001867001729), y=(-0.99999854, 0.0008448274263, 0.00148537932))], {0;0;0}: [Plane(origin=(0.6332660845, 0.8550530018, 1.041218191), x=(-0.0008476000937, -0.9999978979, -0.001867001729), y=(-0.99999854, 0.0008448274263, 0.00148537932))]))

# ----
# Get Pose Joint
get_2 = Button()
pose_2 = Python3Script(robot=robot, get=get_2)  # -> out, configuration, pose_joints
# ---------- pose_2: Python ----------
from scriptcontext import sticky as st
from ur_fabrication_control.direct_control.common import get_current_pose_joints
from compas.geometry import Frame
from compas_robots import Configuration


server_ip = st["server_ip"]
server_port = st["server_port"]
ur_port = st["ur_port"]
ur_ip = st["ur_ip"]
print(ur_ip)

guid = str(ghenv.Component.InstanceGuid)
pose_joints_key = "pose_joints" + guid

if pose_joints_key not in st:
    st[pose_joints_key] = None

# retrieve the current tool frame in axis angle format
if robot.attached_tool:
    tool_angle_axis = list(robot.attached_tool.frame.point) + list(robot.attached_tool.frame.axis_angle_vector)
else:
    tool0_frame = Frame([0, 0, 0], [1, 0, 0], [0, 1, 0])
    tool_angle_axis = list(tool0_frame.point) + list(tool0_frame.axis_angle_vector)

print(tool_angle_axis)

# send script to the robot to receive the current joint configuration
if get:
    st[pose_joints_key] = get_current_pose_joints(server_ip, server_port, ur_ip, ur_port, tool_angle_axis)

if st[pose_joints_key] is not None:
    print(st[pose_joints_key])
    configuration = Configuration.from_revolute_values(st[pose_joints_key])
    pose_joints = configuration.joint_values
"""
if pose_joints_key not in st:
    configuration = Configuration.from_revolute_values([0,0,0,0,0,0])
else:
    configuration = Configuration.from_revolute_values(st[pose_joints_key])

pose_joints = configuration.values
"""
# ---------- end pose_2 ----------
panel_16 = Panel(pose_2.pose_joints)

pline = PolyLine(Vertices=pln_7, Closed=False)
preview_5 = CustomPreview(Geometry=[pln_7, pline], Material=ColourSwatch(SwatchColor=RGB(244, 19, 161)))

set_tasks = Button()
start_fabrication = Button()

# ----
# Stop
stop_4 = Button()
stop_5 = Python3Script(stop=stop_4)  # same code as stop_2

# ----
# Rotate joint
list_8 = ValueList({"Base": 0, "Shoulder": 1, "Elbow": 2, "Wrist1": 3, "Wrist2": 4, "Wrist3": 5}, selected="Wrist3")
rotate_joint = Python3Script(robot=robot, joint=list_8, angle=Slider(-5, range=-180..180))  # -> urscript
# ---------- rotate_joint: Python ----------
import Rhino.Geometry as rg
from compas.geometry import Frame
from compas.geometry import Transformation, Rotation
from compas_rhino.conversions import plane_to_compas_frame
#from compas_ghpython import draw_frame
from ur_fabrication_control import direct_control 
import math

from scriptcontext import sticky as st
from ur_fabrication_control.direct_control.mixins import URScript, URScript_AreaGrip, URScript_ParallelGrip, URScript_Drill


# retrieve the current tool frame in axis angle format
if robot.attached_tool:
    tool_angle_axis = list(robot.attached_tool.frame.point) + list(robot.attached_tool.frame.axis_angle_vector)
else:
    tool0_frame = Frame([0, 0, 0], [1, 0, 0], [0, 1, 0])
    tool_angle_axis = list(tool0_frame.point) + list(tool0_frame.axis_angle_vector)

urscript = URScript_Drill()
urscript.start()
urscript.set_tcp(tool_angle_axis)
urscript.set_payload(4.45, [0.02, -0.019, 0.04])

urscript.rotate_joint_by_angle(joint_index=joint, angle=math.radians(angle))
# rotate_tool_by_angle(urscript, axis="z", angle=math.radians(5))
urscript.end()

urscript = urscript.generate()

print(urscript)
# ---------- end rotate_joint ----------
send = Button()
ur_send = Python3Script(urscript=rotate_joint, send=send)  # -> out; inputs urscript: String
# ---------- ur_send: Python ----------
from scriptcontext import sticky as st
from ur_fabrication_control.direct_control import send_script
import time

ur_ip = st["ur_ip"]
ur_port = st["ur_port"]

if send:
    send_script(urscript, ur_ip, ur_port)
# ---------- end ur_send ----------

rotate_with_force = Python3Script(robot=robot)  # -> urscript
# ---------- rotate_with_force: Python ----------
import Rhino.Geometry as rg
from compas.geometry import Frame
from compas.geometry import Transformation, Rotation
from compas_rhino.conversions import plane_to_compas_frame
#from compas_ghpython import draw_frame
from ur_fabrication_control import direct_control 
import math

from scriptcontext import sticky as st
from ur_fabrication_control.direct_control.mixins import URScript, URScript_AreaGrip, URScript_ParallelGrip, URScript_Drill

# retrieve the current tool frame in axis angle format
if robot.attached_tool:
    tool_angle_axis = list(robot.attached_tool.frame.point) + list(robot.attached_tool.frame.axis_angle_vector)
else:
    tool0_frame = Frame([0, 0, 0], [1, 0, 0], [0, 1, 0])
    tool_angle_axis = list(tool0_frame.point) + list(tool0_frame.axis_angle_vector)

urscript = URScript_Drill()
urscript.start()
urscript.set_tcp(tool_angle_axis)
urscript.set_payload(4.45, [0.02, -0.019, 0.04])

#urscript.rotate_force_mode(axis="x", force=15.0, speed=0.015)
urscript.force_mode([0, 0, 0, 1, 0, 0], [0.0, 0.0, 0.0, 15, 0.0, 0.0], [0.01, 0.01, 0.01, 0.015, 0.01, 0.01])
urscript.stop_by_rotation(axis="x", max_rotation=math.radians(90.0))

urscript.end()

urscript = urscript.generate()

print(urscript)
# ---------- end rotate_with_force ----------
send_2 = Button()
ur_send_2 = Python3Script(urscript=rotate_with_force, send=send_2)  # -> out; inputs urscript: String; same code as ur_send

# ----
# State viewer
trigger_2 = Trigger(Interval=1000, TimerInterval=1000, Target=[fabrication_state, vis_motion])
fabrication_state = Python3Script()  # -> out, state, num_tasks, num_current_task, num_tasks_left, log_messages
# ---------- fabrication_state: Python ----------
from scriptcontext import sticky as st

fabrication = st["fabrication"]

if hasattr(fabrication, "task_thread"):
    if fabrication.task_thread.is_alive():
        state = "THREAD RUNNING"
    else:
        state = "THREAD STOPPED"
print(fabrication.current_task_key)
num_tasks = len(fabrication.tasks)
if fabrication.current_task_key is not None:
    num_current_task = fabrication.current_task_key-1
else:
    num_current_task = 0

num_tasks_left = num_tasks-num_current_task
log_messages = fabrication.log_messages

# assembly = st["assembly"]
# ---------- end fabrication_state ----------
num_current_task = Panel(fabrication_state.num_current_task)
state = Panel(fabrication_state.state)
num_tasks = Panel(fabrication_state.num_tasks)
num_tasks_left = Panel(fabrication_state.num_tasks_left)

# ----
# Stop
stop_6 = Button()
stop_7 = Python3Script(stop=stop_6)  # same code as stop_2

# ----
# RANSAC Global registration
toggle_2 = BooleanToggle(True)
number_slider_3 = Slider(0.1, range=0..0.1)

# ----
# Localisation: Point measuring
number_slider_4 = Slider(0.25, range=0..10)
number_slider_5 = Slider(0.1, range=0..0.1)

py3_3 = Python3Script(source=measurements_source_2, target=reference_target_2, threshold=number_slider_4, compute=toggle_2)  # -> out, source_out, target_out, source_at_target, plane_out, T_RANSAC
# ---------- py3_3: Python ----------
from compas.geometry import Transformation

import open3d as o3d
import Rhino.Geometry as rg

from compas.geometry import Point, Frame
from compas_rhino.conversions import point_to_rhino, frame_to_rhino_plane

from mobile_robot_control.pointcloud_processing.ransac import preprocess_point_cloud_global, execute_global_registration2

if compute: 
    source, source_fpfh = preprocess_point_cloud_global(source, threshold)
    target, target_fpfh = preprocess_point_cloud_global(target, threshold)

    result_ransac = execute_global_registration2(source, target,
                                                source_fpfh, target_fpfh,
                                                threshold)
    print(result_ransac)

    T_RANSAC = Transformation.from_matrix(list(result_ransac.transformation))
    print(T_RANSAC)
    source_out = [rg.Point3d(*pt) for pt in source.points]
    target_out = [rg.Point3d(*pt) for pt in target.points]
    source_at_target = [point_to_rhino(Point(*pt).transformed(T_RANSAC)) for pt in source.points]
    frame_out = Frame.worldXY().transformed(T_RANSAC)
    plane_out = frame_to_rhino_plane(frame_out)
# ---------- end py3_3 ----------
panel_17 = Panel(py3_3.out)
dots = DotDisplay(Point=py3_3.target_out, Colour=ColourSwatch(SwatchColor=RGB(255, 0, 0)), Size=number_slider_3)
dots_2 = DotDisplay(Point=py3_3.source_out, Colour=ColourSwatch(SwatchColor=RGB(0, 204, 255)), Size=number_slider_3)

# ----
# ICP
toggle_3 = BooleanToggle(True)
py3_4 = Python3Script(
    source=measurements_source_2,
    target=reference_target_2,
    initial_guess=py3_3.plane_out,
    threshold=Slider(0.05, range=0..1),
    compute=toggle_3)  # -> out, source_out, target_out, source_at_target, plane_out, T_ICP
# ---------- py3_4: Python ----------
from compas.geometry import Point, Frame, Transformation
from compas_rhino.conversions import point_to_rhino, frame_to_rhino_plane
import Rhino.Geometry as rg

from mobile_robot_control.pointcloud_processing.icp import preprocess_point_cloud_icp, evaluate_local_registration, execute_icp_local_registration

# source_down = preprocess_point_cloud_icp(source, voxel_size)
# target_down = preprocess_point_cloud_icp(target, voxel_size)

trans_init, evaluation = evaluate_local_registration(source, target, threshold, initial_guess)
print(evaluation)

if compute:
    registration_icp = execute_icp_local_registration(source, target, threshold, trans_init)

    print("Inlier Fitness: ", registration_icp.fitness)
    print("Inlier RMSE: ", registration_icp.inlier_rmse)

    print("Transformation: \n", registration_icp.transformation)

source_out = [rg.Point3d(*pt) for pt in source.points]
target_out = [rg.Point3d(*pt) for pt in target.points]
T_ICP = Transformation.from_matrix(list(registration_icp.transformation))
source_at_target = [point_to_rhino(Point(*pt).transformed(T_ICP)) for pt in source.points]
frame_out = Frame.worldXY().transformed(T_ICP)
plane_out = frame_to_rhino_plane(frame_out)
# ---------- end py3_4 ----------
panel_18 = Panel(py3_4.out)

dots_3 = DotDisplay(Point=py3_3.source_at_target, Colour=ColourSwatch(SwatchColor=RGB(255, 144, 0)), Size=number_slider_3)
dots_4 = DotDisplay(Point=py3_4.source_out, Colour=ColourSwatch(SwatchColor=RGB(0, 204, 255)), Size=number_slider_5)
dots_5 = DotDisplay(Point=py3_4.target_out, Colour=ColourSwatch(SwatchColor=RGB(255, 0, 0)), Size=number_slider_5)
dots_6 = DotDisplay(Point=py3_4.source_at_target, Colour=ColourSwatch(SwatchColor=RGB(255, 144, 0)), Size=number_slider_5)

# ----
# Measured RCF
# (robot plane)
pln_8 = Plane(py3_4.plane_out)

# ----
# Move mobile robot base
# "Set to measured RCF", after point measurement localisation is done!
list_9 = ValueList({"origin", "set_to_BCF", "set_to_RCF", "set_to_measured_RCF", "set_from_json"}, selected="set_from_json")
origin = Point(Point(12.58862168, -0.8453053985, -0.15))
angle = Slider(90, range=0..360)
plane = Python3Script(origin=origin, angle=angle)  # -> plane; inputs origin: Point3d
# ---------- plane: Python ----------
import Rhino.Geometry as rg
import math

plane = rg.Plane(origin, rg.Vector3d.XAxis, rg.Vector3d.YAxis)
plane.Rotate(math.radians(angle), rg.Vector3d.ZAxis)
# ---------- end plane ----------
set_frame = Python3Script(robot=robot, set_frame_to=list_9, target_BCF=plane, target_RCF=plane, measured_RCF=pln_8, json_BCF=py3_2.BCF)  # -> bang; inputs target_BCF: Plane, target_RCF: Plane
# ---------- set_frame: Python ----------
from compas.geometry import Frame, Point, Vector, Transformation
from compas.datastructures import Mesh
from compas_fab.robots import CollisionMesh
from compas_rhino.conversions import plane_to_compas_frame

if set_frame_to == "set_to_BCF":
    BCF = plane_to_compas_frame(target_BCF)
elif set_frame_to == "set_to_RCF":
    RCF = plane_to_compas_frame(target_RCF)
    BCF = robot.transform_frame_from_RCF_to_BCF(RCF)
elif set_frame_to == "set_to_measured_RCF":
    RCF = plane_to_compas_frame(measured_RCF)
    BCF = robot.transform_frame_from_RCF_to_BCF(RCF)
elif set_frame_to == "set_from_json":
    BCF = plane_to_compas_frame(json_BCF)
    print("test")
else:
    BCF = Frame.worldXY()

if robot:
    robot.BCF = BCF
# ---------- end set_frame ----------

# ----
# BCF from RCF (measured)
py3_5 = Python3Script(robot=robot, lift=lift_height_at_measuring, robot_plane=pln_8)  # -> out, RCF, RCF0, BCF, RCP, robot_BCP; inputs lift: Double, robot_plane: Plane
# ---------- py3_5: Python ----------
from compas.geometry import Transformation, Translation
from compas.geometry import Frame, Vector
from compas_rhino.conversions import plane_to_compas_frame, frame_to_rhino_plane

import ghpythonlib.components as ghcomp
import Rhino.Geometry as rg


#### This was annoying....
# Frames are always transforming in Global worldXY, if you want the transformation locally, this is the way >>>

## Normal RCF (no lift)
RCF0 = robot.RCF 
## Adjusted RCF (with lift)
RCF = robot.RCF.translated([0,0,lift])

## Convert measured plane to COMPAS
robot_frame = plane_to_compas_frame(robot_plane)

''' OPTION A'''
## Get the BCF in local coordinates from RCF
# base = RCF.to_local_coordinates(Frame.worldXY())
## Get the BCF at the measured plane
# BCF = robot_frame.to_world_coordinates(base)

''' OPTION B'''
# Transformation of the RCF to the measured plane (also RCF)
T = Transformation.from_frame_to_frame(RCF, robot_frame)
# Transforming the robot_footprint(worldxy)
BCF = Frame.worldXY().transformed(T)

## Visualisation
RCP = frame_to_rhino_plane(RCF)
robot_BCP = frame_to_rhino_plane(BCF)
# ---------- end py3_5 ----------
pln_9 = Plane(py3_5.robot_BCP)
pln_10 = Plane(py3_5.RCP)
save_json = Python3Script(
    RCF=py3_5.RCF,
    RCF0=py3_5.RCF0,
    BCF=py3_5.BCF,
    lift_height=lift_height_at_measuring,
    filepath=savedirectory.DIR,
    save=Button())  # -> out, a; inputs lift_height: Double
# ---------- save_json: Python ----------
import os
import math
import datetime
from compas.data import Data
from compas_rhino.conversions import plane_to_compas_frame
today = datetime.date.today()

lift = int(round(lift_height*1000, ndigits=0))
print(lift)
if save:
    rcf_filepath = os.path.join(filepath, f"RCF_lh{lift}{suffix}_{today}.json")
    rcf0_filepath = os.path.join(filepath, f"RCF0_lh{lift}{suffix}_{today}.json")
    bcf_filepath = os.path.join(filepath, f"BCF_lh{lift}{suffix}_{today}.json")
    RCF.to_json(rcf_filepath, pretty=True)
    RCF0.to_json(rcf0_filepath, pretty=True)
    BCF.to_json(bcf_filepath, pretty=True)
# ---------- end save_json ----------

# ----
# Visualisation
show_eef = BooleanToggle(True)
show_frames = BooleanToggle(True)
show_visual = BooleanToggle(True)
show_collision = BooleanToggle(False)
show_attached_collision = BooleanToggle(True)
show_bcf = BooleanToggle(True)

# ----
# Option 2: Pre-planning
list_10 = ValueList({"Plan for course": 0, "Plan for one brick": 1, "Execute pick and place for one brick": 2}, selected="Plan for one brick")  # disabled
number_slider_6 = Slider(0.1, range=0..0.5)  # disabled
radius = Slider(0.001, range=0..0.5)  # disabled
number_slider_7 = Slider(0, range=0..40)  # disabled
motion_validation = BooleanToggle(True)  # disabled
pick_full_bcf_3 = Plane(Plane(origin=(-0.05377338232, 0.4366206332, 0.8561647274), x=(0.9990995169, -0.01710004927, 0.03882967474), y=(-0.0313059575, -0.9148247459, 0.4026358421)))  # disabled
pick_ins_bcf_4 = Plane(Plane(origin=(-0.4715842841, -0.5072080111, 0.8561647274), x=(0.9990995169, 0.01710004927, 0.03882967474), y=(0.0313059575, -0.9148247459, -0.4026358421)))  # disabled
panel_19 = Panel(visualize.current_part_key)  # disabled
toggle_4 = GroupToggle(ToggleActive=True, ToggleVisible=False)  # disabled

# ----
# Move Joints
list_11 = ValueList({"send forward configuration": 0, "send ik configuration": 1, "send analytic ik config": 2, "send one motion configuration": 3, "send all motion configurations": 4}, selected="send ik configuration")
send_3 = Button()

# ----
# Move Cartesian
list_12 = ValueList({"send one cartesian position": 0, "send all cartesian positions": 1}, selected="send all cartesian positions")
radius_2 = Slider(0, range=0..0.5)
send_4 = Button()

# ----
# Plan motion
# Sometimes there is an error in this block. Solution is to make goal_constrints an item, then a list again, then run the code. Funky error.
list_13 = ValueList({"ur20", "ur20_and_liftkit"}, selected="ur20")
compute_2 = Button()
save = Button()
toggle_5 = GroupToggle(ToggleActive=True, ToggleVisible=False)  # disabled

# ----
# Fabrication manager
init_2 = Button()
fabrication = Python3Script(init=init_2)  # -> fabrication
# ---------- fabrication: Python ----------
from scriptcontext import sticky as st
from fabrication_manager.fabrication import FabricationManager
from assembly_information_model.assembly import Assembly
import os

server_ip = st["server_ip"]
server_port = st["server_port"]

if init_:
    path = os.path.abspath(os.path.join(ghdoc.Path,"../../../data/fabrication_logs"))
    print(path)
    fabrication = FabricationManager((server_ip, server_port))
    fabrication.path = path
    st["fabrication"] = fabrication

fabrication = st["fabrication"]
# ---------- end fabrication ----------
reset_task = Button()
next_task = Button()
prev_task = Button()
reset_2 = Button()
data = Data(fabrication_state.log_messages)

tasks = Python3Script(
    routine=list_10,
    robot=robot,
    fabrication=fabrication,
    assembly=transform_assembly.assembly,
    scene=scene,
    velocity=number_slider_6,
    radius=radius,
    brick_key=panel_19,
    course=number_slider_7,
    pick_plane_full_WCF=pick_full_bcf_3,
    pick_plane_ins_WCF=pick_ins_bcf_4,
    motion_validation=motion_validation,
    DATA=path_3.DATA)  # -> tasks, safe_place_plane, safe_pick_plane_full, safe_pick_plane_ins, mid_config, place_safety; inputs brick_key: Int32, course: Int32; disabled
# ---------- tasks: Python ----------
from fabrication_manager.task import Task
from mobile_robot_control.fabrication import MoveJointsTask, MoveLinearTask, MotionPlanFrameTask, ExecuteMotionTask, MotionPlanConfigurationTask
from ur_fabrication_control.direct_control.fabrication import URTask
import Rhino.Geometry as rg
from compas.geometry import Frame, Transformation, Rotation, Vector, Translation, Box
from compas.geometry import Sphere, Circle, Frame, Translation, Rotation, Vector, cross_vectors, Point
from compas_rhino.conversions import sphere_to_rhino, circle_to_rhino, point_to_rhino, frame_to_rhino_plane
from compas_rhino.conversions import plane_to_compas_frame, frame_to_rhino_plane
#from compas_ghpython import draw_frame
from compas_robots import Configuration
from ur_fabrication_control import direct_control 
import math
import os
import time
from scriptcontext import sticky as st
from ur_fabrication_control.direct_control.mixins import URScript, URScript_AreaGrip, URScript_ParallelGrip, URScript_Drill

ur_ip = st['ur_ip']
ur_port = st['ur_port']
robot_address = (ur_ip, ur_port)

print("Brick key is: {}".format(brick_key))

real_configuration = robot.mobile_client.get_current_configuration()
real_lift_height = real_configuration.joint_values[0]
print("Real lift height: {}".format(real_lift_height))

# Pick frames:
pick_safety = 0.2

# full bricks:
pick_frame_full_BCF = plane_to_compas_frame(pick_plane_full_WCF)
safe_pick_frame_full_BCF = pick_frame_full_BCF.transformed(Translation.from_vector(-pick_frame_full_BCF.zaxis * pick_safety))

pick_frame_full_WCF = robot.from_BCF_to_WCF(pick_frame_full_BCF)
safe_pick_frame_full_WCF = robot.from_BCF_to_WCF(safe_pick_frame_full_BCF)
safe_pick_plane_full = frame_to_rhino_plane(safe_pick_frame_full_WCF)

# insulated bricks:
pick_frame_ins_BCF = plane_to_compas_frame(pick_plane_ins_WCF)
safe_pick_frame_ins_BCF = pick_frame_ins_BCF.transformed(Translation.from_vector(-pick_frame_ins_BCF.zaxis * pick_safety))

pick_frame_ins_WCF = robot.from_BCF_to_WCF(pick_frame_ins_BCF)
safe_pick_frame_ins_WCF = robot.from_BCF_to_WCF(safe_pick_frame_ins_BCF)
safe_pick_plane_ins = frame_to_rhino_plane(safe_pick_frame_ins_WCF)

# Place frames:
current_part = assembly.part(brick_key)
place_frame_WCF = current_part.gripping_frame
place_safety = 0.15
safe_place_frame_WCF = place_frame_WCF.transformed(Translation.from_vector(-place_frame_WCF.zaxis * place_safety))
safe_place_plane = frame_to_rhino_plane(safe_place_frame_WCF)

# Middle configuration: This is where the placement will start from. (Change, if necessary)
mid_config = Configuration((real_lift_height, -2.186, -1.048, 2.170, -2.693, -1.571, 0.955), (2, 0, 0, 0, 0, 0, 0))
high_mid_config = Configuration((real_lift_height, -2.190, -1.474, 1.042, -1.139, -1.569, 0.953), (2, 0, 0, 0, 0, 0, 0)) # maybe use this if place frame is higher.

# Payloads: (Check if correct)
no_brick_payload = 5.6
with_brick_payload = no_brick_payload + 3.0
CoG = [0.005, -0.022, 0.072]

# .transformed(Translation.from_vector(Vector.Zaxis() * real_lift_height))

# Questions:
# Do we want to add a task to attach gripper again just in case?


class MoveJointsTask(URTask):
    def __init__(
        self,
        robot,
        robot_address,
        configuration,
        velocity=0.10,
        radius=0.1,
        payload=0.0,
        CoG=[0.0, 0.0, 0.0],
        key=None,
    ):
        super(MoveJointsTask, self).__init__(robot, robot_address, key)
        self.configuration = configuration
        self.velocity = velocity
        self.radius = radius
        self.payload = payload
        self.CoG = CoG

    def create_urscript(self):
        self.urscript.set_payload(self.payload, self.CoG)
        self.urscript.add_line('textmsg(">> TASK{}.")'.format(self.key))

        joint_configurations = []

        if type(self.configuration) == list:
            for configuration in self.configuration:
                joint_configurations.append(Configuration.from_revolute_values(configuration.revolute_values))
        else:
            joint_configurations.append(Configuration.from_revolute_values(self.configuration.revolute_values))
        
        for joint_configuration in joint_configurations:
            self.urscript.move_joint(joint_configuration, self.velocity, self.radius)

        self.log("Going to set configuration {}.".format(self.configuration))

tasks = []

key_ = 0



pick_tasks = [
                MoveJointsTask(robot, robot_address, mid_config, velocity=velocity, radius=radius, payload=no_brick_payload, CoG=CoG, key=key_),
                ]

tasks += pick_tasks
    # key_ = key_+ 7


    # tasks += place_tasks

print(tasks)
# ---------- end tasks ----------
pln_11 = Plane(tasks.safe_pick_plane_ins)  # disabled
pln_12 = Plane(tasks.safe_pick_plane_full)  # disabled
pln_13 = Plane(tasks.safe_place_plane)  # disabled

# ----
# Option 2: Pre-planning
list_14 = ValueList({"Plan for course": 0, "Plan for one brick": 1, "Execute pick and place for one brick": 2, "Execute pick and place for one course": 3, "Execute pick and place without planning": 4, "Execute pick and place without planning and with mid planes": 5}, selected="Execute pick and place without planning and with mid planes")
radius_3 = Slider(0.03, range=0..0.5)
motion_validation_2 = BooleanToggle(False)
panel_20 = Panel(visualize.current_part_key)
tasks_2 = Python3Script(
    routine=list_14,
    robot=robot,
    fabrication=fabrication,
    assembly=transform_assembly.assembly,
    scene=scene,
    velocity=Slider(0.15, range=0..1),
    radius=radius_3,
    brick_key=panel_20,
    brick_type=list_7,
    brick_in_course="0",
    course=Slider(20, range=0..40),
    pick_plane_full_WCF=pick_full_bcf_2,
    pick_plane_ins_WCF=pick_ins_bcf_3,
    mid_config_high=high_mid_config,
    mid_left_plane_BCF=mid_left_bcf,
    mid_right_plane_BCF=mid_right_bcf,
    motion_validation=motion_validation_2,
    DATA=path_3.DATA)  # -> tasks, safe_place_plane, safe_pick_plane_full, safe_pick_plane_ins, mid_left_plane_WCF, mid_right_plane_WCF, mid_config, place_safety, selected_brick_key, selected_brick_frame; inputs brick_key: Int32, brick_type: String, brick_in_course: Int32, course: Int32
# ---------- tasks_2: Python ----------
from fabrication_manager.task import Task
from mobile_robot_control.fabrication import MoveJointsTask, MoveLinearTask, MotionPlanFrameTask, ExecuteMotionTask, MotionPlanConfigurationTask
from ur_fabrication_control.direct_control.fabrication import URTask
import Rhino.Geometry as rg
from compas.geometry import Frame, Transformation, Rotation, Vector, Translation, Box
from compas.geometry import Sphere, Circle, Frame, Translation, Rotation, Vector, cross_vectors, Point
from compas_rhino.conversions import sphere_to_rhino, circle_to_rhino, point_to_rhino
from compas_rhino.conversions import plane_to_compas_frame, frame_to_rhino_plane
#from compas_ghpython import draw_frame
from compas_robots import Configuration
from ur_fabrication_control import direct_control 
import math
import os
import time
from scriptcontext import sticky as st
from ur_fabrication_control.direct_control.mixins import URScript, URScript_AreaGrip, URScript_ParallelGrip, URScript_Drill

ur_ip = st['ur_ip']
ur_port = st['ur_port']
robot_address = (ur_ip, ur_port)

print("Brick key is: {}".format(brick_key))

real_configuration = robot.mobile_client.get_current_configuration()
real_lift_height = real_configuration.joint_values[0]
print("Real lift height: {}".format(real_lift_height))

# Pick frames:
pick_safety = 0.4

# full bricks:
pick_frame_full_BCF = plane_to_compas_frame(pick_plane_full_WCF)
safe_pick_frame_full_BCF = pick_frame_full_BCF.transformed(Translation.from_vector(-pick_frame_full_BCF.zaxis * pick_safety))

pick_frame_full_WCF = robot.from_BCF_to_WCF(pick_frame_full_BCF)
safe_pick_frame_full_WCF = robot.from_BCF_to_WCF(safe_pick_frame_full_BCF)
safe_pick_plane_full = frame_to_rhino_plane(safe_pick_frame_full_WCF)

# insulated bricks:
pick_frame_ins_BCF = plane_to_compas_frame(pick_plane_ins_WCF)
safe_pick_frame_ins_BCF = pick_frame_ins_BCF.transformed(Translation.from_vector(-pick_frame_ins_BCF.zaxis * pick_safety))

pick_frame_ins_WCF = robot.from_BCF_to_WCF(pick_frame_ins_BCF)
safe_pick_frame_ins_WCF = robot.from_BCF_to_WCF(safe_pick_frame_ins_BCF)
safe_pick_plane_ins = frame_to_rhino_plane(safe_pick_frame_ins_WCF)

# Place frames:
print(brick_key)
current_part = assembly.part(brick_key)
print(current_part.key) # ???
print([p for p in assembly.graph.nodes_where({'part':current_part})])

place_frame_WCF = current_part.gripping_frame
place_safety = 0.17 #0.15
safe_place_frame_WCF = place_frame_WCF.transformed(Translation.from_vector(-place_frame_WCF.zaxis * place_safety))
safe_place_plane = frame_to_rhino_plane(safe_place_frame_WCF)

# Middle configuration: This is where the placement will start from. (Change, if necessary)
if assembly.graph.node_attribute(brick_key, 'brick_type') == 'brick_insulated':
    mid_config = Configuration((real_lift_height, -4.472, -1.346, 2.435, -2.657, -1.574, -1.330), (2, 0, 0, 0, 0, 0, 0))
    high_mid_config = Configuration((real_lift_height, -4.471, -1.803, 1.752, -1.517, -1.573, -1.328), (2, 0, 0, 0, 0, 0, 0)) # maybe use this if place frame is higher.
else:
    mid_config = Configuration((real_lift_height, -2.186, -1.048, 2.170, -2.693, -1.571, 0.955), (2, 0, 0, 0, 0, 0, 0))
    high_mid_config = Configuration((real_lift_height, -2.190, -1.474, 1.042, -1.139, -1.569, 0.953), (2, 0, 0, 0, 0, 0, 0)) # maybe use this if place frame is higher.

if mid_config_high:
    mid_config = high_mid_config

# Payloads: (Check if correct)
no_brick_payload = 3.58
CoG = [0.0, 0.0, 0.0]

# .transformed(Translation.from_vector(Vector.Zaxis() * real_lift_height))

class ForcePickPlaceTask(URTask):
    def __init__(self, robot, robot_address, assembly, brick_key, pick=True, payload=5.6, CoG=[0.005, -0.022, 0.072], velocity=0.1, radius=0.0, key=None):
        super(ForcePickPlaceTask, self).__init__(robot, robot_address, key)
        self.robot = robot
        self.robot_address = robot_address
        self.pick = pick
        self.assembly = assembly
        self.brick_key = brick_key
        self.payload = payload
        self.CoG = CoG
        self.velocity = velocity
        self.radius = radius

    def urscript_fabrication_header(self):
        ## Initialize instance
        self.urscript = URScript_ParallelGrip(*self.robot_address)
        self.urscript.start()
        
        if self.robot:
            ## Set tool
            tool = self.robot.attached_tool
            self.urscript.set_tcp(list(tool.frame.point)+list(tool.frame.axis_angle_vector))
        self.urscript.textmessage(">> TASK {}".format(self.key), string=True)
        
        if self.server:
            self.urscript.set_socket(self.server.ip, self.server.port, self.server.name)
            self.urscript.socket_open(self.server.name)
            ## Send script received msg
            self.urscript.socket_send_line_string(self.rec_msg, self.server.name)
                
    def create_urscript(self):
        if self.pick:
            self.log("Picking started!")
            self.urscript.set_payload(self.payload, self.CoG)
            self.urscript.parallelgrip_open()
        else:
            self.log("Placing started!")
            self.urscript.set_payload(self.payload + 3.0, self.CoG)
            self.urscript.parallelcurrentgrip_close()

        self.urscript.add_line("\tsleep({})".format(1.0))

        self.urscript.move_force_mode(force_z=40.0, speed_z=0.02)
        self.urscript.stop_by_force(35.0)

        if self.pick:
            self.urscript.parallelgrip_close()
            self.urscript.set_payload(self.payload + 3.0, self.CoG)
        else:
            self.urscript.parallelgrip_open()
            self.urscript.set_payload(self.payload, self.CoG)
        
        self.urscript.move_tool_by_distance(z_distance=-0.2, velocity=self.velocity, radius=self.radius)

class PlaceTask(URTask):
    def __init__(self, robot, robot_address, place_frame_WCF, velocity=0.10, radius=0.0, payload=5.6, CoG=[0.0, 0.0, 0.0], key=None):
        super(PlaceTask, self).__init__(robot, robot_address, key)
        self.robot = robot
        self.robot_address = robot_address
        self.place_frame_WCF = place_frame_WCF
        self.velocity = velocity
        self.radius = radius
        self.payload = payload
        self.CoG = CoG

    def urscript_fabrication_header(self):
        ## Initialize instance
        self.urscript = URScript_ParallelGrip(*self.robot_address)
        self.urscript.start()
        
        if self.robot:
            ## Set tool
            tool = self.robot.attached_tool
            self.urscript.set_tcp(list(tool.frame.point)+list(tool.frame.axis_angle_vector))
        self.urscript.textmessage(">> TASK {}".format(self.key), string=True)
        
        if self.server:
            self.urscript.set_socket(self.server.ip, self.server.port, self.server.name)
            self.urscript.socket_open(self.server.name)
            ## Send script received msg
            self.urscript.socket_send_line_string(self.rec_msg, self.server.name)
                
    def create_urscript(self):
        place_frame_RCF = self.robot.from_WCF_to_RCF(self.place_frame_WCF)

        self.log("Placing started!")
        self.urscript.set_payload(self.payload, self.CoG)

        self.urscript.add_line("\tsleep({})".format(7.0))
        # self.urscript.move_linear(place_frame_RCF, velocity=self.velocity, radius=self.radius)
        self.urscript.move_linear(place_frame_RCF, velocity=0.08, radius=0.0)

        self.urscript.add_line("\tsleep({})".format(3.0))

        self.urscript.parallelgrip_open()
        
        # set payload after releasing the brick
        self.urscript.set_payload(no_brick_payload, self.CoG)

        final_distance_up = 0.30
        self.urscript.move_tool_by_distance(z_distance=-final_distance_up, velocity=self.velocity, radius=0.0)

class MoveJointsTask(URTask):
    def __init__(
        self,
        robot,
        robot_address,
        configuration,
        velocity=0.10,
        radius=0.1,
        payload=0.0,
        CoG=[0.0, 0.0, 0.0],
        key=None,
    ):
        super(MoveJointsTask, self).__init__(robot, robot_address, key)
        self.configuration = configuration
        self.velocity = velocity
        self.radius = radius
        self.payload = payload
        self.CoG = CoG

    def create_urscript(self):
        self.urscript.set_payload(self.payload, self.CoG)
        self.urscript.add_line('textmsg(">> TASK{}.")'.format(self.key))

        joint_configurations = []

        if type(self.configuration) == list:
            for configuration in self.configuration:
                joint_configurations.append(Configuration.from_revolute_values(configuration.revolute_values))
        else:
            joint_configurations.append(Configuration.from_revolute_values(self.configuration.revolute_values))
        
        for joint_configuration in joint_configurations:
            self.urscript.move_joint(joint_configuration, self.velocity, self.radius)

        self.log("Going to set configuration {}.".format(self.configuration))

class SaveMotionPlantoAssembly(Task):
    def __init__(self, fabrication, assembly, motiontask_key, brick_key, key=None):
        super(SaveMotionPlantoAssembly, self).__init__(key)
        self.fabrication = fabrication
        self.motiontask_key = motiontask_key
        self.brick_key = brick_key
        self.assembly = assembly
        
    def run(self, stop_thread):
        self.log('Saving configurations for brick {}.'.format(self.brick_key))

        motionplan_task = self.fabrication.get_task_by_key(self.motiontask_key)

        configurations = motionplan_task.results.get("configurations")
        self.assembly.graph.node_attribute(self.brick_key, 'place_configs', configurations)

        planes = motionplan_task.results.get("planes")
        frames = [plane_to_compas_frame(plane) for plane in planes]
        self.assembly.graph.node_attribute(self.brick_key, 'place_frames', frames)
        
        self.is_completed = True
        return True

# I created an attempt amount in this motion plan task.
class MotionPlanFrameTask(Task):
    def __init__(
        self,
        robot,
        frame_WCF,
        start_configuration,
        group="ur20",
        tolerance_position=0.001,
        tolerance_xaxis=1.0,
        tolerance_yaxis=1.0,
        tolerance_zaxis=1.0,
        attached_collision_meshes=None,
        path_constraints=None,
        planner_id="RRTConnect",
        validation=True,
        attempts=5,
        key=None,
    ):
        super(MotionPlanFrameTask, self).__init__(key)
        self.robot = robot
        self.group = group
        self.frame_WCF = frame_WCF
        self.start_configuration = start_configuration

        self.tolerance_position = tolerance_position
        self.tolerances_axes = [
                math.radians(tolerance_xaxis),
                math.radians(tolerance_yaxis),
                math.radians(tolerance_zaxis),
            ]

        self.path_constraints = path_constraints
        self.attached_collision_meshes = attached_collision_meshes
        self.planner_id = planner_id

        self.trajectory = None
        self.results = {
            "configurations": [],
            "planes": [],
            "positions": [],
            "velocities": [],
            "accelerations": [],
        }

        self.validation = validation
        self.replan = False
        self.approved = False
        self.attempts = attempts

    def run(self, stop_thread):
        
        frame_BCF = self.robot.from_WCF_to_BCF(self.frame_WCF)
        goal_constraints = self.robot.constraints_from_frame(
            frame_BCF, 
            self.tolerance_position, 
            self.tolerances_axes, 
            self.group)

        self.log("Planning trajectory...")
        
        attempted = 0

        while not stop_thread():
            # Clean trajectory.
            self.replan = False
            self.trajectory = None
            self.results = {
                "configurations": [],
                "planes": [],
                "positions": [],
                "velocities": [],
                "accelerations": [],
                }

            try:
                self.trajectory = self.robot.plan_motion(
                    goal_constraints,
                    start_configuration=self.start_configuration,
                    group=self.group,
                    options=dict(
                        attached_collision_meshes=self.attached_collision_meshes,
                        path_constraints=self.path_constraints,
                        planner_id=self.planner_id,
                    ),
                )
            except:
                self.log("No solution at attempt {}.".format(attempted))

            if self.trajectory is None:
                if attempted < self.attempts:
                    attempted += 1
                    continue
                else:
                    break

            if self.trajectory is not None:
                self.log("Trajectory found at {}.".format(self.trajectory))
                for c in self.trajectory.points:
                    config = self.robot.merge_group_with_full_configuration(
                        c, self.trajectory.start_configuration, self.group
                    )
                    joint_names_ordered = [
                        "robot_ewellix_lift_top_joint",
                        "robot_arm_shoulder_pan_joint",
                        "robot_arm_shoulder_lift_joint",
                        "robot_arm_elbow_joint",
                        "robot_arm_wrist_1_joint",
                        "robot_arm_wrist_2_joint",
                        "robot_arm_wrist_3_joint",
                    ]
                    joint_values_ordered = [
                        config.joint_values[config.joint_names.index(joint_name)]
                        for joint_name in joint_names_ordered
                    ]
                    joint_types_ordered = [
                        config.joint_types[config.joint_names.index(joint_name)]
                        for joint_name in joint_names_ordered
                    ]
                    mobile_robot_config = Configuration(
                        joint_values_ordered, joint_types_ordered, joint_names_ordered
                    )
                    self.results["configurations"].append(mobile_robot_config)

                    frame_t = self.robot.forward_kinematics(
                        c, self.group, options=dict(solver="model")
                    )
                    self.results["planes"].append(
                        frame_to_rhino_plane(
                            self.robot.from_BCF_to_WCF(frame_t)
                        )
                    )
                    self.results["positions"].append(c.positions)
                    self.results["velocities"].append(c.velocities)
                    self.results["accelerations"].append(c.accelerations)

                if self.validation:
                    # Wait until trajectory is approved or replan is requested.
                    while not stop_thread():
                        time.sleep(0.1)
                        if self.approved == True or self.replan == True:
                            break
                    # Break if trajectory is approved.
                    if self.approved == True:
                        break
                    time.sleep(0.1)
                else:
                    break
                
        self.is_completed = True
        return True

tasks = []

key_ = 0

if routine == 0:
    course_keys = [p for p in assembly.graph.nodes_where(conditions={"course": course})]
    print(course_keys)

    for brick_key_in_course in course_keys:
        p = assembly.part(brick_key_in_course)
        place_frame_WCF = p.gripping_frame
        safe_place_frame_WCF = place_frame_WCF.transformed(Translation.from_vector(-place_frame_WCF.zaxis * place_safety))
        
        if assembly.graph.node_attribute(brick_key_in_course, 'brick_type') == 'brick_insulated':
            mid_config_in_course = Configuration((real_lift_height, -4.472, -1.346, 2.435, -2.657, -1.574, -1.330), (2, 0, 0, 0, 0, 0, 0))
            high_mid_config_in_course = Configuration((real_lift_height, -4.471, -1.803, 1.752, -1.517, -1.573, -1.328), (2, 0, 0, 0, 0, 0, 0)) # maybe use this if place frame is higher.
        else:
            mid_config_in_course = Configuration((real_lift_height, -2.186, -1.048, 2.170, -2.693, -1.571, 0.955), (2, 0, 0, 0, 0, 0, 0))
            high_mid_config_in_course = Configuration((real_lift_height, -2.190, -1.474, 1.042, -1.139, -1.569, 0.953), (2, 0, 0, 0, 0, 0, 0)) # maybe use this if place frame is higher.
        
        plan_tasks = [
                MotionPlanFrameTask(robot, frame_WCF=safe_place_frame_WCF, start_configuration=mid_config_in_course, group="ur20", validation=motion_validation, attempts=8, key=key_),
                SaveMotionPlantoAssembly(fabrication, assembly, motiontask_key=key_, brick_key=brick_key_in_course, key=key_+1)
                ]
        tasks += plan_tasks
        key_ = key_+ 2

elif routine == 1:
    plan_tasks = [
            MotionPlanFrameTask(robot, frame_WCF=safe_place_frame_WCF, start_configuration=mid_config, group="ur20", validation=motion_validation, attempts=8, key=key_),
            SaveMotionPlantoAssembly(fabrication, assembly, motiontask_key=key_, brick_key=brick_key, key=key_+1)
            ]
    tasks += plan_tasks

elif routine == 2:
    if assembly.graph.node_attribute(brick_key, 'place_configs') is not None:
        place_configs = assembly.graph.node_attribute(brick_key, 'place_configs')
    else:
        place_configs = []
    reverse_place_configs = place_configs[::-1]
    print(place_configs)

    if assembly.graph.node_attribute(brick_key, 'brick_type') == 'brick_insulated':
        safe_pick_frame_WCF = safe_pick_frame_ins_WCF
        with_brick_payload = no_brick_payload + 2.35
    else:
        safe_pick_frame_WCF = safe_pick_frame_full_WCF
        with_brick_payload = no_brick_payload + 4.4

    pick_tasks = [
                    MoveJointsTask(robot, robot_address, mid_config, velocity=velocity, radius=0, payload=no_brick_payload, CoG=CoG, key=key_+0),
                    MoveLinearTask(robot, robot_address, safe_pick_frame_WCF, in_RCF=False, velocity=velocity, radius=0, payload=no_brick_payload, key=key_+1),
                    ForcePickPlaceTask(robot, robot_address, assembly, brick_key, pick=True, payload=no_brick_payload, velocity=velocity, radius=0, key=key_+2),
                    MoveJointsTask(robot, robot_address, mid_config, velocity=velocity, radius=0, payload=with_brick_payload, CoG=CoG, key=key_+3),
                    ]

    tasks += pick_tasks
    key_ = key_+ 4

    place_tasks = [
                    MoveJointsTask(robot, robot_address, place_configs, velocity=velocity, radius=radius, payload=with_brick_payload, CoG=CoG, key=key_),
                    MoveLinearTask(robot, robot_address, safe_place_frame_WCF, in_RCF=False, velocity=velocity, radius=0.0, payload=with_brick_payload, key=key_+1),
                    PlaceTask(robot, robot_address, place_frame_WCF, velocity=velocity/10, radius=radius, payload=with_brick_payload, CoG=CoG, key=key_+2),
                    # MoveJointsTask(robot, robot_address, reverse_place_configs, velocity=velocity, radius=radius, payload=no_brick_payload, CoG=CoG, key=key_+3),
                    ]

    tasks += place_tasks


elif routine == 3:
    course_keys = [p for p in assembly.graph.nodes_where(conditions={"course": course})]
    if brick_type == 'all_types':
        selected_keys = course_keys
    elif brick_type == "brick_insulated_and_full":
        selected_keys = [key for key in course_keys if assembly.graph.node_attribute(key, 'brick_type') != "brick_air_dried"]
    else:
        selected_keys = [key for key in course_keys if assembly.graph.node_attribute(key, 'brick_type') == brick_type]
    selected_keys = selected_keys[brick_in_course:]
    print("selected_keys:", selected_keys)

    for brick_key_in_course in selected_keys:
        if assembly.graph.node_attribute(brick_key_in_course, 'place_configs') is not None:
            place_configs_in_course = assembly.graph.node_attribute(brick_key_in_course, 'place_configs')
        else:
            place_configs_in_course = []
        reverse_place_configs_in_course = place_configs_in_course[::-1]

        if assembly.graph.node_attribute(brick_key_in_course, 'brick_type') == 'brick_insulated':
            safe_pick_frame_WCF = safe_pick_frame_ins_WCF
            with_brick_payload = no_brick_payload + 2.35
        else:
            safe_pick_frame_WCF = safe_pick_frame_full_WCF
            with_brick_payload = no_brick_payload + 4.4
        
        if assembly.graph.node_attribute(brick_key_in_course, 'brick_type') == 'brick_insulated':
            mid_config_in_course = Configuration((real_lift_height, -4.472, -1.346, 2.435, -2.657, -1.574, -1.330), (2, 0, 0, 0, 0, 0, 0))
            high_mid_config_in_course = Configuration((real_lift_height, -4.471, -1.803, 1.752, -1.517, -1.573, -1.328), (2, 0, 0, 0, 0, 0, 0)) # maybe use this if place frame is higher.
        else:
            mid_config_in_course = Configuration((real_lift_height, -2.186, -1.048, 2.170, -2.693, -1.571, 0.955), (2, 0, 0, 0, 0, 0, 0))
            high_mid_config_in_course = Configuration((real_lift_height, -2.190, -1.474, 1.042, -1.139, -1.569, 0.953), (2, 0, 0, 0, 0, 0, 0)) # maybe use this if place frame is higher.
        
        if mid_config_high:
            mid_config_in_course = high_mid_config_in_course
            #print(mid_config_in_course)
        
        p = assembly.part(brick_key_in_course)
        place_frame_WCF = p.gripping_frame
        safe_place_frame_WCF = place_frame_WCF.transformed(Translation.from_vector(-place_frame_WCF.zaxis * place_safety))

        pick_tasks = [
                        MoveJointsTask(robot, robot_address, mid_config_in_course, velocity=velocity, radius=0, payload=no_brick_payload, CoG=CoG, key=key_+0),
                        MoveLinearTask(robot, robot_address, safe_pick_frame_WCF, in_RCF=False, velocity=velocity, radius=0, payload=no_brick_payload, key=key_+1),
                        ForcePickPlaceTask(robot, robot_address, assembly, brick_key_in_course, pick=True, payload=no_brick_payload, velocity=velocity, radius=0, key=key_+2),
                        MoveJointsTask(robot, robot_address, mid_config_in_course, velocity=velocity, radius=0, payload=with_brick_payload, CoG=CoG, key=key_+3),
                        ]

        tasks += pick_tasks
        key_ = key_+ 4

        place_tasks = [
                        MoveJointsTask(robot, robot_address, place_configs_in_course, velocity=velocity, radius=radius, payload=with_brick_payload, CoG=CoG, key=key_),
                        MoveLinearTask(robot, robot_address, safe_place_frame_WCF, in_RCF=False, velocity=velocity, radius=10, payload=with_brick_payload, key=key_+1),
                        PlaceTask(robot, robot_address, place_frame_WCF, velocity=velocity/10, radius=0, payload=with_brick_payload, CoG=CoG, key=key_+2),
                        # MoveJointsTask(robot, robot_address, reverse_place_configs_in_course, velocity=velocity, radius=radius, payload=no_brick_payload, CoG=CoG, key=key_+3),
                        ]

        tasks += place_tasks
        key_ = key_+ 3

elif routine == 4:
    course_keys = [p for p in assembly.graph.nodes_where(conditions={"course": course})]
    if brick_type == 'all_types':
        selected_keys = course_keys
    elif brick_type == "brick_insulated_and_full":
        selected_keys = [key for key in course_keys if assembly.graph.node_attribute(key, 'brick_type') != "brick_air_dried"]
    else:
        selected_keys = [key for key in course_keys if assembly.graph.node_attribute(key, 'brick_type') == brick_type]
    selected_keys = selected_keys[brick_in_course:]
    print("selected_keys:", selected_keys)

    for brick_key_in_course in selected_keys:
        # if assembly.graph.node_attribute(brick_key_in_course, 'place_configs') is not None:
        #     place_configs_in_course = assembly.graph.node_attribute(brick_key_in_course, 'place_configs')
        # else:
        #     place_configs_in_course = []
        # reverse_place_configs_in_course = place_configs_in_course[::-1]

        if assembly.graph.node_attribute(brick_key_in_course, 'brick_type') == 'brick_insulated':
            safe_pick_frame_WCF = safe_pick_frame_ins_WCF
            with_brick_payload = no_brick_payload + 2.35
        else:
            safe_pick_frame_WCF = safe_pick_frame_full_WCF
            with_brick_payload = no_brick_payload + 4.4
        
        if assembly.graph.node_attribute(brick_key_in_course, 'brick_type') == 'brick_insulated':
            mid_config_in_course = Configuration((real_lift_height, -4.472, -1.346, 2.435, -2.657, -1.574, -1.330), (2, 0, 0, 0, 0, 0, 0))
            high_mid_config_in_course = Configuration((real_lift_height, -4.471, -1.803, 1.752, -1.517, -1.573, -1.328), (2, 0, 0, 0, 0, 0, 0)) # maybe use this if place frame is higher.
        else:
            mid_config_in_course = Configuration((real_lift_height, -2.186, -1.048, 2.170, -2.693, -1.571, 0.955), (2, 0, 0, 0, 0, 0, 0))
            high_mid_config_in_course = Configuration((real_lift_height, -2.190, -1.474, 1.042, -1.139, -1.569, 0.953), (2, 0, 0, 0, 0, 0, 0)) # maybe use this if place frame is higher.
        
        if mid_config_high:
            mid_config_in_course = high_mid_config_in_course
            #print(mid_config_in_course)
        
        p = assembly.part(brick_key_in_course)
        place_frame_WCF = p.gripping_frame
        safe_place_frame_WCF = place_frame_WCF.transformed(Translation.from_vector(-place_frame_WCF.zaxis * place_safety))

        pick_tasks = [
                        MoveJointsTask(robot, robot_address, mid_config_in_course, velocity=velocity, radius=0, payload=no_brick_payload, CoG=CoG, key=key_+0),
                        MoveLinearTask(robot, robot_address, safe_pick_frame_WCF, in_RCF=False, velocity=velocity, radius=0, payload=no_brick_payload, key=key_+1),
                        ForcePickPlaceTask(robot, robot_address, assembly, brick_key_in_course, pick=True, payload=no_brick_payload, velocity=velocity, radius=0, key=key_+2),
                        MoveJointsTask(robot, robot_address, mid_config_in_course, velocity=velocity, radius=0, payload=with_brick_payload, CoG=CoG, key=key_+3),
                        ]

        tasks += pick_tasks
        key_ = key_+ 4

        place_tasks = [
                        #MoveJointsTask(robot, robot_address, place_configs_in_course, velocity=velocity, radius=radius, payload=with_brick_payload, CoG=CoG, key=key_),
                        MoveLinearTask(robot, robot_address, safe_place_frame_WCF, in_RCF=False, velocity=velocity, radius=0, payload=with_brick_payload, key=key_+0),
                        PlaceTask(robot, robot_address, place_frame_WCF, velocity=velocity/10, radius=0, payload=with_brick_payload, CoG=CoG, key=key_+1),
                        # MoveJointsTask(robot, robot_address, reverse_place_configs_in_course, velocity=velocity, radius=radius, payload=no_brick_payload, CoG=CoG, key=key_+3),
                        ]

        tasks += place_tasks
        key_ = key_+ 2

else:
    #####THIS IS NO PLANNING WITH MID PLANE INSTEAD OF CONFIG:####
    course_keys = [p for p in assembly.graph.nodes_where(conditions={"course": course})]
    if brick_type == 'all_types':
        selected_keys = course_keys
    elif brick_type == "brick_insulated_and_full":
        selected_keys = [key for key in course_keys if assembly.graph.node_attribute(key, 'brick_type') != "brick_air_dried"]
    else:
        selected_keys = [key for key in course_keys if assembly.graph.node_attribute(key, 'brick_type') == brick_type]
    selected_keys = selected_keys[brick_in_course:]
    print("selected_keys:", selected_keys)

    # Mid frames:
    course_height = assembly.part(selected_keys[0]).gripping_frame.point.z
    course_height_safety = 0.2

    mid_left_frame_BCF = plane_to_compas_frame(mid_left_plane_BCF)
    mid_left_frame_WCF = robot.from_BCF_to_WCF(mid_left_frame_BCF)
    mid_left_frame_WCF_transformed = mid_left_frame_WCF.transformed(Translation.from_vector(Vector.Zaxis()*(-mid_left_frame_WCF.point.z + course_height + course_height_safety-0.20)))
    mid_left_plane_WCF = frame_to_rhino_plane(mid_left_frame_WCF_transformed)

    mid_right_frame_BCF = plane_to_compas_frame(mid_right_plane_BCF)
    mid_right_frame_WCF = robot.from_BCF_to_WCF(mid_right_frame_BCF)
    mid_right_frame_WCF_transformed = mid_right_frame_WCF.transformed(Translation.from_vector(Vector.Zaxis()*(-mid_right_frame_WCF.point.z + course_height + course_height_safety)))
    mid_right_plane_WCF = frame_to_rhino_plane(mid_right_frame_WCF_transformed)
    
    for brick_key_in_course in selected_keys:
        if assembly.graph.node_attribute(brick_key_in_course, 'brick_type') == 'brick_insulated':
            safe_pick_frame_WCF = safe_pick_frame_ins_WCF
            with_brick_payload = no_brick_payload + 2.35
        else:
            safe_pick_frame_WCF = safe_pick_frame_full_WCF
            with_brick_payload = no_brick_payload + 4.4

        p = assembly.part(brick_key_in_course)
        place_frame_WCF = p.gripping_frame
        safe_place_frame_WCF = place_frame_WCF.transformed(Translation.from_vector(-place_frame_WCF.zaxis * place_safety))

        if assembly.graph.node_attribute(brick_key_in_course, 'brick_type') == 'brick_insulated':
            mid_frame_WCF = mid_right_frame_WCF_transformed
        else:
            mid_frame_WCF = mid_left_frame_WCF_transformed

        pick_tasks = [
                        MoveLinearTask(robot, robot_address, mid_frame_WCF, in_RCF=False, velocity=velocity, radius=0, payload=no_brick_payload, key=key_+0),
                        MoveLinearTask(robot, robot_address, safe_pick_frame_WCF, in_RCF=False, velocity=velocity, radius=0, payload=no_brick_payload, key=key_+1),
                        ForcePickPlaceTask(robot, robot_address, assembly, brick_key_in_course, pick=True, payload=no_brick_payload, velocity=velocity, radius=0, key=key_+2),
                        MoveLinearTask(robot, robot_address, mid_frame_WCF, in_RCF=False, velocity=velocity, radius=0, payload=with_brick_payload, key=key_+3),
                        ]

        tasks += pick_tasks
        key_ = key_+ 4

        place_tasks = [
                        MoveLinearTask(robot, robot_address, safe_place_frame_WCF, in_RCF=False, velocity=velocity, radius=0, payload=with_brick_payload, key=key_),
                        PlaceTask(robot, robot_address, place_frame_WCF, velocity=velocity/10, radius=0, payload=with_brick_payload, CoG=CoG, key=key_+1),
                        ]

        tasks += place_tasks
        key_ = key_+ 2

print(tasks)

selected_brick_key = selected_keys[0]
selected_brick_frame = frame_to_rhino_plane(assembly.part(selected_brick_key).gripping_frame)











################################

# pick_tasks = [
#                 ChangeToolFrameTask(robot, tool_name="gripper", key=key_),
#                 AssemblyMotionsTask(robot, assembly, scene, brick_key, routine="pick", pick_frame=pick_frame, validation=motion_validation, key=key_+1),
#                 ExecuteMotionTask(robot, robot_address, fabrication, motiontask_key=key_+1, velocity=0.05, radius=0.01, payload=5.6, CoG=[0.005, -0.022, 0.072], key=key_+2),
#                 PickOrPlaceBrickForceURTask(robot, robot_address, assembly, brick_key, pick=True, payload=5.6, key=key_+3),
#                 ]

# place_tasks = [
#                 ChangeToolFrameTask(robot, tool_name="gripper", key=key_),
#                 AssemblyMotionsTask(robot, assembly, scene, brick_key, routine="place", pick_frame=pick_frame, validation=motion_validation, key=key_+1),
#                 ExecuteMotionTask(robot, robot_address, fabrication, motiontask_key=key_+1, velocity=0.05, radius=0.01, payload=5.6, CoG=[0.005, -0.022, 0.072], key=key_+2),
#                 PickOrPlaceBrickForceURTask(robot, robot_address, assembly, brick_key, pick=False, payload=5.6, key=key_+3),
#                 ]
# tasks += place_tasks

# class ChangeToolFrameTask(Task):
#     def __init__(self, robot, tool_name='gripper', key=None):
#         super(ChangeToolFrameTask, self).__init__(key)
#         self.robot = robot
#         self.tool_name = tool_name
#         gripper_frame = Frame([0, -(0.2451+0.07), 0.040045], [-1, 0, 0], [0, 0, -1])
#         extruder_frame = Frame([0.351186, 0.00132,  0.10709], [0, -1, 0], [0, 0, -1]) #extruder tip frame
#         if tool_name == 'gripper':
#             self.tool_frame = gripper_frame
#         elif tool_name == 'extruder':
#             self.tool_frame = extruder_frame
        
#     def run(self, stop_thread):
#         self.log('Changing the tool frame to {}.'.format(self.tool_name))
#         self.robot.attached_tools['ur20'].frame = self.tool_frame
#         self.robot.attached_tools['ur20_and_liftkit'].frame = self.tool_frame
#         self.is_completed = True
#         return True

# class AssemblyMotionsTask(MotionPlanFrameTask):
#     def __init__(self, robot, assembly, scene=None, brick_key=0, routine="pick", pick_frame=None, validation=True, key=None):
#         super(AssemblyMotionsTask, self).__init__(robot, frame_WCF=None, start_configuration=None, group="ur20", validation=validation, key=key)
#         self.robot = robot
#         self.assembly = assembly
#         self.scene = scene
#         self.brick_key = brick_key
#         self.routine = routine
#         self.pick_frame = pick_frame

#     def run(self, stop_thread):
#         self.start_configuration = self.robot.mobile_client.get_current_configuration()
#         self.log("Current configuration is: {}".format(self.start_configuration))

#         brick_frame = self.assembly.part(self.brick_key).frame
        
#         if self.routine == "pick":
#             self.log("Motion planning for the picking tasks of brick {} started!".format(self.brick_key))
#             safety = 0.2
#             target_frame = self.pick_frame#.transformed(-self.pick_frame.zaxis * safety)
#             self.frame_WCF = target_frame

#         elif self.routine == "place":
#             self.log("Motion planning for the placing tasks of brick {} started!".format(self.brick_key))
#             safety = 0.2
#             target_frame = brick_frame.transformed(Translation.from_vector(-brick_frame.zaxis * safety))
#             self.frame_WCF = target_frame

#         self.log("Target frame is {}".format(self.frame_WCF))
#         super(AssemblyMotionsTask, self).run(stop_thread)
# ---------- end tasks_2 ----------
toggle_6 = GroupToggle(ToggleActive=True, ToggleVisible=False)  # disabled

pln_14 = Plane(tasks_2.selected_brick_frame)

safe_plane = Python3Script(plane_WCF=visualize.current_part_gripping_frame, place_safety=tasks_2.place_safety)  # -> safe_plane_WCF
# ---------- safe_plane: Python ----------
from compas_rhino.conversions import frame_to_rhino_plane, plane_to_compas_frame
from compas.geometry import Translation

place_frame_WCF = plane_to_compas_frame(plane_WCF)
safe_place_frame_WCF = place_frame_WCF.transformed(Translation.from_vector(-place_frame_WCF.zaxis * place_safety))
safe_plane_WCF = frame_to_rhino_plane(safe_place_frame_WCF)
# ---------- end safe_plane ----------
constraints_from_plane = Python3Script(robot=robot, plane=safe_plane, group=list_13)  # -> constraints
# ---------- constraints_from_plane: Python ----------
"""
Create a position and an orientation constraint from a plane calculated for the group's end-effector link.

COMPAS FAB v1.0.2
"""

import math

from compas_rhino.conversions import plane_to_compas_frame
from ghpythonlib.componentbase import executingcomponent as component


class ConstraintsFromPlane(component):
    def RunScript(self,
            robot,
            plane,
            group,
            tolerance_position,
            tolerance_xaxis,
            tolerance_yaxis,
            tolerance_zaxis):
        goal_constraints = None
        if robot and plane:
            tolerance_position = tolerance_position or 0.001
            tolerance_xaxis = tolerance_xaxis or 1.0
            tolerance_yaxis = tolerance_yaxis or 1.0
            tolerance_zaxis = tolerance_zaxis or 1.0

            frame_WCF = plane_to_compas_frame(plane)
            frame_BCF = robot.from_WCF_to_BCF(frame_WCF)

            tolerances_axes = [
                math.radians(tolerance_xaxis),
                math.radians(tolerance_yaxis),
                math.radians(tolerance_zaxis),
            ]
            goal_constraints = robot.constraints_from_frame(frame_BCF, tolerance_position, tolerances_axes, group)

        return goal_constraints
# ---------- end constraints_from_plane ----------
plan_motion = Python3Script(
    robot=robot,
    goal_constraints=constraints_from_plane,
    start_configuration=tasks_2.mid_config,
    group=list_13,
    compute=compute_2)  # -> out, trajectory; inputs goal_constraints: list
# ---------- plan_motion: Python ----------
"""
Calculate a motion path.

COMPAS FAB v1.0.2
"""

from ghpythonlib.componentbase import executingcomponent as component
from scriptcontext import sticky as st


import System

from compas_fab.ghpython.components import create_id


class PlanMotion(component):
    def RunScript(self,
            robot,
            goal_constraints: System.Collections.Generic.List[object],
            start_configuration,
            group,
            attached_collision_meshes,
            path_constraints,
            planner_id,
            compute):
        key = "trajectory"

        path_constraints = list(path_constraints) if path_constraints else None
        attached_collision_meshes = list(attached_collision_meshes) if attached_collision_meshes else None
        planner_id = str(planner_id) if planner_id else "RRTConnect"

        if (
            robot
            and robot.client
            and robot.client.is_connected
            and start_configuration
            and goal_constraints
            and compute
        ):
            st[key] = robot.plan_motion(
                goal_constraints,
                start_configuration=start_configuration,
                group=group,
                options=dict(
                    attached_collision_meshes=attached_collision_meshes,
                    path_constraints=path_constraints,
                    planner_id=planner_id,
                ),
            )

        trajectory = st.get(key, None)
        return trajectory
# ---------- end plan_motion ----------
trajectory_visualize = Python3Script(robot=robot, group=list_13, trajectory=plan_motion.trajectory)  # -> out, start_configuration, configurations, fraction, time, planes, P, V, A
# ---------- trajectory_visualize: Python ----------
"""
Visualizes a trajectory.

COMPAS FAB v1.0.2
"""


from compas_ghpython.sets import list_to_ghtree
from ghpythonlib.componentbase import executingcomponent as component
from compas_rhino.conversions import frame_to_rhino_plane
from compas_robots import Configuration

class TrajectoryVisualize(component):
    def RunScript(self, robot, group, trajectory):
        start_configuration = None
        configurations = []
        fraction = 0.0
        time = 0.0

        planes = []
        positions = []
        velocities = []
        accelerations = []

        if robot and trajectory:
            group = group or robot.main_group_name
            for c in trajectory.points:
                
                config = robot.merge_group_with_full_configuration(
                    c, trajectory.start_configuration, group
                )
                joint_names_ordered = [
                    "robot_ewellix_lift_top_joint",
                    "robot_arm_shoulder_pan_joint",
                    "robot_arm_shoulder_lift_joint",
                    "robot_arm_elbow_joint",
                    "robot_arm_wrist_1_joint",
                    "robot_arm_wrist_2_joint",
                    "robot_arm_wrist_3_joint",
                ]
                joint_values_ordered = [
                    config.joint_values[config.joint_names.index(joint_name)]
                    for joint_name in joint_names_ordered
                ]
                joint_types_ordered = [
                    config.joint_types[config.joint_names.index(joint_name)]
                    for joint_name in joint_names_ordered
                ]
                mobile_robot_config = Configuration(
                    joint_values_ordered, joint_types_ordered, joint_names_ordered
                )
                configurations.append(mobile_robot_config)
                frame = robot.forward_kinematics(c, group, options=dict(solver="model"))
                planes.append(frame_to_rhino_plane(robot.from_BCF_to_WCF(frame)))
                positions.append(c.positions)
                velocities.append(c.velocities)
                accelerations.append(c.accelerations)

            start_configuration = trajectory.start_configuration
            fraction = trajectory.fraction
            time = trajectory.time_from_start

            

        P = list_to_ghtree(list(zip(*positions)))
        V = list_to_ghtree(list(zip(*velocities)))
        A = list_to_ghtree(list(zip(*accelerations)))

        # return outputs if you have them; here I try it for you:
        return (start_configuration, configurations, fraction, time, planes, P, V, A)
# ---------- end trajectory_visualize ----------
pln_15 = Python3Script(P=trajectory_visualize.planes)  # -> P
# ---------- pln_15: Python ----------
print("hi")
# ---------- end pln_15 ----------
save_plan_to_assmbly = Python3Script(
    assembly=transform_assembly.assembly,
    brick_key=visualize.current_part_key,
    configurations=trajectory_visualize.configurations,
    planes=trajectory_visualize.planes,
    save=save)  # -> out; inputs configurations: list, planes: list
# ---------- save_plan_to_assmbly: Python ----------
from compas_rhino.conversions import plane_to_compas_frame, frame_to_rhino

if save:
    assembly.graph.node_attribute(brick_key, 'place_configs', configurations)
    frames = [plane_to_compas_frame(plane) for plane in planes]
    assembly.graph.node_attribute(brick_key, 'place_frames', frames)
# ---------- end save_plan_to_assmbly ----------
pline_2 = PolyLine(Vertices=pln_15, Closed=False)
select = Python3Script(L=trajectory_visualize.configurations, i=Slider(69, range=0..100))  # -> a; inputs i: Int32
# ---------- select: Python ----------
print(len(L))

if i < len(L):
    a = L[i]
else:
    a = L[-1]
# ---------- end select ----------
preview_6 = CustomPreview(Geometry=[pline_2, pln_15], Material=ColourSwatch(SwatchColor=RGB(59, 137, 161)))

filter_3 = StreamFilter(Gate=list_12, Stream1=pln_14)
movel = Python3Script(robot=robot, planes_WCS=filter_3, velocity=Slider(0.05, range=0..0.5), radius=radius_2)  # -> urscript; inputs planes_WCS: list of Plane
# ---------- movel: Python ----------
import Rhino.Geometry as rg
from compas.geometry import Frame
from compas.geometry import Transformation, Rotation
from compas_rhino.conversions import plane_to_compas_frame
from compas_ghpython.drawing import draw_frame
from ur_fabrication_control import direct_control 
import math

from scriptcontext import sticky as st
from ur_fabrication_control.direct_control import URScript

# retrieve the current tool frame in axis angle format
if robot.attached_tool:
    tool_angle_axis = list(robot.attached_tool.frame.point) + list(robot.attached_tool.frame.axis_angle_vector)
else:
    tool0_frame = Frame([0, 0, 0], [1, 0, 0], [0, 1, 0])
    tool_angle_axis = list(tool0_frame.point) + list(tool0_frame.axis_angle_vector)

frames_RCS = []
for plane_WCS in planes_WCS:
    frame_WCS = plane_to_compas_frame(plane_WCS)
    frame_RCS = robot.from_WCF_to_RCF(frame_WCS)
    pose = frame_RCS.point.__data__ + frame_RCS.axis_angle_vector.__data__
    x = "p[{}, {}, {}, {}, {}, {}]".format(*pose)
    print(x)
    frames_RCS.append(frame_RCS)

urscript = URScript()
urscript.start()
urscript.set_tcp(tool_angle_axis)
for frame_RCS in frames_RCS:
    urscript.move_linear(frame=frame_RCS, velocity=velocity, radius=radius)
urscript.end()

urscript = urscript.generate()

print(urscript)
# ---------- end movel ----------
ur_send_3 = Python3Script(urscript=movel, send=send_4)  # -> out; inputs urscript: String
# ---------- ur_send_3: Python ----------
from scriptcontext import sticky as st
from ur_fabrication_control.direct_control import send_script

ur_ip = st["ur_ip"]
ur_port = st["ur_port"]

if send:
    send_script(urscript, ur_ip, ur_port)
# ---------- end ur_send_3 ----------

# ----
# Option 1: Real-time planning
number_slider_8 = Slider(0.1, range=0..0.5)  # disabled
radius_4 = Slider(0.1, range=0..0.5)  # disabled
motion_validation_3 = BooleanToggle(True)  # disabled
safe_pick_eef = Plane(Plane(origin=(-0.06217311402, 0.4758355801, 1.016904858), x=(0.9990321836, -0.01919604648, 0.03957534459), y=(-0.03341293409, -0.91634347, 0.3989965172)))  # disabled
pick_eef = Plane(Plane(origin=(-0.05782515841, 0.4146730848, 0.8768769382), x=(0.9990323024, -0.01923386568, 0.03955397809), y=(-0.03343840316, -0.9163518129, 0.3989752225)))  # disabled
panel_21 = Panel(visualize.current_part_key)  # disabled
tasks_3 = Python3Script(
    robot=robot,
    fabrication=fabrication,
    assembly=transform_assembly.assembly,
    scene=scene,
    velocity=number_slider_8,
    radius=radius_4,
    brick_key=panel_21,
    pick_plane_full_WCF=pick_full_bcf,
    pick_plane_ins_WCF=pick_ins_bcf_2,
    motion_validation=motion_validation_3,
    DATA=path_3.DATA)  # -> tasks; inputs brick_key: Int32; disabled
# ---------- tasks_3: Python ----------
from fabrication_manager.task import Task
from mobile_robot_control.fabrication import MoveJointsTask, MoveLinearTask, MotionPlanFrameTask, ExecuteMotionTask, MotionPlanConfigurationTask
from ur_fabrication_control.direct_control.fabrication import URTask
import Rhino.Geometry as rg
from compas.geometry import Frame, Transformation, Rotation, Vector, Translation, Box
from compas.geometry import Sphere, Circle, Frame, Translation, Rotation, Vector, cross_vectors, Point
from compas_rhino.conversions import sphere_to_rhino, circle_to_rhino, point_to_rhino, frame_to_rhino_plane
from compas_rhino.conversions import plane_to_compas_frame, frame_to_rhino_plane
#from compas_ghpython import draw_frame
from compas_robots import Configuration
from ur_fabrication_control import direct_control 
import math
import os
import time
from scriptcontext import sticky as st
from ur_fabrication_control.direct_control.mixins import URScript, URScript_AreaGrip, URScript_ParallelGrip, URScript_Drill

ur_ip = st['ur_ip']
ur_port = st['ur_port']
robot_address = (ur_ip, ur_port)

print("Brick key is: {}".format(brick_key))

# Pick frames:
pick_safety = 0.2

# full bricks:
pick_frame_full_BCF = plane_to_compas_frame(pick_plane_full_WCF)
safe_pick_frame_full_BCF = pick_frame_full_BCF.transformed(Translation.from_vector(-pick_frame_full_BCF.zaxis * pick_safety))

pick_frame_full_WCF = robot.from_BCF_to_WCF(pick_frame_full_BCF)
safe_pick_frame_full_WCF = robot.from_BCF_to_WCF(safe_pick_frame_full_BCF)
safe_pick_plane_full = frame_to_rhino_plane(safe_pick_frame_full_WCF)

# insulated bricks:
pick_frame_ins_BCF = plane_to_compas_frame(pick_plane_ins_WCF)
safe_pick_frame_ins_BCF = pick_frame_ins_BCF.transformed(Translation.from_vector(-pick_frame_ins_BCF.zaxis * pick_safety))

pick_frame_ins_WCF = robot.from_BCF_to_WCF(pick_frame_ins_BCF)
safe_pick_frame_ins_WCF = robot.from_BCF_to_WCF(safe_pick_frame_ins_BCF)
safe_pick_plane_ins = frame_to_rhino_plane(safe_pick_frame_ins_WCF)

# Middle configuration: This is where the placement will start from. (Change, if necessary)
mid_config = Configuration((0.000, -2.186, -1.048, 2.170, -2.693, -1.571, 2.526), (2, 0, 0, 0, 0, 0, 0))

# With extruder drill: Configuration((0.006, -1.475, -1.012, 2.113, -1.101, -1.476, 0.002), (2, 0, 0, 0, 0, 0, 0), ('robot_ewellix_lift_top_joint', 'robot_arm_shoulder_pan_joint', 'robot_arm_shoulder_lift_joint', 'robot_arm_elbow_joint', 'robot_arm_wrist_1_joint', 'robot_arm_wrist_2_joint', 'robot_arm_wrist_3_joint'))

# Place frames:
current_part = assembly.part(brick_key)
place_frame_WCF = current_part.gripping_frame
place_safety = 0.15
safe_place_frame_WCF = place_frame_WCF.transformed(Translation.from_vector(-place_frame_WCF.zaxis * place_safety))

# Payloads: (Check if correct)
no_brick_payload = 5.6
with_brick_payload = 8.6
CoG = [0.005, -0.022, 0.072]

# Questions:
# Do we want to add a task to attach gripper again just in case?

class ForcePickPlaceTask(URTask):
    def __init__(self, robot, robot_address, assembly, brick_key, pick=True, payload=5.6, CoG=[0.005, -0.022, 0.072], key=None):
        super(ForcePickPlaceTask, self).__init__(robot, robot_address, key)
        self.robot = robot
        self.robot_address = robot_address
        self.pick = pick
        self.assembly = assembly
        self.brick_key = brick_key
        self.payload = payload
        self.CoG = CoG

    def urscript_fabrication_header(self):
        ## Initialize instance
        self.urscript = URScript_ParallelGrip(*self.robot_address)
        self.urscript.start()
        
        if self.robot:
            ## Set tool
            tool = self.robot.attached_tool
            self.urscript.set_tcp(list(tool.frame.point)+list(tool.frame.axis_angle_vector))
        self.urscript.textmessage(">> TASK {}".format(self.key), string=True)
        
        if self.server:
            self.urscript.set_socket(self.server.ip, self.server.port, self.server.name)
            self.urscript.socket_open(self.server.name)
            ## Send script received msg
            self.urscript.socket_send_line_string(self.rec_msg, self.server.name)
                
    def create_urscript(self):
        if self.pick:
            self.log("Picking started!")
            self.urscript.set_payload(self.payload, self.CoG)
            self.urscript.parallelgrip_open()
        else:
            self.log("Placing started!")
            self.urscript.set_payload(self.payload + 3.0, self.CoG)
            self.urscript.parallelgrip_close()

        self.urscript.add_line("\tsleep({})".format(1.0))

        self.urscript.move_force_mode(force_z=50.0, speed_z=0.03)
        self.urscript.stop_by_force(20.0)

        if self.pick:
            self.urscript.parallelgrip_close()
            self.urscript.set_payload(self.payload + 3.0, self.CoG)
        else:
            self.urscript.parallelgrip_open()
            self.urscript.set_payload(self.payload, self.CoG)
        
        self.urscript.move_tool_by_distance(z_distance=-0.2, velocity=self.velocity, radius=self.radius)

class PlaceTask(URTask):
    def __init__(self, robot, robot_address, place_frame_WCF, velocity=0.10, radius=0.0, payload=5.6, CoG=[0.005, -0.022, 0.072], key=None):
        super(PlaceTask, self).__init__(robot, robot_address, key)
        self.robot = robot
        self.robot_address = robot_address
        self.place_frame_WCF = place_frame_WCF
        self.velocity = velocity
        self.radius = radius
        self.payload = payload
        self.CoG = CoG

    def urscript_fabrication_header(self):
        ## Initialize instance
        self.urscript = URScript_ParallelGrip(*self.robot_address)
        self.urscript.start()
        
        if self.robot:
            ## Set tool
            tool = self.robot.attached_tool
            self.urscript.set_tcp(list(tool.frame.point)+list(tool.frame.axis_angle_vector))
        self.urscript.textmessage(">> TASK {}".format(self.key), string=True)
        
        if self.server:
            self.urscript.set_socket(self.server.ip, self.server.port, self.server.name)
            self.urscript.socket_open(self.server.name)
            ## Send script received msg
            self.urscript.socket_send_line_string(self.rec_msg, self.server.name)
                
    def create_urscript(self):
        place_frame_RCF = self.robot.from_WCF_to_RCF(self.place_frame_WCF)

        self.log("Placing started!")
        self.urscript.set_payload(self.payload, self.CoG)

        self.urscript.move_linear(place_frame_RCF, velocity=self.velocity, radius=self.radius)
        self.urscript.move_linear(place_frame_RCF, velocity=self.velocity, radius=0)

        self.urscript.add_line("\tsleep({})".format(1.0))

        self.urscript.parallelgrip_open()
        
        self.urscript.move_tool_by_distance(z_distance=-0.2, velocity=self.velocity, radius=self.radius)
        
tasks = []

key_ = 0

pick_tasks = [
                MoveJointsTask(robot, robot_address, mid_config, velocity=velocity, radius=radius, payload=no_brick_payload, CoG=CoG, key=key_),
                MoveLinearTask(robot, robot_address, safe_pick_frame_full_WCF, in_RCF=False, velocity=velocity, radius=radius, payload=no_brick_payload, key=key_+1),
                ForcePickPlaceTask(robot, robot_address, assembly, brick_key, pick=True, payload=no_brick_payload, key=key_+2),
                MoveJointsTask(robot, robot_address, mid_config, velocity=velocity, radius=radius, payload=with_brick_payload, CoG=CoG, key=key_+3),
                ]

tasks += pick_tasks
key_ = key_+ 4

place_tasks = [
                MotionPlanFrameTask(robot, frame_WCF=safe_place_frame_WCF, start_configuration=mid_config, group="ur20", validation=motion_validation, key=key_),
                ExecuteMotionTask(robot, robot_address, fabrication, motiontask_key=key_, velocity=velocity, radius=radius, payload=with_brick_payload, CoG=CoG, key=key_+1),
                PlaceTask(robot, robot_address, place_frame_WCF, velocity=velocity, radius=radius, payload=with_brick_payload, CoG=CoG, key=key_+2),
                ExecuteMotionTask(robot, robot_address, fabrication, motiontask_key=key_, velocity=velocity, radius=radius, reverse=True, payload=no_brick_payload, CoG=CoG, key=key_+3),
                ]

tasks += place_tasks

print(tasks)













################################

# pick_tasks = [
#                 ChangeToolFrameTask(robot, tool_name="gripper", key=key_),
#                 AssemblyMotionsTask(robot, assembly, scene, brick_key, routine="pick", pick_frame=pick_frame, validation=motion_validation, key=key_+1),
#                 ExecuteMotionTask(robot, robot_address, fabrication, motiontask_key=key_+1, velocity=0.05, radius=0.01, payload=5.6, CoG=[0.005, -0.022, 0.072], key=key_+2),
#                 PickOrPlaceBrickForceURTask(robot, robot_address, assembly, brick_key, pick=True, payload=5.6, key=key_+3),
#                 ]

# place_tasks = [
#                 ChangeToolFrameTask(robot, tool_name="gripper", key=key_),
#                 AssemblyMotionsTask(robot, assembly, scene, brick_key, routine="place", pick_frame=pick_frame, validation=motion_validation, key=key_+1),
#                 ExecuteMotionTask(robot, robot_address, fabrication, motiontask_key=key_+1, velocity=0.05, radius=0.01, payload=5.6, CoG=[0.005, -0.022, 0.072], key=key_+2),
#                 PickOrPlaceBrickForceURTask(robot, robot_address, assembly, brick_key, pick=False, payload=5.6, key=key_+3),
#                 ]
# tasks += place_tasks

# class ChangeToolFrameTask(Task):
#     def __init__(self, robot, tool_name='gripper', key=None):
#         super(ChangeToolFrameTask, self).__init__(key)
#         self.robot = robot
#         self.tool_name = tool_name
#         gripper_frame = Frame([0, -(0.2451+0.07), 0.040045], [-1, 0, 0], [0, 0, -1])
#         extruder_frame = Frame([0.351186, 0.00132,  0.10709], [0, -1, 0], [0, 0, -1]) #extruder tip frame
#         if tool_name == 'gripper':
#             self.tool_frame = gripper_frame
#         elif tool_name == 'extruder':
#             self.tool_frame = extruder_frame
        
#     def run(self, stop_thread):
#         self.log('Changing the tool frame to {}.'.format(self.tool_name))
#         self.robot.attached_tools['ur20'].frame = self.tool_frame
#         self.robot.attached_tools['ur20_and_liftkit'].frame = self.tool_frame
#         self.is_completed = True
#         return True

# class AssemblyMotionsTask(MotionPlanFrameTask):
#     def __init__(self, robot, assembly, scene=None, brick_key=0, routine="pick", pick_frame=None, validation=True, key=None):
#         super(AssemblyMotionsTask, self).__init__(robot, frame_WCF=None, start_configuration=None, group="ur20", validation=validation, key=key)
#         self.robot = robot
#         self.assembly = assembly
#         self.scene = scene
#         self.brick_key = brick_key
#         self.routine = routine
#         self.pick_frame = pick_frame

#     def run(self, stop_thread):
#         self.start_configuration = self.robot.mobile_client.get_current_configuration()
#         self.log("Current configuration is: {}".format(self.start_configuration))

#         brick_frame = self.assembly.part(self.brick_key).frame
        
#         if self.routine == "pick":
#             self.log("Motion planning for the picking tasks of brick {} started!".format(self.brick_key))
#             safety = 0.2
#             target_frame = self.pick_frame#.transformed(-self.pick_frame.zaxis * safety)
#             self.frame_WCF = target_frame

#         elif self.routine == "place":
#             self.log("Motion planning for the placing tasks of brick {} started!".format(self.brick_key))
#             safety = 0.2
#             target_frame = brick_frame.transformed(Translation.from_vector(-brick_frame.zaxis * safety))
#             self.frame_WCF = target_frame

#         self.log("Target frame is {}".format(self.frame_WCF))
#         super(AssemblyMotionsTask, self).run(stop_thread)
# ---------- end tasks_3 ----------
toggle_7 = GroupToggle(ToggleActive=True, ToggleVisible=False)  # disabled

pln_16 = Plane(tasks_2.selected_brick_frame)
pln_17 = Plane(tasks_2.mid_left_plane_WCF)
pln_18 = Plane(tasks_2.mid_right_plane_WCF)
pln_19 = Plane(tasks_2.safe_place_plane)
pln_20 = Plane(tasks_2.safe_pick_plane_ins)
panel_22 = Panel(tasks_2.selected_brick_key)
pln_21 = Plane(tasks_2.safe_pick_plane_full)

stop_fabrication = Button()
log_messages = Panel(data)

preview_7 = CustomPreview(Geometry=pln_16, Material=ColourSwatch(SwatchColor=RGB(255, 255, 0)))
panel_23 = Panel(tasks_2.mid_config)

fabrication_manager = Python3Script(
    tasks=[tasks_2.tasks, tasks_3],
    fabrication=fabrication,
    set_tasks=set_tasks,
    start=start_fabrication,
    stop=stop_fabrication,
    reset=reset_2,
    next_task=next_task,
    reset_task=reset_task,
    prev_task=prev_task)  # -> out, server; inputs tasks: list
# ---------- fabrication_manager: Python ----------
def task_state_set(state, t):
    t.is_completed = state
    t.is_running = False
    
if set_tasks:
    print("setting tasks")   
    fabrication.clear_tasks()
    fabrication.set_tasks(tasks)

if start:
    #if robot.is_connected(): #and arduino.is_connected():
    print("starting process")
    fabrication.start()

if stop:
    print("stopping process")
    fabrication.stop()
    
if reset:
    print("resetting process")
    fabrication.reset()

if next_task:
    t = fabrication.get_next_task()
    task_state_set(True, t)
    
if reset_task:
    t = fabrication.get_next_task()
    task_state_set(False, t)

if prev_task:
    t = fabrication.get_next_task()
    task_state_set(False, t)
    t = fabrication.tasks[fabrication.current_task_key-1]
    task_state_set(False, t)
    fabrication.get_next_task()
# ---------- end fabrication_manager ----------

# ----
# Draw motion
approve = Button()
replan = Button()
bang = Button()
vis_motion = Python3Script(
    fabrication=fabrication,
    show_brick=Toggle(False),
    assembly=transform_assembly.assembly,
    motiontask_key=num_current_task,
    bang=bang,
    approve=approve,
    replan=replan)  # -> brick_key, brick_geometry, planes, configurations; inputs motiontask_key: Int32, bang: list
# ---------- vis_motion: Python ----------
from compas_robots import Configuration
from scriptcontext import sticky as st
from compas_rhino.conversions import mesh_to_rhino, box_to_rhino, frame_to_rhino

if motiontask_key is not None:
    current_task = motiontask_key #+1

current_task = int(current_task)

task = fabrication.get_task_by_key(current_task)

if show_brick:
    next_task = fabrication.get_task_by_key(current_task + 1)
    brick_key = next_task.brick_key    
    brick_part = assembly.part(brick_key)

    brick_geometry = mesh_to_rhino(brick_part.mesh)

if hasattr(task, "results"):
    st['planes'] = task.results.get("planes")
    st['configurations'] = task.results.get("configurations")

if replan:
    if hasattr(task, "replan"):
        task.replan = True

if approve:
    if hasattr(task, "approved"):
        task.approved = True
planes = st['planes']
configurations = st['configurations']
print(configurations)
# ---------- end vis_motion ----------
configuration = Slider(0, range=0..100)
pline_3 = PolyLine(Vertices=vis_motion.planes, Closed=False)
item = ListItem(List=vis_motion.configurations, Index=configuration, Wrap=True)
toggle_8 = GroupToggle(ToggleActive=True, ToggleVisible=False)  # disabled
preview_8 = CustomPreview(Geometry=[pline_3, vis_motion.brick_geometry], Material=ColourSwatch(SwatchColor=RGB(59, 137, 161)))

filter_4 = StreamFilter(
    Gate=list_4,
    Stream0=zero.configuration,
    Stream1=forward_kinematics,
    Stream2=analytic_inverse.configuration,
    Stream3=inverse.configuration,
    Stream5=draw,
    Stream6=item)
visualise = Python3Script(
    robot=robot,
    configuration=filter_4,
    show_frames=show_frames,
    show_visual_meshes=show_visual,
    show_robot_collision_meshes=show_robot_collision,
    show_collision_meshes=show_collision,
    show_attached_collision_meshes=show_attached_collision,
    show_BCF=show_bcf,
    show_RCF=show_rcf,
    show_EEF=show_eef,
    bang=[set_frame, attach_tool.bang, collision_mesh.bang, attached_collision_mesh.bang])  # -> out, joint_planes, visual_meshes, robot_collision_meshes, collision_meshes, attached_meshes, BCF, RCF, EEF, EEF_in_RCF; inputs bang: list
# ---------- visualise: Python ----------
from scriptcontext import sticky as st
import time
from compas_ghpython import create_id
from compas.geometry import Frame
from compas.geometry import Transformation
from compas_rhino.conversions import frame_to_rhino, mesh_to_compas, mesh_to_rhino, frame_to_rhino_plane
from compas.scene import SceneObject
from compas_fab.robots import PlanningScene
import Rhino.Geometry as rg
import ghpythonlib.components as ghcomp

robot.update(configuration)
print(configuration)
if show_frames == True: 
    #print(configuration)
    joint_frames = robot.model.transformed_frames(configuration)
    joint_planes = [frame_to_rhino(a) for a in joint_frames]

if show_BCF:
    BCF = frame_to_rhino(robot.BCF)

if show_RCF:
    print(robot.RCF)
    RCF = frame_to_rhino(robot.from_BCF_to_WCF(robot.RCF))

if show_EEF:
    EEF_in_RCF = frame_to_rhino(robot.from_BCF_to_RCF(robot.forward_kinematics(
        configuration, options=dict())))
    EEF = frame_to_rhino(robot.from_BCF_to_WCF(robot.forward_kinematics(
        configuration, options=dict())))
    print(EEF)

if show_visual_meshes == True:
    visual_meshes = robot.draw_visual()
    # orient the robot to its base plane:
    robot_BCF = frame_to_rhino_plane(robot.BCF) 
    print(type(robot_BCF))
    init_robot_plane = rg.Plane.WorldXY
    #visual_meshes = ghcomp.Orient(visual_meshes, init_robot_plane, robot_BCF)[0]

if show_robot_collision_meshes == True:
    robot_collision_meshes = robot.draw_collision()

cached_scene_key = "cached_scene"

if show_collision_meshes or show_attached_collision_meshes:
    cached_scene = st.get(cached_scene_key)
    if not cached_scene:
        cached_scene = {"time": 0}

    # # expire cache if the component has not been executed in the last 2 seconds
    # # this allows to slide through a list of configurations
    # # without triggering refreshes of the scene in the middle of it

    # if time.time() - cached_scene["time"] > 2:
    #     update_scene = True
    # else:
    #     update_scene = False

    update_scene = True

    if update_scene:
        scene = PlanningScene(robot)
        scene = robot.client.get_planning_scene()

    if update_scene and show_collision_meshes:
        collision_meshes = []

        for co in scene.world.collision_objects:
            print(co)
            header = co.header
            frame_id = header.frame_id
            cms = co.to_collision_meshes()

            for cm in cms:
                if cm.frame != Frame.worldXY():
                    t = Transformation.from_frame(cm.frame)
                    mesh = cm.mesh.transformed(t)
                else:
                    mesh = cm.mesh
                collision_meshes.extend(SceneObject(item=mesh).draw())

        cached_scene["cm"] = collision_meshes

        collision_meshes = cached_scene.get("cm", [])

    if update_scene and show_attached_collision_meshes:
        attached_meshes = []

        for aco in scene.robot_state.attached_collision_objects:
            for acm in aco.to_attached_collision_meshes():
                print(acm)
                frame_id = aco.object["header"]["frame_id"]
                frame = robot.forward_kinematics(configuration, options=dict(link=frame_id))
                t = Transformation.from_frame(frame)

                # Local CM frame
                if acm.collision_mesh.frame and acm.collision_mesh.frame != Frame.worldXY():
                    t = t * Transformation.from_frame(acm.collision_mesh.frame)

                mesh = acm.collision_mesh.mesh.transformed(t)

                attached_meshes.extend(SceneObject(item=mesh).draw())

        cached_scene["acm"] = attached_meshes

        attached_meshes = cached_scene.get("acm", [])
    
    cached_scene["time"] = time.time()
    st[cached_scene_key] = cached_scene
# ---------- end visualise ----------
py3_6 = Python3Script(planes=[visualise.EEF, visualise.RCF], scale=Slider(0.2, range=0..1))  # -> P, V, C, W; inputs planes: list of Plane, scale: Double
# ---------- py3_6: Python ----------
from Rhino.Display import ColorRGBA
from ghpythonlib.components import ColourRGBf


red = ColourRGBf(255, 255, 0, 0)
green = ColourRGBf(255, 0, 255, 0)
blue = ColourRGBf(255, 0, 0, 255)

P = []
V = []
C = []

# scale = float(scale)

for plane in planes:
    if not plane:
        continue
    P += [plane.Origin] * 3
    V.append(plane.XAxis * scale)
    V.append(plane.YAxis * scale)
    V.append(plane.ZAxis * scale)
    C += [red, green, blue]

W = 3
# ---------- end py3_6 ----------
pln_22 = Plane(visualise.joint_planes)
mesh_4 = Mesh(visualise.collision_meshes)
mesh_5 = Mesh(visualise.visual_meshes)
orient = Orient(Geometry=mesh_5, Source=PlaneXY(0, 0, 0), Target=visualise.BCF)  # -> Geometry, Transform
vdisex_2 = VectorDisplayEx(Point=py3_6.P, Vector=py3_6.V, Colour=py3_6.C, Width=py3_6.W)
preview_9 = CustomPreview(Geometry=orient.Geometry, Material=ColourSwatch(SwatchColor=RGB(87, 87, 87)))

eef_in_rcf = Plane(visualise.EEF_in_RCF)
eef = Plane(visualise.EEF)
mesh_6 = Mesh(visualise.robot_collision_meshes)
mesh_7 = Mesh(visualise.attached_meshes)

filter_5 = StreamFilter(
    Gate=list_11,
    Stream0=forward_kinematics,
    Stream1=inverse.configuration,
    Stream2=analytic_inverse.configuration,
    Stream3=vis_motion.configurations)
movej = Python3Script(configurations=filter_5, velocity=Slider(0.042, range=0..0.5))  # -> urscript, lift, values; inputs configurations: list
# ---------- movej: Python ----------
from ur_fabrication_control.direct_control import URScript
from compas_robots import Configuration
import math

urscript = URScript()
urscript.start()
for configuration in configurations:
    joint_configuration = Configuration.from_revolute_values(configuration.revolute_values)
    print(joint_configuration)
    lift = configuration
    urscript.move_joint(joint_configuration, velocity)
urscript.end()

urscript = urscript.generate()

print(urscript)
# ---------- end movej ----------
ur_send_4 = Python3Script(urscript=movej.urscript, send=send_3)  # -> out; inputs urscript: String
# ---------- ur_send_4: Python ----------
from scriptcontext import sticky as st
from ur_fabrication_control.direct_control import send_script

ur_ip = st["ur_ip"]
ur_port = st["ur_port"]

print(urscript)

if send:
    send_script(urscript, ur_ip, ur_port)
# ---------- end ur_send_4 ----------

panel_24 = Panel(vis_motion.brick_key)

# ----
# Get Pose Cartesian
get_3 = Button()
pose_3 = Python3Script(robot=robot, get=get_3)  # -> out, pose_cartesian
# ---------- pose_3: Python ----------
from scriptcontext import sticky as st
#from ur_fabrication_control.online_control.ur_direct import get_current_pose_cartesian

from ur_fabrication_control.direct_control.common import get_current_pose_cartesian
from compas.geometry import Frame
#from compas_ghpython import draw_frame


server_ip = st["server_ip"]
server_port = st["server_port"]
ur_port = st["ur_port"]
ur_ip = st["ur_ip"]
pose_cartesian_meter = []

# retrieve the current tool frame in axis angle format
if robot.attached_tool:
    print("attached")
    tool_angle_axis = list(robot.attached_tool.frame.point) + list(robot.attached_tool.frame.axis_angle_vector)
    
else:
    tool0_frame = Frame([0, 0, 0], [1, 0, 0], [0, 1, 0])
    tool_angle_axis = list(tool0_frame.point) + list(tool0_frame.axis_angle_vector)

guid = str(ghenv.Component.InstanceGuid)
pose_cartesian_key = "pose_cartesian" + guid

if pose_cartesian_key not in st:
    st[pose_cartesian_key] = None

if get:
    print("getting pose")
    st[pose_cartesian_key] = get_current_pose_cartesian(tool_angle_axis, server_ip, server_port, ur_ip, ur_port, send=True)
    
pose_cartesian = st[pose_cartesian_key]
# ---------- end pose_3 ----------
python = Python3Script(pose=pose_3.pose_cartesian)  # -> out, plane
# ---------- python: Python ----------
__author__ = "Gido"
__version__ = "2023.07.05"

import rhinoscriptsyntax as rs
from compas.geometry import Frame
#from compas_ghpython import draw_frame

if pose is not None:
    frame_RCS = Frame.from_axis_angle_vector(pose[3:6], pose[0:3])
    T = Transformation.from_change_of_basis(robot.RCF, Frame.worldXY())
    frame_WCS = frame_RCS.transformed(T)
    plane = draw_frame(frame_WCS)
# ---------- end python ----------

# ----
# Direct UR control
rec_2 = DataRecorder(pose_3.out, DataLimit=-10, RecordData=True)
task = Python3Script()  # -> out
# ---------- task: Python ----------
import time
from fabrication_manager import Task

task = Task()
print(task.is_completed)

task.perform(lambda:False)
time.sleep(1)

print(task.is_completed)
# ---------- end task ----------
open = BooleanToggle(False)

panel_25 = Panel(rec_2)

# ----
# Open/close gripper
gripper = Python3Script(robot=robot, open=open)  # -> urscript
# ---------- gripper: Python ----------
import Rhino.Geometry as rg
from compas.geometry import Frame, Vector, Point
from compas.geometry import Transformation, Rotation, Translation
from compas_rhino.conversions import plane_to_compas_frame, frame_to_rhino_plane
#from compas_ghpython import draw_frame
from ur_fabrication_control import direct_control 
import math

from scriptcontext import sticky as st
from ur_fabrication_control.direct_control.mixins import URScript, URScript_AreaGrip, URScript_ParallelGrip, URScript_Drill

# retrieve the current tool frame in axis angle format
if robot.attached_tool:
    tool_angle_axis = list(robot.attached_tool.frame.point) + list(robot.attached_tool.frame.axis_angle_vector)
else:
    tool0_frame = Frame([0, 0, 0], [1, 0, 0], [0, 1, 0])
    tool_angle_axis = list(tool0_frame.point) + list(tool0_frame.axis_angle_vector)

urscript = URScript_ParallelGrip()
urscript.start()
urscript.set_tcp(tool_angle_axis)
urscript.add_line("sleep(10.0)")

if open_:
    urscript.parallelgrip_open()
else:
    urscript.parallelgrip_close()

urscript.end()

urscript = urscript.generate()

print(urscript)
# ---------- end gripper ----------
send_5 = Button()
# Save ground truth
ur_send_5 = Python3Script(urscript=gripper, send=send_5)  # -> out; inputs urscript: String; same code as ur_send
