# Grasshopper definition reachability_snippet.ghx (Grasshopper 1.0.8)
# plug-ins: RhinoCodePluginGH

# ----
# Base pose search
# Base poses
dam = DataDam(BufferDelay=10000000, BufferMode=0)  # -> DataSegment_mesh, DataWall_polylines, DataSegment_pointcloud; disabled

# ---- group: Create base pose grid
rec = Rectangle({Plane=Plane(origin=(2.267918114e-05, -2.5, 0), x=(1, 9.071672455e-06, 0), y=(9.071672455e-06, -1, 0)), Size=Domain2(u=-3.154996855..3.154996855, v=-2.5..2.5)})
py3 = Python3Script(rectangle=rec, resolution=Slider(0.1, range=0..1))  # -> out, rpoints; inputs rectangle: Rectangle3d, resolution: Double
# ---------- py3: Python ----------
__author__ = "Gido"
__version__ = "2024.01.10"

import rhinoscriptsyntax as rs
from compas.geometry import Point, Pointcloud
from compas.geometry import Frame, Transformation, Translation
from compas.geometry import transform_points
from mobile_part_based_am.base_positioning import BaseMap

print(rectangle)

bm = BaseMap()
pc = bm.populate_rectangle(rectangle, resolution)

print(rectangle.Height)
print(rectangle.Width)
print(rectangle.Plane)

points_data = [{"pos":[pt.x, pt.y, pt.z]} for pt in pc.points]

from compas_ghpython.drawing import draw_points

rpoints = draw_points(points_data)
# ---------- end py3 ----------

# ---- group: Segment vicinity
volume = Volume(Geometry=dam.DataSegment_mesh)  # -> Volume, Centroid
pdecon = Deconstruct(Point=volume.Centroid)  # -> XComponent, YComponent, ZComponent
pt = ConstructPoint(XCoordinate=pdecon.XComponent, YCoordinate=pdecon.YComponent, ZCoordinate=expr("-x", Slider(0.1, range=0..0.1)))
xy = XYPlane(Origin=pt)
Z = UnitZ(Factor=1)
cir = Circle(Plane=xy, Radius=Slider(2, range=0..10))
extr = Extrude(Base=cir, Direction=Z)
cap = CapHoles(Brep=extr)
brepinc = PointInBrep(Brep=cap, Point=py3.rpoints, Strict=True)
cull = CullPattern(List=py3.rpoints, CullPattern=brepinc)

# ----
path = FilePath("C:\Users\gido\Documents\workspace\mobile_part_based_am\data\reachabilitymaps\rbvogui_xl_ur10e_and_liftkit_earthex_0_4_compas2.json")

# ----
# Reachabilitymap from JSON
list = ValueList({"ur10e_map.json", "rbvogui_xl_ur10e_and_liftkit": "rbvogui_xl_ur10e_and_liftkit.json", "rbvogui_xl_ur10e_and_liftkit_0_4": "rbvogui_xl_ur10e_and_liftkit_0_4.json", "rbvogui_xl_ur10e_and_liftkit_earthex_0_4": "rbvogui_xl_ur10e_and_liftkit_earthex_0_4.json", "rbvogui_xl_ur10e_and_liftkit_earthex_0_4_compas2.json"}, selected="rbvogui_xl_ur10e_and_liftkit_earthex_0_4_compas2.json")
py3_2 = Python3Script()  # -> DATA
# ---------- py3_2: Python ----------
import os

package_path = ghdoc.Path
# .stl files not stored in am_hackathon repo. but in mobile_fabrication_control
DATA = os.path.abspath(os.path.join(package_path,"../../data/reachabilitymaps"))

print(package_path)
print(DATA)
# ---------- end py3_2 ----------
py3_3 = Python3Script(DATA=py3_2, file=list)  # -> out, filepath
# ---------- py3_3: Python ----------
__author__ = "Gido"
__version__ = "2023.04.18"

import os
import rhinoscriptsyntax as rs

filepath = os.path.join(DATA, file)
# ---------- end py3_3 ----------
load_map = Python3Script(filepath=path, load=Toggle(True))  # -> out, reachabilitymap
# ---------- load_map: Python ----------
__author__ = "Gido"
__version__ = "2023.04.18"

import rhinoscriptsyntax as rs
from compas.geometry import Point, Frame
from mobile_part_based_am.base_positioning import ReuleauxReachability, WsSphere
import json

if load:
    reachabilitymap = ReuleauxReachability.from_json(filepath)
# ---------- end load_map ----------
visualize_map = Python3Script(reachabilitymap=load_map.reachabilitymap)  # -> out, reachabilitymap, sphere_points, resolution, reachability_index
# ---------- visualize_map: Python ----------
__author__ = "Gido"
__version__ = "2023.04.17"

import rhinoscriptsyntax as rs

from compas.geometry import Frame
from compas_ghpython.drawing import draw_frame


sphere_points = []
reachability_index = []
for point, ri in reachabilitymap.spheres_data(yield_ri=True):
    sphere_points.append(draw_frame(Frame(point, [1,0,0], [0,1,0])))
    reachability_index.append(ri)
#sphere_points = draw_frames(sphere_frames)
if reachabilitymap.resolution != 0:
    resolution = reachabilitymap.resolution
else:
    resolution = 0.1
# ---------- end visualize_map ----------
gradient = Gradient(
    LowerLimit=0,
    UpperLimit=100,
    Parameter=visualize_map.reachability_index,
    stops=[0: RGB(234, 38, 0), 0.25: RGB(234, 126, 0), 0.5: RGB(254, 244, 84), 0.75: RGB(173, 203, 249), 1: RGB(75, 107, 169)])
dots = DotDisplay(Point=visualize_map.sphere_points, Colour=gradient, Size=expr("x/10", visualize_map.resolution))

# ---- group: Remove opposite wall
E = Edges(<edges referenced from the Rhino model>)
boundary = BoundarySurfaces(Edges=E)
Z_2 = UnitZ(Factor=1)
extr_2 = Extrude(Base=boundary, Direction=Z_2)
Z_3 = UnitZ(Factor=expr("-x", Slider(0.1, range=0..0.1)))
move = Move(Geometry=extr_2, Motion=Z_3)  # -> Geometry, Transform
brepinc_2 = PointInBrep(Brep=move.Geometry, Point=cull, Strict=True)
cull_2 = CullPattern(List=cull, CullPattern=invert(brepinc_2))

# ---- group: Orient planes toward part
item = ListItem(List=flatten(dam.DataWall_polylines), Index=Slider(0, range=0..10), Wrap=True)
crv_cp = CurveClosestPoint(Point=cull_2, Curve=item)  # -> Point, Parameter, Distance
vec2pt = Vector2Pt(PointA=cull_2, PointB=crv_cp.Point, Unitize=True)  # -> Vector, Length
Z_4 = UnitZ(Factor="-1")
xprod = CrossProduct(VectorA=vec2pt.Vector, VectorB=Z_4, Unitize=False)  # -> Vector, Length
pl = ConstructPlane(Origin=cull_2, XAxis=vec2pt.Vector, YAxis=xprod.Vector)

# ----
xy_2 = XYPlane(Origin=py3.rpoints)
pt_2 = Point([<point referenced from the Rhino model> x10])
brep = Brep(<brep referenced from the Rhino model>)

# ---- group: Collision objects
brep_2 = Brep(<brep referenced from the Rhino model>)
brep_3 = Brep(<brep referenced from the Rhino model>)
brep_4 = Brep(<brep referenced from the Rhino model>)
merge = Merge(Data1=brep_3, Data2=brep_4, Data3=brep_2, Data4=brep)

# ----
# Base Map Reuleaux Calculation
resolution = Slider(0.4, range=0..1)
cullpt = CullDuplicates(Points=dam.DataSegment_pointcloud, Tolerance=0.01, CullMode=3)  # -> Points, Indices, Valence
py3_4 = Python3Script(
    goal_points=pt_2,
    base_poses=xy_2,
    reuleaux_map=load_map.reachabilitymap,
    map_resolution=resolution,
    compute=Toggle(True))  # -> out, base_map; inputs goal_points: list of Point3d, base_poses: list of Plane
# ---------- py3_4: Python ----------
__author__ = "Gido"
__version__ = "2023.09.12"

import rhinoscriptsyntax as rs
from compas.geometry import Frame, Pointcloud
from mobile_part_based_am.base_positioning import BaseMap
from compas_ghpython.drawing import draw_points

if compute:
    base_map = BaseMap()
    goal_pointcloud = Pointcloud(goal_points)
    # start_pointcloud = Pointcloud(start_points)
    if reuleaux_map.resolution == 0:
        reuleaux_map.resolution = map_resolution
    for base_pose in base_poses:
        base_frame = Frame(base_pose.Origin, base_pose.XAxis, base_pose.YAxis)
        
        base_map.get_reuleaux_index_by_base_pose(base_frame, reuleaux_map, goal_pointcloud)
# ---------- end py3_4 ----------
py3_5 = Python3Script(base_map=py3_4.base_map, segment_pointcloud=pt_2, collision_objects=brep_3)  # -> out, base_map, base_plane; inputs segment_pointcloud: list of Point3d, collision_objects: list of Brep
# ---------- py3_5: Python ----------
from compas.geometry import Pointcloud, KDTree, Vector
from compas_ghpython.drawing import draw_frame
import math
import ghpythonlib.components as ghcomp
import Rhino.Geometry as rg
from statistics import median_high

def get_ideal_pose_with_segment_and_collision_objects(base_map, segment_pointcloud, collision_breps, segment_distance=1.0, collision_distance=1.0, factor=1):
    ideal_key = None
    mean_dist = None
    mean_ri = None
    node_data = None
    mean_dists = []
    for key, data in base_map.base_map.nodes(data=True):
        kdtree = KDTree(segment_pointcloud)
        segment_result = kdtree.nearest_neighbors(data["point"], 20, distance_sort=True)
        pt, idx, dist = segment_result[0]
        vec = Vector.from_start_end(data["point"], pt)
        vec.z = 0
        dist = vec.length

        if dist < segment_distance:
            data["penalty_factor"] = math.sqrt(1 - (dist / segment_distance) / factor)
        else:
            data["penalty_factor"] = 0

        
        brep_distance = None
        for cbrep in collision_breps:
            # print(data["point"])
            # print(cbrep)
            collision_result = ghcomp.BrepClosestPoint(rg.Point3d(*data["point"]), cbrep)
            # print(collision_result)
            if brep_distance is None:
                brep_distance = collision_result["distance"]
            elif collision_result["distance"] < brep_distance:
                brep_distance = collision_result["distance"]
        # print(brep_distance, collision_distance)
        
        if brep_distance < collision_distance:
            data["collision_penalty_factor"] = math.sqrt(1 - (brep_distance / collision_distance) / factor)
        else: 
            data["collision_penalty_factor"] = 0

        sum_penalties = data["penalty_factor"] + data["collision_penalty_factor"]
        if data["penalty_factor"] + data["collision_penalty_factor"] > 1:
            sum_penalties = 1.0

        node_mean_ri = data["mean_reuleaux_index"] * (1 - sum_penalties)
        node_mean_dist = median_high([r[2] for r in segment_result])
        # print(node_mean_ri, node_mean_dist)
        mean_dists.append(node_mean_dist)
        if mean_ri is None or (mean_ri/mean_dist <= node_mean_ri/node_mean_dist):
            ideal_key = key
            mean_ri = node_mean_ri
            mean_dist = node_mean_dist
            node_data = data
    return ideal_key, node_data

pc = Pointcloud(segment_pointcloud)

key, data = get_ideal_pose_with_segment_and_collision_objects(base_map, pc, collision_objects, segment_distance=1.1, collision_distance=0.9)
# key, data, mdists= base_map.get_ideal_pose_with_closeness_penalty_and_mean_distance(pc)
# print(mdists)
# print(min(mdists))
# print(key)
base_plane = draw_frame(data['frame'])
# ---------- end py3_5 ----------
pln = Plane(py3_5.base_plane)

cap_2 = CapHoles(Brep=merge)
# Base Map Visualization
toggle = BooleanToggle(True)

# ---- group: All base poses
py3_6 = Python3Script(base_map=py3_5.base_map, apply_segment_penalty=toggle, apply_collision_penalty=Toggle(True), show=Toggle(True))  # -> out, planes, reuleaux_indices
# ---------- py3_6: Python ----------
__author__ = "Gido"
__version__ = "2023.09.12"

import rhinoscriptsyntax as rs
from compas_ghpython.drawing import draw_frame
from statistics import mean
import math

planes = []
reuleaux_indices = []
if show:
    for node, data in base_map.base_map.nodes(data=True):
        # print(node)
        planes.append(draw_frame(data['frame']))
        reuleaux_data = data['reuleaux_data']
        if apply_segment_penalty and apply_collision_penalty:
            sum_penalties = data["penalty_factor"] + data["collision_penalty_factor"]
            if data["penalty_factor"] + data["collision_penalty_factor"] > 1:
                sum_penalties = 1.0
            ri_mean = data["mean_reuleaux_index"] * (1- sum_penalties)
        elif apply_segment_penalty:
            ri_mean = data["mean_reuleaux_index"] * (1- data["penalty_factor"])
        elif apply_collision_penalty:
            ri_mean = data["mean_reuleaux_index"] * (1- data["collision_penalty_factor"])
        else:
            ri_mean = data['mean_reuleaux_index']
        reuleaux_indices.append(ri_mean)
# ---------- end py3_6 ----------
bnd = Bounds(Numbers=py3_6.reuleaux_indices)
dedomain = DeconstructDomain(Domain=bnd)  # -> Start, End
gradient_2 = Gradient(
    LowerLimit=dedomain.Start,
    UpperLimit=dedomain.End,
    Parameter=py3_6.reuleaux_indices,
    stops=[0.001: RGB(0, 0, 0), 0.276: RGB(254, 244, 84), 0.75: RGB(173, 203, 249), 1: RGB(75, 107, 169)])
dots_2 = DotDisplay(Point=py3_6.planes, Colour=gradient_2, Size=expr("x/10", Slider(0.4, range=0..1)))

# ----
cp = ClosestPoint(Point=py3_5.base_plane, Cloud=pl)  # -> ClosestPoint, CPIndex, Distance; disabled

manual = Slider(78, range=0..100)  # disabled
list_2 = ValueList({"Manual input": 0, "Ideal pose": 1}, selected="Ideal pose")  # disabled
toggle_2 = BooleanToggle(True)  # disabled
filter = StreamFilter(Gate=list_2, Stream0=manual, Stream1=cp.CPIndex)  # disabled
py3_7 = Python3Script(base_map=py3_5.base_map, reachabilitymap=load_map.reachabilitymap, idx=filter, show=toggle_2)  # -> out, base_plane, reuleaux_points, reuleaux_data, reuleaux_index, reachability_indices, points, values; disabled
# ---------- py3_7: Python ----------
__author__ = "Gido"
__version__ = "2023.09.12"

import rhinoscriptsyntax as rs
from compas_ghpython.utilities import draw_frame, draw_points

planes = []
reuleaux_indices = []
if show:
    i = 0
    for node, data in base_map.base_map.nodes(data=True):
        if i == idx:
            base_plane = draw_frame(data['frame'])
            reuleaux_index = data['mean_reuleaux_index']
            reuleaux_data = data['reuleaux_data']
            reuleaux_points = draw_points([{'pos': [pt.x, pt.y, pt.z]} for pt in reuleaux_data['reuleaux_points']])
            reachability_indices = [ri for point, ri in reachabilitymap.spheres_data(yield_ri=True)]
            points = draw_points([{'pos': [pt.x, pt.y, pt.z]} for pt in reuleaux_data['goal_points']])
            values = reuleaux_data['goal_reuleaux_index']
            break
        i += 1
# ---------- end py3_7 ----------
base_pose = Plane(py3_7.base_plane)  # disabled

sort = SortList(Keys=py3_6.reuleaux_indices, ValuesA=py3_6.planes)  # -> Keys, ValuesA

# ---- group: Reachability of evaluated goal_points
bnd_2 = Bounds(Numbers=py3_7.values)  # disabled
dedomain_2 = DeconstructDomain(Domain=bnd_2)  # -> Start, End; disabled
gradient_3 = Gradient(
    LowerLimit=dedomain_2.Start,
    UpperLimit=dedomain_2.End,
    Parameter=py3_7.values,
    stops=[0.001: RGB(0, 0, 0), 0.276: RGB(254, 244, 84), 0.75: RGB(173, 203, 249), 1: RGB(75, 107, 169)])  # disabled
number_slider = Slider(0.8, range=0..1)  # disabled
dots_3 = DotDisplay(Point=py3_7.points, Colour=gradient_3, Size=expr("x/10", number_slider))  # disabled

# ----
item_2 = ListItem(List=sort.ValuesA, Index=0, Wrap=True)  # -> Item1, Item
pln_2 = Plane(item_2.Item1)

# ---- group: Reachabilitymap at base_pose
gradient_4 = Gradient(
    LowerLimit=0,
    UpperLimit=100,
    Parameter=py3_7.reachability_indices,
    stops=[0.001: RGB(0, 0, 0), 0.276: RGB(254, 244, 84), 0.75: RGB(173, 203, 249), 1: RGB(75, 107, 169)])  # disabled
number_slider_2 = Slider(0.4, range=0..1)  # disabled
dots_4 = DotDisplay(Point=py3_7.reuleaux_points, Colour=gradient_4, Size=expr("x/10", number_slider_2))  # disabled
