# Grasshopper definition reading_3D_model.ghx (Grasshopper 1.0.8)

compas = Python3Script()  # -> out
# ---------- compas: Python ----------
import compas
print(compas.__version__)
# ---------- end compas ----------

# ----
# Generate brick parts
part = Python3Script()  # -> out, brick_full, brick_insulated, brick_half, brick_air_dried
# ---------- part: Python ----------
import os
from compas.geometry import Frame, Box
from compas.datastructures import Mesh
from climate_active_envelopes.assembly import CAEPart as Part



#brick_full
length, width, height = 0.24, 0.115, 0.075
brick_full = Part.from_dimensions(name = "brick_full", length=length, width=width, height=height)
#brick_full.gripping_frame




brick_air_dried = Part.from_dimensions(name = "brick_air_dried", length=length, width=width, height=height)


print(brick_full.frame)
#print(brick_full.attributes)
#print(brick_full.__data__)


#brick_insulated_placeholder_new
length, width, height = 0.24, 0.115, 0.075
brick_insulated = Part.from_dimensions(name = "brick_insulated", length=length, width=width, height=height)



# #brick_insulated_placeholder
# length, width, height = 0.245, 0.12, 0.075
# brick_insulated = Part.from_dimensions(length=length, width=width, height=height)
# brick_insulated.attributes['name'] = "brick_insulated"
# print(brick_insulated.__data__)

#corner brick
length, width, height = 0.245, 0.06, 0.075
brick_half = Part.from_dimensions(name = "brick_half", length=length, width=width, height=height)
#print(brick_half.__data__)

#brick_insulated
# package_path = ghdoc.Path
# data_path = os.path.abspath(os.path.join(package_path,"../../../climate_active_envelopes/data/brick_types"))
# filename = 'brick_insulated_reduced.stl'
# brick_insulated_mesh = Mesh.from_stl(os.path.join(data_path, filename))
# brick_insulated = Part.from_mesh_and_frame(brick_insulated_mesh)
# brick_insulated.attributes['name'] = "brick_insulated"
# #print(brick_insulated.__data__)
# ---------- end part ----------
list = ValueList({"none", "full", "insulated", "half"}, selected="full")
draw = Python3Script(brick_full=part.brick_full, brick_insulated=part.brick_insulated, brick_half=part.brick_half, show=list)  # -> M, P, GP
# ---------- draw: Python ----------
from compas_rhino.conversions import mesh_to_rhino, box_to_rhino, frame_to_rhino
from climate_active_envelopes.assembly import CAEPart as Part
from compas.geometry import Frame
from compas.geometry import Vector
from compas.geometry import Box


if show=="full":

    #extract the mesh of the part for visulization
    compas_mesh_full = brick_full.mesh

    #convert to rhino mesh
    M = mesh_to_rhino(compas_mesh_full)

    #extract and convert to rhino plane
    P = frame_to_rhino(brick_full.frame)
    GP = frame_to_rhino(brick_full.gripping_frame)

    #print(full_brick.__data__)
    #print(type(brick_full))

    
elif show == "insulated":
    
    #extract the mesh of the part for visulization
    compas_mesh_insulated = brick_insulated.mesh

    #convert to rhino mesh
    M = mesh_to_rhino(compas_mesh_insulated)
    
    #extract and convert to rhino plane
    P = frame_to_rhino(brick_insulated.frame)
    GP = frame_to_rhino(brick_insulated.gripping_frame)

elif show == "half":

    #extract the mesh of the part for visulization
    compas_mesh_half = brick_half.mesh

    #convert to rhino mesh
    M = mesh_to_rhino(compas_mesh_half)
    
    #extract and convert to rhino plane
    P = frame_to_rhino(brick_half.frame)
    GP = frame_to_rhino(brick_half.gripping_frame)
else:
    pass
# ---------- end draw ----------
mesh = Mesh(draw.M)
pln = Plane([draw.P, draw.GP])

# ----
# Unload Python modules
# Reading 3D Model
button = Button()
unload = Python3Script(unload=button)  # -> out, a
# ---------- unload: Python ----------
#from compas_ghpython.utilities import unload_modules
from compas_rhino import unload_modules

unload_modules('climate_active_envelopes')
unload_modules('assembly_information_model')
# ---------- end unload ----------

compas___version = Panel(compas)

# ----
# Create empty Assembly
button_2 = Button()
assembly = Python3Script(init=button_2)  # -> out, my_assembly
# ---------- assembly: Python ----------
from climate_active_envelopes.assembly import CAEAssembly as Assembly

#create empty assembly
my_assembly = Assembly()
print(my_assembly)
# ---------- end assembly ----------

# ----
# Shading Simulation
run = BooleanToggle(True)
brep = Brep(<brep referenced from the Rhino model>)
number_slider = Slider(0, range=0..360)
epw_file = FilePath("C:\Users\julia\Downloads\DEU_BY_Munich-Theresienwiese.108650_TMYx\DEU_BY_Munich-Theresienwiese.108650_TMYx.epw")
context_input = Brep(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)
sun_hours = SunHours(
    start_month=Slider(6, range=0..10),
    start_day=Slider(1, range=0..10),
    start_hour=Slider(11, range=0..100),
    end_month=Slider(8, range=0..10),
    end_day=Slider(31, range=0..100),
    end_hour=Slider(16, range=0..100),
    north=number_slider,
    geometry=brep,
    epw_file=epw_file,
    context=context_input,
    grid_size=Slider(0.03, range=0..0.1),
    run=run)  # -> hoys, location, sky_mtx, points, results, mesh, legend

bricks_rotating = Brep([<brep referenced from the Rhino model> x219])
bricks_translating = Brep([<brep referenced from the Rhino model> x221])
bricks_fixed = Brep([<brep referenced from the Rhino model> x98])
bricks_insulated = Brep([<brep referenced from the Rhino model> x1057])
bricks_half = Brep([<brep referenced from the Rhino model> x15])
bricks_air_dried = Brep([<brep referenced from the Rhino model> x155])

list_2 = ValueList({"rotate", "translate"}, selected="rotate")
list_3 = ValueList({"clockwise": "right", "counter clockwise": "left"}, selected="clockwise")
transform = Button()

# ----
# Sun Path
number_slider_2 = Slider(0.7, range=0..10)
pt = Point(Point(14.83702312, 2.706181295, 0))
sunpath = LBSunPath(north=number_slider, location=sun_hours.location, hoys=sun_hours.hoys, center_pt=pt, scale=number_slider_2)  # -> report, vectors, altitudes, azimuths, hoys, sun_pts, analemma, daily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; plug-in component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
geo = Geometry([sunpath.compass, sunpath.daily, sunpath.analemma, sunpath.legend, sunpath.title, sunpath.sun_pts])

# ----
# Climatic Simulation for self-shading properties
geo_2 = Geometry(sun_hours.legend)
panel = Panel(geo_2)

visualize = Python3Script(show=Toggle(True), mesh=sun_hours.mesh)  # -> out, M
# ---------- visualize: Python ----------
if show == True:
    M = mesh
# ---------- end visualize ----------
mesh_2 = Mesh(visualize.M)

bricks_insulated_arch = Brep([<brep referenced from the Rhino model> x19])
bricks_arch = Brep([<brep referenced from the Rhino model> x19])

bricks_cut_rotating = Brep([<brep referenced from the Rhino model> x10])
bricks_cut_translating = Brep([<brep referenced from the Rhino model> x4])
bricks_cut_insulated = Brep([<brep referenced from the Rhino model> x30])

# ----
# Generate brick assembly
boolean_toggle = BooleanToggle(True)
add_bricks = Python3Script(
    compute=boolean_toggle,
    my_assembly=assembly.my_assembly,
    bricks_rotating=bricks_rotating,
    bricks_translating=bricks_translating,
    bricks_fixed=bricks_fixed,
    bricks_insulated=bricks_insulated,
    bricks_half=bricks_half,
    bricks_air_dried=bricks_air_dried,
    brick_full=part.brick_full,
    brick_insulated=part.brick_insulated,
    brick_half=part.brick_half,
    brick_air_dried=part.brick_air_dried)  # -> out, my_assembly; inputs bricks_rotating: list of Brep, bricks_translating: list of Brep, bricks_fixed: list of Brep, bricks_insulated: list of Brep, bricks_half: list of Brep, bricks_air_dried: list of Brep
# ---------- add_bricks: Python ----------
my_assembly.set_brick_params(brick_full, brick_insulated, brick_half)


if compute == True:
    my_assembly.read_model_to_assembly(bricks_rotating, "brick_full", "rotate")
    my_assembly.read_model_to_assembly(bricks_translating, "brick_full", "translate")
    my_assembly.read_model_to_assembly(bricks_fixed, "brick_full", "fixed")
    my_assembly.read_model_to_assembly(bricks_insulated, "brick_insulated", "fixed")
    my_assembly.read_model_to_assembly(bricks_half, "brick_half", "fixed")
    my_assembly.read_model_to_assembly(bricks_air_dried, "brick_full", "fixed")
    
  
print(my_assembly)
# ---------- end add_bricks ----------
add_meshes = Python3Script(
    my_assembly=add_bricks.my_assembly,
    bricks_cut_rotating=bricks_cut_rotating,
    bricks_cut_translating=bricks_cut_translating,
    bricks_cut_insulated=bricks_cut_insulated)  # -> out, my_assembly; inputs bricks_cut_rotating: list of Mesh, bricks_cut_translating: list of Mesh, bricks_cut_insulated: list of Mesh
# ---------- add_meshes: Python ----------
from climate_active_envelopes.assembly import CAEPart as Part
from compas_rhino.conversions import  mesh_to_compas


for m in bricks_cut_rotating:
    mesh = mesh_to_compas(m)
    rotating_cut = Part.from_mesh_and_frame(mesh)
    my_assembly.add_part_from_model(rotating_cut, attr_dict={"brick_type": "rotating_cut", "transform_type": "rotate"})

for m in bricks_cut_translating:
    mesh = mesh_to_compas(m)
    translating_cut = Part.from_mesh_and_frame(mesh)
    my_assembly.add_part_from_model(translating_cut, attr_dict={"brick_type": "translating_cut", "transform_type": "translate"})

for m in bricks_cut_insulated:
    mesh = mesh_to_compas(m)
    insulated_cut = Part.from_mesh_and_frame(mesh)
    my_assembly.add_part_from_model(insulated_cut, attr_dict={"brick_type": "insulated_cut", "transform_type": "fixed"})
# ---------- end add_meshes ----------
interfaces = Python3Script(my_assembly=add_meshes.my_assembly, show_intersections=Toggle(True))  # -> out, my_assembly, meshes
# ---------- interfaces: Python ----------
from compas.geometry import Polygon, Point
from compas_rhino.conversions import mesh_to_rhino
from shapely.geometry import Polygon as ShapelyPolygon



courses = my_assembly.assembly_courses()
#print(courses)
#sorted_parts = [part for course in courses for part in course]



polygons = my_assembly.project_part_faces(courses)    
intersections = my_assembly.compute_polygon_intersections(polygons, courses)
#transformed_intersections = my_assembly.transform_intersections_to_original_course(intersections, courses)
transformed_intersections = my_assembly.transform_intersections_to_course_above(intersections, courses)
my_assembly.set_interface_points()

# Convert transformed intersections to meshes
meshes = []
if show_intersections:

    for key, intersection in transformed_intersections.items():
        mesh = intersection.to_mesh()
        rhino_mesh = mesh_to_rhino(mesh)
        meshes.append(rhino_mesh)




# def project_part_faces(courses):
#     courses = my_assembly.assembly_courses()
#     sorted_parts = [part for course in courses for part in course]
#     polygons = {}
#     for part in sorted_parts:
#         frame_point = my_assembly.graph.node_attributes(part, 'xyz')
#         part = my_assembly.part(part)
#         for face in part.mesh.faces():
#             face_vertices = part.mesh.face_vertices(face)
#             face_coords = [part.mesh.vertex_coordinates(vkey) for vkey in face_vertices]
#             if all(coord[2] == frame_point[2] for coord in face_coords):
#                 target_face = face
#         face_vertices = part.mesh.face_vertices(target_face)
#         vertices = [part.mesh.vertex_coordinates(vkey) for vkey in face_vertices]
#         projected_vertices = [(x, y) for x, y, z in vertices]
#         polygon = Polygon(projected_vertices)
#         polygons[part.key] = polygon
#     return polygons


# def compute_polygon_intersections(polygons, courses):
#     intersections = {}
#     for i in range(len(courses) - 1):
#         current_course = courses[i]
#         next_course = courses[i + 1]
#         for part in current_course:
#             part_polygon = polygons[part]
#             for neighbor in next_course:
#                 neighbor_polygon = polygons[neighbor]
#                 # Convert compas polygons to shapely polygons
#                 shapely_part_polygon = ShapelyPolygon([(point.x, point.y) for point in part_polygon.points])
#                 shapely_neighbor_polygon = ShapelyPolygon([(point.x, point.y) for point in neighbor_polygon.points])
#                 # Compute intersection
#                 intersection = shapely_part_polygon.intersection(shapely_neighbor_polygon)
#                 if not intersection.is_empty:
#                     # Convert shapely intersection back to compas polygon
#                     intersection_coords = list(intersection.exterior.coords)
#                     intersection_points = [Point(x, y, part_polygon.points[0].z) for x, y in intersection_coords]
#                     intersections[(part, neighbor)] = Polygon(intersection_points)
#     return intersections


# def transform_intersections_to_original_course(intersections, courses):
#     transformed_intersections = {}
#     for (part, neighbor), intersection in intersections.items():
#         part_course = next(i for i, course in enumerate(courses) if part in course)
#         neighbor_course = next(i for i, course in enumerate(courses) if neighbor in course)
#         if part_course < neighbor_course:
#             z_coord = my_assembly.graph.node_attribute(part, 'z')
#             transformed_intersection_points = [Point(p.x, p.y, z_coord) for p in intersection.points]
#             transformed_intersections[(part, neighbor)] = Polygon(transformed_intersection_points)
#         else:
#             z_coord = my_assembly.graph.node_attribute(neighbor, 'z')
#             transformed_intersection_points = [Point(p.x, p.y, z_coord) for p in intersection.points]
#             transformed_intersections[(neighbor, part)] = Polygon(transformed_intersection_points)

#         attr = {
#         'interface_type': 'face_face',
#         'interface_points': [(point.x, point.y, point.z) for point in transformed_intersection_points],
#         }
#         my_assembly.graph.add_edge(part, neighbor, attr_dict=attr)

#     return transformed_intersections

# def transform_intersections_to_course_above(intersections, courses):
#     transformed_intersections = {}
#     for (part, neighbor), intersection in intersections.items():
#         neighbor_course = next(i for i, course in enumerate(courses) if neighbor in course)
#         z_coord = my_assembly.graph.node_attribute(neighbor, 'z')
#         transformed_intersection_points = [Point(p.x, p.y, z_coord) for p in intersection.points]
#         transformed_intersections[(part, neighbor)] = Polygon(transformed_intersection_points)

#         attr = {
#             'interface_type': 'face_face',
#             'interface_points': [(point.x, point.y, point.z) for point in transformed_intersection_points],
#         }
#         my_assembly.graph.add_edge(part, neighbor, attr_dict=attr)

#     return transformed_intersections


# def set_interface_points(my_assembly):
#     for key in my_assembly.graph.nodes():
#         part = my_assembly.part(key)
#         frame_point = my_assembly.graph.node_attributes(key, 'xyz')
#         part = my_assembly.part(key)
#         for face in part.mesh.faces():
#             face_vertices = part.mesh.face_vertices(face)
#             face_coords = [part.mesh.vertex_coordinates(vkey) for vkey in face_vertices]
#             if all(coord[2] == frame_point[2] for coord in face_coords):
#                 target_face = face
#         face_vertices = part.mesh.face_vertices(target_face)
#         vertices = [part.mesh.vertex_coordinates(vkey) for vkey in face_vertices]
#         projected_vertices = [(x, y) for x, y, z in vertices]
#         polygon = Polygon(projected_vertices)
#         my_assembly.graph.node_attribute(key, 'interface_points', projected_vertices)
# ---------- end interfaces ----------
add_arch_bricks = Python3Script(my_assembly=interfaces.my_assembly, bricks_arch=bricks_arch, bricks_insulated_arch=bricks_insulated_arch)  # -> out, my_assembly; inputs bricks_arch: list of Brep, bricks_insulated_arch: list of Brep
# ---------- add_arch_bricks: Python ----------
my_assembly.read_model_to_assembly(bricks_arch, "brick_full", "fixed")
my_assembly.read_model_to_assembly(bricks_insulated_arch, "brick_insulated", "fixed")
# ---------- end add_arch_bricks ----------
mesh_3 = Mesh(interfaces.meshes)

# ----
# Apply Gradient
values = Python3Script(results=sun_hours.results, min_value=Slider(-0.3, range=-0.4..0.1), max_value=Slider(0.2, range=0..0.5))  # -> out, normalized_values; inputs results: list
# ---------- values: Python ----------
from compas.itertools import normalize_values



def normalize_to_highest(values, max_value=140.0, target_min=0.1, target_max=1):
    """Normalizes a list of values based on the highest value in the list, 
    scaled to a specific range.

    Args:
    values: A list of numerical values.
    max_value: The expected maximum value. Defaults to 140.0.
    target_min: The minimum value of the target range. Defaults to 0.0.
    target_max: The maximum value of the target range. Defaults to 1.0.

    Returns:
    A list of normalized values.
    """
    highest_value = max(values)

    factor = highest_value / max_value
    print(factor)  # Calculate the scaling factor
    normalized_values = normalize_values(values, target_min, target_max * factor)
    return normalized_values

normalized_values = normalize_values(results, min_value, max_value)
#normalized_values = normalize_to_highest(results)
#print(color_values)

print(max(normalized_values))

print(normalized_values)
# ---------- end values ----------
keys = Python3Script(my_assembly=add_arch_bricks.my_assembly, transform_type=list_2)  # -> out, my_assembly, keys; inputs transform_type: String
# ---------- keys: Python ----------
# for node_id in my_assembly.graph.nodes():
#     transform_type = my_assembly.graph.node_attribute(node_id, 'transform_type')





keys = []
for key in my_assembly.graph.nodes_where({"transform_type": transform_type}):
    keys.append(key)

print(keys)
print(transform_type)
# ---------- end keys ----------
apply_gradient = Python3Script(
    my_assembly=keys.my_assembly,
    normalized_values=values.normalized_values,
    pts=sun_hours.points,
    keys=keys.keys,
    transform_type=list_2,
    rotation_direction=list_3,
    nrbh_size=Slider(15, range=2..250),
    transform=transform)  # -> out, my_assembly; inputs normalized_values: list, pts: list of Point3d, keys: list, nrbh_size: Int32
# ---------- apply_gradient: Python ----------
from compas_rhino.conversions import point_to_compas



#print(my_assembly.__data__)

transform_types = {node_id: my_assembly.graph.node_attribute(node_id, 'transform_type') for node_id in my_assembly.graph.nodes()}
#print(transform_types)

if transform:
    points = []
    for p in pts:
        point = point_to_compas(p)
        points.append(point)

    #assembly = my_assembly
    my_assembly.apply_gradient(normalized_values,points,keys,transform_type, rotation_direction, nrbh_size)
# ---------- end apply_gradient ----------

show_all = BooleanToggle(False)
show_connections = BooleanToggle(False)
show_until_key = BooleanToggle(True)
show_course = BooleanToggle(False)
show_neighbors = BooleanToggle(False)
show_patch = BooleanToggle(False)
show_patch_until_counter = BooleanToggle(False)
show_patches = BooleanToggle(True)
highlight_current_part = BooleanToggle(True)

step = Button()
back = Button()
reset = Button()

curve = Curve(<curve referenced from the Rhino model>)
divide = DivideCurve(Curve=curve, Count=20, Kinks=False)  # -> Points, Tangents, Parameters
pt_2 = Point(divide.Points)

start = Button()
stop = Button()
step_2 = Button()
back_2 = Button()
reset_2 = Button()
full = Button()
list_4 = ValueList({"20", "50", "100", "500", "1000", "5000"}, selected="50")

y_axis = Curve(<curve referenced from the Rhino model>)
x_axis = Curve(<curve referenced from the Rhino model>)
plane = Python3Script(plane_axes=[x_axis, y_axis])  # -> out, plane, sphere; inputs plane_axes: list of Curve
# ---------- plane: Python ----------
import Rhino.Geometry as rg
from compas_rhino.conversions import  plane_to_compas_frame, sphere_to_rhino
from compas.geometry import Sphere

x_axis, y_axis = plane_axes



x_axis = rg.Line(x_axis.PointAtStart, x_axis.PointAtEnd)
y_axis = rg.Line(y_axis.PointAtStart, y_axis.PointAtEnd)

if x_axis.From.DistanceTo(y_axis.From) < 0.01:
    origin = x_axis.From
    xvec = x_axis.Direction
    yvec = y_axis.Direction
elif x_axis.To.DistanceTo(y_axis.To) < 0.01:
    origin = x_axis.To
    xvec = -x_axis.Direction
    yvec = -y_axis.Direction
elif x_axis.From.DistanceTo(y_axis.To) < 0.01:
    origin = x_axis.From
    xvec = x_axis.Direction
    yvec = -y_axis.Direction
elif x_axis.To.DistanceTo(y_axis.From) < 0.01:
    origin = x_axis.To
    xvec = -x_axis.Direction
    yvec = y_axis.Direction

plane = rg.Plane(origin, xvec, yvec)

compas_sphere = Sphere(frame = plane_to_compas_frame(plane), radius=1.5)
sphere = sphere_to_rhino(compas_sphere)
# ---------- end plane ----------
geo_3 = Geometry(plane.sphere)
preview = CustomPreview(Geometry=geo_3, Material=ColourSwatch(SwatchColor=RGBA(131, 85, 57, 100)))

list_5 = ValueList({"1": 0, "2": 20, "3": 10, "4": 2, "5": 18, "6": 0, "7": 20, "8": 10, "9": 3, "10": 16}, selected="1")
frame = Python3Script(start_plane=plane.plane, pts=divide.Points, plane_idx=list_5)  # -> out, origin_frame; inputs pts: list of Point3d, plane_idx: Int32
# ---------- frame: Python ----------
import math

import Rhino.Geometry as rg
import ghpythonlib.components as ghcomp

#from compas_ghpython import draw_frame
from compas.geometry import Frame

sp = start_plane

idx = plane_idx

planes = [rg.Plane(pt, sp.XAxis, sp.YAxis) for pt in pts]
frames = [Frame(p.Origin, p.XAxis, p.YAxis) for p in planes]

origin_plane = planes[idx]
#robot_origin_frame = frames[idx]
origin_frame = frames[idx]
print(origin_frame)
# ---------- end frame ----------

# ----
# Generate buildable patches
sequences = Python3Script(
    assembly=apply_gradient.my_assembly,
    plane=plane.plane,
    origin_frame=frame.origin_frame,
    compute_sequence_in_reach=Button(),
    clear_sequ=Button())  # -> out, assembly; inputs plane: Plane
# ---------- sequences: Python ----------
from compas.geometry import Point
from compas_rhino.conversions import  plane_to_compas_frame
from scriptcontext import sticky as st


# store data in component
guid = str(ghenv.Component.InstanceGuid)
patch_num_key  = "patch_num_" + guid

if patch_num_key not in st:
    st[patch_num_key] = 1


def get_nbrs_under(key):
    nbrs = assembly.graph.neighbors(key)
    #key_z = assembly.graph.node_attribute(key, "z")
    nbrs_under = [n for n in nbrs if assembly.graph.node_attribute(n, "course")<assembly.graph.node_attribute(key, "course")]
    return nbrs_under

# def get_nbrs_above(key):
#     nbrs = assembly.graph.neighbors(key)
#     nbrs_above = [n for n in nbrs if assembly.graph.node_attribute(n, "course") > assembly.graph.node_attribute(key, "course")]
#     return nbrs_above

def is_node_satisfied(key):
    nbrs_under = get_nbrs_under(key)
    if len(nbrs_under):
        for n in nbrs_under:
            if assembly.graph.node_attribute(n, "used") == False:
                return False
    print(f"Node {key} is satisfied.")
    return True


def dist_to_frame(key, origin_frame):
    part_origin = assembly.part(key).frame
    ro = origin_frame.point
    # ro = robot_origin.point
    ro_mirror = Point(ro.x, -(ro.y)-0.2, ro.z-0.35)
    dist = ro_mirror.distance_to_point(part_origin.point)
    return dist

def compute_all_in_reach():
    keys = list(assembly.graph.nodes_where({"used": False}))
    keys_in_patch = []
    frame = plane_to_compas_frame(plane)
    for key in keys:
        dist = dist_to_frame(key, frame)
        if dist < 1.2 and is_node_satisfied(key):
            keys_in_patch.append(key)
            assembly.graph.node_attribute(key, 'used', True)
    return keys_in_patch

if clear_sequ:
    assembly.graph.nodes_attribute(name='used', value=0)
    assembly.graph.nodes_attribute(name='patch', value=0)
    st[patch_num_key] = 1
    assembly.graph.attributes['patch_num'] = st[patch_num_key] 

if compute_sequence_in_reach:
    keys_in_patch = []
    while True:
        new_keys = compute_all_in_reach()
        if not new_keys:
            break
        keys_in_patch.extend(new_keys)
    print(f"Keys in Patch: {keys_in_patch}")
    assembly.graph.nodes_attribute(name='patch', value=st[patch_num_key], keys=keys_in_patch)
    
    #assembly.graph.attributes['patch_num'] = st[patch_num_key] 

    patch_data = {
        'patch_number': st[patch_num_key],
        'parts': {}  # Store part data here
    }

    for key in keys_in_patch:
        part_attributes = assembly.graph.node_attributes(key=key)
        patch_data['parts'][key] = part_attributes


    assembly.graph.attributes['patch_num'] = patch_data
    st[patch_num_key] += 1
# import json

# # Export patch data to JSON, including the graph attribute
# patch_data = {"patch_num": assembly.graph.attributes.get('patch_num', None)}
# with open("patch_data.json", "w") as f:
#     json.dump(patch_data, f)
# ---------- end sequences ----------

counter = Python3Script(
    my_assembly=sequences.assembly,
    start=start,
    stop=stop,
    step=step_2,
    step_back=back_2,
    reset=reset_2,
    full=full,
    interval=list_4)  # -> out, node_key, counter
# ---------- counter: Python ----------
from scriptcontext import sticky as st
import Grasshopper

courses = my_assembly.assembly_courses(tol= 0.0001)
#courses = my_assembly.assembly_courses_xy(tol= 0.0001)
#courses = (my_assembly.assembly_courses_xyz(tol= 0.0001, z_tol = 0.1))


L = [node for course in courses for node in course]
# print(L)



def update_component(ghenv, delay):
    """Schedule an update of the Grasshopper component.

    After the specified delay, the GH component will be automatically updated.

    Parameters
    ----------
    ghenv : :class:`GhPython.Component.PythonEnvironment`
        The current GHPython environment.
    delay : :obj:`int`
        Time in milliseconds until the update is performed.

    Raises
    ------
    ValueError
        If the delay is less than zero.

    """
    if delay <= 0:
        raise ValueError("Delay must be greater than zero")

    ghcomp = ghenv.Component
    ghdoc = ghcomp.OnPingDocument()

    def callback(ghdoc):
        if ghdoc.SolutionState != Grasshopper.Kernel.GH_ProcessStep.Process:
            ghcomp.ExpireSolution(False)

    ghdoc.ScheduleSolution(delay, Grasshopper.Kernel.GH_Document.GH_ScheduleDelegate(callback))




guid = str(ghenv.Component.InstanceGuid)
counter_key = "counter_" + guid
running_key = "running_" + guid

if counter_key not in st:
    st[counter_key] = 0

if running_key not in st:
    st[running_key] = False

if st[running_key]:
    if st[counter_key] < len(L) - 1:
        st[counter_key] += 1
        update_component(ghenv, interval)
    else:
        st[counter_key] = 0
        st[running_key] = False

if start:
    st[running_key] = True

if stop:
    st[running_key] = False

if step:
    if st[counter_key] < len(L) - 1:
        st[counter_key] += 1

if step_back:
    if st[counter_key] < len(L) - 1:
        st[counter_key] -= 1

if reset:
    st[counter_key] = 0
    st[running_key] = False

if full:
    st[counter_key] = len(L) - 1

if len(L):
    node_key = L[st[counter_key]]
    print(f"Current node item: {node_key}")

#st["visualisation_counter"] = st[counter_key]
counter = st[counter_key] + 1

print(L)
# ---------- end counter ----------
panel_2 = Panel(counter.counter)

list_6 = ValueList({"1", "2", "3", "4", "5"}, selected="2")
visualize_2 = Python3Script(
    my_assembly=sequences.assembly,
    show_all=show_all,
    show_connections=show_connections,
    show_until_key=show_until_key,
    show_course=show_course,
    show_neighbors=show_neighbors,
    show_patch=show_patch,
    show_patch_until_counter=show_patch_until_counter,
    show_patches=show_patches,
    highlight_current_part=highlight_current_part,
    node_key=counter.node_key,
    step=step,
    step_back=back,
    reset=reset,
    patch_idx=list_6)  # -> out, parts_geometry, parts_frame, current_part_geometry, current_part_frame, current_part_gripping_frame, G_connections, G_course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; inputs patch_idx: Int32
# ---------- visualize_2: Python ----------
from compas_rhino.conversions import mesh_to_rhino, box_to_rhino, frame_to_rhino
from compas.colors import Color
import Rhino.Geometry as rg
import ghpythonlib.components as ghcomp
from scriptcontext import sticky as st

courses = my_assembly.assembly_courses(tol= 0.0001)

#courses = my_assembly.assembly_courses_xyz(tol= 0.0001, z_tol = 0.1)
#courses = my_assembly.assembly_courses_xy(tol= 0.0001)

L = [node for course in courses for node in course]


G_neighbors = []
G_connections = []
G_course = []
G_patch = []
G_patches =  []
G_sequence_wtop_key = []
G_patches_color = []


key_index = my_assembly.graph.node_index()
keys = [key_index[key] for key in my_assembly.graph.nodes()]
#key = node_key

#get parts datastructure
parts = [p for p in my_assembly.parts()]

if show_all:

    parts = [p for p in my_assembly.parts()]
    parts_geometry = []
    parts_frame = []
    for p in parts:
        parts_geometry.append(mesh_to_rhino(p.mesh))
    parts_frame = [frame_to_rhino(p.frame) for p in parts]
    key = my_assembly.graph.number_of_nodes()-1

if show_connections:
    edges = list(my_assembly.connections())
    for e in edges:
        part1 = my_assembly.part(e[0])
        part2 = my_assembly.part(e[1])
        if not hasattr(part1.frame, 'point') or not hasattr(part2.frame, 'point'):
            print(f"Missing frame point for edge: {e}")
            continue
        p1 = part1.frame.point
        p2 = part2.frame.point
        G_connections += [rg.Line(p1[0], p1[1], p1[2], p2[0], p2[1], p2[2])]

        # p1 = my_assembly.part(e[0]).frame.point
        # p2 = my_assembly.part(e[1]).frame.point
        # G_connections += [rg.Line(p1[0],p1[1],p1[2],p2[0],p2[1],p2[2])]

if show_neighbors:
    nbrs = [key_index[key] for key in my_assembly.graph.neighbors(key=node_key)]
    parts = [my_assembly.part(key) for key in nbrs]
    for p in parts:
        G_neighbors.append(mesh_to_rhino(p.mesh))

if show_course:
    total_courses = max(my_assembly.graph.nodes_attribute('course')) + 1
    course = my_assembly.graph.node_attribute(key=node_key, name='course')
    keys_in_course = list(my_assembly.graph.nodes_where({'course': course}))
    parts = [my_assembly.part(key) for key in keys_in_course]
    for p in parts:
        G_course.append(mesh_to_rhino(p.mesh))

if show_until_key:
    current_index = L.index(node_key)
    parts_geometry = [mesh_to_rhino(parts[key].mesh) for key in L[:current_index + 1]]
    parts_frame = [frame_to_rhino(parts[key].frame) for key in L[:current_index + 1]]
    key = node_key

if show_patch:
    c_max = max(my_assembly.graph.nodes_attribute(name='patch'))
    keys_in_patch = list(my_assembly.graph.nodes_where({'patch': patch_idx}))
    L_patch = [node for course in courses for node in course if node in keys_in_patch]

    guid = str(ghenv.Component.InstanceGuid)
    counter_key = "counter_" + guid
    running_key = "running_" + guid
    if counter_key not in st:
        st[counter_key] = 0
    if step:
        if st[counter_key] < len(L_patch) - 1:
            st[counter_key] += 1
    if step_back:
        if st[counter_key] < len(L_patch) - 1:
            st[counter_key] -= 1
    if reset:
        st[counter_key] = 0
    if len(L_patch):
        patch_key = L_patch[st[counter_key]]
        print(f"Current node item: {patch_key}")
    if show_patch_until_counter:
        current_index = L_patch.index(patch_key)
        parts = [mesh_to_rhino(my_assembly.part(key).mesh) for key in L_patch[:current_index + 1]]
    else:
        parts = [mesh_to_rhino(my_assembly.part(key).mesh) for key in keys_in_patch]
    for p in parts:
        G_patch.append(p)
    key = patch_key

    # if show_sequence_wtop_key:
    #     #key = 100
    #     sequ = my_assembly.assembly_building_sequence(patch_key)
    #     print(sequ)
    #     parts = [my_assembly.part(patch_key) for patch_key in sequ]
    #     for p in parts:
    #         G_sequence_wtop_key.append(mesh_to_rhino(p.mesh))
    # key = patch_key



if show_patches:
    c_max = max(my_assembly.graph.nodes_attribute(name='patch')) + 1
    for patch_index in range(1, c_max):
        keys_in_patch = list(my_assembly.graph.nodes_where({'patch': patch_index}))
        parts = [my_assembly.part(key) for key in keys_in_patch]
        for p in parts:
            G_patches.append(mesh_to_rhino(p.mesh))
            color_value = (1 - patch_index / c_max) - 0.2
            color_value = max(0, min(color_value, 1))  # Ensure the color value is within [0, 1]   
            r = int(255 * (3*color_value))
            g = int(255 * (5*color_value))
            b = int(255 * (1.5*color_value))          
            G_patches_color.append(ghcomp.ColourRGB(r, g, b))

        
# if show_nothing:
#     print("Nothing to see")
#     pass


if highlight_current_part:
    current_part = my_assembly.part(key)
    current_part_geometry = mesh_to_rhino(current_part.mesh)
    current_part_frame = frame_to_rhino(current_part.frame)
    current_part_gripping_frame = frame_to_rhino(current_part.gripping_frame)
    print(current_part.__data__)
    
print(my_assembly)
# ---------- end visualize_2 ----------

geo_4 = Geometry(visualize_2.current_part_gripping_frame)
geo_5 = Geometry(visualize_2.G_neighbors)
geo_6 = Geometry([visualize_2.current_part_geometry, visualize_2.G_connections, visualize_2.G_course])
geo_7 = Geometry([visualize_2.parts_frame, visualize_2.current_part_frame])
geo_8 = Geometry(visualize_2.G_patches)
geo_9 = Geometry(visualize_2.parts_geometry)
preview_2 = CustomPreview(Geometry=geo_9, Material=ColourSwatch(SwatchColor=RGB(196, 141, 141)))
preview_3 = CustomPreview(Geometry=geo_7, Material=ColourSwatch(SwatchColor=RGB(255, 125, 157)))
preview_4 = CustomPreview(Geometry=geo_6, Material=ColourSwatch(SwatchColor=RGB(204, 103, 157)))
preview_5 = CustomPreview(Geometry=geo_4, Material=ColourSwatch(SwatchColor=RGB(246, 202, 157)))
preview_6 = CustomPreview(Geometry=geo_5, Material=ColourSwatch(SwatchColor=RGB(246, 131, 141)))
preview_7 = CustomPreview(Geometry=geo_8, Material=visualize_2.G_patches_color)

# ----
# Radiation Simulation
run_2 = BooleanToggle(False)
radiation_simulation = RadiationSimulation(sky_mtx=sun_hours.sky_mtx, geometry=geo_9, context=context_input, run=run_2)  # -> mesh, legend
brick_wall = Mesh(radiation_simulation.mesh)
geo_10 = Geometry(radiation_simulation.legend)

# ----
# Visualisation Dashboard
panel_3 = Panel(visualize_2.out)
draw_2 = Python3Script(planes=geo_4, scale=Slider(0.2, range=0..1))  # -> out, P, V, C, W; inputs planes: list of Plane
# ---------- draw_2: Python ----------
from System.Drawing import Color

red = Color.FromArgb(255, 0, 0)
green = Color.FromArgb(0, 255, 0)
blue = Color.FromArgb(0, 0, 255)

P = []
V = []
C = []

scale = float(scale)

for plane in planes:
    if not plane:
        continue
    P += [plane.Origin] * 3
    V.append(plane.XAxis * scale)
    V.append(plane.YAxis * scale)
    V.append(plane.ZAxis * scale)
    C += [red, green, blue]

W = 3
# ---------- end draw_2 ----------
vdisex = VectorDisplayEx(Point=draw_2.P, Vector=draw_2.V, Colour=draw_2.C, Width=draw_2.W)

geo_11 = Geometry(visualize_2.G_patch)
export = Button()

# ----
# Export to JSON
path = Python3Script()  # -> HERE, DATA, ASSEMBLY
# ---------- path: Python ----------
import os

HERE = os.path.dirname(ghdoc.Path)
DATA = os.path.abspath(os.path.join(HERE, "..", "data"))
ASSEMBLY = os.path.abspath(os.path.join(DATA, "assembly"))

print(HERE)
print(DATA)
print(ASSEMBLY)
# ---------- end path ----------
export_2 = Button()
export_3 = Python3Script(ASSEMBLY=path.ASSEMBLY, DATA=path.DATA, my_assembly=sequences.assembly, export_patch=export_2, export_assembly=export)  # -> out; inputs ASSEMBLY: String
# ---------- export_3: Python ----------
import os
import json
from compas.datastructures import Assembly
from scriptcontext import sticky as st


# print(my_assembly.graph.nodes_attribute(name='patch', value=st[patch_num_key], keys=keys_in_patch))

courses = my_assembly.assembly_courses(tol=0.0001)
c_max = max(my_assembly.graph.nodes_attribute(name="patch"))
keys_in_patch = list(my_assembly.graph.nodes_where({"patch": c_max}))
L_patch = [node for course in courses for node in course if node in keys_in_patch]


if export_patch:
    filename_patch_data = "patch_1_data_test.json"
    PATH_patch_data = os.path.join(ASSEMBLY, filename_patch_data)

    # Create a dictionary to store the patch node data
    patch_nodes_data = {}

    # Iterate through the patch nodes and extract their attributes
    for node_key in L_patch:
        node_attributes = my_assembly.graph.node_attributes(node_key)
        patch_nodes_data[node_key] = node_attributes

    # Serialize the patch node data to JSON
    with open(PATH_patch_data, "w") as f:
        json.dump(patch_nodes_data, f, indent=4)

    print(f"Patch node data exported to {PATH_patch_data}")


# if export_patch:
#     filename_patch_data = "patch_1_data_test.json"
#     PATH_patch_data = os.path.join(ASSEMBLY, filename_patch_data)
#     stored_patch_data = my_assembly.graph.attributes['patch_num']


if export_assembly:
    # Optionally, export the entire assembly (if needed)
    filename_assembly = "assembly.json"
    PATH_assembly = os.path.join(ASSEMBLY, filename_assembly)

    my_assembly.to_json(PATH_assembly, pretty=True)
    print(f"Assembly exported to {PATH_assembly}")
    print(my_assembly)
# ---------- end export_3 ----------

preview_8 = CustomPreview(Geometry=geo_11, Material=ColourSwatch(SwatchColor=RGB(246, 131, 141)))

# ----
# Import from JSON
import = Button()
path_2 = Python3Script()  # -> out, DATA
# ---------- path_2: Python ----------
import os
import getpass

package_path = ghdoc.Path
username = getpass.getuser()
USER_FOLDER = os.path.abspath(os.path.join("C:/Users/", username))
DATA = os.path.abspath(os.path.join(package_path,"../../data/assembly"))

print(USER_FOLDER)
print(DATA)
# ---------- end path_2 ----------
import_2 = Python3Script(DATA=path_2.DATA, import=import)  # -> out, assembly; inputs DATA: String
# ---------- import_2: Python ----------
import os
import json
from assembly_information_model.assembly import Assembly

from scriptcontext import sticky as st
#from compas.datastructures.network import Network
if _import:
    filename = "patch_1_data.json"
    PATH = os.path.join(DATA, filename)
    print(PATH)

    try:
        with open(PATH, 'r') as f:
            patch_data = json.load(f)

        # Now you have the patch_data dictionary
        # You can access the data like this:
        # patch_number = patch_data['patch_number']
        # parts = patch_data['parts']

        # Example: print the patch number
        print(f"Imported Patch Number: {patch_data.get('patch_number')}")

        st['patch_data'] = patch_data # store patch data in st

    except FileNotFoundError:
        print(f"Error: File not found at {PATH}")
    except json.JSONDecodeError:
        print(f"Error: Invalid JSON format in {PATH}")
    except KeyError as e:
        print(f"Error: Missing key {e} in JSON data.")
    except Exception as e:
        print(f"An unexpected error occurred: {e}")

assembly = st.get('assembly')



#     filename = "250321_demonstrator_v1.json"
#     PATH = os.path.join(DATA, filename)
#     print(PATH)
#     # the assembly has to be serialized such that it can be called from CPython
#     assembly = Assembly.from_json(PATH)
#     st['assembly'] = assembly

# assembly = st.get('assembly')
# ---------- end import_2 ----------

panel_4 = Panel(import_2.out)
toggle = BooleanToggle(True)

button_3 = Button()  # disabled
# ROBOT
py3 = Python3Script()  # -> HERE, DATA, ROBOT_DESCRIPTION; disabled
# ---------- py3: Python ----------
import os

HERE = os.path.dirname(ghdoc.Path)
DATA = os.path.abspath(os.path.join(HERE, "..", "data"))
ROBOT_DESCRIPTION = os.path.abspath(os.path.join(DATA, "robot_description"))

print(HERE)
print(DATA)
print(ROBOT_DESCRIPTION)
# ---------- end py3 ----------
reload = Python3Script(reload=button_3)  # -> out; disabled
# ---------- reload: Python ----------
if reload:
    from compas_rhino import unload_modules
    unload_modules("assembly_information_model")
    unload_modules('mobile_robot_control')
    unload_modules('fabrication_manager')
    unload_modules('ur_fabrication_control')
    unload_modules('spaicr')
# ---------- end reload ----------

origin = Point(Point(11.92859817, -0.7565220575, -0.15))  # disabled

# ----
# ROS client
list_7 = ValueList({"local": "127.0.0.1", "linux computer": "192.168.0.42", "linux eduroam": "10.181.95.254", "linux ccnet": "192.168.0.102", "linux vmware": "192.168.199.36", "robot": "192.168.0.200", "robotAA_wifi": "192.168.0.111", "robotAB_wifi": "192.168.0.112", "robotAB_eduroam": "10.181.67.95"}, selected="local")  # disabled
panel_5 = Panel("9090")  # disabled
connect = BooleanToggle(True)  # disabled
ros = Python3Script(ip=list_7, port=panel_5, connect=connect)  # -> out, ros_client, is_connected; inputs ip: String, port: Int32, connect: Boolean; disabled
# ---------- ros: Python ----------
"""
Connect or disconnect to ROS.

COMPAS FAB v0.27.0
"""
from scriptcontext import sticky as st

from compas_fab.backends import RosClient

ros_client = None

ip = ip or '127.0.0.1'
port = port or 9090
key = "ros_client_001"
ros_client = st.get(key, None)

if ros_client:
    st[key].close()
if connect:
    st[key] = RosClient(ip, port)
    st[key].run(5)

ros_client = st.get(key, None)
is_connected = ros_client.is_connected if ros_client else False
# ---------- end ros ----------
panel_6 = Panel(ros.is_connected)  # disabled

x_axis_2 = Curve(<curve referenced from the Rhino model>)  # disabled
y_axis_2 = Curve(<curve referenced from the Rhino model>)  # disabled
plane_2 = Python3Script(plane_axes=[x_axis_2, y_axis_2])  # -> plane; inputs plane_axes: list of Curve; disabled
# ---------- plane_2: Python ----------
import Rhino.Geometry as rg

x_axis, y_axis = plane_axes



x_axis = rg.Line(x_axis.PointAtStart, x_axis.PointAtEnd)
y_axis = rg.Line(y_axis.PointAtStart, y_axis.PointAtEnd)

if x_axis.From.DistanceTo(y_axis.From) < 0.01:
    origin = x_axis.From
    xvec = x_axis.Direction
    yvec = y_axis.Direction
elif x_axis.To.DistanceTo(y_axis.To) < 0.01:
    origin = x_axis.To
    xvec = -x_axis.Direction
    yvec = -y_axis.Direction
elif x_axis.From.DistanceTo(y_axis.To) < 0.01:
    origin = x_axis.From
    xvec = x_axis.Direction
    yvec = -y_axis.Direction
elif x_axis.To.DistanceTo(y_axis.From) < 0.01:
    origin = x_axis.To
    xvec = -x_axis.Direction
    yvec = y_axis.Direction

plane = rg.Plane(origin, xvec, yvec)
# ---------- end plane_2 ----------

# ----
# Load robot from ROS
load = Button()  # disabled
panel_7 = Panel("")  # disabled
# Make sure that ros bridge, file server, tf2_web_republisher and moveit config is running on the robot!
mobile_robot = Python3Script(ros_client=ros.ros_client, prefix=panel_7, load=load)  # -> out, mobile_robot; inputs prefix: String; disabled
# ---------- mobile_robot: Python ----------
from mobile_robot_control.mobile_robot import MobileRobot
from mobile_robot_control.mobile_robot_client import MobileRobotClient
from scriptcontext import sticky as st
from compas.scene import SceneObject
import Rhino
import scriptcontext

# Set Rhino document context to the active Rhino doc
scriptcontext.doc = Rhino.RhinoDoc.ActiveDoc

from compas_robots.ghpython.scene import RobotModelObject

key = 'robot_AA'
print(key)
if ros_client and ros_client.is_connected and load:
    # Set Rhino context again before interacting with Rhino-specific objects


    # Load URDF from ROS
    robot = ros_client.load_robot(
            load_geometry=True, 
            urdf_param_name= '{}/robot_description'.format(prefix),
            srdf_param_name= '{}/robot_description_semantic'.format(prefix))
    scriptcontext.doc = ghdoc
    robot.scene_object = SceneObject(item=robot.model)
    #robot.scene_object = RobotModelObject(robot.model)
    mobile_robot = MobileRobot(robot.model, robot.scene_object, robot.semantics, client=None)
    st[key] = mobile_robot

    
    # Restore the Grasshopper document context after modifying Rhino objects


# Accessing the mobile_robot object in Grasshopper context
mobile_robot = st.get(key, None)
if mobile_robot:
    # Ensure we're in the Grasshopper context before doing operations specific to Grasshopper
    mobile_robot.mobile_client = MobileRobotClient(ros_client)
    mobile_robot.client = ros_client
# ---------- end mobile_robot ----------

robot = Data(mobile_robot.mobile_robot)  # disabled
info = Python3Script(robot=robot)  # -> out, main_group_name; disabled
# ---------- info: Python ----------
if robot:
    robot.info()
    main_group_name = robot.main_group_name
# ---------- end info ----------
panel_8 = Panel(info.out)  # disabled

# ----
# Attach tool
list_8 = ValueList({"measurement tool": 0, "area gripper": 1, "parallell gripper": 2, "combined tool (extruder)": 3, "combined tool (gripper)": 4}, selected="combined tool (gripper)")  # disabled
show = BooleanToggle(True)  # disabled
path_3 = Python3Script()  # -> DATA; disabled
# ---------- path_3: Python ----------
import os

package_path = ghdoc.Path
DATA = os.path.abspath(os.path.join(package_path,"../../data"))

print(package_path)
print(DATA)
# ---------- end path_3 ----------
tool = Python3Script(data_path=path_3, tool=list_8, show=show)  # -> tool, M, ee_plane; inputs data_path: String; disabled
# ---------- tool: Python ----------
import os, math
from compas.geometry import Frame, Rotation, Vector, Quaternion
from compas.datastructures import Mesh
from compas_rhino.conversions import mesh_to_rhino, frame_to_rhino_plane
from compas_fab.robots import Tool

tolerance = 0

if tool == 0:
    filename = 'measurement_tool_ur20_zaxis.stl'
    #ee_frame = Frame([0, 0, 0], [1, 0, 0], [0, 1, 0])
    ee_frame = Frame([0, 0, 0.122], [1, 0, 0], [0, 1, 0])

elif tool == 1:
    filename = 'vacuum_gripper_ur20_zaxis.stl'
    ee_frame = Frame([0, 0, 0.145 + tolerance], [1, 0, 0], [0, 1, 0])

elif tool == 2:
    filename = 'parallel_gripper_zaxis.stl'
    ee_frame = Frame([0, 0, 0.145 + tolerance], [1, 0, 0], [0, 1, 0])

elif tool == 3:
    filename = 'ur20_extruder_gripper_combined_v6.stl' 
    ee_frame = Frame([0.351186, 0.00132,  0.10709], [0, -1, 0], [0, 0, -1]) #extruder tip frame

elif tool == 4:
    filename = 'ur20_extruder_gripper_combined_v6.stl'
    ee_frame = Frame([0, -(0.2451+0.07), 0.040045],[-1, 0, 0],[0, 0, -1])


data_path = os.path.join(data_path, "tool_geometry")
fullfilename = os.path.join(data_path, filename)

ee_mesh = Mesh.from_stl(fullfilename)

if show:
    M = mesh_to_rhino(ee_mesh)

tool = Tool(ee_mesh, ee_frame)
ee_plane = frame_to_rhino_plane(ee_frame)
print(ee_frame.quaternion.xyzw)
ee_framek = Frame([0.0110607,0.00809854,0.41498], [0,1,0], [1,0,0])
print(ee_framek.quaternion.xyzw)
# ---------- end tool ----------
remove = Button()  # disabled
attach = Button()  # disabled
mesh_4 = Mesh(tool.M)  # disabled
attach_tool = Python3Script(robot=robot, tool=tool.tool, attach=attach, remove=remove)  # -> tool, M, ee_plane, bang; disabled
# ---------- attach_tool: Python ----------
print(robot.get_group_names_from_link_name("robot_arm_flange"))

if attach:
    for planning_group in robot.get_group_names_from_link_name("robot_arm_flange"):
        robot.attach_tool(tool, group=planning_group)
if remove:
    for planning_group in robot.get_group_names_from_link_name("robot_arm_flange"):
        robot.detach_tool(group=planning_group)
# ---------- end attach_tool ----------

# ----
# Move mobile robot base
angle = Slider(90, range=0..360)  # disabled
plane_3 = Python3Script(origin=origin, angle=angle)  # -> plane; inputs origin: Point3d; disabled
# ---------- plane_3: Python ----------
import Rhino.Geometry as rg
import math

plane = rg.Plane(origin, rg.Vector3d.XAxis, rg.Vector3d.YAxis)
plane.Rotate(math.radians(angle), rg.Vector3d.ZAxis)
# ---------- end plane_3 ----------
list_9 = ValueList({"origin", "set_to_BCF", "set_to_RCF"}, selected="set_to_BCF")  # disabled
set_frame = Python3Script(robot=robot, set_frame_to=list_9, target_BCF=plane_3, target_RCF=plane_3)  # -> bang; inputs target_BCF: Plane, target_RCF: Plane; disabled
# ---------- set_frame: Python ----------
from compas.geometry import Frame, Point, Vector, Transformation
from compas.datastructures import Mesh
from compas_fab.robots import CollisionMesh
from compas_rhino.conversions import plane_to_compas_frame

if set_frame_to == "set_to_BCF":
    BCF = plane_to_compas_frame(target_BCF)
elif set_frame_to == "set_to_RCF":
    RCF = plane_to_compas_frame(target_RCF)
    BCF = robot.transform_frame_from_RCF_to_BCF(RCF)
else:
    BCF = Frame.worldXY()

if robot:
    robot.BCF = BCF
# ---------- end set_frame ----------

frame_2 = Python3Script(start_plane=plane_3, origin=origin)  # -> out, origin_frame; inputs origin: Point3d; disabled
# ---------- frame_2: Python ----------
import math

import Rhino.Geometry as rg
import ghpythonlib.components as ghcomp

#from compas_ghpython import draw_frame
from compas.geometry import Frame

sp = start_plane



p = rg.Plane(origin, sp.XAxis, sp.YAxis)
frame = Frame(p.Origin, p.XAxis, p.YAxis)

#robot_origin_plane = planes[idx]
#robot_origin_frame = frames[idx]
origin_frame = frame
plane = p
# ---------- end frame_2 ----------

# ----
# Generate buildable patches
button_4 = Button()  # disabled
button_5 = Button()  # disabled
sequences_2 = Python3Script(
    assembly=apply_gradient.my_assembly,
    robot=robot,
    plane=plane_2,
    origin_frame=frame_2.origin_frame,
    compute_sequence_in_reach=button_4,
    clear_sequ=button_5)  # -> out, assembly; inputs plane: Plane; disabled
# ---------- sequences_2: Python ----------
from compas.geometry import Point
from compas_rhino.conversions import  plane_to_compas_frame
from scriptcontext import sticky as st


# store data in component
guid = str(ghenv.Component.InstanceGuid)
patch_num = "patch_num_" + guid

if patch_num not in st:
    st[patch_num] = 1


def get_nbrs_under(key):
    nbrs = assembly.graph.neighbors(key)
    #key_z = assembly.graph.node_attribute(key, "z")
    nbrs_under = [n for n in nbrs if assembly.graph.node_attribute(n, "course")<assembly.graph.node_attribute(key, "course")]
    return nbrs_under

# def get_nbrs_above(key):
#     nbrs = assembly.graph.neighbors(key)
#     nbrs_above = [n for n in nbrs if assembly.graph.node_attribute(n, "course") > assembly.graph.node_attribute(key, "course")]
#     return nbrs_above

def is_node_satisfied(key):
    nbrs_under = get_nbrs_under(key)
    if len(nbrs_under):
        for n in nbrs_under:
            if assembly.graph.node_attribute(n, "used") == False:
                return False
    print(f"Node {key} is satisfied.")
    return True

"""def dist_to_frame(key, robot_origin):
    
    element_origin = assembly.element(key).frame
    
    ro = robot_origin.point
    ro_mirror = Point(ro.x, -(ro.y)-0.2, ro.z-0.35)
    print ro_mirror
    
    dist = ro_mirror.distance_to_point(element_origin.point)
    
    return dist"""

def dist_to_frame(key, origin_frame):
    part_origin = assembly.part(key).frame
    ro = origin_frame.point
    # ro = robot_origin.point
    ro_mirror = Point(ro.x, -(ro.y)-0.2, ro.z-0.35)
    dist = ro_mirror.distance_to_point(part_origin.point)
    return dist

def compute_all_in_reach():
    keys = list(assembly.graph.nodes_where({"used": False}))
    keys_in_patch = []
    frame = plane_to_compas_frame(plane)
    for key in keys:
        dist = dist_to_frame(key, frame)
        if dist < 1.8 and is_node_satisfied(key):
            keys_in_patch.append(key)
            assembly.graph.node_attribute(key, 'used', True)
    return keys_in_patch

if clear_sequ:
    assembly.graph.nodes_attribute(name='used', value=0)
    assembly.graph.nodes_attribute(name='patch', value=0)
    st[patch_num] = 1

if compute_sequence_in_reach:
    keys_in_patch = []
    while True:
        new_keys = compute_all_in_reach()
        if not new_keys:
            break
        keys_in_patch.extend(new_keys)
    print(f"Keys in Patch: {keys_in_patch}")
    assembly.graph.nodes_attribute(name='patch', value=st[patch_num], keys=keys_in_patch)
    st[patch_num] += 1
# ---------- end sequences_2 ----------

# ----
# Export to JSON
path_4 = Python3Script()  # -> HERE, DATA, ASSEMBLY; disabled; same code as path
export_4 = Button()  # disabled
export_5 = Python3Script(ASSEMBLY=path_4.ASSEMBLY, my_assembly=sequences_2.assembly, export=export_4)  # -> out; inputs ASSEMBLY: String; disabled
# ---------- export_5: Python ----------
import os


    

#print(my_assembly.__data__)
if export:
    #print(DATA)
    filename = "250326_brickwall.json"
    PATH = os.path.join(ASSEMBLY, filename)

    # the assembly has to be serialized such that it can be called from CPython
    my_assembly.to_json(PATH, pretty=True)
    print(my_assembly)
# ---------- end export_5 ----------

# ----
# Configuration
number_slider_3 = Slider(0.3, range=-0.3..0.7)  # disabled

# ----
# forward kinematics
number_slider_4 = Slider(-123.2, range=-400..400)  # disabled
number_slider_5 = Slider(-56.1, range=-180..180)  # disabled
number_slider_6 = Slider(21, range=-360..360)  # disabled
number_slider_7 = Slider(54.1, range=-180..180)  # disabled
number_slider_8 = Slider(-3.6, range=-125..120)  # disabled
number_slider_9 = Slider(-177.1, range=-400..400)  # disabled
forward_kinematics = Python3Script(
    robot=robot,
    lift=number_slider_3,
    j1=number_slider_5,
    j2=number_slider_6,
    j3=number_slider_7,
    j4=number_slider_4,
    j5=number_slider_8,
    j6=number_slider_9)  # -> configuration; disabled
# ---------- forward_kinematics: Python ----------
import math

from compas_robots.model import Joint
from compas_robots import Configuration


if robot:
    joint_types = robot.get_configurable_joint_types()
    joint_names = robot.get_configurable_joint_names()

    joint_values = [j1, j2, j3, j4, j5, j6]
    for i, joint_value in enumerate(joint_values):
        joint_values[i] = math.radians(joint_values[i])
    
    if len(robot.get_configurable_joints()) == 6:
        configuration = Configuration(joint_values, joint_types, joint_names)
    else:
        configuration = Configuration.from_prismatic_and_revolute_values([lift], joint_values)
    print (configuration)
    # configuration = Configuration((0.006, -0.716, -1.187, 2.378, 0.448, 1.464,  0.852), (2, 0, 0, 0, 0, 0, 0), ('robot_ewellix_lift_top_joint', 'robot_arm_shoulder_pan_joint', 'robot_arm_shoulder_lift_joint', 'robot_arm_elbow_joint', 'robot_arm_wrist_1_joint', 'robot_arm_wrist_2_joint', 'robot_arm_wrist_3_joint'))
# ---------- end forward_kinematics ----------

x_axis_3 = Curve(<curve referenced from the Rhino model>)  # disabled
y_axis_3 = Curve(<curve referenced from the Rhino model>)  # disabled
plane_4 = Python3Script(plane_axes=[x_axis_3, y_axis_3])  # -> plane; inputs plane_axes: list of Curve; disabled; same code as plane_2

# ----
# inverse kinematics
list_10 = ValueList({"ur20", "ur20_and_liftkit"}, selected="ur20")  # disabled
compute = Button()  # disabled
inverse = Python3Script(robot=robot, plane=plane_4, group=list_10, compute=compute)  # -> out, configuration; disabled
# ---------- inverse: Python ----------
# """
# Calculate the robot's inverse kinematic for a given plane.

# COMPAS FAB v1.0.2
# """

# from compas_rhino.conversions import plane_to_compas_frame
# from ghpythonlib.componentbase import executingcomponent as component
# from scriptcontext import sticky as st


# class InverseKinematics(component):
#     def RunScript(self, robot, plane, start_configuration, group, compute):
#         key = "inverse_solution"
#         configuration = None
#         if robot and robot.client and robot.client.is_connected and plane and compute:
#             frame_WCF = plane_to_compas_frame(plane)
#             frame_BCF = robot.from_BCF_to_WCF(frame_WCF)
#             configuration = robot.inverse_kinematics(frame_BCF, start_configuration, group)
#             st["inverse_solution"] = configuration
#         configuration = st.get("inverse_solution", None)
#         print(configuration)
#         return configuration


# """
# Calculate the robot's inverse kinematic for a given plane.

# COMPAS FAB v1.0.2
# """

# from compas_rhino.conversions import plane_to_compas_frame
# from ghpythonlib.componentbase import executingcomponent as component
# from scriptcontext import sticky as st


# class InverseKinematics(component):
#     def RunScript(self, robot, plane, start_configuration, group, compute):
#         key = "inverse_solution"
#         configuration = None
#         if robot and robot.client and robot.client.is_connected and plane and compute:
#             frame = plane_to_compas_frame(plane)
#             configuration = robot.inverse_kinematics(frame, start_configuration, group)
#             st["inverse_solution"] = configuration
#         configuration = st.get("inverse_solution", None)
#         return configuration

"""
Calculate the robot's inverse kinematic for a given plane.

COMPAS FAB v1.0.2
"""

from compas_rhino.conversions import plane_to_compas_frame
from ghpythonlib.componentbase import executingcomponent as component
from scriptcontext import sticky as st


class InverseKinematics(component):
    def RunScript(self, robot, plane, start_configuration, group, compute):
        key = "inverse_solution"
        configuration = None
        if robot and robot.client and robot.client.is_connected and plane and compute:
            frame = plane_to_compas_frame(plane)
            configuration = robot.inverse_kinematics(frame, start_configuration, group)
            st["inverse_solution"] = configuration
        configuration = st.get("inverse_solution", None)
        print(configuration)
        return configuration
# ---------- end inverse ----------

pln_2 = Plane(visualize_2.current_part_gripping_frame)  # disabled
left_plane = Plane(Plane(origin=(0, 0.6, 1.1), x=(1, 0, 0), y=(0, -1, 0)))  # disabled
right_plane = Plane(Plane(origin=(10.55959652, -0.5907230181, 1.161138188), x=(0, -1, 0), y=(-1, 0, 0)))  # disabled

# ----
# analytical inverse kinematics
select_configuration = Slider(0, range=0..7)  # disabled
analytic_inverse = Python3Script(robot=robot, lift=number_slider_3, plane=right_plane, idx=select_configuration)  # -> out, configuration, plane_RCF, plane_tool0_RCF; inputs plane: Plane, idx: Int32; disabled
# ---------- analytic_inverse: Python ----------
import Rhino.Geometry as rg
import math
from compas.geometry import Frame, Transformation, Rotation
from compas_robots import Configuration
from ur_fabrication_control.kinematics.ur_kinematics import inverse_kinematics
from ur_fabrication_control.kinematics.ur_params import ur_params
from compas_rhino.conversions import plane_to_compas_frame
from compas_ghpython.drawing import draw_frame

# transform frame to robot coordinate system
frame_WCF = plane_to_compas_frame(plane)
frame_RCF = robot.from_WCF_to_RCF(frame_WCF)

if robot.attached_tool:
    tool0_RCF = robot.from_tcf_to_t0cf([frame_RCF])[0]
else:
    tool0_RCF = frame_RCF

plane_tool0_RCF = draw_frame(tool0_RCF)
plane_RCS = draw_frame(frame_RCF)

# calculate solutions to frame
ur_params = ur_params["ur20"] # get the parameters according to the robot model
# print ur_params
solutions = inverse_kinematics(tool0_RCF, ur_params)
print (solutions)

if not len(solutions):
    joint_values = [0, 0, 0, 0, 0, 0]
else:
    joint_values = solutions[idx]

if len(robot.get_configurable_joints()) == 6:
    configuration = Configuration.from_revolute_values(joint_values)
else:
    configuration = Configuration.from_prismatic_and_revolute_values([lift], joint_values)

print(configuration)
# ---------- end analytic_inverse ----------

# ----
# zero configuration
zero = Python3Script(robot=robot, group=info.main_group_name)  # -> out, configuration; inputs group: String; disabled
# ---------- zero: Python ----------
configuration = robot.zero_configuration(group)
# ---------- end zero ----------

list_11 = ValueList({"0 zero_configuration": 0, "1 forward_kinematics": 1, "2 analytic_inverse_kinematics": 2, "3 inverse_kinematics": 3, "4 motion_planning": 4, "5 real_configuration": 5, "6 assembly": 6}, selected="3 inverse_kinematics")  # disabled
show_robot_collision = BooleanToggle(False)  # disabled
show_rcf = BooleanToggle(True)  # disabled

# ----
# Visualisation
filter = StreamFilter(
    Gate=list_11,
    Stream0=zero.configuration,
    Stream1=forward_kinematics,
    Stream2=analytic_inverse.configuration,
    Stream3=inverse.configuration)  # disabled
show_eef = BooleanToggle(True)  # disabled
show_frames = BooleanToggle(True)  # disabled
show_visual = BooleanToggle(True)  # disabled
show_collision = BooleanToggle(False)  # disabled
show_attached_collision = BooleanToggle(True)  # disabled
show_bcf = BooleanToggle(True)  # disabled
visualise = Python3Script(
    robot=robot,
    configuration=filter,
    show_frames=show_frames,
    show_visual_meshes=show_visual,
    show_robot_collision_meshes=show_robot_collision,
    show_collision_meshes=show_collision,
    show_attached_collision_meshes=show_attached_collision,
    show_BCF=show_bcf,
    show_RCF=show_rcf,
    show_EEF=show_eef,
    bang=[set_frame, attach_tool.bang])  # -> out, joint_planes, visual_meshes, robot_collision_meshes, collision_meshes, attached_meshes, BCF, RCF, EEF, EEF_in_RCF; inputs bang: list; disabled
# ---------- visualise: Python ----------
from scriptcontext import sticky as st
import time
from compas_ghpython import create_id
from compas.geometry import Frame
from compas.geometry import Transformation
from compas_rhino.conversions import frame_to_rhino, mesh_to_compas, mesh_to_rhino, frame_to_rhino_plane
from compas.scene import SceneObject
from compas_fab.robots import PlanningScene
import Rhino.Geometry as rg
import ghpythonlib.components as ghcomp

robot.update(configuration)
print(configuration)
if show_frames == True: 
    #print(configuration)
    joint_frames = robot.model.transformed_frames(configuration)
    joint_planes = [frame_to_rhino(a) for a in joint_frames]

if show_BCF:
    BCF = frame_to_rhino(robot.BCF)

if show_RCF:
    print(robot.RCF)
    RCF = frame_to_rhino(robot.from_BCF_to_WCF(robot.RCF))

if show_EEF:
    EEF_in_RCF = frame_to_rhino(robot.from_BCF_to_RCF(robot.forward_kinematics(
        configuration, options=dict())))
    EEF = frame_to_rhino(robot.from_BCF_to_WCF(robot.forward_kinematics(
        configuration, options=dict())))
    print(EEF)

if show_visual_meshes == True:
    visual_meshes = robot.draw_visual()
    # orient the robot to its base plane:
    robot_BCF = frame_to_rhino_plane(robot.BCF) 
    print(type(robot_BCF))
    init_robot_plane = rg.Plane.WorldXY
    #visual_meshes = ghcomp.Orient(visual_meshes, init_robot_plane, robot_BCF)[0]

if show_robot_collision_meshes == True:
    robot_collision_meshes = robot.draw_collision()

cached_scene_key = "cached_scene"

if show_collision_meshes or show_attached_collision_meshes:
    cached_scene = st.get(cached_scene_key)
    if not cached_scene:
        cached_scene = {"time": 0}

    # # expire cache if the component has not been executed in the last 2 seconds
    # # this allows to slide through a list of configurations
    # # without triggering refreshes of the scene in the middle of it

    # if time.time() - cached_scene["time"] > 2:
    #     update_scene = True
    # else:
    #     update_scene = False

    update_scene = True

    if update_scene:
        scene = PlanningScene(robot)
        scene = robot.client.get_planning_scene()

    if update_scene and show_collision_meshes:
        collision_meshes = []

        for co in scene.world.collision_objects:
            print(co)
            header = co.header
            frame_id = header.frame_id
            cms = co.to_collision_meshes()

            for cm in cms:
                if cm.frame != Frame.worldXY():
                    t = Transformation.from_frame(cm.frame)
                    mesh = cm.mesh.transformed(t)
                else:
                    mesh = cm.mesh
                collision_meshes.extend(SceneObject(item=mesh).draw())

        cached_scene["cm"] = collision_meshes

        collision_meshes = cached_scene.get("cm", [])

    if update_scene and show_attached_collision_meshes:
        attached_meshes = []

        for aco in scene.robot_state.attached_collision_objects:
            for acm in aco.to_attached_collision_meshes():
                print(acm)
                frame_id = aco.object["header"]["frame_id"]
                frame = robot.forward_kinematics(configuration, options=dict(link=frame_id))
                t = Transformation.from_frame(frame)

                # Local CM frame
                if acm.collision_mesh.frame and acm.collision_mesh.frame != Frame.worldXY():
                    t = t * Transformation.from_frame(acm.collision_mesh.frame)

                mesh = acm.collision_mesh.mesh.transformed(t)

                attached_meshes.extend(SceneObject(item=mesh).draw())

        cached_scene["acm"] = attached_meshes

        attached_meshes = cached_scene.get("acm", [])
    
    cached_scene["time"] = time.time()
    st[cached_scene_key] = cached_scene
# ---------- end visualise ----------
number_slider_10 = Slider(0.2, range=0..1)  # disabled
py3_2 = Python3Script(planes=[visualise.EEF, visualise.RCF], scale=number_slider_10)  # -> P, V, C, W; inputs planes: list of Plane, scale: Double; disabled
# ---------- py3_2: Python ----------
from Rhino.Display import ColorRGBA
from ghpythonlib.components import ColourRGBf


red = ColourRGBf(255, 255, 0, 0)
green = ColourRGBf(255, 0, 255, 0)
blue = ColourRGBf(255, 0, 0, 255)

P = []
V = []
C = []

# scale = float(scale)

for plane in planes:
    if not plane:
        continue
    P += [plane.Origin] * 3
    V.append(plane.XAxis * scale)
    V.append(plane.YAxis * scale)
    V.append(plane.ZAxis * scale)
    C += [red, green, blue]

W = 3
# ---------- end py3_2 ----------
pln_3 = Plane(visualise.joint_planes)  # disabled
mesh_5 = Mesh(visualise.collision_meshes)  # disabled
mesh_6 = Mesh(visualise.visual_meshes)  # disabled
orient = Orient(Geometry=mesh_6, Source=PlaneXY(0, 0, 0), Target=visualise.BCF)  # -> Geometry, Transform; disabled
swatch = ColourSwatch(SwatchColor=RGB(87, 87, 87))  # disabled
vdisex_2 = VectorDisplayEx(Point=py3_2.P, Vector=py3_2.V, Colour=py3_2.C, Width=py3_2.W)  # disabled
preview_9 = CustomPreview(Geometry=orient.Geometry, Material=swatch)  # disabled

eef_in_rcf = Plane(visualise.EEF_in_RCF)  # disabled
eef = Plane(visualise.EEF)  # disabled
mesh_7 = Mesh(visualise.robot_collision_meshes)  # disabled
mesh_8 = Mesh(visualise.attached_meshes)  # disabled
py3_3 = Python3Script()  # -> out, a; disabled
# ---------- py3_3: Python ----------
from compas_robots import Configuration
a = Configuration((0.006, 2.932, -0.814, 2.115, -2.879, -1.558, -1.725), (2, 0, 0, 0, 0, 0, 0), ('robot_ewellix_lift_top_joint', 'robot_arm_shoulder_pan_joint', 'robot_arm_shoulder_lift_joint', 'robot_arm_elbow_joint', 'robot_arm_wrist_1_joint', 'robot_arm_wrist_2_joint', 'robot_arm_wrist_3_joint'))
# ---------- end py3_3 ----------

# ==== cluster SunHours
epw_file = ClusterInput()
start_month = ClusterInput()
start_day = ClusterInput()
start_hour = ClusterInput()
end_month = ClusterInput()
end_day = ClusterInput()
end_hour = ClusterInput()
importepw = LBImportEPW(epw_file=epw_file)  # -> location, dry_bulb_temperature, dew_point_temperature, relative_humidity, wind_speed, wind_direction, direct_normal_rad, diffuse_horizontal_rad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; plug-in component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
analysisperiod = LBAnalysisPeriod(
    start_month=start_month,
    start_day=start_day,
    start_hour=start_hour,
    end_month=end_month,
    end_day=end_day,
    end_hour=end_hour)  # -> period, hoys, dates; plug-in component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
north = ClusterInput()
hoys = ClusterOutput(analysisperiod.hoys)
skymatrix = LBCumulativeSkyMatrix(
    north=north,
    location=importepw.location,
    direct_rad=importepw.direct_normal_rad,
    diffuse_rad=importepw.diffuse_horizontal_rad,
    hoys=analysisperiod.hoys)  # -> report, sky_mtx; plug-in component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
location = ClusterOutput(importepw.location)
sky_mtx = ClusterOutput(skymatrix.sky_mtx)
colrange = LBColorRange(index=Slider(5, range=0..100))  # -> colors; plug-in component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
geometry = ClusterInput()
context = ClusterInput()
grid_size = ClusterInput()
run = ClusterInput()
legendpar = LBLegendParameters(colors=colrange)  # -> leg_par; plug-in component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
incidentradiation = LBIncidentRadiation(
    sky_mtx=skymatrix.sky_mtx,
    geometry=flatten(geometry),
    context=flatten(context),
    grid_size=grid_size,
    offset_dist=Slider(0.2, range=0..1),
    legend_par=legendpar,
    run=run)  # -> report, points, results, total, mesh, legend, title, int_mtx; plug-in component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
points = ClusterOutput(incidentradiation.points)
results = ClusterOutput(incidentradiation.results)
mesh = ClusterOutput(incidentradiation.mesh)
legend = ClusterOutput(incidentradiation.legend)

# ==== cluster RadiationSimulation
colrange = LBColorRange(index=Slider(0, range=0..100))  # -> colors; plug-in component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
sky_mtx = ClusterInput()
geometry = ClusterInput()
context = ClusterInput()
run = ClusterInput()
legendpar = LBLegendParameters(colors=colrange)  # -> leg_par; plug-in component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
incidentradiation = LBIncidentRadiation(
    sky_mtx=sky_mtx,
    geometry=flatten(geometry),
    context=flatten(context),
    grid_size=Slider(1, range=0..1),
    offset_dist=Slider(0.2, range=0..1),
    legend_par=legendpar,
    run=run)  # -> report, points, results, total, mesh, legend, title, int_mtx; plug-in component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
legend = ClusterOutput(incidentradiation.legend)
mesh = ClusterOutput(incidentradiation.mesh)
