# Grasshopper definition test_shape_diver.ghx (Grasshopper 1.0.8)
# plug-ins: RhinoCodePluginGH

# ----
# Generate brick parts
list = ValueList({"none", "full", "insulated"}, selected="full")
part = Python3Script()  # -> out, full_brick, insulated_brick
# ---------- part: Python ----------
import os
from compas.geometry import Frame, Box
from compas.datastructures import Mesh
from climate_active_envelopes.assembly import CAEPart as Part



#full_brick
length, width, height = 0.24, 0.115, 0.075
full_brick = Part.from_dimensions(length=length, width=width, height=height)
full_brick.attributes['name'] = "full_brick"
#print(full_brick.attributes)
print(full_brick.__data__)

#insulated_brick_placeholder
# length, width, height = 0.245, 0.12, 0.075
# insulated_brick = Part.from_dimensions(length=length, width=width, height=height)
# insulated_brick.attributes['name'] = "insulated_brick"
# print(insulated_brick.__data__)



#insulated_brick
package_path = ghdoc.Path
data_path = os.path.abspath(os.path.join(package_path,"../../../climate_active_envelopes/data/brick_types"))
filename = 'insulated_brick_reduced.stl'
insulated_brick_mesh = Mesh.from_stl(os.path.join(data_path, filename))
insulated_brick = Part.from_mesh_and_frame(insulated_brick_mesh)
insulated_brick.attributes['name'] = "insulated_brick"
#print(insulated_brick.__data__)
# ---------- end part ----------
draw = Python3Script(full_brick=part.full_brick, insulated_brick=part.insulated_brick, show=list)  # -> M, P
# ---------- draw: Python ----------
from compas_rhino.conversions import mesh_to_rhino, box_to_rhino, frame_to_rhino
from climate_active_envelopes.assembly import CAEPart as Part
from compas.geometry import Frame
from compas.geometry import Vector
from compas.geometry import Box


if show=="full":

    #extract the mesh of the part for visulization
    compas_mesh_full = full_brick.mesh

    #convert to rhino mesh
    M = mesh_to_rhino(compas_mesh_full)

    #extract and convert to rhino plane
    P = frame_to_rhino(full_brick.frame)
    #brick_full.gripping_frame = full_brick.frame
    #print(full_brick.__data__)
    print(type(full_brick))

    
elif show == "insulated":
    
    #extract the mesh of the part for visulization
    compas_mesh_insulated = insulated_brick.mesh

    #convert to rhino mesh
    M = mesh_to_rhino(compas_mesh_insulated)
    
    #extract and convert to rhino plane
    P = frame_to_rhino(insulated_brick.frame)

else:
    pass
# ---------- end draw ----------
mesh = Mesh(draw.M)
pln = Plane(draw.P)

compas = Python3Script()  # -> out
# ---------- compas: Python ----------
import compas
print(compas.__version__)
# ---------- end compas ----------

# ----
# Unload Python modules
button = Button()
unload = Python3Script(unload=button)  # -> out, a
# ---------- unload: Python ----------
from compas_ghpython import unload_modules

unload_modules('climate_active_envelopes')
unload_modules('assembly_information_model')
# ---------- end unload ----------

total_length = Panel(compas)
list_2 = ValueList({"rotate", "translate"}, selected="rotate")
input_brep = Brep(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)

# ----
# Slicing mesh input
layer_height = Slider(0.1, range=0..1)
contour = Python3Script(brep=input_brep, layer_height=layer_height)  # -> out, curves; inputs brep: Mesh, layer_height: Double
# ---------- contour: Python ----------
import Rhino.Geometry as rg

mesh = brep

vertices = mesh.Vertices
pt_base = vertices[0]
pt_end = vertices[2]
print(pt_end)

pt_base = vertices[0]
pt_end = vertices[1]


start_plane = rg.Plane(pt_base, rg.Vector3d(0, 0, 1))
end_plane = rg.Plane(pt_end, rg.Vector3d(0, 0, 1))

curves =rg.Mesh.CreateContourCurves(mesh, pt_base,  pt_end, layer_height)
# ---------- end contour ----------
crv = Curve(contour.curves)

# ----
# Create empty assembly datastructure
button_2 = Button()
assembly = Python3Script(init=button_2)  # -> out, my_assembly
# ---------- assembly: Python ----------
from climate_active_envelopes.assembly import CAEAssembly as Assembly

#create empty assembly
my_assembly = Assembly()
# ---------- end assembly ----------

# ----
# Create brick assembly
list_3 = ValueList({"flemish_bond": 0}, selected="flemish_bond")
create_assembly = Python3Script(
    bond=list_3,
    my_assembly=assembly.my_assembly,
    brick_full=part.full_brick,
    brick_insulated=part.insulated_brick,
    plane=pln,
    lines=contour.curves)  # -> out, my_assembly, total_length; inputs plane: Plane, lines: list of Line
# ---------- create_assembly: Python ----------
total_length = my_assembly.generate_wall(bond,
                        brick_full, 
                        brick_insulated,
                        plane,
                        lines
                        )
# ---------- end create_assembly ----------
total_length_2 = Panel(create_assembly.total_length)

# ----
# Apply Gradient
get_centroids = Python3Script(my_assembly=create_assembly.my_assembly, transform_type=list_2)  # -> out, my_assembly, keys; inputs transform_type: String
# ---------- get_centroids: Python ----------
from compas.geometry import Frame, Translation, Rotation, Transformation, Point
from compas_rhino.conversions import plane_to_compas_frame, point_to_compas

import math
import Rhino.Geometry as rg

values = []
keys = []


for key in my_assembly.graph.nodes_where({"transform_type": transform_type}):
    part = my_assembly.part(key)
    keys.append(key)

my_assembly = my_assembly
# ---------- end get_centroids ----------
toggle = BooleanToggle(True)

number_slider = Slider(0.2, range=0..1)
path = FilePath("C:\Users\julia\Downloads\DEU_BY_Munich-Theresienwiese.108650_TMYx\DEU_BY_Munich-Theresienwiese.108650_TMYx.epw")
importepw = LBImportEPW(epw_file=path)  # -> location, dry_bulb_temperature, dew_point_temperature, relative_humidity, wind_speed, wind_direction, direct_normal_rad, diffuse_horizontal_rad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; plug-in component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
analysisperiod = LBAnalysisPeriod(
    start_month=Slider(7, range=0..10),
    start_day=Slider(1, range=0..10),
    start_hour=Slider(11, range=0..100),
    end_month=Slider(8, range=0..10),
    end_day=Slider(31, range=0..100),
    end_hour=Slider(16, range=0..100))  # -> period, hoys, dates; plug-in component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
colrange = LBColorRange(index=Slider(0, range=0..100))  # -> colors; plug-in component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
legendpar = LBLegendParameters()  # -> leg_par; plug-in component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
skymatrix = LBCumulativeSkyMatrix(
    north=Slider(120, range=0..360),
    location=importepw.location,
    direct_rad=importepw.direct_normal_rad,
    diffuse_rad=importepw.diffuse_horizontal_rad,
    hoys=analysisperiod.hoys)  # -> report, sky_mtx; plug-in component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
context = Brep([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])
colrange_2 = LBColorRange(index=Slider(5, range=0..100))  # -> colors; plug-in component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
legendpar_2 = LBLegendParameters(colors=colrange_2)  # -> leg_par; plug-in component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
incidentradiation = LBIncidentRadiation(
    sky_mtx=skymatrix.sky_mtx,
    geometry=flatten(input_brep),
    context=flatten(context),
    grid_size=Slider(0.08, range=0..0.1),
    offset_dist=number_slider,
    legend_par=legendpar_2,
    run=Toggle(True))  # -> report, points, results, total, mesh, legend, title, int_mtx; plug-in component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
vals = Python3Script(results=incidentradiation.results)  # -> out, color_values; inputs results: list
# ---------- vals: Python ----------
from compas.itertools import normalize_values

color_values = normalize_values(results, 0.0, 0.7)
print(color_values)




"""
color_points = []

for i, point in enumerate(points):
    frame = Frame([color_values[i], point[1] , point[2]], [1,0,0], [0,1,0])
    
    color_points.append(frame.point)
"""
# ---------- end vals ----------
panel = Panel(vals.color_values)

pt = Point(Point(6.146412243, 26.72663197, 0))
sunpath = LBSunPath(location=importepw.location, hoys=analysisperiod.hoys, center_pt=pt, scale=Slider(0.2, range=0..10))  # -> report, vectors, altitudes, azimuths, hoys, sun_pts, analemma, daily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; plug-in component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

apply_gradient = Python3Script(
    my_assembly=create_assembly.my_assembly,
    values=vals.color_values,
    keys=get_centroids.keys,
    transform_type=list_2,
    transform=Button())  # -> out, my_assembly; inputs values: list, keys: list
# ---------- apply_gradient: Python ----------
import math
import Rhino.Geometry as rg
from compas.geometry import Frame, Point
from compas.geometry import Transformation, Rotation, Translation


#print(my_assembly.apply_gradient(values, keys, transform_type_))


#print(my_assembly.__data__)

#transform_types = {node_id: my_assembly.graph.node_attribute(node_id, 'transform_type') for node_id in my_assembly.graph.nodes()}




if transform:
    assembly = my_assembly
    my_assembly.apply_gradient(values, keys, transform_type)

    #print(test)
# ---------- end apply_gradient ----------

# ----
# Visualisation Dashboard
toggle_2 = BooleanToggle(False)
list_4 = ValueList({"show all": "show_all", "show until key": "show_until_key", "show nothing": "show_nothing"}, selected="show all")
visualize = Python3Script(my_assembly=apply_gradient.my_assembly, show=list_4, highlight_current_part=toggle_2)  # -> out, parts_geometry, parts_frame, current_part_geometry, current_part_frame, current_part_gripping_frame
# ---------- visualize: Python ----------
from compas_rhino.conversions import mesh_to_rhino, box_to_rhino, frame_to_rhino

#print assembly
print(my_assembly)
#counter = int(counter)

#get parts datastructure
parts = [p for p in my_assembly.parts()]

#get current part

#if show_wall == True:

if show == "show_all":
    
#get parts datastructure
    parts = [p for p in my_assembly.parts()]
    parts_geometry = []
    parts_frame = []

    #part = parts[0]
    #print(part.gripping_frame)

    #extract the mesh of the parts for visulization (+ converted to rhino mesh)
    parts_geometry = [mesh_to_rhino(p.mesh) for p in parts]
    
    #extract the frame of the parts for visulization (+ converted to rhino plane)
    parts_frame = [frame_to_rhino(p.frame) for p in parts]
    #print(parts_geometry)

    key = my_assembly.graph.number_of_nodes()-1

if show == "show_until_key":
    #extract the mesh of the parts for visulization (+ converted to rhino mesh)
    parts_geometry = [mesh_to_rhino(p.mesh) for p in parts[0:int(counter)]]
    
    #extract the frame of the parts for visulization (+ converted to rhino plane)
    parts_frame = [frame_to_rhino(p.frame) for p in parts[0:int(counter)]]

    key = int(counter)-1

if show == "show_nothing":
    print("Nothing to see")
    pass

if highlight_current_part:
    current_part = my_assembly.part(key)
    current_part_geometry = mesh_to_rhino(current_part.mesh)
    current_part_frame = frame_to_rhino(current_part.frame)
    current_part_gripping_frame = frame_to_rhino(current_part.gripping_frame)
    
    print(current_part.__data__)
# ---------- end visualize ----------
panel_2 = Panel(visualize.out)
geo = Geometry(visualize.parts_geometry)
preview = CustomPreview(Geometry=geo, Material=ColourSwatch(SwatchColor=RGB(196, 141, 141)))

incidentradiation_2 = LBIncidentRadiation(
    sky_mtx=skymatrix.sky_mtx,
    geometry=flatten(visualize.parts_geometry),
    context=flatten(context),
    grid_size=Slider(1, range=0..1),
    offset_dist=number_slider,
    legend_par=legendpar,
    run=Toggle(True))  # -> report, points, results, total, mesh, legend, title, int_mtx; plug-in component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
brick_wall = Mesh(incidentradiation_2.mesh)
