# Grasshopper definition 230803_CAE_design_tool.ghx (Grasshopper 1.0.7)
# plug-ins: MeshEdit Components

panel = Panel("Reload libraries")
bang = Button()
unload = PythonScript(reload=bang)
# ---------- unload: Python ----------
from compas_ghpython import unload_modules

if reload:
    unload_modules('climate_active_envelopes')
# ---------- end unload ----------

ghpython_script = GhPythonScript()  # -> out, a; disabled
# ---------- ghpython_script: Python ----------
__author__ = "Bootsy"
__version__ = "2023.04.27"

import rhinoscriptsyntax as rs

                """
                if j == 0: #first planes
                    z1.Rotate(m.radians(90), plane.ZAxis)
                    z1.Translate(z1.XAxis*-(width/2 + mortar))
                    z1.Translate(z1.YAxis*-(width/2 + mortar))
                    
                if j == len(planes)-1: #last planes
                    z1_copy = rg.Plane(z1)
                    z1_copy.Rotate(m.radians(90), z1_copy.ZAxis)
                    z1_copy.Translate(z1_copy.YAxis*-(width+width/2+mortar*2))
                    z1_copy.Translate(z1_copy.XAxis*-(width/2 + mortar))
                    row.append(z1_copy)
                """
# ---------- end ghpython_script ----------

# ---- group: globals
button = Button()  # disabled
elem_ins = Mesh(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)  # disabled
panel_2 = Panel("0.071")  # disabled
panel_3 = Panel("0.24")  # disabled
panel_4 = Panel("0.115")  # disabled
panel_5 = Panel("0.01")  # disabled
design_globals = GhPythonScript(init=button, width=panel_4, height=panel_2, length=panel_3, mortar=panel_5, elem_ins=elem_ins)  # -> assembly; inputs elem_ins: Mesh; disabled
# ---------- design_globals: Python ----------
from compas.geometry import Frame, Polygon, Plane
from compas.datastructures import Mesh
#from climate_aware_robotic_envelope.assembly import Element, Assembly

from climate_active_envelopes.assembly import BRICK_Assembly as Assembly

from compas_ghpython.artists import Artist

assembly = Assembly()

assembly.set_attribute('width', width)
assembly.set_attribute('height', height)
assembly.set_attribute('length', length)
assembly.set_attribute('mortar', mortar)
assembly.set_attribute('elem_ins', elem_ins)
# ---------- end design_globals ----------

# ---- group: draw element
show = BooleanToggle(False)  # disabled
show_2 = BooleanToggle(False)  # disabled
elem_def = GhPythonScript(assembly=design_globals)  # -> assembly, elem_full, elem_ins; disabled
# ---------- elem_def: Python ----------
from compas.geometry import Frame
from compas_rhino.geometry import RhinoMesh
from compas.datastructures import Mesh
from compas.artists import Artist
from climate_active_envelopes.assembly import BRICK_Assembly as Assembly
from climate_active_envelopes.assembly import CAEElement as Element
import Rhino.Geometry as rg


# dimensions full brick
length = assembly.get_attribute('length')
width = assembly.get_attribute('width')
height = assembly.get_attribute('height')
elem_ins = assembly.get_attribute('elem_ins')


elem_full = Element.from_dimensions(length, width, height)
elem_full.tool_frame = Frame([0, 0, height], [1, 0, 0], [0, -1, 0])


elem_ins = Element.from_rhinomesh_geometry(elem_ins, Frame([0, 0, height/2], [1, 0, 0], [0, -1, 0]))
elem_ins.tool_frame = Frame([0, 0, height], [1, 0, 0], [0, -1, 0])

print elem_ins
print elem_full
# ---------- end elem_def ----------
draw = PythonScript(elem_full=elem_def.elem_full, elem_ins=elem_def.elem_ins, show_full=show_2, show_ins=show)  # -> M, F, S; disabled
# ---------- draw: Python ----------
from compas.artists import Artist


#M = Artist(elem_ins.mesh).draw()
#print M

if show_full:
    M = Artist(elem_full.mesh).draw()
    F = Artist(elem_full.frame).draw()
    S = Artist(elem_full.tool_frame).draw()


if show_ins:
    M = Artist(elem_ins.mesh).draw()
    F = Artist(elem_ins.frame).draw()
    S = Artist(elem_ins.tool_frame).draw()
# ---------- end draw ----------
plane = Plane(draw.F)  # disabled
mesh = Mesh(draw.M)  # disabled
plane_2 = Plane(draw.S)  # disabled

# ----
py = PythonScript()  # -> HERE, DATA
# ---------- py: Python ----------
import os

HERE = os.path.dirname(ghdoc.Path)
DATA = os.path.abspath(os.path.join(HERE, "..", "data"))

#print(HERE)
#print(DATA)
# ---------- end py ----------
number_slider = Slider(12, range=0..100)

# ---- group: wall_mesh
number_slider_2 = Slider(3, range=0.4..10)  # disabled
number_slider_3 = Slider(1.2, range=0.3..10)  # disabled
global_wall = GhPythonScript(assembly=elem_def.assembly, wall_length=number_slider_2, wall_height=number_slider_3)  # -> assembly, mesh_wall, mesh_grid; disabled
# ---------- global_wall: Python ----------
from compas.datastructures import Mesh
from compas.geometry import Curve, Point, Frame
from compas.artists import MeshArtist, Artist
import math as m
import Rhino.Geometry as rg
from compas.utilities import normalize_values

length = assembly.get_attribute('length')
height = assembly.get_attribute('height')
width = assembly.get_attribute('width')
mortar = assembly.get_attribute('mortar')


mesh_wall = Mesh()
mesh_wall_left = Mesh()
mesh_wall_right = Mesh()

mesh_grid = []
mesh_grid_left = []
mesh_grid_right = []

step_in_z = height + mortar/2
step_in_x = (length+width)/2 + mortar
vertices_per_row = int(wall_length / step_in_x)

vertices_per_row_2 = int((wall_length*1.2) / step_in_x)
row = int(wall_height / step_in_z)
#interval = period/vertices_per_row

total_length = (vertices_per_row - 1) * (step_in_x)


#create vertices
for j in range(row): 
    z = j * step_in_z
    for i in range(vertices_per_row): 
        y = 0
        x = i * step_in_x
        mesh_wall.add_vertex(x = x, y = y, z = z) 

#create faces
for j in range(row -1):
    planes_per_row = []
    for i in range(vertices_per_row - 1):
        a = i + j * vertices_per_row
        b = a + vertices_per_row
        c = b + 1
        d = a + 1

#create planes at faces_centroid
        vertex_centroid = mesh_wall.face_centroid(mesh_wall.add_face([a, b, c, d]))
        vertex_pts = Point(vertex_centroid[0], vertex_centroid[1], vertex_centroid[2])
        vertex_frame = Frame([vertex_pts[0], vertex_pts[1], vertex_pts[2]], [1,0,0], [0,1,0])
        vertex_plane = Artist(vertex_frame).draw()
        planes_per_row.append(vertex_plane)
    mesh_grid.append(planes_per_row)

face_cplanes = [plane for planes_row in mesh_grid for plane in planes_row]



























"""
if add_left:
    # create vertices
    for j in range(row): 
        z = j * step_in_z
        for i in range(vertices_per_row_2): 
            y = i * step_in_x
            x = 0
            mesh_wall_left.add_vertex(x = x, y = y, z = z) 
            #V2 = MeshArtist(mesh_wall_left).draw_vertices()
            
    #create faces
    for j in range(row - 1):
        planes_per_row_2 = []
        for i in range(vertices_per_row_2 - 1):
            e = i + j * vertices_per_row_2
            f = e + vertices_per_row_2
            g = f + 1
            h = e + 1
            #mesh_wall_left.add_face([e, f, g, h])
            #M2 = MeshArtist(mesh_wall_left).draw()

    #create planes at faces_centroid
            vertex_centroid_2 = mesh_wall_left.face_centroid(mesh_wall_left.add_face([e, f, g, h]))
            vertex_cpts_2 = Point(vertex_centroid_2[0], vertex_centroid_2[1], vertex_centroid_2[2])
            vertex_cframe_2 = Frame([vertex_cpts_2[0], vertex_cpts_2[1], vertex_cpts_2[2]], [1,0,0], [0,1,0])
            vertex_cplane_2 = Artist(vertex_cframe_2).draw()
            planes_per_row_2.append(vertex_cplane_2)
        mesh_grid_left.append(planes_per_row_2)

    face_cplanes_2 = [plane_2 for planes_row_2 in mesh_grid_left for plane_2 in planes_row_2]




if add_right:
    # create vertices
    for j in range(row): 
        z = j * step_in_z
        for i in range(vertices_per_row_2): 
            y = i * step_in_x
            x = (total_length)
            mesh_wall_right.add_vertex(x = x, y = y, z = z) 


    #create faces
    for j in range(row - 1):
        planes_per_row_2 = []
        for i in range(vertices_per_row_2 - 1):
            k = i + j * vertices_per_row_2
            l = k + vertices_per_row_2
            m = l + 1
            n = k + 1

    #create planes at faces_centroid
            vertex_centroid_3 = mesh_wall_right.face_centroid(mesh_wall_right.add_face([k, l, m, n]))
            vertex_cpts_3 = Point(vertex_centroid_3[0], vertex_centroid_3[1], vertex_centroid_3[2])
            vertex_cframe_3 = Frame([vertex_cpts_3[0], vertex_cpts_3[1], vertex_cpts_3[2]], [1,0,0], [0,1,0])
            vertex_cplane_3 = Artist(vertex_cframe_3).draw()
            planes_per_row_2.append(vertex_cplane_3)
        mesh_grid_right.append(planes_per_row_2)

    face_cplanes_2 = [plane_3 for planes_row_3 in mesh_grid_right for plane_3 in planes_row_3]
    
    
#mesh_wall_all = []
#mesh_wall_all += mesh_wall, mesh_wall_left, mesh_wall_right


## Create wall curves left and right
#total_length = step_in_x*(vertices_per_row-1)
#total_height = step_in_z*(row-1)

#wall_crv_left = rg.Line(rg.Point3d(0,0,0), rg.Point3d(0,0,total_height))
#wall_crv_bottom_left = rg.Line(rg.Point3d(0,0,0), rg.Point3d(0, m.pi*0.5, 0))

#wall_crv_right = rg.Line(rg.Point3d(total_length,0,0), rg.Point3d(total_length, 0, total_height))
#wall_crv_bottom_right = rg.Line(rg.Point3d(total_length,0,0), rg.Point3d(total_length, m.pi*0.5, 0))



#        if add_front:
#            x = i * step_in_x
#            y = amplitude * m.sin(interval * i + phase)
#            mesh_wall.add_vertex(x=x, y=y, z=z)
#
#        if add_left:
#            x = 0
#            y = i * step_in_x
#            mesh_wall.add_vertex(x=x, y=y, z=z)
#
#        if add_right:
#            y = i * step_in_x
#            x = total_length
#            mesh_wall.add_vertex(x=x, y=y, z=z)
"""
# ---------- end global_wall ----------

show_3 = BooleanToggle(True)  # disabled
show_4 = BooleanToggle(False)  # disabled
show_5 = BooleanToggle(False)  # disabled
draw_2 = PythonScript(mesh_wall=global_wall.mesh_wall, show_faces=show_3, show_vertices=show_4, show_labels=show_5)  # -> M, V, L; disabled
# ---------- draw_2: Python ----------
from compas.artists import Artist, MeshArtist, artist
import Rhino.Geometry as rg

meshes = []
vertices = []
labels = []

if show_faces:
    M = MeshArtist(mesh_wall).draw()
    #M_left = MeshArtist(mesh_wall_left).draw()
    #M_right = MeshArtist(mesh_wall_right).draw()

if show_vertices:
    V = MeshArtist(mesh_wall).draw_vertices()
    #V_left = MeshArtist(mesh_wall_left).draw_vertices()
    #V_right = MeshArtist(mesh_wall_right).draw_vertices()

if show_labels:
    L = [key for key in mesh_wall.vertices()]
    #L_left = [key for key in mesh_wall_left.vertices()]
    #L_right = [key for key in mesh_wall_right.vertices()]


    meshes = M
# ---------- end draw_2 ----------
swatch = ColourSwatch(SwatchColor=RGB(0, 0, 0))  # disabled
text_tag = TextTag(Location=draw_2.V, Text=draw_2.L, Colour=swatch)  # disabled
mesh_2 = Mesh(draw_2.M)  # disabled
point = Point(draw_2.V)  # disabled

# ----
ghpython_script_2 = GhPythonScript(x=Slider(20, range=0..100), y=Slider(40, range=0..100))  # -> out, artist, test; inputs x: Int32, y: Int32
# ---------- ghpython_script_2: Python ----------
from compas.datastructures import Network
from compas.geometry import Point
from compas_ghpython.artists import NetworkArtist, Artist

# Create a network to represent the walls of the room
room_network = Network()

# Define the vertices (nodes) for the walls
side_1 = [Point(0, 0, 0), Point(x, 0, 0)]
side_2 = [Point(x, 0, 0), Point(x, 0, y)]
side_3 = [Point(x, 0, y), Point(0, 0, y)]
side_4 = [Point(0, 0, y), Point(0, 0, 0)]


list_of_walls = [side_1, side_2, side_3, side_4]



# Add the vertices to the network
for wall in list_of_walls:
    for point in wall:
        room_network.add_node(point, attr_dict={})  # store attributes for corners

# Define the edges for the walls
wall_edges = [(side_1[0], side_1[1], {}), (side_2[0], side_2[1], {}), (side_3[0], side_3[1], {}), (side_4[0], side_4[1], {})]

# Add the edges to the network
for u, v, attr in wall_edges:
    room_network.add_edge(u, v, attr_dict=attr)

## Set attributes for the corners and openings (as an example)
#room_network.node[side_1[0]]['corner_attribute'] = 'Corner A'
#room_network.node[side_1[1]]['corner_attribute'] = 'Corner B'
#room_network.node[side_2[0]]['corner_attribute'] = 'Corner B'
#room_network.node[side_2[1]]['corner_attribute'] = 'Corner C'
#room_network.node[side_3[0]]['corner_attribute'] = 'Corner C'
#room_network.node[side_3[1]]['corner_attribute'] = 'Corner D'
#room_network.node[side_4[0]]['corner_attribute'] = 'Corner D'
#room_network.node[side_4[1]]['corner_attribute'] = 'Corner A'
#
#room_network.edges[(side_1[0], side_1[1])]['opening_attribute'] = 'Opening 1'
#room_network.edges[(side_2[0], side_2[1])]['opening_attribute'] = 'Opening 2'
## ... Add attributes for other openings ...

# Visualize the network
artist = NetworkArtist(room_network).draw()
#artist.draw_edges(color=(0, 0, 0))
#artist.draw_nodes(size=0.1, color=(255, 0, 0))

# Print the attributes for the corners and openings
print("Corner attributes:")
for node in room_network.nodes():
    print(node, room_network.node[node])
# ---------- end ghpython_script_2 ----------
ghpython_script_3 = GhPythonScript(x=number_slider, y=number_slider, z=number_slider)  # -> out, a; inputs x: Int32, y: Int32, z: Int32
# ---------- ghpython_script_3: Python ----------
from compas.datastructures import Network
from compas_ghpython.artists import NetworkArtist

# Create a network to represent the sides of the room
room_sides_network = Network()


# Define the vertices (nodes) for the sides of the room
side_1 = [0, 0, 0]
side_2 = [x, 0, 0]
side_3 = [x, y, 0]
side_4 = [0, y, 0]

side_5 = [0, 0, z]
side_6 = [x, 0, z]
side_7 = [x, y, z]
side_8 = [0, y, z]

sides = []
sides += side_1, side_2, side_4

room_sides_network.from_nodes_and_edges(sides, sides)


# Add the vertices to the network
#room_sides_network.add_nodes_from([side_1, side_2, side_3, side_4, side_5, side_6, side_7, side_8])
#print room_sides_network

## Define the edges for the sides
#side_edges = [
#    (side_1, side_2),
#    (side_2, side_3),
#    (side_3, side_4),
#    (side_4, side_1),
#    (side_5, side_6),
#    (side_6, side_7),
#    (side_7, side_8),
#    (side_8, side_5),
#    (side_1, side_5),
#    (side_2, side_6),
#    (side_3, side_7),
#    (side_4, side_8),
#]
#
## Add the edges to the network
#room_sides_network.add_edges_from(side_edges)
#
## Define attributes for openings and corners
#for node in room_sides_network.nodes():
#    room_sides_network.node[node]['corner'] = False
#    room_sides_network.node[node]['opening'] = None
#
#corner_nodes = [side_1, side_2, side_3, side_4]
#for corner in corner_nodes:
#    room_sides_network.node[corner]['corner'] = True
#
#room_sides_network.node[side_1]['opening'] = 'Window'
#room_sides_network.node[side_2]['opening'] = 'Door'
#room_sides_network.node[side_3]['opening'] = 'Window'
#room_sides_network.node[side_4]['opening'] = None
#
## Visualize the network
#artist = NetworkArtist(room_sides_network)
#artist.draw_edges(color=(0, 0, 0))
#artist.draw_nodes(size=0.1, color=(255, 0, 0))
#
## Accessing neighbors and edge indices
#for node in room_sides_network.nodes():
#    neighbors = room_sides_network.neighbors(node)
#    print(f"Node: {node}, Neighbors: {neighbors}")
#    for neighbor in neighbors:
#        edge_index = room_sides_network.edge_index(node, neighbor)
#        print(f"Edge index between {node} and {neighbor}: {edge_index}")
# ---------- end ghpython_script_3 ----------

plane_grid = GhPythonScript(assembly=global_wall.assembly, mesh_grid=global_wall.mesh_grid)  # -> assembly, plane_grid; inputs mesh_grid: list; disabled
# ---------- plane_grid: Python ----------
from compas.geometry import Curve, Point, Frame
from compas.artists import Artist, artist
import math as m
import Rhino.Geometry as rg

length = assembly.get_attribute('length')
height = assembly.get_attribute('height')
width = assembly.get_attribute('width')
mortar = assembly.get_attribute('mortar')


plane_grid = []

def create_plane_grid(mesh_grid):

    for i, row_planes in enumerate(mesh_grid):
        row = []
        for j, plane in enumerate(row_planes):
            z1 = plane
            z1.Translate(z1.ZAxis*-height/2)


            #odd layers
            if i%2 == 0: 
                if j%2 == 0: 
                    z1.Translate(z1.YAxis*+(length/4 + mortar/4))
                    z1.Rotate(m.radians(90), z1.ZAxis)
                    z4 = rg.Plane(z1)
                    z4.Translate(z4.XAxis*+(length + mortar))
                    row.append(z4)

                if j%2 == 1:
                    z2 = rg.Plane(z1)
                    z2.Rotate(m.radians(90), z2.ZAxis)
                    z2.Translate(z2.YAxis*+(width/2 + mortar/2))
                    z2.Translate(z2.XAxis*+((length/2+width/2) + mortar))
                    row.append(z2)
                    z3 = rg.Plane(z2)
                    z2.Translate(z2.YAxis*-(width + mortar))
                    row.append(z3)
                    z5 = rg.Plane(z1)
                    z5.Translate(z5.YAxis*+((length+ width) + mortar*2))
                    row.append(z5)


            #even layers
            if i%2 == 1:
                if j%2 == 1:
                    z1.Translate(z1.YAxis*+(length/4 + mortar/4))
                    z1.Rotate(m.radians(90), z1.ZAxis)
                    z4 = rg.Plane(z1)
                    z4.Translate(z4.XAxis*+(length + mortar))
                    row.append(z4)

                if j%2 == 0:
                    z2 = rg.Plane(z1)
                    z2.Rotate(m.radians(90), z2.ZAxis)
                    z2.Translate(z2.YAxis*+(width/2 + mortar/2))
                    z2.Translate(z2.XAxis*+((length/2+width/2) + mortar))
                    row.append(z2)
                    z3 = rg.Plane(z2)
                    z2.Translate(z2.YAxis*-(width + mortar))
                    row.append(z3)
                    z5 = rg.Plane(z1)
                    z5.Translate(z5.YAxis*+((length+ width) + mortar*2))
                    row.append(z5)

            row.append(z1)

            
        plane_grid.append(row)
    return plane_grid

plane_grid = create_plane_grid(mesh_grid)


def list_from_2darray(array):
    return [item for sublist in array for item in sublist]

planes = list_from_2darray(plane_grid)
# ---------- end plane_grid ----------
transformation = GhPythonScript(
    plane_grid=plane_grid.plane_grid,
    mesh_wall=global_wall.mesh_wall,
    transf_values=[627, 628, 563, 471, 463, 434, 407, 380, 358, 402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])  # -> t_pts, params_grid; inputs plane_grid: list, transf_values: list; disabled
# ---------- transformation: Python ----------
import Rhino.Geometry as rg
from compas.utilities import normalize_values
from compas.geometry import Curve, Point, Frame


# create list of face_centroids
c_pts = []
for j, face in enumerate(mesh_wall.faces()):
    vertex_centroid = mesh_wall.face_centroid(face)
    points = rg.Point3d(vertex_centroid[0],vertex_centroid[1], vertex_centroid[2])
    c_pts.append(points)

#normalize values from the simulation
transf_values = normalize_values(transf_values, -1.0, 0.0)
params_grid = []

# create new planes / points from transf_values
t_pts = []
t_pls = []
for i, points in enumerate(c_pts):
    x = points[0]
    z = points[2]
    y = transf_values[i]
    t_pt = rg.Point3d(x,y,z)
    t_pts.append(t_pt)
    # create planes from points
    t_pl = rg.Plane(rg.Point3d(x,y,z), rg.Vector3d(1, 0, 0), rg.Vector3d(0, 1, 0))
    t_pls.append(t_pl)

"""
    planes = plane_grid[i]


    for j, plane in enumerate(planes):
        params = {
            'plane': plane,
            't_pt': t_pts[i],
            't_pl': t_pls[i],
            'dist': t_pts[i] - c_pts[i]
        }
        params_grid.append(params)

params_list = []
for i,row in enumerate(params_grid):
    print i
    for j, params_list in enumerate(row):
        pass

"""



    #print i, row
    #for j, params_list in enumerate(row):
        #print params_list

#def translate_points(c_pts, t_vecs):
#    translated_points = []
#    for c_pt, t_vec in zip(c_pts, t_vecs):
#        translated_point = rg.Point3d.Add(c_pt, t_vec)
#        translated_points.append(translated_point)
#    return translated_points
#
#points = translate_points(c_pts, t_vecs)

#points = translate_points(c_pts, t_vecs)
# ---------- end transformation ----------
point_2 = Point(transformation.t_pts)  # disabled

ghpython_script_4 = GhPythonScript(x=Slider(12, range=0..100), z=Slider(8, range=0..100))  # -> out, node, edge, a; inputs x: Int32, z: Int32
# ---------- ghpython_script_4: Python ----------
from compas.geometry import Polyline
from compas.datastructures import Mesh
from compas.datastructures import Network
from compas_ghpython.artists import MeshArtist, PolylineArtist, NetworkArtist
import rhinoscriptsyntax as rs


#polyline = Polyline([[0, 0, 0],[x, 0, 0],[x, 0, z],[0, 0, z]])
#a = PolylineArtist(polyline).draw()
#
#
#wall_network = Network()
#
#for point in polyline:
#    wall_network.add_node(point, attr_dict={})
#
#
##edge_indices = [(0, 1), (1, 2), (2, 3), (3, 0)]  # Define the indices of the nodes forming edges
##for u, v in edge_indices:
##    wall_network.add_edge(u, v, attr_dict={})
#
#
##for node in wall_network.nodes():
##    print('Node:', node)
#
#
#node, edge = NetworkArtist(wall_network).draw()
#print node



#polyline = Polyline([[0, 0, 0],[x, 0, 0],[x, 0, z],[0, 0, z]])
Point_1 = [0, 0, 0]
Point_2 = [x, 0, 0]
Point_3 = [x, 0, z]
Point_4 = [0, 0, z]
points = []
points += Point_1, Point_2, Point_3, Point_4

# Create a Polyline representing the vertical surface
#surface_polyline = Polyline(points)

# Create nodes using the vertices of the Polyline
nodes = points

# Define the edges connecting the nodes
edge_indices = [(0, 1), (1, 2), (2, 3), (3, 0)]  # Define the indices of the nodes forming edges
edges = edge_indices

# Create a network using the nodes and edges
vertical_surface_network = Network.from_nodes_and_edges(nodes, edges)

# Visualize the network in Rhino
node, edge = NetworkArtist(vertical_surface_network).draw()
# ---------- end ghpython_script_4 ----------
show_all = BooleanToggle(False)
list = ValueList({"front", "1": "left", "2": "right", "3": "back"}, selected="2")
line = Line(ghpython_script_4.edge)
point_3 = Point(ghpython_script_4.node)
design_globals_2 = GhPythonScript(x=Slider(14, range=0..100), y=Slider(19, range=0..100), z=Slider(6, range=0..100))  # -> out, network_front, network_left, network_right, network_back, networks; inputs x: Int32, y: Int32, z: Int32
# ---------- design_globals_2: Python ----------
from compas.geometry import Point
from compas.datastructures import Network
#from compas_ghpython.artists import NetworkArtist
from compas.artists import NetworkArtist
from scriptcontext import sticky as st

front_nodes = []
left_nodes = []
right_nodes = []
back_nodes = []


# Define the vertices / nodes
front_nodes += Point(0, 0, 0), Point(x, 0, 0), Point(x, 0, z), Point(0, 0, z)
print front_nodes
left_nodes += front_nodes[0], Point(0, 0, z), Point(0, y, z), Point(0, y, 0)
right_nodes += front_nodes[1], front_nodes[2], Point(x, y, z), Point(x, y, 0)
back_nodes += Point(0, y, 0), Point(0, y, z), Point(x, y, z), Point(x, y, 0)

# Define the edges connecting the nodes
front_edges = [(0, 1), (1, 2), (2, 3), (3, 0)]  
left_edges = [(0, 1), (1, 2), (2, 3), (3, 0)]  
right_edges = [(0, 1), (1, 2), (2, 3), (3, 0)]  
back_edges = [(0, 1), (1, 2), (2, 3), (3, 0)]  

# Define network for each side
network_front = Network.from_nodes_and_edges(front_nodes, front_edges)
network_left = Network.from_nodes_and_edges(left_nodes, left_edges)
network_right = Network.from_nodes_and_edges(right_nodes, right_edges)
network_back = Network.from_nodes_and_edges(back_nodes, back_edges)


networks = {'front': network_front, 'left': network_left, 'right': network_right, 'back': network_back}

combined_network = Network()

for name, network in networks.items():
    for node in network.nodes():
        if not combined_network.has_node(node):
            combined_network.add_node(node)
    for edge in network.edges():
        u, v = edge
        if not combined_network.has_edge(u, v):
            combined_network.add_edge(u, v)

#st['combined_network.subnetworks'] = networks
#networks = st['combined_network.subnetworks']
#print networks

st["networks"] = networks

print networks
#
## Define attributes
#opening_attr = {0: None, 1: {'type': 'window', 'size': (0.80, 0.80), 'height': 0.90}, 2: {'type': 'door', 'size': (2., 1.10), 'height': 0}}
##print opening_attr
#
#
#corner_attr = {0: {'type': 'intersecting', 'brick_bond': 'stretcher'}, 1: {'type': 'adjoining', 'brick_bond': 'stretcher'}}
##print corner_attr
#
## Assign attributes to the front network
#network_front.attributes['openings'] = opening_attr
#network_front.attributes['corners'] = corner_attr
#
#
#for node, attributes in network_front.attributes['openings'].items():
#
#    if attributes:
#        if attributes['type'] == 'window':
#            current_attribute = {'pos': network_front.node_coordinates(node), 'radius': 0.5}
#            window_size = attributes['size']
#            window_height = attributes['height']
#            current_attribute = draw_spheres([current_attribute])
#
#        elif attributes['type'] == 'door':
#            current_attribute = {'pos': network_front.node_coordinates(node), 'radius': 0.5}
#            door_size = attributes['size']
#            current_attribute = draw_spheres([current_attribute])
#
#








for key, attr in network_front.nodes(True):
    pass #print key, attr

for key, attr in network_front.edges(True):
    pass #print key, attr
    
#network_objs = network_front, network_left, network_right, network_back
#print network_objs

"""
network = Network()

for nodes in [network_front.nodes(), network_left.nodes(), network_right.nodes(), network_back.nodes()]:
    network.add_node(nodes)

for edges in [network_front.edges(), network_left.edges(), network_right.edges(), network_back.edges()]:
    for edge in edges:
        network.add_edge(edge[0], edge[1])
"""

#for key, network in enumerate(network_objs):
#    print key, network
# ---------- end design_globals_2 ----------
draw_network = GhPythonScript(networks=design_globals_2.networks, show_all=show_all, show_by_name=Toggle(True), name=list)  # -> nodes_front, edges_front, nodes_left, edges_left, nodes_right, edges_right, nodes_back, edges_back, nodes, edges; inputs networks: list
# ---------- draw_network: Python ----------
from compas_ghpython.artists import NetworkArtist
from compas.datastructures import Network
from scriptcontext import sticky as st
print name
#print networks
networks = st["networks"]
print networks
nodes = []
edges = []
for network in networks:
    print network
    if show_all:
        #nodes, edges =
        pass
    if show_by_name:
        if n == name:
            nodes, edges = NetworkArtist(network).draw()
    
        elif n == name:
            nodes, edges = NetworkArtist(network).draw()
    
        elif n == name:
            nodes, edges = NetworkArtist(network).draw()
    
        else:
            nodes, edges = NetworkArtist(network).draw()




#
#networks = network_front, network_left, network_right, network_back
##print networks
#
#if show_network == True:
#    if name == 0:
#        nodes, edges = NetworkArtist(network_front).draw()
#    if network_type == 1:
#        nodes, edges = NetworkArtist(network_left).draw()
#    if network_type == 2:
#        nodes, edges = NetworkArtist(network_right).draw()
#    if network_type == 3:
#        nodes, edges = NetworkArtist(network_back).draw()
#
#    if network_type == 4:
#        for network in networks:
#            nodes, edges = NetworkArtist(network).draw()
#
#
#
#if show_all == True:
#    for network in networks:
#        #print network
##        nodes_front, edges_front = NetworkArtist(network).draw()
#
#
#
#
##nodes_left, edges_left = NetworkArtist(network_left).draw()
##nodes_right, edges_right = NetworkArtist(network_right).draw()
##nodes_back, edges_back = NetworkArtist(network_back).draw()
# ---------- end draw_network ----------

# ---- group: assembly structure
transf = BooleanToggle(False)  # disabled
button_2 = Button()  # disabled
assembly = GhPythonScript(
    assembly=plane_grid.assembly,
    t_pts=transformation.t_pts,
    generate=button_2,
    transform=transf,
    plane_grid=plane_grid.plane_grid,
    params_grid=transformation.params_grid,
    elem_full=elem_def.elem_full,
    elem_ins=elem_def.elem_ins)  # -> assembly; inputs t_pts: list of Point3d, plane_grid: list, params_grid: list; disabled
# ---------- assembly: Python ----------
import Rhino.Geometry as rg
import math as m
from compas.geometry import Frame, Point, Rotation, Transformation, Translation
from compas.utilities import normalize_values
#from climate_aware_robotic_envelope.assembly import Assembly

#from climate_active_envelopes.assembly import BRICK_Assembly as Assembly


length = assembly.get_attribute('length')
height = assembly.get_attribute('height')
width = assembly.get_attribute('width')
mortar = assembly.get_attribute('mortar')

"""
c_pts = []
for j, face in enumerate(mesh_wall.faces()):
    vertex_centroid = mesh_wall.face_centroid(face)
    points = rg.Point3d(vertex_centroid[0],vertex_centroid[1], vertex_centroid[2])
    c_pts.append(points)

for i, points in enumerate(c_pts):
    transf_values = normalize_values(transf_values, -0.10, 0.0)
    t_val = transf_values[i]
    t_pl = rg.Plane(rg.Point3d(points[0],t_val,points[2]), rg.Vector3d(1, 0, 0), rg.Vector3d(0, 1, 0))
    t_frame = Frame(t_pl.Origin, t_pl.XAxis, t_pl.YAxis)
"""
if generate:
    for i, row in enumerate(plane_grid): # number of layers and all planes
        for j, plane in enumerate(row): #j = planes / layer
            frame = Frame(plane.Origin, plane.XAxis, plane.YAxis)
            frame_pt = frame.point

            if transform == True:
                for t_pt in t_pts:
                    dist =  t_pt.DistanceTo(rg.Point3d(frame.point[0], frame.point[1], frame.point[2]))

                if i%2 == 0 and j%3 == 1 and j%2 == 1:
                    plane.Translate(plane.XAxis*-m.radians(dist*2))

                if i%2 == 1  and j%3 != 0 and j%3 != 1 and j%2 == 1:
                    plane.Translate(plane.XAxis*-m.radians(dist*2))
                T = Transformation.from_frame_to_frame(Frame.worldXY(), Frame(plane.Origin, plane.XAxis, plane.YAxis))
            else: 
                T = Transformation.from_frame_to_frame(Frame.worldXY(), frame)


            if i%2 == 1 and j%2 == 1 and j%3 != 1:
                c = elem_full.transformed(T)
                assembly.add_element(c)
            elif i%2 == 0 and j%2 == 1 and j%3 != 0:
                c = elem_full.transformed(T)
                assembly.add_element(c)
            else:
                c = elem_ins.transformed(T)
                assembly.add_element(c)
# ---------- end assembly ----------

# ---- group: to JSON
button_3 = Button()  # disabled
export = PythonScript(DATA=py.DATA, assembly=assembly, export_to_json=button_3)  # disabled
# ---------- export: Python ----------
import os
#from compas.datastructures.mesh import mesh_quads_to_triangles
#from compas.datastructures.mesh import mesh_unify_cycles



if export_to_json:

    filename = "brickwall.json"
    PATH = os.path.join(DATA, filename)



    # the assembly has to be serialized such that it can be called from CPython
    assembly.to_json(PATH)

"""
if export_to_json_unity:
    
    for key, e in assembly.elements():
    
        #convert to trimesh
        mesh_quads_to_triangles(e._mesh, check_angles=False)
        #mesh_unify_cycles(e._mesh)
        #print e._mesh.faces
        #print e._mesh.face_vertices(list(e._mesh.faces())[0])

    filename = "brickwall_unity.json"
    PATH = os.path.join(DATA, filename)
    assembly.to_json(PATH)
"""
# ---------- end export ----------

# ----
point_4 = Point(draw_network.nodes)
line_2 = Line(draw_network.edges)
point_5 = Point(draw_network.nodes_front)
line_3 = Line(draw_network.edges_front)
attributes = GhPythonScript(network_front=design_globals_2.network_front)  # -> out, a
# ---------- attributes: Python ----------
from compas.geometry import Point
from compas.datastructures import Mesh
from compas.datastructures import Network
from compas_ghpython.artists import NetworkArtist
from compas_ghpython import draw_spheres, artists

# Define attributes
opening_attr = {0: None, 1: {'type': 'window', 'size': (0.80, 0.80), 'height': 0.90}, 2: {'type': 'door', 'size': (2., 1.10), 'height': 0}}
#print opening_attr


corner_attr = {0: {'type': 'intersecting', 'brick_bond': 'stretcher'}, 1: {'type': 'adjoining', 'brick_bond': 'stretcher'}}
#print corner_attr

# Assign attributes to the front network
network_front.attributes['openings'] = opening_attr
network_front.attributes['corners'] = corner_attr


for node, attributes in network_front.attributes['openings'].items():

    if attributes:
        if attributes['type'] == 'window':
            current_attribute = {'pos': network_front.node_coordinates(node), 'radius': 0.5}
            window_size = attributes['size']
            window_height = attributes['height']
            current_attribute = draw_spheres([current_attribute])

        elif attributes['type'] == 'door':
            current_attribute = {'pos': network_front.node_coordinates(node), 'radius': 0.5}
            door_size = attributes['size']
            current_attribute = draw_spheres([current_attribute])
# ---------- end attributes ----------

# ---- group: Network Artist
show_6 = BooleanToggle(True)  # disabled
number_slider_4 = Slider(26, range=0..47)  # disabled
draw_3 = GhPythonScript(assembly=assembly, show_network=show_6, key=number_slider_4)  # -> nodes, edges, current_node, current_node_neighbors; inputs key: Int32; disabled
# ---------- draw_3: Python ----------
import sys, os
import ghpythonlib.components as ghcomp
from compas.datastructures import Network
from compas_ghpython.artists import NetworkArtist
from compas_rhino.geometry import RhinoLine

import compas_ghpython
import Rhino.Geometry as rg


data = assembly.network.to_data()
network = Network.from_data(data)

print assembly.network.number_of_nodes()

def draw_network(network):
    """Draw a network in Grasshopper.
    """
    points = []
    for key, attr in network.nodes(True):
        points.append({
            'pos': network.node_coordinates(key),
        })

    lines = []
    for (u, v), attr in network.edges(True):
        lines.append({
            'start': network.node_coordinates(u),
            'end': network.node_coordinates(v),
        })

    points_rg = compas_ghpython.draw_points(points)
    lines_rg = compas_ghpython.draw_lines(lines)

    return points_rg, lines_rg

if show_network:
    nodes, edges = draw_network(network)
    
    current_node = {'pos': network.node_coordinates(key), 'radius': 0.03}
    current_node = compas_ghpython.draw_spheres([current_node])
    
    current_node_neighbors_keys = network.neighbors(key)
    current_node_neighbors = [{'pos': network.node_coordinates(key), 'radius': 0.02} for key in current_node_neighbors_keys]
    current_node_neighbors = compas_ghpython.draw_spheres(current_node_neighbors)
# ---------- end draw_3 ----------
pt = Point(draw_3.nodes)  # disabled
line_4 = Line(draw_3.edges)  # disabled
brep = Brep(draw_3.current_node_neighbors)  # disabled
brep_2 = Brep(draw_3.current_node)  # disabled

# ----
brep_3 = Brep()

key = Slider(388, range=0..388)  # disabled
till_key = Button()  # disabled
start = Button()  # disabled
reset = Button()  # disabled
stop = Button()  # disabled
back = Button()  # disabled
step = Button()  # disabled
full = Button()  # disabled
list_2 = ValueList({"20", "50", "100", "500", "1000", "5000"}, selected="1000")  # disabled

ghpython_script_5 = GhPythonScript()  # -> out, edges, nodes
# ---------- ghpython_script_5: Python ----------
from compas.datastructures import Network
from compas.geometry import Line
from compas.artists import NetworkArtist, Artist

# Create a Network instance
network = Network()

# Define the four sides of the rectangular room as Line segments
sides = [
    Line((0, 0, 0), (5, 0, 0)),
    Line((5, 0, 0), (5, 3, 0)),
    Line((5, 3, 0), (0, 3, 0)),
    Line((0, 3, 0), (0, 0, 0))
]



# Add the sides as nodes to the network
for i, side in enumerate(sides):
    network.add_node(i, x=side.midpoint[0], y=side.midpoint[1], z=side.midpoint[2])

# Define the edges between the nodes to represent the connections between sides
edges = [
    (0, 1),
    (1, 2),
    (2, 3),
    (3, 0)
]

# Add the edges to the network
for u, v in edges:
    network.add_edge(u, v)

# Create a NetworkArtist instance to visualize the network
edges, nodes = NetworkArtist(network).draw()
# ---------- end ghpython_script_5 ----------

counter = CountThroughList(
    assembly=assembly,
    start=start,
    stop=stop,
    step=step,
    step_back=back,
    reset=reset,
    full=full,
    till_key=till_key,
    key=key,
    interval=list_2)  # -> item, counter; inputs start: Boolean, stop: Boolean, step_back: Boolean, key: Int32; disabled
# ---------- counter: Python ----------
from scriptcontext import sticky as st
from compas_ghpython import update_component


L = list(assembly.elements())
# store data in component
guid = str(ghenv.Component.InstanceGuid)
counter_key = "counter_" + guid
running_key = "running_" + guid

if counter_key not in st:
    st[counter_key] = 0

if running_key not in st:
    st[running_key] = False
    

if st[running_key]:
    if st[counter_key] < len(L) - 1:
        st[counter_key] += 1
        update_component(ghenv, interval)
    else:
        st[counter_key] = 0
        st[running_key] = False
    
    
if start:
    st[running_key] = True

if stop:
    st[running_key] = False

if step:
    if st[counter_key] < len(L) - 1:
        st[counter_key] += 1

if step_back:
    if  0 < st[counter_key] < len(L):
        st[counter_key] -= 1

if reset:
    st[counter_key] = 0

if till_key:
    st[counter_key] = key

if full:
    st[counter_key] = len(L)-1

if len(L):
    item = L[st[counter_key]]



#st["visualisation_counter"] = st[counter_key]
#st[counter_key]= 500
counter = st[counter_key]
# ---------- end counter ----------
idx = Panel(counter.counter)  # disabled

# ---- group: Assembly Artist
show_7 = BooleanToggle(False)  # disabled
show_8 = BooleanToggle(True)  # disabled
show_9 = BooleanToggle(True)  # disabled
draw_4 = PythonScript(assembly=assembly, show_all=show_7, show_current=show_8, show_counter=show_9, counter=counter.counter)  # -> G, G_element, tool_planes_WCS, current_tool_plane; inputs counter: Int32; disabled
# ---------- draw_4: Python ----------
import os
import sys

import math

from compas.colors import Color
from compas.artists import Artist
from compas_ghpython.artists import NetworkArtist


G = []
G_element = []
#color = Color.from_rgb255(220,165,165)

key_index = assembly.network.key_index()
keys = [key_index[key] for key in assembly.network.nodes()]
elements = [assembly.element(key) for key in keys]
#print elements
#print([(e.gripping_frame) for e in elements])

tool_planes_WCS = [Artist(e.tool_frame).draw() for e in elements]

current_tool_plane = tool_planes_WCS[counter]

if show_all and not show_counter:
    for element in elements:
        mesh = Artist(element.mesh).draw(Color.from_rgb255(220,165,165))
        G.append(mesh)

if show_counter:
    for element in elements[0:counter+1]:
        mesh = Artist(element.mesh).draw(Color.from_rgb255(220,165,165))
        G.append(mesh)

if show_current:
    element = assembly.element(counter)
    mesh = Artist(element.mesh).draw(Color.from_rgb255(41,49,51))
    G_element.append(mesh)


#    course = assembly.network.node_attribute(key=counter, name='course')
#    keys_in_course = list(assembly.network.nodes_where({'course': course}))
#    elements = [assembly.element(key) for key in keys_in_course]
#    for element in elements:
#        mesh = Artist(element.mesh).draw(color)
#        G.append(mesh)
# ---------- end draw_4 ----------
pln = Plane(draw_4.tool_planes_WCS)  # disabled
geo = Geometry(draw_4.G_element)  # disabled
pln_2 = Plane(draw_4.current_tool_plane)  # disabled
geo_2 = Geometry(draw_4.G)  # disabled

# ---- group: transformation values
number_slider_5 = Slider(1, range=0.01..1)  # disabled
context = Brep(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)  # disabled
mesh_flip = MeshFlip(Mesh=mesh_2)  # disabled
boolean_toggle = BooleanToggle(True)  # disabled
boolean_toggle_2 = BooleanToggle(False)  # disabled
direct_sun_hours = DirectSunHours(geometry=mesh_flip, context=context, grid_size=number_slider_5, run=boolean_toggle)  # -> points, results, mesh, sky_mtx; disabled
incidentradiation = LBIncidentRadiation(
    sky_mtx=direct_sun_hours.sky_mtx,
    geometry=flatten(geo_2),
    context=flatten(context),
    grid_size=number_slider_5,
    run=boolean_toggle_2)  # -> out, points, results, total, mesh, legend, title, int_mtx; disabled; plug-in component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
mesh_3 = Mesh(direct_sun_hours.mesh)  # disabled

# ----
mesh_4 = Mesh(incidentradiation.mesh)  # disabled
show_10 = BooleanToggle(True)
show_11 = BooleanToggle(True)
ghpython_script_6 = GhPythonScript()  # -> out, a
# ---------- ghpython_script_6: Python ----------
#for key, attr in network_front.nodes(True):
#    pass# print key, attr
#
#for key, attr in network_front.edges(True):
#    pass #print key, attr
    
#network_objs = network_front, network_left, network_right, network_back
#print network_objs


#network = Network()
#
#for nodes in [network_front.nodes(), network_left.nodes(), network_right.nodes(), network_back.nodes()]:
#    network.add_node(nodes)
#
#for edges in [network_front.edges(), network_left.edges(), network_right.edges(), network_back.edges()]:
#    for edge in edges:
#        network.add_edge(edge[0], edge[1])


#for key, network in enumerate(network_objs):
#    print key, network

#nodes_front, edges_front = NetworkArtist(network_front).draw()
#nodes_left, edges_left = NetworkArtist(network_left).draw()
#nodes_right, edges_right = NetworkArtist(network_right).draw()
#nodes_back, edges_back = NetworkArtist(network_back).draw()
# ---------- end ghpython_script_6 ----------
global_wall_2 = GhPythonScript(
    factor_x=Slider(6.6, range=0.4..10),
    factor_z=Slider(2.56, range=0.3..10),
    factor_y=Slider(5.62, range=0.3..10),
    key=Slider(2, range=0..3))  # -> mesh_wall, nodes, edges, current_node, current_nodes_neighbors; inputs factor_x: Int32, factor_z: Int32
# ---------- global_wall_2: Python ----------
from compas.datastructures import Mesh, Network
#from compas.artists import NetworkArtist
from compas_ghpython.artists import NetworkArtist
from compas_ghpython import draw_spheres
import compas
mesh_wall = Mesh()



# Add front side vertices
for j in range(2):
    x = j * factor_x
    for i in range(2):
        z = i * factor_z
        mesh_wall.add_vertex(x=x, y=0, z=z)

# Add front side face
for j in range(1):
    for i in range(1):
        a = i + j * 2
        b = a + 1
        c = b + 2
        d = a + 2
        mesh_wall.add_face([a, b, c, d])

# add left side vertices
for j in range(2):
    z = j * factor_z
    for i in range(2):
        y = i * factor_y
        x = 0
        mesh_wall.add_vertex(x=x, y=y, z=z)

# add left side face
for j in range(1):
    for i in range(1):
        a = 4 + i + j * 2
        b = a + 1
        c = b + 2
        d = a + 2
        mesh_wall.add_face([a, b, c, d])

# add right side vertices
for j in range(2):
    z = j * factor_z
    for i in range(2):
        y = i * factor_y
        x = factor_x
        mesh_wall.add_vertex(x=x, y=y, z=z)

# add right side face
for j in range(1):
    for i in range(1):
        a = 8 + i + j * 2
        b = a + 1
        c = b + 2
        d = a + 2
        mesh_wall.add_face([a, b, c, d])

# Add back side vertices
for j in range(2):
    x = j * factor_x
    for i in range(2):
        y = factor_y
        z = i * factor_z
        mesh_wall.add_vertex(x=x, y=y, z=z)


# Add back side face
for j in range(1):
    for i in range(1):
        a = 12 + i + j * 2
        b = a + 1
        c = b + 2
        d = a + 2
        mesh_wall.add_face([a, b, c, d])





network = Network()

for face in mesh_wall.faces():
    center = mesh_wall.face_centroid(face)
    node = network.add_node(x=center[0], y=center[1], z=center[2])

current_node = {'pos': network.node_coordinates(key), 'radius' : 0.3}
current_node = draw_spheres([current_node])
# ---------- end global_wall_2 ----------
draw_5 = PythonScript(mesh_wall=global_wall_2.mesh_wall, show_faces=show_10, show_vertices=show_11)  # -> M, M_left, V
# ---------- draw_5: Python ----------
from compas.artists import Artist, MeshArtist, artist
import Rhino.Geometry as rg

meshes = []
vertices = []
labels = []

if show_faces:
    M = MeshArtist(mesh_wall).draw()
    #M_left = MeshArtist(mesh_wall_left).draw()
    #M_right = MeshArtist(mesh_wall_right).draw()

if show_vertices:
    V = MeshArtist(mesh_wall).draw_vertices()
    #V_left = MeshArtist(mesh_wall_left).draw_vertices()
    #V_right = MeshArtist(mesh_wall_right).draw_vertices()




    meshes = M
# ---------- end draw_5 ----------
ghpython_script_7 = GhPythonScript(x=Slider(14, range=0..100), y=Slider(19, range=0..100))  # -> out, a1, d1, b1, c1, edges, nodes
# ---------- ghpython_script_7: Python ----------
from compas.datastructures import Network, Mesh
from compas.geometry import Surface, Point, Vector, Frame
from compas.artists import NetworkArtist
from compas_ghpython.artists import Artist, PointArtist
from climate_active_envelopes.utilities import frame_to_plane




# Create a Network instance
network = Network()

# Define the corner points of the rectangular room

a = Point(0, 0, 0)
b = Point(x, 0, 0)
c = Point(x, y, 0)
d = Point(0, y, 0)

corner_points = []
corner_points += a, b, c, d

a1 = PointArtist(a).draw()
b1= PointArtist(b).draw()
c1= PointArtist(c).draw()
d1= PointArtist(d).draw()

# Create surface segments for each side of the room
for i in range(4):

    start = corner_points[i]
    end = corner_points[(i + 1) % 4]
    print start
    print end
    # Define the surface segment as a rectangular frame
    xaxis = end - start
    yaxis = Vector(0, 0, 1)  # Assuming sides are on the XY plane
    frame = Frame(start, xaxis, yaxis)
    plane = frame_to_plane(frame)
    print plane
    # Create a surface segment
    surface = Surface.from_plane(plane)

    # Add the surface segment as a node to the network
    #network.add_node(i, surface=surface)

# Define the edges between the nodes to represent the connections between surface segments
edges = [
    (0, 1),
    (1, 2),
    (2, 3),
    (3, 0)
]

## Add the edges to the network
#for u, v in edges:
#    network.add_edge(u, v)
#
## Create a NetworkArtist instance to visualize the network
#edges, nodes = NetworkArtist(network).draw()
# ---------- end ghpython_script_7 ----------
point_6 = Point(ghpython_script_7.nodes)
line_5 = Line(ghpython_script_7.edges)
mesh_5 = Mesh([draw_5.M, draw_5.M_left])
point_7 = Point(draw_5.V)
point_8 = Point(global_wall_2.nodes)
line_6 = Line(global_wall_2.edges)
brep_4 = Brep(global_wall_2.current_node)
brep_5 = Brep(global_wall_2.current_nodes_neighbors)

# ==== cluster DirectSunHours
file_path = FilePath("C:\Users\Bootsy\Downloads\Braunschweig-hour.epw")
importepw = LBImportEPW(epw_file=file_path)  # -> location, dry_bulb_temperature, dew_point_temperature, relative_humidity, wind_speed, wind_direction, direct_normal_rad, diffuse_horizontal_rad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; plug-in component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
analysisperiod = LBAnalysisPeriod(
    start_month=Slider(3, range=0..10),
    start_day=Slider(1, range=0..10),
    start_hour=Slider(11, range=0..100),
    end_month=Slider(8, range=0..10),
    end_day=Slider(31, range=0..100),
    end_hour=Slider(16, range=0..100))  # -> period, hoys, dates; plug-in component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
sunpath = LBSunPath(north="0", location=importepw.location, hoys=analysisperiod.hoys, scale=0.05)  # -> out, vectors, altitudes, azimuths, hoys, sun_pts, analemma, daily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; plug-in component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
colrange = LBColorRange(index=22)  # -> colors; plug-in component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
legendpar = LBLegendParameters(colors=colrange)  # -> leg_par; plug-in component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
skymatrix = LBCumulativeSkyMatrix(
    north="0",
    location=importepw.location,
    direct_rad=importepw.direct_normal_rad,
    diffuse_rad=importepw.diffuse_horizontal_rad,
    hoys=analysisperiod.hoys)  # -> out, sky_mtx; plug-in component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
geometry = ClusterInput()
context = ClusterInput()
grid_size = ClusterInput()
run = ClusterInput()
sky_mtx = ClusterOutput(skymatrix.sky_mtx)
directsunhours = LBDirectSunHours(
    vectors=flatten(sunpath.vectors),
    geometry=flatten(geometry),
    context=flatten(context),
    grid_size=grid_size,
    offset_dist=0.01,
    legend_par=legendpar,
    run=run)  # -> out, points, results, mesh, legend, title, int_mtx; plug-in component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
points = ClusterOutput(directsunhours.points)
results = ClusterOutput(directsunhours.results)
mesh = ClusterOutput(directsunhours.mesh)
