# Grasshopper definition 230818_CAE_reference_tool.ghx (Grasshopper 1.0.7)

mesh = GhPythonScript()  # -> out, a
# ---------- mesh: Python ----------
def create_outer_wall_network(self, length, width, height):
    """Create network from mesh
    """
    mesh_wall = Mesh()
    # Add front side vertices
    for j in range(2):
        x = j * width
        for i in range(2):
            z = i * height
            mesh_wall.add_vertex(x=x, y=0, z=z)
    
    # Add front side face
    for j in range(1):
        for i in range(1):
            a = i + j * 2
            b = a + 1
            c = b + 2
            d = a + 2
            mesh_wall.add_face([a, b, c, d])
    
    # add left side vertices
    for j in range(2):
        z = j * height
        for i in range(2):
            y = i * length
            x = 0
            mesh_wall.add_vertex(x=x, y=y, z=z)
    
    # add left side face
    for j in range(1):
        for i in range(1):
            a = 4 + i + j * 2
            b = a + 1
            c = b + 2
            d = a + 2
            mesh_wall.add_face([a, b, c, d])
    
    # add right side vertices
    for j in range(2):
        z = j * height
        for i in range(2):
            y = i * length
            x = width
            mesh_wall.add_vertex(x=x, y=y, z=z)
    
    # add right side face
    for j in range(1):
        for i in range(1):
            a = 8 + i + j * 2
            b = a + 1
            c = b + 2
            d = a + 2
            mesh_wall.add_face([a, b, c, d])
    
    # Add back side vertices
    for j in range(2):
        x = j * width
        for i in range(2):
            y = length
            z = i * height
            mesh_wall.add_vertex(x=x, y=y, z=z)
    
    # Add back side face
    for j in range(1):
        for i in range(1):
            a = 12 + i + j * 2
            b = a + 1
            c = b + 2
            d = a + 2
            mesh_wall.add_face([a, b, c, d])
# ---------- end mesh ----------
wall = Brep(<brep referenced from the Rhino model>)

panel = Panel("Reload libraries")
bang = Button()
unload = PythonScript(reload=bang)
# ---------- unload: Python ----------
from compas_ghpython import unload_modules

if reload:
    unload_modules('climate_active_envelopes')
# ---------- end unload ----------

ref_elem = GhPythonScript(mesh=wall)  # -> element; inputs mesh: Mesh
# ---------- ref_elem: Python ----------
from compas.geometry import Frame
from compas_rhino.geometry import RhinoMesh
from compas.datastructures import Mesh
from compas.artists import Artist
from climate_active_envelopes.assembly import ReferenceElement as Element
import Rhino.Geometry as rg


## dimensions full brick
#length = assembly.get_attribute('length')
#width = assembly.get_attribute('width')
#height = assembly.get_attribute('height')
#elem_ins = assembly.get_attribute('elem_ins')


#elem_full = Element.from_dimensions(length, width, height)
#elem_full.tool_frame = Frame([0, 0, height], [1, 0, 0], [0, -1, 0])


mesh = Element.from_rhinomesh_geometry(mesh, Frame([0, 0, 0], [1, 0, 0], [0, -1, 0]))
# ---------- end ref_elem ----------
py = PythonScript()  # -> HERE, DATA
# ---------- py: Python ----------
import os

HERE = os.path.dirname(ghdoc.Path)
DATA = os.path.abspath(os.path.join(HERE, "..", "data"))

#print(HERE)
#print(DATA)
# ---------- end py ----------
ref_model = GhPythonScript(element=ref_elem)  # -> plane_grid; inputs element: Mesh
# ---------- ref_model: Python ----------
from compas.geometry import Frame
from compas_rhino.geometry import RhinoMesh
from compas.datastructures import Mesh
from compas.artists import Artist
from climate_active_envelopes.assembly import Assembly, Element
import Rhino.Geometry as rg


## dimensions full brick
#length = assembly.get_attribute('length')
#width = assembly.get_attribute('width')
#height = assembly.get_attribute('height')
#elem_ins = assembly.get_attribute('elem_ins')


elem_full = Element.from_dimensions(length, width, height)
elem_full.tool_frame = Frame([0, 0, height], [1, 0, 0], [0, -1, 0])


elem_ins = Element.from_rhinomesh_geometry(elem_ins, Frame([0, 0, height/2], [1, 0, 0], [0, -1, 0]))
elem_ins.tool_frame = Frame([0, 0, height], [1, 0, 0], [0, -1, 0])

print elem_ins
print elem_full
# ---------- end ref_model ----------
