# Grasshopper definition 230821_CAE_reference_tool.ghx (Grasshopper 1.0.7)

# ---- group: reference_elements
variable = Slider(0.4, range=0..3)
show = BooleanToggle(True)
ref_elems = GhPythonScript(length=Slider(0.4, range=0.4..10), height=Slider(0.3, range=0.3..10), variable=variable)  # -> front_elem, back_elem, right_elem, left_elem
# ---------- ref_elems: Python ----------
from compas.geometry import Frame
from climate_active_envelopes.assembly import ReferenceElement as Element


frame = Frame.worldXY()

front_elem = Element.create_ref_elem(frame, length, height)
back_elem = Element.create_ref_elem(frame, length, height)

right_elem = Element.create_ref_elem(frame, length+variable, height)
left_elem = Element.create_ref_elem(frame, length+variable, height)
# ---------- end ref_elems ----------
draw = PythonScript(ref_elem=ref_elems.right_elem, show=show)  # -> M, F
# ---------- draw: Python ----------
from compas.artists import MeshArtist, Artist


if show:
    M = Artist(ref_elem.mesh).draw()
    F = Artist(ref_elem.frame).draw()
# ---------- end draw ----------
mesh = Mesh(draw.M)
pln = Plane(draw.F)

# ---- group: reference_element
variable_2 = Slider(0.4, range=0..3)
show_2 = BooleanToggle(True)
ref_elem = GhPythonScript(length=Slider(0.4, range=0.4..10), height=Slider(0.3, range=0.3..10), variable=variable_2)  # -> front_elem, back_elem, right_elem, left_elem; same code as ref_elems
draw_2 = PythonScript(ref_elem=ref_elem.right_elem, show=show_2)  # -> M, F; same code as draw
mesh_2 = Mesh(draw_2.M)
pln_2 = Plane(draw_2.F)

# ----
panel = Panel("Reload libraries")
bang = Button()
unload = PythonScript(reload=bang)
# ---------- unload: Python ----------
from compas_ghpython import unload_modules

if reload:
    unload_modules('climate_active_envelopes')
# ---------- end unload ----------

# ---- group: brick_elements
elem_ins = Mesh(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)
brick_elems = GhPythonScript(init=Button(), brick_width="0.115", brick_height="0.071", brick_length="0.24", mortar="0.01", elem_ins=elem_ins)  # -> brick_full, brick_ins; inputs elem_ins: Mesh
# ---------- brick_elems: Python ----------
from compas.geometry import Frame
from compas_rhino.geometry import RhinoMesh
from compas.datastructures import Mesh
from compas.artists import Artist
from climate_active_envelopes.assembly import Element
import Rhino.Geometry as rg




brick_full = Element.from_dimensions(brick_length,brick_width, brick_height)
brick_full.tool_frame = Frame([0, 0, brick_height], [1, 0, 0], [0, -1, 0])


brick_ins = Element.from_rhinomesh_geometry(elem_ins, Frame([0, 0, brick_height/2], [1, 0, 0], [0, -1, 0]))
brick_ins.tool_frame = Frame([0, 0, brick_height], [1, 0, 0], [0, -1, 0])

print brick_ins
print brick_full
# ---------- end brick_elems ----------

show_3 = BooleanToggle(False)
show_4 = BooleanToggle(False)
draw_3 = PythonScript(brick_full=brick_elems.brick_full, brick_ins=brick_elems.brick_ins, show_full=show_4, show_ins=show_3)  # -> M, F, S
# ---------- draw_3: Python ----------
from compas.artists import Artist
from compas.datastructures import Mesh

#M = Artist(elem_ins.mesh).draw()
#print M

if show_full:
    M = Artist(brick_full.mesh).draw()
    F = Artist(brick_full.frame).draw()
    S = Artist(brick_full.tool_frame).draw()


if show_ins:
    M = Artist(brick_ins.mesh).draw()
    F = Artist(brick_ins.frame).draw()
    S = Artist(brick_ins.tool_frame).draw()
# ---------- end draw_3 ----------
pln_3 = Plane(draw_3.F)
pln_4 = Plane(draw_3.S)
mesh_3 = Mesh(draw_3.M)

# ----
py = PythonScript()  # -> HERE, DATA
# ---------- py: Python ----------
import os

HERE = os.path.dirname(ghdoc.Path)
DATA = os.path.abspath(os.path.join(HERE, "..", "data"))

print(HERE)
print(DATA)
# ---------- end py ----------
ref_model = GhPythonScript(
    front_elem=ref_elems.front_elem,
    back_elem=ref_elems.back_elem,
    right_elem=ref_elems.right_elem,
    left_elem=ref_elems.left_elem)  # -> plane_grid, front_artist
# ---------- ref_model: Python ----------
from compas.datastructures import Mesh
from compas.artists import MeshArtist


print front_elem

print right_elem
# ---------- end ref_model ----------
ref_model_2 = GhPythonScript(
    front_elem=ref_elem.front_elem,
    back_elem=ref_elem.back_elem,
    right_elem=ref_elem.right_elem,
    left_elem=ref_elem.left_elem)  # -> plane_grid, front_artist; same code as ref_model
mesh_4 = Mesh(ref_model.front_artist)
mesh_5 = Mesh(ref_model_2.front_artist)
network_code_backup = GhPythonScript()  # -> out, a
# ---------- network_code_backup: Python ----------
    def create_outer_wall_network(self, length, width, height):
        """Create network from mesh
        """
        mesh_wall = Mesh()
        # Add front side vertices
        for j in range(2):
            x = j * width
            for i in range(2):
                z = i * height
                mesh_wall.add_vertex(x=x, y=0, z=z)
        
        # Add front side face
        for j in range(1):
            for i in range(1):
                a = i + j * 2
                b = a + 1
                c = b + 2
                d = a + 2
                mesh_wall.add_face([a, b, c, d])
        
        # add left side vertices
        for j in range(2):
            z = j * height
            for i in range(2):
                y = i * length
                x = 0
                mesh_wall.add_vertex(x=x, y=y, z=z)
        
        # add left side face
        for j in range(1):
            for i in range(1):
                a = 4 + i + j * 2
                b = a + 1
                c = b + 2
                d = a + 2
                mesh_wall.add_face([a, b, c, d])
        
        # add right side vertices
        for j in range(2):
            z = j * height
            for i in range(2):
                y = i * length
                x = width
                mesh_wall.add_vertex(x=x, y=y, z=z)
        
        # add right side face
        for j in range(1):
            for i in range(1):
                a = 8 + i + j * 2
                b = a + 1
                c = b + 2
                d = a + 2
                mesh_wall.add_face([a, b, c, d])
        
        # Add back side vertices
        for j in range(2):
            x = j * width
            for i in range(2):
                y = length
                z = i * height
                mesh_wall.add_vertex(x=x, y=y, z=z)
        
        # Add back side face
        for j in range(1):
            for i in range(1):
                a = 12 + i + j * 2
                b = a + 1
                c = b + 2
                d = a + 2
                mesh_wall.add_face([a, b, c, d])

        network = self.network
        centroids = []
        
        # add face centroids as node to the network
        for face in mesh_wall.faces():
            center = mesh_wall.face_centroid(face)
            centroids.append(center)
        
        for i, center_pts in enumerate(centroids):
            network.add_node(i, x=center_pts[0], y=center_pts[1], z=center_pts[2])
        
        # add face edges of adjoining faces to the network
        connections = [(0, [1, 2]), (1, [0, 3]), (2, [0, 3]), (3, [1, 2])]
        
        for node, neighbors in connections:
            for neighbor in neighbors:
                # check both directions of the nodes if edge already exists
                if network.has_edge(node, neighbor) != True:
                    if network.has_edge(neighbor, node) != True:
                        network.add_edge(node, neighbor)

        return network
# ---------- end network_code_backup ----------
