# Grasshopper definition 230822_CAE_reference_tool.ghx (Grasshopper 1.0.7)

# ---- group: reference_elements
variable = Slider(0.7, range=0..3)
ref_elems = GhPythonScript(length=Slider(1.7, range=0.4..10), height=Slider(1.18, range=0.3..10), variable=variable)  # -> reference_model
# ---------- ref_elems: Python ----------
from compas.geometry import Frame, Vector
from climate_active_envelopes.assembly import ReferenceElement as Element
from climate_active_envelopes.assembly import ReferenceModel as Assembly
from compas.geometry import Frame, Point, Rotation, Transformation, Translation

frame = Frame.worldXY()

front_element = Element.create_ref_elem(frame, length, height)
back_element = Element.create_ref_elem(frame, length, height)
right_element = Element.create_ref_elem(frame, length+variable, height)
left_element = Element.create_ref_elem(frame, length+variable, height)

back_frame = Frame(Point(length, length+variable, 0), Vector(-1, 0, 0), Vector(0, -1, 0))
right_frame = Frame(Point(length, 0, 0), Vector(0, 1, 0), Vector(-1, 0, 0))
left_frame = Frame(Point(0, length+variable, 0), Vector(0, -1, 0), Vector(1, 0 , 0))


reference_model = Assembly()

T1 = Transformation.from_frame_to_frame(frame, back_frame)
T2 = Transformation.from_frame_to_frame(frame, right_frame)
T3 =Transformation.from_frame_to_frame(frame, left_frame)

front_elem = front_element
back_elem = back_element.transformed(T1)
right_elem = right_element.transformed(T2)
left_elem = left_element.transformed(T3)

reference_model.add_element(front_elem)
reference_model.add_element(back_elem)
reference_model.add_element(right_elem)
reference_model.add_element(left_elem)

reference_model.add_connection(0, 2)
reference_model.add_connection(1, 3)
reference_model.add_connection(2, 1)
reference_model.add_connection(3, 0)
print reference_model
# ---------- end ref_elems ----------

# ----
panel = Panel("Reload libraries")
bang = Button()
unload = PythonScript(reload=bang)
# ---------- unload: Python ----------
from compas_ghpython import unload_modules

if reload:
    unload_modules('climate_active_envelopes')
# ---------- end unload ----------

# ---- group: brick_elements
elem_ins = Mesh(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)
brick_elems = GhPythonScript(init=Button(), brick_width="0.115", brick_height="0.071", brick_length="0.24", mortar="0.01", elem_ins=elem_ins)  # -> brick_full, brick_ins; inputs elem_ins: Mesh
# ---------- brick_elems: Python ----------
from compas.geometry import Frame
from compas_rhino.geometry import RhinoMesh
from compas.datastructures import Mesh
from compas.artists import Artist
from climate_active_envelopes.assembly import Element
import Rhino.Geometry as rg




brick_full = Element.from_dimensions(brick_length,brick_width, brick_height)
brick_full.tool_frame = Frame([0, 0, brick_height], [1, 0, 0], [0, -1, 0])


brick_ins = Element.from_rhinomesh_geometry(elem_ins, Frame([0, 0, brick_height/2], [1, 0, 0], [0, -1, 0]))
brick_ins.tool_frame = Frame([0, 0, brick_height], [1, 0, 0], [0, -1, 0])

print brick_ins
print brick_full
# ---------- end brick_elems ----------

show = BooleanToggle(False)
show_2 = BooleanToggle(False)
draw = PythonScript(brick_full=brick_elems.brick_full, brick_ins=brick_elems.brick_ins, show_full=show_2, show_ins=show)  # -> M, F, S
# ---------- draw: Python ----------
from compas.artists import Artist
from compas.datastructures import Mesh

#M = Artist(elem_ins.mesh).draw()
#print M

if show_full:
    M = Artist(brick_full.mesh).draw()
    F = Artist(brick_full.frame).draw()
    S = Artist(brick_full.tool_frame).draw()


if show_ins:
    M = Artist(brick_ins.mesh).draw()
    F = Artist(brick_ins.frame).draw()
    S = Artist(brick_ins.tool_frame).draw()
# ---------- end draw ----------
pln = Plane(draw.F)
pln_2 = Plane(draw.S)
mesh = Mesh(draw.M)

# ----
py = PythonScript()  # -> HERE, DATA
# ---------- py: Python ----------
import os

HERE = os.path.dirname(ghdoc.Path)
DATA = os.path.abspath(os.path.join(HERE, "..", "data"))

print(HERE)
print(DATA)
# ---------- end py ----------
python = GhPythonScript(reference_model=ref_elems)  # -> reference_model, a
# ---------- python: Python ----------
from compas.datastructures import Mesh
from compas.datastructures import Network
from climate_active_envelopes.assembly import Element
from climate_active_envelopes.assembly import ReferenceModel

#data = reference_model.network.to_data()
#network = Network.from_data(data)

#print network

from compas.geometry import Line, Point

# Define the number of contour lines and the brick height
height = 5  # You can adjust this number as needed
brick_height = 0.1  # Adjust the brick height as needed
length = 2
variable = 1
# Create contour lines for each element
contour_lines = []

for i in range(height):
    z = i * brick_height  # Calculate the z-coordinate for each contour line
    line = Line(Point(0, 0, z), Point(length + variable, 0, z))  # Assuming lines along the x-axis
    contour_lines.append(line)

reference_model.network.add

# Add nodes to the reference_model
nodes = [reference_model.network.add_node(line.start, {'x': line.start.x, 'y': line.start.y, 'z': line.start.z}),
         reference_model.add_node(line.end, {'x': line.end.x, 'y': line.end.y, 'z': line.end.z})]

# Add edges to represent the contour lines
for i in range(0, len(nodes), 2):
    reference_model.add_edge(nodes[i], nodes[i + 1])

# Print the reference_model's network data
data = reference_model.network.to_data()
network = Network.from_data(data)
print(network)
# ---------- end python ----------

show_3 = BooleanToggle(True)
show_4 = BooleanToggle(True)
step = Button()
back = Button()
python_2 = GhPythonScript(reference_model=ref_elems, step=step, back=back)  # -> out, counter
# ---------- python_2: Python ----------
from scriptcontext import sticky as st
from compas_ghpython import update_component

L = list(reference_model.elements())
# store data in component
guid = str(ghenv.Component.InstanceGuid)
counter_key = "counter_" + guid
running_key = "running_" + guid

#if counter_key not in st:
#    st[counter_key] = 0
#
#if running_key not in st:
#    st[running_key] = False
#
#if st[running_key]:
#    if st[counter_key] < len(L) - 1:
#        st[counter_key] += 1
#        update_component(ghenv, interval)
#    else:
#        st[counter_key] = 0
#        st[running_key] = False

if step:
    if st[counter_key] < len(L) - 1:
        st[counter_key] += 1

if back:
    if  0 < st[counter_key] < len(L):
        st[counter_key] -= 1

counter = st[counter_key]
# ---------- end python_2 ----------
draw_2 = PythonScript(reference_model=ref_elems, show_all=show_3, show_current=show_4, counter=python_2.counter)  # -> G, G_elem, planes, current_plane; inputs counter: Int32
# ---------- draw_2: Python ----------
import os
import sys

import math

from compas.colors import Color
from compas.artists import Artist
from compas_ghpython.artists import NetworkArtist


G = []
G_elem = []

key_index = reference_model.network.key_index()
keys = [key_index[key] for key in reference_model.network.nodes()]
elements = [reference_model.element(key) for key in keys]

planes = [Artist(e.frame).draw() for e in elements]
current_plane = planes[counter]


if show_all: # and not show_counter
    for element in elements:
        mesh = Artist(element.mesh).draw(Color.from_rgb255(220,165,165))
        G.append(mesh)

#if show_counter:
#    for element in elements[0:counter+1]:
#        mesh = Artist(element.mesh).draw(Color.from_rgb255(220,165,165))
#        G.append(mesh)

if show_current:
    element = reference_model.element(counter)
    mesh = Artist(element.mesh).draw(Color.from_rgb255(41,49,51))
    G_elem.append(mesh)
"""

G = []

#color = Color.from_rgb255(220,165,165)

key_index = assembly.network.key_index()
keys = [key_index[key] for key in assembly.network.nodes()]
elements = [assembly.element(key) for key in keys]
#print elements
#print([(e.gripping_frame) for e in elements])

tool_planes_WCS = [Artist(e.tool_frame).draw() for e in elements]

current_tool_plane = tool_planes_WCS[counter]

if show_all and not show_counter:
    for element in elements:
        mesh = Artist(element.mesh).draw(Color.from_rgb255(220,165,165))
        G.append(mesh)

if show_counter:
    for element in elements[0:counter+1]:
        mesh = Artist(element.mesh).draw(Color.from_rgb255(220,165,165))
        G.append(mesh)


#    course = assembly.network.node_attribute(key=counter, name='course')
#    keys_in_course = list(assembly.network.nodes_where({'course': course}))
#    elements = [assembly.element(key) for key in keys_in_course]
#    for element in elements:
#        mesh = Artist(element.mesh).draw(color)
#        G.append(mesh)

"""
# ---------- end draw_2 ----------
pln_3 = Plane(draw_2.current_plane)
geo = Geometry(draw_2.G)
geo_2 = Geometry(draw_2.G_elem)
pln_4 = Plane(draw_2.planes)

show_5 = BooleanToggle(True)
draw_3 = GhPythonScript(reference_model=python.reference_model, show_network=show_5, counter=python_2.counter)  # -> nodes, edges, current_node, current_node_neighbors, labels; inputs counter: Int32
# ---------- draw_3: Python ----------
import sys, os
import ghpythonlib.components as ghcomp
from compas.datastructures import Network
from compas_ghpython.artists import NetworkArtist
from compas_rhino.geometry import RhinoLine

import compas_ghpython
import Rhino.Geometry as rg


data = reference_model.network.to_data()
network = Network.from_data(data)

#print reference_model.network.number_of_nodes()

def draw_network(network):
    """Draw a network in Grasshopper.
    """
    points = []
    for counter, attr in network.nodes(True):
        points.append({
            'pos': network.node_coordinates(counter),
        })

    lines = []
    for (u, v), attr in network.edges(True):
        lines.append({
            'start': network.node_coordinates(u),
            'end': network.node_coordinates(v),
        })

    points_rg = compas_ghpython.draw_points(points)
    lines_rg = compas_ghpython.draw_lines(lines)

    return points_rg, lines_rg

if show_network:
    nodes, edges = draw_network(network)
    
    current_node = {'pos': network.node_coordinates(counter), 'radius': 0.1}
    current_node = compas_ghpython.draw_spheres([current_node])
    
    current_node_neighbors_counters = network.neighbors(counter)
    current_node_neighbors = [{'pos': network.node_coordinates(counter), 'radius': 0.2} for counter in current_node_neighbors_counters]
    current_node_neighbors = compas_ghpython.draw_spheres(current_node_neighbors)

    labels = [counter for counter in network.nodes()]
# ---------- end draw_3 ----------
pt = Point(draw_3.nodes)
line = Line(draw_3.edges)
brep = Brep(draw_3.current_node)
brep_2 = Brep(draw_3.current_node_neighbors)
tag = TextTag(Location=draw_3.nodes, Text=draw_3.labels)

# ---- group: wall_mesh
global_wall = GhPythonScript(wall_length=Slider(2, range=0.4..10), wall_height=Slider(1, range=0.3..10))  # -> assembly, mesh_wall, mesh_grid
# ---------- global_wall: Python ----------
from compas.datastructures import Mesh
from compas.geometry import Curve, Point, Frame
from compas.artists import MeshArtist, Artist
import math as m
import Rhino.Geometry as rg
from compas.utilities import normalize_values

length = assembly.get_attribute('length')
height = assembly.get_attribute('height')
width = assembly.get_attribute('width')
mortar = assembly.get_attribute('mortar')


mesh_wall = Mesh()

mesh_grid = []


step_in_z = height + mortar/2
step_in_x = (length+width)/2 + mortar
vertices_per_row = int(wall_length / step_in_x)


row = int(wall_height / step_in_z)
#interval = period/vertices_per_row

total_length = (vertices_per_row - 1) * (step_in_x)


#create vertices
for j in range(row): 
    z = j * step_in_z
    for i in range(vertices_per_row): 
        y = 0
        x = i * step_in_x
        mesh_wall.add_vertex(x = x, y = y, z = z) 

#create faces
for j in range(row -1):
    planes_per_row = []
    for i in range(vertices_per_row - 1):
        a = i + j * vertices_per_row
        b = a + vertices_per_row
        c = b + 1
        d = a + 1

#create planes at faces_centroid
        vertex_centroid = mesh_wall.face_centroid(mesh_wall.add_face([a, b, c, d]))
        vertex_pts = Point(vertex_centroid[0], vertex_centroid[1], vertex_centroid[2])
        vertex_frame = Frame([vertex_pts[0], vertex_pts[1], vertex_pts[2]], [1,0,0], [0,1,0])
        vertex_plane = Artist(vertex_frame).draw()
        planes_per_row.append(vertex_plane)
    mesh_grid.append(planes_per_row)

face_cplanes = [plane for planes_row in mesh_grid for plane in planes_row]



























"""
if add_left:
    # create vertices
    for j in range(row): 
        z = j * step_in_z
        for i in range(vertices_per_row_2): 
            y = i * step_in_x
            x = 0
            mesh_wall_left.add_vertex(x = x, y = y, z = z) 
            #V2 = MeshArtist(mesh_wall_left).draw_vertices()
            
    #create faces
    for j in range(row - 1):
        planes_per_row_2 = []
        for i in range(vertices_per_row_2 - 1):
            e = i + j * vertices_per_row_2
            f = e + vertices_per_row_2
            g = f + 1
            h = e + 1
            #mesh_wall_left.add_face([e, f, g, h])
            #M2 = MeshArtist(mesh_wall_left).draw()

    #create planes at faces_centroid
            vertex_centroid_2 = mesh_wall_left.face_centroid(mesh_wall_left.add_face([e, f, g, h]))
            vertex_cpts_2 = Point(vertex_centroid_2[0], vertex_centroid_2[1], vertex_centroid_2[2])
            vertex_cframe_2 = Frame([vertex_cpts_2[0], vertex_cpts_2[1], vertex_cpts_2[2]], [1,0,0], [0,1,0])
            vertex_cplane_2 = Artist(vertex_cframe_2).draw()
            planes_per_row_2.append(vertex_cplane_2)
        mesh_grid_left.append(planes_per_row_2)

    face_cplanes_2 = [plane_2 for planes_row_2 in mesh_grid_left for plane_2 in planes_row_2]




if add_right:
    # create vertices
    for j in range(row): 
        z = j * step_in_z
        for i in range(vertices_per_row_2): 
            y = i * step_in_x
            x = (total_length)
            mesh_wall_right.add_vertex(x = x, y = y, z = z) 


    #create faces
    for j in range(row - 1):
        planes_per_row_2 = []
        for i in range(vertices_per_row_2 - 1):
            k = i + j * vertices_per_row_2
            l = k + vertices_per_row_2
            m = l + 1
            n = k + 1

    #create planes at faces_centroid
            vertex_centroid_3 = mesh_wall_right.face_centroid(mesh_wall_right.add_face([k, l, m, n]))
            vertex_cpts_3 = Point(vertex_centroid_3[0], vertex_centroid_3[1], vertex_centroid_3[2])
            vertex_cframe_3 = Frame([vertex_cpts_3[0], vertex_cpts_3[1], vertex_cpts_3[2]], [1,0,0], [0,1,0])
            vertex_cplane_3 = Artist(vertex_cframe_3).draw()
            planes_per_row_2.append(vertex_cplane_3)
        mesh_grid_right.append(planes_per_row_2)

    face_cplanes_2 = [plane_3 for planes_row_3 in mesh_grid_right for plane_3 in planes_row_3]
    
    
#mesh_wall_all = []
#mesh_wall_all += mesh_wall, mesh_wall_left, mesh_wall_right


## Create wall curves left and right
#total_length = step_in_x*(vertices_per_row-1)
#total_height = step_in_z*(row-1)

#wall_crv_left = rg.Line(rg.Point3d(0,0,0), rg.Point3d(0,0,total_height))
#wall_crv_bottom_left = rg.Line(rg.Point3d(0,0,0), rg.Point3d(0, m.pi*0.5, 0))

#wall_crv_right = rg.Line(rg.Point3d(total_length,0,0), rg.Point3d(total_length, 0, total_height))
#wall_crv_bottom_right = rg.Line(rg.Point3d(total_length,0,0), rg.Point3d(total_length, m.pi*0.5, 0))



#        if add_front:
#            x = i * step_in_x
#            y = amplitude * m.sin(interval * i + phase)
#            mesh_wall.add_vertex(x=x, y=y, z=z)
#
#        if add_left:
#            x = 0
#            y = i * step_in_x
#            mesh_wall.add_vertex(x=x, y=y, z=z)
#
#        if add_right:
#            y = i * step_in_x
#            x = total_length
#            mesh_wall.add_vertex(x=x, y=y, z=z)
"""
# ---------- end global_wall ----------

show_6 = BooleanToggle(True)
show_7 = BooleanToggle(False)
show_8 = BooleanToggle(False)
draw_4 = PythonScript(mesh_wall=global_wall.mesh_wall, show_faces=show_6, show_vertices=show_7, show_labels=show_8)  # -> M, V, L
# ---------- draw_4: Python ----------
from compas.artists import Artist, MeshArtist, artist
import Rhino.Geometry as rg

meshes = []
vertices = []
labels = []

if show_faces:
    M = MeshArtist(mesh_wall).draw()
    #M_left = MeshArtist(mesh_wall_left).draw()
    #M_right = MeshArtist(mesh_wall_right).draw()

if show_vertices:
    V = MeshArtist(mesh_wall).draw_vertices()
    #V_left = MeshArtist(mesh_wall_left).draw_vertices()
    #V_right = MeshArtist(mesh_wall_right).draw_vertices()

if show_labels:
    L = [key for key in mesh_wall.vertices()]
    #L_left = [key for key in mesh_wall_left.vertices()]
    #L_right = [key for key in mesh_wall_right.vertices()]


    meshes = M
# ---------- end draw_4 ----------
mesh_2 = Mesh(draw_4.M)
pt_2 = Point(draw_4.V)
tag_2 = TextTag(Location=draw_4.V, Text=draw_4.L, Colour=ColourSwatch(SwatchColor=RGB(0, 0, 0)))

# ----
plane_grid = GhPythonScript(assembly=global_wall.assembly, mesh_grid=global_wall.mesh_grid)  # -> assembly, plane_grid, planes; inputs mesh_grid: list; disabled
# ---------- plane_grid: Python ----------
from compas.geometry import Curve, Point, Frame
from compas.artists import Artist, artist
import math as m
import Rhino.Geometry as rg

length = assembly.get_attribute('length')
height = assembly.get_attribute('height')
width = assembly.get_attribute('width')
mortar = assembly.get_attribute('mortar')


plane_grid = []

def create_plane_grid(mesh_grid):

    for i, row_planes in enumerate(mesh_grid):
        row = []
        for j, plane in enumerate(row_planes):
            z1 = plane
            z1.Translate(z1.ZAxis*-height/2)


            #odd layers
            if i%2 == 0: 
                if j%2 == 0: 
                    z1.Translate(z1.YAxis*+(length/4 + mortar/4))
                    z1.Rotate(m.radians(90), z1.ZAxis)
                    z4 = rg.Plane(z1)
                    z4.Translate(z4.XAxis*+(length + mortar))
                    row.append(z4)

                if j%2 == 1:
                    z2 = rg.Plane(z1)
                    z2.Rotate(m.radians(90), z2.ZAxis)
                    z2.Translate(z2.YAxis*+(width/2 + mortar/2))
                    z2.Translate(z2.XAxis*+((length/2+width/2) + mortar))
                    row.append(z2)
                    z3 = rg.Plane(z2)
                    z2.Translate(z2.YAxis*-(width + mortar))
                    row.append(z3)
                    z5 = rg.Plane(z1)
                    z5.Translate(z5.YAxis*+((length+ width) + mortar*2))
                    row.append(z5)


            #even layers
            if i%2 == 1:
                if j%2 == 1:
                    z1.Translate(z1.YAxis*+(length/4 + mortar/4))
                    z1.Rotate(m.radians(90), z1.ZAxis)
                    z4 = rg.Plane(z1)
                    z4.Translate(z4.XAxis*+(length + mortar))
                    row.append(z4)

                if j%2 == 0:
                    z2 = rg.Plane(z1)
                    z2.Rotate(m.radians(90), z2.ZAxis)
                    z2.Translate(z2.YAxis*+(width/2 + mortar/2))
                    z2.Translate(z2.XAxis*+((length/2+width/2) + mortar))
                    row.append(z2)
                    z3 = rg.Plane(z2)
                    z2.Translate(z2.YAxis*-(width + mortar))
                    row.append(z3)
                    z5 = rg.Plane(z1)
                    z5.Translate(z5.YAxis*+((length+ width) + mortar*2))
                    row.append(z5)

            row.append(z1)
        plane_grid.append(row)
    return plane_grid

plane_grid = create_plane_grid(mesh_grid)


def list_from_2darray(array):
    return [item for sublist in array for item in sublist]

planes = list_from_2darray(plane_grid)
# ---------- end plane_grid ----------
dist = GhPythonScript(
    mesh_grid=global_wall.mesh_grid,
    plane_grid=plane_grid.plane_grid,
    mesh_wall=global_wall.mesh_wall,
    transf_values=[627, 628, 563, 471, 463, 434, 407, 380, 358, 402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])  # -> out, params_grid; inputs mesh_grid: list, plane_grid: list, transf_values: list; disabled
# ---------- dist: Python ----------
import Rhino.Geometry as rg
from compas.utilities import normalize_values
from compas.geometry import Curve, Point, Frame, Vector
from compas.artists import Artist



def calculate_distance_to(transf_values, mesh_wall):
    #normalize values from the simulation
    transf_values = normalize_values(transf_values, 0.00, -0.3)

    # create list of face_centroids of the initial mesh
    c_pts = []
    for j, face in enumerate(mesh_wall.faces()):
        vertex_centroid = mesh_wall.face_centroid(face)
        points = rg.Point3d(vertex_centroid[0],vertex_centroid[1], vertex_centroid[2])
        c_pts.append(points)

    #create new planes / points from transf_values
    t_pts = []
    t_pls = []
    for i, points in enumerate(c_pts):
        x = points[0]
        z = points[2]
        y = transf_values[i]
        #create transformation points
        t_pt = rg.Point3d(x,y,z)
        t_pts.append(t_pt)
    
        # create planes from points
        t_pl = rg.Plane(rg.Point3d(x,y,z), rg.Vector3d(1, 0, 0), rg.Vector3d(0, 1, 0))
        t_pls.append(t_pl)

    #t_points = []
    distances = []
    for c_pt, t_pt in zip(c_pts, t_pts):
        c_point = rg.Point3d(c_pt)
        t_point = rg.Point3d(t_pt)
        #t_points.append(t_point)
        distance = rg.Point3d.DistanceTo(c_point, t_point)
        distances.append(distance)
    return distances
    #return t_points

dist_params = calculate_distance_to(transf_values, mesh_wall)


params_per_row = []
for i, row_planes in enumerate(mesh_grid):
    for j, plane in enumerate(row_planes):
        params_per_row.append(dist_params[j])


params_grid = []
for i, row_planes in enumerate(plane_grid):
    params_row = []
    for j, planes in enumerate(row_planes):
        if i%2 == 0 and j%3 == 1 and j%2 == 1:
            new_params_odd = params_per_row[j]
            params_row.append(new_params_odd)

        if i%2 == 1  and j%3 != 0 and j%3 != 1 and j%2 == 1:
            new_params_even = params_per_row[j]
            params_row.append(new_params_even)
    params_grid.append(params_row)


values = []
for i, row in enumerate(params_grid):
    for j, trans_val in enumerate(row):
        if i%2 == 0:
            print "row_odd =", i, "transf_per_row =", j, "trans_val =", trans_val
        if i%2 ==1:
            print "row_even =", i, "transf_per_row =", j, "trans_val =", trans_val
        trans_val = params_grid[i][j]

        values.append(trans_val)
print values
# ---------- end dist ----------

python_3 = GhPythonScript()  # -> out, a; unedited script template
