# Grasshopper definition 250205_assembly_design.ghx (Grasshopper 1.0.8)
# plug-ins: RhinoCodePluginGH

front = Geometry(<extrusion referenced from the Rhino model>)
left = Geometry(<extrusion referenced from the Rhino model>)
top = Geometry(<surface referenced from the Rhino model>)
right = Geometry(<extrusion referenced from the Rhino model>)
bottom = Geometry(<surface referenced from the Rhino model>)
back = Geometry(<extrusion referenced from the Rhino model>)
cell_network = Python3Script(front=front, right=right, left=left, back=back, top=top, bottom=bottom)  # -> out, cell_network; inputs front: Mesh, right: Mesh, left: Mesh, back: Mesh, top: Mesh, bottom: Mesh
# ---------- cell_network: Python ----------
from climate_active_envelopes.assembly import CAEComponent as component
from compas_rhino.conversions import mesh_to_compas
from compas.datastructures import CellNetwork


#convert rhino_mesh to compas

front_face = mesh_to_compas(front)
right_face = mesh_to_compas(right)
left_face = mesh_to_compas(left)
back_face = mesh_to_compas(back)
top_face = mesh_to_compas(top)
bottom_face = mesh_to_compas(bottom)

meshes = [front_face, right_face, left_face,back_face,top_face, bottom_face]

#create an empty CellNetwork
cell_network = CellNetwork()


# Function to find or add a vertex and return its key
def find_or_add_vertex(x, y, z):
    for vkey in cell_network.vertices():
        vx, vy, vz = cell_network.vertex_coordinates(vkey)
        if vx == x and vy == y and vz == z:
            return vkey
    return cell_network.add_vertex(x=x, y=y, z=z)

for mesh in meshes:
    face_keys = []
    # Extract vertices and faces from the mesh
    for fkey in mesh.faces():
        face_vertices = []
        for vkey in mesh.face_vertices(fkey):
            x, y, z = mesh.vertex_coordinates(vkey)
            vertex = component.find_or_add_vertex(cell_network, x, y, z)
            face_vertices.append(vertex)
        face_key = cell_network.add_face(face_vertices)
        face_keys.append(face_key)
cell_network.add_cell(face_keys)
print(cell_network)
# ---------- end cell_network ----------

compas = Python3Script()  # -> out
# ---------- compas: Python ----------
import compas
print(compas.__version__)
# ---------- end compas ----------

# ----
# Generate brick parts
list = ValueList({"none", "full", "insulated"}, selected="full")
part = Python3Script()  # -> out, full_brick, insulated_brick
# ---------- part: Python ----------
import os
from compas.geometry import Frame, Box
from compas.datastructures import Mesh
from climate_active_envelopes.assembly import CAEPart as Part



#full_brick
length, width, height = 0.24, 0.115, 0.075
full_brick = Part.from_dimensions(length=length, width=width, height=height)
full_brick.attributes['name'] = "full_brick"
#print(full_brick.attributes)
print(full_brick.__data__)

#insulated_brick_placeholder
length, width, height = 0.245, 0.12, 0.075
insulated_brick = Part.from_dimensions(length=length, width=width, height=height)
insulated_brick.attributes['name'] = "insulated_brick"
#print(insulated_brick.__data__)



#insulated_brick
# package_path = ghdoc.Path
# data_path = os.path.abspath(os.path.join(package_path,"../../../climate_active_envelopes/data/brick_types"))
# filename = 'insulated_brick_reduced.stl'
# insulated_brick_mesh = Mesh.from_stl(os.path.join(data_path, filename))
# insulated_brick = Part.from_mesh_and_frame(insulated_brick_mesh)
# insulated_brick.attributes['name'] = "insulated_brick"
# #print(insulated_brick.__data__)
# ---------- end part ----------
draw = Python3Script(full_brick=part.full_brick, insulated_brick=part.insulated_brick, show=list)  # -> M, P
# ---------- draw: Python ----------
from compas_rhino.conversions import mesh_to_rhino, box_to_rhino, frame_to_rhino
from climate_active_envelopes.assembly import CAEPart as Part
from compas.geometry import Frame
from compas.geometry import Vector
from compas.geometry import Box


if show=="full":

    #extract the mesh of the part for visulization
    compas_mesh_full = full_brick.mesh

    #convert to rhino mesh
    M = mesh_to_rhino(compas_mesh_full)

    #extract and convert to rhino plane
    P = frame_to_rhino(full_brick.frame)
    #brick_full.gripping_frame = full_brick.frame
    #print(full_brick.__data__)
    print(type(full_brick))

    
elif show == "insulated":
    
    #extract the mesh of the part for visulization
    compas_mesh_insulated = insulated_brick.mesh

    #convert to rhino mesh
    M = mesh_to_rhino(compas_mesh_insulated)
    
    #extract and convert to rhino plane
    P = frame_to_rhino(insulated_brick.frame)

else:
    pass
# ---------- end draw ----------
mesh = Mesh(draw.M)
pln = Plane(draw.P)

# ----
# Unload Python modules
button = Button()
unload = Python3Script(unload=button)  # -> out, a
# ---------- unload: Python ----------
from compas_ghpython import unload_modules

unload_modules('climate_active_envelopes')
unload_modules('assembly_information_model')
# ---------- end unload ----------

list_2 = ValueList({"rotate", "translate"}, selected="rotate")
total_length = Panel(compas)
geometry_input = Brep(<brep referenced from the Rhino model>)

# ----
# Slicing mesh input
layer_height = Slider(0.1, range=0..1)
contour = Python3Script(brep=geometry_input, layer_height=layer_height)  # -> out, curves; inputs brep: Mesh, layer_height: Double
# ---------- contour: Python ----------
import Rhino.Geometry as rg

mesh = brep

vertices = mesh.Vertices
pt_base = vertices[0]
pt_end = vertices[2]
print(pt_end)

pt_base = vertices[0]
pt_end = vertices[1]


start_plane = rg.Plane(pt_base, rg.Vector3d(0, 0, 1))
end_plane = rg.Plane(pt_end, rg.Vector3d(0, 0, 1))

curves =rg.Mesh.CreateContourCurves(mesh, pt_base,  pt_end, layer_height)
# ---------- end contour ----------
crv = Curve(contour.curves)

# ----
# Shading Simulation
toggle = BooleanToggle(True)
number_slider = Slider(0, range=0..360)
epw_file = FilePath("C:\Users\julia\Downloads\DEU_BY_Munich-Theresienwiese.108650_TMYx\DEU_BY_Munich-Theresienwiese.108650_TMYx.epw")
context_input = Brep([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])
number_slider_2 = Slider(0.2, range=0..1)
shading_simulation = ShadingSimulation(
    start_month=Slider(7, range=0..10),
    start_day=Slider(1, range=0..10),
    start_hour=Slider(11, range=0..100),
    end_month=Slider(8, range=0..10),
    end_day=Slider(31, range=0..100),
    end_hour=Slider(16, range=0..100),
    north=number_slider,
    geometry=geometry_input,
    epw_file=epw_file,
    context=context_input,
    grid_size=Slider(0.04, range=0..0.1),
    offset_dist=number_slider_2,
    run=toggle)  # -> hoys, location, sky_mtx, results, mesh, legend

# ----
# Create empty assembly datastructure
button_2 = Button()
assembly = Python3Script(init=button_2)  # -> out, my_assembly
# ---------- assembly: Python ----------
from climate_active_envelopes.assembly import CAEAssembly as Assembly

#create empty assembly
my_assembly = Assembly()
# ---------- end assembly ----------

show_selected_face = BooleanToggle(True)
show_until_key = BooleanToggle(True)
show_all = BooleanToggle(True)

next_edge = Button()
face_back = Button()
face_next = Button()
reset = Button()

geo = Geometry(shading_simulation.legend)

visualize = Python3Script(show=Toggle(False), mesh=shading_simulation.mesh)  # -> out, M
# ---------- visualize: Python ----------
if show == True:
    M = mesh
# ---------- end visualize ----------
mesh_2 = Mesh(visualize.M)

panel = Panel(geo)

select_face = Python3Script(cell_network=cell_network.cell_network, face_next=face_next, face_back=face_back, next_edge=next_edge, reset=reset)  # -> out, cell_network, counter
# ---------- select_face: Python ----------
from climate_active_envelopes.assembly import CAEComponent as component
from scriptcontext import sticky as st

#st["edge_key"] = edge_key
#st["face_key"] = face_key

L = range(cell_network.number_of_faces())

# store data in component
guid = str(ghenv.Component.InstanceGuid)
counter_key = "counter_" + guid
running_key = "running_" + guid
print(counter_key)

if counter_key not in st:
    st[counter_key] = 0

if face_next:
    if st[counter_key] < len(L) - 1:
        st[counter_key] += 1
    else:
        st[counter_key] = 0 

if face_back:
    if st[counter_key] < len(L) - 1:
        st[counter_key] -= 1
    else:
        st[counter_key] = 0 

if reset:
    st[counter_key] = 0
    st[running_key] = False

counter = st[counter_key]+1


selected_face, face_type = component.select_face_by_key(cell_network, counter)
#selected_edge, edge_type = component.select_edge_by_key(cell_network, edge_key)
# ---------- end select_face ----------
panel_2 = Panel(select_face.counter)

viz = Python3Script(
    cell_network=select_face.cell_network,
    show_all=show_all,
    show_selected_face=show_selected_face,
    show_until_key=show_until_key,
    counter=select_face.counter)  # -> P, L, M
# ---------- viz: Python ----------
from compas.geometry import Frame
from compas_rhino.conversions import frame_to_rhino, line_to_rhino, mesh_to_rhino
from climate_active_envelopes.assembly import CAEComponent as component
from scriptcontext import sticky as st

# Vizualize in Rhino
if show_all:

    P = []
    for vertex_key in cell_network.vertices():
        coordinates = cell_network.vertex_coordinates(vertex_key)
        #print(f"Vertex Key: {vertex_key}, Coordinates: {coordinates}")
        frames = Frame(coordinates, [1, 0, 0], [0, 1, 0])
        rhino_planes = frame_to_rhino(frames)
        P.append(rhino_planes)

    L = []
    for edge in cell_network.edges():
        line = cell_network.edge_line(edge)
        curves = line_to_rhino(line)
        L.append(curves)

    M = []
    for face in cell_network.faces():
        face_meshes = cell_network.faces_to_mesh([face])
        mesh = mesh_to_rhino(face_meshes)
        M.append(mesh)



# if show_selected_edge:
#     L = []
#     edge_key = st["edge_key"]
#     selected_edge = component.select_edge_by_key(cell_network, edge_key)[1]
#     edge_line = cell_network.edge_line(cell_network.selected_edge) 
#     print(edge_line)
#     L = line_to_rhino(edge_line)
#     #L.append(curves)

# if show_edge_faces:
#     M = []
#     edge_key = st["edge_key"]
#     component.select_adjacent_faces_by_edge(cell_network, edge_key)
#     face_meshes = cell_network.faces_to_mesh(cell_network.selected_edge_faces)
#     M = mesh_to_rhino(face_meshes)

if show_selected_face:
    M = []
    face_mesh = cell_network.faces_to_mesh([cell_network.selected_face])
    M = mesh_to_rhino(face_mesh)


if show_until_key:
    all_face_meshes = []
    for face in cell_network.faces():
        face_meshes = cell_network.faces_to_mesh([face])
        all_face_meshes.append(face_meshes)

    M = [mesh_to_rhino(face_mesh) for face_mesh in all_face_meshes[:int(counter)]]
    key = int(counter) - 1

# if highlight_current:
#     current_part = cell_network(key)
#     current_part_geometry = mesh_to_rhino(current_part.mesh)
# ---------- end viz ----------
mesh_3 = Mesh(viz.M)
points = Point(viz.P)
preview = CustomPreview(Geometry=mesh_3, Material=ColourSwatch(SwatchColor=RGB(255, 125, 157)))
preview_2 = CustomPreview(Geometry=viz.L, Material=ColourSwatch(SwatchColor=RGB(255, 125, 157)))

number_slider_3 = Slider(4, range=0..11)  # disabled
number_slider_4 = Slider(3, range=0..5)  # disabled
select = Python3Script(edge_key=number_slider_3, face_key=number_slider_4)  # -> out, cell_network; disabled
# ---------- select: Python ----------
from climate_active_envelopes.assembly import CAEComponent as component
from scriptcontext import sticky as st

st["edge_key"] = edge_key
st["face_key"] = face_key
#cell_network.selected_edge = component.select_edge_by_key(cell_network, edge_key)[0]

#cell_network.selected_face = component.select_face_by_key(cell_network, face_key)[0]


selected_edge, edge_type = component.select_edge_by_key(cell_network, edge_key)
selected_face, face_type = component.select_face_by_key(cell_network, face_key)

# if face_type == 'wall':
#     face_edges = cell_network.face_edges(selected_face)
#     column_edge = None
#     for edge in face_edges:
#         edge_vector = cell_network.edge_vector(edge)
#         if edge_vector[2] in [-1, 1]:  # Check if the edge is vertical (column)
#             column_edge = edge
#             cell_network.edge_attribute(edge, 'edge_type', 'column')
#             break  # Stop after finding the first column edge

#     if column_edge:
#         print(f"Column edge found: {column_edge}")
#     else:
#         print("No column edge found.")
# else:
#     print("Selected face is not a wall.")

    
#target_geo_feedback = ['Key {}: Distance to target geometry: {dist:.2f}m'. format(current_key, dist=distance)]
# ---------- end select ----------

list_3 = ValueList({"Single layer": "single_layer", "Double layer": "double_layer"}, selected="Double layer")

# ----
# Create brick assembly
list_4 = ValueList({"Flemish bond": "flemish_bond"}, selected="Flemish bond")
create_assembly = Python3Script(
    bond_type=list_4,
    wall_system=list_3,
    my_assembly=assembly.my_assembly,
    brick_full=part.full_brick,
    brick_insulated=part.insulated_brick,
    plane=pln,
    lines=contour.curves)  # -> out, my_assembly, total_length; inputs plane: Plane, lines: list of Line
# ---------- create_assembly: Python ----------
total_length = my_assembly.generate_wall(bond_type,
                        wall_system, 
                        brick_full, 
                        brick_insulated,
                        plane,
                        lines
                        )
# ---------- end create_assembly ----------
total_length_2 = Panel(create_assembly.total_length)

get_centroids = Python3Script(my_assembly=create_assembly.my_assembly, transform_type=list_2)  # -> out, my_assembly, keys; inputs transform_type: String
# ---------- get_centroids: Python ----------
from compas.geometry import Frame, Translation, Rotation, Transformation, Point
from compas_rhino.conversions import plane_to_compas_frame, point_to_compas

import math
import Rhino.Geometry as rg

values = []
keys = []


for key in my_assembly.graph.nodes_where({"transform_type": transform_type}):
    part = my_assembly.part(key)
    keys.append(key)

my_assembly = my_assembly
# ---------- end get_centroids ----------

# ----
# Apply Gradient
vals = Python3Script(results=shading_simulation.results)  # -> out, color_values; inputs results: list
# ---------- vals: Python ----------
from compas.itertools import normalize_values



def normalize_to_highest(values, max_value=140.0, target_min=0.0, target_max=1.0):
    """Normalizes a list of values based on the highest value in the list, 
    scaled to a specific range.

    Args:
    values: A list of numerical values.
    max_value: The expected maximum value. Defaults to 116.0.
    target_min: The minimum value of the target range. Defaults to 0.0.
    target_max: The maximum value of the target range. Defaults to 0.7.

    Returns:
    A list of normalized values.
    """
    highest_value = max(values)
    factor = highest_value / max_value  # Calculate the scaling factor
    normalized_values = normalize_values(values, target_min, target_max * factor)
    return normalized_values


color_values = normalize_to_highest(results)

#color_values = normalize_values(results, 0.0, 0.7)
print(color_values)




"""
color_points = []

for i, point in enumerate(points):
    frame = Frame([color_values[i], point[1] , point[2]], [1,0,0], [0,1,0])
    
    color_points.append(frame.point)
"""
# ---------- end vals ----------
panel_3 = Panel(vals.color_values)
apply_gradient = Python3Script(
    my_assembly=get_centroids.my_assembly,
    values=vals.color_values,
    keys=get_centroids.keys,
    transform_type=list_2,
    transform=Button())  # -> out, my_assembly; inputs values: list, keys: list
# ---------- apply_gradient: Python ----------
import math
import Rhino.Geometry as rg
from compas.geometry import Frame, Point
from compas.geometry import Transformation, Rotation, Translation


#print(my_assembly.apply_gradient(values, keys, transform_type_))


#print(my_assembly.__data__)

#transform_types = {node_id: my_assembly.graph.node_attribute(node_id, 'transform_type') for node_id in my_assembly.graph.nodes()}


if transform:
    assembly = my_assembly
    my_assembly.apply_gradient(values, keys, transform_type)

    #print(test)
# ---------- end apply_gradient ----------

select_2 = Python3Script()  # -> out, cell_network; disabled
# ---------- select_2: Python ----------
from climate_active_envelopes.assembly import CAEComponent as component
from scriptcontext import sticky as st

st["edge_key"] = edge_key

cell_network.selected_edge = component.select_edge_by_key(cell_network, edge_key)[0]

cell_network.selected_face = component.select_face_by_key(cell_network, face_key)[0]

#print(component.select_adjacent_faces_by_edge(cell_network, edge_key)[1])
#selected_edge_faces = component.select_adjacent_faces_by_edge(cell_network, edge_key)


# # select edge by key
# for key, edge in enumerate(cell_network.edges()):
#     if key == edge_key:
#         selected_edge = edge
# print(f"Selected edge for key {edge_key}: {selected_edge}")

# # Add to cell_network attributes
# cell_network.selected_edge = selected_edge



# select adjacent faces by the selected edge
#selected_edge_faces = cell_network.edge_faces(cell_network.selected_edge)
#print(f"Selected edge and adjacent faces for key {edge_key} : {selected_edge_faces}")

# Add the faces to cell_network attributes if needed
#cell_network.selected_edge_faces = selected_edge_faces



# # # select face by key
# for key, face in enumerate(cell_network.faces()):
#     if key == face_key:
#         selected_face = face
# print(f"Selected face for key {face_key}: {selected_face}")

# # Add to cell_network attributes
# cell_network.selected_face = selected_face














# all_edges = list(cell_network.edges())
# print("All edges:", all_edges)


# # Access specific edge attributes
# for edge in all_edges:
#     u, v = edge
#     print(f"Edge between {u} and {v}")
# ---------- end select_2 ----------

# ----
# Sun Path
number_slider_5 = Slider(0.3, range=0..10)
pt = Point(Point(-0.1120708673, 31.05692892, 0))
sunpath = LBSunPath(
    north=number_slider,
    location=shading_simulation.location,
    hoys=shading_simulation.hoys,
    center_pt=pt,
    scale=number_slider_5)  # -> report, vectors, altitudes, azimuths, hoys, sun_pts, analemma, daily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; plug-in component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
geo_2 = Geometry([sunpath.compass, sunpath.daily, sunpath.analemma, sunpath.legend, sunpath.title, sunpath.sun_pts])

py3 = Python3Script(cell_network=select_face.cell_network)  # -> out, a
# ---------- py3: Python ----------
from climate_active_envelopes.assembly import CAEComponent as component
from scriptcontext import sticky as st

st["counter"] = face_key
selected_face, face_type = component.select_face_by_key(cell_network, face_key)
# ---------- end py3 ----------
panel_4 = Panel(select_face.out)

# ----
# Transform
toggle_2 = BooleanToggle(False)
pln_2 = Plane(PlaneXY(2.43007085, -1.968439302, -0.2055923429))
transform = Python3Script(my_assembly=apply_gradient.my_assembly, transform=toggle_2, origin_plane=pln, new_origin_plane=pln_2)  # -> out, my_assembly
# ---------- transform: Python ----------
from compas.geometry import Frame, Transformation, Rotation, Translation
from compas_rhino.conversions import plane_to_compas_frame


new_origin_frame = plane_to_compas_frame(new_origin_plane)
origin_frame = plane_to_compas_frame(origin_plane)

if transform:
    T = Transformation.from_frame_to_frame(origin_frame, new_origin_frame)
    my_assembly = my_assembly.transformed(T)
# ---------- end transform ----------

start = Button()
stop = Button()
step = Button()
back_2 = Button()
reset_2 = Button()
full = Button()
list_5 = ValueList({"20", "50", "100", "500", "1000", "5000"}, selected="500")
counter = Python3Script(
    my_assembly=transform.my_assembly,
    start=start,
    stop=stop,
    step=step,
    step_back=back_2,
    reset=reset_2,
    full=full,
    interval=list_5)  # -> out, counter
# ---------- counter: Python ----------
from scriptcontext import sticky as st
import Grasshopper

def update_component(ghenv, delay):
    """Schedule an update of the Grasshopper component.

    After the specified delay, the GH component will be automatically updated.

    Parameters
    ----------
    ghenv : :class:`GhPython.Component.PythonEnvironment`
        The current GHPython environment.
    delay : :obj:`int`
        Time in milliseconds until the update is performed.

    Raises
    ------
    ValueError
        If the delay is less than zero.

    """
    if delay <= 0:
        raise ValueError("Delay must be greater than zero")

    ghcomp = ghenv.Component
    ghdoc = ghcomp.OnPingDocument()

    def callback(ghdoc):
        if ghdoc.SolutionState != Grasshopper.Kernel.GH_ProcessStep.Process:
            ghcomp.ExpireSolution(False)

    ghdoc.ScheduleSolution(delay, Grasshopper.Kernel.GH_Document.GH_ScheduleDelegate(callback))

L = range(my_assembly.graph.number_of_nodes())

# store data in component
guid = str(ghenv.Component.InstanceGuid)
counter_key = "counter_" + guid
running_key = "running_" + guid

if counter_key not in st:
    st[counter_key] = 0

if running_key not in st:
    st[running_key] = False
    

if st[running_key]:
    if st[counter_key] < len(L) - 1:
        st[counter_key] += 1
        update_component(ghenv, interval)
    else:
        st[counter_key] = 0
        st[running_key] = False
    
if start:
    st[running_key] = True

if stop:
    st[running_key] = False

if step:
    if st[counter_key] < len(L) - 1:
        st[counter_key] += 1

if step_back:
    if st[counter_key] < len(L) - 1:
        st[counter_key] -= 1

if reset:
    st[counter_key] = 0
    st[running_key] = False

if full:
    st[counter_key] = len(L)-1

if len(L):
    item = L[st[counter_key]]


#st["visualisation_counter"] = st[counter_key]
counter = st[counter_key]+1
# ---------- end counter ----------
panel_5 = Panel(counter.counter)

# ----
# Visualisation Dashboard
list_6 = ValueList({"show all": "show_all", "show until key": "show_until_key", "show nothing": "show_nothing"}, selected="show until key")
visualize_2 = Python3Script(my_assembly=transform.my_assembly, show=list_6, highlight_current_part=Toggle(False), counter=panel_5)  # -> out, parts_geometry, parts_frame, current_part_geometry, current_part_frame, current_part_gripping_frame
# ---------- visualize_2: Python ----------
from compas_rhino.conversions import mesh_to_rhino, box_to_rhino, frame_to_rhino

#print assembly
print(my_assembly)
#counter = int(counter)

#get parts datastructure
parts = [p for p in my_assembly.parts()]

#get current part

#if show_wall == True:

if show == "show_all":
    
#get parts datastructure
    parts = [p for p in my_assembly.parts()]
    parts_geometry = []
    parts_frame = []

    #part = parts[0]
    #print(part.gripping_frame)

    #extract the mesh of the parts for visulization (+ converted to rhino mesh)
    parts_geometry = [mesh_to_rhino(p.mesh) for p in parts]
    
    #extract the frame of the parts for visulization (+ converted to rhino plane)
    parts_frame = [frame_to_rhino(p.frame) for p in parts]
    #print(parts_geometry)

    key = my_assembly.graph.number_of_nodes()-1

if show == "show_until_key":
    #extract the mesh of the parts for visulization (+ converted to rhino mesh)
    parts_geometry = [mesh_to_rhino(p.mesh) for p in parts[0:int(counter)]]
    
    #extract the frame of the parts for visulization (+ converted to rhino plane)
    parts_frame = [frame_to_rhino(p.frame) for p in parts[0:int(counter)]]

    key = int(counter)-1

if show == "show_nothing":
    print("Nothing to see")
    pass

if highlight_current_part:
    current_part = my_assembly.part(key)
    current_part_geometry = mesh_to_rhino(current_part.mesh)
    current_part_frame = frame_to_rhino(current_part.frame)
    current_part_gripping_frame = frame_to_rhino(current_part.gripping_frame)
    
    print(current_part.__data__)
# ---------- end visualize_2 ----------
panel_6 = Panel(visualize_2.out)
geo_3 = Geometry(visualize_2.parts_geometry)
geo_4 = Geometry([visualize_2.current_part_frame, visualize_2.current_part_geometry])
geo_5 = Geometry(visualize_2.current_part_gripping_frame)
geo_6 = Geometry(visualize_2.parts_frame)
preview_3 = CustomPreview(Geometry=geo_3, Material=ColourSwatch(SwatchColor=RGB(196, 141, 141)))
preview_4 = CustomPreview(Geometry=geo_6, Material=ColourSwatch(SwatchColor=RGB(255, 125, 157)))
preview_5 = CustomPreview(Geometry=geo_4, Material=ColourSwatch(SwatchColor=RGB(255, 125, 157)))
preview_6 = CustomPreview(Geometry=geo_5, Material=ColourSwatch(SwatchColor=RGB(255, 125, 157)))
draw_2 = Python3Script(planes=geo_5, scale=Slider(0.2, range=0..1))  # -> out, P, V, C, W; inputs planes: list of Plane
# ---------- draw_2: Python ----------
from System.Drawing import Color

red = Color.FromArgb(255, 0, 0)
green = Color.FromArgb(0, 255, 0)
blue = Color.FromArgb(0, 0, 255)

P = []
V = []
C = []

scale = float(scale)

for plane in planes:
    if not plane:
        continue
    P += [plane.Origin] * 3
    V.append(plane.XAxis * scale)
    V.append(plane.YAxis * scale)
    V.append(plane.ZAxis * scale)
    C += [red, green, blue]

W = 3
# ---------- end draw_2 ----------
vdisex = VectorDisplayEx(Point=draw_2.P, Vector=draw_2.V, Colour=draw_2.C, Width=draw_2.W)

# ----
# Radiation Simulation
toggle_3 = BooleanToggle(False)
radiation_simulation = RadiationSimulation(
    sky_mtx=shading_simulation.sky_mtx,
    geometry=visualize_2.parts_geometry,
    context=context_input,
    offset_dist=number_slider_2,
    run=toggle_3)  # -> mesh, legend
geo_7 = Geometry(radiation_simulation.legend)
brick_wall = Mesh(radiation_simulation.mesh)

# ----
# Export to JSON
path = Python3Script()  # -> HERE, DATA, ASSEMBLY
# ---------- path: Python ----------
import os

HERE = os.path.dirname(ghdoc.Path)
DATA = os.path.abspath(os.path.join(HERE, "..", "data"))
ASSEMBLY = os.path.abspath(os.path.join(DATA, "assembly"))

print(HERE)
print(DATA)
print(ASSEMBLY)
# ---------- end path ----------
export = Button()
export_2 = Python3Script(ASSEMBLY=path.ASSEMBLY, my_assembly=transform.my_assembly, export=export)  # -> out; inputs ASSEMBLY: String
# ---------- export_2: Python ----------
import os

#print(my_assembly.__data__)
if export:
    #print(DATA)
    filename = "brickwall_2x2_full_and_insulated.json"
    PATH = os.path.join(ASSEMBLY, filename)

    # the assembly has to be serialized such that it can be called from CPython
    my_assembly.to_json(PATH)
# ---------- end export_2 ----------

number_slider_6 = Slider(3, range=0.4..10)  # disabled
number_slider_7 = Slider(1.2, range=0.3..10)  # disabled
py3_2 = Python3Script(wall_length=number_slider_6, wall_height=number_slider_7)  # -> out, M; inputs wall_length: Double, wall_height: Double; disabled
# ---------- py3_2: Python ----------
from compas.datastructures import Mesh
from compas.geometry import Curve, Point, Frame
from compas_rhino.conversions import frame_to_rhino, mesh_to_rhino
import math as m
import Rhino.Geometry as rg


mesh_wall = Mesh()

mesh_grid = []

length, width, height, mortar = 0.245, 0.12, 0.075, 0.11

step_in_z = height + mortar/2
step_in_x = (length+width)/2 + mortar
vertices_per_row = int(wall_length / step_in_x)
row = int(wall_height / step_in_z)


total_length = (vertices_per_row - 1) * (step_in_x)


#create vertices
for j in range(row): 
    z = j * step_in_z
    for i in range(vertices_per_row): 
        y = 0
        x = i * step_in_x
        mesh_wall.add_vertex(x = x, y = y, z = z) 

#create faces
for j in range(row -1):
    planes_per_row = []
    for i in range(vertices_per_row - 1):
        a = i + j * vertices_per_row
        b = a + vertices_per_row
        c = b + 1
        d = a + 1

#create planes at faces_centroid
        vertex_centroid = mesh_wall.face_centroid(mesh_wall.add_face([a, b, c, d]))
        vertex_pts = Point(vertex_centroid[0], vertex_centroid[1], vertex_centroid[2])
        vertex_frame = Frame([vertex_pts[0], vertex_pts[1], vertex_pts[2]], [1,0,0], [0,1,0])
        vertex_plane = frame_to_rhino(vertex_frame)
        planes_per_row.append(vertex_plane)
    mesh_grid.append(planes_per_row)

face_cplanes = [plane for planes_row in mesh_grid for plane in planes_row]

M = mesh_to_rhino(mesh_wall)
# ---------- end py3_2 ----------

# ==== cluster ShadingSimulation
epw_file = ClusterInput()
start_month = ClusterInput()
start_day = ClusterInput()
start_hour = ClusterInput()
end_month = ClusterInput()
end_day = ClusterInput()
end_hour = ClusterInput()
importepw = LBImportEPW(epw_file=epw_file)  # -> location, dry_bulb_temperature, dew_point_temperature, relative_humidity, wind_speed, wind_direction, direct_normal_rad, diffuse_horizontal_rad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; plug-in component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
analysisperiod = LBAnalysisPeriod(
    start_month=start_month,
    start_day=start_day,
    start_hour=start_hour,
    end_month=end_month,
    end_day=end_day,
    end_hour=end_hour)  # -> period, hoys, dates; plug-in component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
north = ClusterInput()
hoys = ClusterOutput(analysisperiod.hoys)
skymatrix = LBCumulativeSkyMatrix(
    north=north,
    location=importepw.location,
    direct_rad=importepw.direct_normal_rad,
    diffuse_rad=importepw.diffuse_horizontal_rad,
    hoys=analysisperiod.hoys)  # -> report, sky_mtx; plug-in component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
location = ClusterOutput(importepw.location)
sky_mtx = ClusterOutput(skymatrix.sky_mtx)
colrange = LBColorRange(index=Slider(5, range=0..100))  # -> colors; plug-in component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
geometry = ClusterInput()
context = ClusterInput()
grid_size = ClusterInput()
offset_dist = ClusterInput()
run = ClusterInput()
legendpar = LBLegendParameters(colors=colrange)  # -> leg_par; plug-in component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
incidentradiation = LBIncidentRadiation(
    sky_mtx=skymatrix.sky_mtx,
    geometry=flatten(geometry),
    context=flatten(context),
    grid_size=grid_size,
    offset_dist=offset_dist,
    legend_par=legendpar,
    run=run)  # -> report, points, results, total, mesh, legend, title, int_mtx; plug-in component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
results = ClusterOutput(incidentradiation.results)
mesh = ClusterOutput(incidentradiation.mesh)
legend = ClusterOutput(incidentradiation.legend)

# ==== cluster RadiationSimulation
colrange = LBColorRange(index=Slider(0, range=0..100))  # -> colors; plug-in component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
sky_mtx = ClusterInput()
geometry = ClusterInput()
context = ClusterInput()
offset_dist = ClusterInput()
run = ClusterInput()
legendpar = LBLegendParameters(colors=colrange)  # -> leg_par; plug-in component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
incidentradiation = LBIncidentRadiation(
    sky_mtx=sky_mtx,
    geometry=flatten(geometry),
    context=flatten(context),
    grid_size=Slider(1, range=0..1),
    offset_dist=offset_dist,
    legend_par=legendpar,
    run=run)  # -> report, points, results, total, mesh, legend, title, int_mtx; plug-in component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
legend = ClusterOutput(incidentradiation.legend)
mesh = ClusterOutput(incidentradiation.mesh)
