# Grasshopper definition assembly_design_JF.ghx (Grasshopper 1.0.8)
# plug-ins: RhinoCodePluginGH

# ----
# Part definition
part = Python3Script()  # -> out, full_brick, insulated_brick
# ---------- part: Python ----------
import os
from compas.geometry import Frame
from compas.geometry import Box
from climate_active_envelopes.assembly import CAEPart as Part
from compas.datastructures import Mesh

#full_brick
length, width, height = 0.24, 0.115, 0.075
full_brick = Part.from_dimensions(length=length, width=width, height=height)
print(full_brick.__data__)

#insulated_brick_placeholder
# length, width, height = 0.26, 0.12, 0.075
# insulated_brick = Part.from_dimensions(length=length, width=width, height=height)
# print(insulated_brick.__data__)



#insulated_brick
package_path = ghdoc.Path
data_path = os.path.abspath(os.path.join(package_path,"../../../climate_active_envelopes/data/brick_types"))
filename = 'insulated_brick_reduced.stl'

insulated_brick_mesh = Mesh.from_stl(os.path.join(data_path, filename))
insulated_brick = Part.from_mesh_and_frame(insulated_brick_mesh)
print(insulated_brick.__data__)
# ---------- end part ----------
list = ValueList({"none", "full", "insulated"}, selected="full")
draw = Python3Script(full_brick=part.full_brick, insulated_brick=part.insulated_brick, show=list)  # -> M, P
# ---------- draw: Python ----------
from compas_rhino.conversions import mesh_to_rhino, box_to_rhino, frame_to_rhino
from climate_active_envelopes.assembly import CAEPart as Part
from compas.geometry import Frame
from compas.geometry import Vector
from compas.geometry import Box


if show=="full":

    #extract the mesh of the part for visulization
    compas_mesh_full = full_brick.mesh

    #convert to rhino mesh
    M = mesh_to_rhino(compas_mesh_full)

    #extract and convert to rhino plane
    P = frame_to_rhino(full_brick.frame)
    #brick_full.gripping_frame = full_brick.frame
    #print(full_brick.__data__)
    print(type(full_brick))

    
elif show == "insulated":
    
    #extract the mesh of the part for visulization
    compas_mesh_insulated = insulated_brick.mesh

    #convert to rhino mesh
    M = mesh_to_rhino(compas_mesh_insulated)
    
    #extract and convert to rhino plane
    P = frame_to_rhino(insulated_brick.frame)

else:
    pass
# ---------- end draw ----------
mesh = Mesh(draw.M)
pln = Plane(draw.P)

# ----
# Create empty
# assembly datastructure
button = Button()
assembly = Python3Script(init=button)  # -> my_assembly
# ---------- assembly: Python ----------
from climate_active_envelopes.assembly import CAEAssembly as Assembly

#create empty assembly
my_assembly = Assembly()
# ---------- end assembly ----------

# ----
# Reference Model
x = Slider(1, range=0.4..10)
y = Slider(1, range=0.2..10)
z = Slider(1, range=0.2..10)
box = Python3Script(length=x, height=y, width=z)  # -> out, box; inputs length: Double, height: Double, width: Double
# ---------- box: Python ----------
from compas.geometry import Box

box = Box(length, height, width)
# ---------- end box ----------
key = Slider(1, range=0..5)
cellnetwork = Python3Script(box=box.box)  # -> out, cellnetwork
# ---------- cellnetwork: Python ----------
from compas.datastructures import CellNetwork, Mesh
from compas.geometry import Box

cellnetwork = CellNetwork()

vertices = box.vertices
[cellnetwork.add_vertex(x=x, y=y, z=z) for x, y, z in vertices]

faces = box.faces
fkeys = [cellnetwork.add_face(fverts) for fverts in faces]

cells = [fkeys]
[cellnetwork.add_cell(fkeys) for fkeys in cells]
# ---------- end cellnetwork ----------
select_face = Python3Script(cellnetwork=cellnetwork.cellnetwork, key=key, generate_key_surface=Toggle(False))  # -> out, polygon, draw_key_face
# ---------- select_face: Python ----------
from compas.datastructures import Mesh
from compas_rhino.conversions import mesh_to_rhino, curve_to_rhino

# Get key face
key_face = Mesh()
polygon = cellnetwork.face_polygon(key)
draw_key_face = mesh_to_rhino(polygon.to_mesh())



for edge in list(cellnetwork.edges()):
    if cellnetwork.vertex_coordinates(edge[0])[2] != cellnetwork.vertex_coordinates(edge[1])[2]:
        cellnetwork.edge_attribute(edge, 'is_vertical', True)
    else:
        cellnetwork.edge_attribute(edge, 'is_horizontal', True)

edges = cellnetwork.edges(True)

print(list(cellnetwork.edges(True)))
#print(list(cellnetwork.edges_where({'is_vertical': False})))

vertical_edges = [edge for edge in cellnetwork.edges() if cellnetwork.edge_attribute(edge, 'is_vertical')]
#print(vertical_edges)

#vertical_edges
# ---------- end select_face ----------
mesh_2 = Mesh(select_face.draw_key_face)

# ----
# Unload Python modules
button_2 = Button()
unload = Python3Script(unload=button_2)  # -> out, a
# ---------- unload: Python ----------
from compas_rhino import unload_modules

unload_modules('climate_active_envelopes.assembly')
unload_modules('climate_active_envelopes.part')
# ---------- end unload ----------

contour = Python3Script(polygon=select_face.polygon, interval="0.08")  # -> out, curves; inputs interval: Double
# ---------- contour: Python ----------
from compas_rhino.conversions import point_to_rhino, mesh_to_rhino
import Rhino.Geometry as rg

pt_base = point_to_rhino(polygon.points[1])
print(pt_base)
pt_end = point_to_rhino(polygon.points[2])
print(pt_end)

mesh = mesh_to_rhino(polygon.to_mesh())

curves =rg.Mesh.CreateContourCurves(mesh, pt_base,  pt_end, interval)
# ---------- end contour ----------

list_2 = ValueList({"flemish_bond": 0, "other_bond": 1, "other_bond_archive": 2}, selected="other_bond")
crv = Curve(contour.curves)
add_parts = Python3Script(
    bond=list_2,
    my_assembly=assembly,
    brick_full=part.full_brick,
    brick_insulated=part.insulated_brick,
    plane=pln,
    lines=contour.curves)  # -> out, my_assembly, total_length; inputs plane: Plane, lines: list of Line
# ---------- add_parts: Python ----------
import math
import Rhino.Geometry as rg
from compas.geometry import Frame, Point, Vector
from compas.geometry import Transformation, Rotation, Translation
import compas.geometry as cg
from compas_rhino.conversions import plane_to_compas_frame, point_to_compas

total_length = my_assembly.generate_wall(bond,
                        brick_full, 
                        brick_insulated,
                        plane,
                        lines
                        )
# ---------- end add_parts ----------

# ----
# Image sampler - Gradient mapping
get_centroids = Python3Script(my_assembly=add_parts.my_assembly)  # -> out, my_assembly, values, keys, z_values, x_values, y_values
# ---------- get_centroids: Python ----------
from compas.geometry import Frame, Translation, Rotation, Transformation, Point
from compas_rhino.conversions import plane_to_compas_frame, point_to_compas

import math
import Rhino.Geometry as rg



values = []
keys = []
z_values = []
x_values = []
y_values = []

for key in my_assembly.graph.nodes_where({"fixed": False}):
    part = my_assembly.part(key)
    print(type(part))
    compas_point = part.frame.point
    rhino_point = rg.Point3d(compas_point.x, compas_point.y, compas_point.z)
    values.append(rhino_point)
    x_values.append(rhino_point.X)
    z_values.append(rhino_point.Z)
    y_values.append(rhino_point.Y)
    keys.append(key)

my_assembly = my_assembly
# ---------- end get_centroids ----------
zs = Bounds(Numbers=get_centroids.z_values)
xs = Bounds(Numbers=get_centroids.x_values)
rnz = RemapNumbers(Value=get_centroids.z_values, Source=zs, Target=Domain(0, 1))  # -> Mapped, Clipped
rnx = RemapNumbers(Value=get_centroids.x_values, Source=xs, Target=Domain(0, 1))  # -> Mapped, Clipped
cp = ConstructPoint(XCoordinate=rnx.Mapped, YCoordinate=rnz.Mapped, ZCoordinate=get_centroids.y_values)
image_sampler = ImageSampler(cp, Filter="Value", Interpolate=False, Umax=1, Umin=0, Vmax=1, Vmin=0, Wrap=0)

pln_2 = Plane(pln)
total_length = Panel(add_parts.total_length)

# ----
# Visualise Image Sampler
bounds = Bounds(Numbers=image_sampler)
dd = DeconstructDomain(Domain=bounds)  # -> Start, End
gradient = Gradient(LowerLimit=dd.Start, UpperLimit=dd.End, Parameter=image_sampler, stops=[0.328: RGB(0, 0, 0), 1: RGB(255, 255, 255)])
custom_preview = CustomPreview(Geometry=get_centroids.values, Material=gradient)

start = Button()
stop = Button()
step = Button()
back = Button()
reset = Button()
full = Button()
list_3 = ValueList({"20", "50", "100", "500", "1000", "5000"}, selected="500")
counter = Python3Script(
    my_assembly=add_parts.my_assembly,
    start=start,
    stop=stop,
    step=step,
    step_back=back,
    reset=reset,
    full=full,
    interval=list_3)  # -> out, counter
# ---------- counter: Python ----------
from scriptcontext import sticky as st
import Grasshopper

def update_component(ghenv, delay):
    """Schedule an update of the Grasshopper component.

    After the specified delay, the GH component will be automatically updated.

    Parameters
    ----------
    ghenv : :class:`GhPython.Component.PythonEnvironment`
        The current GHPython environment.
    delay : :obj:`int`
        Time in milliseconds until the update is performed.

    Raises
    ------
    ValueError
        If the delay is less than zero.

    """
    if delay <= 0:
        raise ValueError("Delay must be greater than zero")

    ghcomp = ghenv.Component
    ghdoc = ghcomp.OnPingDocument()

    def callback(ghdoc):
        if ghdoc.SolutionState != Grasshopper.Kernel.GH_ProcessStep.Process:
            ghcomp.ExpireSolution(False)

    ghdoc.ScheduleSolution(delay, Grasshopper.Kernel.GH_Document.GH_ScheduleDelegate(callback))

L = range(my_assembly.graph.number_of_nodes())

# store data in component
guid = str(ghenv.Component.InstanceGuid)
counter_key = "counter_" + guid
running_key = "running_" + guid

if counter_key not in st:
    st[counter_key] = 0

if running_key not in st:
    st[running_key] = False
    

if st[running_key]:
    if st[counter_key] < len(L) - 1:
        st[counter_key] += 1
        update_component(ghenv, interval)
    else:
        st[counter_key] = 0
        st[running_key] = False
    
if start:
    st[running_key] = True

if stop:
    st[running_key] = False

if step:
    if st[counter_key] < len(L) - 1:
        st[counter_key] += 1

if step_back:
    if st[counter_key] < len(L) - 1:
        st[counter_key] -= 1

if reset:
    st[counter_key] = 0
    st[running_key] = False

if full:
    st[counter_key] = len(L)-1

if len(L):
    item = L[st[counter_key]]


#st["visualisation_counter"] = st[counter_key]
counter = st[counter_key]+1
# ---------- end counter ----------
panel = Panel(counter.counter)

python_3_script = Python3Script(mesh=mesh_2)  # -> brep; inputs mesh: Mesh
# ---------- python_3_script: Python ----------
from Rhino.Geometry import Brep

brep = Brep.CreateFromMesh(mesh, True)
# ---------- end python_3_script ----------
path = FilePath("C:\Users\julia\Downloads\DEU_BY_Munich-Theresienwiese.108650_TMYx\DEU_BY_Munich-Theresienwiese.108650_TMYx.epw")
context = Brep(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)
cluster = Cluster(
    start_month=Slider(3, range=0..10),
    start_day=Slider(1, range=0..10),
    start_hour=Slider(11, range=0..100),
    end_month=Slider(8, range=0..10),
    end_day=Slider(31, range=0..100),
    end_hour=Slider(16, range=0..100),
    north="0",
    geometry=python_3_script,
    epw_file=path,
    context=context,
    grid_size=Slider(0.2, range=0..1),
    offset_dist=Slider(0.2, range=0..1),
    run=Toggle(True))  # -> results, mesh
mesh_3 = Mesh(cluster.mesh)
vals = Python3Script(results=cluster.results)  # -> out, color_values; inputs results: list
# ---------- vals: Python ----------
from compas.itertools import normalize_values

color_values = normalize_values(results, 0.0, 0.7)
print(color_values)




"""
color_points = []

for i, point in enumerate(points):
    frame = Frame([color_values[i], point[1] , point[2]], [1,0,0], [0,1,0])
    
    color_points.append(frame.point)
"""
# ---------- end vals ----------

# ----
# Apply Gradient
toggle = BooleanToggle(False)
apply_gradient = Python3Script(my_assembly=get_centroids.my_assembly, transform=toggle, values=vals.color_values, keys=get_centroids.keys)  # -> out, my_assembly; inputs values: list, keys: list
# ---------- apply_gradient: Python ----------
import math
import Rhino.Geometry as rg
from compas.geometry import Frame, Point
from compas.geometry import Transformation, Rotation, Translation

if transform:
    assembly = my_assembly
    my_assembly.apply_gradient(transform, values, keys)
# ---------- end apply_gradient ----------

# ----
# Transform
toggle_2 = BooleanToggle(False)
pln_3 = Plane(pln_2)
transform = Python3Script(my_assembly=apply_gradient.my_assembly, transform=toggle_2, origin_plane=pln_2, new_origin_plane=pln_3)  # -> out, my_assembly
# ---------- transform: Python ----------
from compas.geometry import Frame, Transformation, Rotation, Translation
from compas_rhino.conversions import plane_to_compas_frame


new_origin_frame = plane_to_compas_frame(new_origin_plane)
origin_frame = plane_to_compas_frame(origin_plane)

if transform:
    T = Transformation.from_frame_to_frame(origin_frame, new_origin_frame)
    my_assembly = my_assembly.transformed(T)
# ---------- end transform ----------

# ----
# Export to JSON
path_2 = Python3Script()  # -> HERE, DATA, ASSEMBLY
# ---------- path_2: Python ----------
import os

HERE = os.path.dirname(ghdoc.Path)
DATA = os.path.abspath(os.path.join(HERE, "..", "data"))
ASSEMBLY = os.path.abspath(os.path.join(DATA, "assembly"))

print(HERE)
print(DATA)
print(ASSEMBLY)
# ---------- end path_2 ----------
export = Button()
export_2 = Python3Script(ASSEMBLY=path_2.ASSEMBLY, my_assembly=transform.my_assembly, export=export)  # -> out; inputs ASSEMBLY: String
# ---------- export_2: Python ----------
import os

#print(my_assembly.__data__)
if export:
    #print(DATA)
    filename = "brickwall_2x2_full_and_insulated.json"
    PATH = os.path.join(ASSEMBLY, filename)

    # the assembly has to be serialized such that it can be called from CPython
    my_assembly.to_json(PATH)
# ---------- end export_2 ----------

panel_2 = Panel(vals.color_values)

# ----
# Visualisation Dashboard
list_4 = ValueList({"show all": "show_all", "show until key": "show_until_key"}, selected="show all")
visualize = Python3Script(my_assembly=add_parts.my_assembly, show=list_4, highlight_current_part=Toggle(False), counter=panel)  # -> out, parts_geometry, parts_frame, current_part_geometry, current_part_frame, current_part_gripping_frame
# ---------- visualize: Python ----------
from compas_rhino.conversions import mesh_to_rhino, box_to_rhino, frame_to_rhino

#print assembly
print(my_assembly)
#counter = int(counter)

#get parts datastructure
parts = [p for p in my_assembly.parts()]

#get current part



if show == "show_all":
    
#get parts datastructure
    parts = [p for p in my_assembly.parts()]
    parts_geometry = []
    parts_frame = []

    #part = parts[0]
    #print(part.gripping_frame)

    #extract the mesh of the parts for visulization (+ converted to rhino mesh)
    parts_geometry = [mesh_to_rhino(p.mesh) for p in parts]
    
    #extract the frame of the parts for visulization (+ converted to rhino plane)
    parts_frame = [frame_to_rhino(p.frame) for p in parts]
    #print(parts_geometry)

    key = my_assembly.graph.number_of_nodes()-1

if show == "show_until_key":
    #extract the mesh of the parts for visulization (+ converted to rhino mesh)
    parts_geometry = [mesh_to_rhino(p.mesh) for p in parts[0:int(counter)]]
    
    #extract the frame of the parts for visulization (+ converted to rhino plane)
    parts_frame = [frame_to_rhino(p.frame) for p in parts[0:int(counter)]]

    key = int(counter)-1

if highlight_current_part:
    current_part = my_assembly.part(key)
    current_part_geometry = mesh_to_rhino(current_part.mesh)
    current_part_frame = frame_to_rhino(current_part.frame)
    current_part_gripping_frame = frame_to_rhino(current_part.gripping_frame)
    
    print(current_part.__data__)
# ---------- end visualize ----------
panel_3 = Panel(visualize.out)

geo = Geometry(visualize.parts_geometry)
geo_2 = Geometry(visualize.parts_frame)
geo_3 = Geometry([visualize.current_part_frame, visualize.current_part_geometry])
geo_4 = Geometry(visualize.current_part_gripping_frame)
preview = CustomPreview(Geometry=geo, Material=ColourSwatch(SwatchColor=RGB(196, 141, 141)))
preview_2 = CustomPreview(Geometry=geo_2, Material=ColourSwatch(SwatchColor=RGB(255, 125, 157)))
preview_3 = CustomPreview(Geometry=geo_3, Material=ColourSwatch(SwatchColor=RGB(255, 125, 157)))
preview_4 = CustomPreview(Geometry=geo_4, Material=ColourSwatch(SwatchColor=RGB(255, 125, 157)))

draw_2 = Python3Script(planes=geo_4, scale=Slider(0.2, range=0..1))  # -> out, P, V, C, W; inputs planes: list of Plane
# ---------- draw_2: Python ----------
from System.Drawing import Color

red = Color.FromArgb(255, 0, 0)
green = Color.FromArgb(0, 255, 0)
blue = Color.FromArgb(0, 0, 255)

P = []
V = []
C = []

scale = float(scale)

for plane in planes:
    if not plane:
        continue
    P += [plane.Origin] * 3
    V.append(plane.XAxis * scale)
    V.append(plane.YAxis * scale)
    V.append(plane.ZAxis * scale)
    C += [red, green, blue]

W = 3
# ---------- end draw_2 ----------
vdisex = VectorDisplayEx(Point=draw_2.P, Vector=draw_2.V, Colour=draw_2.C, Width=draw_2.W)

# ==== cluster Cluster
epw_file = ClusterInput()
start_month = ClusterInput()
start_day = ClusterInput()
start_hour = ClusterInput()
end_month = ClusterInput()
end_day = ClusterInput()
end_hour = ClusterInput()
importepw = LBImportEPW(epw_file=epw_file)  # -> location, dry_bulb_temperature, dew_point_temperature, relative_humidity, wind_speed, wind_direction, direct_normal_rad, diffuse_horizontal_rad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; plug-in component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
analysisperiod = LBAnalysisPeriod(
    start_month=start_month,
    start_day=start_day,
    start_hour=start_hour,
    end_month=end_month,
    end_day=end_day,
    end_hour=end_hour)  # -> period, hoys, dates; plug-in component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
north = ClusterInput()
skymatrix = LBCumulativeSkyMatrix(
    north=north,
    location=importepw.location,
    direct_rad=importepw.direct_normal_rad,
    diffuse_rad=importepw.diffuse_horizontal_rad,
    hoys=analysisperiod.hoys)  # -> report, sky_mtx; plug-in component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
colrange = LBColorRange(index=Slider(22, range=0..100))  # -> colors; plug-in component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
geometry = ClusterInput()
context = ClusterInput()
grid_size = ClusterInput()
offset_dist = ClusterInput()
run = ClusterInput()
legendpar = LBLegendParameters(colors=colrange)  # -> leg_par; plug-in component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
incidentradiation = LBIncidentRadiation(
    sky_mtx=skymatrix.sky_mtx,
    geometry=flatten(geometry),
    context=flatten(context),
    grid_size=grid_size,
    offset_dist=offset_dist,
    legend_par=legendpar,
    run=run)  # -> report, points, results, total, mesh, legend, title, int_mtx; plug-in component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
results = ClusterOutput(incidentradiation.results)
mesh = ClusterOutput(incidentradiation.mesh)
