# Grasshopper definition climate simulation.ghx (Grasshopper 1.0.8)
# plug-ins: RhinoCodePluginGH

brep = Brep(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)
path = FilePath("C:\Users\julia\Downloads\DEU_BY_Munich-Theresienwiese.108650_TMYx\DEU_BY_Munich-Theresienwiese.108650_TMYx.epw")
context = Brep(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)
cluster = Cluster(
    start_month=Slider(3, range=0..10),
    start_day=Slider(1, range=0..10),
    start_hour=Slider(11, range=0..100),
    end_month=Slider(8, range=0..10),
    end_day=Slider(31, range=0..100),
    end_hour=Slider(16, range=0..100),
    north="0",
    geometry=brep,
    epw_file=path,
    context=context,
    grid_size=Slider(0.2, range=0..1),
    offset_dist=Slider(0.2, range=0..1),
    run=Toggle(True))  # -> results, mesh
vals = Python3Script(results=cluster.results)  # -> out, color_values; inputs results: list
# ---------- vals: Python ----------
from compas.itertools import normalize_values

color_values = normalize_values(results, 0.0, 0.05)
print(color_values)




"""
color_points = []

for i, point in enumerate(points):
    frame = Frame([color_values[i], point[1] , point[2]], [1,0,0], [0,1,0])
    
    color_points.append(frame.point)
"""
# ---------- end vals ----------
mesh = Mesh(cluster.mesh)
panel = Panel(vals.color_values)

# ==== cluster Cluster
start_month = ClusterInput()
start_day = ClusterInput()
start_hour = ClusterInput()
end_month = ClusterInput()
end_day = ClusterInput()
end_hour = ClusterInput()
epw_file = ClusterInput()
north = ClusterInput()
geometry = ClusterInput()
context = ClusterInput()
grid_size = ClusterInput()
offset_dist = ClusterInput()
run = ClusterInput()
importepw = LBImportEPW(epw_file=epw_file)  # -> location, dry_bulb_temperature, dew_point_temperature, relative_humidity, wind_speed, wind_direction, direct_normal_rad, diffuse_horizontal_rad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; plug-in component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
analysisperiod = LBAnalysisPeriod(
    start_month=start_month,
    start_day=start_day,
    start_hour=start_hour,
    end_month=end_month,
    end_day=end_day,
    end_hour=end_hour)  # -> period, hoys, dates; plug-in component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
skymatrix = LBCumulativeSkyMatrix(
    north=north,
    location=importepw.location,
    direct_rad=importepw.direct_normal_rad,
    diffuse_rad=importepw.diffuse_horizontal_rad,
    hoys=analysisperiod.hoys)  # -> report, sky_mtx; plug-in component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
colrange = LBColorRange(index=Slider(22, range=0..100))  # -> colors; plug-in component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
legendpar = LBLegendParameters(colors=colrange)  # -> leg_par; plug-in component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
incidentradiation = LBIncidentRadiation(
    sky_mtx=skymatrix.sky_mtx,
    geometry=flatten(geometry),
    context=flatten(context),
    grid_size=grid_size,
    offset_dist=offset_dist,
    legend_par=legendpar,
    run=run)  # -> report, points, results, total, mesh, legend, title, int_mtx; plug-in component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
results = ClusterOutput(incidentradiation.results)
mesh = ClusterOutput(incidentradiation.mesh)
