# Grasshopper definition 231213_CAE_reference_model.ghx (Grasshopper 1.0.7)

panel = Panel("Reload libraries")
bang = Button()
unload = PythonScript(reload=bang)
# ---------- unload: Python ----------
from compas_ghpython import unload_modules

if reload:
    unload_modules('climate_active_envelopes')
# ---------- end unload ----------

init = Button()
width = Slider(0.62, range=0.2..10)
width_2 = Slider(0.62, range=0.2..10)
width_3 = Slider(0.62, range=0.2..10)
init_2 = Button()
init_3 = Button()
py = PythonScript()  # -> HERE, DATA
# ---------- py: Python ----------
import os

HERE = os.path.dirname(ghdoc.Path)
DATA = os.path.abspath(os.path.join(HERE, "..", "data"))

print(HERE)
print(DATA)
# ---------- end py ----------
pln = Plane(PlaneXY(0, 0, 0))
brep = Brep(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)

# ---- group: front_element
reference_element = GhPythonScript(
    init=init,
    plane=pln,
    rh_mesh=brep,
    length=Slider(1, range=0.4..10),
    height=Slider(0.3, range=0.2..10),
    bond_type="flemish_bond")  # -> front_element, M; inputs rh_mesh: Brep
# ---------- reference_element: Python ----------
from climate_active_envelopes.assembly import ReferenceElement 
from climate_active_envelopes.assembly import ReferenceModel
from compas.artists import Artist
from compas.geometry import Frame
#from compas_rhino.geometry import RhinoBrep
#from compas_rhino.geometry import RhinoMesh
from compas.datastructures import Mesh
from compas.datastructures import Network
from compas_ghpython.artists import NetworkArtist


#frame = Frame(plane.Origin, plane.XAxis, plane.YAxis)
#
#mesh = RhinoBrep(rh_mesh)
#
#front_element = ReferenceElement.from_parameters_2(frame, mesh, length, height, bond_type)
#
#M = Artist(front_element.brep).draw()
# ---------- end reference_element ----------

# ----
pln_2 = Plane(Plane(origin=(3, 0, 0), x=(0, 1, 0), y=(-1, 0, 0)))
pln_3 = Plane(PlaneXY(0, 0, 0))
reference_element_2 = GhPythonScript(
    init=init_2,
    length=Slider(0.9, range=0.4..10),
    height=Slider(0.87, range=0.2..10),
    width=width,
    bond_type="flemish_bond")  # -> front_element, M, M1, M2
# ---------- reference_element_2: Python ----------
from climate_active_envelopes.assembly import ReferenceElement 
from compas.datastructures import VolMesh, CellNetwork, Mesh
from compas.geometry import Box, Frame
from compas.artists import MeshArtist, Artist


box = Box(length, height, width)

frame = Frame.worldXY()
wall = ReferenceElement.from_dimensions(frame, length, height, bond_type)


cellnetwork = CellNetwork()

for vertex in box.vertices:
    print vertex
    key = cellnetwork.add_vertex(x=vertex[0], y=vertex[1], z=vertex[2])

face_keys = []
for face in box.faces:
    print face
    key = cellnetwork.add_face(face)
    face_keys.append(key)


#cellnetwork.add_cell(face_keys)


#print cellnetwork

#Convert CellNetwork to Mesh
mesh = Mesh()

for key, attr in cellnetwork.vertices(True):
    mesh.add_vertex(key=key, attr_dict = attr)
    
for facekey, attr in cellnetwork.faces(True):
    vertices = cellnetwork.face_vertices(facekey)
    mesh.add_face(vertices, facekey = facekey, attr_dict=attr)

M = MeshArtist(mesh).draw_edges()
M1 = MeshArtist(mesh).draw_vertices()
M2 = MeshArtist(mesh).draw_faces()
# ---------- end reference_element_2 ----------
reference_element_3 = GhPythonScript(
    init=init_3,
    plane=pln_2,
    length=Slider(3, range=0.4..10),
    height=Slider(2.5, range=0.2..10),
    width=width_2,
    bond_type="flemish_bond")  # -> right_element; inputs plane: Plane
# ---------- reference_element_3: Python ----------
from climate_active_envelopes.assembly import ReferenceElement 
from compas.datastructures import VolMesh, CellNetwork, Mesh
from compas.geometry import Box, Frame
from compas.artists import MeshArtist, Artist

frame = Frame(plane.Origin, plane.XAxis, plane.YAxis)
right_element = ReferenceElement.from_dimensions(frame, length, height, bond_type)






#cellnetwork = CellNetwork()
#
#for vertex in element.vertices:
#    key = cellnetwork.add_vertex(x=vertex[0], y=vertex[1], z=vertex[2])

#box = Box(length, height, width)
#
#cellnetwork = CellNetwork()
#
#for vertex in box.vertices:
#    key = cellnetwork.add_vertex(x=vertex[0], y=vertex[1], z=vertex[2])
#
#face_keys = []
#for face in box.faces:
#    key = cellnetwork.add_face(face)
#    face_keys.append(key)
#
#
#cellnetwork.add_cell(face_keys)
#
#
##print cellnetwork
#
## Convert CellNetwork to Mesh
#mesh = Mesh()
#
#for key, attr in cellnetwork.vertices(True):
#    mesh.add_vertex(key=key, attr_dict = attr)
#    
#for facekey, attr in cellnetwork.faces(True):
#    vertices = cellnetwork.face_vertices(facekey)
#    mesh.add_face(vertices, facekey = facekey, attr_dict=attr)
#
#M = MeshArtist(mesh).draw_edges()
#M1 = MeshArtist(mesh).draw_vertices()
#M2 = MeshArtist(mesh).draw_faces()
# ---------- end reference_element_3 ----------
reference_element_4 = GhPythonScript(
    init=init_3,
    plane=pln_3,
    length=Slider(3, range=0.4..10),
    height=Slider(2.5, range=0.2..10),
    width=width_3,
    bond_type="flemish_bond")  # -> front_element; inputs plane: Plane
# ---------- reference_element_4: Python ----------
from climate_active_envelopes.assembly import ReferenceElement 
from compas.datastructures import VolMesh, CellNetwork, Mesh
from compas.geometry import Box, Frame
from compas.artists import MeshArtist, Artist

cellnetwork = CellNetwork()
frame = Frame(plane.Origin, plane.XAxis, plane.YAxis)

front_element = ReferenceElement.from_dimensions(frame, length, height, bond_type)


vertex_keys = []
for vertex in front_element.vertices:
    key = cellnetwork.add_vertex(x=vertex[0], y=vertex[1], z=vertex[2])
    vertex_keys.append(key)

face_keys = []
for face in front_element.faces:
    face_vertex_keys = [vertex_keys[front_element.vertices.index(vertex)] for vertex in face]
    key = cellnetwork.add_face(face_vertex_keys)
    face_keys.append(key)

cellnetwork.add_cell(face_keys)


#
#cellnetwork = CellNetwork()
#
#for vertex in box.vertices:
#    key = cellnetwork.add_vertex(x=vertex[0], y=vertex[1], z=vertex[2])
#
#face_keys = []
#for face in box.faces:
#    key = cellnetwork.add_face(face)
#    face_keys.append(key)
#
#
#cellnetwork.add_cell(face_keys)
#
#
##print cellnetwork
#
## Convert CellNetwork to Mesh
#mesh = Mesh()
#
#for key, attr in cellnetwork.vertices(True):
#    mesh.add_vertex(key=key, attr_dict = attr)
#    
#for facekey, attr in cellnetwork.faces(True):
#    vertices = cellnetwork.face_vertices(facekey)
#    mesh.add_face(vertices, facekey = facekey, attr_dict=attr)
#
#M = MeshArtist(mesh).draw_edges()
#M1 = MeshArtist(mesh).draw_vertices()
#M2 = MeshArtist(mesh).draw_faces()
# ---------- end reference_element_4 ----------
crv = Curve(reference_element_2.M)
pt = Point(reference_element_2.M1)
connectivity = GhPythonScript()  # -> connectivity
# ---------- connectivity: Python ----------
connectivity = [[0,1], [1,2]]

#print reference_model.add_connection(0, 2)
#reference_model.add_connection(1, 3)
#reference_model.add_connection(2, 1)
#reference_model.add_connection(3, 0)
# ---------- end connectivity ----------

# ---- group: reference model
connectivity_2 = GhPythonScript()  # -> connectivity
# ---------- connectivity_2: Python ----------
connectivity = [[0,1], [1,2], [2,3], [3,0]]

#print reference_model.add_connection(0, 2)
#reference_model.add_connection(1, 3)
#reference_model.add_connection(2, 1)
#reference_model.add_connection(3, 0)
# ---------- end connectivity_2 ----------
reference_model = GhPythonScript(reference_elements=reference_element.front_element, connectivity=connectivity_2)  # -> out, reference_model; inputs reference_elements: list, connectivity: list
# ---------- reference_model: Python ----------
from climate_active_envelopes.assembly import ReferenceModel
from compas.datastructures import Network
from compas_ghpython.artists import NetworkArtist
#from compas_rhino.artists.networkartist import NetworkArtist

reference_model = ReferenceModel()
#print reference_model

for i, element in enumerate(reference_elements):
    reference_model.add_element(element)

print connectivity

for connection in connectivity:
    reference_model.add_connection(connection[0], connection[1])

#data = reference_model.network.to_data()
#network = Network.from_data(data)
#
#nodes, edges = NetworkArtist(network).draw()
# ---------- end reference_model ----------

# ----
key = Slider(3, range=0..3)
reference_model_2 = GhPythonScript(reference_elements=[reference_element_4, reference_element_3], connectivity=connectivity, key=key)  # -> out, reference_model; inputs reference_elements: list, connectivity: list
# ---------- reference_model_2: Python ----------
from climate_active_envelopes.assembly import ReferenceModel
from compas.datastructures import Network, CellNetwork
from compas_ghpython.artists import NetworkArtist
#from compas_rhino.artists.networkartist import NetworkArtist

reference_model = ReferenceModel()
print reference_model


for i, element in enumerate(reference_elements):
    reference_model.add_element_2(element)




#print connectivity
#
#for connection in connectivity:
#    reference_model.add_connection(connection[0], connection[1])

#data = reference_model.network.to_data()
#network = Network.from_data(data)
#print network
#
#nodes, edges = NetworkArtist(network).draw()
# ---------- end reference_model_2 ----------
length = Slider(4.53, range=4..10)
width_4 = Slider(3.93, range=2..7)
height = Slider(2.38, range=2..3)

reference_model_3 = GhPythonScript(length=length, width=width_4, height=height, key=Slider(3, range=0..3))  # -> ref_model, nodes, edges, current_node, current_nodes_neighbors, labels
# ---------- reference_model_3: Python ----------
from compas.datastructures import Mesh, Network
from compas_ghpython.artists import NetworkArtist
from compas_ghpython import draw_spheres
from climate_active_envelopes.assembly.reference_model import Reference_Model
from compas.colors import Color
from compas.artists import Artist, MeshArtist, artist

rm = Reference_Model()

ref_model =  rm.create_outer_wall_network(length, width, height)

# draw network nodes and network edges
nodes, edges = NetworkArtist(ref_model).draw()


# vizualize current node and its neighbors
current_node = {'pos': ref_model.node_coordinates(key), 'radius' : 0.03}
current_node = draw_spheres([current_node])
current_nodes_neighbors_keys = ref_model.neighbors(key)
current_nodes_neighbors = [{'pos': ref_model.node_coordinates(key), 'radius' : 0.02} for key in current_nodes_neighbors_keys]
current_nodes_neighbors = draw_spheres(current_nodes_neighbors)
labels = [key for key in ref_model.nodes()]


"""
corner_attributes = {}
for face in reference_unit.faces():
    vertices = reference_unit.face_vertices(face)

    sides_with_walls = []
    for i, vertex in enumerate(vertices):
        print vertex
        next_vertex = vertices[(i + 1) % len(vertices)]  # Get the next vertex in a cyclic manner
        if reference_unit.is_edge_on_boundary(vertex, next_vertex):
            sides_with_walls.append((vertex, next_vertex))

    for side_vertices in sides_with_walls:
        print side_vertices
        for vertex in side_vertices:
            corner_attributes[vertex] = {'adjoining_wall': True}
"""
# ---------- end reference_model_3 ----------
brep_2 = Brep(reference_model_3.current_node)
pt_2 = Point(reference_model_3.nodes)
line = Line(reference_model_3.edges)
brep_3 = Brep(reference_model_3.current_nodes_neighbors)
swatch = ColourSwatch(SwatchColor=RGB(0, 0, 0))
tag = TextTag(Location=reference_model_3.nodes, Text=reference_model_3.labels, Colour=swatch)
preview = CustomPreview(Geometry=line, Material=swatch)
preview_2 = CustomPreview(Geometry=brep_3, Material=ColourSwatch(SwatchColor=RGB(214, 62, 62)))
preview_3 = CustomPreview(Geometry=brep_2, Material=ColourSwatch(SwatchColor=RGB(255, 255, 255)))

draw_network = GhPythonScript(reference_model=reference_model_2.reference_model)  # -> out, nodes, edges, faces
# ---------- draw_network: Python ----------
from compas.datastructures import Network, CellNetwork, Mesh
from compas_ghpython.artists import NetworkArtist, MeshArtist



data = reference_model.cellnetwork.to_data()
#print data

cellnetwork = CellNetwork.from_data(data)
print cellnetwork



mesh = Mesh()

for key, attr in cellnetwork.vertices(True):
    mesh.add_vertex(key=key, attr_dict = attr)
    
for facekey, attr in cellnetwork.faces(True):
    vertices = cellnetwork.face_vertices(facekey)
    mesh.add_face(vertices, facekey = facekey, attr_dict=attr)

edges = MeshArtist(mesh).draw_edges()
nodes = MeshArtist(mesh).draw_vertices()
faces = MeshArtist(mesh).draw_faces()
# ---------- end draw_network ----------

# ---- group: reference model
draw_network_2 = GhPythonScript(reference_model=reference_model.reference_model)  # -> out, nodes, edges
# ---------- draw_network_2: Python ----------
from compas.datastructures import Network
#from compas_ghpython.artists import NetworkArtist
#from compas.artists import NetworkArtist
from compas_ghpython.artists import NetworkArtist

from compas import artists





data = reference_model.network.to_data()
network = Network.from_data(data)

print data


nodes, edges = NetworkArtist(network).draw()
# ---------- end draw_network_2 ----------
pt_3 = Point(draw_network_2.nodes)
line_2 = Line(draw_network_2.edges)

# ----
line_3 = Line(draw_network.edges)
pt_4 = Point(draw_network.nodes)

generate_outer_corner = Button()
add_inner_brickwall = Button()
generate_brick_wall = Button()
select_brick = Button()
create_self_shading = BooleanToggle(False)
insulated_brick = Brep(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)
generate_brick_assembly = GhPythonScript(
    reference_model=reference_model.reference_model,
    key=Slider(0, range=0..3),
    insulated_brick=insulated_brick,
    create_self_shading=create_self_shading,
    generate_outer_corner=generate_outer_corner,
    generate_brick_wall=generate_brick_wall,
    step_up=select_brick,
    add_inner_brickwall=add_inner_brickwall)  # -> out, brick_assembly; inputs insulated_brick: Mesh, color_values: list
# ---------- generate_brick_assembly: Python ----------
from scriptcontext import sticky as st
from compas_rhino.geometry import RhinoMesh
from climate_active_envelopes.assembly import ReferenceElement

reference_element = reference_model.element(key)

if generate_brick_wall:
    reference_element.generate_brick_assembly(insulated_brick_mesh = RhinoMesh.from_geometry(insulated_brick).to_compas(), 
                                                color_values = color_values, 
                                                create_self_shading=create_self_shading) #, add_outer_corner=add_outer_corner)

if generate_outer_corner:
    reference_element.generate_outer_corner(insulated_brick_mesh = RhinoMesh.from_geometry(insulated_brick).to_compas(), 
                                                color_values = color_values, 
                                                create_self_shading=create_self_shading)


brick_assembly = reference_element.brick_assembly



#
#L = list(brick_assembly.elements())
#
#guid = str(ghenv.Component.InstanceGuid)
#element_key = "elem_" + guid
#
#if step_up:
#    if st[element_key] <  len(L) - 1:
#        st[element_key] += 1
#
#
#    element = brick_assembly.element(counter)
#    print element
#    mesh = Artist(element.mesh).draw(Color.from_rgb255(41,49,51))
#    current_brick.append(mesh)
# ---------- end generate_brick_assembly ----------
